# Grasshopper definition ParcellationSmooth.gh (Grasshopper 1.0.7)
# plug-ins: Human

# Input Parcel Boundary
panel = Panel("11558472.259789195,153658.964415209,11558406.876011157,153764.98129272828,11558403.688764185,153913.09859014646,11558272.180322167,154136.6667178189,11558456.213226028,154446.1586527868,11558948.437403865,154247.75519996692,11558972.367530914,154230.03969479157,11559077.263673156,154109.22274570927,11559075.134850495,154065.7582452532,11559002.675137078,153960.2664760104,11558940.282920757,153887.27001702157,11558877.66048896,153830.8553194688,11558796.627194406,153779.59220252768,11558743.31856633,153758.0682138811,11558551.642433774,153699.77239697037,11558472.259789195,153658.964415209")
# Pre-assigned streamline method
# Access points
specificstreamlinetoggle = BooleanToggle(False)

min_area = Slider(50000, range=0..150000)
idealorientation = Slider(1, range=0..1)

# ---- group: parcellation model
# Streamline Selection para
continuity = Slider(3, range=0..4)
anglevar = Slider(1, range=0..4)
lengthvar = Slider(0, range=0..4)
access = Slider(4, range=0..4)
evenarea = Slider(4, range=0..4)
orientation = Slider(2, range=0..4)
sidenumber = Slider(3, range=0..4)
entwine = Entwine(
    Branch00=continuity,
    Branch01=sidenumber,
    Branch02=anglevar,
    Branch03=lengthvar,
    Branch04=access,
    Branch05=evenarea,
    Branch06=orientation,
    FlattenInputs=True)  # -> flatten(Result)

# ----
# minimum elongation constraint
min_elongation = Slider(3, range=0..50)

# ---- group: road length/angle-dominance : 0 for length, 1 for angle
# Optimization para ( set default first )
wa = Slider(0.6, range=0..1)

# ----
# First road toggle
firstroad = BooleanToggle(False)

# ---- group: Keep the vertices in the initial position
vanchorstrength = Slider(10, range=0..10000)

# ---- group: Keep the naked vertices on the boundary crv
voncrvstrength = Slider(0, range=0..10000)

# ---- group: Keep the between points in the initial position
panchorstrength = Slider(10, range=0..10000)

# ---- group: Make the continuous road smooth
roadsmoothstrength = Slider(1000, range=0..100000)

# ---- group: Make the road junction angle orthogonal
roadjunctionanglestrength = Slider(0, range=0..50000)

# ---- group: Make the parcel side smooth
parcelsidesmoothstrength = Slider(2000, range=0..10000)

# ---- group: Make the parcel angle orthogonal
parcelsideanglestrength = Slider(0, range=0..50000)

# ---- group: Make the parcel side length equal
parcelsidelengthstrength = Slider(0, range=0..10000)

# ---- group: Make the adjacency parcels smoothly arranged
parceladjacencystrength = Slider(100, range=0..10000)

# ----
# simplification choice
# 0: With resample points
# 1: Will be straight line
# Road category para
simplifychoice = Slider(0, range=0..1)
simplifychoice_2 = GetInteger(simplifychoice, AtLeast=1, AtMost=1, Maximum=2147483647, Minimum=-2147483648, TreeAccess=False)

# ----
# Modules
ghpython_script = GhPythonScript()  # -> out, EV_AccessPoint
# ---------- ghpython_script: Python ----------
###########################
####    Import Libs    ####
###########################
import Rhino.Geometry as rg
import Rhino.RhinoDoc as rd
import Rhino.RhinoMath as rm
import ghpythonlib.components as ghc


###########################
####    Description    ####
###########################
### EV_AccessPoint : Evaluation For AccessPoint
### The user will input a pair of access point.
### This library is to create the first split line generated with these access point inputs. Check the steps below.


class EV_AccessPoint:
     
    class Splitline:
        def __init__(self,geometry):
            self.geometry = geometry
            
            self.scoreEvenArea = None
            self.scoreElongation = None
            self.scoreCompactness = None
            self.scoreConvexity = None
            self.scoreOrientation = None
            
            self.scoreParcelLevel = None

            self.elongationPair = None
            self.areaPair = None
            self.convexityPair  = None
            self.compactnessPair = None
            self.orientationPair = None


    ###########################
    # Step1: Make sure the input polyline is CounterClockwise
    ###########################
    @staticmethod
    def EnsureCounterClockwise(inputPolyline):
        inputPolylineCurve = inputPolyline.ToPolylineCurve()
        if inputPolylineCurve.ClosedCurveOrientation().ToString() == "Clockwise":
            inputPolyline.Reverse()
            #print ("reverse it from Clockwise to CounterClockwise")
        else:
            #print ("its CounterClockwise originally")
            pass

    ###########################
    # Step2: Provide options
    # Option1: Try the "Streamline".         The pair of access point is located on EdgeA and EdgeB. See if its end points can locate on the same edges. 
    #                                        (Noted that sometimes even the end Point is far away from the access point, we still consider it is valid)
    # Option2: Try the "BezierCrv".          Populate some random points in a region. -> Keep the points inside the polyline -> Create BezierCrv option -> Evaluate the criteria values of the split parcel -> Choose the best one
    # Option3: Try the "StraightLne".        Simply connect the pair of access point to get a line.
    ########################### 


    ######
    ### Option1: "Streamline"
    ######

    ### Difference between these 2 functions : Simplfied version is used the combined edges based on similar angle. 
    @staticmethod 
    def CheckPositionIndex(inputPolyline,pt):
        tol = 0.001
        #### Method 1 : didnt simplify 
        numSegment = inputPolyline.SegmentCount
        for i in range(numSegment):
            thisSeg =  inputPolyline.SegmentAt(i)
            if thisSeg.DistanceTo(pt,True) < tol:
                position = i
        return position
    
    @staticmethod 
    def CheckPositionIndex_Simplified(newedges,pt):
        tol = 0.001
        
        ##### Method 2 :  simplified
        distances = []
        numedge= len(newedges)
        for i in range(numedge):
            thisEdge= newedges[i]
            closestPt_t = thisEdge.ClosestParameter (pt)
            closestPt = thisEdge.PointAt(closestPt_t)
            
            distances.append(closestPt.DistanceTo(pt))

        position = distances.index(min(distances))
        return position

    @staticmethod 
    def CheckStreamLineValidity (PC,inputPolyline,streamline,closestPoint_A,closestPoint_B):  
        newedges = PC.ProcessMesh.GetNewEdges(inputPolyline)
        nodePosition_0 = EV_AccessPoint.CheckPositionIndex_Simplified(newedges,closestPoint_A)
        nodePosition_1 = EV_AccessPoint.CheckPositionIndex_Simplified(newedges,closestPoint_B)
        streamline_StartPosition = EV_AccessPoint.CheckPositionIndex_Simplified(newedges,streamline.First)
        streamline_EndPosition = EV_AccessPoint.CheckPositionIndex_Simplified(newedges,streamline.Last)
        print ("nodePosition_0:",nodePosition_0,"nodePosition_1:",nodePosition_1,streamline_StartPosition,streamline_EndPosition)
        if (streamline_StartPosition == nodePosition_0 and streamline_EndPosition == nodePosition_1) or (streamline_StartPosition == nodePosition_1 and streamline_EndPosition == nodePosition_0):
            return "valid"
        else:
            return "invalid"
            
    ### For desicion making : If both streamlines are valid, choose the one closer to the input access point.
    @staticmethod
    def CompareStreamlineCloseToNode(streamlineA,streamlineB,closestPoint_A,closestPoint_B):
         
        distA =  streamlineA.Last.DistanceTo(closestPoint_A)
        distB =  streamlineB.Last.DistanceTo(closestPoint_B)
        
        if distA <= distB:
            return streamlineA
        else:
            return streamlineB
    
    @staticmethod
    def DecideFinalStreamline(streamlineA,validity_A,streamlineB,validity_B,strightLine,validity_Straight,closestPoint_A,closestPoint_B,preference,bestSl):
        finalDesicion = []

        if validity_A == "valid" and validity_B == "invalid":
            finalDesicion = streamlineA
            
        elif validity_A == "invalid" and validity_B == "valid":
            finalDesicion = streamlineB
            
        elif validity_A == "valid" and validity_B == "valid":
            
            finalDesicion = EV_AccessPoint.CompareStreamlineCloseToNode(streamlineA,streamlineB,closestPoint_A,closestPoint_B)
        
         
        elif validity_A == "invalid" and validity_B == "invalid":
            
            if preference == "straight":   
                if validity_Straight == "valid":
                    finalDesicion = strightLine
                elif validity_Straight == "invalid":
                    finalDesicion = bestSl
                    
            elif preference == "bcrv":
                 finalDesicion = bestSl
            
        return [finalDesicion]

    
    
    ######
    ### Option2: "BezierCrv"
    ######
    @staticmethod 
    def GetDetectRegion(line,moveDist):
        direction = rg.Vector3d(line.To - line.From)
        direction2 = rg.Vector3d(direction)

        wxy_Plane=rg.Plane.WorldXY
        ZAxis=wxy_Plane.ZAxis
        direction2.Rotate(rm.ToRadians(90),ZAxis)
        direction2.Unitize()

        
        pt1 = rg.Point3d.Add(line.From,direction2*moveDist)
        pt2 = rg.Point3d.Add(line.From,-direction2*moveDist)
        pt3 = rg.Point3d.Add(line.To,-direction2*moveDist)
        pt4 = rg.Point3d.Add(line.To,direction2*moveDist)
        detectRegion= rg.Polyline([pt1,pt2,pt3,pt4,pt1])

        newPlane = rg.Plane(rg.Point3d(0,0,0),direction2,direction)

        detectRegion = rg.Rectangle3d(newPlane,pt1,pt3)
        
        return detectRegion

    @staticmethod 
    def GetBezierCrvOptions(detectRegion,inputPolyline,closestPoint_A,closestPoint_B,populateNum):
        points = ghc.Populate2D(detectRegion,populateNum,1)
        #print points
        bCurveList = []
        bCurveList_Valid = []
        mtol = 0.001
        atol = 0.01745329

        ### bCrv 
        pt_a = closestPoint_A
        pt_b = closestPoint_B

        ### generate valid bCrvs
        for pt in points:
            ptList= [pt_a, pt,pt_b]
            streamline = rg.NurbsCurve.Create(False,2,ptList)
            bCurveList.append(streamline)

        inputPolylineCurve = inputPolyline.ToPolylineCurve()

        ### select valid bCrvs
        for bCurve in bCurveList:
            
            if rg.Intersect.Intersection.CurveCurve(bCurve,inputPolylineCurve,mtol,mtol).Count ==2 and int(inputPolylineCurve.Contains(bCurve.PointAt(bCurve.Domain.Mid))) == 1:
                bCurveList_Valid.append(bCurve)

        return bCurveList_Valid,points,bCurveList
        
    @staticmethod 
    def InitializeSplitlines(bCrvOptions,score_EvenArea,score_Elongation,score_Compactness,score_Convexity,score_Orientation,score_Overall,elongationPairCollection,areaPairCollection,convexityPairCollection,compactnessPairCollection,orientationPairCollection):
        sls = []
        for i in range(len(bCrvOptions)):
            sl = EV_AccessPoint.Splitline(bCrvOptions[i])
            
            if score_EvenArea!=None:
                sl.scoreEvenArea = score_EvenArea[i]
            if score_Elongation!=None:
                sl.scoreElongation = score_Elongation[i]
            if score_Compactness!=None:
                sl.scoreCompactness = score_Compactness[i]
            if score_Convexity!=None:
                sl.scoreConvexity = score_Convexity[i]
            if score_Orientation!=None:
                sl.scoreOrientation = score_Orientation[i]
            
            
            sl.scoreParcelLevel = score_Overall[i]

            sl.elongationPair = elongationPairCollection[i]
            sl.areaPair = areaPairCollection[i]
            sl.convexityPair  = convexityPairCollection[i]
            sl.compactnessPair = compactnessPairCollection[i]
            sl.orientationPair = orientationPairCollection[i]
            
            sls.append(sl)
        
        return sls

    @staticmethod 
    def SelectBestSplitline(sls):
        scores=[]
        for sl in sls:
        
            scores.append(sl.scoreParcelLevel)

        index = scores.index(max(scores))
        bestSl = sls[index].geometry
        
        return bestSl

    @staticmethod 
    def ConvertNurbcurveToPolyline(nCrv,divNum):
        ts = nCrv.DivideByCount(divNum,True)
        divPts = [] 
        for t in ts:
            divPts.append(nCrv.PointAt(t))
        
        polyL = rg.Polyline(divPts)
        
        return polyL
    

    ######
    ### Option3: "StraightLne"
    ######
    @staticmethod 
    def GetStrightLine(userInputPair,nodes):
        
        pt_a = nodes[userInputPair[0]].geometry
        pt_b = nodes[userInputPair[1]].geometry
        line = rg.Line(pt_a,pt_b)
        
        return line

    @staticmethod
    def CheckStrightLineValidity(line,inputPolyline):
        tol=0.001
        
        if rg.Intersect.Intersection.CurveLine(inputPolyline.ToPolylineCurve(),line,tol,tol).Count==2:
            return "valid"
        else:
            return "invalid"
# ---------- end ghpython_script ----------
ghpython_script_2 = GhPythonScript()  # -> out, WebApp_Func
# ---------- ghpython_script_2: Python ----------
###########################
####    Import Libs    ####
###########################
import Rhino.Geometry as rg
import Rhino.RhinoDoc as rd
import Rhino.RhinoMath as rm
import Rhino as rh


###########################
####    Description    ####
###########################
### WebApp_Func : Some help functions for the webapp
### This is a library contain some help functions for the webapp specifically


class WebApp_Func:
    #########################################################
    #############        Relocate        ####################
    #########################################################
    ### This is becuase the input coordinate is always far away from origin (0,0,0)
    ### functions to move it back to orgin and then place it back
    
    
    @staticmethod
    def RelocateGeo(geo,sourceCenter,tartgetCenter):
        xChange = sourceCenter.X - tartgetCenter.X
        yChange = sourceCenter.Y - tartgetCenter.Y
        zChange = sourceCenter.Z - tartgetCenter.Z

        ### polyline case
        if isinstance(geo, rg.Polyline):
            newPts = []
            for point in geo:
                newPts.append(rg.Point3d(point.X - xChange,point.Y - yChange ,point.Z - zChange))
                newPolyL = rg.Polyline(newPts)
                newGeo = newPolyL
        elif isinstance(geo, rg.Point3d):
            newPt = rg.Point3d(geo.X - xChange,geo.Y - yChange ,geo.Z - zChange)
            newGeo = newPt
        return newGeo

    @staticmethod
    def RelocateGeoToOrigin(geo,sourceCenter):
        tartgetCenter = rg.Point3d(0,0,0)
        
        if isinstance(geo, rg.Polyline):
            sourceCenter = rg.AreaMassProperties.Compute(geo.ToPolylineCurve()).Centroid
            newPolyL = WebApp_Func.RelocateGeo(geo,sourceCenter,tartgetCenter)
            newGeo = newPolyL
        
        elif isinstance(geo, rg.Point3d):
            
            
            newPt = WebApp_Func.RelocateGeo(geo,sourceCenter,tartgetCenter)
            newGeo = newPt
            
        return newGeo
        
    @staticmethod
    def RelocateGeoFromorigin(geo,tartgetCenter):
    
        sourceCenter = rg.Point3d(0,0,0)
    
        if isinstance(geo, rg.Polyline) or isinstance(geo, rg.PolylineCurve):
            newPolyL = WebApp_Func.RelocateGeo(geo,sourceCenter,tartgetCenter)
            newGeo = newPolyL
        elif isinstance(geo, rg.Point3d):
            newPt = WebApp_Func.RelocateGeo(geo,sourceCenter,tartgetCenter)
            newGeo = newPt
        return newGeo
    
    @staticmethod
    def RelocateGeo(geo,sourceCenter,tartgetCenter):
        xChange = sourceCenter.X - tartgetCenter.X
        yChange = sourceCenter.Y - tartgetCenter.Y
        zChange = sourceCenter.Z - tartgetCenter.Z
    
        ### polyline case
        if isinstance(geo, rg.Polyline):
            newPts = []
            for point in geo:
                newPts.append(rg.Point3d(point.X - xChange,point.Y - yChange ,point.Z - zChange))
                newPolyL = rg.Polyline(newPts)
                newGeo = newPolyL
                
        elif isinstance(geo, rg.PolylineCurve) or isinstance(geo, rg.LineCurve) or isinstance(geo, rg.PolyCurve) or isinstance(geo, rg.NurbsCurve):
            newGeo = geo
            movingVec = tartgetCenter- sourceCenter
            newGeo.Transform(rg.Transform.Translation(movingVec.X,movingVec.Y,movingVec.Z))
            
        elif isinstance(geo, rg.Point3d):
            newPt = rg.Point3d(geo.X - xChange,geo.Y - yChange ,geo.Z - zChange)
            newGeo = newPt
        return newGeo

    @staticmethod
    def MoveFromOriginAndScaleAllParcels(parcels,targetPoint,scale):
        newParcels = []
        for parcel in parcels:
            newParcels.append(WebApp_Func.MoveFromOriginAndScale(parcel,targetPoint,scale))
        return newParcels
    
    @staticmethod
    def MoveFromOriginAndScale(geo,targetPoint,scale):
        geo_New = WebApp_Func.RelocateGeoFromOrigin(geo,targetPoint)
        transform = rg.Transform.Scale(targetPoint,scale)
        geo_New.Transform(transform)
        return geo_New
    
    @staticmethod
    def RelocateGeoFromOrigin(geo,tartgetCenter):
        
        sourceCenter = rg.Point3d(0,0,0)

        if isinstance(geo, rg.Polyline) or isinstance(geo, rg.PolylineCurve) or isinstance(geo, rg.LineCurve) or isinstance(geo, rg.PolyCurve) or isinstance(geo, rg.NurbsCurve):
            newPolyL = WebApp_Func.RelocateGeo(geo,sourceCenter,tartgetCenter)
            newGeo = newPolyL
        elif isinstance(geo, rg.Point3d):
            newPt = WebApp_Func.RelocateGeo(geo,sourceCenter,tartgetCenter)
            newGeo = newPt
        elif isinstance(geo, rg.Line):
            newStart = WebApp_Func.RelocateGeo(geo.From,sourceCenter,tartgetCenter)
            newEnd = WebApp_Func.RelocateGeo(geo.To,sourceCenter,tartgetCenter)
            newGeo = rg.Line(newStart,newEnd)
        return newGeo
        

    #########################################################
    #############       Draco Mesh       ####################
    #########################################################
    ### This is to create draco mesh, noted that it's moved along Zaxis by default to avoid overlapping with the map
    @staticmethod     
    def DracoCompression_MoveZ(polyL,z=1):
        mesh= rg.Mesh.CreateFromClosedPolyline(polyL)
        movement = rg.Transform.Translation(0,0,z)
        mesh.Transform(movement)
        options =  rh.FileIO.DracoCompressionOptions()
        options.CompressionLevel = 5
        options.IncludeTextureCoordinates = False
        options.IncludeVertexColors = False

        compressed = rh.FileIO.DracoCompression.Compress(mesh, options)
        base64Draco = compressed.ToBase64String()
        return base64Draco
        
        
    #########################################################
    #############     OutPut to JS       ####################
    #########################################################
    ### Organize the data and output as something javascript can use 
    @staticmethod  
    def AssignWebTreeID(allNodes):
        count = 0
        for node in allNodes:
            node.webTreeID = count
            count+=1
    
    @staticmethod
    def StoreInfoIntoDict(allNodes,meshDracos):
        treeDict = {}

        for node in allNodes:
            key = node.webTreeID
            value = {}
            value["meshDraco"] = meshDracos[node.webTreeID]  #### currently its polyline 
            
            if node.parent != None:
                value["parent"] = node.parent.webTreeID  #### currently its polyline 
            else:
                value["parent"] = "None"
            
        
            childrenID = []
            if node.child_A!= None:
                childrenID.append(node.child_A.webTreeID)
            if node.child_B!= None:
                childrenID.append(node.child_B.webTreeID)
            if node.child_C!= None:
                childrenID.append(node.child_C.webTreeID)
                
            value["children"] = childrenID
            
            value["depth"] = node.depth
            treeDict[key] = value
        
        return treeDict
    
    @staticmethod
    def ExportToSperateDict(treeDict):
        IDList = []
        childrenList = []
        parentList = []
        depthList = []
        dracoList = []

        for key in treeDict.keys():
            IDList.append(key)
            childrenList.append(treeDict[key]["children"])
            parentList.append(treeDict[key]["parent"])
            depthList.append(treeDict[key]["depth"])
            dracoList.append(treeDict[key]["meshDraco"])
        
        return IDList,childrenList,parentList,depthList,dracoList
    
    @staticmethod
    ### Noted that this use "EV module" to have those geometry evaulation functions
    def GetEvaluationValueList(EV,polyLs):
        areaList = []
        orientationList = []
        elongationList = []
        compactnessList = []
        convexityList = []
        
        for polyL in polyLs:
            
            ###convert typ
            if isinstance(polyL,rg.PolylineCurve)!=True:
                polyLCrv = polyL.ToPolylineCurve()
            else:
                polyLCrv = polyL
                
            area = rg.AreaMassProperties.Compute(polyLCrv).Area
            orientation =  rm.ToDegrees(EV.EvaluateOrientation(polyLCrv)) #angle against X-axis
            elongation = EV.EvaluateElongation(polyLCrv)
            compactness = EV.EvaluateCompactness(polyLCrv)
            convexity = EV.EvaluateConvexity(polyLCrv)
            
            areaList.append(area)
            orientationList.append(orientation)
            elongationList.append(elongation)
            compactnessList.append(compactness)
            convexityList.append(convexity)

        return areaList,orientationList,elongationList,compactnessList,convexityList
# ---------- end ghpython_script_2 ----------
ghpython_script_3 = GhPythonScript()  # -> out, PC
# ---------- ghpython_script_3: Python ----------
###########################
####    Import Libs    ####
###########################
import Rhino.Geometry as rg
#import Rhino.RhinoDoc as rd
import Rhino.RhinoMath as rm

import ghpythonlib.components as ghc
import math

import clr
clr.AddReference("PlanktonGh.dll")             ### This is the half-edge mesh lib, developed for C# grasshopper environment
import PlanktonGh
clr.ImportExtensions(PlanktonGh.RhinoSupport)

# clr.AddReferenceToFile("Eigen.Wrapper.dll")        ### This is a wrapper contains some functions from C++ Eigen lib
# import Eigen.Wrapper
# from System.Collections.Generic import List        ### This is a List type that used for C# 

clr.AddReference("CGAL.Wrapper.dll")                 ### This is a wrapper contains some functions from C++ CGAL lib
import CGAL.Wrapper
from System.Collections.Generic import List



###########################
####    Description    ####
###########################
### PC : Pre-Compute
### This is a library to convert the input polyline into triangulation mesh -> apply the half-edge mesh -> store info


##########################
####    Processing    ####
##########################
class PC:
    class ProcessVertex:
        def __init__(self,vh,index): 
            self.vh = vh                                        ### Store the orginal type object from Plankton
            self.index = index                                  ### Store the index, Type: Int
            self.geometry = rg.Point3d(vh.X,vh.Y,vh.Z)          ### Store the geometry, Type: Point3d
            self.closestPoint = None                            ### Store the geometry, Type: Point3d
            self.crossField = None                              ### Store vectors, Type: list<Vector3d>
      
            self.is_OnEdge = None                               ### Store property, Type: bool
            self.is_MedialAxisVertex = None                     ### Store property, Type: bool

        def __del__(self):
            self.vh = None
            self.index = None
            self.crossField = None
            self.distanceEverySegment = None
            self.closestEdgeIndex = None
            self.is_OnEdge = None
            self.is_MedialAxisVertex = None
        
            self.is_OnEdge = None
            self.is_MedialAxisVertex = None
          
            
    class ProcessTriangle:
        def __init__(self,fh,index):  
            self.triangleFh = fh                                ### Store the orginal type object from Plankton   
            self.index = index                                  ### Store the index, Type: Int
            self.triangleVertices = None                        ### Store the vertices of this triangle, Type: list<ProcessVertex>
            self.triangleBoundary = None                        ### Store the this triangle polyline, Type: Polyline
            self.centroid = None                                ### Store the this centroid of this triangle polyline, Type: Point3d
            self.is_MedialAxis = None                           ### Store property, Type: bool
                 
        def __del__(self):
            self.triangleFh = None                   
            self.index = None 
            self.triangleVertices = None         
            self.triangleBoundary = None       
            self.centroid = None                       
            self.is_MedialAxis = None                      
 
            
    class ProcessMesh:
        def __init__(self):
            self.vertexList = None                              ### Store the vertex list, Type: list<ProcessVertex>
            self.triangleList = None                            ### Store the vertex list, Type: list<ProcessTriangle>
            self.triRemeshBoundary = None                       ### Store the this mesh naked boundary, Type: Polyline
            self.delaunayMesh = None                            ### Store the the remeshed result, Type: Mesh
            self.halfEdgeMesh = None                            ### Store the the half-edge mesh, Type: Plankton Mesh
            self.length = None                                  ### Store parameter that used for remeshing, Type: float
       

        def __del__(self):
            self.vertexList = None
            self.triangleList = None
            self.triRemeshBoundary = None
            self.delaunayMesh= None
            self.halfEdgeMesh=None
            self.length = None


        ###############
        # This is the main function to create the ProcessMesh with all the info     
        ###############
        def InitializeInput(self,input,length):
            
            ### Get the vertices, pop the last one
            inputVertices=[]
            for index in range(len(input)-1):
                inputVertices.append(input[index])

            newPtList = inputVertices
            newPtList = List[rg.Point3d](newPtList)

            ########################## 
            # CGAL_Remesh : start
            # Make sure the mesh has enough num of faces, but not to many. 200 - 400 faces is a good default setting.

            delaunayMesh = CGAL.Wrapper.GeometryProcessingMethods.CGAL_Remesh(newPtList,0.125,length,20) 
            facecount=delaunayMesh.Faces.Count
            whileCount = 0   # Just an insurance to avoid infinite loop
            
            while facecount<200:
                whileCount+=1
                length=length * 0.8
                whileCount+=1
                newPtList = List[rg.Point3d](inputVertices)
                delaunayMesh = CGAL.Wrapper.GeometryProcessingMethods.CGAL_Remesh(newPtList,0.125,length,20) 
                try:
                    facecount=delaunayMesh.Faces.Count

                except:
                    print ("CGAL_Remesh failed")
                    break

                #print ("Inside InitializeInput while loop, checking facecount:"),facecount

                if whileCount>10:
                    print ("I am going to break the while loop")
                    print ("currently the length is %f"%(length)), "facecount:",facecount
                    break
            
            while facecount>400:
                whileCount+=1

                length=length * 1.2
                whileCount+=1
                newPtList = List[rg.Point3d](inputVertices)
                delaunayMesh = CGAL.Wrapper.GeometryProcessingMethods.CGAL_Remesh(newPtList,0.125,length,20) 
                try:
                    facecount=delaunayMesh.Faces.Count

                except:
                    print ("CGAL_Remesh failed")
                    break

                #print ("Inside InitializeInput while loop, checking facecount:"),facecount
                
                if whileCount>10:
                    print ("I am going to break the while loop_larger")
                    print ("currently the length is %f"%(length)), "facecount:",facecount
                    break
                    
            # CGAL_Remesh : end 
            ##########################

            ### Apply the half-edge mesh
            halfEdgeMesh = delaunayMesh.ToPlanktonMesh()
            faceList_HEM=halfEdgeMesh.Faces
            edgeList_HEM=halfEdgeMesh.Halfedges
            vertexList_HEM=halfEdgeMesh.Vertices

            ### [FOR DEBUG or CHECK]
            #facecount=delaunayMesh.Faces.Count
            #print ("outside while loop, checking facecount" ),facecount
            
            ### Get the offset boundary, find the external one
            wxy_Plane=rg.Plane.WorldXY
            #tol = rd.ActiveDoc.ModelAbsoluteTolerance  
            tol = 0.001   
            triRemeshBoundary = input
            triRemeshBoundary_curve = input.ToPolylineCurve()
            offset1= triRemeshBoundary_curve.Offset(wxy_Plane,tol,tol,rg.CurveOffsetCornerStyle.Sharp)[0]
            offset2= triRemeshBoundary_curve.Offset(wxy_Plane,-tol,tol,rg.CurveOffsetCornerStyle.Sharp)[0]
            if offset1.GetLength() > offset2.GetLength() :
                offsetTriRemeshBoundary = offset1
            else:
                offsetTriRemeshBoundary = offset2
            

            ##################################
            ###store vertices in vertexList###
            ##################################
            processVertexList=[]
            for i in range(vertexList_HEM.Count):
                processVertex=PC.ProcessVertex(vertexList_HEM[i],i)
                processVertexList.append(processVertex)
            

            ###add the rest info
            for processVertex in processVertexList:
                
                self.GetClosestPointOnOffsetBoundary(processVertex,offsetTriRemeshBoundary)
                self.CreateCrossField(processVertex)
                self.CheckVertexOnEdge(processVertex,halfEdgeMesh)
  
            # self.RenewVerticesOnEdgeCrossfield_TangentMethod(processVertexList,halfEdgeMesh,input) ### Optional
  
            ##################################
            ###   store faces in faceList  ###
            ##################################
            
            ###store triFace in faceList
            processTriangleList=[]
            for i in range(faceList_HEM.Count):
                processTriangle=PC.ProcessTriangle(faceList_HEM[i],i)
                processTriangleList.append(processTriangle)
            
            ###add the rest info
            for i in range(faceList_HEM.Count):
                threeVerticesIndices = faceList_HEM.GetVertices(i)
                triangleVertices=[processVertexList[threeVerticesIndices[0]],processVertexList[threeVerticesIndices[1]],processVertexList[threeVerticesIndices[2]]]

                processTriangleList[i].triangleVertices=triangleVertices
            
                self.GetTriangle(processTriangleList[i])
                self.GetTriangleCentroid(processTriangleList[i])
                #self.CheckMedialAxisTriangle(processTriangleList[i])       ### Optional

            #####################################
            ###   store all in to ProcessMesh ###
            #####################################
            self.vertexList = processVertexList
            self.triangleList = processTriangleList
            self.triRemeshBoundary = triRemeshBoundary
            self.delaunayMesh= delaunayMesh
            self.halfEdgeMesh= halfEdgeMesh
            self.length = length
  
  
        ###############
        # These are the functions to join the edges, reducing the num of edges  
        ############### 
        
        def MakeCounterClockwiseDirection(self,inputPolyline):
            inputPolyline_copy = rg.Polyline(inputPolyline)
            inputPolylineCurve = inputPolyline_copy.ToPolylineCurve()
            if inputPolylineCurve.ClosedCurveOrientation().ToString() == "Clockwise":
                inputPolyline_copy.Reverse()
        
            else:
                pass
            
            return inputPolyline_copy
            
        def GetEdgeIndices(self,input):
            crv = self.MakeCounterClockwiseDirection(input)
            count=0
        
            ### get vertices
            vertices=[]
            for index in range(len(crv)-1):
                vertices.append(crv[index])
                
            edgeIndices=[]
            edgeSegments=[]
            
            for i in range(len(vertices)):
                if i==0:
                    vector1=rg.Vector3d(vertices[len(vertices)-1]-vertices[0])
                    vector2=rg.Vector3d(vertices[1]-vertices[0])    
                    edgeSegments.append(rg.Line(vertices[0],vertices[1]))     
                    
                elif i==len(vertices)-1:
                    vector1=rg.Vector3d(vertices[i-1]-vertices[len(vertices)-1])
                    vector2=rg.Vector3d(vertices[0]-vertices[len(vertices)-1])
                    edgeSegments.append(rg.Line(vertices[len(vertices)-1],vertices[0])) 
        
                else: 
                    vector1=rg.Vector3d(vertices[i-1]-vertices[i])
                    vector2=rg.Vector3d(vertices[i+1]-vertices[i])
                    edgeSegments.append(rg.Line(vertices[i],vertices[i+1])) 
                    
                angle = rm.ToDegrees(rg.Vector3d.VectorAngle(vector1,vector2))
                
                if rg.Vector3d.CrossProduct(vector1,vector2).Z>0:
                    angle=360-angle
                

                if angle<135 or angle>225:
                    count+=1
                
                edgeIndices.append(count)
                
            
            #[original,new]
            if edgeIndices[0]==1:
                for i in range(len(edgeIndices)):
                    edgeIndices[i]=edgeIndices[i]-1
            
            #check the seam position
            vector1=rg.Vector3d(vertices[len(vertices)-1]-vertices[0])
            vector2=rg.Vector3d(vertices[1]-vertices[0])
            
            angle = rm.ToDegrees(rg.Vector3d.VectorAngle(vector1,vector2))
            
            if rg.Vector3d.CrossProduct(vector1,vector2).Z>0:
                angle=360-angle
            
            lastIndex = edgeIndices[len(edgeIndices)-1]
            if angle>135 and angle<225 :
                for i in range(len(edgeIndices)):
                    if edgeIndices[i] ==lastIndex:
                        edgeIndices[i] =0
        
            return [edgeIndices,edgeSegments]
        
        def GetCombindedEgdeIndices(self,boundary):
            edgeIndices,edgeSegments = self.GetEdgeIndices(boundary)
            output_list = [[i for i, x in enumerate(edgeIndices) if x == unique_val]
                           for unique_val in set(edgeIndices)]
            
            return output_list
        
        @staticmethod
        def GetJoinedEdge(input,newIndex,edgeIndices):
            segments_curve = []
            segments_originalIndex = []
            for i in range(len(edgeIndices)):
                if edgeIndices[i] == newIndex:
                    segments_curve.append(input.SegmentAt(i))
                    segments_originalIndex.append(i)
            pts_curve = []
            
            maxIndex = len(edgeIndices)-1
            minIndex = 0
            
            if maxIndex in segments_originalIndex and minIndex in segments_originalIndex:
                # special case
                # sort the indices
                newOrder_Indices = []
                newOrder_Segments = []

                
                distToMax = []
                distToMin = []

                # caculate the distance
                for index in segments_originalIndex:
                    distToMax.append(abs(index-maxIndex))
                    distToMin.append(abs(index-minIndex))

                # store the First part
                for i in range(len(segments_originalIndex)):
                    if distToMax[i] < distToMin[i]:
                        newOrder_Indices.append(segments_originalIndex[i])

                # store the Second part
                for i in range(len(segments_originalIndex)):
                    if distToMin[i] < distToMax[i]:
                        newOrder_Indices.append(segments_originalIndex[i])
                
                # store the geometry
                for i in newOrder_Indices:
                    newOrder_Segments.append(input.SegmentAt(i))
        
                
                for seg in newOrder_Segments:
                    pts_curve.append(seg.From)
                pts_curve.append(newOrder_Segments[-1].To)
                
                curve = rg.Polyline(pts_curve)
                
                return curve
            else:
                for seg in segments_curve:
                    pts_curve.append(seg.From)
                    
                pts_curve.append(segments_curve[-1].To)
                
                curve = rg.Polyline(pts_curve)
                
                return curve
            
        @staticmethod
        def GetNewEdges(input):
            edgeIndices,edges= PC.ProcessMesh().GetEdgeIndices(input)
            newEdges = []
            numEdge = max(edgeIndices) + 1
            
            for index in range(numEdge):
                newEdges.append(PC.ProcessMesh.GetJoinedEdge(input,index,edgeIndices))
            
            return newEdges
            
            
        ###############
        # These are the functions to fill up the info needed for compute streamline later 
        ############### 
        
        # This is the function to get the naked vertex indices in half edge mesh, collecting them IN ORDER   
        def GetBoundaryVertexIndices(self,HEM,curve):
            
            boundaryVIndices=[]
            
            for i in range(HEM.Vertices.Count):
                if HEM.Vertices.IsBoundary(i)==True:
                    startIndex = i
                    break
            try:
                boundaryVIndices.append(startIndex)
            except:
                
                print ("no Vertices.IsBoundary?"), [HEM.Vertices.IsBoundary(i) for i in range(HEM.Vertices.Count)]
                print ("no Vertices.IsBoundary?"),  True in [HEM.Vertices.IsBoundary(i) for i in range(HEM.Vertices.Count)]
                print ("sth wrong in GetBoundaryVertexIndices")
                for i in range(HEM.Vertices.Count):
                    print (HEM.Vertices.IsBoundary(i))
                    print (HEM.Vertices[i].ToXYZ().X),",",(HEM.Vertices[i].ToXYZ().Y),",",(HEM.Vertices[i].ToXYZ().Z)
                
                print ("curve to be mesh")
                for pt in curve:
                    print (pt.X),",",(pt.Y),",",(pt.Z)
            set = HEM.Vertices.GetVertexNeighbours(startIndex)
            
            whileCount = 0
            while (len(boundaryVIndices)==1 or boundaryVIndices[len(boundaryVIndices)-1]!=boundaryVIndices[0]):
                whileCount+=1
                if whileCount>10000:
                    break
                curri=boundaryVIndices[len(boundaryVIndices)-1]
                set = HEM.Vertices.GetVertexNeighbours(curri)
                for index in set:
                    if HEM.Vertices.IsBoundary(index)==True:
                        boundaryVIndices.append(index)
                        break
            
            boundaryVIndices.pop()
            return boundaryVIndices
        

        
        # Offset a 2D polyline           
        def NormalizeVec(self,x,y):
            distance = math.sqrt(x*x+y*y)
            return x/distance, y/distance
        
        def MakeOffsetPoly(self,inputVertices,offset,outer_ccw = 1):
            oldX =[]
            oldY =[]
            num_points = len(inputVertices)
            
            for i in range(num_points):
                oldX.append(inputVertices[i].X)
                oldY.append(inputVertices[i].Y)
                
            newX=[]
            newY=[]
            
            for curr in range(num_points):
                prev = (curr + num_points - 1) % num_points
                next = (curr + 1) % num_points
            
                vnX =  oldX[next] - oldX[curr]
                vnY =  oldY[next] - oldY[curr]
                vnnX, vnnY = self.NormalizeVec(vnX,vnY)
                nnnX = vnnY
                nnnY = -vnnX
            
                vpX =  oldX[curr] - oldX[prev]
                vpY =  oldY[curr] - oldY[prev]
                vpnX, vpnY = self.NormalizeVec(vpX,vpY)
                npnX = vpnY * outer_ccw
                npnY = -vpnX * outer_ccw
            
                bisX = (nnnX + npnX) * outer_ccw
                bisY = (nnnY + npnY) * outer_ccw
            
                bisnX, bisnY = self.NormalizeVec(bisX,  bisY)
                bislen = offset /  math.sqrt((1 + nnnX*npnX + nnnY*npnY)/2)
            
                newX.append(oldX[curr] + bislen * bisnX)
                newY.append(oldY[curr] + bislen * bisnY)
            
            outputVertices=[]
            for i in range(num_points):
                outputVertices.append(rg.Point3d(newX[i],newY[i],0))
            
            
            return outputVertices
            
                
        # Related with the cross field (4-vector field) , 3 methods to update the crossfield on the edge vertices, they have minor difference.(Not very important)
        def GetClosestPointOnOffsetBoundary (self,processVertex,offsettriRemeshBoundary):
            vertex = processVertex.geometry
            
            t=offsettriRemeshBoundary.ClosestPoint(vertex)[1]
            closestPoint=offsettriRemeshBoundary.PointAt(t)
            processVertex.closestPoint = closestPoint
            
        def CreateCrossField(self,processVertex):
            wxy_Plane=rg.Plane.WorldXY
            ZAxis=wxy_Plane.ZAxis
            
           
            vector_A = rg.Vector3d(processVertex.closestPoint - processVertex.geometry)
            vector_A.Unitize()
            vector_B = rg.Vector3d(vector_A)
            vector_C = rg.Vector3d(vector_A)
            vector_D = rg.Vector3d(vector_A)

            vector_B.Rotate(rm.ToRadians(90),ZAxis)
            vector_C.Rotate(rm.ToRadians(180),ZAxis)
            vector_D.Rotate(rm.ToRadians(270),ZAxis)
     
            processVertex.crossField = [vector_A,vector_B,vector_C,vector_D]
            
        def RenewVerticesOnEdgeCrossfield(self,processVertexList,HEM,crv):
            boundaryVIndices=self.GetBoundaryVertexIndices(HEM,crv)
            OnEdgeVertices=[]
            OnEdgeVertices_Geo=[]
            for index in boundaryVIndices:
                OnEdgeVertices.append(processVertexList[index])
                OnEdgeVertices_Geo.append(processVertexList[index].geometry)
        
            #tol = rd.ActiveDoc.ModelAbsoluteTolerance
            tol = 0.001
            newPointList_1 = self.MakeOffsetPoly(OnEdgeVertices_Geo,tol)
            newPointList_2 = self.MakeOffsetPoly(OnEdgeVertices_Geo,-tol)
            
            polyline_1 = rg.Polyline(newPointList_1)
            polyline_2 = rg.Polyline(newPointList_2)
            
            if polyline_1.Length > polyline_2.Length :
                newPointList = newPointList_1
            else:
                newPointList = newPointList_2
        
            for i in range(len(OnEdgeVertices)):
                OnEdgeVertices[i].closestPoint=newPointList[i]
                self.CreateCrossField(OnEdgeVertices[i])
            
        def RenewVerticesOnEdgeCrossfield_TangentMethod(self,processVertexList,HEM,crv):
            boundaryVIndices=self.GetBoundaryVertexIndices(HEM,crv)
            OnEdgeVertices=[]
            OnEdgeVertices_Geo=[]
            for index in boundaryVIndices:
                OnEdgeVertices.append(processVertexList[index])
                OnEdgeVertices_Geo.append(processVertexList[index].geometry)
        
            #tol = rd.ActiveDoc.ModelAbsoluteTolerance
            tol = 0.001
            wxy_Plane=rg.Plane.WorldXY
            ZAxis=wxy_Plane.ZAxis
            for i in range(len(OnEdgeVertices_Geo)):
                if i!= 0 and i!= len(OnEdgeVertices_Geo)-1:
                    vec1 = rg.Vector3d(OnEdgeVertices_Geo[i+1]-OnEdgeVertices_Geo[i])

                elif i==0:
                    vec1 = rg.Vector3d(OnEdgeVertices_Geo[i+1]-OnEdgeVertices_Geo[i])

                elif i==len(OnEdgeVertices_Geo)-1:
                    vec1 = rg.Vector3d(OnEdgeVertices_Geo[0] - OnEdgeVertices_Geo[i])

                
                vec0 = rg.Vector3d(vec1)
                vec2 = rg.Vector3d(vec1)
                vec3 = rg.Vector3d(vec1)
                
                vec0.Unitize()
                vec1.Unitize()
                vec2.Unitize()
                vec3.Unitize()
                
                vec1.Rotate(rm.ToRadians(-90),ZAxis)
                vec2.Rotate(rm.ToRadians(90),ZAxis)
                vec3.Rotate(rm.ToRadians(180),ZAxis)
                
                newCrossfield = [vec0,vec1,vec2,vec3]
                
                OnEdgeVertices[i].crossField = newCrossfield
            
        def RenewVerticesOnEdgeCrossfield_TangentMethod_2(self,processVertexList,HEM,crv):
            boundaryVIndices=self.GetBoundaryVertexIndices(HEM,crv)
            OnEdgeVertices=[]
            OnEdgeVertices_Geo=[]
            for index in boundaryVIndices:
                OnEdgeVertices.append(processVertexList[index])
                OnEdgeVertices_Geo.append(processVertexList[index].geometry)
        
            #tol = rd.ActiveDoc.ModelAbsoluteTolerance
            tol = 0.001
            wxy_Plane=rg.Plane.WorldXY
            ZAxis=wxy_Plane.ZAxis
            for i in range(len(OnEdgeVertices_Geo)):
                if i!= 0 and i!= len(OnEdgeVertices_Geo)-1:
                    vec1 = rg.Vector3d(OnEdgeVertices_Geo[i+1]-OnEdgeVertices_Geo[i])
                    vec3 = rg.Vector3d(OnEdgeVertices_Geo[i-1]-OnEdgeVertices_Geo[i])
                elif i==0:
                    vec1 = rg.Vector3d(OnEdgeVertices_Geo[i+1]-OnEdgeVertices_Geo[i])
                    vec3 = rg.Vector3d(OnEdgeVertices_Geo[len(OnEdgeVertices_Geo)-1]-OnEdgeVertices_Geo[i])
                elif i==len(OnEdgeVertices_Geo)-1:
                    vec1 = rg.Vector3d(OnEdgeVertices_Geo[0] - OnEdgeVertices_Geo[i])
                    vec3 = rg.Vector3d(OnEdgeVertices_Geo[i-1] - OnEdgeVertices_Geo[i])
                
               
                vec1.Unitize()
                vec3.Unitize()
                vec0 = (vec1+vec3)
                vec2 = -(vec1+vec3)
                vec0.Unitize()
                vec1.Unitize()
                vec2.Unitize()
                vec3.Unitize()
                newCrossfield = [vec0,vec1,vec2,vec3]
                
                OnEdgeVertices[i].crossField = newCrossfield


        # Store the other info
        def GetTriangle(self,processTriangle):
            threeVertices = processTriangle.triangleVertices
            processTriangle.triangleBoundary =  rg.Polyline([threeVertices[0].geometry,threeVertices[1].geometry,threeVertices[2].geometry,threeVertices[0].geometry])
        
        def GetTriangleCentroid(self,processTriangle):
            processTriangle.centroid = processTriangle.triangleBoundary.CenterPoint()
        
        def CheckVertexOnEdge(self,processVertex,HEM):
            if HEM.Vertices.IsBoundary(processVertex.index)==True:
                processVertex.is_OnEdge = 1
            else:
                processVertex.is_OnEdge = 0
                
        def CheckMedialAxisVertex(self,processTriangle):
            
            if processTriangle.is_MedialAxis  == 1:
                processTriangle.triangleVertices[0].is_MedialAxisVertex = 1
                processTriangle.triangleVertices[1].is_MedialAxisVertex = 1
                processTriangle.triangleVertices[2].is_MedialAxisVertex = 1
                
        def CheckMedialAxisTriangle(self,processTriangle):
        
            a=processTriangle.triangleVertices[0]
            b=processTriangle.triangleVertices[1]
            c=processTriangle.triangleVertices[2]
            
            if a.closestEdgeIndex!=b.closestEdgeIndex or a.closestEdgeIndex!=c.closestEdgeIndex or b.closestEdgeIndex!=c.closestEdgeIndex:
                processTriangle.is_MedialAxis = 1
         
                
            else:
                processTriangle.is_MedialAxis = 0
# ---------- end ghpython_script_3 ----------
ghpython_script_4 = GhPythonScript()  # -> out, DM
# ---------- ghpython_script_4: Python ----------
###########################
####    Import Libs    ####
###########################
import Rhino.Geometry as rg
import Rhino.RhinoDoc as rd
import Rhino.RhinoMath as rm
import ghpythonlib.components as ghc


###########################
####    Description    ####
###########################
### DM : Data Mapping
### This is a library to speed up the searching in triangulation mesh by overlapping a pixel grid on it.
### The indices of the triangle mesh will be recorded inside the pixels.


###########################
####    Data Mapping   ####
###########################
class DM:
    class MappingPixel:
        def __init__(self,pixel,rowIndex,columnIndex):
            self.pixel = pixel                                                     ### Pixel's geometry, Type: Polyline       
            self.centroid = rg.AreaMassProperties.Compute(self.pixel).Centroid     ### Pixel's Centroid geometry, Type: Point3d
            self.position = rg.Point3d(rowIndex,columnIndex,0)                     ### Pixel's rowIndex and columnIndex in the MappingGrid, Type: Point3d 
            self.documentedTriangle = []                                           ### Store the indices of triangle, Type: List<int> 
        
        def __del__(self):
            self.pixel = None
            self.centroid = None
            self.position = None
            self.documentedTriangle = None
            
            
    class MappingGrid:
        def __init__(self):
            self.grid = None                     
            self.rows = None                     
            self.columns = None
            self.origin = None
            self.e = None
        
        def __del__(self):
            for i in range(self.rows):
                self.grid[i] = None
            self.grid = None
            self.columns = None
            self.rows = None
            self.origin = None
            self.e = None
            #rh.RhinoApp.WriteLine("Kill a MappingGrid ")
  
        ###################################################
        # These are the functions to create the grid, noted that "density" and "extendNum" are default values
        # "density" control to control the size of pixel
        # "extendNum" is to enlarge the Mapping grid to make sure it can cover the whole input mesh
        ###################################################
        def GetSqaure(self,halfSize,Xcord,Ycord):
            
            pt1=rg.Point3d(Xcord - halfSize , Ycord - halfSize ,0)
            pt2=rg.Point3d(Xcord - halfSize , Ycord + halfSize ,0)
            pt3=rg.Point3d(Xcord + halfSize , Ycord + halfSize ,0)
            pt4=rg.Point3d(Xcord + halfSize , Ycord - halfSize ,0)
            
            #remember to add the last point
            return rg.Polyline([pt1,pt2,pt3,pt4,pt1]).ToPolylineCurve()
        
        def CreateMappingGrid(self,input,density=100,extendNum=5):
            # Get BoundingBox
            obb = input.BoundingBox
            
            # Get the edge length
            dist1 = obb.Max.X - obb.Min.X
            dist2 = obb.Max.Y - obb.Min.Y
            
            e1 = dist1/density
            e2 = dist2/density
            
            if e1<=e2:
                
                num1 = int(dist1/e1)
                num2 = int(int(dist2/e1)+1)
            
            else:
                num1 = int(int(dist1/e2)+1)
                num2 = int(dist2/e2)
                
            eMin = min([e1,e2])
            
            e=eMin
            
            ## Set the origin
            originX = obb.Min.X - extendNum*e
            originY = obb.Min.Y - extendNum*e
            
           
            ###########
            #so far all the info is prepared
            #originX,originY,e,num1,num2
        
        
            # Create a store
            gridlist=[]
            
            for i in range(num1+extendNum*2):
               gridlist.append([])
        
            for rowIndex in range(num1+extendNum*2):
                for columnIndex in range(num2+extendNum*2):
                    mappingPixel = DM.MappingPixel(self.GetSqaure(e*0.5,rowIndex*e+originX,columnIndex*e+originY),rowIndex,columnIndex )
                    gridlist[rowIndex].append(mappingPixel)
                    
            self.grid = gridlist
            
            self.rows = num1+extendNum*2
            self.columns = num2+extendNum*2
            self.origin = rg.Point3d(originX,originY,0)
            
            self.e = e

        ###################################################
        # Compuate and store the indices of triangle into the pixel
        # Noted that it will remap the position
        ###################################################
        def GetTriangleDetectRegion(self,triangle,time=2):
            e = self.e

            Xs = [triangle[0].X,triangle[1].X,triangle[2].X]
            Ys = [triangle[0].Y,triangle[1].Y,triangle[2].Y]
            
            maxPt = rg.Point3d(max(Xs),max(Ys),0)
            minPt = rg.Point3d(min(Xs),min(Ys),0)

            minPt_New = rg.Point3d(minPt.X-time*e,minPt.Y-time*e,0)
            maxPt_New = rg.Point3d(maxPt.X+time*e,maxPt.Y+time*e,0)

            startRowIndex,startColumnIndex = self.RemapPosition(minPt_New)
            endRowIndex,endColumnIndex = self.RemapPosition(maxPt_New)
   
            detectRegion = []
            for i in range(startRowIndex,endRowIndex,1):
                for j in range(startColumnIndex,endColumnIndex,1):
                    
                    detectRegion.append(self.grid[i][j])
            
            return detectRegion

        def GetOverlappedTriangleIndex(self,processMesh,detectRadius=2):
            tol = 0.001
            triangleList=processMesh.triangleList

            for faceIndex in range(len(triangleList)):
                
                triangle=triangleList[faceIndex].triangleBoundary
                detectRegion=self.GetTriangleDetectRegion(triangle,detectRadius)
                for detectPixel in detectRegion:
                    
                    ### these conditions are neccessary to make sure the triangle can be recored no mater it is too small(inside the pixel)/ too large(outside the pixel), and of course, intersected with the pixel
                    if rg.Intersect.Intersection.CurveCurve(detectPixel.pixel, triangle.ToPolylineCurve(),tol,tol).Count!=0 or int(triangle.ToPolylineCurve().Contains(detectPixel.centroid))==1 or int(detectPixel.pixel.Contains(triangleList[faceIndex].centroid)==1):

                        pixelPosition=detectPixel.position
                        pixelLocation=(int(pixelPosition.X),int(pixelPosition.Y))
                        self.grid[pixelLocation[0]][pixelLocation[1]].documentedTriangle.append(faceIndex)
                                 
        def RemapPosition(self,pt):
            originX = self.origin.X
            originY = self.origin.Y
            e = self.e
            
            remapX = int(round((pt.X-originX)/e))
            remapY = int(round((pt.Y-originY)/e))
            
            return (remapX,remapY)
# ---------- end ghpython_script_4 ----------
ghpython_script_5 = GhPythonScript()  # -> out, SLG
# ---------- ghpython_script_5: Python ----------
###########################
####    Import Libs    ####
###########################
import Rhino.Geometry as rg
import Rhino.RhinoDoc as rd
import Rhino.RhinoMath as rm

import random

###########################
####    Description    ####
###########################
### SLG : Streamline generation
### This is a library to generate a streamline, it is based on the vertex field in a triangulation mesh
### The key concept it is to using barycentric to calculate the streamline growth direction 

class SLG:
    #########################
    ########streamline#######
    #########################
    class StreamlineVertex:
        def __init__(self,vertex):
            self.geometry = vertex                # Type: Point3d   It is the start or end
            
        def __del__(self):
            self.vertex = None
            
    class StreamlinePoint:
        def __init__(self,point):
            self.geometry = point                 # Type: Point3d   It is the start or end  
            
        def __del__(self):
            self.point = None
            
    class Streamline:
        def __init__(self):
            self.startVertex = None              # Type: StreamlineVertex   It is the start 
            self.endVertex = None                # Type: StreamlineVertex   It is the end    
            self.betweenPoints = []              # Type: list<StreamlinePoint>   It is the start 
            
            self.evenAreaValue = None            # Type: float   It is the score of even area  (wait for delete) 
            
            self.elongationPair = None           # Type: list<float>  [a,b]       Store the area of the pair of split polygon
            self.areaPair = None                 # Type: list<float>  [a,b]       Store the elongation of the pair of split polygon   
            self.convexityPair = None            # Type: list<float>  [a,b]       Store the convexity of the pair of split polygon   
            self.compactnessPair = None          # Type: list<float>  [a,b]       Store the compactness of the pair of split polygon   
            self.orientationPair = None          # Type: list<float>  [a,b]       Store the orientation of the pair of split polygon   
            
            self.scoreEvenArea = None            # Type: float   It is the score of even area    
            self.scoreElongation = None          # Type: float   It is the score of elongation
            self.scoreCompactness = None         # Type: float   It is the score of compactness
            self.scoreConvexity = None           # Type: float   It is the score of convexity
            self.scoreOrientation = None         # Type: float   It is the score of orientation   
            self.scoreOverall = None             # Type: float   It is the score of weighted overall score
            
        def __del__(self):
            self.startVertex = None              
            self.endVertex = None                
            self.betweenPoints = None               
            
            self.evenAreaValue = None            
            
            self.elongationPair = None           
            self.areaPair = None                   
            self.convexityPair = None             
            self.compactnessPair = None             
            self.orientationPair = None           
            
            self.scoreEvenArea = None               
            self.scoreElongation = None          
            self.scoreCompactness = None         
            self.scoreConvexity = None           
            self.scoreOrientation = None           
            self.scoreOverall = None             
        
        # Get the geometry    
        def GetGeometry(self):
            allPoints=[]
            allPoints.append(self.startVertex.geometry)
            for point in self.betweenPoints:
                allPoints.append(point.geometry)
            allPoints.append(self.endVertex.geometry)
            
            return rg.Polyline(allPoints)
        
        # Initialization 
        def CreateStreamlineInstance(self,streamline):
            streamlinePoints = [] 
            
            for i in range(len(streamline)):
                streamlinePoints.append(streamline[i])

            for i in range(len(streamlinePoints)):
                if i==0:
                    self.startVertex = SLG.StreamlineVertex(streamlinePoints[i])
                elif i == len(streamlinePoints)-1:
                    self.endVertex = SLG.StreamlineVertex(streamlinePoints[i])
                else:
                    self.betweenPoints.append(SLG.StreamlinePoint(streamlinePoints[i]))

        # Reverse 
        def Reverse(self):
            temp=self.startVertex
            self.startVertex=self.endVertex
            self.endVertex=temp
            self.betweenPoints.reverse()

    class StreamlineNetwork:
        def __init__(self):
            self.network = []           # Type: list<Streamline>     Store stremline instances  
            
        def __del__(self):
            self.network = None        
        
        #########
        # Seed point related functions, to control the seed point's activity status
        #########
        
        # This is a function to collect which "seed points" should be disable (within the detect distance) 
        def DetectVertices(self,pointList,seedpointList,streamline,detectDistance):
            spL = seedpointList.list
            detectedVertices=[]
            if len(pointList)>1:
                for seedpoint in spL:

                    pt=streamline.ClosestPoint (seedpoint.vh.geometry)
                    distance=seedpoint.vh.geometry.DistanceTo(pt)
                    if distance<=detectDistance:
                        detectedVertices.append(seedpoint)
            
            return detectedVertices

        # This is a function to update the activity status
        def UpdateActivityStatus(self,processMesh,seedpointList,streamline,thisSeedpoint,tag):
            
            streamlineClosestPt=streamline.ClosestPoint(thisSeedpoint.vh.geometry)
            thisVector=rg.Vector3d(streamlineClosestPt-thisSeedpoint.vh.geometry)
            
            
            if thisSeedpoint.vh.crossField[0]!=None and thisVector.Length!=0:
                
                angle1=rm.ToDegrees(rg.Vector3d.VectorAngle(thisVector,thisSeedpoint.vh.crossField[0]))
                angle2=rm.ToDegrees(rg.Vector3d.VectorAngle(thisVector,thisSeedpoint.vh.crossField[1]))
                angle3=rm.ToDegrees(rg.Vector3d.VectorAngle(thisVector,thisSeedpoint.vh.crossField[2]))
                angle4=rm.ToDegrees(rg.Vector3d.VectorAngle(thisVector,thisSeedpoint.vh.crossField[3]))
                
                anglelist=[angle1,angle2,angle3,angle4]
                minAngleIndex=anglelist.index(min(anglelist))
        
                if minAngleIndex == 0 or minAngleIndex == 2:             # This is the index of 4-vector field
                    thisSeedpoint.secondActivityStatus= False

                elif minAngleIndex == 1 or minAngleIndex == 3:           # This is the index of 4-vector field
                    thisSeedpoint.firstActivityStatus= False
            
            # If it is the startPoint
            elif thisSeedpoint.vh.crossField[0]==None or thisVector.Length==0:
                if tag == "first":
                    thisSeedpoint.firstActivityStatus=False
                    
                elif tag == "second":
                    thisSeedpoint.secondActivityStatus=False

        def UpdateSeedPointList(self,seedpointList,detectedVertices):
            spL = seedpointList.list
            for detectedVertex in detectedVertices:
                
                if detectedVertex.firstActivityStatus == False and  detectedVertex.secondActivityStatus == False :
                    detectedVertex.validity = False
                    if detectedVertex in spL:
                        spL.remove(detectedVertex)
        
        #########
        # Compute process
        #########      
        
        # Get the barycentric coefficient      
        def GetBarycentricCoefficient(self,threeVertices,ptX):
            #get the vertices of triangle
            pointA=threeVertices[0]
            pointB=threeVertices[1]
            pointC=threeVertices[2]
            
            #area of this triangle
            areaABC=rg.Vector3d.CrossProduct(rg.Vector3d(pointB-pointA) ,rg.Vector3d(pointC-pointA) ).Length *0.5
            
            #area of first subtriangle
            Nc=rg.Vector3d.CrossProduct(rg.Vector3d(pointB-pointA),rg.Vector3d(ptX-pointA))
            Ncc=rg.Vector3d.CrossProduct(rg.Vector3d(pointB-pointA),rg.Vector3d(pointC-pointA))
            mc=rg.Vector3d.Multiply(Nc,Ncc)
            
            if mc>=0:
                areaABX=0.5*Nc.Length
            
            else:
                areaABX=-0.5*Nc.Length
            
            coefficientc=areaABX/areaABC
            
            #area of second subtriangle
            Nb=rg.Vector3d.CrossProduct(rg.Vector3d(pointA-pointC),rg.Vector3d(ptX-pointC))
            Nbb=rg.Vector3d.CrossProduct(rg.Vector3d(pointA-pointC),rg.Vector3d(pointB-pointC))
            mb=rg.Vector3d.Multiply(Nb,Nbb)
            
            if mb>=0:
                areaAXC=0.5*Nb.Length
            
            else:
                areaAXC=-0.5*Nb.Length
            
            coefficientb=areaAXC/areaABC
            
            #area of third subtriangle
            Na=rg.Vector3d.CrossProduct(rg.Vector3d(pointC-pointB),rg.Vector3d(ptX-pointB))
            Naa=rg.Vector3d.CrossProduct(rg.Vector3d(pointC-pointB),rg.Vector3d(pointA-pointB))
            ma=rg.Vector3d.Multiply(Na,Naa)
            
            if ma>=0:
                areaXBC=0.5*Na.Length
            
            else:
                areaXBC=-0.5*Na.Length
            
            coefficienta=areaXBC/areaABC
            
            
            return (coefficienta,coefficientb,coefficientc)
        
        # Get a new vector to guide the streamline growth, it will return scenario tag， including:
        # "Normal": Normal case, it is still inside the boundary
        # "Special": Special case, it is still inside the boundary, but it is inside a "medial axis" triangle face
        # "Out": It runs out of the boundary or data mapping grid  
        # "OnBoundary": It is on the boundary (with in the model tolerance)         
        def GetNewVector(self,mappingGrid,processMesh,point,pointList):
            triRemeshBoundary =  processMesh.triRemeshBoundary.ToPolylineCurve()
            vList = processMesh.vertexList
            fList = processMesh.triangleList
    
            thisPointRow=int(round(point.X))
            thisPointColumn=int(round(point.Y))
            thisPointRow,thisPointColumn = mappingGrid.RemapPosition(point)
            coefficients=[]
            
            # scenario: Out of boundary
            tol = 0.001
            if int(triRemeshBoundary.Contains (point,rg.Plane.WorldXY,tol))==2:
                return None,None,"Out"
                
            # scenario: Out of data mapping grid 
            if thisPointRow > mappingGrid.rows or thisPointColumn > mappingGrid.columns or thisPointRow < 0 or thisPointColumn < 0:
                return None,None,"Out"

            # scenario： It is on the boundary (with in the model tolerance)  
            if int(triRemeshBoundary.Contains (point,rg.Plane.WorldXY,tol))==3:
                return None,None,"OnBoundary"    

            for triangleIndex in mappingGrid.grid[thisPointRow][thisPointColumn].documentedTriangle:
                threeVertices = fList[triangleIndex].triangleVertices
                threeVertices_geo = [threeVertices[0].geometry,threeVertices[1].geometry,threeVertices[2].geometry]
  
                coefficients=self.GetBarycentricCoefficient(threeVertices_geo,point)
                if coefficients[0]>=0 and coefficients[1]>=0 and coefficients[2]>=0:
                    break
            
            
            u=float(coefficients[0])
            v=float(coefficients[1])
            w=float(coefficients[2])
            
            
            
            ptListLength=len(pointList)
            
            thisVector=rg.Vector3d(pointList[ptListLength-2]-pointList[ptListLength-1])
            
            vec_a,vec_b,vec_c = self.GetAccordingMaxVec(threeVertices,thisVector)
            newVector=u * vec_a + v * vec_b +w * vec_c
            newVector.Unitize()
            flag = "Normal"   # scenario: Normal
            
            # scenario: Special
            if fList[triangleIndex].is_MedialAxis == 1:
                flag = "Special"

            return newVector,triangleIndex,flag
         
        # The point is inside one triangle with three vertices. Each vertex has a 4-vector field. Find the max for each.     
        def GetAccordingMaxVec(self,threeVertices,thisVector):
            chosenMaxVecs = []
            for vertex in threeVertices:
                angleList = []
                for i in range(4):
                    angleList.append(rm.ToDegrees(rg.Vector3d.VectorAngle(thisVector,vertex.crossField[i])))
                maxAngleIndex = angleList.index(max(angleList))
                chosenMaxVecs.append(vertex.crossField[maxAngleIndex])
     
            return chosenMaxVecs

        # Add a point in the chosen direction
        def GetTempPoint_LowOrder(self,startPoint,dL,startPointVector):
            temppoint = rg.Point3d.Add(startPoint,startPointVector*dL)
            return temppoint
        
        # Get the max angle vector_NormalCase  
        def CalculateMaxAngle_NormalCase(self,processMesh,triangleIndex,pointList,newVector):
            wxy_plane=rg.Plane.WorldXY
            ZAxis=wxy_plane.ZAxis
            ptListLength=len(pointList)
            thisVector=rg.Vector3d(pointList[ptListLength-2]-pointList[ptListLength-1])

            
            vectorList = [rg.Vector3d(newVector)]
            for angle in [90, 180, 270]:
                rotatedVector = rg.Vector3d(newVector)
                rotatedVector.Rotate(rm.ToRadians(angle), ZAxis)
                vectorList.append(rotatedVector)

            angleList = [rm.ToDegrees(rg.Vector3d.VectorAngle(thisVector, vector)) for vector in vectorList]
            maxAngleIndex = angleList.index(max(angleList))
            chosenVector = vectorList[maxAngleIndex]

            return chosenVector

        # Get the max angle vector_SpecialCase  
        def CalculateMaxAngle_SpecialCase(self,processMesh,triangleIndex,pointList,newVector):
            wxy_plane = rg.Plane.WorldXY
            ZAxis = wxy_plane.ZAxis
            
            fList = processMesh.triangleList
            
            ptListLength = len(pointList)
            thisVector = rg.Vector3d(pointList[ptListLength - 2] - pointList[ptListLength - 1])

            # This newVector's four direction vectors
            vectorList = [newVector]
            for angle in [0, 90, 180, 270]:
                rotatedVector = rg.Vector3d(newVector)
                rotatedVector.Rotate(rm.ToRadians(angle), ZAxis)
                vectorList.append(rotatedVector)
            
            # Collection threeVertices' crossField
            threeVertices = fList[triangleIndex].triangleVertices
            for vertex in threeVertices:
                vectorList = vectorList + vertex.crossField

            # Get the max angle one
            angleList = [rm.ToDegrees(rg.Vector3d.VectorAngle(thisVector, vector)) for vector in vectorList]
            maxAngleIndex = angleList.index(max(angleList))
            chosenVector = vectorList[maxAngleIndex]
            
            return chosenVector
        
        # Get the point list in one direction
        def GetStreamlinePointList(self,mappingGrid,processMesh,startPoint,choice,dL,threshold=400):
            tol = 0.001
            if choice!= "Specific":

                triRemeshBoundary =  processMesh.triRemeshBoundary
                pointList=[]
                pointList.append(startPoint.vh.geometry)
                startPointVector=startPoint.vh.crossField[choice]
                startPoint=startPoint.vh.geometry
            
            elif choice == "Specific":
                triRemeshBoundary =  processMesh.triRemeshBoundary
                wxy_Plane=rg.Plane.WorldXY

                triRemeshBoundary_curve = triRemeshBoundary.ToPolylineCurve()
                offset1= triRemeshBoundary_curve.Offset(wxy_Plane,tol,tol,rg.CurveOffsetCornerStyle.Sharp)[0]
                offset2= triRemeshBoundary_curve.Offset(wxy_Plane,-tol,tol,rg.CurveOffsetCornerStyle.Sharp)[0]
                
                
                if offset1.GetLength() > offset2.GetLength() :
                    offsetTriRemeshBoundary = offset1
                else:
                    offsetTriRemeshBoundary = offset2

                pointList=[]
                
                pointList.append(startPoint)
                t =offsetTriRemeshBoundary.ClosestPoint(startPoint)[1]
                closestPt = offsetTriRemeshBoundary.PointAt(t)
                startPointVector=rg.Vector3d(startPoint-closestPt)
                startPointVector.Unitize()
            
            
            # start calculating new point
            newPoint=self.GetTempPoint_LowOrder(startPoint,dL,startPointVector)
            pointList.append(newPoint)
            
            
            # set a threshold to avoid possible infinite situation.  otherwise it shoule be while GetNewVector(...)!=None
            for i in range(threshold):
                caseResult= self.GetNewVector(mappingGrid,processMesh,newPoint,pointList)
            
                newVector = caseResult[0]
                triangleIndex = caseResult[1]
                flag = caseResult[2]
               
                if flag == "Special":
                    maxVector=self.CalculateMaxAngle_SpecialCase(processMesh,triangleIndex,pointList,newVector)
                    newPoint=self.GetTempPoint_LowOrder(newPoint,dL,maxVector)
                    pointList.append(newPoint)
                    
                elif flag == "Normal":
                    maxVector=self.CalculateMaxAngle_NormalCase(processMesh,triangleIndex,pointList,newVector)
                    newPoint=self.GetTempPoint_LowOrder(newPoint,dL,maxVector)
                    pointList.append(newPoint)
                
                elif flag =="Out":
                    line=rg.Line((pointList[len(pointList)-2]),(pointList[len(pointList)-1]))
                    
                  
                    for i in range(triRemeshBoundary.SegmentCount) :
                        
                        if rg.Intersect.Intersection.LineLine(triRemeshBoundary.SegmentAt(i),line,tol,True)[0]==True:
                            
                            # make sure the end is perpendicular 
                            thisSegement = triRemeshBoundary.SegmentAt(i)
                            # lastPoint = thisSegement.ClosestPoint (pointList[len(pointList)-2],True)
                            
                            t = rg.Intersect.Intersection.LineLine(thisSegement,line,tol,True)[1]
                            lastPoint=triRemeshBoundary.SegmentAt(i).PointAt(t)
                            
                            pointList.pop()
                            pointList.append(lastPoint)
                    
                    if pointList[len(pointList)-1].DistanceTo(pointList[len(pointList)-2]) < 0.1:  ### set 0.1 instead of 0.001 :this is important to avoid extreme case when remesh
                        pointList.pop(len(pointList)-2)
                 
                    break  # Stop here
                    
                elif flag=="OnBoundary":
                    coindicentPt = pointList[-1]
                    lastPt =triRemeshBoundary.ClosestPoint(coindicentPt)
                    pointList.pop()
                    pointList.append(lastPt)
                    
                    break  # Stop here

                # A very extreme scenario : If the step is too small and it intersect with boundary, and there are more than 1 intersetion point:
                checkPolyL = rg.Polyline([pointList[-2],pointList[-1]])
                if rg.Intersect.Intersection.CurveCurve(checkPolyL.ToPolylineCurve(),triRemeshBoundary.ToPolylineCurve(),tol,tol).Count >1:
                    pointList.pop()

                    closestEndPt =rg.Intersect.Intersection.CurveCurve(checkPolyL.ToPolylineCurve(),triRemeshBoundary.ToPolylineCurve(),tol,tol).Item[0].PointA
                    pointList.append(closestEndPt)
                    if pointList[len(pointList)-1].DistanceTo(pointList[len(pointList)-2]) < tol:
                            pointList.pop(len(pointList)-2)

                    break
                
            return pointList

        # Get the point list in one direction
        def GetJoinedStreamline(self,mappingGrid,processMesh,startPoint,vectorIndex_1,vectorIndex_2,dL):

            # Get two point lists
            pointList1=self.GetStreamlinePointList(mappingGrid,processMesh,startPoint,vectorIndex_1,dL,threshold=400)
            pointList2=self.GetStreamlinePointList(mappingGrid,processMesh,startPoint,vectorIndex_2,dL,threshold=400)
            
            #reverse direction and delete the overlapping point
            pointList1.reverse()
             
            if len(pointList1)>1 and len(pointList2)>1:
                pointList1.pop()
                pointList1.extend(pointList2)
                fullPointList=pointList1
            
            elif len(pointList1)==1 or len(pointList2)==1:  # a very special case, one of the list has only 1 point. The other point is reduced becasue of tolerance detection. Just abandon this option
                fullPointList = []
                pass
            
            if len(fullPointList)>1:
                return fullPointList
            else:
                return None
        
        # The combined function           
        def GetStreamlineNetwork(self,mappingGrid,processMesh,seedpointList,detectDistance,dL,random = False):
            tol = 0.001
            streamlines=[]
            spL=seedpointList.list
            
            whileCount = 0             
            while len(spL)>0:
                if whileCount>10000:   ### avoid infinite loop
                    break
                
                # Get the start point, prefer not ramdon to reproduce the result 
                restSeedpoint = []
                for i in range(len(spL)):
                    restSeedpoint.append(i)

                if random ==False:
                    chosenIndex = restSeedpoint[0]
                elif random == True:
                    chosenIndex = random.sample(restSeedpoint,1)[0]
                startPoint = spL[chosenIndex]

                
                ##### first direction #####
                if startPoint.firstActivityStatus == True:
                    startPoint.firstActivityStatus = False
                    pointList1=self.GetJoinedStreamline(mappingGrid,processMesh,startPoint,0,2,dL)
                    
                    if pointList1!=None:
                        if len(pointList1)>1:
                            streamline1=rg.Polyline(pointList1)
                            
                            if rg.Intersect.Intersection.CurveSelf(streamline1.ToPolylineCurve(),tol).Count ==0:
                                streamlines.append(streamline1)
                                
                        
                        # Update the seed point status
                        if rg.Intersect.Intersection.CurveSelf(streamline1.ToPolylineCurve(),tol).Count==0 and len(pointList1)>0:
                            changenote1=self.DetectVertices(pointList1,seedpointList,streamline1,detectDistance)
                        else:
                            changenote1=[]
                    
                        if len(changenote1)>0:
                            for thisSeedpoint in changenote1:
                                self.UpdateActivityStatus(processMesh,seedpointList,streamline1,thisSeedpoint,"first")
                        
                        self.UpdateSeedPointList(seedpointList,changenote1)

                ##### second direction #####
                if startPoint.secondActivityStatus == True:
                    startPoint.secondActivityStatus = False
                    pointList2 = self.GetJoinedStreamline(mappingGrid,processMesh,startPoint,1,3,dL)
      
                    if pointList2!=None:
                        if len(pointList2)>1:
                            streamline2=rg.Polyline(pointList2)
                
                            if rg.Intersect.Intersection.CurveSelf(streamline2.ToPolylineCurve(),tol).Count ==0:
                                streamlines.append(streamline2)
                        
                        # Update the seed point status        
                        if rg.Intersect.Intersection.CurveSelf(streamline2.ToPolylineCurve(),tol).Count ==0 and len(pointList2)>0:
                            changenote2=self.DetectVertices(pointList2,seedpointList,streamline2,detectDistance)
                        
                        else:
                            changenote2=[]
                            
                        if len(changenote2)>0:
                            for thisSeedpoint in changenote2:
                                self.UpdateActivityStatus(processMesh,seedpointList,streamline2,thisSeedpoint,"second")
        
                        self.UpdateSeedPointList(seedpointList,changenote2)

                ##### make sure it is removed #####   
                spL = seedpointList.list
                if (startPoint.firstActivityStatus ==False and startPoint.secondActivityStatus ==False) and startPoint in spL:
                    startPoint.validity = False
                    spL.remove(startPoint)
    
                    
                whileCount+=1    ### avoid infinite loop
                
            return streamlines
        
        # Get the streamline only in "up+down" , or "left+right"
        def GetStreamlineOnSpecificPoint(self,startPoint,mappingGrid,processMesh,dL):
            # this will only go for 1 direction
            pointList=self.GetStreamlinePointList(mappingGrid,processMesh,startPoint,"Specific",dL)
            streamline=None
            
            if pointList!=None:
                if len(pointList)>1:
                    streamline=rg.Polyline(pointList)
                
                else:
                    streamline=None
       
            return streamline
        
    #########################
    ########Seedpoint########
    #########################
    
    class Seedpoint:
        def __init__(self,vh):
            self.vh = vh                           # Type: ProcessVertex     Vertex Handle, can call the corresponding ProcessVertex
            self.firstActivityStatus = True        # Type: bool              Activity status of the first direction generation (First direction is the direction "0" and "2" in four-vector)
            self.secondActivityStatus = True       # Type: bool              Activity status of the second direction generation (First direction is the direction "1" and "3" in four-vector) 
            self.validity = True                   # Type: bool              If first and second activity status are false, it will be false
            
        def __def__(self):
            self.vh = None           
            self.firstActivityStatus = None
            self.secondActivityStatus = None
            self.validity = None
            
    class SeedpointList:
        def __init__(self):     
            self.list = None                       # Type: list<Seedpoint>   Store a list of seed point
            
        def __def__(self):
            self.list = None
        
        # Initialize, boolean_onEdge,boolean_onMa is to exclude some of the points
        # point on boundary edge will only have one direction, to be simple, just exclude it
        # point on medial axis might generate streamline with strong discontinuity, just exclude it
        def CreateSeedpointList(self,processMesh,boolean_onEdge,boolean_onMa):
            seedpointList=[]
            vertexList = processMesh.vertexList
            
            if boolean_onEdge == 1 and boolean_onMa == 1:
                for vertex in vertexList:
                    if vertex.is_OnEdge != 1 and vertex.is_MedialAxisVertex != 1:
                        seedpoint=SLG.Seedpoint(vertex)
                        seedpointList.append(seedpoint)
                         
            elif boolean_onEdge == 0 and boolean_onMa == 1:
                for vertex in vertexList:
                    if  vertex.is_MedialAxisVertex != 1:
                        seedpoint=SLG.Seedpoint()
                        seedpoint.vh=vertex
                        seedpointList.append(seedpoint)
               
            elif boolean_onEdge == 1 and boolean_onMa == 0:
                for vertex in vertexList:
                    if  vertex.is_OnEdge != 1:
                        seedpoint=SLG.Seedpoint()
                        seedpoint.vh=vertex
                        seedpointList.append(seedpoint)
                        
            elif boolean_onEdge == 0 and boolean_onMa == 0:
                for vertex in vertexList:
                    seedpoint=SLG.Seedpoint()
                    seedpoint.vh=vertex
                    seedpointList.append(seedpoint)
            
            self.list = seedpointList
                

    #########################
    ######## Diagram ########
    #########################
    
    @staticmethod
    def PrintStreamlines(streamlines):
        print ("diagram for all streamlines")
        for streamline in streamlines:
            for pt in streamline:
                print (pt.X),pt.Y,0
            print ("-----")
        return 0
# ---------- end ghpython_script_5 ----------
ghpython_script_6 = GhPythonScript()  # -> out, EV
# ---------- ghpython_script_6: Python ----------
###########################
####    Import Libs    ####
###########################
import Rhino.Geometry as rg
import Rhino.RhinoDoc as rd
import Rhino.RhinoMath as rm

import ghpythonlib.components as ghc
import math
import clr

clr.AddReference("CGAL.Wrapper.dll")                 ### This is a wrapper contains some functions from C++ CGAL lib
import CGAL.Wrapper

from System.Collections.Generic import List        ### This is a List type that used for C# 

###########################
####    Description    ####
###########################
### EV : Evaluation
### This library is to do the evaluation and score.
### Eventually the info will be store in streamline instance.


class EV:

    ######################################################
    ##########          Evaluation          ##############
    ######################################################
    
    # Evaluate the area, the ratio result always less than 1
    @staticmethod
    def EvaluateAreaRatio(polygons):
        polygon1=polygons[0]
        polygon2=polygons[1]

        area1=rg.AreaMassProperties.Compute(polygon1).Area
        area2=rg.AreaMassProperties.Compute(polygon2).Area
        
        areaPair= [area1,area2]

        ### SmallArea / BigArea
        if area1>=area2:
            ratio = area2/area1
        else:
            ratio = area1/area2
            
        return ratio,areaPair
    
    # Evaluate the orientation angle against world X-axis
    @staticmethod
    def EvaluateOrientation(geo,obb=None):
        if obb == None:
            obb = EV.GetOBB(geo,5)
        obb = EV.MakeCounterClockwiseDirection(obb)
        # Construct the local coordinate
        obbOrigin = None
        distance = []
        for i in range(len(obb)-1):
            distance.append(obb[i].DistanceTo(rg.Point3d(0,0,0)))
        
        ptIndex = distance.index(min(distance))
        obbOrigin =obb[ptIndex]
        
        
        if ptIndex != 0 and ptIndex != 3:
            Xend = obb[ptIndex+1]
            Yend = obb[ptIndex-1]
        
        elif ptIndex==0:
            Xend = obb[ptIndex+1]
            Yend = obb[3]
        elif ptIndex==3:
            
            Xend = obb[0]
            Yend = obb[ptIndex-1]
        
        obbXaxis = rg.Vector3d(Xend - obbOrigin)
        obbYaxis = rg.Vector3d(Yend - obbOrigin)
        
        globalXaxis = rg.Vector3d(1,0,0)

        # Compare the longer obb edge
        if obbXaxis.Length >=obbYaxis.Length:
            compare = obbXaxis
        else:
            compare = obbYaxis
            
        angle = rg.Vector3d.VectorAngle(compare,globalXaxis)
        
        # This makes it always return angle less than 90
        if angle > rm.HalfPI:
            angle = rm.TwoPI/2 - angle
                        
        return angle

    # Evaluate the elonation,  the elonation result always less than 1
    @staticmethod
    def EvaluateElongation(geo,obb=None):
        if obb == None:
            obb = EV.GetOBB(geo,5)

        edge1=obb.SegmentAt(0)
        edge2=obb.SegmentAt(1)
        
        if edge1.Length>edge2.Length:
            ratio=edge1.Length/edge2.Length
        else:
            ratio=edge2.Length/edge1.Length
        
        return ratio
    
    # Evaluate the compactness, which is based on the formula  
    # Compactness is defined as the ratio of the area of an object to the area of a circle with the same perimeter.  
    @staticmethod
    def EvaluateCompactness(geo): 
        return 4 * math.pi * rg.AreaMassProperties.Compute(geo).Area/geo.GetLength()**2
       
    # Evaluate the convexity, compared with its convex hull
    @staticmethod
    def EvaluateConvexity(geo):
        if isinstance(geo,rg.Polyline)!= True:
            if isinstance(geo,rg.PolylineCurve) or isinstance(geo,rg.NurbsCurve) or isinstance(geo,rg.PolyCurve):
                geoLength = geo.GetLength()
                ts = []
                step = geo.Domain[1]/100
                for i in range(100):
                
                    ts.append(step*i)

                pts = []
                for t in ts:
                    pts.append(geo.PointAt(t))
                
            ptList = List[rg.Point3d](pts)
            
        else:
            geoLength = geo.Length
            ptList = [geo[index] for index in range(len(geo)-1)]
            ptList = List[rg.Point3d](ptList)
            
        convexHull = CGAL.Wrapper.GeometryProcessingMethods.CGAL_2DConvexHull(ptList)
        convexity = convexHull.Length/geoLength
        
        
        return convexity
    
  
    # Evaluate the continuity by the amount of angle change
    @staticmethod 
    def EvaluateContinuity(streamline):
        
        streamlineVertices=[]
        for index in range(len(streamline)-1):
            streamlineVertices.append(streamline[index])
    
        #global values
        num=len(streamlineVertices)
   
        
        #Intermediate values
        direction = rg.Vector3d(0,0,0)
        newVec = rg.Vector3d(0,0,0)

        angleSum = 0
        for i in range(1,len(streamlineVertices)-1,1):
            direction = streamlineVertices[i]-streamlineVertices[i-1]
            newVec = streamlineVertices[i+1] - streamlineVertices[i]
            angle = rg.Vector3d.VectorAngle(newVec,direction)
            angle = rm.ToDegrees(angle)
            angleSum+=angle
        
        continuity=angleSum/num
        
        return continuity
        
    # Evaluate the side num
    @staticmethod
    def EvaluateSideNum(sides):
        return len(sides)   
    
    # Evaluate the side length variance

    @staticmethod
    def EvaluateSideLengthVariance(sides):
   
        totalLength = 0
        for side in sides:
            totalLength+= side.Length   

        meanLength = totalLength/len(sides)  
        
        
        sumSquares = 0
        for side in sides:
            
            deviation = side.Length/meanLength  
            sumSquares = sumSquares + (deviation * deviation)

        variance = sumSquares/len(sides)
       
        return variance  
    
    # Evaluate the angle variance, reminder: they are abstracted to lines
    @staticmethod
    def EvaluateAngleVariance(sides):
        
        angles = []
        for i in range(len(sides)-1):
            currSide = sides[i]
            nextSide = sides[i+1]
            
      
            
            vecA = rg.Vector3d(rg.Point3d(currSide.First.X,currSide.First.Y,0) - rg.Point3d(currSide.Last.X,currSide.Last.Y,0))
            vecB = rg.Vector3d(rg.Point3d(nextSide.Last.X,nextSide.Last.Y,0) - rg.Point3d(nextSide.First.X,nextSide.First.Y,0))
            angle = rg.Vector3d.VectorAngle(vecA,vecB)
            angles.append(angle)
            #angles.append(int(rm.ToDegrees(angle)))

        currSide = sides[-1]
        nextSide = sides[0]


        vecA = rg.Vector3d(rg.Point3d(currSide.First.X,currSide.First.Y,0) - rg.Point3d(currSide.Last.X,currSide.Last.Y,0))
        vecB = rg.Vector3d(rg.Point3d(nextSide.Last.X,nextSide.Last.Y,0) - rg.Point3d(nextSide.First.X,nextSide.First.Y,0))
        angle = rg.Vector3d.VectorAngle(vecA,vecB)
        angles.append(angle)
        #angle = rm.ToDegrees(angle)
        angles.append(int(angle))
      
        sumAngle = 0
        for angle in angles:
            sumAngle+=angle
        meanAngle = sumAngle/len(sides)
        
        sumSquares = 0
        for i in range(len(sides)):
    
            deviation = angles[i] - meanAngle
            sumSquares += deviation * deviation

        variance = sumSquares/len(sides)
        
 
        return variance
    
    # Evaluate the accessibility variance, it there is side length varience for a parcel which is longer than the threshold, we consider this splited parcel is accessible
    # Reminder: it use side length to check , instead of edge length
    @staticmethod 
    def EvaluateAccess_WithLength(parcFace,currE_Dict,p1_LengthVar,p2_LengthVar,p1_relatedEdgeIDs,p2_relatedEdgeIDs,startEdgeID,endEdgeID,startHitPoint,endHitPoint,percentage = 0.5):
     
        ### Global
        p1Access = 0
        p2Access = 0
 
        ### Split
        startEdge = currE_Dict[startEdgeID].GetGeometry()
        startEdgeCrv = startEdge.ToPolylineCurve()
        cPt_t = startEdgeCrv.ClosestPoint(startHitPoint)[1]

        if abs(cPt_t-startEdgeCrv.Domain.T0)>0.001 and abs(cPt_t-startEdgeCrv.Domain.T1)>0.001:
            splitResult = startEdgeCrv.Split(cPt_t)
            splitStart_0 = splitResult[0]
            splitStart_1 =  splitResult[1]
        
        elif abs(cPt_t-startEdgeCrv.Domain.T0)<0.001:
            splitStart_0 = None
            splitStart_1 = startEdgeCrv
        
        elif abs(cPt_t-startEdgeCrv.Domain.T1)<0.001:
            splitStart_0 = startEdgeCrv
            splitStart_1 = None
        
        endEdge = currE_Dict[endEdgeID].GetGeometry()
        endEdgeCrv = endEdge.ToPolylineCurve()
        
        cPt_t = endEdgeCrv.ClosestPoint(endHitPoint)[1]
        
        if abs(cPt_t-endEdgeCrv.Domain.T0)>0.001 and abs(cPt_t-endEdgeCrv.Domain.T1)>0.001:
            splitResult = endEdgeCrv.Split(cPt_t)
            splitEnd_0 = splitResult[0]
            splitEnd_1 =  splitResult[1]
        
        elif abs(cPt_t-endEdgeCrv.Domain.T0)<0.001:
            splitEnd_0 = None
            splitEnd_1 = endEdgeCrv
        
        elif abs(cPt_t-endEdgeCrv.Domain.T1)<0.001:
            splitEnd_0 = endEdgeCrv
            splitEnd_1 = None
            
        ### Get possible related streets
        streetRecordDict = {}
        for edge in parcFace.edges:
            if edge.streetID != None:

                if edge.streetID not in streetRecordDict.keys():
                    streetRecordDict[edge.streetID] = [edge.ID]
                else:
                    streetRecordDict[edge.streetID].append(edge.ID)
            
        streetRecordList =  streetRecordDict.values()
   
        ### check p1
        restStreetEdgeList_p1 = []
        for streetRecord in streetRecordList:
            thisRestStreetEdges = []
            for edgeID in p1_relatedEdgeIDs:
                if edgeID in streetRecord:
                    
                    if edgeID == startEdgeID or edgeID == currE_Dict[startEdgeID].twinID:
                        if splitStart_0!=None:
                            thisRestStreetEdges.append(splitStart_0.TryGetPolyline()[1])
                    
                    elif edgeID == endEdgeID or edgeID == currE_Dict[endEdgeID].twinID:
                        if splitEnd_1!=None:
                            thisRestStreetEdges.append(splitEnd_1.TryGetPolyline()[1])
                    
                    else:
                        thisRestStreetEdges.append(currE_Dict[edgeID].GetGeometry())
                        
            restStreetEdgeList_p1.append(thisRestStreetEdges) 
    
        restStreetLengthList_p1 = []
        
        for thisRestStreetEdges in restStreetEdgeList_p1:
            totalLength = 0
            
            for eGeo in thisRestStreetEdges:
                totalLength += eGeo.Length
            restStreetLengthList_p1.append(totalLength)    
                
        for length in restStreetLengthList_p1:
            if length >= p1_LengthVar*percentage:
                p1Access = 1
                break
    
        ### check p2
        restStreetEdgeList_p2 = []
        for streetRecord in streetRecordList:
            thisRestStreetEdges = []
            for edgeID in p2_relatedEdgeIDs:
               
                if edgeID in streetRecord:
                    if edgeID == startEdgeID or edgeID == currE_Dict[startEdgeID].twinID:
                        
                        if splitStart_1!=None:
                            thisRestStreetEdges.append(splitStart_1.TryGetPolyline()[1])
                    
                    elif edgeID == endEdgeID or edgeID == currE_Dict[endEdgeID].twinID:
                        
                        if splitEnd_0!=None:
                            thisRestStreetEdges.append(splitEnd_0.TryGetPolyline()[1])
                    
                    else:
                        
                        thisRestStreetEdges.append(currE_Dict[edgeID].GetGeometry())
                        
            restStreetEdgeList_p2.append(thisRestStreetEdges)   
            
    
        restStreetLengthList_p2 = []
        for thisRestStreetEdges in restStreetEdgeList_p2:
            totalLength = 0
            for eGeo in thisRestStreetEdges:
                
                totalLength += eGeo.Length
            restStreetLengthList_p2.append(totalLength)    
                
        for length in restStreetLengthList_p2:
            if length >= p2_LengthVar*percentage:
                p2Access = 1  
                break 
        

        
        return p1Access,p2Access
    
        # Evaluate the accessibility variance, it there is one side for a parcel which is longer than the threshold, we consider this splited parcel is accessible
    
    # This is a combined function including : numDifference,continuity,angleVar, lengthVar, access             
    @staticmethod 
    def EvaluateGeometrySideRelated(SPF,SLG,parcFace,streamline,EDict_All):
        p1_Sides,p2_Sides,p1_relatedEdgeIDs,p2_relatedEdgeIDs,startSplitInfo,endSplitInfo,p1_relatedSideNonSplit,p2_relatedSideNonSplit,startEdgeID,endEdgeID,startHitPoint,endHitPoint =  EV.GetGeometrySideTemporarily(SPF,SLG,parcFace,streamline,EDict_All)  
       
        p1_Sides_Clean = []
        for side in p1_Sides:
            if side.Length < 0.001:
                # print ("p1 Length < 0.001")
                pass
            else:
                side = EV.SimplifyVertices(side)
                p1_Sides_Clean.append(side)
            
            
        
        p2_Sides_Clean = []
        for side in p2_Sides:
            if side.Length < 0.001:
                # print ("p2 Length < 0.001")
                pass
            else:
                side = EV.SimplifyVertices(side)
                p2_Sides_Clean.append(side)
        
              
        p1_Num = EV.EvaluateSideNum(p1_Sides_Clean)
        p2_Num = EV.EvaluateSideNum(p2_Sides_Clean)
        numDifference = abs((p1_Num - p2_Num))
        
        continuity = EV.EvaluateContinuity(streamline)
        
        
        p1_AngleVar = EV.EvaluateAngleVariance(p1_Sides_Clean)
        p2_AngleVar = EV.EvaluateAngleVariance(p2_Sides_Clean)
        angleVarAve = (p1_AngleVar + p2_AngleVar)/2


        
        p1_LengthVar = EV.EvaluateSideLengthVariance(p1_Sides_Clean)
        p2_LengthVar = EV.EvaluateSideLengthVariance(p2_Sides_Clean)
        lengthVarAve = (p1_LengthVar + p2_LengthVar )/2
        
        p1_accessScore,p2_accessScore = EV.EvaluateAccess_WithLength(parcFace,EDict_All,p1_LengthVar,p2_LengthVar,p1_relatedEdgeIDs,p2_relatedEdgeIDs,startEdgeID,endEdgeID,startHitPoint,endHitPoint,percentage = 0.5)
        accessAve= (p1_accessScore + p2_accessScore)/2

        return numDifference,continuity, angleVarAve, lengthVarAve,accessAve
       
       
        
    ######################################################
    ##########             Score            ##############
    ###################################################### 
    
    #####
    # Now it is only used in access point part, and just to store some info
    ####
    @staticmethod
    def Score_ParcelLevel_A(streamlines,boundary,idealElongation,idealCompactness,idealConvexity,idealOrientation,calcEA=True,calcEL=True,calcCP=True,calcCV=True,calcOR=True):
        
        ###Record the problematic streamline index
        problematicIndices = []
        
        ###This is to record the Difference to the Ideal Value
        discrepancies_area=[]
        discrepancies_elongation=[]
        discrepancies_compactness=[]
        discrepancies_convexity=[]
        discrepancies_orientation=[]
        
        ###This is to record datas for each Pair
        areaPairCollection = []
        elongationPairCollection = []
        compactnessPairCollection = []
        convexityPairCollection = []
        orientationPairCollection = []
        
        for i in range(len(streamlines)):
   
    

            polygons=EV.SplitPolygon(streamlines[i],boundary)

            ### check if the polygons valid
            checkTag1 = None
            checkTag2 = None
            
            if polygons !=None:
                checkTag1 = rg.AreaMassProperties.Compute(polygons[0])
                checkTag2 = rg.AreaMassProperties.Compute(polygons[1])

                obbs = [EV.GetOBB(geo,2) for geo in polygons]  # Elongation and Orientation evluation will use, get them here avoiding compute them twice
  
            if polygons !=None and checkTag1!=None and checkTag2!=None:
                
                ### Even Area  ###
                if calcEA == True:
                    ratio,areaPair = EV.EvaluateAreaRatio(polygons)
                    areaPairCollection.append(areaPair)
                    
                    discrepancy_area=abs(ratio-1)          
                    discrepancies_area.append(discrepancy_area)
                    
      
                elif calcEA == False:
                    discrepancy_area=None        
                    discrepancies_area.append(None)
                
                ###       Elongation      ###
                elongationPair = []
                discrepancy_elongation_pair=[]
                
                if calcEL == True:
                    for i in range(len(polygons)):
                        obb = obbs[i]
                        ratio = EV.EvaluateElongation(geo,obb)
                        
                        elongationPair.append(ratio)
                        discrepancy_elongation=abs(ratio-idealElongation)
                        
                        discrepancy_elongation_pair.append(discrepancy_elongation)

                    elongationPairCollection.append(elongationPair) 
                    discrepancies_elongation.append( (discrepancy_elongation_pair[0] + discrepancy_elongation_pair[1])/2 )  ### take the average

 
                elif calcEL == False:
                    elongationPairCollection.append([None,None]) 
                    discrepancies_elongation.append( None )  ### take the average
                
                ###       Compactness       ###
                compactnessPair = [] 
                discrepancy_compactness_pair=[]
                
                if calcCP == True:
                    for geo in polygons:
                        
                        compactness = EV.EvaluateCompactness(geo)
                        compactnessPair.append(compactness)
                        discrepancy_compactness = abs(compactness-idealCompactness)
                        discrepancy_compactness_pair.append(discrepancy_compactness)
                        
                    compactnessPairCollection.append(compactnessPair)
                    discrepancies_compactness.append( (discrepancy_compactness_pair[0] + discrepancy_compactness_pair[1])/2 )   ### take the average
                
                elif calcCP == False:
                    compactnessPairCollection.append([None,None]) 
                    discrepancies_compactness.append( None )  ### take the average
                    
                ###       Convexity       ###
                convexityPair = []
                discrepancy_convexity_pair = []
                
                if calcCV == True:
                    for geo in polygons:

                        convexity = EV.EvaluateConvexity(geo) 
                        convexityPair.append(convexity)
                        discrepancy_convexity = abs(convexity-idealConvexity)
                        discrepancy_convexity_pair.append(discrepancy_convexity)
                        
                    convexityPairCollection.append(convexityPair)
                    discrepancies_convexity.append( (discrepancy_convexity_pair[0] + discrepancy_convexity_pair[1])/2 )  ### take the average
                
                elif calcCV == False:
                    convexityPairCollection.append([None,None]) 
                    discrepancies_convexity.append( None)  ### take the average 
                    
                ###       Orientation       ###
                # idealOrientation = 0  - > meaning prefer N-S
                # idealOrientation = 1  - > meaning prefer W-E
                
                orientationPair = []
                discrepancy_orientation_pair = []
                
                if calcOR == True:
                    for i in range(len(polygons)):
                        obb = obbs[i]
                        orientation = EV.EvaluateOrientation(geo,obb)  # 0 -> NS, 1-> WS
                        orientationPair.append(orientation)
                        
                        # get the discrepancy
                        if orientation > rm.HalfPI:
                            orientation = rm.TwoPI/2 - orientation
                
                        if idealOrientation == 0: # prefer NS
                            discrepancy_orientation = abs(orientation - rm.HalfPI)
                        
                        elif idealOrientation == 1: # prefer WE
                            discrepancy_orientation = abs(orientation - 0)

                        discrepancy_orientation_pair.append(discrepancy_orientation)
                        
                    orientationPairCollection.append(orientationPair)
                    discrepancies_orientation.append( (discrepancy_orientation_pair[0] + discrepancy_orientation_pair[1])/2 )  ### take the average
      
                elif calcOR == False:
                    orientationPairCollection.append([None,None]) 
                    discrepancies_orientation.append( None)  ### take the average    
          
                    
            else:
                problematicIndices.append(i)

            if problematicIndices != []:
                for index in problematicIndices:
                    streamlines.pop(index)
            
        return (discrepancies_area,discrepancies_elongation,discrepancies_compactness,discrepancies_convexity,discrepancies_orientation,areaPairCollection,elongationPairCollection,compactnessPairCollection,convexityPairCollection,orientationPairCollection)

    #####
    # Now the selection function rely on this
    ####
    @staticmethod 
    def Score_ParcelLevel_B(SPF,SLG,parcFace,streamlines,EDict_All):
        continuityList = []
        numDifferenceList = []
        angleVarAveList = []
        lengthVarAveList = []
        accessAveList = []
    
        ###Check if it can split
        removeItems =[]
        for streamline in streamlines:
            if EV.SplitPolygon(streamline,parcFace.processMesh.triRemeshBoundary) == None:
                removeItems.append(streamline)
        
        for item in removeItems:
            streamlines.remove(item)
           
        for streamline in streamlines:

            numDifference,continuity, angleVarAve, lengthVarAve,aveAccessScore = EV.EvaluateGeometrySideRelated(SPF,SLG,parcFace,streamline,EDict_All)
         
            
            numDifferenceList.append(numDifference)
            continuityList.append(continuity)
            angleVarAveList.append(angleVarAve)
            lengthVarAveList.append(lengthVarAve)
            accessAveList.append(aveAccessScore)
      
        return continuityList,numDifferenceList,  angleVarAveList, lengthVarAveList,accessAveList


    # Make sure len(allList) equal to len(weight)
    @staticmethod
    def GetOverallScore(allList,weight):
        
        #Clean

        new_allList = []
        new_weight = []

        for a, b in zip(allList, weight):
            if a != None:
                new_allList.append(a)
                new_weight.append(b)

        overallScore = []

        for i in range(len(new_allList[0])):
             
            score = sum(new_allList[j][i] * new_weight[j] for j in range(len(new_allList)))
            overallScore.append(score)
        return overallScore
    
    #####
    # Score post processing
    #####
    @staticmethod
    def RemapRange(numlist,tartgetdomainstart,tartgetdomainend):

        tartgetdomain=ghc.ConstructDomain(tartgetdomainstart,tartgetdomainend)
    
        maxnum=max(numlist)
    
        minnum=min(numlist)
        
        sourcerdomain=ghc.ConstructDomain(minnum,maxnum)
        
        newrange=ghc.RemapNumbers(numlist,sourcerdomain,tartgetdomain)[0]
        
        return newrange


    ######################################################
    ##########       Evaluation Help Function    #########
    ######################################################
    
    # Help to split the side temporarily    
    @staticmethod
    def GetGeometrySideTemporarily(SPF,SLG,parcFace,streamline,EDict_All):
        
        for side in parcFace.sides:
            for edgeID in side:
                ptList = []
                currEdge = EDict_All[edgeID]
                if currEdge.isValid == True:
                    all =  currEdge.GetVPInstance()
                    for instance in all:
                        ptList.append(instance.geometry)
   
        streamlineInstance = SLG.Streamline()
        streamlineInstance.CreateStreamlineInstance(streamline)
        startEdge,endEdge,startEdgeIndex,endEdgeIndex,startSplitPointPair,endSplitPointPair,flag = SPF.DetectLocation(parcFace,streamlineInstance)     ### include reverse already

        ### Get the startSide
        startEdgeID = parcFace.edges[startEdgeIndex].ID
   
        for i in range(len(parcFace.sides)):
            side = parcFace.sides[i]
           
            if startEdgeID in side:
                startSideIndex = i
                break
        
        ### Get the endSide
        endEdgeID = parcFace.edges[endEdgeIndex].ID
    
        for i in range(len(parcFace.sides)):
            side = parcFace.sides[i]
            if endEdgeID in side:
                endSideIndex = i
                break
        
        ### Get startSide Geometry
        startSide = parcFace.sides[startSideIndex]
        
        startPtList = []
        for edgeID in startSide:
            
            currEdge = EDict_All[edgeID]
            if currEdge.isValid == True:
                
                all =  currEdge.GetVPInstance()
                for instance in all:
                    startPtList.append(instance.geometry)
                    
        startSideGeo = rg.Polyline(startPtList)
        
        ### Get endSide Geometry
        endSide = parcFace.sides[endSideIndex]
        
        endPtList = []
        for edgeID in endSide:
            
            
            currEdge = EDict_All[edgeID]
            if currEdge.isValid == True:
                
                all =  currEdge.GetVPInstance()
                for instance in all:
                    endPtList.append(instance.geometry)
                    
        endSideGeo = rg.Polyline(endPtList)
          
        slice_0=[]
        slice_1=[]
        slice_2=[]
                        
        for sideIndex in range(len(parcFace.sides)):
            if sideIndex < startSideIndex:
                slice_0.append(sideIndex)
            
            elif sideIndex > startSideIndex and sideIndex < endSideIndex:
                slice_1.append(sideIndex)
                
            elif sideIndex > endSideIndex:
                slice_2.append(sideIndex)

        
        slice_2.extend(slice_0)
 
        firstHalf = slice_2
        secondHalf = slice_1
 
        ### Get startSide IndexPair
        startIndexPair_Side=[]

        all = [pt for pt in startSideGeo]
        for i in range(len(all)-1):
            segment=rg.Line(all[i],all[i+1])
            if segment.DistanceTo(streamlineInstance.startVertex.geometry,True)<0.01:
                startIndexPair_Side=[i,i+1]
       
        ### Get endSide IndexPair
        endIndexPair_Side=[]

        all = [pt for pt in endSideGeo]
    
        for i in range(len(all)-1):
            segment=rg.Line(all[i],all[i+1])
            if segment.DistanceTo(streamlineInstance.endVertex.geometry,True)<0.01:
                endIndexPair_Side=[i,i+1]

        subSide_Start_0,subSide_Start_1 = EV.SplitSide_Temp(startSideGeo,streamlineInstance.startVertex.geometry,startIndexPair_Side)
        subSide_End_0,subSide_End_1 = EV.SplitSide_Temp(endSideGeo,streamlineInstance.endVertex.geometry,endIndexPair_Side)

        ###################
        ### p1 sides collection
        ###################
        p1_Sides = []
        ### Step 1
        p1_Sides.append(streamlineInstance.GetGeometry())
        ### Step 2
        p1_Sides.append(subSide_End_1)
        ### Step 3
        for sideIndex in firstHalf:
            ptList = []
            side = parcFace.sides[sideIndex]
            for edgeID in side:
                currEdge = EDict_All[edgeID]
                if currEdge.isValid == True:
                    all =  currEdge.GetVPInstance()
                    for instance in all:
                        ptList.append(instance.geometry)
                        
            sideGeo = rg.Polyline(ptList)
            p1_Sides.append(sideGeo)
        ### Step 4
        p1_Sides.append(subSide_Start_0)

        ###################
        ### p2 sides collection
        ###################   
        p2_Sides = []

        ### Step 1
        p2_Sides.append(subSide_Start_1)
        ### Step 2
        for sideIndex in secondHalf:
            ptList = []
            side = parcFace.sides[sideIndex]
            for edgeID in side:
                currEdge = EDict_All[edgeID]
                if currEdge.isValid == True:
                    all =  currEdge.GetVPInstance()
                    for instance in all:
                        ptList.append(instance.geometry)
            sideGeo = rg.Polyline(ptList)
            p2_Sides.append(sideGeo)
        ### Step 3
        p2_Sides.append(subSide_End_0)
        
        ### Step 4
        streamlineReverse = rg.Polyline(streamlineInstance.GetGeometry())
        streamlineReverse.Reverse()
        p2_Sides.append(streamlineReverse)
        
        
        ### Collection of side Edge
        p1_relatedEdgeIDs = []
        p2_relatedEdgeIDs = []
        slice_0_EdgeIDs = []
        slice_1_EdgeIDs = []
        slice_2_EdgeIDs = []
        
        p1_relatedSideNonSplit = []
        p2_relatedSideNonSplit = []
        
        
        for sideIndex in range(len(parcFace.sides)):
            
            if sideIndex < startSideIndex:
                slice_0_EdgeIDs.extend(parcFace.sides[sideIndex])
                p1_relatedSideNonSplit.append(parcFace.sides[sideIndex])
                
            elif sideIndex > startSideIndex and sideIndex < endSideIndex:
                slice_1_EdgeIDs.extend(parcFace.sides[sideIndex])
                p2_relatedSideNonSplit.append(parcFace.sides[sideIndex])
                
            elif sideIndex > endSideIndex:
                slice_2_EdgeIDs.extend(parcFace.sides[sideIndex])
                p1_relatedSideNonSplit.append(parcFace.sides[sideIndex])
        
        slice_2_EdgeIDs.extend(slice_0_EdgeIDs)
 

        currEdges =parcFace.edges
        #slice the vertices list into 3 segments
        slice_0=[]
        slice_1=[]
        slice_2=[]
   
        for edgeIndex in range(len(currEdges)):
            if edgeIndex < startEdgeIndex:
                slice_0.append(currEdges[edgeIndex].ID)

            elif edgeIndex > startEdgeIndex and edgeIndex < endEdgeIndex:
                slice_1.append(currEdges[edgeIndex].ID)

            elif edgeIndex > endEdgeIndex:
                slice_2.append(currEdges[edgeIndex].ID)

        slice_2.extend(slice_0)
        p1_relatedEdgeIDs = slice_2
        p2_relatedEdgeIDs = slice_1
        p1_relatedEdgeIDs.extend([startEdgeID,endEdgeID])
        p2_relatedEdgeIDs.extend([startEdgeID,endEdgeID])

        ### record the detail info for access checking
        startSideSplitInfo = [startSideIndex,subSide_Start_0,subSide_Start_1]
        endSideSplitInfo = [endSideIndex,subSide_End_0,subSide_End_1]
        
        ### record the detail info for access checking
        startHitPoint = streamlineInstance.startVertex.geometry
        endHitPoint = streamlineInstance.startVertex.geometry 
        
        
        return p1_Sides,p2_Sides,p1_relatedEdgeIDs,p2_relatedEdgeIDs,startSideSplitInfo,endSideSplitInfo,p1_relatedSideNonSplit,p2_relatedSideNonSplit,startEdgeID,endEdgeID,startHitPoint,endHitPoint
    
    @staticmethod    
    def SplitSide_Temp(side,newV,indexPair_Side):
        all = [pt for pt in side]
        #print "len(all)", len(all)
        
        
        ### side 1
        newSide_1 = rg.Polyline()
        newSide_1.Add(side.First)
        for i in range(len(all)):
            #print i,indexPair_Side
            if i!=0 and i !=len(all)-1 and i <= indexPair_Side[0]:
                newSide_1.Add(all[i])
        newSide_1.Add(newV)
        
        ### side 2
        newSide_2 = rg.Polyline()
        newSide_2.Add(newV)
        for i in range(len(all)):
            if i!=0 and i !=len(all)-1 and i >= indexPair_Side[1]:
                newSide_2.Add(all[i])
        newSide_2.Add(side.Last)
            
        return newSide_1,newSide_2

    @staticmethod
    def SplitPolygon(streamline,boundary):
        
        if type(streamline) == type(rg.Polyline()):
            streamline = streamline.ToPolylineCurve()
        if type(boundary) == type(rg.Polyline()):
            boundary = boundary.ToPolylineCurve()
            
        streamline = streamline.Extend(rg.CurveEnd.Both,0.01,rg.CurveExtensionStyle.Line)
        tempCollection=[]
        tempCollection=[boundary,streamline]

        
        wxy_plane=rg.Plane.WorldXY
        #tol=rd.ActiveDoc.ModelAbsoluteTolerance
        tol = 0.001
        
        
        result=rg.Curve.CreateBooleanRegions(tempCollection,wxy_plane,False,tol)
        
        
        try:
            a=rg.CurveBooleanRegions.RegionCurves(result,0)[0]
            b=rg.CurveBooleanRegions.RegionCurves(result,1)[0]

        except:
  
            print ("SplitPolygon fails")
            print ("FAIL boundary:")
            boundary = boundary.TryGetPolyline()[1]
            for pt in boundary:
                print (pt.X), "," , (pt.Y), "," , (pt.Z)
                
            print ("FAIL streamline:")
            streamline = streamline.TryGetPolyline()[1]
            for pt in streamline:
                print (pt.X), "," , (pt.Y), "," , (pt.Z)

            return 
        return[a,b]

    @staticmethod
    def MakeCounterClockwiseDirection(inputPolyline):
        inputPolyline_copy = rg.Polyline(inputPolyline)
        inputPolylineCurve = inputPolyline_copy.ToPolylineCurve()
        if inputPolylineCurve.ClosedCurveOrientation().ToString() == "Clockwise":
            inputPolyline_copy.Reverse()
    
        else:
            pass
        
        return inputPolyline_copy

    @staticmethod
    def SimplifyVertices(polyL):
    
        newPtList = []
        segments = polyL.GetSegments()
        
        newPtList.append(polyL.First)
        for i in range(len(segments)-1):
            currSeg = segments[i]
            nextSeg = segments[i+1]
        
            vecA = rg.Vector3d(currSeg.To - currSeg.From)
            vecB = rg.Vector3d(nextSeg.To - nextSeg.From)
            
            if rg.Vector3d.VectorAngle(vecA,vecB) > 0.001:
                newPtList.append(nextSeg.From)
                
        newPtList.append(polyL.Last)
        simplifiedPolyL = rg.Polyline(newPtList)

        return simplifiedPolyL

    ###############
    ### OBB Function
    ###############
    @staticmethod
    def CheckObjCoPlanarity(obj,tol=0.001):

        pt_list=[]
        
        rc,plane=obj.TryGetPlane(tol)
        if not rc: return
        nc = obj.ToNurbsCurve()
        if nc is None: return
        crv_pts = [nc.Points[i].Location for i in xrange(nc.Points.Count)]
        pt_list.extend(crv_pts)
            
        if rg.Point3d.ArePointsCoplanar(pt_list,tol):
            rc, plane = rg.Plane.FitPlaneToPoints(pt_list)
            if rc==rg.PlaneFitResult.Success: return plane
    
    @staticmethod
    def Objectbbox(geom,xform):
        if isinstance(geom,rg.Point):
            pt=geom.Location
            if xform: pt = xform * pt
            return rg.BoundingBox(pt,pt)
        if xform: return geom.GetBoundingBox(xform)
        return geom.GetBoundingBox(True)
    
    #gets a plane-aligned bounding box
    @staticmethod
    def BoundingBoxPlane(objs,plane,ret_pts=False,accurate=True):

        wxy_plane=rg.Plane.WorldXY

        
        xform = rg.Transform.ChangeBasis(wxy_plane, plane)
        bbox = rg.BoundingBox.Empty
        if type(objs) is list or type(objs) is tuple:
            for obj in objs:
                objectbbox = EV.Objectbbox(obj, xform)
                bbox = rg.BoundingBox.Union(bbox,objectbbox)
        else:
            objectbbox = EV.Objectbbox(objs, xform)
            bbox = rg.BoundingBox.Union(bbox,objectbbox)
            
        if not bbox.IsValid: return
        plane_to_world = rg.Transform.ChangeBasis(plane,wxy_plane)
        if ret_pts:
            corners = list(bbox.GetCorners())
            for pt in corners: pt.Transform(plane_to_world)
            return corners
        else:
            box=rg.Box(bbox)
            box.Transform(plane_to_world)
            return box
    
    #this is the main 2D bb calculation search function
    @staticmethod
    def PlanarMinBB(objs,plane,tot_ang,divs):
        inc=tot_ang/divs
        #rotate plane half total angle minus direction
        plane.Rotate(-tot_ang*0.5,plane.ZAxis,plane.Origin)
        bb = EV.BoundingBoxPlane(objs,plane)
        curr_plane=rg.Plane(plane)
        curr_area=EV.BoxArea(bb)
        #loop through angle increments
        for i in range(divs):
            plane.Rotate(inc,plane.ZAxis,plane.Origin)
            bb = EV.BoundingBoxPlane(objs,plane)
            new_area=EV.BoxArea(bb)
            if new_area<curr_area:

                curr_area=new_area
                curr_plane=rg.Plane(plane)
        return curr_plane, curr_area
    
    #2D planar bounding rectangle routine
    @staticmethod
    def MinBoundingRectanglePlane(obj,curr_plane,im_rep=False):
        #pass True argument above if you want to print intermediate results
        #initialize
        factor=0.01 #0.01 (1/100 of model abs tolerance)
        angle=math.pi*0.5 #start angle 90 degrees
        divs=90  #initial division 1 degree intervals
        #tol = rd.ActiveDoc.ModelAbsoluteTolerance
        tol = 0.001
        #get initial rough bounding box
        init_bb=EV.BoundingBoxPlane(obj,curr_plane,ret_pts=False)
        curr_area=EV.BoxArea(init_bb)

        #main calculation loop
        safe=10 #set safety limit at 10
        for i in range(safe):
            curr_plane,new_area = EV.PlanarMinBB(obj,curr_plane,angle,divs)
            #abort if area is 0 or extremely small
            #if new_area<tol*0.1:
                #print err_msg ; return
            #break out of loop if new area is the same as prev. area within limit
            if abs(curr_area-new_area)<factor*tol: break
            #otherwise, decrease increments and loop
            curr_area=new_area
            angle*=(1/divs)
            
            
        f_bb=EV.BoundingBoxPlane(obj,curr_plane,ret_pts=True)
        return f_bb,curr_area,i
    
    #used for planar bounding rectangle calculation
    @staticmethod
    def BoxArea(box):
        return (box.X[1]-box.X[0])*(box.Y[1]-box.Y[0])
    
    #Combine function
    @staticmethod
    def GetOBB(G,N):
        
        obj = G
        plane=EV.CheckObjCoPlanarity(obj,tol=0.001)
        #launch planar bounding box routine
        f_bb,curr_area,passes=EV.MinBoundingRectanglePlane(obj,plane,False)
        #add polyline, report message
        bb=rg.Polyline([f_bb[0],f_bb[1],f_bb[2],f_bb[3],f_bb[0]])

        return bb
    
  
    ######################################################
    ################ Sort  Score Function  ###############
    ######################################################
       
    @staticmethod
    def SortStreamlines_Overall(streamlineNetwork):
        
        list = streamlineNetwork.network
        
        sortedList = list
        num = len(list)

        for i in range(num):

            for j in range(i+1,num):

                if list[i].scoreOverall < sortedList[j].scoreOverall:
                    swp = sortedList[i]
                    sortedList[i] = sortedList[j]
                    sortedList[j] = swp

                        
        return sortedList

    ######################################################
    ##########     Exclude  Special case    ##############
    ######################################################
    @staticmethod
    def ExcludeSpecialCase(parcFace,streamlines):
        # print "in ExcludeSpecialCase"
        # for edge in parcFace.edges:
        #     for pt in edge.GetGeometry():
        #         print pt.X,pt.Y,0
            
        #     print "-----" 
        
        # print "before cleanning",len(streamlines)
        tol = 0.01
        streamlines_Clean = []
        edgeGeos = [edge.GetGeometry() for edge in parcFace.edges]
        
  
        # count = 0
        for sl in streamlines:
            startTouchIndex = None 
            endTouchIndex = None
            # closestPtStarts = []
            # closestPtEnds = []
            # startDists = []
            # endDists = []
            for i in range(len(edgeGeos)):
                closestPtStart = edgeGeos[i].ClosestPoint(sl.First)
                #closestPtStarts.append(closestPtStart)
                
                #startDists.append(closestPtStart.DistanceTo(sl.First))
                if closestPtStart.DistanceTo(sl.First) <=tol: 
                    #print "sl.First",closestPtStart,closestPtStart.DistanceTo(sl.First)
                    startTouchIndex = i
                
                closestPtEnd = edgeGeos[i].ClosestPoint(sl.Last)
                #closestPtEnds.append(closestPtEnd)
                
                #endDists.append(closestPtEnd.DistanceTo(sl.Last))
                if closestPtEnd.DistanceTo(sl.Last) <=tol: 
                    #print "sl.Last",closestPtEnd,closestPtEnd.DistanceTo(sl.Last)
                    endTouchIndex = i
                    
                if startTouchIndex and endTouchIndex:
                    break
            
            # print "min startDists", min(startDists), "min endDists", min(endDists) 
            # print "closestPtStart"
            # for j in range(len(closestPtStarts)):
            #     print closestPtStarts[j],startDists[j]
            # print "closestPtEnd",
            # for j in range(len(closestPtEnds)):
            #     print closestPtEnds[j],endDists[j]
            # print "count",count,"startTouchIndex,endTouchIndex",startTouchIndex,endTouchIndex
            # for pt in sl:
            #     print pt.X,pt.Y,0
            # count+=1

            if startTouchIndex != endTouchIndex:
                streamlines_Clean.append(sl)
                
        # print "after cleanning",len(streamlines_Clean)
        return streamlines_Clean

    ######################################################
    ############    Store   Function       ###############
    ######################################################
    @staticmethod
    def GetAllScoreToInstance(SPF,SLG,parcFace,EDict_All,sameSideList,streamlineNetwork,streamlines,weight,idealOrientation,idealElongation=1.5,idealCompactness=1,idealConvexity=1):  

        #[CHEKC OR DEBUG] print ("parcFace.ID"),parcFace.ID, ("Get streamlines"),len(streamlines)

        ###################
        #### for diagram 
        ###################
        #SLG.PrintStreamlines(streamlines)
        
        ###################
        #### Exclude the Special case
        ###################
        streamlines = EV.ExcludeSpecialCase(parcFace,streamlines)
        
        ###################
        #### update info
        ###################
        parcFace.GetSide(EDict_All)
        parcFace.CombineSide(EDict_All,sameSideList)

        ###################
        #### Intinal Score
        ###################
        calcEA=True
        calcEL=True
        calcCP=False
        calcCV=False
        calcOR=True
        
        result_A = EV.Score_ParcelLevel_A(streamlines,parcFace.processMesh.triRemeshBoundary,idealElongation,idealCompactness,idealConvexity,idealOrientation,calcEA,calcEL,calcCP,calcCV,calcOR)
        
        
        if calcEA == True:
            score_EvenArea = result_A[0]                 # Considered into overall Score
            areaPairCollection = result_A[5]             # Store
        
        if calcEL == True:
            score_Elongation = result_A[1]               # Not considered into overall Score
            elongationPairCollection = result_A[6]       # Store
            
        if calcCP == True:   
            score_Compactness = result_A[2]              # Not considered into overall Score 
            compactnessPairCollection = result_A[7]      # Store   
            
        if calcCV == True:  
            score_Convexity = result_A[3]                # Not considered into overall Score
            convexityPairCollection = result_A[8]        # Store
        
        if calcOR == True:
            score_Orientation = result_A[4]              # Considered into overall Score
            orientationPairCollection = result_A[9]      # Store
 
     
        #Related with side num
        
       
        result_B = EV.Score_ParcelLevel_B(SPF,SLG,parcFace,streamlines,EDict_All)
        score_Continuity = result_B[0]
        score_SideNum = result_B[1]
        score_AngleVar = result_B[2]
        score_LengthVar = result_B[3]
        score_Access = result_B[4]
      
 
        ###################
        #### Remap
        ###################
        
  
        score_Continuity = EV.RemapRange(score_Continuity,1,0)
        score_SideNum = EV.RemapRange(score_SideNum,1,0)  
        score_AngleVar = EV.RemapRange(score_AngleVar,1,0) 
        score_LengthVar = EV.RemapRange(score_LengthVar,1,0)
        score_Access= EV.RemapRange(score_Access,0,1)
        score_EvenArea = EV.RemapRange(score_EvenArea,1,0)           # the smaller difference to 1， meaning its more even
        score_Orientation = EV.RemapRange(score_Orientation,1,0)     # the smaller difference, its better 

        
        score_OverallScore = EV.GetOverallScore([score_Continuity,score_SideNum,score_AngleVar,score_LengthVar,score_Access,score_EvenArea,score_Orientation],weight)
   
        ###################
        #### Assign
        ###################
        #Assign to each instance
        
        for i in range(len(streamlines)):
            sl = SLG.Streamline()
            sl.CreateStreamlineInstance(streamlines[i])
            
            
            sl.Continuity = score_Continuity[i]
            sl.scoreAngleVar = score_AngleVar[i]
            sl.scoreLengthVar = score_LengthVar[i]
            sl.scoreEvenArea = score_EvenArea[i]
            sl.scoreOrientation = score_Orientation[i]
            sl.scoreOverall = score_OverallScore[i]

            
            
            if calcOR == True:
                sl.orientationPair = orientationPairCollection[i]
            
            if calcEA == True:
                sl.areaPair =  areaPairCollection[i]
                if sl.areaPair[0] >= sl.areaPair[1]:
                    sl.evenAreaValue = sl.areaPair[1]/sl.areaPair[0]
                else:
                    sl.evenAreaValue = sl.areaPair[0]/sl.areaPair[1]
            
            
            if calcEL == True:
                sl.elongationPair = elongationPairCollection[i] 
            if calcCV == True:      
                sl.convexityPair = convexityPairCollection[i]  
            if calcCP == True:        
                sl.compactnessPair = compactnessPairCollection[i]     

            streamlineNetwork.network.append(sl)
# ---------- end ghpython_script_6 ----------
ghpython_script_7 = GhPythonScript()  # -> out, PL
# ---------- ghpython_script_7: Python ----------
###########################
####    Import Libs    ####
###########################
import Rhino.Geometry as rg
#import Rhino.RhinoDoc as rd
import Rhino.RhinoMath as rm
import Queue
import ghpythonlib.components as ghc
import math


###########################
####    Description    ####
###########################
### PL : Parcellation
### This is a library to construct the parcel data structure (For one parcel)

### Important concept: "Depth" ,"Deepcopy" for tree data structure 
### Each time we go deeper, we do a deep copy to avoid affecting data in the previous depth  
### Becasue edge contains vertices and points, parcel contains edges. Must use the current depth info to do the deep copy!
### Each depth has the unique dictionaries to store all the vertices,points,edges
 
 
### Important concept:"Twin" for own-made half-edge structure in the parcellation
### Tthere is no twin edge for naked edge. The feature is used frequently in the later processing.

###########################
####    Parcellation   ####
###########################
class PL:
    class ParcVertex:
        def __init__(self,vertex,ID):
            self.geometry = vertex                   # Type: Point3d
            self.ID = ID                             # Type: Int     It is unique regardless the depth.
            self.onBoundary = False                  # Type: Bool    If it is on the naked edges        
            self.original = False                    # Type: Bool    If it is orginal input from user
            self.depth = None                        # Type: Int     The depth when it's generated   
            
        def __del__(self):
            self.geometry = None
            self.ID = None
            self.onBoundary = None 
            self.original = None 
            self.depth = None
            
        def DeepCopy(self):
            newParcV = PL.ParcVertex(self.geometry,self.ID)
            newParcV.onBoundary = self.onBoundary 
            newParcV.original = self.original 
            newParcV.depth = self.depth
            return newParcV
        
    class ParcPoint:
        def __init__(self,point,ID):
            self.geometry = point                   # Type: Point3d
            self.ID = ID                            # Type: Int     It is unique regardless the depth.
            self.depth = None                       # Type: Int     The depth when it's generated  
            
        def __del__(self):
            self.geometry = None
            self.ID = None
            self.depth = None
          
        def DeepCopy(self):
            newParcPoint =  PL.ParcPoint(self.geometry,self.ID)
            newParcPoint.depth = self.depth
            return newParcPoint
    
    # This class is used when we want to simplfy the parcel, we want to keep some essential points that will affect the shape very much
    class ParcTurningPoint:
        def __init__(self,point,ID):
            self.geometry = point                   # Type: Point3d
            self.ID = ID                            # Type: Int     It is unique regardless the depth.
            self.onBoundary = False                 # Type: Bool    If it is on the naked edges        
            self.depth = None                       # Type: Int     The depth when it's generated   
            
        def __del__(self):
            self.geometry = None
            self.ID = None
            self.onBoundary = None 
            self.depth = None
                  
        def DeepCopy(self):
            newParcTurningPoint = PL.ParcTurningPoint(self.geometry,self.ID)
            newParcTurningPoint.depth = self.depth
            return newParcTurningPoint
    
    # This class is used when we want to simplfy the parcel    
    class ParcResamplePoint:
        def __init__(self,point,ID):
            self.geometry = point                   # Type: Point3d
            self.ID = ID                            # Type: Int     It is unique regardless the depth
            self.turning = False                    # Type: Bool    If it is converted from a turning point
            self.onBoundary = False                 # Type: Bool    If it is on the naked edges 
            self.depth = None                       # Type: Int     The depth when it's generated  
             
        def __del__(self):
            self.geometry = None
            self.ID = None
            self.turning = None                    
            self.onBoundary = None                
            self.depth = None                       
            
        def DeepCopy(self):
            newParcResamplePoint = PL.ParcResamplePoint(self.geometry,self.ID)
            newParcResamplePoint.depth = self.depth
            return newParcResamplePoint
        
    class ParcEdge:
        def __init__(self,ID):  
            self.startVertex = None                 # Type: ParcVertex                  Start vertex of an edge
            self.endVertex = None                   # Type: ParcVertex                  End vertex of an edge
            self.betweenPoints = []                 # Type: list<ParcPoint>             Points between start and end 
            self.turningPoints = []                 # Type: list<ParcTurningPoint>      Points that are essential
            self.resamplePoints = []                # Type: list<ParcResamplePoint>     Points that generated after simpification
            
            self.ID = ID                            # Type: Int                         It is unique regardless the depth
            self.twin = None                        # Type: ParcEdge                    Its twin edge. Currently it only store when it is processing, after deepcopy this info will gone. Becasue the new deep copied twinEdge can be retrieve by the ID
            self.twinID = None                      # Type: Int                         Its twin edge's ID
            self.parentID = None                    # Type: Int                         Its parent edge's ID
            self.childrenIDs = []                   # Type: list<Int>                   Its children edges' ID

            self.naked = False                      # Type: Bool                        If it is a naked edge 
            
            self.isValid = True                     # Type: Bool                        This is important. If the start and end are too close, the length is 0 and it becomes invalid. It sometimes happened in merging/spliting.
            
            self.depth = None                       # Type: Int                         The depth when it's generated  
            self.generation = None                  # Type: Int                         This differs from depth, it record the intial depth that this is generated, meaing it won't be affected by deepcopy
            
            self.isStreet = False                   # Type: Bool                        If it is on a street 
            self.streetID = None                    # Type: Bool                        If it is on a street , record the streetID
            
            self.offsetDistance = 0                 # Type: Float                       The offset distance assigned to this edge
            self.hierarchy = None                   # Type: Int                         The road hierarchy/category
     
        def __del__(self):
            self.startVertex = None                 
            self.endVertex = None                   
            self.betweenPoints = None              
            self.turningPoints = None               
            self.resamplePoints = None             
            
            self.ID = None                      
            self.twin = None                       
            self.twinID = None                      
            self.parentID = None                    
            self.childrenIDs = None                   

            self.naked = None                     
            
            self.isValid = None                     
            
            self.depth = None                       
            self.generation = None                 
            
            self.isStreet = None                 
            self.streetID = None                   
            
            self.offsetDistance = None             
            self.hierarchy = None                  

        # After initialization, store the vertices and between points
        def FillInfo(self,list):
            for i in range(len(list)):
                if i == 0:
                    self.startVertex = list[0]
                elif i == len(list)-1:
                    self.endVertex = list[len(list)-1]
                else:
                    self.betweenPoints.append(list[i])
        
        # Reverse the order, vertices and between points
        def Reverse(self):
            temp=self.startVertex
            self.startVertex=self.endVertex
            self.endVertex=temp
            self.betweenPoints.reverse()
        
        # Create a twin Edge. Reminder : there is no twin edge for naked edge. The feature is used frequently in the later processing.   
        def CreateTwin(self,ID):
            newEdge = PL.ParcEdge(ID)
            newEdge.startVertex = self.endVertex
            newEdge.endVertex = self.startVertex
            for i in range(len(self.betweenPoints)-1,-1,-1):

                newEdge.betweenPoints .append(self.betweenPoints[i])
            
            newEdge.twin = self
            newEdge.twinID = self.ID
            self.twin = newEdge
            self.twinID = ID
            
            return newEdge
                    
        def DeepCopy(self,PV_Dict):
            # Step 1: Make sure it is using current PV_Dict (points and vertices dictionary)
            # Step 2: Create Edge 
            # Step 3: Redirect to get the twin edge address, becasue now the twin edge might not has been created. (Optional, now the script does call twin edge directly. Twin edge is called by twinID)
            
            # Initialize 
            newEdge = PL.ParcEdge(self.ID)
            
            # Store Info
            newEdge.startVertex = PV_Dict[self.startVertex.ID]
            newEdge.endVertex = PV_Dict[self.endVertex.ID]
            for bPt in self.betweenPoints:
                newEdge.betweenPoints.append(PV_Dict[bPt.ID])
   
            newEdge.naked = self.naked
            newEdge.isValid = self.isValid
            
            newEdge.depth = self.depth
            newEdge.generation = self.generation
            
            newEdge.offsetDistance = self.offsetDistance
            newEdge.hierarchy = self.hierarchy
            
            newEdge.twinID = self.twinID
            newEdge.childrenIDs = [id for id in self.childrenIDs]
            newEdge.parentID = self.parentID
            
            newEdge.isStreet = self.isStreet
            newEdge.streetID = self.streetID
            
            return newEdge
        
        # This is a help function to track the edge's ancestor's ID  
        def FindAncestorEdgeID(self,EDict_All):
            ancestorID = None
            queue =Queue.Queue()
            queue.put(self)
            while (queue.empty()!=True):
                node = queue.get()
                ancestorID = node.ID
                if node.parentID != None:
                    queue.put(EDict_All[node.parentID]) 
            return ancestorID
        
        # Use a shareEdge to split the naked edge 
        # Named normal is becasue of there is "Special case", but it has been reduced on purpose. But the name is kept for consitency 
        def SplitEdge_Naked_Normal(self,shareEdge,newV,choice,E_Dict,E_Dict_All,VP_Dict):
            
            # Retreive the twin edge by twinID 
            shareEdgeTwin = E_Dict[shareEdge.twinID]
            
            # Check if newV is too close to exsiting Vertex, meaning it need to do a merge action
            # Remember to check either start or end to merge
            distToStart = newV.geometry.DistanceTo(self.startVertex.geometry)
            distToEnd = newV.geometry.DistanceTo(self.endVertex.geometry)
            if distToStart<0.01:

                theNewEdge = E_Dict[self.ID]
                newV =  theNewEdge.startVertex
                if choice == "start":
                    shareEdge.startVertex = newV
                    shareEdgeTwin.endVertex = newV
                elif choice == "end":
                    shareEdge.endVertex = newV  
                    shareEdgeTwin.startVertex = newV

                # [CHECK or DEBUG]
                # print ("VV too close happened!")
                # print ("shareEdge.startVertex"),shareEdge.startVertex.geometry.X,shareEdge.startVertex.geometry.Y,0
                # print ("shareEdge.endVertex"),shareEdge.endVertex.geometry.X,shareEdge.endVertex.geometry.Y,0
                # print ("newV"),newV.geometry.X,newV.geometry.Y,0

            elif distToEnd<0.01:
          
                theNewEdge = E_Dict[self.ID]

                newV =  theNewEdge.endVertex
                if choice == "start":
                    shareEdge.startVertex = newV
                    shareEdgeTwin.endVertex = newV
                elif choice == "end":
                    shareEdge.endVertex = newV  
                    shareEdgeTwin.startVertex = newV

                # [CHECK or DEBUG]
                # print ("VV too close happened!")
                # print ("shareEdge.startVertex"),shareEdge.startVertex.geometry.X,shareEdge.startVertex.geometry.Y,0
                # print ("shareEdge.endVertex"),shareEdge.endVertex.geometry.X,shareEdge.endVertex.geometry.Y,0
                # print ("newV"),newV.geometry.X,newV.geometry.Y,0
            
            # Create new ID for the edge, initialze, copy or store neccessary data
            currMaxID = max(E_Dict.Keys)
            newEdge_1 = PL.ParcEdge(currMaxID+1)
            newEdge_2 = PL.ParcEdge(currMaxID+2)
            
            newEdge_1.startVertex = self.startVertex
            newEdge_1.endVertex = newV
            
            newEdge_2.startVertex = newV
            newEdge_2.endVertex = self.endVertex
            
            newEdge_1.generation = self.generation
            newEdge_2.generation = self.generation
            
            newEdge_1.naked = self.naked
            newEdge_2.naked = self.naked
            
            if newEdge_1.startVertex == newEdge_1.endVertex:
                newEdge_1.isValid = False
            if newEdge_2.startVertex == newEdge_2.endVertex:
                newEdge_2.isValid = False

            newEdges = [newEdge_1,newEdge_2]
            for edge in newEdges:
                self.childrenIDs.append(edge.ID)
                edge.parentID = self.ID

                edge.isStreet = self.isStreet
                edge.streetID = self.streetID

            # Store them into current dictionary 
            E_Dict[newEdge_1.ID] = newEdge_1
            E_Dict[newEdge_2.ID] = newEdge_2
            
            E_Dict_All[newEdge_1.ID] = newEdge_1
            E_Dict_All[newEdge_2.ID] = newEdge_2
            

            # [CHECK or DEBUG]
            #print ("in SplitEdge_Naked_Normal")
            #print ("E_Dict.pop(self.ID):", self.ID , id(E_Dict[self.ID]))
            # Remove the split edge
            E_Dict.pop(self.ID)
            
            
            newEdge_1.hierarchy = self.hierarchy
            newEdge_2.hierarchy = self.hierarchy
            return newEdge_1,newEdge_2
        
        # Use a shareEdge to split the naked edge 
        # Named normal is becasue of there is "Special case", but it has been reduced on purpose. But the name is kept for consitency 
        def SplitEdge_Shared_Normal(self,shareEdge,newV,choice,E_Dict,E_Dict_All,VP_Dict,indexPair):
            
            # Retreive the twin edge by twinID 
            shareEdgeTwin = E_Dict[shareEdge.twinID]
            
            # Check if newV is too close to exsiting Vertex, meaning it need to do a merge action. Remember to change the twin shareEdge!
            # Remember to check either start or end to merge
            distToStart = newV.geometry.DistanceTo(self.startVertex.geometry)
            distToEnd = newV.geometry.DistanceTo(self.endVertex.geometry)
            
            # [CHECK or DEBUG]
            # print ("VV too close happened!")
            # print ("shareEdge.startVertex"),shareEdge.startVertex.geometry.X,shareEdge.startVertex.geometry.Y,0
            # print ("shareEdge.endVertex"),shareEdge.endVertex.geometry.X,shareEdge.endVertex.geometry.Y,0
            # print ("newV"),newV.geometry.X,newV.geometry.Y,0
            
            if distToStart<0.01:
                theNewEdge = E_Dict[self.ID]
                newV =  theNewEdge.startVertex
                if choice == "start":
                    shareEdge.startVertex = newV
                    shareEdgeTwin.endVertex = newV                                  
                elif choice == "end":
                    shareEdge.endVertex = newV  
                    shareEdgeTwin.startVertex = newV   
  
                # [CHECK or DEBUG]
                # print ("VV too close happened!")
                # print ("shareEdge.startVertex"),shareEdge.startVertex.geometry.X,shareEdge.startVertex.geometry.Y,0
                # print ("shareEdge.endVertex"),shareEdge.endVertex.geometry.X,shareEdge.endVertex.geometry.Y,0
                # print ("newV"),newV.geometry.X,newV.geometry.Y,0

            elif distToEnd<0.01:
                theNewEdge = E_Dict[self.ID]
                newV =  theNewEdge.endVertex
                if choice == "start":
                    shareEdge.startVertex = newV
                    shareEdgeTwin.endVertex = newV
                elif choice == "end":
                    shareEdge.endVertex = newV    
                    shareEdgeTwin.startVertex = newV

                # [CHECK or DEBUG]
                # print ("VV too close happened!")
                # print ("shareEdge.startVertex"),shareEdge.startVertex.geometry.X,shareEdge.startVertex.geometry.Y,0
                # print ("shareEdge.endVertex"),shareEdge.endVertex.geometry.X,shareEdge.endVertex.geometry.Y,0
                # print ("newV"),newV.geometry.X,newV.geometry.Y,0

            currMaxID = max(E_Dict.keys())
            all = self.GetVPInstance()

            #  ID gap left for their twins, so it is +1 and +3
            newEdge_1 = PL.ParcEdge(currMaxID+1)
            newEdge_2 = PL.ParcEdge(currMaxID+3)
            
            # Fill info for newEdge_1
            newEdge_1.startVertex = self.startVertex
            newEdge_1.endVertex = newV
            
            for i in range(len(all)):
                if i!=0 and i !=len(all)-1 and i <= indexPair[0]:
                    newEdge_1.betweenPoints.append(all[i])
                    
            # check if the last seg length is too short
            if newEdge_1.betweenPoints != []:
                dist = newEdge_1.betweenPoints[-1].geometry.DistanceTo(newV.geometry)
                if dist < 0.01:
                    print ("VP too close happened!")
                    newEdge_1.betweenPoints.pop() 
                    
                    
            # fill info for newEdge_2
            newEdge_2.startVertex = newV
            newEdge_2.endVertex = self.endVertex
   
            for i in range(len(all)):
                if i!=0 and i !=len(all)-1 and i >= indexPair[1]:
                    newEdge_2.betweenPoints.append(all[i])
                    
            # check if the last seg length is too short
            if newEdge_2.betweenPoints != []:
                dist = newEdge_2.betweenPoints[0].geometry.DistanceTo(newV.geometry)
                if dist < 0.01:
                    print ("VP too close happened!")
                    #print newEdge_2.betweenPoints[-1].geometry.X,newEdge_2.betweenPoints[-1].geometry.Y,newEdge_2.betweenPoints[-1].geometry.Z
 
                    newEdge_2.betweenPoints.pop(0) 
                    
                
            # Create twins
            newEdge_1_twin = newEdge_1.CreateTwin(currMaxID+2)
            newEdge_2_twin = newEdge_2.CreateTwin(currMaxID+4)
            
            # Fill info for twins
            newEdge_1.generation = self.generation
            newEdge_1_twin.generation = self.generation
            newEdge_2.generation = self.generation
            newEdge_2_twin.generation = self.generation
            
            newEdge_1.naked = self.naked
            newEdge_1_twin.naked = self.naked
            newEdge_2.naked = self.naked
            newEdge_2_twin.naked = self.naked

            if newEdge_1.startVertex== newEdge_1.endVertex:
                newEdge_1.isValid = False
            if newEdge_2.startVertex== newEdge_2.endVertex:
                newEdge_2.isValid = False
            if newEdge_1_twin.startVertex== newEdge_1_twin.endVertex:
                newEdge_1_twin.isValid = False
            if newEdge_2_twin.startVertex== newEdge_2_twin.endVertex:
                newEdge_2_twin.isValid = False
                

            newEdges = [newEdge_1,newEdge_1_twin,newEdge_2,newEdge_2_twin]
            for edge in newEdges:
                edge.parentID = self.ID
                edge.streetID = self.streetID
                
                edge.isStreet = self.isStreet
                edge.streetID = self.streetID
                
            self.childrenIDs.append(newEdge_1.ID)
            self.childrenIDs.append(newEdge_2.ID)
            E_Dict[self.twinID].childrenIDs.append(newEdge_2_twin.ID)  # Remeber to add for its twin edge
            E_Dict[self.twinID].childrenIDs.append(newEdge_1_twin.ID)   # Remeber to add for its twin edge

            # Store in Dict
            E_Dict[newEdge_1.ID] = newEdge_1
            E_Dict[newEdge_1_twin.ID] = newEdge_1_twin
            E_Dict[newEdge_2.ID] = newEdge_2
            E_Dict[newEdge_2_twin.ID] = newEdge_2_twin
            
            E_Dict_All[newEdge_1.ID] = newEdge_1
            E_Dict_All[newEdge_1_twin.ID] = newEdge_1_twin
            E_Dict_All[newEdge_2.ID] = newEdge_2
            E_Dict_All[newEdge_2_twin.ID] = newEdge_2_twin
            
            # Remove the split edge , pop the twin edge LATER! 
            # [CHECK or DEBUG]
            #print ("in SplitEdge_Shared_Normal")
            #print ("E_Dict.pop(self.ID)"),self.ID, ("self.twinID"),self.twinID
            E_Dict.pop(self.ID)

            
            
            newEdge_1.hierarchy = self.hierarchy
            newEdge_1_twin.hierarchy = self.hierarchy
            newEdge_2.hierarchy = self.hierarchy
            newEdge_2_twin.hierarchy = self.hierarchy
            
            return newEdge_1,newEdge_1_twin,newEdge_2,newEdge_2_twin

        
        ###########
        # This set is to get the geometry. Defalut is to build a polyline with vertices and points. Later it comes with different versions for different needs.
        ###########
        def GetGeometry(self):
            allPoints=[]
            
            
            allPoints.append(self.startVertex.geometry)
            
            if self.betweenPoints != []:
                for point in self.betweenPoints:
                    allPoints.append(point.geometry)
                    
            allPoints.append(self.endVertex.geometry)
            
            return rg.Polyline(allPoints)

        def GetGeometry_Simplified(self):
            return rg.Line(self.startVertex.geometry,self.endVertex.geometry)
        
        def GetGeometry_SimplifiedWithTurningPoints(self):
            v_Geo = []
            v_Geo.append(self.startVertex.geometry)
            if self.turningPoints!=[]:
                for tPt in self.turningPoints:   
                    v_Geo.append(tPt.geometry)
            
            v_Geo.append(self.endVertex.geometry)
            
            if len(v_Geo) == 2:
                newPolyL = rg.Polyline(2)
                newPolyL.Add(v_Geo[0])
                newPolyL.Add(v_Geo[1])
                return newPolyL
            else:
                return rg.Polyline(v_Geo)

        def GetGeometry_SimplifiedWithResamplePoints(self):
            allPoints=[]

            allPoints.append(self.startVertex.geometry)
            
            if self.resamplePoints != []:
                for point in self.resamplePoints:
                    allPoints.append(point.geometry)
                    
            allPoints.append(self.endVertex.geometry)
            
            return rg.Polyline(allPoints)
        
        ###########
        # This set is to get the vertices and points info. Defalut is to vertices and points info. Later it comes with different versions for different needs.
        ###########                    
        def GetVPID(self):
            allPoints=[]
            allPoints.append(self.startVertex.ID)
            
            if self.betweenPoints != None:
                for point in self.betweenPoints:
                    allPoints.append(point.ID)
            
            ### small differentfrom the parcFace method, need to get the last vertex 
            allPoints.append(self.endVertex.ID)
            return allPoints
            
        def GetVPInstance(self):
            allPoints=[]
            allPoints.append(self.startVertex)
            
            if self.betweenPoints != None:
                for point in self.betweenPoints:
                    allPoints.append(point)
            
            ### small differentfrom the parcFace method, need to get the last vertex 
            allPoints.append(self.endVertex)
            return allPoints
        
        def GetVPInstance_Resample(self):
            allPoints=[]
            allPoints.append(self.startVertex)
            
            if self.resamplePoints != None:
                for point in self.resamplePoints:
                    allPoints.append(point)
            
            ### small differentfrom the parcFace method, need to get the last vertex 
            allPoints.append(self.endVertex)
            return allPoints

    class ParcFace:
        def __init__(self):
            self.ID = None                   # Type: Int     It is unique regardless the depth.               
            self.depth = None                # Type: Int     The depth when it's generated.  
            
            self.processMesh = None          # Type: ProcessMesh     The ProcessMesh that used to 
            self.triangleSize = None         # Type: Float          The triangle Size that is used for this triangluation
            
            self.vertices = []               # Type: list<ParcVertex>          Store the vertices
            self.edges = []                  # Type: list<ParcEdge>            Store the edges, reminder: it is different from sides. In same cases they are the same
            self.sides = []                  # Type: list<list<float>>         Store the indices of the edges in the parcel that should be considered as one SIDE    Reminder: it is index, not ID 
                  
            self.sortedSL = None             # Type: list<Streamline>          Store the sorted Streamline instances based on overall score order
            
            self.situation = 0               # Type: Int                       If self.situation = 1: choose to use a specific streamline instead of choosing by evluation    
            self.startPt = None              # Type: Point3d                   Store the position where this parcel is touched 
            self.specificStreamline = None   # Type: Polyline                  Store this specific streamline     
            
            self.alive = True                # Type: bool                      If it should still be split, or hit the stop condition    
            self.identity = None             # Type: str                       "A" or "B" mean it is a split result, "C" means it is a "dead node copy" of its parent 
            self.parent = None               # Type: ParcFace                  Store its parent ParcFace
            self.child_A = None              # Type: ParcFace                  Store its child ParcFace
            self.child_B = None              # Type: ParcFace                  Store its child ParcFace
            self.child_C = None              # Type: ParcFace                  Store its  a "dead node copy" of itself 
            
            self.neighbors = []              # Type: list<ParcFace>            Store its neighbor ParcFace
            self.mutualE_P = {}              # Type: dict<ParcEdge：ParcFace>            Store its neighbor ParcFace and the mutual ParcEdge
            self.mutualP_E = {}              # Type: dict<ParcFace：ParcEdge>            Store its neighbor ParcFace and the mutual ParcEdge
            
            self.accessible = False          # Type: bool                      If it is accessible
       
        def __del__(self):
            self.ID = None                                 
            self.depth = None               
            
            self.processMesh = None          
            self.triangleSize = None        
            
            self.vertices = None              
            self.edges = None                  
            self.sides = None            
                  
            self.sortedSL = None            
            
            self.situation = None               
            self.startPt = None             
            self.specificStreamline = None  
            
            self.alive = None                   
            self.identity = None             
            self.parent = None              
            self.child_A = None             
            self.child_B = None             
            self.child_C = None              
            
            self.neighbors = None               
            self.mutualE_P = None             
            self.mutualP_E = None        
            
            self.accessible = False         
        
        def FormParcFace_First(self,input,ID,catList=None):
                    #The first input only have vertices
                    input,reverseTag = self.MakeCounterClockwiseDirection(input)
                    
                    #Prepare the cat info
                    if catList!=None:
                        if reverseTag == True:
                            catList.reverse()
                                
                    inputVertices=[]
                    for index in range(len(input)-1):
                        inputVertices.append(input[index])
                        
                    vertices=[]
                    for index in range(len(inputVertices)):
                        vertex = PL.ParcVertex(inputVertices[index],index)
                        vertex.original = True
                        vertex.onBoundary = True
                        vertex.depth = 0
                        vertices.append(vertex)
                        

                    self.vertices = vertices
                    
                    edges=[]
                    
                    edgeCount = 0
                    

                                
                    
                    for i in range(len(self.vertices)):
                        edge=PL.ParcEdge(edgeCount)
                        edge.depth = 0
                        edge.naked = True ### for road hierarchy
                        
                        
                        if catList!=None and catList!=[]:
                            edge.hierarchy = catList[i]

                        if i !=len(self.vertices)-1:
                            edge.startVertex = self.vertices[i]
                            edge.endVertex = self.vertices[i+1]
                            
                        else:
                            edge.startVertex = self.vertices[i]
                            edge.endVertex = self.vertices[0]
                        edges.append(edge)
                        
                        edgeCount+=1
                    
                    
                    self.edges=edges
                    self.depth = 0
                    self.roads = edges
                    self.roadIDs = [edge.ID for edge in self.edges]
                    self.accessible = True
                    
                    ####for graph
                    self.ID = ID
                    
                    ####for roadFinding
                    for edge in self.edges:
                        self.sides.append([edge.ID])
       
        def InitializeParcFaceWithID(self,F_Dict):
            self.ID = max(F_Dict.keys())+1
            F_Dict[self.ID]  = self
  
        def DeepCopy(self,VP_Dict,E_Dict,E_Dict_All):
            newParcFace = PL.ParcFace()
            
            newParcFace.identity = self.identity
            for edge in self.edges:
                #Add vertices 
                newParcFace.AddFaceV(VP_Dict[edge.startVertex.ID])
                
                
                newEdge = E_Dict[edge.ID]
         
                newParcFace.edges.append(newEdge)
            
            newParcFace.sortedSL = self.sortedSL
            newParcFace.specificStreamline = self.specificStreamline 
            
            newParcFace.alive = self.alive
            
            newParcFace.child_A = self.child_A
            newParcFace.child_B = self.child_B
            newParcFace.child_C = self.child_C    ### This is to store Dead Node
            
            newParcFace.parent = self.parent     # parent is correct , no need to change
            
            #if self.alive == False:
                #newParcFace.depth = self.depth +1        ### this might cause +2: from working - >solution, from solution -> working
            #else:
            newParcFace.depth = self.depth 
                
            newParcFace.neighbors = []
            for neigbor in self.neighbors:
                newParcFace.neighbors.append(neigbor)
            # neighbors is linking to previous depth, need to relink ### be careful, this need to append one by one
            
            newParcFace.mutualE_P = {}
            for key in self.mutualE_P:
                newParcFace.mutualE_P[key] = self.mutualE_P[key]

            newParcFace.mutualP_E = {}
            for key in self.mutualP_E:
                newParcFace.mutualP_E[key] = self.mutualP_E[key]

            newParcFace.situation = self.situation
            newParcFace.triangleSize = self.triangleSize

            if self.startPt != None:
                startPtID = self.startPt.ID
                newParcFace.startPt = VP_Dict[startPtID]
            
            ### for road finding 
            newParcFace.accessible = self.accessible

            ### for graph
            newParcFace.ID = self.ID
          

            ### find side
            newParcFace.sides = self.sides
            return newParcFace
        
        ###########
        # Fill up the lacking info
        ###########
        # A help function
        def MakeCounterClockwiseDirection(self,inputPolyline):
            inputPolyline_copy = rg.Polyline(inputPolyline)
            inputPolylineCurve = inputPolyline_copy.ToPolylineCurve()
            if inputPolylineCurve.ClosedCurveOrientation().ToString() == "Clockwise":
                inputPolyline_copy.Reverse()
                tag = True
            else:
                tag = False
                pass
            
            return inputPolyline_copy,tag

        # Insert a item into self.vertices
        def AddFaceV(self,item):
            self.vertices.append(item)
          
        # Get the side info. Reminder: "side" is not "edge"
        def GetSide(self,EDict_All):
            ancestorIDs = []
            for edge in self.edges:
                ancestorIDs.append(edge.FindAncestorEdgeID(EDict_All))
            
            ### Cluster 
            clusters = []  
            sides = []
            for i in range(len(ancestorIDs)):
                element = ancestorIDs[i]
                parcEdge = self.edges[i]
                if not any(element in cluster for cluster in clusters):
                    # if element is not in exsiting list 
                    clusters.append([element])
                    sides.append([parcEdge.ID])
                else:
                    # if element is in exsiting list 
                    for i in range(len(clusters)):
                        currCluster = clusters[i]
                        currSide = sides[i]
                        if element in currCluster:
                            currCluster.append(element)
                            currSide.append(parcEdge.ID)
                            break
            
            self.sides = sides

        # According to the defined "same side list(detemine which intial edges should be consider as a side)", combine side info
        def CombineSide(self,EDict_All,sameSideList):
            sides = self.sides
            newSides = []
            sameSideCollection = {}
            for sideIndex in range(len(sides)):
                currSide = sides[sideIndex]
                
                ### check the first edge
                thisEdge = EDict_All[currSide[0]]
                ancestorEdgeID = thisEdge.FindAncestorEdgeID(EDict_All)
                
                for i in range(len(sameSideList)):
                    sameSide = sameSideList[i]
                    if ancestorEdgeID in sameSide:
                        sameSideIndex = i
                        if sameSideIndex not in sameSideCollection.keys():
                            sameSideCollection[sameSideIndex] = []
                            sameSideCollection[sameSideIndex].append(thisEdge.ID)
                            newSides.append(sameSideCollection[i])
                            
                        elif sameSideIndex  in sameSideCollection.keys():
                            sameSideCollection[sameSideIndex].append(thisEdge.ID)
                            
                        break 
                else:
                    newSides.append(currSide)
            
            self.sides = newSides
   

        def UpdateAffectedInfo_Normal(self,shareEdge,affectedEdge,newEdges,currEDict,choice):
            ### step1: Get the affectedEdge'twin 
            ### step2: Detect the insert position(id or indices) on this edge, get the pair
            
            ### step 3&4:insert new Edges , be careful ,these should be the twin version, delete the affected edge,  insert the new vertex to vertices List  (switch step4)  
            ### step5: remove the affected Edge from currE dict (the twin Edge has been poped previously)
        
            tol = 0.001
            ### STEP1
            targetEdge = affectedEdge.twin
            if choice == "start":
                checkPt = shareEdge.startVertex
            elif choice == "end":
                checkPt = shareEdge.endVertex
                
            ### STEP2
            if len(targetEdge.betweenPoints) == 0:
                pass
                ### impossible, only the boundary edge has no betweenPoints
            
            elif len(targetEdge.betweenPoints) != 0:
                all = targetEdge.GetVPInstance()

                for i in range(len(all)-1):
                    segment = rg.Line(all[i].geometry,all[+1].geometry)
                    if segment.DistanceTo(checkPt.geometry,True)<tol:
                        insertPair = [i,i+1] ### this is index on Edge, not ID
                    
            ### STEP 3&4
            # insert edges
            edgeReplaceIndex = self.edges.index(targetEdge)
            if newEdges[3].isValid == True:
                self.edges.insert(edgeReplaceIndex,newEdges[3])  ### insert the twin one
            if newEdges[1].isValid == True:
                self.edges.insert(edgeReplaceIndex+1,newEdges[1]) ### insert the twin one
            self.edges.remove(targetEdge)  ### remove the old one
            
            # insert vertices
            newVertices = []
            for pE in self.edges:
                newVertices.append(pE.startVertex)
            
            self.vertices = newVertices
  
            ### STEP5
            currEDict.pop(targetEdge.ID) ### Reminder: (the twin Edge has been poped previously)
 
        ###########
        # This set is to get the parcel geometry. Defalut is to build a polyline with vertices and points. Later it comes with different versions for different needs.
        ###########
        def GetGeometry(self):
            all=[]
            
            for edge in self.edges:
                all.append(edge.startVertex.geometry)
                
                for point in edge.betweenPoints:
                    all.append(point.geometry)
            

            all.append(self.vertices[0].geometry)
            
            return rg.Polyline(all)
        
        def GetGeometry_Simplified(self): 

            vertices = self.vertices
            v_Geo = [v.geometry for v in vertices]
            v_Geo.append(v_Geo[0])
            
            return rg.Polyline(v_Geo)

        def GetGeometry_SimplifiedWithTurningPoints(self): 
            v_Geo = []
            for edge in self.edges:
                
                v_Geo.append(edge.startVertex.geometry)
                if edge.turningPoints!=[]:
                    for tPt in edge.turningPoints:
                            
                        v_Geo.append(tPt.geometry)
            
            v_Geo.append(v_Geo[0])

            return rg.Polyline(v_Geo)
    
        def GetGeometry_SimplifiedWithResamplePoints(self):
            v_Geo = []
            for edge in self.edges:
                
                v_Geo.append(edge.startVertex.geometry)
                if edge.resamplePoints!=[]:
                    for rPt in edge.resamplePoints:
                            
                        v_Geo.append(rPt.geometry)
            
            v_Geo.append(v_Geo[0])

            return rg.Polyline(v_Geo)
        
        def GetSideGeometry(self):
            sideGeometry = []
            for side in self.sides:
                thisSidePEs = []
                for edgeIndex in side:
                    for edge in self.edges:
                        if edgeIndex == edge.ID:
                            thisSidePEs.append(edge)
                
                thisSidePts =[]
                for pE in thisSidePEs:
                    thisSidePts.append(pE.startVertex.geometry)
                    for rPt in pE.betweenPoints:
                        thisSidePts.append(rPt.geometry)
                    
                thisSidePts.append(thisSidePEs[-1].endVertex.geometry)
                sideGeometry.append(rg.Polyline(thisSidePts))
            
            return sideGeometry
        
        def GetSideGeometry_Resample(self):
            sideGeometry = []
            for side in self.sides:
                thisSidePEs = []
                for edgeIndex in side:
                    for edge in self.edges:
                        if edgeIndex == edge.ID:
                            thisSidePEs.append(edge)
                
                thisSidePts =[]
                for pE in thisSidePEs:
                    thisSidePts.append(pE.startVertex.geometry)
                    for rPt in pE.resamplePoints:
                        thisSidePts.append(rPt.geometry)
                    
                thisSidePts.append(thisSidePEs[-1].endVertex.geometry)
                sideGeometry.append(rg.Polyline(thisSidePts))
            
            return sideGeometry
                    
        def GetSideGeometry_Simplified(self):
            sideGeometry = []
            for side in self.sides:
                thisSidePEs = []
                for edgeIndex in side:
                    for edge in self.edges:
                        if edgeIndex == edge.ID:
                            thisSidePEs.append(edge)
                
                thisSidePts =[]
                for pE in thisSidePEs:
                    thisSidePts.append(pE.startVertex.geometry)

                thisSidePts.append(thisSidePEs[-1].endVertex.geometry)
                sideGeometry.append(rg.Polyline(thisSidePts))
            
            return sideGeometry            
        
        ###########
        # This set is to get the info of Vertices, Points, Edges.. 
        ###########
        def GetVPID(self):
            all=[]
            
            for edge in self.edges:
                all.append(edge.startVertex.ID)
                
                for point in edge.betweenPoints:
                    all.append(point.ID)
                    
  
            return all
            
        def GetVID(self):
            all=[]
            for v in self.vertices:
                all.append(v.ID)
            return all
        
        def GetVPInstance(self):
            all=[]
            
            for edge in self.edges:
                all.append(edge.startVertex)
                
                for point in edge.betweenPoints:
                    all.append(point)
                    

            return all
            
        def GetVPGeo(self):
            all=[]
            
            for edge in self.edges:
                all.append(edge.startVertex.geometry)
                for point in edge.betweenPoints:
                    all.append(point.geometry)
            
            return all
        
        def GetVPID_SimplifiedWithResamplePoints(self):
            all=[]
            
            for edge in self.edges:
                all.append(edge.startVertex.ID)
                
                for point in edge.resamplePoints:
                    all.append(point.ID)
       
            return all
        
        def GetVPInstance_SimplifiedWithResamplePoints(self):
            all=[]
            
            for edge in self.edges:
                all.append(edge.startVertex)
                
                for point in edge.resamplePoints:
                    all.append(point)
  
            return all
        
        def GetVPGeo_SimplifiedWithResamplePoints(self):
            all=[]
            
            for edge in self.edges:
                all.append(edge.startVertex.geometry)
                for point in edge.resamplePoints:
                    all.append(point.geometry)
            
            return all
        
        def GetVPID_SimplifiedWithTurningPoints(self):
            all=[]
            
            for edge in self.edges:
                all.append(edge.startVertex.ID)
                
                for point in edge.turningPoints:
                    all.append(point.ID)
 
            return all
        
        def GetVPInstance_SimplifiedWithTurningPoints(self):
            all=[]
            
            for edge in self.edges:
                all.append(edge.startVertex)
                
                for point in edge.turningPoints:
                    all.append(point)

            return all
        
        def GetVPGeo_SimplifiedWithTurningPoints(self):
            all=[]
            
            for edge in self.edges:
                all.append(edge.startVertex.geometry)
                for point in edge.turningPoints:
                    all.append(point.geometry)
            
            return all
            
        def GetVPInstance_Simplified(self):
            all=[]
            
            for edge in self.edges:
                all.append(edge.startVertex)

            #all.append(self.vertices[0])
            return all
        
        def GetEID(self):
            all=[]
            for edge in self.edges:
                
                all.append(edge.ID)
            return all
            
        def GetEInstance(self):
            all=[]
            for edge in self.edges:
                all.append(edge)
            return all
# ---------- end ghpython_script_7 ----------
ghpython_script_8 = GhPythonScript()  # -> out, SPF
# ---------- ghpython_script_8: Python ----------
###########################
####    Import Libs    ####
###########################
import Rhino.Geometry as rg
import Rhino.RhinoDoc as rd
import Rhino.RhinoMath as rm
import Rhino.RhinoApp as ra

from collections import deque 
import Queue
import math



###########################
####    Description    ####
###########################
### SPF : Split ParcFace
### This is a library to split the ParcFace and reconstruct new ParcFace
### Reminder : The construction process follows a counterclockwise order
### Key Concept : There is a "Solution space" to store each depth's results. When we want to proceed to the next depth split, we need to conduct a deep copy for the whole depth into "Working space"
###               When the node are deeply copied from "Solution space" to "Working space" or vice versa, the parent,children,neighbors... those relationship need to be redirected to the correct node!


class SPF:

    ######################################
    ####           Speed Up           ####
    ######################################

    # If the node' area is less than min area, we can mark them "Dead" in advance.
    @staticmethod
    def KillNodesInAdvance(currQ,minArea):
        for node in currQ:
            if node.alive == True:
                parcelGeo = node.GetGeometry()
                if rg.AreaMassProperties.Compute(parcelGeo.ToPolylineCurve()).Area < 2*minArea:
                    node.alive == False
    
    # If all nodes are "Dead", return a tag that indicates to stop the loop               
    @staticmethod
    def CheckIfAllNodesDead(currQ):
        checkAlive = []
        for node in currQ:
            checkAlive.append(node.alive)
        if True not in checkAlive:
            return True
        else:
            return False
   
   
    ######################################
    ####          Tree Data           ####
    ######################################
   
    # Insert new nodes 
    @staticmethod
    def InsertValue(splitResult,newTriangleSize,Q,currQ_Dict):
        
        thisNode = Q[0]
        parcel_A = splitResult[0]
        parcel_B = splitResult[1]
        
        parcel_A.triangleSize = newTriangleSize
        parcel_B.triangleSize = newTriangleSize
        
        # Store child A'info
        if thisNode.child_A == None:
            thisNode.child_A = parcel_A
            thisNode.child_A.parent=thisNode
            thisNode.child_A.depth = thisNode.child_A.parent.depth+1
            Q.append(parcel_A)
            
        # Store child B'info    
        if thisNode.child_B == None:
            thisNode.child_B = parcel_B
            thisNode.child_B.parent=thisNode
            thisNode.child_B.depth = thisNode.child_B.parent.depth+1
            Q.append(parcel_B)
        
        # Succeed and pop  
        Q.popleft()
        currQ_Dict.pop(thisNode.ID)
        

    # Tree traversal function, get the last depth nodes
    @staticmethod
    def FindTheBottomElements_LevelOrder_Q(root):
        
        bottomElements = deque()
        if(root==None):
            return
        
        queue =Queue.Queue()
        queue.put(root)
        
        while (queue.empty()!=True):
            node = queue.get()
            if node.child_A == None and node.child_B == None and node.child_C == None:  
                bottomElements.append(node)
            
            if (node.child_A != None ): 
                queue.put(node.child_A)
            
            if (node.child_B != None ):
                queue.put(node.child_B)
                
            if (node.child_C != None ):
                queue.put(node.child_C)
                
        return bottomElements

    # Tree traversal function, get all the nodes
    @staticmethod
    def TraverseCollectAllNodes(root):
        allNodes = []
        if(root==None):
            return
    
        queue =Queue.Queue()
        queue.put(root)
        
        while (queue.empty()!=True):
            node = queue.get()
            allNodes.append(node)
            
                    
            if (node.child_A != None ):
                queue.put(node.child_A)
            
            if (node.child_B != None ):
                queue.put(node.child_B) 
                
            if (node.child_C != None ):
                queue.put(node.child_C)     
                
        return allNodes
         
         
    # If the parcel has an edge which twin edge is inside another parcel, they are neighbors   
    @staticmethod
    def CheckNeighbor(thisParcFace, comparedParcFace):
        c_Edges = comparedParcFace.edges
        this_Edges =thisParcFace.edges

        for edge in this_Edges:
            if edge.twin in c_Edges:   
                thisParcFace.neighbors.append(comparedParcFace)
                comparedParcFace.neighbors.append(thisParcFace)
                
                thisParcFace.mutualP_E[comparedParcFace] = edge
                thisParcFace.mutualE_P[edge] = comparedParcFace
                
                comparedParcFace.mutualP_E[thisParcFace] = edge.twin
                comparedParcFace.mutualE_P[edge.twin] = thisParcFace
                break
    
    # Remove the node from other nodes'neighbor info
    @staticmethod
    def RemoveInvalidNeighbor(thisParcFace,currQ):
        for node in currQ:
            if thisParcFace in node.neighbors:
                # remove from neighbors
                node.neighbors.remove(thisParcFace)

                # remove from mutualE_P,mutualP_E
                removedE = node.mutualP_E[thisParcFace]
                removedP = thisParcFace
     
                if node.mutualE_P[removedE] == removedP:   ### Important reminder: Must have this if condition, because RedirectNeigbor might have updated this dict!!!
                    node.mutualE_P.pop(removedE)
   
                node.mutualP_E.pop(removedP)
                

    ######################################
    ####           DeepCopy           ####
    ######################################

    @staticmethod
    def GetDeepCopyDict_VP(oldPV_Dict):
        VPInstances = oldPV_Dict.values()
        new_Dict = {}
        for vp in VPInstances:
            new_Dict[vp.ID] = vp.DeepCopy()
        return new_Dict

    @staticmethod
    def GetDeepCopyDict_E_All(newVPDict,oldEDict_All):
        EInstances = oldEDict_All.values()
        new_Dict = {}
        for edge in EInstances:
            new_Dict[edge.ID] = edge.DeepCopy(newVPDict)


        for key in new_Dict:
            if new_Dict[key].twinID!=None:
                new_Dict[key].twin = new_Dict[new_Dict[key].twinID]   
    
        return new_Dict
    
    @staticmethod
    def GetDeepCopyDict_E(oldEDict, newEdict_All):
        new_Dict = {}
        for key in oldEDict.keys():
            new_Dict[key] = newEdict_All[key]

        return new_Dict

    @staticmethod
    def GetDeepCopyParcFace_Q(currQ,newVPDict,newEDict,newE_Dict_All,redirectMap):
        
        newParcFaces = deque()

        for parcFace in currQ:
            newParcFace = parcFace.DeepCopy(newVPDict,newEDict,newE_Dict_All)
            newParcFaces.append(newParcFace)

        for i in range(len(newParcFaces)):
            #insert both key:value and value:key
            redirectMap[newParcFaces[i]] = currQ[i] 
            redirectMap[currQ[i]] = newParcFaces[i]
            
     
        # this is for the working space
        return newParcFaces
    
    @staticmethod
    def GetDeepCopyParcFace_Dict(currQ):
        currQ_Dict_new = {}
        for parcF in currQ:
            currQ_Dict_new[parcF.ID] = parcF
        return currQ_Dict_new
    
    
    ######################################
    ####           Redirect           ####
    ######################################
    @staticmethod
    def RedirectParentChildren(currQ,redirectMap):
        for parcFace in currQ:
            ### Scenario 1: If this is a dead node, let the original node become its parent, depth has +1 already
            if parcFace.alive == False:
                if parcFace.identity =="A":
                    parcFace.parent = parcFace.parent.child_A
                    
                elif parcFace.identity =="B":
                    parcFace.parent = parcFace.parent.child_B
                
                elif parcFace.identity =="C":
                    parcFace.parent = parcFace.parent.child_C
                
                parcFace.identity = "C"    
                parcFace.parent.child_C = parcFace    

            ### Scenario 2: If this is an alive node, redirect the parcFaces to find the real parents
            elif parcFace.alive == True:
                if parcFace.parent!=None:
                    # rediect parent
                    
                    parcFace.parent  = redirectMap[parcFace.parent]
                    
                    # rediect children
                    if parcFace.identity =="A":
                        parcFace.parent.child_A = parcFace
                    
                    elif parcFace.identity =="B":
                        parcFace.parent.child_B = parcFace

    @staticmethod
    def RedirectNeighbors(currQ,newEDict,redirectMap):
        ### this is after deepcopy all the parcFaces in this depth
        ### redirect the parcFaces to find the real parents
        
        ### correct the parcFace's neighbors, let them point to current DeepCopy parcFace
        ### correct each parcFace's mutualE, let them point to current DeepCopy Edge 
        
        for parcFace in currQ:
            
            # update the "neighbors" 
            for i in range(len(parcFace.neighbors)):
                thisNeighbor = parcFace.neighbors[i] 
                parcFace.neighbors[i] = redirectMap[thisNeighbor]
                #print ("before redirection:"),id(parcFace),"'s neighbor is :",id(thisNeighbor)
                #print ("after redirection:"),id(parcFace),"'s neighbor is :",id(redirectMap[thisNeighbor])  
                
                 
            # update the "mutualP_E" 
            for key in parcFace.mutualP_E.Keys:
                edgeID = parcFace.mutualP_E[key].ID
                newMutualEdge = newEDict[edgeID]
                
                newParcFace = redirectMap[key]
                
                # add the new map
                parcFace.mutualP_E[newParcFace]=newMutualEdge
                
                # del the old one
                parcFace.mutualP_E.pop(key)
            
            # update the "mutualE_P" 
            for key in parcFace.mutualE_P.Keys:
                edgeID = key.ID
                newMutualEdge = newEDict[edgeID]
                
                newParcFace = redirectMap[parcFace.mutualE_P[key]]

                # add the new map
                parcFace.mutualE_P[newMutualEdge]=newParcFace
                
                # del the old one
                parcFace.mutualE_P.pop(key)


    ######################################
    ####      Geometry Processing     ####
    ######################################
    @staticmethod
    def DetectLocation(parcFace,streamline):
        # print "in DetectLocation"
        # for edge in parcFace.edges:
        #     for pt in edge.GetGeometry():
        #         print pt.X,pt.Y,0
        #     print "-----"
        
        # for pt in streamline.GetGeometry():
        #     print pt.X,pt.Y,0
        tol = 0.01 # This one is set bigger(depending on if previously simplification is done and causes discrepancy), or 0.001, but generally 0.01 is fine 
        currEdges = parcFace.edges
        
        ############### detect startpoint and endpoint location ###############
        ### First round locate
        # Locate edge
        startEdge=None
        endEdge=None
        startEdgeIndex=None
        endEdgeIndex=None
        startSplitPointPair=[]
        endSplitPointPair=[]
    
        for i in range(len(currEdges)):
            if startEdge==None:
                closestPt = currEdges[i].GetGeometry().ClosestPoint(streamline.startVertex.geometry)
                #print closestPt.DistanceTo(streamline.startVertex.geometry)
                if closestPt.DistanceTo(streamline.startVertex.geometry) <=tol: 
                    
                    startEdge=currEdges[i]
                    startEdgeIndex = i
                
            if endEdge==None:
                closestPt = currEdges[i].GetGeometry().ClosestPoint(streamline.endVertex.geometry)
                #print closestPt.DistanceTo(streamline.endVertex.geometry)
                if closestPt.DistanceTo(streamline.endVertex.geometry) <=tol:
                    endEdge=currEdges[i]
                    endEdgeIndex = i
            
            # if both edges found        
            if startEdge and endEdge:
                break
        
        
        #print "---"      
        ####  Normal  case : Now there is only normal case
        if startEdgeIndex!=endEdgeIndex:                                     
            flag=0  # to check if its special case , but now it is excluded
            
            #classify the startEdge and endEdge to 1st touch egde and 2nd touch edge
            if startEdgeIndex>endEdgeIndex:
                streamline.Reverse()
                
                temp=startEdgeIndex
                startEdgeIndex=endEdgeIndex
                endEdgeIndex=temp
                
                temp=startEdge
                startEdge=endEdge
                endEdge=temp
            
            ####second round locate
            # if startEdge instance has "between points", conduct second round 
            if len(startEdge.betweenPoints)!=0:
                all = startEdge.GetVPInstance()
                
                for i in range(len(all)-1):

                    segment=rg.Line(all[i].geometry,all[i+1].geometry)
                    if segment.DistanceTo(streamline.startVertex.geometry,True)<tol:   
                        startSplitPointPair=[i,i+1]
                        break

            # if endEdge instance has "between points", conduct second round 
            if len(endEdge.betweenPoints)!=0:
                all = endEdge.GetVPInstance()
                for i in range(len(all)-1):
                    
                    segment=rg.Line(all[i].geometry,all[i+1].geometry)
                    if segment.DistanceTo(streamline.endVertex.geometry,True)<tol:
                        endSplitPointPair=[i,i+1]
                        break
                        
        return startEdge,endEdge,startEdgeIndex,endEdgeIndex,startSplitPointPair,endSplitPointPair,flag

    @staticmethod
    def DetectLocation_Constrained(parcFace,streamline):
        #### Only Need to Detect The end
        
        tol = 0.01 # This one is set bigger(depending on if previously simplification is done and causes discrepancy), or 0.001, but generally 0.01 is fine 
        currEdges = parcFace.edges

        ############### detect startpoint and endpoint location ###############
        ### First round locate
        # Locate edge
        endEdge=None
        endEdgeIndex=None
        endSplitPointPair=[]
    
        for i in range(len(currEdges)):
                
            if endEdge==None:
                closestPt = currEdges[i].GetGeometry().ClosestPoint(streamline.endVertex.geometry)
                if closestPt.DistanceTo(streamline.endVertex.geometry) <=tol:
                    endEdge=currEdges[i]
                    endEdgeIndex = i
                    
            if endEdge:
                break

        # if endEdge instance has "between points", conduct second round 
        if len(endEdge.betweenPoints)!=0:
            all = endEdge.GetVPInstance()
            for i in range(len(all)-1):
                
                segment=rg.Line(all[i].geometry,all[i+1].geometry)
                if segment.DistanceTo(streamline.endVertex.geometry,True)<tol:
                    endSplitPointPair=[i,i+1]

        return endEdge,endEdgeIndex,endSplitPointPair
    
    @staticmethod
    def GetStartPtInfo(thisNode):
        for i in range(len(thisNode.edges)):
            edge = thisNode.edges[i]
            if edge.endVertex == thisNode.startPt:
                startPt_PrevE = edge
                startPt_PrevE_Index = i

            if edge.startVertex == thisNode.startPt:
                startPt_NextE = edge
                startPt_NextE_Index = i
        
        
        return [startPt_PrevE_Index,startPt_NextE_Index]
    
    @staticmethod
    def GetNewShare(PL,thisNode,sl,VP_Dict,E_Dict,E_Dict_All,startEdge,endEdge):
        # the new shared list order is same as the corrected streamline
        
        currVPIDs=[]
        for ID in VP_Dict.keys():
            currVPIDs.append(ID)
        currMaxVPID = max(currVPIDs)
       
        newShareList = []
        
        ### initialze streamline to parc vertex and point
        for i in range(len(sl.GetGeometry())):
            pts = sl.GetGeometry()
            if i == 0:
                newShareList.append(PL.ParcVertex(pts[0],currMaxVPID+i+1))
            elif i == len(sl.GetGeometry())-1:
                newShareList.append(PL.ParcVertex(pts[len(sl.GetGeometry())-1],currMaxVPID+i+1))
            else:
                newShareList.append(PL.ParcPoint(pts[i],currMaxVPID+i+1))
        
        ### initialze the twin parcEdge
        currEIDs=[]
        for ID in E_Dict.keys():
            currEIDs.append(ID)
            currMaxEID = max(currEIDs)
        
        newEdge = PL.ParcEdge(currMaxEID+1)
        newEdge.FillInfo(newShareList)
        newEdge_twin = newEdge.CreateTwin(newEdge.ID+1)
        
        ### store in current dict
        SPF.ExtendCurrVPDict(VP_Dict,newShareList)
        SPF.ExtendCurrEDict(E_Dict,newEdge)
        SPF.ExtendCurrEDict(E_Dict,newEdge_twin)
        SPF.ExtendCurrEDict_All(E_Dict_All,newEdge)
        SPF.ExtendCurrEDict_All(E_Dict_All,newEdge_twin)
        ### For road
        newEdge.generation = thisNode.depth + 1
        newEdge_twin.generation = thisNode.depth +1
        
        ### Check If vertex on the boundary, if so ,update "onBoundary"
        if startEdge.naked ==True:
            newEdge.startVertex.onBoundary = True
            
        if endEdge.naked ==True:
            newEdge.endVertex.onBoundary = True
        return newEdge,newEdge_twin

    @staticmethod
    def GetNewShare_Constrained(PL,thisNode,VP_Dict,E_Dict,E_Dict_All):
        # the new shared list order is same as the corrected streamline
        sl = thisNode.specificStreamline
        currVPIDs=[]
        for ID in VP_Dict.keys():
            currVPIDs.append(ID)
        currMaxVPID = max(currVPIDs)
       
        newShareList = []
        
        ### initialze streamline to parc vertex and point
        for i in range(len(sl.GetGeometry())):
            pts = sl.GetGeometry()
            if i == 0:
                newShareList.append(thisNode.startPt)
            elif i == len(sl.GetGeometry())-1:
                newShareList.append(PL.ParcVertex(pts[len(sl.GetGeometry())-1],currMaxVPID+i))
            else:
                newShareList.append(PL.ParcPoint(pts[i],currMaxVPID+i))
        
        ### initialze the twin parcEdge
        currEIDs=[]
        for ID in E_Dict.keys():
            currEIDs.append(ID)
            currMaxEID = max(currEIDs)
        
        newEdge = PL.ParcEdge(currMaxEID+1)
        newEdge.FillInfo(newShareList)
        newEdge_twin = newEdge.CreateTwin(newEdge.ID+1)
        
        ### store in current dict
        #Before extention, remove the first exsiting one
        
        newShareList.remove(thisNode.startPt)
        SPF.ExtendCurrVPDict(VP_Dict,newShareList)
        
        SPF.ExtendCurrEDict(E_Dict,newEdge)
        SPF.ExtendCurrEDict(E_Dict,newEdge_twin)
        SPF.ExtendCurrEDict_All(E_Dict_All,newEdge)
        SPF.ExtendCurrEDict_All(E_Dict_All,newEdge_twin)


        newEdge.generation = thisNode.depth
        newEdge_twin.generation = thisNode.depth
        
        ### Check If vertex on the boundary, if so ,update "onBoundary"  -> this add outside
        
        return newEdge,newEdge_twin
        
    @staticmethod
    def ConstructNewParcel_Normal(PL,parcFace,F_Dict,VP_Dict,E_Dict,E_Dict_All,shareEdge,shareEdge_twin,startEdge,endEdge,startEdgeIndex,endEdgeIndex,startSplitPointPair,endSplitPointPair,currStreetGraph):

        p1,p2,splitEdges_Start, splitEdges_End= SPF.Construct_NormalCase(PL,parcFace,F_Dict,VP_Dict,E_Dict,E_Dict_All,shareEdge,shareEdge_twin,startEdge,endEdge,startEdgeIndex,endEdgeIndex,startSplitPointPair,endSplitPointPair,currStreetGraph)
        #fill the relationship here
        p1.identity = "A"
        p2.identity = "B"
        
        #fill neighbors relationship
        p1.neighbors.append(p2)
        p2.neighbors.append(p1)
        
        
        p1.mutualP_E[p2] = shareEdge
        p1.mutualE_P[shareEdge] = p2
        
        p2.mutualP_E[p1] = shareEdge_twin
        p2.mutualE_P[shareEdge_twin] = p1
        return p1,p2,splitEdges_Start, splitEdges_End

    @staticmethod
    def ConstructNewParcel_Constrained(PL,parcFace,F_Dict,VP_Dict,E_Dict,E_Dict_All,shareEdge,shareEdge_twin,endEdge,startIndexPair,endEdgeIndex,endSplitPointPair,currStreetGraph):
        parcel_1,parcel_2,splitEdges_End = SPF.Construct_Constrained(PL,parcFace,F_Dict,VP_Dict,E_Dict,E_Dict_All,startIndexPair,endSplitPointPair,endEdgeIndex,shareEdge,shareEdge_twin,endEdge)
        #fill the relationship here
        parcel_1.identity = "A"
        parcel_2.identity = "B"
        
        #fill neighbors relationship
        parcel_1.neighbors.append(parcel_2)
        parcel_2.neighbors.append(parcel_1)
        
        
        parcel_1.mutualP_E[parcel_2] = shareEdge
        parcel_1.mutualE_P[shareEdge] = parcel_2
        
        parcel_2.mutualP_E[parcel_1] = shareEdge_twin
        parcel_2.mutualE_P[shareEdge_twin] = parcel_1
        
        
        ########################
        ###  for streetGraph_Constraint
        ########################
    
        if endEdge.streetID!=None:
            if endEdge.naked ==True :
                subEdge_End_0 = splitEdges_End[0]
                subEdge_End_1 = splitEdges_End[1]
                targetStreet,startNode,endNode,order =  currStreetGraph.CheckInsertLocation(endEdge)
                # no twin edge,must be true
                targetStreet.Insert(startNode,endNode,subEdge_End_0,subEdge_End_1,E_Dict)
                
            elif endEdge.naked == False :
                subEdge_End_a = splitEdges_End[0]
                subEdge_End_a_twin = splitEdges_End[1]
                subEdge_End_b = splitEdges_End[2]
                subEdge_End_b_twin = splitEdges_End[3]
                
                targetStreet,startNode,endNode,order =  currStreetGraph.CheckInsertLocation(endEdge)
                if order == True:
                    targetStreet.Insert(startNode,endNode,subEdge_End_a,subEdge_End_b,E_Dict)
                elif order != True:
                    targetStreet.Insert(startNode,endNode,subEdge_End_b_twin,subEdge_End_a_twin,E_Dict)


        return parcel_1,parcel_2,splitEdges_End

    @staticmethod
    def Construct_Constrained(PL,thisNode,F_Dict,VP_Dict,E_Dict,E_Dict_All,startIndexPair,endSplitPointPair,endEdgeIndex,shareEdge,shareEdge_twin,endEdge):
        
        if endEdge.naked ==True:
            shareEdge.endVertex.onBoundary = True    ### pending to relocate
            splitResult = endEdge.SplitEdge_Naked_Normal(shareEdge,shareEdge.endVertex,"end",E_Dict,E_Dict_All,VP_Dict)
            subEdge_End_0 = splitResult[0]
            subEdge_End_1 = splitResult[1]
            splitEdges_End = [subEdge_End_0,subEdge_End_1]
            chosenNewEdges = [subEdge_End_0,subEdge_End_1]
    
        elif endEdge.naked == False:
            splitResult = endEdge.SplitEdge_Shared_Normal(shareEdge,shareEdge.endVertex,"end",E_Dict,E_Dict_All,VP_Dict,endSplitPointPair)
            subEdge_End_a = splitResult[0]
            subEdge_End_a_twin = splitResult[1]
            subEdge_End_b = splitResult[2]
            subEdge_End_b_twin = splitResult[3]
            splitEdges_End = [subEdge_End_a,subEdge_End_a_twin,subEdge_End_b, subEdge_End_b_twin]
            chosenNewEdges = [subEdge_End_a,subEdge_End_b]
                
        numEdge = len(thisNode.edges)
        edges = thisNode.edges
        
        ### collect edges in corret order
        slice1 = []
        slice2 = []

        if endEdgeIndex>max(startIndexPair) and endEdgeIndex == numEdge-1:
            slice1.append(shareEdge)
            slice1.append(chosenNewEdges[1])
            for i in range(0,startIndexPair[1],1):
                slice1.append(edges[i]) 
            
            for i in range(startIndexPair[1],endEdgeIndex,1):
                slice2.append(edges[i]) 
            slice2.append(chosenNewEdges[0])
            slice2.append(shareEdge_twin)
        
        elif endEdgeIndex>max(startIndexPair) and endEdgeIndex != numEdge-1:
            slice1.append(shareEdge)
            slice1.append(chosenNewEdges[1])
            for i in range(endEdgeIndex+1,numEdge,1):
                slice1.append(edges[i])
            
            for i in range(0,startIndexPair[1],1):
                slice1.append(edges[i]) 
            
            for i in range(startIndexPair[1],endEdgeIndex,1):
                slice2.append(edges[i]) 
            slice2.append(chosenNewEdges[0])
            slice2.append(shareEdge_twin)
            
        elif 0 not in startIndexPair and endEdgeIndex<max(startIndexPair):
            slice1.append(shareEdge)
            slice1.append(chosenNewEdges[1])
            for i in range(endEdgeIndex+1,startIndexPair[1],1):
                slice1.append(edges[i])
            
            for i in range(startIndexPair[1],numEdge,1):
                slice2.append(edges[i])
            
            for i in range(0,endEdgeIndex,1):
                slice2.append(edges[i])
                
            slice2.append(chosenNewEdges[0])
            slice2.append(shareEdge_twin)
        
        elif 0 in startIndexPair:
            slice1.append(shareEdge)
            slice1.append(chosenNewEdges[1])
            for i in range(endEdgeIndex+1,numEdge,1):
                slice1.append(edges[i])
                
            for i in range(0,endEdgeIndex,1):
                slice2.append(edges[i])
        
            slice2.append(chosenNewEdges[0])
            
        ### construct parcels
        parcel_1=PL.ParcFace()
        parcel_1.InitializeParcFaceWithID(F_Dict)
        for edge in slice1:
            if edge.isValid == True: #VV to close
                parcel_1.AddFaceV(edge.startVertex)
                parcel_1.edges.append(edge)
        
        parcel_2=PL.ParcFace()
        parcel_2.InitializeParcFaceWithID(F_Dict)
        for edge in slice2:
            if edge.isValid == True: #VV to close
                parcel_2.AddFaceV(edge.startVertex)
                parcel_2.edges.append(edge)
            
        
 
   
        return parcel_1,parcel_2,splitEdges_End
    
    @staticmethod
    def Construct_NormalCase(PL,parcFace,F_Dict,VP_Dict,E_Dict,E_Dict_All,shareEdge,shareEdge_twin,startEdge,endEdge,startEdgeIndex,endEdgeIndex,startSplitPointPair,endSplitPointPair,currStreetGraph):
        currEdges =parcFace.edges
        #slice the vertices list into 3 segments
        slice_0=[]
        slice_1=[]
        slice_2=[]
        
        for edgeIndex in range(len(currEdges)):
            if edgeIndex < startEdgeIndex:
                slice_0.append(edgeIndex)
            
            elif edgeIndex > startEdgeIndex and edgeIndex < endEdgeIndex:
                slice_1.append(edgeIndex)
                
            elif edgeIndex > endEdgeIndex:
                slice_2.append(edgeIndex)

        
        slice_2.extend(slice_0)
        firstHalf = slice_2
        secondHalf = slice_1
        
        
        ############### prepare the splitEdge ###############
        splitEdges_Start = []
        splitEdges_End= []
        if startEdge.naked ==True:
            splitResult = startEdge.SplitEdge_Naked_Normal(shareEdge,shareEdge.startVertex,"start",E_Dict,E_Dict_All,VP_Dict)
            subEdge_Start_0 = splitResult[0]
            subEdge_Start_1 = splitResult[1]
            splitEdges_Start = [subEdge_Start_0,subEdge_Start_1]
            
        elif startEdge.naked == False:
            splitResult = startEdge.SplitEdge_Shared_Normal(shareEdge,shareEdge.startVertex,"start",E_Dict,E_Dict_All,VP_Dict,startSplitPointPair)
            subEdge_Start_a = splitResult[0]
            subEdge_Start_a_twin = splitResult[1]
            subEdge_Start_b = splitResult[2]
            subEdge_Start_b_twin = splitResult[3]
            splitEdges_Start = [subEdge_Start_a,subEdge_Start_a_twin,subEdge_Start_b,subEdge_Start_b_twin]
            
        if endEdge.naked ==True:
            splitResult = endEdge.SplitEdge_Naked_Normal(shareEdge,shareEdge.endVertex,"end",E_Dict,E_Dict_All,VP_Dict)
            subEdge_End_0 = splitResult[0]
            subEdge_End_1 = splitResult[1]
            splitEdges_End = [subEdge_End_0,subEdge_End_1]
            

        elif endEdge.naked == False:
            splitResult = endEdge.SplitEdge_Shared_Normal(shareEdge,shareEdge.endVertex,"end",E_Dict,E_Dict_All,VP_Dict,endSplitPointPair)
            subEdge_End_a = splitResult[0]
            subEdge_End_a_twin = splitResult[1]
            subEdge_End_b = splitResult[2]
            subEdge_End_b_twin = splitResult[3]
            splitEdges_End = [subEdge_End_a,subEdge_End_a_twin,subEdge_End_b,subEdge_End_b_twin]
            
            
        ############### construct new parcel ###############
        parcel_1=PL.ParcFace()
        parcel_1.InitializeParcFaceWithID(F_Dict)
        ########################
        ###  from streamline 
        ########################
        ### add 2 verties
        

        #if shareEdge.startVertex not in parcel_1.vertices:  ### avoid VV to close
        parcel_1.AddFaceV(shareEdge.startVertex)
            
        #if shareEdge.endVertex not in parcel_1.vertices:  ### avoid VV to close
        parcel_1.AddFaceV(shareEdge.endVertex)
        
        ### add 1 edge
        parcel_1.edges.append(shareEdge)
        

        ########################
        ### when it hit endEdge 
        ########################
        ### add 1 vertex 
        #if endEdge.endVertex not in parcel_1.vertices:  ### avoid VV to close
        parcel_1.AddFaceV(VP_Dict[endEdge.endVertex.ID])


        ### add 1 edge 
        if endEdge.naked ==True and subEdge_End_1.isValid == True: # VV to close,edge invalid
            parcel_1.edges.append(subEdge_End_1)

            
        elif endEdge.naked == False and subEdge_End_b.isValid == True:
            parcel_1.edges.append(subEdge_End_b)

            
      
        ########################
        ### from firstHalf
        ########################
        
        ### add vertices and edges
        for i in range(len(firstHalf)):
            thisEdge = currEdges[firstHalf[i]]
            #if VP_Dict[thisEdge.endVertex.ID] not in parcel_1.vertices:  ### avoid VV to close
            parcel_1.AddFaceV(VP_Dict[thisEdge.endVertex.ID])
            newEdge = E_Dict[thisEdge.ID]
            parcel_1.edges.append(newEdge)
        
        ############################
        ### when it hit startEdge
        ############################
        
        ### no need to add verteices

        if startEdge.naked ==True and subEdge_Start_0.isValid == True:
            parcel_1.edges.append(subEdge_Start_0)
            
        elif startEdge.naked == False and subEdge_Start_a.isValid == True:
            parcel_1.edges.append(subEdge_Start_a)
        
       
        ###################
        ###form parcel_2###
        ###################
        parcel_2=PL.ParcFace()
        parcel_2.InitializeParcFaceWithID(F_Dict)
        ########################
        ### when it hit startEdge
        ########################
        ### add 2 vertices 
        #if shareEdge.startVertex not in parcel_2.vertices:
        parcel_2.AddFaceV(shareEdge.startVertex)
        #if startEdge.endVertex not in parcel_2.vertices:
        parcel_2.AddFaceV(VP_Dict[startEdge.endVertex.ID])
        
        ### add 1 edge
        if startEdge.naked ==True and subEdge_Start_1.isValid == True:
            parcel_2.edges.append(subEdge_Start_1)
        elif startEdge.naked == False and subEdge_Start_b.isValid == True:
            parcel_2.edges.append(subEdge_Start_b)
    
        
        ########################
        ### from secondHalf
        ########################
        ### add vertices and edges
        for i in range(len(secondHalf)):
            thisEdge = currEdges[secondHalf[i]]
            #if VP_Dict[thisEdge.endVertex.ID] not in parcel_2.vertices:  ### avoid VV to close
            parcel_2.AddFaceV(VP_Dict[thisEdge.endVertex.ID])
            newEdge=E_Dict[thisEdge.ID]
            parcel_2.edges.append(newEdge)

            
        ########################
        ### when it hit endEdge
        ########################
        
        ### add 1 vertex
        if shareEdge.endVertex not in parcel_2.vertices:
            parcel_2.AddFaceV(shareEdge.endVertex)
    
        ### add 1 edge
        if endEdge.naked ==True and subEdge_End_0.isValid == True:
            parcel_2.edges.append(subEdge_End_0)
    
        elif endEdge.naked == False and subEdge_End_a.isValid == True:
            parcel_2.edges.append(subEdge_End_a)
        
        ########################
        ###  from streamline
        ########################

        ### no need to add vertex
        ### add 1 edge
        
        parcel_2.edges.append(shareEdge_twin)
        

        p1=parcel_1
        p2=parcel_2
        
        
        ########################
        ###  for streetGraph
        ########################
   
        if startEdge.streetID!=None:
            if startEdge.naked ==True :
                targetStreet,startNode,endNode,order =  currStreetGraph.CheckInsertLocation(startEdge)
                # no twin edge,must be true
                targetStreet.Insert(startNode,endNode,subEdge_Start_0,subEdge_Start_1,E_Dict)
                #print "caseA"
                
            elif startEdge.naked == False :
        
                targetStreet,startNode,endNode,order =  currStreetGraph.CheckInsertLocation(startEdge)
                
                if order == True:
                    targetStreet.Insert(startNode,endNode,subEdge_Start_a,subEdge_Start_b,E_Dict)
         
                elif order != True:
                    targetStreet.Insert(startNode,endNode,subEdge_Start_b_twin,subEdge_Start_a_twin,E_Dict)
           

            p1.accessible = True
            p2.accessible = True

        if endEdge.streetID!=None:
            if endEdge.naked ==True :
                
                targetStreet,startNode,endNode,order =  currStreetGraph.CheckInsertLocation(endEdge)
                # no twin edge,must be true
                targetStreet.Insert(startNode,endNode,subEdge_End_0,subEdge_End_1,E_Dict)
                #print "caseC"
            elif endEdge.naked == False :
                
                targetStreet,startNode,endNode,order =  currStreetGraph.CheckInsertLocation(endEdge)
                
                if order == True:
                    targetStreet.Insert(startNode,endNode,subEdge_End_a,subEdge_End_b,E_Dict)
                elif order != True:
                    targetStreet.Insert(startNode,endNode,subEdge_End_b_twin,subEdge_End_a_twin,E_Dict)
                #print "caseD"
                
            p1.accessible = True
            p2.accessible = True    
       
        return p1,p2,splitEdges_Start,splitEdges_End


    ############################################
    ####  Check parcel affected by subdiv   ####
    ############################################
    # Normal case it will affect 2 parcels (start and end side)
    @staticmethod
    def GetAffectedParcFace(parcFace,startEdge,endEdge):
        # get this parcFace's neighbors
        allNeighbors= parcFace.neighbors
        
        start_PF = None
        end_PF = None
        

        for neighbor in allNeighbors:
            if neighbor.mutualP_E[parcFace] == startEdge or neighbor.mutualP_E[parcFace] == startEdge.twin:
                start_PF=neighbor
                break


        for neighbor in allNeighbors:
            if neighbor.mutualP_E[parcFace] == endEdge or neighbor.mutualP_E[parcFace] == endEdge.twin:
                end_PF=neighbor
                break

        if start_PF != None:
            start_PF.situation = 1
            
        if end_PF != None:
            end_PF.situation = 1
            
        return start_PF,end_PF

    # Constrained case it will affect 1 parcels (end side only)
    @staticmethod
    def GetAffectedParcFace_Constrained(parcFace,endEdge):
        # get this parcFace's neighbors
        allNeighbors= parcFace.neighbors

        end_PF = None
        
        for neighbor in allNeighbors:
            if neighbor.mutualP_E[parcFace] == endEdge or neighbor.mutualP_E[parcFace] == endEdge.twin:
                end_PF=neighbor
                break
            else:
                pass
        if end_PF != None:
            end_PF.situation = 1
            
        return end_PF


    ######################################
    ####  Store new data into Dict    ####
    ###################################### 
    @staticmethod
    def ExtendCurrVPDict(currDict,newSharedList):
        for i in range(len(newSharedList)):
            currDict[newSharedList[i].ID] = newSharedList[i]

    @staticmethod
    def ExtendCurrEDict(currDict,newEdge):
        currDict[newEdge.ID] = newEdge
       
    @staticmethod   
    def ExtendCurrEDict_All(currDict_All,newEdge):
        currDict_All[newEdge.ID] = newEdge  
       
       
    ######################################
    ####     Streamline Selection     ####
    ######################################    
    @staticmethod   
    def GetCurrentWeight(weight,currDepth,coefficient=None):
        currentWeight=[]
        if coefficient!=None:
            for i in range(len(weight)):
                currentWeight.append( round(weight[i] * math.pow(coefficient[i],currDepth),3))
                
        elif coefficient == None:
            currentWeight = weight

        return currentWeight
   
    @staticmethod
    def StoreStreamlines(PC,DM,SLG,EV,thisNode,EDict_All,sameSideList,weight,pt,idealOrientation,resolution,disableRate):
        
  
        ### create processMesh
        crv = thisNode.GetGeometry()
        processMesh = PC.ProcessMesh()
        
        ### Get the resoluion processMesh
        if thisNode.parent == None:
            useTriangleSize = resolution
            thisNode.triangleSize = resolution
 
        else:
            useTriangleSize = thisNode.triangleSize
        processMesh.InitializeInput(crv,useTriangleSize)   #length 
        
        ### Optional, for debug
        thisNode.processMesh = processMesh
        
        ### create dataMapping
        mappingGrid = DM.MappingGrid()
        mappingGrid.CreateMappingGrid(crv,20,5)    #rows,columns 
        mappingGrid.GetOverlappedTriangleIndex(processMesh,2)  #detectRadius 
        ### create seedPoint
        
        seedpointList = SLG.SeedpointList()
        seedpointList.CreateSeedpointList(processMesh,1,1)  #reduce points onEdge, on MA
    
        ### creat streamline network instance with score
        
        newTriangleSize = processMesh.length
        
        #dL = newTriangleSize*0.3
        dL = newTriangleSize
        disableDistance=newTriangleSize * disableRate
        
        streamlineNetwork=SLG.StreamlineNetwork()

        
        if weight!=None and pt == None:
            # print ("【Free】using TOP N Streamlines"),thisNode.ID
            streamlineNetwork=SLG.StreamlineNetwork()
            

            streamlines = streamlineNetwork.GetStreamlineNetwork(mappingGrid,processMesh,seedpointList,disableDistance,dL)  #disable distance, dL
 
            EV.GetAllScoreToInstance(SPF,SLG,thisNode,EDict_All,sameSideList,streamlineNetwork,streamlines,weight,idealOrientation)

            sortStreamlines = EV.SortStreamlines_Overall(streamlineNetwork)
 
            #print "after sortStremline , ",sortStreamlines[0].scoreOverall,sortStreamlines[-1].scoreOverall
            thisNode.sortedSL = sortStreamlines
            
            #print "we get ",len(sortStreamlines), "streamlines"
            
        elif weight == None and pt != None:
            # print ("【Constarined】using Streamline On Specific Point "),thisNode.ID
            
      
            streamline=streamlineNetwork.GetStreamlineOnSpecificPoint(pt,mappingGrid,processMesh,dL)
            
            if streamline!=None:
                sl = SLG.Streamline()
                sl.CreateStreamlineInstance(streamline)
                thisNode.specificStreamline = sl
            else:
                thisNode.specificStreamline = None
        
        else:
            print ("input error")
        
        
     
        #document the triangle size
        return newTriangleSize
    
    # Mutiple round accessment to pick the streamline.
    # Can have buffer/ tolerance / strict conditions
    @staticmethod
    def TryStreamlineOptions(thisNode,minArea,minElongation,minConvexity,minCompactness,tolerance):
        
        ### First round search. It must fulfill the minArea requirement.

        for i in range(len(thisNode.sortedSL)):
            elongation_a = thisNode.sortedSL[i].elongationPair[0]
            elongation_b = thisNode.sortedSL[i].elongationPair[1]
            area_a = thisNode.sortedSL[i].areaPair[0]
            area_b = thisNode.sortedSL[i].areaPair[1]
            
            if thisNode.sortedSL[i].convexityPair != None:
                convexity_a = thisNode.sortedSL[i].convexityPair[0]
                convexity_b = thisNode.sortedSL[i].convexityPair[1]
            if thisNode.sortedSL[i].compactnessPair != None:    
                compactness_a = thisNode.sortedSL[i].compactnessPair[0]
                compactness_b = thisNode.sortedSL[i].compactnessPair[1]
            if thisNode.sortedSL[i].orientationPair != None: 
                orientation_a = thisNode.sortedSL[i].orientationPair[0]  
                orientation_b = thisNode.sortedSL[i].orientationPair[1]  
     
            if area_a >= minArea*tolerance and area_b >= minArea*tolerance :
                if area_a < 2*minArea or area_b < 2*minArea:
                    if elongation_a < minElongation and elongation_b < minElongation:
                        streamline = thisNode.sortedSL[i]
                        break
                    
                else:
                    streamline = thisNode.sortedSL[i]
                    break                                               # Found, then return. 

            else:
                if i!=len(thisNode.sortedSL)-1:                     # Not the last one yet. Keep finding.
                    streamline = None
                elif i ==len(thisNode.sortedSL)-1:                  # It is the last already. Not found.  
                    streamline = None

        return streamline
    
    
    # Use the specific streamline for constraint case
    @staticmethod
    def TrySpecificStreamline(EV,thisNode,minArea,minElongation,minConvexity,minCompactness,tolerance):
        if thisNode.specificStreamline == None:
            return None
        streamline = thisNode.specificStreamline.GetGeometry()
        boundary = thisNode.GetGeometry()
        
        splitResult = EV.SplitPolygon(streamline,boundary)
        
        if splitResult == None:
            return None
        
        parc_a = splitResult[0]
        parc_b = splitResult[1]

        area_a =rg.AreaMassProperties.Compute(parc_a).Area
        area_b =rg.AreaMassProperties.Compute(parc_b).Area
        
        ### record score
        if area_a>= area_b:
            evenAreaValue = area_b/area_a
        else:
            evenAreaValue = area_a/area_b

        elongation_a = EV.EvaluateElongation(parc_a) 
        elongation_b = EV.EvaluateElongation(parc_b)
        convexity_a = EV.EvaluateConvexity(parc_a)
        convexity_b = EV.EvaluateConvexity(parc_b)
        compactness_a = EV.EvaluateCompactness(parc_a)
        compactness_b = EV.EvaluateCompactness(parc_b)
    
        orientation_a = EV.EvaluateOrientation(parc_a)
        orientation_b = EV.EvaluateOrientation(parc_b)

        
        ### First round search. It must fulfill the minArea requirement.
        if area_a >= minArea*tolerance and area_b >= minArea*tolerance :
            if area_a < 2*minArea or area_b < 2*minArea:
                if elongation_a < minElongation and elongation_b < minElongation:
                    streamline = thisNode.specificStreamline

        else:
            streamline = None

        thisNode.specificStreamline.evenAreaValue = evenAreaValue
        thisNode.specificStreamline.elongationPair = [elongation_a,elongation_b]
        thisNode.specificStreamline.compactnessPair=[compactness_a,compactness_b]
        thisNode.specificStreamline.convexityPair=[convexity_a,convexity_b]
        thisNode.specificStreamline.orientationPair=[orientation_a,orientation_b]
        return streamline
# ---------- end ghpython_script_8 ----------
ghpython_script_9 = GhPythonScript()  # -> out, GRP
# ---------- ghpython_script_9: Python ----------
###########################
####    Import Libs    ####
###########################
import Rhino.Geometry as rg
import Rhino.RhinoDoc as rd
import Rhino.RhinoMath as rm

import ghpythonlib.components as ghc
import math


###########################
####    Description    ####
###########################
### GRP : Graph
### This library is to create graph and some help function. Graph operation will be included in RF (Road Finding)
### Use dict represent graph


class GRP:
    class ParcelGraph:
        
        # Initialize and deep copy
        def __init__(self):
            self.graph = {}                      # Type: Dict   {parcFace{nPF:mutualP_E} ...}  Store a ParcelGraph          
            self.depth = None
            
        def __del__(self):
            self.graph = None
            self.depth = None
            
        def DeepCopy(self,currQ_Dict,currE_Dict):
            
            ### convert the IDGraph
            IDGraph = self.GetIDNumWeightGraph()
            newParcelGraph = GRP.ParcelGraph()
            
            ### create space
            for pFID in IDGraph.graph.keys():
                newParcelGraph.graph[currQ_Dict[pFID]] = {}
            
            for pFID in IDGraph.graph.keys():
                for nPFID in IDGraph.graph[pFID].keys():
                    newParcelGraph.graph[currQ_Dict[pFID]][currQ_Dict[nPFID]] = currE_Dict [IDGraph.graph[pFID][nPFID]]
            
            newParcelGraph.depth = self.depth
            
            return newParcelGraph

        @staticmethod
        def CreateParcelGraphForThisDepth(currQ_Dict):
            newParcelGraph = GRP.ParcelGraph()
            
            for parcFace in currQ_Dict.values():
                
                newParcelGraph.graph[parcFace] = {}
                thisNeighborPFInstances = parcFace.mutualP_E.keys()
                for nPF in thisNeighborPFInstances:
                    newParcelGraph.graph[parcFace][nPF] = parcFace.mutualP_E[nPF]
            
            return newParcelGraph

 
        # Check info
        def CheckItemDepth(self):
            ### check if deepcopy is corret
            for pF in self.graph.keys():
                print ("pF.ID"), pF.ID, "pF.depth",pF.depth
                for npF in self.graph[pF]:
                    print ("npF.ID"), npF.ID, "npF.depth", npF.depth
                print ("-----------")

        def GetIDNumWeightGraph(self):
            newDict = {}
            for thisKey in self.graph.keys():
                newDict[thisKey.ID] = {}
                
                for nPF in self.graph[thisKey].keys():
                    newDict[thisKey.ID][nPF.ID] = self.graph[thisKey][nPF].ID

            newGraph = GRP.ParcelGraph() 
            newGraph.graph = newDict 
            return newGraph
                
            
            
        def GetIDNumWeightGraphAndPrint(self):
            newDict = {}
            for thisKey in self.graph.keys():
                newDict[thisKey.ID] = {}
                
                for nPF in self.graph[thisKey].keys():
                    newDict[thisKey.ID][nPF.ID] = self.graph[thisKey][nPF].ID

            newGraph = GRP.ParcelGraph() 
            newGraph.graph = newDict 
            print (newGraph.graph)
            return newGraph
                
            
            
            
    class JunctionGraph:
        
        # Initialize and deep copy
        def __init__(self):
            self.graph = {}                     # Type: Dict   {parcVertex{parcVertex:parcEdge} ...}  Store a JunctionGraph  
            self.depth = None
            
        def __del__(self):
            self.graph = None
            self.depth = None
            
        def DeepCopy(self,currVP_Dict,currE_Dict):
            ### convert the IDGraph
            IDGraph = self.GetIDNumWeightGraph()
            newJunctionGraph = GRP.JunctionGraph()
            
            ### create space
            for vID in IDGraph.graph.keys():
                newJunctionGraph.graph[currVP_Dict[vID]] = {}
                
            for vID in IDGraph.graph.keys():
                for nVID in IDGraph.graph[vID].keys():        
                    newJunctionGraph.graph[currVP_Dict[vID]][currVP_Dict[nVID]] = currE_Dict[IDGraph.graph[vID][nVID]]
            
            newJunctionGraph.depth = self.depth
            return newJunctionGraph
        
        @staticmethod
        def CreateJunctionGraphForThisDepth(currE_Dict):
            newJunctionGraph = GRP.JunctionGraph()
            
            ### collect valid vertex ID
            validV = []
            for edge in currE_Dict.values():
                if edge.isValid == True:  ### this is so important becasue currE_Dict contains invalid edges
                    if edge.naked == False or (edge.naked ==True and edge.streetID != None):
                        if edge.startVertex not in validV:
                            validV.append(edge.startVertex)

                        if edge.endVertex not in validV:
                            validV.append(edge.endVertex)
                
            ### create space
            for vID in validV:
                newJunctionGraph.graph[vID] = {}
            
            for edge in currE_Dict.values():
                if edge.isValid == True:  ### this is so important becasue currE_Dict contains invalid edges
                    if edge.naked == False or (edge.naked ==True and edge.streetID != None):
                        newJunctionGraph.graph[edge.startVertex][edge.endVertex] = edge  ### useInstance, so I dont need to update number 
                        newJunctionGraph.graph[edge.endVertex][edge.startVertex] = edge  ### useInstance, so I dont need to update number
                
            
            return newJunctionGraph
        
 
        # Check info
        def CheckAddress(self,VPDict):
            for pV in  VPDict.values():
                print ("pV.ID"), pV.ID, "pV.address",id(pV) 
                print ("-----------------------")
            for pV in VPDict.graph.keys():
                print ("pV.ID"), pV.ID, "pV.address",id(pV)
                for npV in VPDict.graph[pV]:
                    print ("npV.ID"), npV.ID, "npV.address",id(npV)
                print ("-----------") 

        def GetIDNumWeightGraph(self):
            newDict = {}
            for thisKey in self.graph.keys():
                newDict[thisKey.ID] = {}
                for neighKey in self.graph[thisKey]:
                    newDict[thisKey.ID][neighKey.ID] = self.graph[thisKey][neighKey].ID
                    
            newGraph = GRP.JunctionGraph() 
            newGraph.graph = newDict    
            return newGraph
    
        def GetIDNumWeightGraphAndPrint(self):
            newDict = {}
            for thisKey in self.graph.keys():
                newDict[thisKey.ID] = {}
                for neighKey in self.graph[thisKey]:
                    newDict[thisKey.ID][neighKey.ID] = self.graph[thisKey][neighKey].ID
                    
            newGraph = GRP.JunctionGraph() 
            newGraph.graph = newDict    
            print (newGraph.graph)    
            return newGraph
    
 
 
    #############
    # Now road finding is using this graph
    #############
    class ParcEdgeGraph:
        def __init__(self):
            self.graph = {}             # Type: Dict   {parcVertex{parcVertex:parcEdge} ...}  Store a JunctionGraph 
            self.depth = None
            
        def __del__(self):
            self.graph = None
            self.depth = None

        def DeepCopy(self,currE_Dict):
            
            ### convert the IDGraph
            IDGraph = self.GetIDNumWeightGraph()
            newParcEdgeGraph = GRP.ParcEdgeGraph()

            ### create space
            for eID in IDGraph.graph.keys():
                newParcEdgeGraph.graph[currE_Dict[eID]] = {}
            
            for eID in IDGraph.graph.keys():
                for nEID in IDGraph.graph[eID].keys():
                    
                    newParcEdgeGraph.graph[currE_Dict[eID]][currE_Dict[nEID]] = currE_Dict[IDGraph.graph[eID][nEID]]

            newParcEdgeGraph.depth = self.depth
            return newParcEdgeGraph
        
        def Clone(self):
            newParcEdgeGraph = GRP.ParcEdgeGraph()

            ### create space
            for pE in self.graph.keys():
                newParcEdgeGraph.graph[pE] = {}
            
            for pE in self.graph.keys():
                for nPE in self.graph[pE].keys():
                    
                    newParcEdgeGraph.graph[pE][nPE] = self.graph[pE][nPE]

            return newParcEdgeGraph
               

        @staticmethod
        def CreateParcEdgeGraphForThisDepth(junctionGraph):

            newParcEdgeGraph = GRP.ParcEdgeGraph()
            ### the TwinEdge will not be so clear
            newGraph = newParcEdgeGraph.graph
            ### create space
            
            for pV in junctionGraph.graph.keys():
                for parcEdge in junctionGraph.graph[pV].values():
                    if parcEdge.naked == False or (parcEdge.naked == True and parcEdge.streetID!=None) :######## avoid find road around the boundary  // allow first depth naked street
                        
                        newGraph[parcEdge] = {}

            for pV in junctionGraph.graph.keys():
                allParcEdges = junctionGraph.graph[pV].values()
                for parcEdge in allParcEdges:   
                    #print parcEdge.ID ,  parcEdge.generation, parcEdge.streetID
                    if parcEdge.naked == False or (parcEdge.naked == True and parcEdge.streetID!=None) :######## avoid find road around the boundary // allow first depth naked street
                        for nbParcEdge in allParcEdges:
                            if    nbParcEdge!=parcEdge and nbParcEdge.naked == False: ######## avoid find road around the boundary
                                newGraph[parcEdge][nbParcEdge] = nbParcEdge
                                #print "parcEdge,nbParcEdge",parcEdge.ID,nbParcEdge.ID 
            return newParcEdgeGraph

        @staticmethod
        def CreateNakedParcEdgeGraph(EDict):
            nakedParcEdgeGraph = GRP.ParcEdgeGraph()
            allNakedEdges = []
            for edge in EDict.values():
                if edge.naked == True and edge.isValid == True:
                    nakedParcEdgeGraph.graph[edge] = {}
                    allNakedEdges.append(edge)
            
            for nakedEdge in nakedParcEdgeGraph.graph.keys():
                nakedEdgeVIDs = [nakedEdge.startVertex.ID,nakedEdge.endVertex.ID]
                for comparedEdge in allNakedEdges:
                    if comparedEdge.startVertex.ID in nakedEdgeVIDs or comparedEdge.endVertex.ID in nakedEdgeVIDs:
                        nakedParcEdgeGraph.graph[nakedEdge][comparedEdge] = comparedEdge
            
            return nakedParcEdgeGraph

        @staticmethod
        def CreateMixParcEdgeGraph(EDict,extraEdges,exclude=[]):
            mixParcEdgeGraph = GRP.ParcEdgeGraph()
            allEdges = []
            for edge in EDict.values():
                if edge.naked == True and edge.isValid == True:
                    if edge not in exclude:
                        mixParcEdgeGraph.graph[edge] = {}
                        allEdges.append(edge)
            
            for edge in extraEdges:
                mixParcEdgeGraph.graph[edge] = {}
                allEdges.append(edge)
            
            
            for edge in mixParcEdgeGraph.graph.keys():
                edgeVIDs = [edge.startVertex.ID,edge.endVertex.ID]
                for comparedEdge in allEdges:
                    if edge!=comparedEdge:
                        if comparedEdge.startVertex.ID in edgeVIDs or comparedEdge.endVertex.ID in edgeVIDs:
                            mixParcEdgeGraph.graph[edge][comparedEdge] = comparedEdge
            
            return mixParcEdgeGraph


        def GetAllParcEdgeID(self):
            allParcEdge = self.graph.keys()
            allParcEdgeID = [parcEdge.ID for parcEdge in allParcEdge]
            
            return allParcEdgeID
        
        def GetAllParcEdgeTwinID(self):
            allParcEdge = self.graph.keys()
            allParcEdgeTwinID = []
            for parcEdge in allParcEdge: 
                if parcEdge.naked == False:
                    allParcEdgeTwinID.append(parcEdge.twinID)
            
            return allParcEdgeTwinID   

        def GetIDNumWeightGraph(self):
            newDict = {}
            for thisKey in self.graph.keys():
                newDict[thisKey.ID] = {}
                for neighKey in self.graph[thisKey]:
                    newDict[thisKey.ID][neighKey.ID] = self.graph[thisKey][neighKey].ID
                    
            newGraph = GRP.ParcEdgeGraph() 
            newGraph.graph = newDict           
            return newGraph 
        
        def GetIDNumWeightLengthGraph(self):
            newDict = {}
            for thisKey in self.graph.keys():
                newDict[thisKey.ID] = {}
                for neighKey in self.graph[thisKey]:
                    newDict[thisKey.ID][neighKey.ID] = self.graph[thisKey][neighKey].GetGeometry().Length
                    
            newGraph = GRP.ParcEdgeGraph() 
            newGraph.graph = newDict           
            return newGraph 
  
        def GetIDNumWeightAngleGraph(self):
            newDict = {}
            angleGraph = self.CreateParcEdgeAngleGraph()
            for thisKey in self.graph.keys():
                newDict[thisKey.ID] = {}
                for neighKey in self.graph[thisKey]:
                    newDict[thisKey.ID][neighKey.ID] = angleGraph.graph[thisKey][neighKey]
                    
            newGraph = GRP.ParcEdgeGraph() 
            newGraph.graph = newDict           
            return newGraph 

        def GetIDNumWeightAngleGraph_Debug(self):
            newDict = {}
            angleGraph = self.CreateParcEdgeAngleGraph_Debug()
            for thisKey in self.graph.keys():
                newDict[thisKey.ID] = {}
                for neighKey in self.graph[thisKey]:
                    newDict[thisKey.ID][neighKey.ID] = angleGraph.graph[thisKey][neighKey]
                    
            newGraph = GRP.ParcEdgeGraph() 
            newGraph.graph = newDict           
            return newGraph 

        ############
        # Abstract functions
        ############
        # This function is to abstract the streets as nodes, creating a graph. 
        # Reminder : The base graph is the fundamental parcEdge graph 
        def AbstractSubGraph(self,PL,streetGraph,EDict): 
            
            # Create a new graph, eventually will return this
            newParcEdgeGraph = GRP.ParcEdgeGraph()    
            
            # Collect the edges that should be abstracted in to new abstract nodes
            abstarctParcEdgesCollection = []
            for street in streetGraph.graph.keys():
                abstarctParcEdgesCollection.extend(street.GetAllParcEdge())

            # Create a new node that represent the whole street network
            newNodeKey = PL.ParcEdge("abstractNode")
            newNodeKey.startVertex = PL.ParcVertex(rg.Point3d(0,0,0),"abstractNode")
            newNodeKey.endVertex = PL.ParcVertex(rg.Point3d(0,0,0),"abstractNode")

            # Merge those related info to the new node
            # Collect are related edges
            allRelatedParcEdges = []


            for pE in abstarctParcEdgesCollection: 
                thisPERelated = []
                if pE in self.graph.keys():
                    thisPERelated = self.graph[pE].values()
                elif pE.naked == False and EDict[pE.twinID] in self.graph.keys():
                    thisPERelated = self.graph[EDict[pE.twinID]].values()
                
                for pER in thisPERelated:
                    if pER.naked ==True :
                        if pER not in allRelatedParcEdges and pER not in abstarctParcEdgesCollection:   # havent added and not in abstract node
                            allRelatedParcEdges.append(pER)
                            
                    else:
                        if pER not in allRelatedParcEdges and pER not in abstarctParcEdgesCollection and EDict[pER.twinID] not in abstarctParcEdgesCollection :
                                allRelatedParcEdges.append(pER)
            
            # Add these as the new node's neighbors
            newNodeValue = {}
            for pER in allRelatedParcEdges:
                newNodeValue[pER] = pER
            
            # Store this new node into the graph
            newParcEdgeGraph.graph[newNodeKey] = newNodeValue
        
            # Add the remain nodes, create space
            for restParcEdge in self.graph.keys():         # "rest" means it is not in a street , make sure its twin edge is not in a street either, create a space in the graph
                if restParcEdge.naked ==True:
                    if restParcEdge not in abstarctParcEdgesCollection:     
                        newParcEdgeGraph.graph[restParcEdge] = {}     
                elif restParcEdge.naked == False:
                    if  restParcEdge not in abstarctParcEdgesCollection and EDict[restParcEdge.twinID] not in abstarctParcEdgesCollection:
                        newParcEdgeGraph.graph[restParcEdge] = {}
            
            # Add the remain nodes' neighbor, but exclude the edges that have been abstracted       
            for restParcEdge in newParcEdgeGraph.graph.keys(): 
                if restParcEdge!=newNodeKey:
                    for pEdge in self.graph[restParcEdge].keys():  ### be careful to use "keys()" or "values()"
                        if pEdge.naked ==True:
                            if pEdge not in abstarctParcEdgesCollection :
                                newParcEdgeGraph.graph[restParcEdge][pEdge] = pEdge
                        
                            elif pEdge in abstarctParcEdgesCollection :
                                newParcEdgeGraph.graph[restParcEdge][newNodeKey] = pEdge
                    
                        elif pEdge.naked == False: 
                            if pEdge not in abstarctParcEdgesCollection and EDict[pEdge.twinID] not in abstarctParcEdgesCollection:
                                newParcEdgeGraph.graph[restParcEdge][pEdge] = pEdge
                            
                            elif pEdge in abstarctParcEdgesCollection or EDict[pEdge.twinID] in abstarctParcEdgesCollection:
                                newParcEdgeGraph.graph[restParcEdge][newNodeKey] = pEdge

            # Add the new node as those related nodes' neighbor , beacasue the new node does not exsit in the intial graph. This is neccessary.
            for nbPE in newParcEdgeGraph.graph[newNodeKey].keys():
                newParcEdgeGraph.graph[nbPE][newNodeKey] = nbPE

            return newParcEdgeGraph , newNodeKey # the abstract graph and abstract node    
        
        def AbstractSubGraphWithNakedStreet(self,PL,nakedStreets,EDict): 
            
            # Create a new graph, eventually will return this
            newParcEdgeGraph = GRP.ParcEdgeGraph()    
            
            # Collect the edges that should be abstracted in to new abstract nodes
            abstarctParcEdgesCollection = []
            for street in nakedStreets:
                abstarctParcEdgesCollection.extend(street.GetAllParcEdge())

            # Create a new node that represent the whole street network
            newNodeKey = PL.ParcEdge("abstractNode")
            newNodeKey.startVertex = PL.ParcVertex(rg.Point3d(0,0,0),"abstractNode")
            newNodeKey.endVertex = PL.ParcVertex(rg.Point3d(0,0,0),"abstractNode")

            # Merge those related info to the new node
            # Collect are related edges
            allRelatedParcEdges = []


            for pE in abstarctParcEdgesCollection: 
                
                thisPERelated = []
                if pE in self.graph.keys():
                    thisPERelated = self.graph[pE].values()
                elif pE.naked == False and EDict[pE.twinID] in self.graph.keys():
                    thisPERelated = self.graph[EDict[pE.twinID]].values()

                for pER in thisPERelated:
                    if pER.naked ==True :
                        if pER not in allRelatedParcEdges and pER not in abstarctParcEdgesCollection:   # havent added and not in abstract node
                            allRelatedParcEdges.append(pER)
                            
                    else:
                        if pER not in allRelatedParcEdges and pER not in abstarctParcEdgesCollection and EDict[pER.twinID] not in abstarctParcEdgesCollection :
                                allRelatedParcEdges.append(pER)
     
            # Add these as the new node's neighbors
            newNodeValue = {}
            for pER in allRelatedParcEdges:
                newNodeValue[pER] = pER
            
            # Store this new node into the graph
            newParcEdgeGraph.graph[newNodeKey] = newNodeValue
        
            # Add the remain nodes, create space
            for restParcEdge in self.graph.keys():         # "rest" means it is not in a street , make sure its twin edge is not in a street either, create a space in the graph
                if restParcEdge.naked ==True:
                    if restParcEdge not in abstarctParcEdgesCollection:     
                        newParcEdgeGraph.graph[restParcEdge] = {}     
                elif restParcEdge.naked == False:
                    if  restParcEdge not in abstarctParcEdgesCollection and EDict[restParcEdge.twinID] not in abstarctParcEdgesCollection:
                        newParcEdgeGraph.graph[restParcEdge] = {}
            
            # Add the remain nodes' neighbor, but exclude the edges that have been abstracted       
            for restParcEdge in newParcEdgeGraph.graph.keys(): 
                if restParcEdge!=newNodeKey:
                    for pEdge in self.graph[restParcEdge].keys():  ### be careful to use "keys()" or "values()"
                        if pEdge.naked ==True:
                            if pEdge not in abstarctParcEdgesCollection :
                                newParcEdgeGraph.graph[restParcEdge][pEdge] = pEdge
                        
                            elif pEdge in abstarctParcEdgesCollection :
                                newParcEdgeGraph.graph[restParcEdge][newNodeKey] = pEdge
                    
                        elif pEdge.naked == False: 
                            if pEdge not in abstarctParcEdgesCollection and EDict[pEdge.twinID] not in abstarctParcEdgesCollection:
                                newParcEdgeGraph.graph[restParcEdge][pEdge] = pEdge
                            
                            elif pEdge in abstarctParcEdgesCollection or EDict[pEdge.twinID] in abstarctParcEdgesCollection:
                                newParcEdgeGraph.graph[restParcEdge][newNodeKey] = pEdge

            # Add the new node as those related nodes' neighbor , beacasue the new node does not exsit in the intial graph. This is neccessary.
            for nbPE in newParcEdgeGraph.graph[newNodeKey].keys():
                newParcEdgeGraph.graph[nbPE][newNodeKey] = nbPE

            return newParcEdgeGraph , newNodeKey # the abstract graph and abstract node    
        
        
        # This function is to abstract the edges in the mutual start, creating a graph. 
        # Reminder : The base graph is the graph that the street network has been abstracted
        def AbstractSubGraphWithMutualStart(self,PL,startEdgeCollection,sideGeo,EDict):
            # Create a new graph, eventually will return this    
            newParcEdgeGraph = GRP.ParcEdgeGraph()
            
            # Create a new node that represent the edges in the same side
            newNodeKey = PL.ParcEdge("abstractStart")
            newNodeKey.startVertex = PL.ParcVertex(sideGeo.First,startEdgeCollection[0].startVertex.ID)
            newNodeKey.endVertex = PL.ParcVertex(sideGeo.Last,startEdgeCollection[-1].endVertex.ID)
            for i in range(1,len(sideGeo)-1,1):
                newNodeKey.betweenPoints.append(PL.ParcPoint(sideGeo[i],"abstractStart"))
                
            # Merge those related info to the new node
            # Collect are related edges
            allRelatedParcEdges = []

            for pE in startEdgeCollection: 
                thisPERelated = None
                
                if pE in self.graph.keys():
                    thisPERelated = self.graph[pE].values()   
                elif pE.naked == False and EDict[pE.twinID] in self.graph.keys():
                    thisPERelated = self.graph[EDict[pE.twinID]].values()        

                if thisPERelated == [] or thisPERelated == None:           # In case nothing found
                    continue

                for pER in thisPERelated:
                    if pER.naked ==True :
                        if pER not in allRelatedParcEdges and pER not in startEdgeCollection:
                            allRelatedParcEdges.append(pER)
                    else:
                        if pER not in allRelatedParcEdges and pER not in startEdgeCollection and EDict[pER.twinID] not in startEdgeCollection :
                            allRelatedParcEdges.append(pER)  
            
            # Add these as the new node's neighbors
            newNodeValue = {}
            for pER in allRelatedParcEdges:
                newNodeValue[pER] = pER
            
            # Store this new node into the graph
            newParcEdgeGraph.graph[newNodeKey] = newNodeValue
            
            # Add the remain nodes, create space
            for restParcEdge in self.graph.keys():    # "rest" means it is not in "start side" , make sure its twin edge is not in "start side"  either, create a space in the graph
                if restParcEdge.naked ==True:
                    if restParcEdge not in startEdgeCollection:
                        newParcEdgeGraph.graph[restParcEdge] = {}
                elif restParcEdge.naked == False:                       # Be careful since now this base graph has the abstract network node, some extra action needed
                    if restParcEdge.ID != "abstractNode":               # If it is not operating the "abstract network node"
                        if  restParcEdge not in startEdgeCollection and EDict[restParcEdge.twinID] not in startEdgeCollection:
                            newParcEdgeGraph.graph[restParcEdge] = {}
                    elif restParcEdge.ID == "abstractNode":             # If it is operating the "abstract network node"
                        newParcEdgeGraph.graph[restParcEdge] = {}
              
            # Add the remain nodes' neighbor, but exclude the edges that have been abstracted    
            for restParcEdge in newParcEdgeGraph.graph.keys(): 
                if restParcEdge!=newNodeKey:
                    for pEdge in self.graph[restParcEdge].keys():  # be careful to use "keys()" or "values()"
                        if pEdge.naked ==True:
                            if pEdge not in startEdgeCollection :
                                newParcEdgeGraph.graph[restParcEdge][pEdge] = pEdge
                                #print "case1","newParcEdgeGraph.graph[restParcEdge][pEdge] = pEdge" , restParcEdge.ID,pEdge.ID,pEdge.ID

                            elif pEdge in startEdgeCollection :
                                newParcEdgeGraph.graph[restParcEdge][newNodeKey] = pEdge
         
                        elif pEdge.naked == False and pEdge.ID != "abstractNode": 
                            if pEdge not in startEdgeCollection and EDict[pEdge.twinID] not in startEdgeCollection:
                                newParcEdgeGraph.graph[restParcEdge][pEdge] = pEdge
                                #print "case3","newParcEdgeGraph.graph[restParcEdge][pEdge] = pEdge" , restParcEdge.ID,pEdge.ID,pEdge.ID

                            elif pEdge in startEdgeCollection or EDict[pEdge.twinID] in startEdgeCollection:
                                newParcEdgeGraph.graph[restParcEdge][newNodeKey] = pEdge
                             
                        elif pEdge.naked == False and pEdge.ID == "abstractNode": 
                            newParcEdgeGraph.graph[restParcEdge][pEdge] = pEdge
                            
            # Add the new node as those related nodes' neighbor , beacasue the new node does not exsit in the intial graph. This is neccessary.   
            for nbPE in newParcEdgeGraph.graph[newNodeKey].keys():
                newParcEdgeGraph.graph[nbPE][newNodeKey] = nbPE


  
            ###########################
            # Special Treatment 
            # - Kill mutual connection of the continuous edges
            # e.g.  T case : AbstractNode(abstract network node) might have 2 connection of startAbstart
            ###########################
            for i in range(len(startEdgeCollection)-1):
                firstPE = startEdgeCollection[i]
                secondPE = startEdgeCollection[i+1]
                
                firstPE_Right = None                # Make sure the edge is in the graph (becasue of twin edge)
                secondPE_Right = None               # Make sure the edge is in the graph (becasue of twin edge)
                if firstPE in self.graph.keys():    # use the base graph
                    firstPE_Right = firstPE
                elif EDict[firstPE.twinID] in self.graph.keys():
                    firstPE_Right = EDict[firstPE.twinID]

                if secondPE in self.graph.keys():
                    secondPE_Right = secondPE
                elif EDict[secondPE.twinID] in self.graph.keys():
                    secondPE_Right = EDict[secondPE.twinID]
                    
                if firstPE_Right !=None and secondPE_Right!=None:
                        firstNeighbors = self.graph[firstPE_Right].keys()
                        secondNeighbors = self.graph[secondPE_Right].keys()
                        
                        firstSet = set(firstNeighbors)
                        secondSet = set(secondNeighbors)
                        commonPEList = firstSet.intersection(secondSet)

                        for commonPE in commonPEList:
                            if commonPE.ID != "abstractNode":                        ### when the corner of exsiting streets touching the mutual edges with a point
                                newParcEdgeGraph.graph[commonPE].pop(newNodeKey)
                                newParcEdgeGraph.graph[newNodeKey].pop(commonPE)  
   
            return newParcEdgeGraph,newNodeKey
        
        # This function is to disconnect the new generated street TEMPORARILY (Because the street might not be completed yet, to avoid it search backward), creating a graph. 
        # Reminder : Need to clone a base graph to avoid it is changed
        def AbstractSubGraphWithNewStreet(self,EDict,newStreet,streetGraph): 
            
            # Clone the base Graph (the graph that the street network has been abstracted)
            newBaseGraph = self.Clone()
            
            # Retrieve the newNodeKey
            for key in newBaseGraph.graph.keys():
                if key.ID == "abstractNode":
                    newNodeKey = key
              

            # Make sure the edge in newStreet are in the graph (becasue of twin edge)
            newStreetPEs = newStreet.GetAllParcEdge()
            newStreetPEs_Valid = []
            for edge in newStreetPEs:
                if edge in newBaseGraph.graph.keys():
                    newStreetPEs_Valid.append(edge)
                elif EDict[edge.twinID] in newBaseGraph.graph.keys():
                    newStreetPEs_Valid.append(EDict[edge.twinID]) 
            
            newStreetPEs_ValidIDs = [edge.ID for edge in newStreetPEs_Valid]   
     
            ###########################
            # Special Treatment 
            # Kill connection within the street edges to avoid searching backward
            ###########################
      
            for thisEdge in newStreetPEs_Valid:
                for nbEdge in newBaseGraph.graph[thisEdge].keys():
                    if nbEdge.ID in newStreetPEs_ValidIDs:
                        newBaseGraph.graph[thisEdge].pop(nbEdge)
                        newBaseGraph.graph[nbEdge].pop(thisEdge)
      
            ###########################
            # Special Treatment 
            # - Kill mutual connection of the continuous edges
            # e.g.  T case : AbstractNode(abstract network node) might have 2 connection of startAbstart
            ###########################
            newStreetPEs = newStreet.GetAllParcEdge()
            for i in range(len(newStreetPEs_Valid)-1):
                firstPE = newStreetPEs_Valid[i]
                secondPE = newStreetPEs_Valid[i+1]
    
                if firstPE !=None and secondPE!=None:
                    firstNeighbors = newBaseGraph.graph[firstPE].keys()
                    secondNeighbors = newBaseGraph.graph[secondPE].keys()
                    
                    firstSet = set(firstNeighbors)
                    secondSet = set(secondNeighbors)
                    commonPEList = firstSet.intersection(secondSet)
                    
                    for commonPE in commonPEList:
                        #print "commonPE",commonPE.ID, "firstPE",firstPE.ID,  "secondPE",secondPE.ID
  
                        newBaseGraph.graph[commonPE].pop(firstPE)
                        newBaseGraph.graph[commonPE].pop(secondPE)
                        newBaseGraph.graph[firstPE].pop(commonPE)
                        newBaseGraph.graph[secondPE].pop(commonPE)
                        
            # print [edge.ID for edge in newBaseGraph.graph[newNodeKey].keys()]    
            ###########################
            # Kill connection the end streetSegemnt with streetGraph
            ###########################
            pE = newStreet.end.prevConnection
     
            pETwin =  EDict[newStreet.end.prevConnection.twinID]
            
            if pE in newBaseGraph.graph[newNodeKey].keys():
                chosenPE = pE
            else:
                chosenPE = pETwin

            ### it might be killed previously
            if chosenPE in newBaseGraph.graph[newNodeKey].keys():
                newBaseGraph.graph[newNodeKey].pop(chosenPE)
                newBaseGraph.graph[chosenPE].pop(newNodeKey)

            # print " before Kill connection the end street Segment "
            # print [egde.ID for egde in newBaseGraph.graph[chosenPE]]
            ###########################
            # Kill connection the end street Segment with streetGraph : for single edge. the mutual point of its neighbor is on the streetGraph already
            ###########################
            # Find the rest valid neighbors
            # print [edge.ID for edge in newBaseGraph.graph[newNodeKey].keys()]
            # print [edge.ID for edge in newBaseGraph.graph[newNodeKey].values()]
            # print chosenPE.ID,chosenPE.twinID
            # if chosenPE in newBaseGraph.graph[newNodeKey].keys():
            restValidNEdges = newBaseGraph.graph[chosenPE].keys()
            allStreetVIDs = streetGraph.GetAllParcVertexID()
            # print "allStreetVIDs",allStreetVIDs
            # print "chosenPE", chosenPE.startVertex.ID,chosenPE.endVertex.ID
            for nEdge in restValidNEdges:
                # print "nEdge", nEdge.startVertex.ID,nEdge.endVertex.ID
                mutualV = None
                if chosenPE.startVertex.ID == nEdge.startVertex.ID:
                    mutualV = chosenPE.startVertex
                elif chosenPE.startVertex.ID == nEdge.endVertex.ID:
                    mutualV = chosenPE.startVertex
                elif chosenPE.endVertex.ID == nEdge.startVertex.ID:
                    mutualV = chosenPE.endVertex
                elif chosenPE.endVertex.ID == nEdge.endVertex.ID:
                    mutualV = chosenPE.endVertex
                if mutualV.ID in allStreetVIDs:
                    newBaseGraph.graph[nEdge].pop(chosenPE)
                    newBaseGraph.graph[chosenPE].pop(nEdge)
            
            # print " after Kill connection the end street Segment "
            # print [egde.ID for edeg in newBaseGraph.graph[chosenPE]]
            return newBaseGraph, newNodeKey # the abstract one disconnect the uncompleted street connection,  same exsiting network without this new uncompleted street  

        def CheckQuickPath(self,abstarctStart,abstarctNode,wA):
            abstarctStartRelated = self.graph[abstarctStart].keys()
            # print ("abstarctStartRelated" ), [pE.ID for pE in abstarctStartRelated]
            #print ("currUsedGraphNb" ),[parcEdge.ID for parcEdge in self.graph[abstarctNode].keys()]
            #print ("currUsedGraphNb" ),[parcEdge.ID for parcEdge in self.graph[abstarctNode].values()]
            possiblePath = []
            for parcEdge in abstarctStartRelated:
                if parcEdge in self.graph[abstarctNode].keys():
                    possiblePath.append(parcEdge)
                    
            
            ### special
            for parcEdge in abstarctStartRelated:
                if parcEdge.ID == "abstractNode":
                    # print ("quick path connected with abstractNode")
                    minPath = [abstarctStart,abstarctNode]
                    minScore = 0
                    return minPath,minScore


            angleCosts = []
            distCosts = []
            scoreCosts = []
            distanceList = []
            for pE in self.graph.keys():
                if pE.ID !="abstractStart":
                    distanceList.append(pE.GetGeometry().Length)
                    minDist = min(distanceList)
                    maxDist = max(distanceList)

        
            minAngle = 0
            maxAngle = math.pi
            wD = 1 - wA
            
            # chose the optimal one 
            if len(possiblePath) == 0:
                # print ("no QuickPath")
                return None,None
            
            elif len(possiblePath) == 1:
                minPath = [abstarctStart,possiblePath[0],abstarctNode]
                # print ("QuickPath 1 "),[node.ID for node in minPath]
                pEdge = possiblePath[0]
                if pEdge.startVertex.geometry == abstarctStart.startVertex.geometry or pEdge.endVertex.geometry == abstarctStart.startVertex.geometry:
                    commonPt = abstarctStart.startVertex.geometry
                elif pEdge.startVertex.geometry == abstarctStart.endVertex.geometry or pEdge.endVertex.geometry == abstarctStart.endVertex.geometry:
                    commonPt = abstarctStart.endVertex.geometry
                
                if commonPt == pEdge.startVertex.geometry:
                    nextPEpt = pEdge.endVertex.geometry
                elif commonPt == pEdge.endVertex.geometry:
                    nextPEpt = pEdge.startVertex.geometry
                    
                if commonPt == abstarctStart.startVertex.geometry:
                    nextASpt = abstarctStart.endVertex.geometry
                elif commonPt == abstarctStart.endVertex.geometry:
                    nextASpt = abstarctStart.startVertex.geometry
                    
                vecA = rg.Vector3d(commonPt - nextPEpt)    
                vecB = rg.Vector3d(nextASpt -commonPt)    
                angle = rg.Vector3d.VectorAngle(vecA,vecB)
                
                angleCosts.append(angle)
                distCosts.append(pEdge.GetGeometry().Length + abstarctStart.GetGeometry().Length)
        
     
                costDist_Remap = (distCosts[0]-minDist) / (maxDist- minDist)
                costAngle_Remap = (angleCosts[0]-minAngle) / (maxAngle- minAngle)
        
                costMix = wD * costDist_Remap + wA * costAngle_Remap
                return minPath,costMix
            
            elif len(possiblePath) > 1:
                #print ("len(possiblePath) > 1")
                #print [pE.ID for pE in possiblePath]
                for pEdge in possiblePath:
                
                    # print ("pEdge.ID"), pEdge.ID
                    # print ("pEdge start and end " )
                    # pEGeo = pEdge.GetGeometry()
                    # for pt in pEGeo:
                    #     print pt.X, pt.Y, 0
                
                    # print ("abstarctStart start and end ")
                    # abGeo = abstarctStart.GetGeometry()
                    # for pt in abGeo:
                    #     print pt.X, pt.Y, 0

                    #print "-------"
                    # find common point
                    if pEdge.startVertex.geometry == abstarctStart.startVertex.geometry or pEdge.endVertex.geometry == abstarctStart.startVertex.geometry:
                        commonPt = abstarctStart.startVertex.geometry
                    elif pEdge.startVertex.geometry == abstarctStart.endVertex.geometry or pEdge.endVertex.geometry == abstarctStart.endVertex.geometry:
                        commonPt = abstarctStart.endVertex.geometry
                    
                    if commonPt == pEdge.startVertex.geometry:
                        nextPEpt = pEdge.endVertex.geometry
                    elif commonPt == pEdge.endVertex.geometry:
                        nextPEpt = pEdge.startVertex.geometry
                        
                    if commonPt == abstarctStart.startVertex.geometry:
                        nextASpt = abstarctStart.endVertex.geometry
                    elif commonPt == abstarctStart.endVertex.geometry:
                        nextASpt = abstarctStart.startVertex.geometry
                        
                    vecA = rg.Vector3d(commonPt-nextPEpt)    
                    vecB = rg.Vector3d(nextASpt -commonPt)    
                    angle = rg.Vector3d.VectorAngle(vecA,vecB)
                    
                    angleCosts.append(angle)
                    distCosts.append(pEdge.GetGeometry().Length + abstarctStart.GetGeometry().Length)


                for i in range(len(possiblePath)):    
                    costDist_Remap = (distCosts[i]-minDist) / (maxDist- minDist)
                    costAngle_Remap = (angleCosts[i]-minAngle) / (maxAngle- minAngle)
            
                    costMix = wD * costDist_Remap + wA * costAngle_Remap
                    scoreCosts.append(costMix)
                    
                minScore = min(scoreCosts)
                minIndex = scoreCosts.index(minScore)
                minPE = possiblePath[minIndex]
                minPath = [abstarctStart,minPE,abstarctNode]
                
                #print ("angleCosts "), angleCosts 
                #print ("distCosts"),distCosts
                #print  ("scoreCosts "), scoreCosts
                #print ("QuickPath n "),[node.ID for node in minPath]
                
                return minPath,minScore
        
        def CheckQuickPath_Eva(self,startEdge,possiblePath,abstarctNode,wA):

            angleCosts = []
            distCosts = []
            scoreCosts = []
            distanceList = []
            for pE in self.graph.keys():
                if pE.ID !="abstractStart":
                    distanceList.append(pE.GetGeometry().Length)
                    minDist = min(distanceList)
                    maxDist = max(distanceList)

        
            minAngle = 0
            maxAngle = math.pi
            wD = 1 - wA
            
            
            # chose the optimal one 
            if len(possiblePath) == 0:
                # print ("no QuickPath")
                return None,None
            
            elif len(possiblePath) == 1:
                minPath = [startEdge,possiblePath[0],abstarctNode]
                # print ("QuickPath 1 "),[node.ID for node in minPath]
                pEdge = possiblePath[0]
                if pEdge.startVertex.geometry == startEdge.startVertex.geometry or pEdge.endVertex.geometry == startEdge.startVertex.geometry:
                    commonPt = startEdge.startVertex.geometry
                elif pEdge.startVertex.geometry == startEdge.endVertex.geometry or pEdge.endVertex.geometry == startEdge.endVertex.geometry:
                    commonPt = startEdge.endVertex.geometry
                
                if commonPt == pEdge.startVertex.geometry:
                    nextPEpt = pEdge.endVertex.geometry
                elif commonPt == pEdge.endVertex.geometry:
                    nextPEpt = pEdge.startVertex.geometry
                    
                if commonPt == startEdge.startVertex.geometry:
                    nextASpt = startEdge.endVertex.geometry
                elif commonPt == startEdge.endVertex.geometry:
                    nextASpt = startEdge.startVertex.geometry
                    
                vecA = rg.Vector3d(commonPt - nextPEpt)    
                vecB = rg.Vector3d(nextASpt -commonPt)    
                angle = rg.Vector3d.VectorAngle(vecA,vecB)
                
                angleCosts.append(angle)
                distCosts.append(pEdge.GetGeometry().Length + startEdge.GetGeometry().Length)
        
     
                costDist_Remap = (distCosts[0]-minDist) / (maxDist- minDist)
                costAngle_Remap = (angleCosts[0]-minAngle) / (maxAngle- minAngle)
        
                costMix = wD * costDist_Remap + wA * costAngle_Remap
                return minPath,costMix
            
            elif len(possiblePath) > 1:
                #print ("len(possiblePath) > 1")
                #print [pE.ID for pE in possiblePath]
                for pEdge in possiblePath:
                
                    # print ("pEdge.ID"), pEdge.ID
                    # print ("pEdge start and end " )
                    # pEGeo = pEdge.GetGeometry()
                    # for pt in pEGeo:
                    #     print pt.X, pt.Y, 0
                
                    # print ("abstarctStart start and end ")
                    # abGeo = abstarctStart.GetGeometry()
                    # for pt in abGeo:
                    #     print pt.X, pt.Y, 0

                    #print "-------"
                    # find common point
                    if pEdge.startVertex.geometry == startEdge.startVertex.geometry or pEdge.endVertex.geometry == startEdge.startVertex.geometry:
                        commonPt = startEdge.startVertex.geometry
                    elif pEdge.startVertex.geometry == startEdge.endVertex.geometry or pEdge.endVertex.geometry == startEdge.endVertex.geometry:
                        commonPt = startEdge.endVertex.geometry
                    
                    # print pEdge.startVertex.geometry.X,pEdge.startVertex.geometry.Y,0
                    # print pEdge.endVertex.geometry.X,pEdge.endVertex.geometry.Y,0
                    # print startEdge.startVertex.geometry.X,startEdge.startVertex.geometry.Y,0
                    # print startEdge.endVertex.geometry.X,startEdge.endVertex.geometry.Y,0


                    if commonPt == pEdge.startVertex.geometry:
                        nextPEpt = pEdge.endVertex.geometry
                    elif commonPt == pEdge.endVertex.geometry:
                        nextPEpt = pEdge.startVertex.geometry
                        
                    if commonPt == startEdge.startVertex.geometry:
                        nextASpt = startEdge.endVertex.geometry
                    elif commonPt == startEdge.endVertex.geometry:
                        nextASpt = startEdge.startVertex.geometry
                        
                    vecA = rg.Vector3d(commonPt - nextPEpt)    
                    vecB = rg.Vector3d(nextASpt -commonPt)    
                    angle = rg.Vector3d.VectorAngle(vecA,vecB)
                    
                    angleCosts.append(angle)
                    distCosts.append(pEdge.GetGeometry().Length + startEdge.GetGeometry().Length)


                for i in range(len(possiblePath)):    
                    costDist_Remap = (distCosts[i]-minDist) / (maxDist- minDist)
                    costAngle_Remap = (angleCosts[i]-minAngle) / (maxAngle- minAngle)
            
                    costMix = wD * costDist_Remap + wA * costAngle_Remap
                    scoreCosts.append(costMix)
                    
                minScore = min(scoreCosts)
                minIndex = scoreCosts.index(minScore)
                minPE = possiblePath[minIndex]
                minPath = [startEdge,minPE,abstarctNode]
                
                #print ("QuickPath n "),[node.ID for node in minPath]
                
                return minPath,minScore
                     
        def CheckAddress(self,EDict):
            for e in  EDict.values():
                print ("e.ID"), e.ID, "e.address",id(e) 
            print ("-----------------------")
            for e in EDict.graph.keys():
                print ("e.ID"), e.ID, "e.address",id(e)
                for nE in EDict.graph[e]:
                    print ("nE.ID"), nE.ID, "nE.address",id(nE)
                print ("-----------")
        
        
        @staticmethod                
        def CreateRelatedEdgeGraph(relatedEdges):
            # Create a mutual edge graph to search
            relatedEdgeGraph = GRP.ParcEdgeGraph()
            for edge in relatedEdges:
                relatedEdgeGraph.graph[edge] = {}
                for otherEdge in relatedEdges:
                    if otherEdge != edge:
                        # check if they are connected
                        if edge.startVertex.geometry == otherEdge.startVertex.geometry or edge.startVertex.geometry == otherEdge.endVertex.geometry:
                            relatedEdgeGraph.graph[edge][otherEdge] = otherEdge
                        elif edge.endVertex.geometry == otherEdge.startVertex.geometry or edge.endVertex.geometry == otherEdge.endVertex.geometry:
                            relatedEdgeGraph.graph[edge][otherEdge] = otherEdge
            
            return relatedEdgeGraph      
        
        def CreateParcEdgeAngleGraph(self):
            angleGraph = GRP.ParcEdgeGraph()
            for thisNode in self.graph.keys():
                angleGraph.graph[thisNode] = {}
                
            for thisNode in self.graph.keys():
                if thisNode.ID != "abstractNode":
                    for nb in self.graph[thisNode]:
                        thisChosen = None
                        nbChosen = None
                        nbGeo = None
                        thisGeo = None
                        #print nb.ID,nb.startVertex.ID,nb.endVertex.ID
                        #print thisNode.ID,thisNode.startVertex.ID,thisNode.endVertex.ID
                        
                        if nb.ID != "abstractNode":
                            if thisNode.startVertex.ID != nb.startVertex.ID and thisNode.startVertex.ID != nb.endVertex.ID:
                                thisChosen = thisNode.endVertex
                            elif thisNode.startVertex.ID == nb.startVertex.ID or thisNode.startVertex.ID == nb.endVertex.ID:
                                thisChosen = thisNode.startVertex

                            if nb.startVertex.ID == thisChosen.ID :
                                nbChosen = nb.startVertex
                            elif nb.endVertex.ID == thisChosen.ID :
                                nbChosen = nb.endVertex
                            
                            ### get This node geo 
                            if thisChosen.ID == thisNode.startVertex.ID:
                                thisGeo = rg.Polyline(thisNode.GetGeometry())
                            elif thisChosen.ID == thisNode.endVertex.ID:
                                thisGeo = rg.Polyline(thisNode.GetGeometry())
                                thisGeo.Reverse()
                                
                            ### get nb node geo 
                            if nbChosen.ID == nb.startVertex.ID:
                                nbGeo = rg.Polyline(nb.GetGeometry())
                            elif thisChosen.ID == nb.endVertex.ID:
                                nbGeo = rg.Polyline(nb.GetGeometry())
                                nbGeo.Reverse()
                            # except:
                            #     nbGeo = rg.Polyline(nb.GetGeometry())
                            #     print ("nbGeo")
                            #     for pt in nbGeo:
                            #         print (pt.X),pt.Y,0
                                
                            #     print ("thisNode")    
                            #     for pt in thisNode.GetGeometry():
                            #         print (pt.X),pt.Y,0    
                                    
                            
                            
                            
                            #thisVec = rg.Vector3d (thisGeo[0] - thisGeo[1])
                            #nbVec = rg.Vector3d (nbGeo[1] - nbGeo[0])
                            
                            thisVec = rg.Vector3d (thisGeo.First - thisGeo.Last)
                            nbVec = rg.Vector3d (nbGeo.Last - nbGeo.First)
                            
                            angle = rg.Vector3d.VectorAngle(thisVec,nbVec)
                            angleGraph.graph[thisNode][nb] = rm.ToDegrees(angle)

                        elif nb.ID =='abstractNode':
                            angleGraph.graph[thisNode][nb] = 0
                
                elif thisNode.ID =='abstractNode':
                    
                    for nb in self.graph[thisNode]:
                        #print thisNode.ID, nb.ID
                        angleGraph.graph[thisNode][nb] = 0
            
            return angleGraph
    
        def CreateParcEdgeAngleGraph_Debug(self):
            angleGraph = GRP.ParcEdgeGraph()
            for thisNode in self.graph.keys():
                angleGraph.graph[thisNode] = {}
                
            for thisNode in self.graph.keys():
                if thisNode.ID != "abstractNode":
                    for nb in self.graph[thisNode]:
                        thisChosen = None
                        nbChosen = None
                        nbGeo = None
                        thisGeo = None
                        #print nb.ID,nb.startVertex.ID,nb.endVertex.ID
                        #print thisNode.ID,thisNode.startVertex.ID,thisNode.endVertex.ID
                        nbGeo = rg.Polyline(nb.GetGeometry())
                        
                        #for pt in nbGeo:
                            #print pt.X,pt.Y,0
                            
                        if nb.ID != "abstractNode":
                            if thisNode.startVertex.ID != nb.startVertex.ID and thisNode.startVertex.ID != nb.endVertex.ID:
                                thisChosen = thisNode.endVertex
                            elif thisNode.startVertex.ID == nb.startVertex.ID or thisNode.startVertex.ID == nb.endVertex.ID:
                                thisChosen = thisNode.startVertex

                            if nb.startVertex.ID == thisChosen.ID :
                                nbChosen = nb.startVertex
                            elif nb.endVertex.ID == thisChosen.ID :
                                nbChosen = nb.endVertex
                            
                            ### get This node geo 
                            if thisChosen.ID == thisNode.startVertex.ID:
                                thisGeo = rg.Polyline(thisNode.GetGeometry())
                            elif thisChosen.ID == thisNode.endVertex.ID:
                                thisGeo = rg.Polyline(thisNode.GetGeometry())
                                thisGeo.Reverse()
                                
                            ### get nb node geo 
                            if nbChosen == None or thisChosen == None:
                                #print "CreateParcEdgeAngleGraph Speical! nbChosen == None or thisChosen == None"
                                angleGraph.graph[thisNode][nb] =float("inf")
                                return why  # this should not happen
                                continue
                                
                            if nbChosen.ID == nb.startVertex.ID:
                                nbGeo = rg.Polyline(nb.GetGeometry())
                            elif thisChosen.ID == nb.endVertex.ID:
                                nbGeo = rg.Polyline(nb.GetGeometry())
                                nbGeo.Reverse()
                            # except:
                            #     nbGeo = rg.Polyline(nb.GetGeometry())
                            #     print ("nbGeo")
                            #     for pt in nbGeo:
                            #         print (pt.X),pt.Y,0
                                
                            #     print ("thisNode")    
                            #     for pt in thisNode.GetGeometry():
                            #         print (pt.X),pt.Y,0    
                                    
                            
                            
                            
                            #thisVec = rg.Vector3d (thisGeo[0] - thisGeo[1])
                            #nbVec = rg.Vector3d (nbGeo[1] - nbGeo[0])
                            
                            thisVec = rg.Vector3d (thisGeo.First - thisGeo.Last)
                            nbVec = rg.Vector3d (nbGeo.Last - nbGeo.First)
                            
                            angle = rg.Vector3d.VectorAngle(thisVec,nbVec)
                            angleGraph.graph[thisNode][nb] = rm.ToDegrees(angle)

                        elif nb.ID =='abstractNode':
                            angleGraph.graph[thisNode][nb] = 0
                
                elif thisNode.ID =='abstractNode':
                    
                    for nb in self.graph[thisNode]:
                        #print thisNode.ID, nb.ID
                        angleGraph.graph[thisNode][nb] = 0
            
            return angleGraph
         
            
            
    #############
    # Store Street info in this graph
    #############      
    class StreetGraph:
        
        # Initialize and deep copy
        def __init__(self):
            self.graph = {}
            self.depth = None
            
        def __del__(self):
            self.graph = None
        
        def DeepCopy(self,currPV_Dict,currE_Dict):
            #print "In StreetGraph DeepCopy"
            #print "prevous num = ", len(self.graph.keys())
            newStreetGraph = GRP.StreetGraph()
            
            #### Create a street redirection dict
            redirectionDict = {}  #newStreet:oldStreet
            #print "In StreetGraph DeepCopy,GetAllParcEdgeTwinID" , self. GetAllParcEdgeAndTwinEdgeID()
            for oldStreet in self.graph.keys():
                newStreet = oldStreet.DeepCopy(currPV_Dict,currE_Dict)
                redirectionDict[newStreet] = oldStreet
                redirectionDict[oldStreet] = newStreet
            
            #print redirectionDict
            for oldStreet in self.graph.keys(): # olad
                
                newStreetGraph.graph[redirectionDict[oldStreet]] = {}
                for nbOldStreet in self.graph[oldStreet].keys():
                    newStreetGraph.graph[redirectionDict[oldStreet]][ redirectionDict[nbOldStreet] ] = self.graph[oldStreet][nbOldStreet]
            
            #print "new num = ", len(newStreetGraph.graph.keys())
            newStreetGraph.depth = self.depth
            
            return newStreetGraph
        
        # Extract info    
        def GetAllParcEdgeID(self):
            allParcEdgeID = []
            for street in self.graph.keys():
                #print "in GetAllParcEdgeID"
                #print street
                allParcEdgeID.extend(street.GetAllParcEdgeID())
            return allParcEdgeID
        
        def GetAllParcEdge(self):
            allParcEdges = []
            for street in self.graph.keys():
                #print "in GetAllParcEdgeID"
                #print street
                allParcEdges.extend(street.GetAllParcEdge())
            return allParcEdges
  
        def GetAllParcEdgeTwinID(self):
            allParcEdgeID = []
            for street in self.graph.keys():
                allParcEdgeID.extend(street.GetAllParcEdgeTwinID())
            return allParcEdgeID
        
        def GetAllParcEdgeAndTwinEdgeID(self):
            allParcEdgeID = []
            for street in self.graph.keys():
                allParcEdgeID.extend(street.GetAllParcEdgeTwinID())
            return allParcEdgeID
        
        def GetAllParcVertexID(self):
            allParcVertexID = []
            for street in self.graph.keys():
                allParcVertexID.extend(street.GetAllParcVertexID())
            return allParcVertexID

        def GetStreetDict(self):
            streetDict = {}
            for street in self.graph.keys():
                streetDict[street.ID] = street
            return streetDict
            
            
        # Add and modify street   
        def AddStreet(self,newStreet,EDict):
            maxStreetID = len(self.graph.keys())
            newStreet.ID = maxStreetID+1
            newStreet.AssignStreetIDForParcEdge(EDict)
            #print "add a street and give ID", newStreet.ID
            if len(self.graph.keys())!=0:
   
                ### add the new street into graph
                self.graph[newStreet] = {}
                
                ### find the connected streetNode
                connectedStreetNode = newStreet.end
                
                #print ("in AddStreet connectedStreetNode.ID" ), connectedStreetNode.ID
                ### check the street with this node
                for street in self.graph.keys():
                    allpVID = self.GetAllParcVertexID()
                    if connectedStreetNode.node.ID in allpVID:
                        self.graph[newStreet][street] = connectedStreetNode.ID   ###### reminder: this might be dupilicated twice, so use ID to identify it here
                        self.graph[street][newStreet] = connectedStreetNode.ID   ###### reminder: this might be dupilicated twice, so use ID to identify it here
                        break
                #print "current street num", len(self.graph.keys())
             
            else:
                self.graph[newStreet] = {}

        def CheckInsertLocation(self,splitEdge):
      
            #print "in CheckInsertLocation"
            # for street in self.graph.keys():
            #     print street.ID,[edge.ID for edge in street.GetAllParcEdge()]
            streetDict = self.GetStreetDict()
            #print "streetDict" , streetDict
            # for streetID in streetDict.keys():
            #     print "streetID",streetID,streetDict[streetID].naked
            #     for pt in streetDict[streetID].GetGeometry():
            #         print pt.X,pt.Y,0
            #     print "----"


            targetStreet = streetDict[splitEdge.streetID]
            # print "splitEdge.streetID",splitEdge.streetID
            # print "splitEdge.ID",splitEdge.ID
            # print "targetStreet"
            # print targetStreet.GetAllParcEdgeID()
            # for pt in targetStreet.GetGeometry():
            #     print pt.X,pt.Y,pt.Z
            # print "----"
            
            # print "splitEdge"
            # for pt in splitEdge.GetGeometry():
            #     print pt.X,pt.Y,pt.Z
            # print "----"
            ### info of this 
            # IDs = targetStreet.GetAllParcEdgeID()
            # print "CheckInsertLocation GetAllParcEdgeID",IDs
            # twinIDs = targetStreet.GetAllParcEdgeTwinID()
            # print "CheckInsertLocation GetAllParcEdge twinIDs",twinIDs
            # print "targetStreet IDs",IDs
            # print "targetStreet twinIDs",twinIDs
            whileCount = 0

            streetNode = targetStreet.head
            # if targetStreet.end.next!=None:
            #     print (targetStreet.end.next.ID)
            
            #print "before while"
            while streetNode.next!=None:
                if whileCount>5000:
                    break
                whileCount +=1
                
                parcEdge = streetNode.nextConnection
                #print "parcEdgeVertices",parcEdge.startVertex.ID,parcEdge.startVertex.geometry,parcEdge.endVertex.ID,parcEdge.ID,parcEdge.endVertex.geometry
                #print "streetNode,streetNode.next",streetNode.ID,streetNode.node.geometry,streetNode.next.ID,streetNode.next.node.geometry
                if splitEdge.naked == True:
                    if splitEdge.ID == parcEdge.ID:
                        #print "parcEdge.ID in IDs",splitEdge.ID,IDs
                       
                        return (targetStreet,streetNode,streetNode.next,True)   ### True meaning in order
                
                elif splitEdge.naked == False:
                    if splitEdge.ID == parcEdge.ID:
                        
                        return (targetStreet,streetNode,streetNode.next,True)
                    
                    elif splitEdge.ID == parcEdge.twinID:
                    #print "parcEdge.ID in twinIDs",splitEdge.twinID,twinIDs
                       
                        return (targetStreet,streetNode,streetNode.next,False)   ### False meaning in order
                
                
                ### if it doesnt return, continue
                streetNode = streetNode.next

                  

        # Debug
        def CheckIfAllStreetInEDict(self,EDict):
            tag = False
            for street in self.graph.keys():
                thisStreetEdges = street.GetAllParcEdge()
                thisStreetEdgeIDs = [pE.ID for pE in thisStreetEdges]
                for thisID in thisStreetEdgeIDs:
                    if thisID not in EDict.keys():
                        tag = True
                        #print ("streetID"),street.ID, "Not in EDICT"
                        return tag
            return tag
# ---------- end ghpython_script_9 ----------
ghpython_script_10 = GhPythonScript()  # -> out, PP
# ---------- ghpython_script_10: Python ----------
###########################
####    Import Libs    ####
###########################
import Rhino.Geometry as rg
import Rhino.RhinoDoc as rd
import Rhino.RhinoMath as rm


###########################
####    Description    ####
###########################
### PP : Post-processing
### This is a library to merge edges if the edges are too short 
### User will input a "sideLengthPercentage", do the merge action if the edge.Length < sideLength*sideLengthPercentage and edge.naked == False



class PP:
    @staticmethod
    def CheckMergeEdge(PL,currQ,EDict,VP_Dict,sideLengthPercentage,mergedEdgeColletion,mergedEdgeIDColletion):

        # Store the edges that should be merged
        mergedEdgeIndicesCollection = []    
        mergedEdgeNewVCollection = []
        mergedParcelsCollection = []
        
        for currPF in currQ:
            for currSideIndex in range(len(currPF.sides)):
                currSide = currPF.sides[currSideIndex]
                if len(currSide) == 1:    # If there is one edge in this side, skip
                    continue
                
                else:
                    sideLength = 0
                    ## get side geometry
                    for edgeIndex in currSide:
                        currEdge = EDict[edgeIndex]
                        currEdgeGeo = currEdge.GetGeometry()
                        sideLength += currEdgeGeo.Length
                    
                    for edgeIndex in currSide:
                        currEdge = EDict[edgeIndex]
                        currEdgeGeo = currEdge.GetGeometry()
                        if currEdgeGeo.Length < sideLength*sideLengthPercentage and currEdge.naked == False: # Check the action condition
                            # print ("CheckMergeEdge happened,parcelID:"),currPF.ID
                            checkTag = PP.IfGoingToBeSelfIntersected(PL,currPF,currEdge,EDict,VP_Dict)
                            
                            if checkTag!=True: 
                                mergedEdgeIndices,mergedEdgeNewVs,mergedParcels = PP.ReduceMergeEdge(PL,currQ,currPF,currEdge,currSideIndex,EDict,VP_Dict)
                                mergedEdgeColletion.append(currEdge.GetGeometry())
                                mergedEdgeIDColletion.append(currEdge.ID)
                                mergedEdgeIndicesCollection.extend(mergedEdgeIndices)
                                mergedEdgeNewVCollection.extend(mergedEdgeNewVs)
                                mergedParcelsCollection.extend(mergedParcels)

                               
        return mergedEdgeIndicesCollection,mergedEdgeNewVCollection,mergedParcelsCollection
    
    # There will be extreme case that when the merge happened, some parcels will be self-intersected. If so, need to skip this merge action
    # Need to check all the related parcel (itself and its neighbors)
    @staticmethod   
    def IfGoingToBeSelfIntersected(PL,currPF,selectedEdge,EDict,VP_Dict):   
        # currPF is targetParcel

        checkTag = None
        startV = selectedEdge.startVertex   ### store here, later I cant get this by selected edge
        endV = selectedEdge.endVertex       ### store here, later I cant get this by selected edge
        
        ### create a new vertex, if on the boundary , merge it to the boundary
        if startV.onBoundary == True:
            newV = startV
        elif endV.onBoundary == True: 
            newV = endV 
        else:
            startPt =  selectedEdge.GetGeometry().First
            EndPt =  selectedEdge.GetGeometry().Last
            avePt = (startPt+EndPt)/2
            currMaxVPID = max(VP_Dict.Keys)
            newV = PL.ParcVertex(avePt,currMaxVPID+1)
            
            VP_Dict[newV.ID] = newV ## add into VP dict
            
        ### find the parcels to treat with 
        targetParcel = currPF
            
        # check if there is nbParcel    
        if selectedEdge.twinID  == None:
            nbParcel = None
            twinEdge = None
        else:
            nbParcel = currPF.mutualE_P[selectedEdge]
            twinEdge = EDict[selectedEdge.twinID]
            
        ##### Get the newGeo
        targetParcelEdges = [edge for edge in targetParcel.edges]
        targetParcelEdges.remove(selectedEdge)
        targetParcelEdgeGeos = []
        targetParcelPts = []
        for edge in targetParcelEdges:
            thisEdgeGeo = edge.GetGeometry()
            if edge.endVertex == startV:
                thisEdgeGeo.Last = newV.geometry
            if edge.startVertex == endV:
                thisEdgeGeo.First = newV.geometry
            
            targetParcelEdgeGeos.append(thisEdgeGeo)
            
        for edgeGeo in targetParcelEdgeGeos:
            for i in range(len(edgeGeo)-1):
                targetParcelPts.append(edgeGeo[i])
        targetParcelPts.append(targetParcelEdgeGeos[-1].Last)
        targetParcelGeo = rg.Polyline(targetParcelPts) 
        
        if rg.Intersect.Intersection.CurveSelf(targetParcelGeo.ToPolylineCurve(),0.001).Count == 0:
            checkTag = False
        else:
            checkTag = True
            return checkTag
        
        ### Get the newGeo
        if nbParcel !=None:     
      
            nbParcelEdges = [edge for edge in nbParcel.edges]
            nbParcelEdges.remove(twinEdge)  
            nbParcelEdgeGeos = []
            nbParcelPts = []  
            for edge in nbParcelEdges:  
                thisEdgeGeo = edge.GetGeometry()
                if edge.endVertex == endV:
                    thisEdgeGeo.Last = newV.geometry
                if edge.startVertex == startV:
                    thisEdgeGeo.First = newV.geometry
                nbParcelEdgeGeos.append(thisEdgeGeo)

            for edgeGeo in nbParcelEdgeGeos:
                for i in range(len(edgeGeo)-1):
                    nbParcelPts.append(edgeGeo[i])
            nbParcelPts.append(nbParcelEdgeGeos[-1].Last)
            nbParcelGeo = rg.Polyline(nbParcelPts) 
            
            if rg.Intersect.Intersection.CurveSelf(nbParcelGeo.ToPolylineCurve(),0.001).Count == 0:
                checkTag = False
            else:
                checkTag = True

            if rg.Intersect.Intersection.CurveCurve(targetParcelGeo.ToPolylineCurve(), nbParcelGeo.ToPolylineCurve(),0.001,0.001).Count  > 1: 
                checkTag = True  

        return checkTag
            
    # This is the function to modify the parcel data. Change the stored vertices and edges info accordingly 
    @staticmethod   
    def ReduceMergeEdge(PL,currQ,currPF,selectedEdge,currSideIndex,EDict,VP_Dict):   
        startV = selectedEdge.startVertex   ### store here, later I cant get this by selected edge
        endV = selectedEdge.endVertex       ### store here, later I cant get this by selected edge
        
        ### create a new vertex, if on the boundary , merge it to the boundary
        if startV.onBoundary == True:
            newV = startV
        elif endV.onBoundary == True: 
            newV = endV 
        else:
            startPt =  selectedEdge.GetGeometry().First
            EndPt =  selectedEdge.GetGeometry().Last
            avePt = (startPt+EndPt)/2
            currMaxVPID = max(VP_Dict.Keys)
            newV = PL.ParcVertex(avePt,currMaxVPID+1)
            
            VP_Dict[newV.ID] = newV ## add into VP dict
            
        ### find the parcels to treat with 
        targetParcel = currPF
            
        # check if there is nbParcel    
        if selectedEdge.twinID  == None:
            nbParcel = None
            twinEdge = None
        else:
            nbParcel = currPF.mutualE_P[selectedEdge]
            twinEdge = EDict[selectedEdge.twinID]
            
        
        ### check if its going to be a triangle. If so. Return
        for side in targetParcel.sides:
            if selectedEdge.ID in side:
                if len(side) == 1:
                    return [],[],[]
        
        if nbParcel!= None:      
            for side in nbParcel.sides:
                if twinEdge.ID in side:
                    if len(side) == 1:
                        return [],[],[]
        
        ### replace the edge startVertex and endVertex  /  this treatment for all parcels / this will change the selected edge
        for parcel in currQ:
            if parcel != targetParcel and parcel != nbParcel:
                edges = parcel.edges
                for edge in edges:
                    if edge.startVertex == startV:
                        edge.startVertex = newV
                    if edge.endVertex == startV:
                        edge.endVertex = newV
                    if edge.startVertex == endV:
                        edge.startVertex = newV
                    if edge.endVertex == endV:
                        edge.endVertex = newV

                for i in range(len(parcel.vertices)):
                    vertex = parcel.vertices[i]
                    if vertex == startV or vertex == endV:
                        parcel.vertices[i] = newV

        ### targetParcel: remove the edge， change affected edge vertices 
        targetParcel.edges.remove(selectedEdge)
        edges = targetParcel.edges
        for edge in edges:
            if edge.endVertex == startV:
                edge.endVertex = newV
            if edge.startVertex == endV:
                edge.startVertex = newV
        
        ### targetParcel: remove 2 original V and insert new V
        v_TargetParcel = targetParcel.vertices
        index_Start = v_TargetParcel.index(startV)
        index_End = v_TargetParcel.index(endV)
        
        newVertices = v_TargetParcel[:index_Start]+[newV]+v_TargetParcel[index_Start+1:]    
        newVertices.pop(index_End)    

        if index_End == 0:    ### to sort the vertices order
            newVertices = [newVertices[-1]]+ newVertices[0:-1]
        targetParcel.vertices = newVertices

        ### targetParcel: Update Side
        targetParcel.sides[currSideIndex].remove(selectedEdge.ID)
        
        ### nbParcel: remove the twinedge
        if nbParcel !=None:
            nbParcel.edges.remove(twinEdge)

            nbEdges = nbParcel.edges
            for edge in nbEdges:
                if edge.endVertex == endV:
                    edge.endVertex = newV
                if edge.startVertex == startV:
                    edge.startVertex = newV
            
            ### nbParcel: remove 2 original V and insert new V
            v_nbParcel = nbParcel.vertices
            index_Start_nb = v_nbParcel.index(endV)    #twin, end->start
            index_End_nb = v_nbParcel.index(startV)

            newVertices_nb = v_nbParcel[:index_Start_nb]+[newV]+v_nbParcel[index_Start_nb+1:] 
            newVertices_nb.pop(index_End_nb)
            
            if index_End_nb == 0:    ### to sort the vertices order
                
                newVertices_nb = [newVertices_nb[-1]]+ newVertices_nb[0:-1]
            nbParcel.vertices = newVertices_nb
                    
            ### nbParcel: Update Side
            for currNbSideIndex in range (len(nbParcel.sides)):
                currNbSide = nbParcel.sides[currNbSideIndex]
                if twinEdge.ID in currNbSide:
                    nbParcel.sides[currNbSideIndex].remove(twinEdge.ID)
                    break

            
            ### update neighbor info 
            targetParcel.neighbors.pop(targetParcel.neighbors.index(nbParcel))
            nbParcel.neighbors.pop(nbParcel.neighbors.index(targetParcel))
            
            targetParcel.mutualE_P.pop(selectedEdge)
            nbParcel.mutualE_P.pop(twinEdge)
            
            targetParcel.mutualP_E.pop(nbParcel)
            nbParcel.mutualP_E.pop(targetParcel)

    
        ### remove from Edict
        if selectedEdge.ID in EDict.keys():
            EDict.pop(selectedEdge.ID)
            
        if selectedEdge.twinID in EDict.keys():
            EDict.pop(selectedEdge.twinID)

        ### store merged info
        mergedEdgeIndices = []
        mergedEdgeIndices.append(selectedEdge.ID)
        if twinEdge!=None:
            mergedEdgeIndices.append(twinEdge.ID)
            
        mergedEdgeNewVs= [newV,newV]   # Becasue edge and twinEdge are all stored, store the newV twice to match the order
        mergedParcels = [targetParcel,nbParcel]
        return mergedEdgeIndices,mergedEdgeNewVs,mergedParcels
            
    # This is the function to modify the street data. There might be some merged edges in street instanceshould be removed. 
    # When there are merged edges:  four scenarios explained in code
    # It's a customized linked list structure. Need to be updated
    @staticmethod
    def CheckStreetChangedByMerge(RF,currStreetGraph,mergedEdgeIndices,mergedEdgeNewVs):
        # No merged edge, return
        if mergedEdgeIndices == []:
            return 
        
        # There are merged edges
        allStreets = currStreetGraph.GetStreetDict().values()
        
        for street in allStreets:
            whileCount = 0       # An insurrance..
            streetNode = street.head
            
            ### Scenario 1 : The street only has one edge, then remove this street from currStreetGraph, also clean the connection relationship
            if len(street.GetAllParcEdge()) == 1 and street.GetAllParcEdge()[0].ID in mergedEdgeIndices:
                currStreetGraph.graph.pop(street)                        # remove the street from currStreetGraph
                for key in currStreetGraph.graph.keys():                 # clean the connection relationship 
                    if street in currStreetGraph.graph[key]:
                        currStreetGraph.graph[key].pop(street)

                #[DEBUG or CHECK]
                # print ("In CheckStreetChangedByMerge, Scenario 1(After), street ID:"),street.ID, " street.head.node.ID:",street.head.node.ID," street.end.node.ID: ", street.end.node.ID," all nodes: ",([sNode.ID for sNode in street.GetAllStreetNodes()])
            
            else:
                while streetNode.next!=None:
                    if whileCount>1000:     # An insurrance..
                        break
                    whileCount +=1

                    # Get the current info
                    allParcEdges = street.GetAllParcEdge()
                    firstEdgeID = allParcEdges[0].ID
                    lastEdgeID = allParcEdges[-1].ID 

                    # Back to Scenario 1
                    if len(street.GetAllParcEdge()) == 1 and street.GetAllParcEdge()[0].ID in mergedEdgeIndices:
                        currStreetGraph.graph.pop(street)                        # remove the street from currStreetGraph
                        for key in currStreetGraph.graph.keys():                 # clean the connection relationship 
                            if street in currStreetGraph.graph[key]:
                                currStreetGraph.graph[key].pop(street)


                    currParcEdge = streetNode.nextConnection

                    if currParcEdge.ID in mergedEdgeIndices:
                        
                        indexInList = mergedEdgeIndices.index(currParcEdge.ID)
                        thisNewV = mergedEdgeNewVs[indexInList]
                        thisNewStreetNode = RF.StreetNode(thisNewV)
                        
                        ### Scenario 2 : The merged edge is the first edge in this street instance
                        if currParcEdge.ID == firstEdgeID:
                            #[DEBUG or CHECK]
                            # print ("In CheckStreetChangedByMerge, Scenario 2(Before), street ID:"),street.ID, " street.head.node.ID:",street.head.node.ID," street.end.node.ID: ", street.end.node.ID," all nodes: ",([sNode.ID for sNode in street.GetAllStreetNodes()])

                            currentStart = street.start                     # It gonna disappear
                            currentStart_Next = currentStart.next           # It gonna disappear
                            currentStart_Next_Next = currentStart_Next.next
                            
                            street.head = thisNewStreetNode
                            street.head.prev = None
                            street.head.prevConnection = None
                            street.head.nextConnection = currentStart_Next.nextConnection
                            street.head.next = currentStart_Next_Next
                            currentStart_Next_Next.prev = street.head

                            #[DEBUG or CHECK]
                            # print ("In CheckStreetChangedByMerge, Scenario 2(After), street ID:"),street.ID, " street.head.node.ID:",street.head.node.ID," street.end.node.ID: ", street.end.node.ID," all nodes: ",([sNode.ID for sNode in street.GetAllStreetNodes()])

                        ### Scenario 3 : The merged edge is the last edge in this street instance
                        elif currParcEdge.ID == lastEdgeID:
                            #[DEBUG or CHECK]
                            # print ("In CheckStreetChangedByMerge, Scenario 3(Before), street ID:"),street.ID, " street.head.node.ID:",street.head.node.ID," street.end.node.ID: ", street.end.node.ID," all nodes: ",([sNode.ID for sNode in street.GetAllStreetNodes()])
                            
                            currentEnd = street.end                     # It gonna disappear
                            currentEnd_Prev = currentEnd.prev           # It gonna disappear
                            currentEnd_Prev_Prev = currentEnd_Prev.prev

                            street.end = thisNewStreetNode
                            street.end.next = None
                            street.end.nextConnection = None
                            street.end.prevConnection = currentEnd_Prev.prevConnection
                            street.end.prev = currentEnd_Prev_Prev
                            currentEnd_Prev_Prev.next =  street.end


                            #[DEBUG or Check]
                            # print ("In CheckStreetChangedByMerge, Scenario 3(After), street ID:"),street.ID, " street.head.node.ID:",street.head.node.ID," street.end.node.ID: ", street.end.node.ID," all nodes: ",([sNode.ID for sNode in street.GetAllStreetNodes()])

                            
                            break ### becasue end changed
                        
                        ### Scenario 4 : The merged edge is not the first or last edge in this street instance
                        else:
                            #[DEBUG or CHECK]

                            currStreetNode = streetNode             # It gonna disappear
                            prevStreetNode = currStreetNode.prev     
                            nextStreetNode = currStreetNode.next    # It gonna disappear
                            nextNextStreetNode = nextStreetNode.next    
                            

                            prevStreetNode.next = thisNewStreetNode   
                            
                            thisNewStreetNode.prev = prevStreetNode
                            thisNewStreetNode.prevConnection = prevStreetNode.nextConnection
                            thisNewStreetNode.next = nextNextStreetNode
                            thisNewStreetNode.nextConnection = nextNextStreetNode.prevConnection
                            
                            nextNextStreetNode.prev = thisNewStreetNode
                            
                            #[DEBUG or CHECK]
                            # print ("In CheckStreetChangedByMerge, Scenario 4(After), street ID:"),street.ID, " street.head.node.ID:",street.head.node.ID," street.end.node.ID: ", street.end.node.ID," all nodes: ",([sNode.ID for sNode in street.GetAllStreetNodes()])

                    streetNode = streetNode.next
    
    # Remove the startpoint for the constrained case becasue the geometry might be changed. The start point might not longer on the edge.
    # To be safe, just erase this situation
    @staticmethod         
    def EraseParcelStartPointsIfMergedOrAffected(mergedParcels):
        for parcel in mergedParcels:
            allRelatedParcels = [parcel]
            allRelatedParcels.extend(parcel.neighbors)
            for relatedParcel in allRelatedParcels:
                relatedParcel.situation = 0
                relatedParcel.startPt = None
    
    
    # Merge might remove the only accessible edge of the parcel and change its accessibility                
    @staticmethod
    def CheckAccessibilityChangedByMerge(mergedParcelsCollection):
        for parcel in mergedParcelsCollection:
            if parcel!=None:
                if parcel.accessible == True:
                    accesibleEdgeCount = 0

                    for edge in parcel.edges:
                        if edge.streetID != None:
                            accesibleEdgeCount += 1
                      
                    if accesibleEdgeCount == 0:
                        parcel.accessible = False
# ---------- end ghpython_script_10 ----------
ghpython_script_11 = GhPythonScript()  # -> out, RD
# ---------- ghpython_script_11: Python ----------
###########################
####    Import Libs    ####
###########################
import Rhino.Geometry as rg
import Rhino.RhinoDoc as rd
import Rhino.RhinoMath as rm

from collections import Counter


###########################
####    Description    ####
###########################
### RD : Road
### This is the module to explode the streets found based on road finding.
### Explode the street and reconnect e.g. L shape will explode into 2 roads, edges the connected will be selected with in a minimum angle to combine into a road

class RD:
    class Road:
        def __init__(self,edgeCollection):
            self.edgeCollection = edgeCollection                            # list<ParcEdge>   The road consist of these edges

        def __del__(self):
            self.edgeCollection = None

        # Help function to extract info
        def GetAllVertexInstance(self):
            allVertexInstance = []
            for edge in self.edgeCollection:
                allVertexInstance.append(edge.startVertex)
                
            allVertexInstance.append(self.edgeCollection[-1].endVertex)
            
            return allVertexInstance
        
        def GetRelevantPE(self,jV):
            relevantPEs = []
            for pE in self.edgeCollection:
                if jV == pE.startVertex or jV == pE.endVertex:
                    relevantPEs.append(pE)

            return relevantPEs
        

        ###########
        # This set is to get the parcel geometry. Defalut is to build a polyline with vertices and points. Later it comes with different versions for different needs.
        ###########
        def GetGeometry(self):   #default one with betweenPoints
            newPts = []
            for edge in self.edgeCollection:
                newPts.append(edge.startVertex.geometry) 
                for bPt in edge.betweenPoints:
                    newPts.append(bPt.geometry)
            newPts.append(self.edgeCollection[-1].endVertex.geometry)

            return rg.Polyline(newPts)

        def GetGeometry_Simplified(self):   #StartPoint and EndPoint
            newPts = []
            for edge in self.edgeCollection:
                newPts.append(edge.startVertex.geometry) 
            newPts.append(self.edgeCollection[-1].endVertex.geometry)

            return rg.Polyline(newPts)

        def GetGeometry_SimplifiedWithTurningPoints(self):   
            newPts = []
            for edge in self.edgeCollection:
                newPts.append(edge.startVertex.geometry) 
                for tPt in edge.turningPoints:
                    newPts.append(tPt.geometry)
            newPts.append(self.edgeCollection[-1].endVertex.geometry)
            return rg.Polyline(newPts)
        
        def GetGeometry_SimplifiedWithResamplePoints(self):   
            newPts = []
            for edge in self.edgeCollection:
                newPts.append(edge.startVertex.geometry) 
                for rPt in edge.resamplePoints:
                    newPts.append(rPt.geometry)
            newPts.append(self.edgeCollection[-1].endVertex.geometry)
            return rg.Polyline(newPts)

        ###########
        # This set is to get the info of Vertices, Points ... 
        ###########
        def GetAllVPInstance_Resample(self):
            allVP = []
            for pE in self.edgeCollection:
                allVP.append(pE.startVertex)
                for rPt  in pE.resamplePoints:
                    allVP.append(rPt)
            allVP.append(self.edgeCollection[-1].endVertex)
            
            return allVP

        def GetAllVPInstance_TurningPoints(self):
            allVP = []
            for pE in self.edgeCollection:
                allVP.append(pE.startVertex)
                for rPt  in pE.turningPoints:
                    allVP.append(rPt)
            allVP.append(self.edgeCollection[-1].endVertex)
            
            return allVP
        
        def GetAllVPInstance_Simplified(self):
            allVP = []
            for pE in self.edgeCollection:
                allVP.append(pE.startVertex)

            allVP.append(self.edgeCollection[-1].endVertex)
            
            return allVP
        

    
    ############################################
    ##########  Create Road Instance   #########
    ############################################
    
   # Input the edges that consist of this Road and get the Road instance, 
    @staticmethod 
    def CreateRoadInstances(edgeCollection_All):
        roads = []
        for edgeCollection in edgeCollection_All:
            roads.append(RD.Road(edgeCollection))
        return roads

    # Input the currStreetGraph and get the Road instance to represent the original roads 
    @staticmethod 
    def CreateRoadInstances_Original(currStreetGraph,currE_Dict):
        originalRoads = []
        
        for street in currStreetGraph.graph.keys():
            if street.original == True:
                allPE = street.GetAllParcEdge()
                allPE_Valid = []
                for pE in allPE:
                    if pE.isValid == True:
                        allPE_Valid.append(pE)
                        
                allPEIDs = [pE.ID for pE in allPE_Valid]
                allPE_Curr = [currE_Dict[eID] for eID in allPEIDs]
                originalRoads.append(RD.Road(allPE_Curr))

        return originalRoads
    
    # Input the currStreetGraph and get the Road instance to represent the naked roads 
    @staticmethod 
    def CreateRoadInstances_Naked(currStreetGraph,currE_Dict):
        originalRoads = []
        
        for street in currStreetGraph.graph.keys():
            if street.naked == True:
                allPE = street.GetAllParcEdge()
                allPE_Valid = []
                for pE in allPE:
                    if pE.isValid == True:
                        allPE_Valid.append(pE)
                        
                allPEIDs = [pE.ID for pE in allPE_Valid]
                allPE_Curr = [currE_Dict[eID] for eID in allPEIDs]
                originalRoads.append(RD.Road(allPE_Curr))

        return originalRoads
    
    ###################################
    ##########  Create Road   #########
    ###################################
    # Step 1: Create the dictionary to record which ParcEgdes have been stored in a road.
    # Step 2: Start from one ParcEgde. Start from one side. Find the min angle connection until there is no more. Start from another side
    # Step 3: Initialze the road instance.
    
    # Details : Disable the edge in the record dictionary
    #           Be careful with the twin edge. One it is used , its twin edge should be considered used.
    #           Sort the order, making sure the end of the first edge is connecting the start of next edge.  
    #           Bebug and checking code is kept inside.
    
    # Get the dictionary to record which ParcEgdes have been stored in a road
    @staticmethod
    def CreateConnectionRecord(currStreetGraph,currEDict):
        edgeConnectionRecord = {}
        allPE = []
        for street in currStreetGraph.graph.keys():
            #print "in GetAllParcEdgeID"
            #print street
            allPE.extend(street.GetAllParcEdge())
        currStreetE_Dict = {}
        
        for pE in allPE:
            currStreetE_Dict[pE.ID] = pE
            #print "pE.ID,pE.twinID",pE.ID,pE.twinID,pE.generation

            if pE.naked == False:
                
                #print pE.isValid
                
                currStreetE_Dict[pE.twinID] = currEDict[pE.twinID]
        
        for pE in allPE:
            if pE.naked ==True:
                edgeConnectionRecord[pE.ID] = True
            else:
                
                edgeConnectionRecord[pE.ID] = False
                edgeConnectionRecord[pE.twinID] = False
                
                
        return edgeConnectionRecord,currStreetE_Dict

    # Overall function to get all roads
    @staticmethod
    def GetRoadCollection(edgeConnectionRecord,currE_Dict):
        edgeCollection_All = []
        for key in edgeConnectionRecord.keys():
            #print ("Start from this ParcEdge"),key 
            if edgeConnectionRecord[key] != True: 
                edgeCollection = RD.GetARoad(edgeConnectionRecord,currE_Dict,key,rm.ToRadians(45)) 
                #print ("Finish one road searching, it stores: "),[edge.ID for edge in edgeCollection] 
                #print "-----"
                edgeCollection_All.append(edgeCollection)
            pass

        return edgeCollection_All

    # Function to get a road and the help functions
    @staticmethod
    def GetARoad(edgeConnectionRecord,currE_Dict,key,angleTolerance):
        processEdge = currE_Dict[key]
        #print "The processing ParcEdge's ID and twinID are",processEdge.ID,processEdge.twinID
        
        ### Update Dict 
        edgeConnectionRecord[processEdge.ID] =True 
        edgeConnectionRecord[processEdge.twinID] =True
        
        ### Get both halves
        edgeCollection_Start = RD.GetARoad_FirstHalf(edgeConnectionRecord,currE_Dict,processEdge,angleTolerance)
        edgeCollection_End = RD.GetARoad_SecondHalf(edgeConnectionRecord,currE_Dict,processEdge,angleTolerance)
        
        ### Combine, need to reveser the direction
        edgeCollection_Start_Twin = []
        for edge in edgeCollection_Start:
            edgeCollection_Start_Twin.append(currE_Dict[edge.twinID])
        
        edgeCollection_End.reverse()
        edgeCollection_End_Twin = []
        for edge in edgeCollection_End:

            edgeCollection_End_Twin.append(currE_Dict[edge.twinID])
            
        edgeCollection_Combined= edgeCollection_End_Twin + [currE_Dict[processEdge.twinID]] + edgeCollection_Start_Twin 

        return edgeCollection_Combined

    @staticmethod
    def GetARoad_FirstHalf(edgeConnectionRecord,currE_Dict,processEdge,angleTolerance,threshold = 1000):
        ### Initialize the store
        edgeCollection_Start = []
        ### Start from startVertex
        relatedEdges = RD.GetRelatedEdgeFromStart(processEdge,currE_Dict)
        #if relatedEdges!=[]:
            #print ("GetARoad_FirstHalf relatedEdges"), [edge.ID for edge in relatedEdges]
        if relatedEdges == []:
            return edgeCollection_Start
        
        selectedEdge = RD.GetMinAngleEdge(processEdge,relatedEdges,angleTolerance,edgeConnectionRecord)
        #if selectedEdge!=None:
           # print ("GetARoad_FirstHalf selectedEdge"), selectedEdge.ID 
        
        if selectedEdge == None or selectedEdge.naked ==True:       # Stop condition
            return edgeCollection_Start       
        
        else:
            edgeCollection_Start.append(selectedEdge)
            #print ("Get edge's ID:"),selectedEdge.ID
            
            ### update Dict 
            edgeConnectionRecord[selectedEdge.ID] =True 
            edgeConnectionRecord[selectedEdge.twinID] =True 

            ### Continue
            for i in range(threshold):
                if relatedEdges!=[]:
                    relatedEdges = RD.GetRelatedEdgeFromStart(selectedEdge,currE_Dict)
                # if relatedEdges != []:
                #     print ("GetARoad_FirstHalf relatedEdges"), [edge.ID for edge in relatedEdges]
                if relatedEdges == []:
                    break 
                selectedEdge = RD.GetMinAngleEdge(selectedEdge,relatedEdges,angleTolerance,edgeConnectionRecord)
                # if selectedEdge!=None:
                #     print ("GetARoad_FirstHalf selectedEdge"), selectedEdge.ID 
        
                if selectedEdge==None or selectedEdge.naked ==True:
                    break
                else:
                    ### update Dict 
                    edgeConnectionRecord[selectedEdge.ID] =True 
                    edgeConnectionRecord[selectedEdge.twinID] =True 
                    edgeCollection_Start.append(selectedEdge)
                    #print ("GET EDGE id:"),selectedEdge.ID


            return edgeCollection_Start
        
    @staticmethod
    def GetARoad_SecondHalf(edgeConnectionRecord,currE_Dict,processEdge,angleTolerance,threshold = 1000):
        ### Initialize the store
        edgeCollection_End = []
        ### start from endVertex
        relatedEdges = RD.GetRelatedEdgeFromEnd(processEdge,currE_Dict)
        # if relatedEdges!=[]:
        #      print ("GetARoad_SecondHalf relatedEdges"), [edge.ID for edge in relatedEdges]
        if relatedEdges == []:
            return edgeCollection_End
        selectedEdge = RD.GetMinAngleEdge(processEdge,relatedEdges,angleTolerance,edgeConnectionRecord)
        # if selectedEdge!=None:
        #      print ("GetARoad_SecondHalf selectedEdge"), selectedEdge.ID 
        if selectedEdge == None or selectedEdge.naked ==True:
            return edgeCollection_End
        
        else:
            edgeCollection_End.append(selectedEdge)
            #print ("Get edge's ID:"),selectedEdge.ID
            
            ### update Dict 
            edgeConnectionRecord[selectedEdge.ID] =True 
            edgeConnectionRecord[selectedEdge.twinID] =True 
            
            ### Continue
            for i in range(threshold):
                relatedEdges = RD.GetRelatedEdgeFromEnd(selectedEdge,currE_Dict)
                # if relatedEdges!=[]:
                #     print ("GetARoad_SecondHalf relatedEdges"), [edge.ID for edge in relatedEdges]
                selectedEdge = RD.GetMinAngleEdge(selectedEdge,relatedEdges,angleTolerance,edgeConnectionRecord)
                # if selectedEdge!=None:
                #     print ("GetARoad_SecondHalf selectedEdge"), selectedEdge.ID 
                if selectedEdge==None or selectedEdge.naked ==True:
                    break
                else:
                    ### update Dict 
                    edgeConnectionRecord[selectedEdge.ID] =True 
                    edgeConnectionRecord[selectedEdge.twinID] =True 
                    edgeCollection_End.append(selectedEdge)
                    #print ("Get edge's ID:"),selectedEdge.ID
            
            return edgeCollection_End
        
    @staticmethod
    def GetRelatedEdgeFromStart(processEdge,currEDict):
        detectParcV = processEdge.startVertex
        
        relatedEdges = []
        alledges = currEDict.values()

        #becasue there are twins
        for edge in alledges:
            if edge.endVertex.ID == detectParcV.ID and edge.ID != processEdge.twinID:
                relatedEdges.append(edge)
        
        return relatedEdges
    
    @staticmethod
    def GetRelatedEdgeFromEnd(processEdge,currEDict):
        
        detectParcV = processEdge.endVertex
        
        relatedEdges = []
        alledges = currEDict.values()


        #becasue there are twins
        for edge in alledges:
            if edge.startVertex.ID == detectParcV.ID and edge.ID != processEdge.twinID:   #### copied parcels are not the same instances, use ID to track
                relatedEdges.append(edge)
        
        return relatedEdges
    
    @staticmethod
    def GetMinAngleEdge(processEdge,relatedEdges,toleranceAngle,record):
        angles = []
        ###simplified, so its a line 
        thisEdge_Vec = rg.Vector3d(processEdge.endVertex.geometry - processEdge.startVertex.geometry)

        relatedIDs = [relatedEdge.ID for relatedEdge in relatedEdges]
        #print ("relatedIDs:", relatedIDs)
        for relatedEdge in relatedEdges:
            relatedEdge_Vec = rg.Vector3d(relatedEdge.endVertex.geometry - relatedEdge.startVertex.geometry)
            angles.append(rg.Vector3d.VectorAngle(thisEdge_Vec,relatedEdge_Vec)) 
        
        if relatedEdges == []:
            return None
         
        relatedEdges,angles = RD.SortListsAccordingly(relatedEdges,angles)
        minEdge = None
        for i in range(len(relatedEdges)):
            currAngle = angles[i]
            currEdge = relatedEdges[i]

            
            if currAngle < toleranceAngle and record[currEdge.ID]==False:
                minEdge = currEdge
                #print ("processEdge"),processEdge.ID,("Get an edge"),minEdge.ID,rm.ToDegrees(currAngle)
                break
        
        
        return minEdge
    
    # Help Function: It is used to sort two lists based on the values in the second list
    @staticmethod
    def SortListsAccordingly(listIstance,listNum):

        zipped_list = list(zip(listIstance, listNum))
        sorted_list = sorted(zipped_list, key=lambda x: x[1])
        listIstance_Sorted,listNum_Sorted = zip(*sorted_list)
        return listIstance_Sorted,listNum_Sorted
    
    ###################################
    ##########   Sort  Road   #########
    ###################################
    @staticmethod
    def FindMaxRepeated(list):
        counts = Counter(list)
        max_count = max(counts.values())
        max_repeated_elements = [element for element, count in counts.items() if count == max_count]
        return max(max_repeated_elements)

    @staticmethod
    def SortRoadCat(roads,newRoads):

        roadEdgeDepths = [[edge.generation for edge in road.edgeCollection] for road in roads]
        
        sortedBase = [RD.FindMaxRepeated(thisRoadEdgeDepth) for thisRoadEdgeDepth in roadEdgeDepths] 
        
        sorted_elements = sorted(zip(newRoads, sortedBase), key=lambda x: x[1])
        newRoads = [element for element, _ in sorted_elements]
        roadCatOrder = [base for _, base in sorted_elements]


        ### Create mid points record coresponding to order of road category
        roadMidPoints = []
        for roadGeo in newRoads:
            roadGeoCrv = roadGeo.ToPolylineCurve()
            roadMidPoint = roadGeoCrv.PointAtLength(roadGeoCrv.GetLength()/2)
            roadMidPoints.append(roadMidPoint)

        return newRoads,roadMidPoints,roadCatOrder
# ---------- end ghpython_script_11 ----------
ghpython_script_12 = GhPythonScript()  # -> out, OP
# ---------- ghpython_script_12: Python ----------
###########################
####    Import Libs    ####
###########################
import Rhino.Geometry as rg
import Rhino.RhinoMath as rm
import Rhino.RhinoApp as ra
import ghpythonlib.components as ghc

from System.Collections.Generic import List
import clr
clr.AddReference("KangarooSolver.dll")

import KangarooSolver as ks

from itertools import combinations
from collections import Counter

import math

###########################
####    Description    ####
###########################
### OP : Optimization
### This is a library to do the geometry optimization

class OP:

    ###########################################
    ########          Preview           #######
    ###########################################
    # Preview the geometry in last depth of the tree
    @staticmethod
    def PreviewAllParcVertexAndParcPoint(allParcF):
        allV = []
        allP = []
        for pF in allParcF:
            Vs = pF.vertices
            for v in Vs:
                if v not in allV:
                    allV.append(v)
            
            edges = pF.edges
            for e in edges:
                allP.extend(e.betweenPoints)

        allV_Geo = [v.geometry for v in allV]
        allP_Geo = [pt.geometry for pt in allP]
        
        return  allV_Geo,allP_Geo

    @staticmethod
    def GetAllEdgeGeoAndIDFromDict(currE_Dict):
        edges = []
        edges_indices = []
        for edge in currE_Dict.values():
            edges.append(edge.GetGeometry())
            edges_indices.append(edge.ID)
        return edges,edges_indices


    ###################################
    ####           Copy            ####
    ###################################
    # Make a partial copy, becasue it does not want to affect the stored nodes
    @staticmethod
    def MakePartialCopy(selectedParcFace):
        currVP_Dict = {}
        for parcFace in selectedParcFace:
            thisVPInstances = parcFace.GetVPInstance()
            for VPInstance in thisVPInstances:
                if VPInstance.ID not in currVP_Dict.keys():
                    currVP_Dict[VPInstance.ID] = VPInstance.DeepCopy()
            
            if parcFace.startPt!=None:
                if parcFace.startPt.ID not in currVP_Dict.keys():
                    currVP_Dict[parcFace.startPt.ID] = parcFace.startPt.DeepCopy()
        currE_Dict = {}

        for parcFace in selectedParcFace:
            thisEInstances = parcFace.edges
            for EInstance in thisEInstances:
                if EInstance.ID not in currE_Dict.keys():
                    newE =  EInstance.DeepCopy(currVP_Dict)
                    currE_Dict[EInstance.ID] = newE
                    #E_Redirect[newE] = EInstance

        currE_Dict_All = currE_Dict
        copiedParcFace = []
        for parcFace in selectedParcFace:
        
            copiedParcFace.append(parcFace.DeepCopy(currVP_Dict,currE_Dict,currE_Dict_All))
            #print ("before:"),len(parcFace.vertices),("after:"),len(copiedParcFace[-1].vertices)

        ########## build redirectMap
        redirectMap = {}
        for i in range(len(selectedParcFace)):
            redirectMap[selectedParcFace[i]] = copiedParcFace[i]
            redirectMap[copiedParcFace[i]] = selectedParcFace[i]


        return copiedParcFace,currVP_Dict,currE_Dict,redirectMap

    @staticmethod
    def RedirectNeighbors_Temp(currQ,prevQ,newEDict,redirectMap):

        for parcFace in currQ:
            # update the "neighbors" 
            for i in range(len(parcFace.neighbors)):
                thisNeighbor = parcFace.neighbors[i]
                if thisNeighbor in prevQ:
                    parcFace.neighbors[i] = redirectMap[thisNeighbor]
        
        #print "-----------------------before"
        for parcFace in currQ:
            NIDs = []
            for N in parcFace.neighbors:
                NIDs.append(id(N))
            #print id(parcFace),"NIDs:", NIDs
            
        for parcFace in currQ:
            #print "-----parcFace",id(parcFace)
            thisNs = parcFace.neighbors
            #print (len(thisNs))
            newNs = []
            for thisN in thisNs:
                
                if thisN  in currQ:
                    newNs.append(thisN)
            parcFace.neighbors=newNs
                    

        # update the "mutualP_E" 
        for parcFace in currQ:
            thisNeighbors = parcFace.neighbors
            parcFace.mutualP_E = {}
            parcFace.mutualE_P = {}
            
            for thisN in thisNeighbors:
                
                parcFace_prev = redirectMap[parcFace]
                thisN_prev = redirectMap[thisN]
                
                eID = thisN_prev.mutualP_E[parcFace_prev].twinID
                
                parcFace.mutualP_E[thisN] = newEDict[eID]
                parcFace.mutualE_P[newEDict[eID]] = thisN
            
    
    ###################################
    ####       Truning Points      ####
    ###################################
    
    ############
    # Find turning points
    ############
    # Find turning point for an edge.
    # If the turning angle is large, it keep this point, it return the indices and geometry
    @staticmethod
    def FindTurningPoint(polyL,detectAngle):
        segments = polyL.GetSegments()
        
        turningPts = []
        turningPtIndices = []
        for i in range(len(segments)-1):
            currSeg = segments[i]
            nextSeg = segments[i+1]
            currVec = rg.Vector3d(currSeg.To - currSeg.From)
            nextVec = rg.Vector3d(nextSeg.To - nextSeg.From)
            angle = rg.Vector3d.VectorAngle(currVec,nextVec)
            detectAngle_R = rm.ToRadians(detectAngle)
            if  angle>detectAngle_R:
                turningPts.append(currSeg.To)
                turningPtIndices.append(i+1)
        
        return turningPtIndices,turningPts

    # Find turning point for a parcel.
    @staticmethod
    def FindTurningPointsForParcel_AfterMerge(parcel,detectAngle):
        allVP = parcel.GetVPInstance()
        edges = parcel.edges
        
        # Collect turningPoint indices
        turningPtInfo = []
        for i in range(len(edges)):
            turningPtInfo.append([])
            
        for i in range(len(edges)):
            currEdge = edges[i]
            allVP = currEdge.GetVPInstance()
            
            turningPtIndices,turningPts = OP.FindTurningPoint(currEdge.GetGeometry(),detectAngle)
            

            # Dont consider BetweenPt[0] or betweenPt[-1], becasue the big angle might come from merging
            turningPtIndices_Clean = []
            turningPts_Clean = []
            
            for ptIndex in turningPtIndices:
                if ptIndex != 1 and ptIndex!= len(allVP)-2:  
                 
                    turningPtIndices_Clean.append(ptIndex)
                    turningPts_Clean.append(turningPts[turningPtIndices.index(ptIndex)])
              
            turningParcPoints_Clean = []
            for index in turningPtIndices_Clean:
                turningParcPoints_Clean.append(allVP[index])
                    
            turningPtInfo[i].append(i)
            turningPtInfo[i].append(turningPtIndices_Clean)
            turningPtInfo[i].append(turningPts_Clean)
            turningPtInfo[i].append(turningParcPoints_Clean)
            
            # The return format is [(edgeIndex,[turningPtIndices],[Point3d],[ParcPoint])
        return turningPtInfo

    # Find turning point for the all parcels.
    @staticmethod
    def GetTurningPtInfoCollection(allParcel,detectAngle):
        turningPtCollection = []
        for parcel in allParcel:
            turningPtInfo =  OP.FindTurningPointsForParcel_AfterMerge(parcel,detectAngle)
            turningPtCollection.append([parcel,turningPtInfo])
        return turningPtCollection
    
    ############
    # Extract info
    ############   
    @staticmethod
    def ExtractTurningPtInfo(turningPtCollection):
        turningParcPts = []
        turningParcFs = []
        
        for parcelIndex in range(len(turningPtCollection)): 
            turningPtInfo = turningPtCollection[parcelIndex][1]
            thisParcel = turningPtCollection[parcelIndex][0]
        
            for egdeIndex in range(len(turningPtInfo)):
                for parcPt in turningPtInfo[egdeIndex][3]:
                    turningParcPts.append(parcPt)
                    turningParcFs.append(thisParcel)  
                        
        return turningParcPts,turningParcFs

    @staticmethod
    def ExtractEdgeTurningPtIndices(turningPtCollection):
        E_tPt_Collection = []
        for info in turningPtCollection:
            thisParcF = info[0]
            edges = thisParcF.edges
            edgesInfo = info[1]
            for edgeInfo in edgesInfo:
                thisEdgeIndex = edgeInfo[0]
                thisEdge = edges[thisEdgeIndex]
                turningPtIndices = edgeInfo[1]
                if edgeInfo[1] != []:
                    E_tPt_Collection.append([thisEdge,turningPtIndices])


        E_tPt_Collection_Clean = []
        IDRecord = []
        for collection in E_tPt_Collection:
            edge = collection[0]
            if edge.ID not in IDRecord:
                IDRecord.append(edge.ID) 
                IDRecord.append(edge.twinID) 
                E_tPt_Collection_Clean.append(collection)
        
        E_tPt_Dict = {}
        for collection in E_tPt_Collection_Clean:
            E_tPt_Dict[collection[0]] = collection[1]
        return E_tPt_Dict

    ############
    # Modification
    ############
    @staticmethod
    def ModifyAllTurningPointsWithNewType(PL,turningPtCollection,allParcF,currVP_Dict,currE_Dict):
        finishedEdge_Record = []
        for i in range(len(turningPtCollection)):
            thisParcF = allParcF[i]
            turningPtInfo_ThisParcel = turningPtCollection[i][1]
            
            for edgeIndex  in range(len(turningPtInfo_ThisParcel)):
                turningPtInfo_ThisEdge = turningPtInfo_ThisParcel[edgeIndex]
                thisEdge = thisParcF.edges[edgeIndex]
                thisEdgeID = thisEdge.ID
                
                if thisEdgeID not in finishedEdge_Record:
                    
                    turningPoint3d = turningPtInfo_ThisEdge[2]
                    for pt3d in turningPoint3d:
                        
                        thisEdge.turningPoints.append(PL.ParcTurningPoint(pt3d,max(currVP_Dict.keys())+1))

                    finishedEdge_Record.append(thisEdgeID)
                    
                    # treat the twinEdge, if any
                    thisTwinEdgeID = thisEdge.twinID
                    if thisTwinEdgeID != None :
                        thisTwinEdge = currE_Dict[thisTwinEdgeID]
                        for turingPt in thisEdge.turningPoints:
                            thisTwinEdge.turningPoints.append(turingPt)
                        thisTwinEdge.turningPoints.reverse()
                        finishedEdge_Record.append(thisTwinEdgeID)

        

    ###################################
    ####      Resample points      ####
    ################################### 
       
    # Help function
    @staticmethod
    def DivideEdgeByNumAndClean(edge_Geo,divNum,tol):

        resamplePoints = []
        rebuildEdge = ghc.RebuildCurve(edge_Geo,1,divNum,False)
        segs,vertices = ghc.Explode(rebuildEdge,True)

        for time in range(len(vertices)-1):
            for i in range(len(vertices)-2):
                currPt = vertices[i]
                nextPt = vertices[i+1]
                dist = currPt.DistanceTo(nextPt)
                if dist<tol:
                    vertices.pop(i+1)
                    break
        
        ### check last segment
        lastDist = vertices[-1].DistanceTo(vertices[-2])
        if lastDist < tol and len(vertices) >2:
            vertices.pop(-2)
        
        if len(vertices) ==2:
            resamplePoints = []
        else:
            resamplePoints = vertices[1:-1]
        
        return resamplePoints

    ############
    # Different treatment for two scenerios 
    ############
    @staticmethod
    def GetResamplePoints_Normal(PL,currVP_Dict,edge,divNum,tol = 1):
        edge_Geo = edge.GetGeometry()
        resamplePoints_Geo = OP.DivideEdgeByNumAndClean(edge_Geo,divNum,tol)
        resamplePoints = []
        for pt in resamplePoints_Geo:
            currVPMaxID = max(currVP_Dict.keys())
            newResamplePoint = PL.ParcResamplePoint(pt,currVPMaxID+1)
            currVP_Dict[currVPMaxID+1] = newResamplePoint

            edge.resamplePoints.append(newResamplePoint)
            if edge.naked ==True:
                newResamplePoint.onBoundary = True
            resamplePoints.append(newResamplePoint)
        edge.resamplePoints = resamplePoints
        #print "Normal: ",edge.ID
        
    @staticmethod
    def GetResamplePoints_WithTurningPoints(PL,currVP_Dict,edge,turningIndex,divNum,tol = 1):
        edge_Geo = edge.GetGeometry()
        pts = [pt for pt in edge_Geo]
        ts = []

        for pt in pts:
            ts.append(edge_Geo.ClosestParameter (pt))
        allIndices = [i for i in range(len(pts))]
        seg_PolyLs = []
        ptIndexSlices = []
        for i in range(len(turningIndex)):
            if i == 0 :
                ptIndexSlices.append(allIndices[0:turningIndex[i]+1])
            elif i != 0 and i!=len(turningIndex)-1:
                ptIndexSlices.append(allIndices[turningIndex[i-1]:turningIndex[i]+1])
            elif i==len(turningIndex)-1:
                ptIndexSlices.append(allIndices[turningIndex[i-1]:])
                
        if len(turningIndex) == 1:
            ptIndexSlices.append(allIndices[turningIndex[i-1]:])


        resamplePoints = []
        
        ### Assign div Number 
        divNumRest = divNum - len(ptIndexSlices)

        polyLs = []
        for sliceIndex in range(len(ptIndexSlices)):
            
            v_PolyL = []
            for index in ptIndexSlices[sliceIndex]:
                v_PolyL.append(pts[index])
                
            polyLs.append(rg.Polyline(v_PolyL))

        lengths = [polyL.Length for polyL in polyLs]
        totalLength = sum(lengths)
        divNums = []
        for i in range(len(lengths)):
            num = int(math.ceil(lengths[i]/totalLength * divNumRest))
            if num == 2:
                num +=1
            divNums.append(num)

        ### Process    
        for sliceIndex in range(len(ptIndexSlices)):

            PolyL = polyLs[sliceIndex]
            rPoints_Temp = OP.DivideEdgeByNumAndClean(PolyL,divNums[sliceIndex],tol)
            
            ### Convert point3d to instances
            
            for rPt in rPoints_Temp:
                currVPMaxID = max(currVP_Dict.keys())
                rPointInstance = PL.ParcResamplePoint(rPt,currVPMaxID+1)

                currVP_Dict[currVPMaxID+1] = rPointInstance
                resamplePoints.append(rPointInstance)
            
            if sliceIndex!= len(ptIndexSlices)-1:
                currVPMaxID = max(currVP_Dict.keys())
                rPointInstance = PL.ParcResamplePoint(pts[turningIndex[sliceIndex]],currVPMaxID+1)
                rPointInstance.turning = True
                currVP_Dict[currVPMaxID+1] = rPointInstance
                resamplePoints.append(rPointInstance)
                
            edge.resamplePoints = resamplePoints

    ############
    # Modification
    ############
    @staticmethod
    def GetResamplePointsForAllEdges(PL,currVP_Dict,currE_Dict,turningPtCollection,divNum=5,tol = 2):
        E_tPt_Dict = OP.ExtractEdgeTurningPtIndices(turningPtCollection)
        turningEdges = E_tPt_Dict.keys()
        turningEID = []

        for edge in E_tPt_Dict.keys():
            turningEID.append(edge.ID)
            turningEID.append(edge.twinID)

        ### Normal treatment 
        normalTreatmentRecord = []
        for key in currE_Dict.keys():
            currEdge = currE_Dict[key]
            if key not in turningEID and key not in normalTreatmentRecord and currEdge.naked == False:
                normalTreatmentRecord.append(key)
                OP.GetResamplePoints_Normal(PL,currVP_Dict,currEdge,divNum,tol)
                currResamplePoints =  currEdge.resamplePoints
                twinEdge = currE_Dict[currEdge.twinID]
                twinResamplePoints = []
                for rPt in currResamplePoints:
                    twinResamplePoints.append(rPt)
                twinResamplePoints.reverse()
                twinEdge.resamplePoints = twinResamplePoints
                
        ### Sepcial treatment for egdes with turning points
        for edge in turningEdges:
            currEdge = edge
            currTurningPtIndices = E_tPt_Dict[currEdge]
            OP.GetResamplePoints_WithTurningPoints(PL,currVP_Dict,currEdge,currTurningPtIndices,divNum,tol)
            
            currResamplePoints =  currEdge.resamplePoints
            twinEdge = currE_Dict[currEdge.twinID]
            twinResamplePoints = []
            for rPt in currResamplePoints:
                twinResamplePoints.append(rPt)
            twinResamplePoints.reverse()
            twinEdge.resamplePoints = twinResamplePoints


    ###################################
    ####    Constraint HelpFun     ####
    ################################### 
    @staticmethod 
    def AssignRoadID(roads):
        for i in range(len(roads)):
            roads[i].ID = i

    @staticmethod 
    def GetStreetAngleConstraintPair(roads):
        allRoads = []
        allRoads.extend(roads)
  
        OP.AssignRoadID(allRoads)
        allVertices = []
        for road in allRoads:
            allVertices.extend(road.GetAllVertexInstance())
    
        counter = Counter(allVertices)
        junctionVertices = [v for v, count in counter.items() if count >= 2]

            
        jvs = [jv.geometry for jv in junctionVertices]            
        jVInfoCollection = []
        for jV in junctionVertices:
            thisJVInfo = [jV]  #[jv,[IDs]]
            roadIDs = []
            for road in allRoads:
                thisRoadVertices = road.GetAllVertexInstance()
                if jV in thisRoadVertices:
                    roadIDs.append(road.ID)
                    
            thisJVInfo.append(roadIDs)
            jVInfoCollection.append(thisJVInfo)
            
     
        roadDict = {}
        for road in allRoads:
            roadDict[road.ID] = road
        
        ### Get pairCollection
        pairColllection = []
        for info in jVInfoCollection:
            jV = info[0]
            combs = []

            for comb in combinations(info[1], 2):
                combs.append(comb)
                
            for comb in combs:
                relevantPEs_A =  roadDict[comb[0]].GetRelevantPE(jV)
                relevantPEs_B =  roadDict[comb[1]].GetRelevantPE(jV)
                
                for pE_A in relevantPEs_A:
                    for pE_B in relevantPEs_B:
                        pairColllection.append([pE_A,pE_B,jV])
                
        ### Check the direction of pair
        pairColllection_Check = []
        for pair in pairColllection:
            pE_A = pair[0]
            pE_B = pair[1]
            if pE_A.naked ==True and pE_B.naked ==True:
                continue
            
            commonV = pair[2]
            
            if pE_A.startVertex == commonV:
                if pE_A.resamplePoints!= []:
                    pE_A_Geo = rg.Line( commonV.geometry , pE_A.resamplePoints[0].geometry)
                else:
                    pE_A_Geo = rg.Line( commonV.geometry , pE_A.endVertex.geometry)
                    
            elif pE_A.endVertex == commonV:
                if pE_A.resamplePoints!= []:
                    pE_A_Geo = rg.Line( commonV.geometry, pE_A.resamplePoints[-1].geometry)
                else:
                    pE_A_Geo = rg.Line( commonV.geometry , pE_A.startVertex.geometry)

            if pE_B.startVertex == commonV:
                if pE_B.resamplePoints!= []:
                    pE_B_Geo = rg.Line(commonV.geometry,  pE_B.resamplePoints[0].geometry)
                else:
                    pE_B_Geo = rg.Line( commonV.geometry , pE_B.endVertex.geometry)
            
            elif pE_B.endVertex == commonV:
                if pE_B.resamplePoints!= []:
                    pE_B_Geo = rg.Line( commonV.geometry , pE_B.resamplePoints[-1].geometry)    
                else:
                    pE_B_Geo = rg.Line( commonV.geometry , pE_B.startVertex.geometry)
                    
            if  rm.ToDegrees(rg.Vector3d.VectorAngle(rg.Vector3d(pE_A_Geo.To -pE_A_Geo.From) ,rg.Vector3d(pE_B_Geo.To -pE_B_Geo.From)))  >  135:
                continue 
            
            pairColllection_Check.append([pE_A_Geo,pE_B_Geo])
            
        return pairColllection_Check,jvs   # return the pairs of line, and all the junction vertex geometries
        
    ###################################
    ####    Combined function      ####
    ###################################
    
    # choice == 0: Resample; choice = 1, simplified
    @staticmethod
    def OptimizeWithConstraints(GRP,copiedParcFace,roads,inputPolyline,EDict,constraints,choice = 0):

        # Get the old roads geometry  (Different scenarios)
        if choice == 0:
            oldRoads = [road.GetGeometry_SimplifiedWithResamplePoints() for road in roads]

        elif choice == 1:
            oldRoads = [road.GetGeometry_Simplified() for road in roads]
            

        # Get the optimization subjects, type: instance  (Different scenarios)
        allPts = []
        for parcF in copiedParcFace:
            for parcEdge in parcF.edges:
   
                if parcEdge.startVertex not in allPts:
                    allPts.append(parcEdge.startVertex)

                # Different choices : choice == 0: Resample; choice = 1, simplified
                if choice == 0:
                    for rPt in parcEdge.resamplePoints:
                        if rPt not in allPts:
                            
                            allPts.append(rPt)
                elif choice == 1:
                   
                    pass

                if parcEdge.endVertex not in allPts:
                    allPts.append(parcEdge.endVertex)

        
        # Get the optimization subjects, type: Point3d
        allPts_Geo = []
        for pt in allPts:
            allPts_Geo.append(pt.geometry)
           
        ### Get forming Order (Different scenarios)   
        orderCollection = []    
        for parcFace in copiedParcFace:
            formingOrder = []
            
            if choice == 0:
                allInstances = parcFace.GetVPInstance_SimplifiedWithResamplePoints()
                allInstances.append(allInstances[0])

            elif choice == 1:
                allInstances = parcFace.GetVPInstance_Simplified()
                allInstances.append(allInstances[0])
                
            for v in allInstances:
                index = allPts.index(v)
                formingOrder.append(index)
            orderCollection.append(formingOrder)
        
        # Record the Pt dictionary for retreiving later
        allPtsIDDict = {}
        for pt in allPts:
            allPtsIDDict[pt.ID] = pt
        
        ### Get forming Order _ (Different scenarios)    
        orderCollection_Road = []  
  
          
        for road in roads:
            formingOrder_Road = []
            
            if choice == 0:
                allInstances = road.GetAllVPInstance_Resample()
            
            elif choice == 1:
                allInstances = road.GetAllVPInstance_Simplified()
                
            for v in allInstances:
                index = allPts.index(allPtsIDDict[v.ID])
                formingOrder_Road.append(index)
            
            orderCollection_Road.append(formingOrder_Road)
        
        
        ### Initialze Solver
        ps = ks.PhysicalSystem()
        goals = List[ks.IGoal]()
        
        ### Strength Control
        vAnchorStrength = constraints[0]  #fix the original position of those vertices on the boundary
        vOnCrvStrength = constraints[1]   #keep those vertices on boundary
        pAnchorStrength = constraints[2]     #fix the original position of non-boundary vertices on 
        
        roadSmoothStrength = constraints[3]  # treat each segment , the degree < upperLimit
        upperLimit = rm.ToRadians(0)
        roadJunctionAngleStrength = constraints[4]
        
        parcelSideSmoothStrength = constraints[5]
        parcelSideAngleStrength = constraints[6]
        parcelSideLengthStrength = constraints[7]
        parcelAdjacencyStrength = constraints[8]
        
        
 
        #region Constraint: Closeness
        VPAnchor_Constraint = []
        for i in range(len(allPts)):
            currObj = allPts[i]
            if currObj.onBoundary == True:
                VPAnchor_Constraint.append(ks.Goals.Anchor(currObj.geometry, vAnchorStrength))

            elif currObj.onBoundary == False:
                VPAnchor_Constraint.append(ks.Goals.Anchor(currObj.geometry, pAnchorStrength))

        #endregion
        
        #region Constraint: vOnCrvStrength
        vOnCrv_Constraint = []
        boundaryV = List[rg.Point3d]()
        for i in range(len(allPts)):
            currObj = allPts[i]
            if currObj.onBoundary == True:
                boundaryV.Add(currObj.geometry)
        
        vOnCrv_Constraint.append(ks.Goals.OnCurve(boundaryV,inputPolyline.ToPolylineCurve(),vOnCrvStrength))    
        #endregion
        
        #region Constrain: roadAngle   
        roadAngle_Constraint = []
        lowerLimit = 0
        
        for polyL in oldRoads:
            segments = polyL.GetSegments()
            segments_List = [seg for seg in segments]
            lineA = segments_List[:-1]
            lineB =  segments_List[1:] 
            for i in range(len(lineA)):
                roadAngle_Constraint.append(ks.Goals.ClampAngle(lineA[i],lineB[i],upperLimit,lowerLimit,roadSmoothStrength))
        #endregion

        #region Constrain: roadJunctionAngle
        pairColllection, jvs = OP.GetStreetAngleConstraintPair(roads)
        roadJunctionAngle_Constraint = []
        for pair in pairColllection:
            lineA = rg.Line(pair[0].To,pair[0].From)
            lineB = pair[1]
            roadJunctionAngle_Constraint.append(ks.Goals.Angle(lineA,lineB,rm.ToRadians(90),roadJunctionAngleStrength))
        #endregion

        
        #region Constrain: parcelSideSmooth
        parcelSideSmooth_Constraint = []
        for parcFace in copiedParcFace:
            # if len(parcFace.sides) == 3:
            #     continue
            for side in parcFace.sides:
                if True in [EDict[side[index]].naked for index in range(len(side))]:
                    continue
                else:
                    pEs = [EDict[edgeIndex] for edgeIndex in side]
                    thisSidePts = []
                    for pE in pEs:
                        thisSidePts.append(pE.startVertex.geometry)
                        for rPt in pE.resamplePoints:
                            thisSidePts.append(rPt.geometry)
                    
                    thisSidePts.append(pE.endVertex.geometry)
                   
                    thisSideGeometry = rg.Polyline(thisSidePts)
                    
                    
                    thisSegments =  thisSideGeometry.GetSegments()
                    
                    
                    for i in range(len(thisSegments)-1):
                        currSeg = thisSegments[i]
                        nextSeg = thisSegments[i+1]
                        # currVec = rg.Vector3d(currSeg.To - currSeg.From)
                        # nextVec = rg.Vector3d(nextSeg.To - nextSeg.From)

                        parcelSideSmooth_Constraint.append(ks.Goals.Angle(currSeg,nextSeg,rm.ToRadians(0),parcelSideSmoothStrength))

        #endregion
        
        #region Constrain: parcelSideAngle  
        parcelSideAngle_Constraint = []
        for parcFace in copiedParcFace:
            # if len(parcFace.sides) <= 3:
            #     print "tri ID" ,parcFace.ID
            #     continue
            idealAngle = (len(parcFace.sides)-2)*180 / len(parcFace.sides)
            for i in range(len(parcFace.sides)-1):
                currSide = parcFace.sides[i]
                nextSide =parcFace.sides[i+1]
                
                if True in [EDict[currSide[index]].naked for index in range(len(currSide))] or True in [EDict[nextSide[index]].naked for index in range(len(nextSide))] :
                    continue
                
                else:
                    pEs = [EDict[edgeIndex] for edgeIndex in currSide]
                    currSidePts = []
                    for pE in pEs:
                        currSidePts.append(pE.startVertex.geometry)
                        for rPt in pE.resamplePoints:
                            currSidePts.append(rPt.geometry)
                        
                        currSidePts.append(pE.endVertex.geometry)
                        
                    currSideGeometry = rg.Polyline(currSidePts)  
                    currSegs = currSideGeometry.GetSegments()
                    
                    pEs = [EDict[edgeIndex] for edgeIndex in nextSide]
                    nextSidePts = []
                    for pE in pEs:
                        nextSidePts.append(pE.startVertex.geometry)
                        for rPt in pE.resamplePoints:
                            nextSidePts.append(rPt.geometry)
                            
                        nextSidePts.append(pE.endVertex.geometry)
                        
                    nextSideGeometry = rg.Polyline(nextSidePts)  
                    nextSegs = nextSideGeometry.GetSegments()
                    
                    currSegs_Last = currSegs[len(currSegs)-1]
                    nextSegs_First = nextSegs[0]
                    # currVec = rg.Vector3d(currSegs_Last.To - currSegs_Last.From)
                    # nextVec = rg.Vector3d(nextSegs_First.To - nextSegs_First.From)

    
                    parcelSideAngle_Constraint.append(ks.Goals.Angle(currSegs_Last,nextSegs_First,rm.ToRadians(idealAngle),parcelSideAngleStrength))
                    
            ### the last 
            currSide = parcFace.sides[len(parcFace.sides)-1]
            nextSide =parcFace.sides[0]      
            if EDict[currSide[0]].naked ==True or EDict[nextSide[0]].naked ==True:
                    continue
                
            else:
                pEs = [EDict[edgeIndex] for edgeIndex in currSide]
                currSidePts = []
                for pE in pEs:
                    currSidePts.append(pE.startVertex.geometry)
                    for rPt in pE.resamplePoints:
                        currSidePts.append(rPt.geometry)
                    currSidePts.append(pE.endVertex.geometry)
                    
                currSideGeometry = rg.Polyline(currSidePts)  
                currSegs = currSideGeometry.GetSegments()
                
                pEs = [EDict[edgeIndex] for edgeIndex in nextSide]
                nextSidePts = []
                for pE in pEs:
                    nextSidePts.append(pE.startVertex.geometry)
                    for rPt in pE.resamplePoints:
                        nextSidePts.append(rPt.geometry)
                    nextSidePts.append(pE.endVertex.geometry)
                nextSideGeometry = rg.Polyline(nextSidePts)  
                nextSegs = nextSideGeometry.GetSegments()
                
                currSegs_Last = currSegs[len(currSegs)-1]
                nextSegs_First = nextSegs[0]
                # currVec = rg.Vector3d(currSegs_Last.To - currSegs_Last.From)
                # nextVec = rg.Vector3d(nextSegs_First.To - nextSegs_First.From)


                parcelSideAngle_Constraint.append(ks.Goals.Angle(currSegs_Last,nextSegs_First,rm.ToRadians(idealAngle),parcelSideAngleStrength))
        
        #endregion 

        #region Constrain: parcelSideLength
        parcelSideLength_Constraint = []
        for parcFace in copiedParcFace:
            ### Get the ideal side length
            resampleSides = parcFace.GetSideGeometry_Resample()
            sumLength = 0
            for rSide in resampleSides:
                sumLength += rSide.Length
            idealLength = sumLength/len(parcFace.sides)
            
            ### ideal length for each segment by percentage
            for rSide in resampleSides:
                for segment in rSide.GetSegments():
                    idealSegmentLength = idealLength/rSide.SegmentCount
                    parcelSideLength_Constraint.append(ks.Goals.Spring(segment,idealSegmentLength,parcelSideLengthStrength))
        #endregion    
        

                
        #region Constrain: parcelAdjacencyStrength
        parcelAdjacency_Constraint = []
        currJunctionGraph = GRP.JunctionGraph.CreateJunctionGraphForThisDepth(EDict)
        currParcEdgeGraph = GRP.ParcEdgeGraph.CreateParcEdgeGraphForThisDepth(currJunctionGraph) 

        for thisPE in currParcEdgeGraph.graph.keys():
            if thisPE.naked ==True:
                continue
            
            nbEdges = currParcEdgeGraph.graph[thisPE]

            for nbEdge in nbEdges:
                if nbEdge.naked ==True:
                    continue
                if thisPE.startVertex.geometry == nbEdge.startVertex.geometry or thisPE.endVertex.geometry == nbEdge.startVertex.geometry:
                    commonPt = nbEdge.startVertex.geometry
                elif thisPE.startVertex.geometry == nbEdge.endVertex.geometry or thisPE.endVertex.geometry == nbEdge.endVertex.geometry:
                    commonPt = nbEdge.endVertex.geometry
                
                if commonPt == thisPE.startVertex.geometry:
                    if thisPE.resamplePoints!=[]:
                        nextPEpt = thisPE.resamplePoints[0].geometry
                    else:
                        
                        nextPEpt = thisPE.endVertex.geometry
                elif commonPt == thisPE.endVertex.geometry:
                    if thisPE.resamplePoints!=[]:
                        nextPEpt = thisPE.resamplePoints[-1].geometry
                    else:
                        
                        nextPEpt = thisPE.endVertex.geometry
                
                    
                if commonPt == nbEdge.startVertex.geometry:
                    if nbEdge.resamplePoints!=[]:
                        nextNBpt = nbEdge.resamplePoints[0].geometry
                    else:
                        
                        nextNBpt = nbEdge.endVertex.geometry
                elif commonPt == nbEdge.endVertex.geometry:
                    if nbEdge.resamplePoints!=[]:
                        nextNBpt = nbEdge.resamplePoints[-1].geometry
                    else:
                        
                        nextNBpt = nbEdge.startVertex.geometry
                    
                lineA = rg.Line(nextPEpt,commonPt)
                lineB = rg.Line(commonPt,nextNBpt)
                
                vecA = rg.Vector3d(commonPt-nextPEpt)
                vecB = rg.Vector3d(nextNBpt-commonPt)
                angle = rg.Vector3d.VectorAngle(vecA,vecB)
                angle_Degree = rm.ToDegrees(angle)
                if angle_Degree>=0 and angle_Degree<30:
                    parcelAdjacency_Constraint.append(ks.Goals.Angle(lineA,lineB,rm.ToRadians(0),parcelAdjacencyStrength))
                elif angle_Degree>=60 and angle_Degree<=120:
                    parcelAdjacency_Constraint.append(ks.Goals.Angle(lineA,lineB,rm.ToRadians(90),parcelAdjacencyStrength))

               
        #endregion
        
        ##### Assign to PhysicalSystem
        allConstraint = []
        allConstraint.extend(VPAnchor_Constraint)
        allConstraint.extend(vOnCrv_Constraint)
      
        allConstraint.extend(roadAngle_Constraint)
        allConstraint.extend(roadJunctionAngle_Constraint)
        
        allConstraint.extend(parcelSideSmooth_Constraint)
        allConstraint.extend(parcelSideAngle_Constraint)
        allConstraint.extend(parcelSideLength_Constraint)
        allConstraint.extend(parcelAdjacency_Constraint)
        

        for g in allConstraint:
            ps.AssignPIndex(g,0.001)
            goals.Add(g)


        ##### Save previous result
        oldParcels = []
        for order in orderCollection:
            vs =[]
            for index in order:
                vs.append(allPts[index].geometry)
            vs.append(vs[0])
            oldParcels.append(rg.Polyline(vs))
            
        ##### Solve
        counter = 0
        threshold = 0.00001
        #threshold = 1e-10
        while counter < 1000:
            ps.Step(goals,True,threshold)
            counter += 1
            if ps.GetvSum() < threshold:
                break
    
        A = ps.GetOutput(goals)
        B = counter
        C = ps.GetPositionArray()

        ptList = []
        for pt in C:
            ptList.append(pt)

        ##### Get the final Result preview _Road  
        newRoads = []
        for order in orderCollection_Road:
            vs =[]
            for index in order:
                vs.append(ptList[index])
            
            newRoads.append(rg.Polyline(vs))
            
        ##### Get the final Result preview   
        
        newParcels = []
        for order in orderCollection:
            vs =[]
            for index in order:
                vs.append(ptList[index])
            vs.append(vs[0])
            newParcels.append(rg.Polyline(vs))



        ##### this is to refer to the optimized geometry and do data analysis
        ptDict_New = {}
        ptDict_Old = {}
        #for instance in allInstances:
        
        for i in range(len(allPts)):
            thisInstance = allPts[i]
            ptDict_New[thisInstance.ID] = ptList[i] 
            ptDict_Old[thisInstance.ID] = thisInstance.geometry
        
        print ("Computation Count"),counter
        return newParcels,oldParcels,newRoads,oldRoads,ptDict_New,ptDict_Old #ptDict,orderCollection,orderCollection_Road
    
    @staticmethod
    def OptimizeWithConstraints_Failed(copiedParcFace,roads,choice):
        # Get the optimization subjects, type: instance  (Different scenarios)
        choice = 0

        # Get the old roads geometry  (Different scenarios)
        if choice == 0:
            oldRoads = [road.GetGeometry_SimplifiedWithResamplePoints() for road in roads]

        elif choice == 1:
            oldRoads = [road.GetGeometry_Simplified() for road in roads]

        newRoads = oldRoads
        
        
        ptDict_New = {}
        ptDict_Old = {}
        allPts = []
        for parcF in copiedParcFace:
            for parcEdge in parcF.edges:

                if parcEdge.startVertex not in allPts:
                    allPts.append(parcEdge.startVertex)

                # Different choices : choice == 0: Resample; choice = 1, simplified
                if choice == 0:
                    for rPt in parcEdge.resamplePoints:
                        if rPt not in allPts:
                            allPts.append(rPt)
                elif choice == 1:
                    pass

                if parcEdge.endVertex not in allPts:
                    allPts.append(parcEdge.endVertex)


        for i in range(len(allPts)):
            thisInstance = allPts[i]
            ptDict_Old[thisInstance.ID] = thisInstance.geometry
        
        ptDict_New = ptDict_Old
        
        ### Get forming Order (Different scenarios)   
        orderCollection = []    
        for parcFace in copiedParcFace:
            formingOrder = []
            
            if choice == 0:
                allInstances = parcFace.GetVPInstance_SimplifiedWithResamplePoints()
                allInstances.append(allInstances[0])

            elif choice == 1:
                allInstances = parcFace.GetVPInstance_Simplified()
                allInstances.append(allInstances[0])
                
            for v in allInstances:
                index = allPts.index(v)
                formingOrder.append(index)
            orderCollection.append(formingOrder)
        
        
        oldParcels = []
        for order in orderCollection:
            vs =[]
            for index in order:
                vs.append(allPts[index].geometry)
            vs.append(vs[0])
            oldParcels.append(rg.Polyline(vs))
        
        newParcels = oldParcels

        return newParcels,oldParcels,newRoads,oldRoads,ptDict_New,ptDict_Old
    
    #############################################
    ####    Get info after Opt function      ####
    #############################################
    @staticmethod
    def GetBoundaryAfterOpt(currE_Dict,ptDict_New):
        boundaryEdges = []
        for edge in currE_Dict.values():
            if edge.naked == True:
                relatedPointGeos = []    # Get the new point geo after opt
                relatedPointGeos.append(ptDict_New[edge.startVertex.ID])
                for rPt in edge.resamplePoints:
                    relatedPointGeos.append(ptDict_New[rPt.ID])
                relatedPointGeos.append(ptDict_New[edge.endVertex.ID])
                boundaryEdges.append(rg.Polyline(relatedPointGeos).ToPolylineCurve())
        boundaryOpt = rg.Curve.JoinCurves(boundaryEdges)[0]
        
        return boundaryOpt

    @staticmethod
    def GetNakedRoadAfterOpt(nakedRoads,ptDict_New):
        nakedRoadCats_WithoutJoined = []
        nakedRoadGeos_WithoutJoined = []
        
        for road in nakedRoads:
            thisRoadPts = [ptDict_New[edge.startVertex.ID] for edge in road.edgeCollection] + [ptDict_New[road.edgeCollection[-1].endVertex.ID]]
            thisRoadGeo = rg.Polyline(thisRoadPts).ToPolylineCurve()
            nakedRoadGeos_WithoutJoined.append(thisRoadGeo)
            nakedRoadCats_WithoutJoined.append(road.edgeCollection[0].hierarchy ) 
        nakedRoadGeos = rg.Curve.JoinCurves(nakedRoadGeos_WithoutJoined)      # Join the curve 
        nakedRoadGeosNum = len(nakedRoadGeos)
        
        # for road center line

        return nakedRoadGeos,nakedRoadGeosNum,nakedRoadGeos_WithoutJoined,nakedRoadCats_WithoutJoined
# ---------- end ghpython_script_12 ----------
ghpython_script_13 = GhPythonScript()  # -> out, OF
# ---------- ghpython_script_13: Python ----------
###########################
####    Import Libs    ####
###########################
import Rhino.Geometry as rg
import Rhino.RhinoDoc as rd
import Rhino.RhinoMath as rm


###########################
####    Description    ####
###########################
### OF : OF function
### This is a library to offset the road creating width
### Key concept： "A" is touching "B" and "C".  The offset of "A:: "A_1" and "A_2" are not touching "B" and "C". So you need to extend "A_1" and "A_2"
###               "B" and "C can be the same : The boundary.

class OF:

    ################
    # Preparation : Assign
    ################

    ### Decide the newly added road's hierarchy based on surrounding
    @staticmethod
    def DecideCatToAssign(catList):
        
        # remove 6 (None)
        catListWithout6 = []
        for cat in catList:
            if cat!=6:
                catListWithout6.append(cat)
        catList= catListWithout6
        
        
        if catList!=[]:
            maxCatList = max(catList)
            chosenCats = []
            
            #Case 0:
            if maxCatList <= 3:
                chosenCats = [3,4]
            
            #Case 1:
            elif maxCatList == 4:
                chosenCats = [4,5]
            
            
            #Case 2:
            elif maxCatList == 5:
                if 4 in catList:
                    chosenCats = [4,5]
                elif 4 not in catList:
                    chosenCats = [5,5]
                    

                
        else:

            chosenCats = [4,5]

        
        return chosenCats


    ### Simply classify the road from newRoads output to proceed
    @staticmethod
    def PreClassifyRoads(newRoads,originalRoadGeosNum,roadMidPoints,roadCatOrder):
        if originalRoadGeosNum!=0:
            boundaryRoads = newRoads[-originalRoadGeosNum:]                                       # Extract the nakedRoundRoad, in this input it is always at index 0
            internalJoinedRoads= rg.Curve.JoinCurves(newRoads[:-originalRoadGeosNum])              # Join the rest roads if possible, the results will be used to create closed region for trimming parcels
        elif originalRoadGeosNum==0:
            boundaryRoads = []
            internalJoinedRoads= rg.Curve.JoinCurves([road for road in newRoads]) 

        # Re-sort the order based on preivous road cat order. Because the road order might be changed because of this "JoinCurves" method 
        sortedBase = []
        for i in range(len(internalJoinedRoads)):
            sortedBase.append(7)   # Append an invalid number

        for i in range(len(internalJoinedRoads)):
            thisRoad = internalJoinedRoads[i]
            dists = []
            cats = []
    
            for j in range(len(roadMidPoints)):
                currMidPoint = roadMidPoints[j]
                closestPointT = thisRoad.ClosestPoint(currMidPoint)[1]
                closestPoint = thisRoad.PointAt(closestPointT)
                dist = closestPoint.DistanceTo(currMidPoint)
                dists.append(dist)
                cats.append(roadCatOrder[j])
            minIndex = dists.index(min(dists))
            sortedBase[i] = cats[minIndex]

     
        sorted_elements = sorted(zip(internalJoinedRoads, sortedBase), key=lambda x: x[1])
        internalJoinedRoads = [element for element, _ in sorted_elements]    

        allRoads = [geo for geo in internalJoinedRoads]                 # Create a store space for all the road, replacing the input with joined result
        allRoads.extend(boundaryRoads)

        return boundaryRoads,internalJoinedRoads,allRoads
    
    ### Assign hierarchy for naked edges
    @staticmethod
    def AssignNakedEdgesHierarchy(collection_StreetGraph, copiedParcFace):
        firstLayerIDs =[ street.ID for street in collection_StreetGraph[0].graph.keys()]
        nakedRoadParcEdgeIDs = []

        allRoadParcEdgeIDs = []
        for street in collection_StreetGraph[-1].graph.keys():
            if  street.ID not in firstLayerIDs:
                allRoadParcEdgeIDs.extend(street. GetAllParcEdgeAndTwinEdgeID())
            
            else:
                nakedRoadParcEdgeIDs.extend(street. GetAllParcEdgeAndTwinEdgeID())
    
        for pF in copiedParcFace:

            for edge in pF.edges:
                edge.offsetDistance = 0
                if edge.ID in allRoadParcEdgeIDs:
                    edge.hierarchy = 3
                    
                elif edge.ID in nakedRoadParcEdgeIDs:
                    edge.hierarchy = 1
    
    @staticmethod
    def GetRelevantOffsets(edgeGeoList,validStreetGeos):
        validComparisionIndices = []
        for j in range(len(edgeGeoList)):
            edgeGeo = edgeGeoList[j]
            thisEdgeStart = edgeGeo.PointAtStart
            thisEdgeEnd = edgeGeo.PointAtEnd
            
            for i in range(len(validStreetGeos)):
                streetGeo = validStreetGeos[i]
                closestStartT = streetGeo.ClosestPoint(thisEdgeStart)[1]
                closestStartPoint = streetGeo.PointAt(closestStartT)
                startDistance = thisEdgeStart.DistanceTo(closestStartPoint)
                
                closestEndT = streetGeo.ClosestPoint(thisEdgeEnd)[1]
                closestEndPoint = streetGeo.PointAt(closestEndT)
                endDistance = thisEdgeEnd.DistanceTo(closestEndPoint)
                
                # [DEBUG or CHECK]
                #if i ==1 and j==3:
                #if i ==0 and j ==5:
                #     print "edgeGeo",j
                #     for pt in edgeGeo.TryGetPolyline()[1]:
                #         print pt   
                
                #     print "streetGeo"
                #     for pt in streetGeo.TryGetPolyline()[1]:
                #         print pt  
                        
                    #print "edgeGeoList",j,"validStreetGeos",i, "startDistance",startDistance,"endDistance",endDistance
                if startDistance<0.1 or endDistance<0.1:
                    if i not in validComparisionIndices:
                        validComparisionIndices.append(i)

        return validComparisionIndices


    ################
    # Preparation : Retrieve the data structure after optimization
    ################
    
    ### Reconstruct the parcel with simple data structure, based on previous data struture and new pt dictionary
    @staticmethod
    def ReconstructSimplifiedParcelAfterOptimization(PL,copiedParcFace,ptDict_New,choice):
        
        ptDict_New = ptDict_New[0]  ### this is the dict from optimization part

        ### start with each parcFace
        resampleParcFaces = []
        for pF in copiedParcFace:
            
            newVs = []
            newEs = []  
            newF = PL.ParcFace()
            
            for edge in pF.edges:

                startVertex = PL.ParcVertex(ptDict_New[edge.startVertex.ID],edge.startVertex.ID)
                if edge.startVertex.onBoundary == True:
                    startVertex.onBoundary = True
                
                
                endVertex = PL.ParcVertex(ptDict_New[edge.endVertex.ID],edge.endVertex.ID)
                if edge.endVertex.onBoundary == True:
                    endVertex.onBoundary = True
                
                rPoints = []
                if choice == 0:
                    for rPt in edge.resamplePoints:
                        rPoints.append(PL.ParcResamplePoint(ptDict_New[rPt.ID],rPt.ID))
            
                newEdge = PL.ParcEdge(edge.ID)
                newEdge.hierarchy = edge.hierarchy
                newEdge.offsetDistance = edge.offsetDistance
                newEdge.startVertex = startVertex              
                newEdge.endVertex = endVertex     
                newEdge.resamplePoints = rPoints
                newEdge.naked = edge.naked
                newEs.append(newEdge)
            
            newVs = [pE.startVertex for pE in newEs]
            newF.vertices = newVs
            newF.edges = newEs
            newF.ID = pF.ID
            
            resampleParcFaces.append(newF)
            
            
        resamplePFGeos = [PF.GetGeometry_SimplifiedWithResamplePoints() for PF in resampleParcFaces]
        resamplePFIndices = [PF.ID for PF in resampleParcFaces]
        
        return resampleParcFaces,resamplePFGeos,resamplePFIndices

    ### Get the offset curve and offset region,excluding the first depth of roads
    @staticmethod
    def GetValidStreetGeos(collection_StreetGraph):
        ### this function is to exclude the first depth of roads, collect the other road geometries
        firstLayerIDs =[ street.ID for street in collection_StreetGraph[0].graph.keys()]

        validStreets = [] ### collect street instance

        allRoadParcEdgeIDs = []
        for street in collection_StreetGraph[-1].graph.keys():
            if  street.ID not in firstLayerIDs:
                allRoadParcEdgeIDs.extend(street. GetAllParcEdgeAndTwinEdgeID())
                validStreets.append(street)

        validStreetGeos = [] ### collect street geometry
        for street in validStreets:
            validStreetGeos.append(street.GetGeometry().ToPolylineCurve())

        return validStreetGeos

    
    
    
    ################
    # Compute process : Create a closed region for every road to trim the related parcels
    ################
    
    @staticmethod
    def ExtendOneSideToReach(crv,boundary,extensionSide,iteration,extension,targetCount,tol=0.01):
        
        ### make a copy
        crvCopy = rg.PolylineCurve(crv)
        
        ### extend the crv from a specific side
        for i in range(iteration):
            crvCopy= crvCopy.Extend(extensionSide,extension,rg.CurveExtensionStyle.Line)
            if rg.Intersect.Intersection.CurveCurve(crvCopy,boundary,tol,tol).Count == targetCount:
                break
        
        ### extend the last time and get the intersectionPt
        newPtList = []
        if extensionSide == rg.CurveEnd.Start:
            
            ### check the last seg
            crvCopyPL = crvCopy.TryGetPolyline()[1]
            lastPt = crvCopyPL[0]
            lastLastPt = crvCopyPL[1]
            lastSeg = rg.Polyline([lastPt,lastLastPt]).ToPolylineCurve()
            
            
            if rg.Intersect.Intersection.CurveCurve(lastSeg,boundary,tol,tol).Count != 0:
                
                intersectionPt = rg.Intersect.Intersection.CurveCurve(lastSeg,boundary,tol,tol).Item[0].PointB  ### important, it is the point on boundary
                
            newPtList = [intersectionPt]
            for pt in crv.TryGetPolyline()[1]:
                newPtList.append(pt)
            
        elif extensionSide == rg.CurveEnd.End:
            ### check the last seg
            crvCopyPL = crvCopy.TryGetPolyline()[1]

            pts = [pt for pt in crvCopyPL]
            lastPt = pts[-1]
            lastLastPt = pts[-2]
            lastSeg = rg.Polyline([lastPt,lastLastPt]).ToPolylineCurve()
            
            if rg.Intersect.Intersection.CurveCurve(lastSeg,boundary,tol,tol).Count != 0:
                intersectionPt = rg.Intersect.Intersection.CurveCurve(lastSeg,boundary,tol,tol).Item[0].Point
            
            for pt in crv.TryGetPolyline()[1]:
                newPtList.append(pt)
            newPtList.append(intersectionPt)
        
        newCrv = rg.Polyline(newPtList).ToPolylineCurve()  

        return newCrv

    # There are 3 scenerios based on current number of intersection points. 
    @staticmethod
    def ExtendOffsetCrvToReach(crv,boundary,iteration,extension,tol):
        
        intersectionCount = rg.Intersect.Intersection.CurveCurve(crv,boundary,tol,tol).Count
            
        if intersectionCount == 2:
            #print ("intersectionCount == 2")
            pass
            
        elif intersectionCount == 1:
            #print ("intersectionCount == 1")
            intersectionPt = rg.Intersect.Intersection.CurveCurve(crv,boundary,tol,tol).Item[0].PointA
            
            start1 = crv.PointAtStart
            end1 = crv.PointAtEnd
            
            distanceStart = intersectionPt.DistanceTo(start1)
            distanceEnd = intersectionPt.DistanceTo(end1)
            
            if distanceStart>distanceEnd:
                extensionSide = rg.CurveEnd.Start
                
            elif distanceStart<distanceEnd:
                extensionSide = rg.CurveEnd.End

            crv = OF.ExtendOneSideToReach(crv,boundary,extensionSide,iteration,extension,2)

        elif intersectionCount == 0:
            #print ("intersectionCount == 0")
            crv = OF.ExtendOneSideToReach(crv,boundary,extensionSide,iteration,extension,1)
            crv = OF.ExtendOneSideToReach(crv,boundary,extensionSide,iteration,extension,2)

        return crv

    @staticmethod
    def ExtendOffsetCrvToReachOneEnd(crv,comparision,iteration,extension,extensionSide,tol):
        # print "ExtendOffsetCrvToReachOneEnd"
        crvCopy = crv.Duplicate()
        newCrv = crvCopy
        intersectionCount = rg.Intersect.Intersection.CurveCurve(crv,comparision,tol,tol).Count

        # print "intersectionCount",intersectionCount
        if intersectionCount == 0:
            
            for i in range(iteration):
                crvCopy= crvCopy.Extend(extensionSide,extension,rg.CurveExtensionStyle.Line)
                if rg.Intersect.Intersection.CurveCurve(crvCopy,comparision,tol,tol).Count == 1:
                    break

            if extensionSide == rg.CurveEnd.End:
                intersectionPt = rg.Intersect.Intersection.CurveCurve(crvCopy,comparision,tol,tol).Item[0].PointB   
                newPtList = []
                for pt in crv.TryGetPolyline()[1]:
                    newPtList.append(pt)
                newPtList.append(intersectionPt)
                
            if extensionSide == rg.CurveEnd.Start:
                
                # [DEBUG OR CHECK] : Check the current operated geometry
                # print "comparision"
                # for pt in comparision.TryGetPolyline()[1]:
                #     print pt 
                
                # print "crvCopy"
                # for pt in crvCopy.TryGetPolyline()[1]:
                #     print pt 
                    
                intersectionPt = rg.Intersect.Intersection.CurveCurve(crvCopy,comparision,tol,tol).Item[0].PointB
                newPtList = [intersectionPt]
                for pt in crv.TryGetPolyline()[1]:
                    newPtList.append(pt)
            newCrv = rg.Polyline(newPtList).ToPolylineCurve()
       
 
        elif intersectionCount == 1:  ### Make sure it is the correct position interstion
            print "intersectionCount",intersectionCount
            startPt = crv.PointAtStart
            endPt = crv.PointAtEnd
            closestStartT = comparision.ClosestPoint(startPt)[1]
            closestStartPoint = comparision.PointAt(closestStartT)
            distStart = startPt.DistanceTo(closestStartPoint)
                         
       
            closestEndT = comparision.ClosestPoint(endPt)[1]
            closestEndtPoint = comparision.PointAt(closestEndT)
            distEnd = endPt.DistanceTo(closestEndtPoint)
            
            intersectionPt = rg.Intersect.Intersection.CurveCurve(crvCopy,comparision,tol,tol).Item[0].PointB   
            
            if intersectionPt.DistanceTo(startPt) <0.01 or intersectionPt.DistanceTo(endPt) <0.01:  # in case the intersection pt not happened at start or end
                if distStart< distEnd and extensionSide == rg.CurveEnd.Start:
                    newCrv = crvCopy
                elif distStart> distEnd and extensionSide == rg.CurveEnd.End:
                    newCrv = crvCopy
                
            else:
                # print "here",extensionSide
                # print "startPt",startPt.X,startPt.Y,0
                # print "endPt",endPt.X,endPt.Y,0
                # print "closestStartT",closestStartT,"closestEndT",closestEndT
                # print "closestStartPoint",closestStartPoint.X,closestStartPoint.Y,0
                # print "closestEndtPoint",closestEndtPoint.X,closestEndtPoint.Y,0
                
                # print "distStart, distEnd",distStart, distEnd
       
                for i in range(iteration):
                    
                    crvCopy= crvCopy.Extend(extensionSide,extension,rg.CurveExtensionStyle.Line)
                    if rg.Intersect.Intersection.CurveCurve(crvCopy,comparision,tol,tol).Count == 2:

                        break
                
                if extensionSide == rg.CurveEnd.End:
                    if rg.Intersect.Intersection.CurveCurve(crvCopy,comparision,tol,tol).Count == 1:
                        intersectionPt = rg.Intersect.Intersection.CurveCurve(crvCopy,comparision,tol,tol).Item[0].PointB
                    
                    else:
                        intersectionPts =  [rg.Intersect.Intersection.CurveCurve(crvCopy,comparision,tol,tol).Item[i].PointB for i in range(rg.Intersect.Intersection.CurveCurve(crvCopy,comparision,tol,tol).Count)]
                        dists = [ intersectionPt.DistanceTo(crvCopy.PointAtEnd) for intersectionPt in intersectionPts]
                        intersectionPt = intersectionPts[dists.index(min(dists))]
                 
                            
                    newPtList = []
                    for pt in crv.TryGetPolyline()[1]:
                        newPtList.append(pt)
                    newPtList.append(intersectionPt)
                    
                if extensionSide == rg.CurveEnd.Start:
                    
                    # [DEBUG OR CHECK] : Check the current operated geometry
                    # print "comparision"
                    # for pt in comparision.TryGetPolyline()[1]:
                    #     print pt 
                    
                    # print "crvCopy"
                    # for pt in crvCopy.TryGetPolyline()[1]:
                    #     print pt 
                    
                    if rg.Intersect.Intersection.CurveCurve(crvCopy,comparision,tol,tol).Count == 1:
                        intersectionPt = rg.Intersect.Intersection.CurveCurve(crvCopy,comparision,tol,tol).Item[0].PointB
                    
                    else:
                        intersectionPts =  [rg.Intersect.Intersection.CurveCurve(crvCopy,comparision,tol,tol).Item[i].PointB for i in range(rg.Intersect.Intersection.CurveCurve(crvCopy,comparision,tol,tol).Count)]
                        dists = [ intersectionPt.DistanceTo(crvCopy.PointAtStart) for intersectionPt in intersectionPts]
                        intersectionPt = intersectionPts[dists.index(min(dists))]
                    
                    newPtList = [intersectionPt]
                    for pt in crv.TryGetPolyline()[1]:
                        newPtList.append(pt)
                newCrv = rg.Polyline(newPtList).ToPolylineCurve()
        # print "newCrv"
        # for pt in newCrv.TryGetPolyline()[1]:
        #     print pt.X,pt.Y,pt.Z    
         
        return newCrv

    @staticmethod
    def ExtendOffsetCrvToReachBoundaryBothSides(crv,comparision,iteration,extension,tol_Extension,tol_Intersection):
        

        wxy_Plane = rg.Plane.WorldXY
        ### comparision is the boundary
        crvInitial = crv.Duplicate()
        crvCopy = crv.Duplicate()

        ######
        ### check startPoint 
        ######
        startPoint = crvCopy.PointAtStart
        intersectionPt_Start = None
        
        # for pt in crvCopy.TryGetPolyline()[1]:
        #     print pt.X,pt.Y,pt.Z
        # print "---"
        # for pt in comparision.TryGetPolyline()[1]:
        #     print pt.X,pt.Y,pt.Z
                
        ###  2:out  3:Coincident, these mean no need to extend
        if int (comparision.Contains(startPoint,wxy_Plane,tol_Extension)) == 2: # or int (comparision.Contains(startPoint,wxy_Plane,tol_Extension)) == 3
            pass 
        
        else:
            for i in range(iteration):
                crvCopy= crvCopy.Extend(rg.CurveEnd.Start,extension,rg.CurveExtensionStyle.Line)
                startPoint = crvCopy.PointAtStart
        
                if int (comparision.Contains(startPoint)) == 2:# or int (comparision.Contains(startPoint)) == 3:
                    break
            
            # Get the last segment
            currPtList = [pt for pt in crvCopy.TryGetPolyline()[1]]
            secondStartPoint = currPtList[1]
            thirdStartPoint = currPtList[2]
            lastSeg = rg.Polyline([secondStartPoint,startPoint]).ToPolylineCurve()    
            secondLastSeg = rg.Polyline([thirdStartPoint,secondStartPoint]).ToPolylineCurve()    
            if rg.Intersect.Intersection.CurveCurve(lastSeg,comparision,tol_Intersection,tol_Intersection).Count!= 0:
                intersectionPt_Start = rg.Intersect.Intersection.CurveCurve(lastSeg,comparision,tol_Intersection,tol_Intersection).Item[0].PointB   #larger tol here, make sure we find a point 
            
            else:
                intersectionPt_Start = rg.Intersect.Intersection.CurveCurve(secondLastSeg,comparision,tol_Intersection,tol_Intersection).Item[0].PointB   #larger tol here, make sure we find a point 
            
            newPtList = [intersectionPt_Start]
            for pt in crv.TryGetPolyline()[1]:
                newPtList.append(pt)
                    
            crvCopy = rg.Polyline(newPtList).ToPolylineCurve()
        
     
        ######
        ### check endPoint 
        ######
        endPoint = crvCopy.PointAtEnd

        if int (comparision.Contains(endPoint,wxy_Plane,tol_Extension)) == 2 : #or int (comparision.Contains(endPoint,wxy_Plane,tol_Extension)) == 3
            pass
        
        else:
            for i in range(iteration):
                crvCopy = crvCopy.Extend(rg.CurveEnd.End,extension,rg.CurveExtensionStyle.Line)
                endPoint = crvCopy.PointAtEnd

                if int (comparision.Contains(endPoint)) == 2: # or int (comparision.Contains(endPoint)) == 3:
                    break
        
            # Get the last segment
            currPtList = [pt for pt in crvCopy.TryGetPolyline()[1]]
            secondEndPoint = currPtList[-2]
            thirdSEndPoint = currPtList[-3]
            lastSeg = rg.Polyline([secondEndPoint,endPoint]).ToPolylineCurve()    
            secondLastSeg = rg.Polyline([thirdSEndPoint,secondEndPoint]).ToPolylineCurve()    

            if rg.Intersect.Intersection.CurveCurve(lastSeg,comparision,tol_Intersection,tol_Intersection).Count!= 0:
                intersectionPt_End = rg.Intersect.Intersection.CurveCurve(lastSeg,comparision,tol_Intersection,tol_Intersection).Item[0].PointB    #larger tol here, make sure we find a point 
            else:
                intersectionPt_End = rg.Intersect.Intersection.CurveCurve(secondLastSeg,comparision,tol_Intersection,tol_Intersection).Item[0].PointB    #larger tol here, make sure we find a point 
            ### To simplify
            if intersectionPt_Start!=None:
                newPtList = [intersectionPt_Start]
            else:
                newPtList = []
            for pt in crvInitial.TryGetPolyline()[1]: 
                newPtList.append(pt)
            newPtList.append(intersectionPt_End)
            crvCopy = rg.Polyline(newPtList).ToPolylineCurve()   

        return crvCopy
    
    @staticmethod
    def ExtendOffsetCrvToReachInternalBothSides(crv,comparision,iteration,extension,tol_Extension,tol_Intersection):
    
        ### comparision is the Internal
        crvCopy = crv.Duplicate()

        intersectionCount = rg.Intersect.Intersection.CurveCurve(crv,comparision,tol_Intersection,tol_Intersection).Count
        
        if intersectionCount == 2:
            pass
        
        else:
                        
            for i in range(iteration):
                crvCopy= crvCopy.Extend(rg.CurveEnd.Both,extension,rg.CurveExtensionStyle.Line)
                if rg.Intersect.Intersection.CurveCurve(crvCopy,comparision,tol_Intersection,tol_Intersection).Count == 2:
                    break
            
        return crvCopy
        
  
    @staticmethod
    def GetExactSegment(crv,comparision,tol_Intersection,tag):

        intersection_events = rg.Intersect.Intersection.CurveCurve(crv, comparision,tol_Intersection,tol_Intersection)
        #print "intersection_events",intersection_events.Count
        if intersection_events.Count !=0:
            ts = []
            #print crv.Domain
      
            for i in range(intersection_events.Count):
                ts.append(intersection_events.Item[i].ParameterA)
            #print ts             
            if len(ts) == 1:
                intersectionPt = crv.PointAt(ts[0])
                #print "crv.Domain",crv.Domain
                if  intersectionPt.DistanceTo(crv.PointAtStart)   < 0.001 or intersectionPt.DistanceTo(crv.PointAtEnd)  < 0.001:
                    #print "case1.1"
                    newCrv = crv
                else:
                    #print "case1.2"
                    if tag == "start":
                        correspondingT = crv.Domain.T0
                        intersectT = ts[0]
                        finishT = crv.Domain.T1
                    
                    elif tag == "end":
                        correspondingT = crv.Domain.T1
                        intersectT = ts[0]
                        finishT = crv.Domain.T0
                    
                    newCrv = crv.Trim(min(intersectT,finishT),max(intersectT,finishT))
            
            elif len(ts) == 2:
                intersectionPt_Min = crv.PointAt(min(ts))
                intersectionPt_Max = crv.PointAt(max(ts))
                if intersectionPt_Min.DistanceTo(crv.PointAtStart)  < 0.001 and intersectionPt_Max.DistanceTo(crv.PointAtEnd) < 0.001:
                    #print "case2.1"
                    newCrv = crv
                
                else:
                    #print "case2.2"
                    #print tag
                    intersectPts = [crv.PointAt(ts[0]), crv.PointAt(ts[1])]
                    #print intersectPts
                    #print "PointAtEnd",crv.PointAtEnd
                    if tag == "start":
                        checkPoint = crv.PointAtStart
                        dists = [pt.DistanceTo(checkPoint) for pt in intersectPts]
                        minIndex = dists.index(min(dists))
                        intersectT = ts[minIndex]
                        correspondingT = crv.Domain.T0
                        finishT = crv.Domain.T1
                        
                    elif tag == "end":
                        checkPoint = crv.PointAtEnd
                        dists = [pt.DistanceTo(checkPoint) for pt in intersectPts]
                        minIndex = dists.index(min(dists))
                        intersectT = ts[minIndex]
                        correspondingT = crv.Domain.T1
                        finishT = crv.Domain.T0

                   
                    #print crv.Domain
                    #print "intersectT,finishT",intersectT,finishT
                    newCrv = crv.Trim(min(intersectT,finishT),max(intersectT,finishT))

        else:
            newCrv = crv
            pass
        
        return newCrv
    
    @staticmethod
    def GetThisHierachyOffsetUnionRegion(validStreetGeos,boundary,offsetDists,validStreetGeos_CatIndices,chosenCats,iteration=100,extension=0.1,tol_Extension=0.001,tol_Intersection = 0.001,tol_Boolean = 0.01):
        ### global variable
        debug = []
        comparisionTriplet = []
        wxy_Plane = rg.Plane.WorldXY
        joinedRegions = []
        allOffsets_Flatten = []
        allOffsets = []
        allOffsetRegions = []
        
        ### Start one road by one road
        
        for i in range(len(validStreetGeos)):
            print "i:",i
            streetGeo = validStreetGeos[i]
          
            chosenCat = chosenCats[validStreetGeos_CatIndices[i]]
        
            offsetDist = offsetDists[validStreetGeos_CatIndices[i]]
            
            comparedGeos = [geo for geo in validStreetGeos]
            
            #### exclude itself
            comparedGeos.remove(streetGeo)

            #### join curves
            comparedGeos = rg.Curve.JoinCurves(comparedGeos)
            comparedGeos = [geo for geo in comparedGeos]
            
            #### include the boundary
            comparedGeos.append(boundary)
            
            
            #### exclude the connected (optional,testing)
            thisStreetGeoStart = streetGeo.PointAtStart
            thisStreetGeoEnd = streetGeo.PointAtEnd    
            for geo in comparedGeos:
                if geo != boundary:
                    if geo.PointAtStart.DistanceTo(thisStreetGeoStart) <0.01 or geo.PointAtEnd.DistanceTo(thisStreetGeoStart)<0.01 or geo.PointAtStart.DistanceTo(thisStreetGeoEnd) <0.01 or geo.PointAtEnd.DistanceTo(thisStreetGeoEnd)<0.01:
                        debug.append(geo)
        
            ### collect the comparisionTriplet : [streetGeo,startComparsion,endComparsion]
            # check the startPoint
            thisStart = streetGeo.PointAtStart
            distances = []
            for comparedGeo in comparedGeos:
                closestT = comparedGeo.ClosestPoint(thisStart)[1]
                closestPoint = comparedGeo.PointAt(closestT)
                distances.append(closestPoint.DistanceTo(thisStart))
            
            startComparsion = comparedGeos[distances.index(min(distances))]
            
            # check the endPoint
            thisEnd= streetGeo.PointAtEnd
            distances = []
            for comparedGeo in comparedGeos:
                closestT = comparedGeo.ClosestPoint(thisEnd)[1]
                closestPoint = comparedGeo.PointAt(closestT)
                distances.append(closestPoint.DistanceTo(thisEnd))
        
            endComparsion = comparedGeos[distances.index(min(distances))]     
                    
            triplet = [streetGeo,startComparsion,endComparsion]
            comparisionTriplet.append([streetGeo,startComparsion,endComparsion])                
            
            
            ### Get the unionRegion
            crv = triplet[0]
            startCrv = triplet[1]
            endCrv = triplet[2]        
            
            
            ## [DEBUG OR CHECK] : Check itself and the offset reslut
            # print "----------------------"
            # for pt in crv.TryGetPolyline()[1]:
            #    print pt.X,pt.Y,0
            # print "----crv----"


            # for pt in startCrv.TryGetPolyline()[1]:
            #     print pt.X,pt.Y,0
            # print "----startCrv----"

            
            # for pt in endCrv.TryGetPolyline()[1]:
            #     print pt.X,pt.Y,0
            # print "----endCrv----"
            
            ### Get 2 offsets
            offset1 = None
            offset2 = None
            
            offset1 = crv.Offset(wxy_Plane,offsetDist,tol_Extension,rg.CurveOffsetCornerStyle.Sharp)[0]
            offset2 = crv.Offset(wxy_Plane,-offsetDist,tol_Extension,rg.CurveOffsetCornerStyle.Sharp)[0]

            
            if startCrv != endCrv and startCrv!=boundary and endCrv!=boundary:
                boolTag = 1
                # print "Before extend"
                # for pt in offset1.TryGetPolyline()[1]:
                #     print pt.X,pt.Y,0
           
                offset1 = OF.ExtendOffsetCrvToReachOneEnd(offset1,startCrv,iteration,extension,rg.CurveEnd.Start,tol_Extension)
                print "after  extend startCrv"
                for pt in offset1.TryGetPolyline()[1]:
                    print pt.X,pt.Y,0
                    
                offset1 = OF.ExtendOffsetCrvToReachOneEnd(offset1,endCrv,iteration,extension,rg.CurveEnd.End,tol_Extension)
                
                print "after  extend endCrv"
                for pt in offset1.TryGetPolyline()[1]:
                    print pt.X,pt.Y,0
                
                offset1 = OF.GetExactSegment(offset1, startCrv,tol_Intersection,"start")
                
                # print "after  GetExactSegment startCrv"
                # for pt in offset1.TryGetPolyline()[1]:
                #     print pt.X,pt.Y,0
                    
                offset1 = OF.GetExactSegment(offset1, endCrv,tol_Intersection,"end")
                
                
                # print "after  GetExactSegment endCrv"
                # for pt in offset1.TryGetPolyline()[1]:
                #     print pt.X,pt.Y,0
                    
                # print "Before extend"
                # for pt in offset2.TryGetPolyline()[1]:
                #     print pt.X,pt.Y,0
                offset2 = OF.ExtendOffsetCrvToReachOneEnd(offset2,startCrv,iteration,extension,rg.CurveEnd.Start,tol_Extension)

                print "After  extend startCrv"
                for pt in offset2.TryGetPolyline()[1]:
                    print pt.X,pt.Y,0
                offset2 = OF.ExtendOffsetCrvToReachOneEnd(offset2,endCrv,iteration,extension,rg.CurveEnd.End,tol_Extension)
                
                # print "After  extend endCrv"
                # for pt in offset2.TryGetPolyline()[1]:
                #     print pt.X,pt.Y,0
                
                # print "before  GetExactSegment startCrv"
                # for pt in offset2.TryGetPolyline()[1]:
                #     print pt.X,pt.Y,0
                # print "----"
                # for pt in startCrv.TryGetPolyline()[1]:
                #     print pt.X,pt.Y,0
                offset2 = OF.GetExactSegment(offset2, startCrv,tol_Intersection,"start") 
                # print "After  GetExactSegment startCrv"
                # for pt in offset2.TryGetPolyline()[1]:
                #     print pt.X,pt.Y,0
                
                
                # print "before  GetExactSegment endCrv"
                # for pt in offset2.TryGetPolyline()[1]:
                #     print pt.X,pt.Y,0
                # print "----"
                # for pt in endCrv.TryGetPolyline()[1]:
                #     print pt.X,pt.Y,0
                    
                offset2 = OF.GetExactSegment(offset2, endCrv,tol_Intersection,"end")

                # print "after  GetExactSegment endCrv"
                # for pt in offset2.TryGetPolyline()[1]:
                #     print pt.X,pt.Y,0
                    
            elif startCrv != endCrv and ((startCrv==boundary and endCrv!=boundary) or (startCrv!=boundary and endCrv==boundary)):   
                boolTag = 2
                
          
                offset1 = OF.ExtendOffsetCrvToReachOneEnd(offset1,startCrv,iteration,extension,rg.CurveEnd.Start,tol_Extension)
                # if i == 2:
                #     print "after extend start"
                #     for pt in offset1.TryGetPolyline()[1]:
                #         print pt.X,pt.Y,0
                offset1 = OF.ExtendOffsetCrvToReachOneEnd(offset1,endCrv,iteration,extension,rg.CurveEnd.End,tol_Extension)
     
                # if i == 2:
                #     print "after extend End"
                #     for pt in offset1.TryGetPolyline()[1]:
                #         print pt.X,pt.Y,0
                offset1 = OF.GetExactSegment(offset1, startCrv,tol_Intersection,"start")
                offset1 = OF.GetExactSegment(offset1, endCrv,tol_Intersection,"end")
                
                # if i == 2:
                #     print "before extend"
                #     for pt in offset2.TryGetPolyline()[1]:
                #         print pt.X,pt.Y,0
                offset2 = OF.ExtendOffsetCrvToReachOneEnd(offset2,startCrv,iteration,extension,rg.CurveEnd.Start,tol_Extension)
                offset2 = OF.ExtendOffsetCrvToReachOneEnd(offset2,endCrv,iteration,extension,rg.CurveEnd.End,tol_Extension)
                # if i == 2:
                #     print "after extend"
                #     for pt in offset2.TryGetPolyline()[1]:
                #         print pt.X,pt.Y,0
                offset2 = OF.GetExactSegment(offset2, startCrv,tol_Intersection,"start") 
                # if i == 2:
                #     print "after GetExactSegmentstart"
                #     for pt in offset2.TryGetPolyline()[1]:
                #         print pt.X,pt.Y,0
                offset2 = OF.GetExactSegment(offset2, endCrv,tol_Intersection,"end")
            
            
            elif startCrv == endCrv and startCrv == boundary:          # This must be the boundary   
                # print "before ExtendOffsetCrvToReachBoundaryBothSides"
                # for pt in offset1.TryGetPolyline()[1]:
                #     print pt.X,pt.Y,0
                boolTag = 3
                offset1 = OF.ExtendOffsetCrvToReachBoundaryBothSides(offset1,startCrv,iteration,extension,tol_Extension,tol_Intersection)
                offset2 = OF.ExtendOffsetCrvToReachBoundaryBothSides(offset2,startCrv,iteration,extension,tol_Extension,tol_Intersection)
                
                
                ts = []
                for i in range(rg.Intersect.Intersection.CurveCurve(offset1,startCrv,tol_Intersection,tol_Intersection).Count):
                    t = rg.Intersect.Intersection.CurveCurve(offset1,startCrv,tol_Intersection,tol_Intersection).Item[i].ParameterA
                    ts.append(t)
                
                splitOffsets =  offset1.Split(ts)
                
                lengths = [seg.GetLength() for seg in splitOffsets]
                
                maxIndex = lengths.index(max(lengths))
                
                offset1 = splitOffsets[maxIndex]
         
                ts = []
                for i in range(rg.Intersect.Intersection.CurveCurve(offset2,startCrv,tol_Intersection,tol_Intersection).Count):
                    t = rg.Intersect.Intersection.CurveCurve(offset2,startCrv,tol_Intersection,tol_Intersection).Item[i].ParameterA
                    ts.append(t)
                
                splitOffsets =  offset2.Split(ts)
                
                lengths = [seg.GetLength() for seg in splitOffsets]
                
                maxIndex = lengths.index(max(lengths))
                
                offset2 = splitOffsets[maxIndex]

    
            elif startCrv == endCrv and startCrv != boundary:    # This must be an internal C Road 
                boolTag = 4
        
                offset1 = OF.ExtendOffsetCrvToReachInternalBothSides(offset1,startCrv,iteration,extension,tol_Extension,tol_Intersection)
           
                offset2 = OF.ExtendOffsetCrvToReachInternalBothSides(offset2,startCrv,iteration,extension,tol_Extension,tol_Intersection)
                
                
                offset1 = OF.GetExactSegment(offset1, startCrv,tol_Intersection,"start") 
                
                # print "after GetExactSegment start"
                # for pt in offset1.TryGetPolyline()[1]:
                #     print pt.X,pt.Y,0
                
                offset1 = OF.GetExactSegment(offset1, endCrv,tol_Intersection,"end")
                # print "after GetExactSegment end"
                # for pt in offset1.TryGetPolyline()[1]:
                #     print pt.X,pt.Y,0
                offset2 = OF.GetExactSegment(offset2, startCrv,tol_Intersection,"start") 
                offset2 = OF.GetExactSegment(offset2, endCrv,tol_Intersection,"end")
                
            print "boolTag",boolTag
            if boolTag == 1 or boolTag == 4:
                startSeg = None   
                startPt_Offset1 = offset1.PointAtStart
                startPt_Offset2 = offset2.PointAtStart
                closeStartT_Offset1 = startCrv.ClosestPoint(startPt_Offset1)[1]
                closeStartT_Offset2 = startCrv.ClosestPoint(startPt_Offset2)[1]
                
                minT_Start = min(closeStartT_Offset1,closeStartT_Offset2)
                maxT_Start = max(closeStartT_Offset1,closeStartT_Offset2)
                startSeg = startCrv.Trim(minT_Start,maxT_Start)
                        
                endSeg = None        
                endPt_Offset1 = offset1.PointAtEnd
                endPt_Offset2 = offset2.PointAtEnd
                closeEndT_Offset1 = endCrv.ClosestPoint(endPt_Offset1)[1]
                closeEndT_Offset2 = endCrv.ClosestPoint(endPt_Offset2)[1]
                
                minT_End = min(closeEndT_Offset1,closeEndT_Offset2)
                maxT_End = max(closeEndT_Offset1,closeEndT_Offset2)

                endSeg = endCrv.Trim(minT_End,maxT_End)
                region = rg.Curve.JoinCurves([offset1,offset2,startSeg,endSeg])[0]
             
            elif boolTag == 2:
                
                boundaryCrv = None
                nonBoundaryCrv = None
                
                if startCrv == boundary:
                    boundaryCrv = startCrv
                    nonBoundaryCrv = endCrv
                    nonPt_Offset1 = offset1.PointAtEnd
                    nonPt_Offset2 = offset2.PointAtEnd
                    pt_Offset1 = offset1.PointAtStart
                    pt_Offset2 = offset2.PointAtStart
                    
                elif endCrv == boundary:
                    boundaryCrv = endCrv
                    nonBoundaryCrv = startCrv
                    nonPt_Offset1 = offset1.PointAtStart
                    nonPt_Offset2 = offset2.PointAtStart
                    pt_Offset1 = offset1.PointAtEnd
                    pt_Offset2 = offset2.PointAtEnd
                    
                nonSeg = None   
       
                closeNonT_Offset1 = nonBoundaryCrv.ClosestPoint(nonPt_Offset1)[1]
                closeNonT_Offset2 = nonBoundaryCrv.ClosestPoint(nonPt_Offset2)[1]

                minT_Non = min(closeNonT_Offset1,closeNonT_Offset2)
                maxT_Non = max(closeNonT_Offset1,closeNonT_Offset2)
                nonSeg = nonBoundaryCrv.Trim(minT_Non,maxT_Non)
                
                # for pt in offset1.TryGetPolyline()[1]:
                #     print pt.X,pt.Y,0
                
                # print "---"
                
                # for pt in offset2.TryGetPolyline()[1]:
                #     print pt.X,pt.Y,0
                
                # print "---" 
                
                # for pt in nonSeg.TryGetPolyline()[1]:
                #     print pt.X,pt.Y,0
                
                # print "---" 
                
                # for pt in boundaryCrv.TryGetPolyline()[1]:
                #     print pt.X,pt.Y,0
                
                # print "---" 
                
                # areas = []
                # wxy_plane=rg.Plane.WorldXY
                # #tol=rd.ActiveDoc.ModelAbsoluteTolerance
                # tol = 0.001

                # result=rg.Curve.CreateBooleanRegions([offset1,offset2,boundary],wxy_plane,False,tol)
                # regions = []

                # print "region"
                # for i in range(result.RegionCount):
                #     thisRegion = rg.CurveBooleanRegions.RegionCurves(result,i)[0]
                #     regions.append(thisRegion)
                #     areas.append(rg.AreaMassProperties.Compute(region).Area)
        
                # for r in regions:
                #     for pt in r.TryGetPolyline()[1]:
                #         print pt.X,pt.Y,0
                # return 0
                
                boundarySeg = None   
       
                closeT_Offset1 = boundaryCrv.ClosestPoint(pt_Offset1)[1]
                closeT_Offset2 = boundaryCrv.ClosestPoint(pt_Offset2)[1]

                boundarySegs = boundaryCrv.Split([closeT_Offset1,closeT_Offset2])
                
                if boundarySegs[0].GetLength()<boundarySegs[1].GetLength():
                    boundarySeg = boundarySegs[0]
                else:
                    boundarySeg = boundarySegs[1]
                
                # print "boundarySeg"
                # for pt in boundarySeg.TryGetPolyline()[1]:
                #     print pt.X,pt.Y,0
                    
                region = rg.Curve.JoinCurves([offset1,offset2,nonSeg,boundarySeg])[0]
                
            elif boolTag == 3:
 
                startPt_Offset1 = offset1.PointAtStart
                startPt_Offset2 = offset2.PointAtStart
      
                endPt_Offset1 = offset1.PointAtEnd
                endPt_Offset2 = offset2.PointAtEnd
           
                        
                wxy_plane=rg.Plane.WorldXY
                #tol=rd.ActiveDoc.ModelAbsoluteTolerance
                tol = 0.001

                result=rg.Curve.CreateBooleanRegions([offset1,offset2,boundary],wxy_plane,False,tol)
                region = None
                for i in range(result.RegionCount):
                    thisRegion = rg.CurveBooleanRegions.RegionCurves(result,i)[0]
                    containTag0 = int(thisRegion.Contains(startPt_Offset1))
                    containTag1 = int(thisRegion.Contains(startPt_Offset2))
                    containTag2 = int(thisRegion.Contains(endPt_Offset1))
                    containTag3 = int(thisRegion.Contains(endPt_Offset2))
                    if containTag0 == 3 and containTag1 == 3 and containTag2 == 3 and containTag3 == 3:
                        region = thisRegion
                        break
                    
            
                           
            
            # print "startSeg"
            # for pt in startSeg.TryGetPolyline()[1]:
            #     print pt.X,pt.Y,0

            # print "endSeg"
            # for pt in endSeg.TryGetPolyline()[1]:
            #     print pt.X,pt.Y,0
                
            # print "offset1" 
            # for pt in offset1.TryGetPolyline()[1]:
            #     print pt.X,pt.Y,0
                
            # print "offset2" 
            # for pt in offset2.TryGetPolyline()[1]:
            #     print pt.X,pt.Y,0  
            # startPt_Offset1 = offset1.PointAtStart
            # startPt_Offset2 = offset2.PointAtStart
            # endPt_Offset1 = offset1.PointAtEnd
            # endPt_Offset2 = offset2.PointAtEnd

            # allPt = [startPt_Offset1,startPt_Offset2,endPt_Offset1,endPt_Offset2]
            # booleanRegionResult = rg.Curve.CreateBooleanRegions(crvCollection,wxy_Plane,True,tol_Boolean)
            # regions = [booleanRegionResult.RegionCurves(i)[0] for i in range(booleanRegionResult.RegionCount)]
            
      
            # for crv in [offset1,offset2,startSeg,endSeg]:
            #     for pt in crv.TryGetPolyline()[1]:
            #         print pt.X,pt.Y,0
            #     print "-----"
            
            print "----------------------------------"
            
            joinedRegions.append(region) 
            
            
            allOffsets_Flatten.append(offset1)
            allOffsets_Flatten.append(offset2)
            allOffsets.append([offset1,offset2])
            allOffsetRegions.append(region)
        
        # print "joinedRegions"
        # for crv in joinedRegions:
        #     for pt in crv.TryGetPolyline()[1]:
        #         print pt.X,pt.Y,0
        #     print "-----"
        offsetRegionUnion =  rg.Curve.CreateBooleanUnion (joinedRegions,tol_Boolean)
        
        return allOffsets,allOffsets_Flatten,allOffsetRegions,offsetRegionUnion
        
        
        
        
    ################
    # Combined function
    ################ 
    ### Use the region union to trim the parcel.
    ### Keeping the debug code inside
    @staticmethod
    def GetOffsetParcelAndEdgeCat(resampleParcFaces,validStreetGeos,allOffsets,allOffsetRegions,validStreetGeos_CatIndices,chosenCats,tol_Intersection = 0.001):
        pFGeoCollection = []
        pEGeoCollection = []
        pECatCollection = []
        for i in range(len(resampleParcFaces)):

            testPF = resampleParcFaces[i]
            #print "-----------------"
            # print ("testPF.ID:"),testPF.ID,"i",i
            # Make a EdgeCatDict
            # if testPF.ID != 5:
            #     continue
            
            thisRoundEdgeGeos = [edge.GetGeometry_SimplifiedWithResamplePoints().ToPolylineCurve() for edge in testPF.edges]
            thisRoundEdgeCats = [edge.hierarchy for edge in testPF.edges]
            thisRoundPFGeo = testPF.GetGeometry_SimplifiedWithResamplePoints().ToPolylineCurve()
            
     
            ### Iterate
            validComparisionIndices = OF.GetRelevantOffsets(thisRoundEdgeGeos,validStreetGeos)
            #print "validComparisionIndices",validComparisionIndices
            validOffsetCat = [ chosenCats[validStreetGeos_CatIndices[index]]  for index in validComparisionIndices]
            validOffsetPair = [allOffsets[index] for index in validComparisionIndices]
            validOffsetRegions = [allOffsetRegions[index] for index in validComparisionIndices]
            
            
            thisRoundEdgeGeos_Explode = []
            thisRoundEdgeCats_Explode = []
            for i in range(len(thisRoundEdgeGeos)):
                thisEdgeGeo = thisRoundEdgeGeos[i].TryGetPolyline()[1]
                thisEdgeCat = thisRoundEdgeCats[i]
                
                thisRoundEdgeGeos_Explode.extend(thisEdgeGeo.GetSegments())
                segCount = thisEdgeGeo.SegmentCount 
                for k in range(segCount):
                    thisRoundEdgeCats_Explode.append(thisEdgeCat)
            
            
            thisRoundEdgeGeos = thisRoundEdgeGeos_Explode
            thisRoundEdgeCats = thisRoundEdgeCats_Explode
            
   
            for i in range(len(validOffsetPair)):

                offsetCat = validOffsetCat[i]
                offsetPair = validOffsetPair[i] 
                offsetRegion = validOffsetRegions[i]

                trimmedParcel = rg.Curve.CreateBooleanDifference(thisRoundPFGeo,offsetRegion,tol_Intersection)[0]

                allSegTrimmed = trimmedParcel.TryGetPolyline()[1].GetSegments()

                allSegTrimmedCats = []
                for trimmedSeg in allSegTrimmed:
                    tag = True
                    midPoint_Trimmed = (trimmedSeg.To + trimmedSeg.From)/2
                    for j in range(len(thisRoundEdgeGeos)):
                        edgeGeo = thisRoundEdgeGeos[j]
                        # print "edgeGeo"
                        # print edgeGeo.From.X, edgeGeo.From.Y, 0
                        # print edgeGeo.To.X, edgeGeo.To.Y, 0
                        closestPoint = edgeGeo.ClosestPoint(midPoint_Trimmed,True)
               
                        # print closestPoint
                        # print midPoint_Trimmed
                        # print "---"
                        dist = closestPoint.DistanceTo(midPoint_Trimmed)
                        
                        if dist<0.01:
                            allSegTrimmedCats.append(thisRoundEdgeCats[j])
                            tag=False
                            break
                  
                    if tag == True:
                        allSegTrimmedCats.append(offsetCat)
                

                thisRoundPFGeo = trimmedParcel
                thisRoundEdgeGeos = allSegTrimmed
                thisRoundEdgeCats = allSegTrimmedCats
                #print thisRoundEdgeCats    
            pFGeoCollection.append(thisRoundPFGeo)
            pEGeoCollection.append(thisRoundEdgeGeos)
            pECatCollection.append(thisRoundEdgeCats)
            
        return pFGeoCollection,pEGeoCollection,pECatCollection
    ################
    # Help function
    ################
    @staticmethod
    # For now there are 2 CATs of road will have offset.  This is a function to split the list in to 2 lists. Each list will be assigned one CAT. 
    # e.g. There are 10 roads. User input 0.2, 0.8, meaning 2 roads will be assigned as CAT.1, 8 roads will be assigned as CAT.2
    def CreateListWithProportions(n,a_ratio):
        b_ratio  = 1 - a_ratio

        # If there is only one road 
        if n == 1:
            return [0]   # 0 means first CAT.
        
        # If there are mutiple roads 
        else:
            a_count = int(n * a_ratio)
            if a_count<1:
                a_count=1
            b_count = int(n * b_ratio)
            
            if b_count<1:
                b_count=1

            if a_count + b_count != n:
                b_count = n - a_count
            
            result_list = [0] * a_count + [1] * b_count   # 0 means first CAT, 1 means second CAT
            return result_list
# ---------- end ghpython_script_13 ----------
ghpython_script_14 = GhPythonScript()  # -> out, RF
# ---------- ghpython_script_14: Python ----------
###########################
####    Import Libs    ####
###########################
import Rhino.Geometry as rg
import Rhino.RhinoDoc as rd
import Rhino.RhinoMath as rm

import ghpythonlib.components as ghc
import math

import heapq
from collections import deque




###########################
####    Description    ####
###########################
### RF : Road Finding
### This is a library to do the road search in graph



###########################
####    RoadFinding    ####
###########################
class RF:
    class Street:
        
        #####
        # Initialize
        #####
        def __init__(self,head,end):
            self.head = head                # Type: StreetNode      The head of street
            self.end = end                  # Type: StreetNode      The end of street
            self.ID = None                  # Type: Int             The ID
            self.doubleSize = False         # Type: Bool            If it is double side connected
            self.original = False           # Type: Bool            If it is the original road
            self.naked = False           # Type: Bool            If it is the naked road
            
        def __del__(self):
            self.head = None
            self.end = None
            self.ID = None
            self.doubleSize = None
        
        # A linked list deep copy. The debug code is kept inside.
        def DeepCopy(self,currPV_Dict,currE_Dict):
            oldStreetNodes = self.GetAllStreetNodes()
            # print ("In street copy, copying street ID"), self.ID
            # print ("All old StreetNodes:"), [sNode.ID for sNode in oldStreetNodes]
            # print ("All old parcEdge:"), [edge.ID for edge in self.GetAllParcEdge()]
            allPVID = self.GetAllParcVertexID()
            currPV = [currPV_Dict[vID] for vID in allPVID]
            
            newStreetNodes = [RF.StreetNode(parcVertex) for parcVertex in currPV] 
            # print ("All newStreetNodes,"), [sNode.ID for sNode in newStreetNodes]
            
            newStreetNodeDict = {}
            for streetNode in newStreetNodes:
                newStreetNodeDict[streetNode.ID] = streetNode
            
            ### Fill Info
            for i in range(len(newStreetNodes)):
                currNewStreetNode = newStreetNodes[i]
                if oldStreetNodes[i].prev!= None:
                    
                    #print ("the oldStreetNodes[i].ID"), oldStreetNodes[i].ID , ",oldStreetNodes[i].prev.ID", oldStreetNodes[i].prev.ID 
                    currNewStreetNode.prev = newStreetNodeDict [oldStreetNodes[i].prev.ID]
                    
                    # [DEBUG or CHECK]
                    # print ("Is it double side connected ?"),self.doubleSize
                    
                    # for pt in self.GetGeometry():
                    #     print pt.X,pt.Y,0
  
                else:
                    currNewStreetNode.prev = None
                
                if oldStreetNodes[i].next!= None:
                    #print ("In street DeepCopy,next.ID ") ,oldStreetNodes[i].next.ID
                    currNewStreetNode.next = newStreetNodeDict[oldStreetNodes[i].next.ID]  
                else:
                    currNewStreetNode.next = None
                
                if oldStreetNodes[i].prevConnection!= None:  
                    #print ("In street DeepCopy, oldStreetNodes[i].prevConnection.ID:") , oldStreetNodes[i].prevConnection.ID
                    currNewStreetNode.prevConnection = currE_Dict [oldStreetNodes[i].prevConnection.ID]  
                else:
                    currNewStreetNode.prevConnection = None
                    
                if oldStreetNodes[i].nextConnection!= None:
                    #print ("In street DeepCopy, nextConnection.ID"),oldStreetNodes[i].nextConnection.ID,oldStreetNodes[i].nextConnection.isValid
                    # for pt in oldStreetNodes[i].nextConnection.GetGeometry():
                    #     print pt.X,pt.Y,0
                    # print "---"
                    currNewStreetNode.nextConnection = currE_Dict [oldStreetNodes[i].nextConnection.ID]  
                else:
                    currNewStreetNode.nextConnection = None
                
            newStreet = RF.Street(newStreetNodes[0],newStreetNodes[-1])
            
            newStreet.ID = self.ID 
            newStreet.doubleSize = self.doubleSize
            newStreet.original = self.original
            newStreet.naked = self.naked 
            
            #print ("All new parcEdge:"), [edge.ID for edge in newStreet.GetAllParcEdge()]
            
            return newStreet

        # This function is used in multi-scenarios .e.g. Normal case or a abstractStart
        # The important thing is to sort the edge direction becasue of twin edge
        @staticmethod   
        def CreateStreet(parcEdgeColletion,Edict,streetGraph,sideEdgeCollection = None,abstractStartFlag = False):
            #print "CreateStreet"
            streetNodes = []
         
            if abstractStartFlag == True and sideEdgeCollection != None:
                ### pop the abstartStart
                parcEdgeColletion.pop(0)
                
                newSideEdgeCollection = RF.SortParcEdgeOrder(sideEdgeCollection,Edict)
                
                ### check the order
                if newSideEdgeCollection[-1].endVertex == parcEdgeColletion[0].startVertex or newSideEdgeCollection[-1].endVertex == parcEdgeColletion[0].endVertex: 
                    
                    pass
                else:
              
                    newSideEdgeCollection.reverse()
                    for i in range(len(newSideEdgeCollection)):
                        newSideEdgeCollection[i] = Edict[newSideEdgeCollection[i].twinID]
                
                parcEdgeColletion = newSideEdgeCollection + parcEdgeColletion
      
            if len(parcEdgeColletion) >= 2:
                # print "len(parcEdgeColletion) >= 2"
                # for edge in parcEdgeColletion:
                #     for pt in edge.GetGeometry():
                #         print pt.X,pt.Y
                #     print "-----"
                if False not in [edge.naked for edge in parcEdgeColletion]:
                    # These are all naked edges
                    if parcEdgeColletion[0].endVertex != parcEdgeColletion[1].startVertex: # Wrong order
                        parcEdgeColletion.reverse()
                    else:
                        pass
                
                else:
                    ### sort the order
                    # check the first parcEdge direction
                    if parcEdgeColletion[0].endVertex ==  parcEdgeColletion[1].startVertex  or parcEdgeColletion[0].endVertex ==  parcEdgeColletion[1].endVertex:
                        pass
                    else:
                        parcEdgeColletion[0] = Edict[parcEdgeColletion[0].twinID]
                    
                    # keep sorting order
                    for i in range(len(parcEdgeColletion)-1):
                        if parcEdgeColletion[i+1].startVertex!= parcEdgeColletion[i].endVertex:
                            parcEdgeColletion[i+1] = Edict[parcEdgeColletion[i+1].twinID]
                
                # print "after sorting"
                # print parcEdgeColletion.
                # Create StreetNode instance
                for i in range(len(parcEdgeColletion)):
                    streetNodes.append(RF.StreetNode(parcEdgeColletion[i].startVertex))
                streetNodes.append(RF.StreetNode(parcEdgeColletion[len(parcEdgeColletion)-1].endVertex))
                
                # Fill info for Street Node instances
                for i in range(len(streetNodes)):
                    currStreetNode = streetNodes[i]
                    if i == 0:
                        currStreetNode.prev = None
                        currStreetNode.next = streetNodes[i+1]
                        currStreetNode.prevConnection = None
                        currStreetNode.nextConnection = parcEdgeColletion[i]
                        
                    elif i != 0 and i != len(streetNodes)-1:
                        currStreetNode.prev = streetNodes[i-1]
                        currStreetNode.next = streetNodes[i+1]
                        currStreetNode.prevConnection = parcEdgeColletion[i-1]
                        currStreetNode.nextConnection = parcEdgeColletion[i]
                        
                    elif i == len(streetNodes)-1:
                        currStreetNode.prev = streetNodes[i-1]
                        currStreetNode.next = None
                        currStreetNode.prevConnection = parcEdgeColletion[i-1]
                        currStreetNode.nextConnection = None
                
                # Assign it to street and create Street instance
                newStreet = RF.Street(streetNodes[0],streetNodes[len(streetNodes)-1])
                
   
            elif len(parcEdgeColletion) == 1: 
                
                if parcEdgeColletion[0].naked!=True:
                    ### Check if startNode is connecting exsiting streets 
                    allStreetNodeIDs = streetGraph.GetAllParcVertexID()
                    if parcEdgeColletion[0].startVertex.ID in allStreetNodeIDs:
                        parcEdgeColletion[0] = Edict[parcEdgeColletion[0].twinID] 
                
                
                # Create Street Node instances
                streetNode_Start = RF.StreetNode(parcEdgeColletion[0].startVertex)
                streetNode_End = RF.StreetNode(parcEdgeColletion[0].endVertex)
                
                # Fill info for Street Node instances
                streetNode_Start.prev = None
                streetNode_Start.next = streetNode_End
                streetNode_Start.prevConnection = None
                streetNode_Start.nextConnection = parcEdgeColletion[0]
                
                streetNode_End.prev = streetNode_Start
                streetNode_End.next = None
                streetNode_End.prevConnection = parcEdgeColletion[0]
                streetNode_End.nextConnection = None
                
                # Create Street instance
                newStreet = RF.Street(streetNode_Start,streetNode_End)


            whileCount = 0
            allParcVertex = []
            streetNode = newStreet.end
            while streetNode.prev!=None:
                if whileCount>1000:
                    break
                whileCount +=1
 
                allParcVertex.append(streetNode.node.ID)
                streetNode = streetNode.prev
                
            allParcVertex.append(newStreet.head.node.ID)
 
            return newStreet

        
        
        # The edge might be split, need to update the street correspondingly
        def Insert(self,startNode,endNode,newEdge1,newEdge2,EDict):
            # [DEBUG or CHECK]
            # print ("Before insert into a street")
            # self.PrintVIDHeadToEnd()
            # self.PrintVIDEndToHead()
            
            newEdge1.streetID = startNode.nextConnection.streetID
            newEdge2.streetID = startNode.nextConnection.streetID
            
            
            if newEdge1.naked == False:
                EDict[newEdge1.twinID].streetID = newEdge1.streetID 
            if newEdge2.naked == False:
                EDict[newEdge2.twinID].streetID = newEdge2.streetID     
            
            # print ("in Street Insert"), startNode.nextConnection.ID, "becoming", newEdge1.ID, "and ", newEdge2.ID

            streetNode = self.head
            # print ("in Street Insert"), "self.head",self.head

            while streetNode.nextConnection!=None:

                #print ("in Street Insert", streetNode.prev), streetNode.prevConnection, streetNode.next,streetNode.nextConnection
                streetNode = streetNode.next    
                
            ######----------------start changing--------------------######
            newStreetNode = RF.StreetNode(newEdge1.endVertex)
            
            # [DEBUG or CHECK]
            # print "Print edge1 Geo"
            # edge1Geo =  newEdge1.GetGeometry()
            # for pt in edge1Geo:
            #     print pt.X,",",pt.Y,",",0
            # print "Print edge2 Geo"
            # edge2Geo =  newEdge2.GetGeometry()
            # for pt in edge2Geo:
            #     print pt.X,",",pt.Y,",",0
            
            #########
            ### Change info of startNode
            #########
            # print ("in Street Insert"), "previous startNode.next",startNode.next.node.geometry,startNode.next
            startNode.next = newStreetNode
            # print ("in Street Insert"), "after startNode.next",startNode.next.node.geometry , startNode.next
            # print ("in Street Insert"), "previous startNode.nextConnection", startNode.nextConnection
            startNode.nextConnection = newEdge1
            # print ("in Street Insert"),"after startNode.next",startNode.nextConnection
            
            #add info for the new startNode
            newStreetNode.prev = startNode
            newStreetNode.prevConnection = newEdge1
            newStreetNode.next = endNode
            newStreetNode.nextConnection = newEdge2
            
            #########
            ### Change info of endNode
            #########
            # print ("in Street Insert"), "previous endNode.prev",endNode.prev.node.geometry,endNode.prev
            endNode.prev = newStreetNode
            # print ("in Street Insert"), "after endNode.prev",endNode.prev.node.geometry,endNode.prev
            
            # print ("in Street Insert"), "previous endNode.prevConnection",endNode.prevConnection
            endNode.prevConnection = newEdge2
            # print ("in Street Insert"), "after endNode.prevConnection",endNode.prevConnection
            
            streetNode = self.head
            # print ("in Street Insert"), "self.head",self.head
            # print ("in Street Insert"), streetNode.node.geometry
            while streetNode.nextConnection!=None:

                # print ("in Street Insert"), (streetNode.prev),streetNode.prevConnection, streetNode.next,streetNode.nextConnection
                streetNode = streetNode.next 
                # print ("in Street Insert") streetNode
            
            # [DEBUG or CHECK]
            # print ("After insert into a street")
            # self.PrintVIDHeadToEnd()
            # self.PrintVIDEndToHead()
            # self.PrintGeometry()
       
        # Extend the street for another side
        # Many scenarios
        def Extend_PE(self,PECollection,EDict):
            # print ("Street ID:"),self.ID, "is extending"
            
            # [DEBUG or CHECK]
            # print ("Before Extend")
            # self.PrintVIDHeadToEnd()
            # self.PrintVIDEndToHead()
            # print ("in Extend_PE, the PECollection length:"), len(PECollection), " Their IDs", [PE.ID for PE in PECollection]
            # print ("in Extend_PE, the PECollection's start vertex IDs:"), [PE.startVertex.ID for PE in PECollection]
            
            if len(PECollection) >=2:
                ### Sort the order
                # check the first parcEdge direction, they must have twin becasue they are not naked
                if PECollection[0].endVertex ==  PECollection[1].startVertex  or PECollection[0].endVertex ==  PECollection[1].endVertex:
                    pass
                else:
                    PECollection[0] = EDict[PECollection[0].twinID]
                    
                ### keep sorting order
                for i in range(len(PECollection)-1):
                    
                    if PECollection[i+1].startVertex!= PECollection[i].endVertex:
                        PECollection[i+1] = EDict[PECollection[i+1].twinID]
                
                for i in range(len(PECollection)):
                    PECollection[i] = EDict[PECollection[i].twinID]
                PECollection.reverse()  ### important

                # print ("in Extend_PE, after sorting,the PECollection length:"), len(PECollection), " Their IDs", [PE.ID for PE in PECollection]
                # print ("in Extend_PE, after sorting,the PECollection's start vertex IDs:"), [PE.startVertex.ID for PE in PECollection]
                
                
                ### Add into street
                # Create StreetNode instance
                streetNodes = []
                for i in range(len(PECollection)):
                    streetNodes.append(RF.StreetNode(PECollection[i].startVertex)) # the last one does not need to be added,its original head
                    
                # Fill info for Street Node instances
                if len(streetNodes)!=1:
                    for i in range(len(streetNodes)):
                        currStreetNode = streetNodes[i]
                        if i == 0:
                            currStreetNode.prev = None
                            currStreetNode.next = streetNodes[i+1]
                            currStreetNode.prevConnection = None
                            currStreetNode.nextConnection = PECollection[i]
                            
                        elif i != 0 and i != len(streetNodes)-1:
                            currStreetNode.prev = streetNodes[i-1]
                            currStreetNode.next = streetNodes[i+1]
                            currStreetNode.prevConnection = PECollection[i-1]
                            currStreetNode.nextConnection = PECollection[i]    
                       
                        elif i == len(streetNodes)-1 :  ###important to add this condition,prevent later error
                            
                            streetNodes[i].prev =  streetNodes[i-1]
                            streetNodes[i].prevConnection =  PECollection[i-1]

                        
                elif len(streetNodes)==1:
                    pass
            
            elif len(PECollection) ==1:
                if PECollection[0].endVertex == self.head.node:
                    pass
                else:
                    PECollection[0] = EDict[PECollection[0].twinID]
                streetNodes = []
                for i in range(len(PECollection)):
                    streetNodes.append(RF.StreetNode(PECollection[i].startVertex)) # the last one does not need to be added,its original head      


                
            ##### Connect the original head
            originalHead = self.head
            #print ("The originalHead is: "),originalHead.ID
            originalHead.prev = streetNodes[-1]
            #print ("The originalHead.prev is: "), originalHead.prev.ID
            originalHead.prevConnection = PECollection[-1]
            
            
            streetNodes[-1].next = originalHead    # Cover the case that there is only 1 street node
            streetNodes[-1].nextConnection = PECollection[-1]
            
            self.head = streetNodes[0]   
                                
            # print ("After Extend")
            # self.PrintVIDHeadToEnd()
            # self.PrintVIDEndToHead()                        
               
        #####
        # Modification
        #####  
        def AssignStreetIDForParcEdge(self,EDict):
            allParcEdge = self.GetAllParcEdge()
            for pE in allParcEdge:
                pE.streetID = self.ID
                if pE.naked == False:
                    EDict[pE.twinID]. streetID = self.ID
      
        def Reverse(self,EDict):
            # [DEBUG or CHECK]
            # print ("Before reverse")
            # self.PrintVIDHeadToEnd()
            # print  self.GetAllParcEdgeID()    
            
            allEdges = self.GetAllParcEdge()
            allNodes = self.GetAllStreetNodes()
            for i in range(len(allNodes)-2,-1,-1):
                allNodes[i+1].next = allNodes[i]
                allNodes[i].prev = allNodes[i+1]
                
                
            allNodes[-1].prev = None
            allNodes[0].next = None

            for i in range(len(allNodes)-2,-1,-1):
                allNodes[i+1].nextConnection = EDict[allEdges[i].twinID]
                allNodes[i].prevConnection = EDict[allEdges[i].twinID]

            allNodes[-1].prevConnection = None
            allNodes[0].nextConnection = None

            self.head = allNodes[-1] 
            self.end = allNodes[0] 

            # print ("After reverse")
            # self.PrintVIDHeadToEnd()
            # print self.GetAllParcEdgeID()   

        @staticmethod    
        def SortOrderForStreet(parcEdgeColletion,Edict):
            if len(parcEdgeColletion) >= 2:
                ### sort the order
                # check the first parcEdge direction
                if parcEdgeColletion[0].endVertex ==  parcEdgeColletion[1].startVertex  or parcEdgeColletion[0].endVertex ==  parcEdgeColletion[1].endVertex:
                    pass
                else:
                    parcEdgeColletion[0] = Edict[parcEdgeColletion[0].twinID]
                
                # keep sorting order
                for i in range(len(parcEdgeColletion)-1):
                    if parcEdgeColletion[i+1].startVertex!= parcEdgeColletion[i].endVertex:
                        parcEdgeColletion[i+1] = Edict[parcEdgeColletion[i+1].twinID]

        #####
        # Get Geometry
        #####
        def PrintGeometry(self):     
            parcEdgeCollection = []
            streetNode = self.head
            
            
            whileCount = 0
            while streetNode.nextConnection!=None:
                if whileCount>1000:
                    break
                whileCount +=1
                parcEdgeCollection.append(streetNode.nextConnection)
                streetNode = streetNode.next
            
            vGeo = []
            IDs = []
            
            for pEdge in parcEdgeCollection:
                vGeo.append(pEdge.startVertex.geometry)  
                IDs.append(pEdge.startVertex.ID)
                if pEdge.betweenPoints!= []:
                    for bPt in pEdge.betweenPoints:
                        vGeo.append(bPt.geometry)  
                        IDs.append(bPt.ID)
        
            vGeo.append(parcEdgeCollection[-1].endVertex.geometry)  
            IDs.append(parcEdgeCollection[-1].endVertex.ID)
            print (parcEdgeCollection[-1].endVertex.geometry.X),",",parcEdgeCollection[-1].endVertex.geometry.Y,",",0   
            
            print ("Is it DoubleSize:"),self.doubleSize
            for i in range(len(vGeo)):
                print (vGeo[i].X),",",vGeo[i].Y,",",0, ("ID:"),IDs[i]
            return 0
                
        def GetGeometry(self):
            parcEdgeCollection = []
            streetNode = self.head

            whileCount = 0
            while streetNode.nextConnection!=None:
                if whileCount>1000:
                    break
                whileCount +=1
                
                parcEdgeCollection.append(streetNode.nextConnection)
                streetNode = streetNode.next
            
            vGeo = []
            for pEdge in parcEdgeCollection:
                vGeo.append(pEdge.startVertex.geometry)  
                if pEdge.betweenPoints!= []:
                    for bPt in pEdge.betweenPoints:
                        vGeo.append(bPt.geometry)  
            vGeo.append(parcEdgeCollection[-1].endVertex.geometry)  
            return rg.Polyline(vGeo)
       
        #####
        # Extra info
        #####
        def GetAllParcEdge(self):
            whileCount = 0
            allParcEdge = []
            streetNode = self.head
            while streetNode.next!=None:
                if whileCount>1000:
                    break
                whileCount +=1
 
                allParcEdge.append(streetNode.nextConnection)
                streetNode = streetNode.next
            return allParcEdge
        
        def GetAllParcEdgeID(self):
            whileCount = 0
            allParcEdge = []
            streetNode = self.head
            while streetNode.next!=None:
                if whileCount>1000:
                    break
                whileCount +=1

                allParcEdge.append(streetNode.nextConnection.ID)
                
                streetNode = streetNode.next
            
            return allParcEdge

        def GetAllParcEdgeTwinID(self):
            whileCount = 0
            allParcEdge = []
            streetNode = self.head
            
            while streetNode.next!=None:
                if whileCount>1000:
                    break
                whileCount +=1
                if streetNode.nextConnection.naked == False:
                    allParcEdge.append(streetNode.nextConnection.twinID)
                streetNode = streetNode.next
            return allParcEdge

        def GetAllParcEdgeAndTwinEdgeID(self):
            whileCount = 0
            allParcEdge = []
            streetNode = self.head
            while streetNode.next!=None:
                if whileCount>1000:
                    break
                whileCount +=1
 
                allParcEdge.append(streetNode.nextConnection.ID)
                allParcEdge.append(streetNode.nextConnection.twinID)
                streetNode = streetNode.next
            return allParcEdge

        def GetAllParcVertexID(self):
            whileCount = 0
            allParcVertex = []
            streetNode = self.head
            while streetNode.next!=None:
                if whileCount>1000:
                    break
                whileCount +=1
 
                allParcVertex.append(streetNode.node.ID)
                streetNode = streetNode.next
                
            allParcVertex.append(self.end.node.ID)
            
            return allParcVertex
 
        def GetAllParcVertex(self):
            whileCount = 0
            allParcVertex = []
            streetNode = self.head
            while streetNode.next!=None:
                if whileCount>1000:
                    break
                whileCount +=1
 
                allParcVertex.append(streetNode.node)
                streetNode = streetNode.next
                
            allParcVertex.append(self.end.node)
            
            return allParcVertex
 
        def GetAllStreetNodes(self):
            whileCount = 0
            allStreetNodes = []
            streetNode = self.head
            while streetNode.next!=None:
                if whileCount>1000:
                    break
                whileCount +=1
 
                allStreetNodes.append(streetNode)
                streetNode = streetNode.next
            allStreetNodes.append(self.end)
            
            return allStreetNodes
        
        #####
        # Debug
        #####
        def PrintVIDHeadToEnd(self):
            print ("This street, head to end ")
            whileCount = 0
            allParcVertex = []
            streetNode = self.head
            while streetNode.next!=None:
                if whileCount>1000:
                    break
                whileCount +=1
 
                allParcVertex.append(streetNode.node.ID)
                streetNode = streetNode.next
                
            allParcVertex.append(self.end.node.ID)
            print (allParcVertex)
    
        def PrintVIDEndToHead(self):
            print ("This street,end to head ")
            whileCount = 0
            allParcVertex = []
            streetNode = self.end
            while streetNode.prev!=None:
                if whileCount>1000:
                    break
                whileCount +=1
 
                allParcVertex.append(streetNode.node.ID)
                streetNode = streetNode.prev
                
            allParcVertex.append(self.head.node.ID)
            print (allParcVertex)
            

        
    class StreetNode:
        def __init__(self,node):
            self.node = node                # Type: ParcVertex       it stores , even the parcVertex are the same , they can be in different street
            self.prev = None                # Type: StreetNode       The previous StreetNode
            self.next = None                # Type: StreetNode       The next StreetNode
            self.prevConnection = None      # Type: ParcEdge         The prev StreetNode
            self.nextConnection = None      # Type: ParcEdge         The next StreetNode
            self.ID = node.ID               # Type: Int              The ID
        
        def __del__(self):
            self.node = None
            self.prev = None   
            self.next = None  
            self.prevConnection = None 
            self.nextConnection = None 
            self.ID = None
        
   
   
    ##################
    ### This is the overall combined function
    ##################
    @staticmethod
    def FindRoadForThisDepth_New(GRP,PL,currQ,currParcEdgeGraph,streetGraph,EDict,wA,doubleSideTag=False):
        ### [DEBUG OR CHECK]
        # print "in FindRoadForThisDepth_New"
        # for pF in currQ:
        #     for pt in pF.GetGeometry():
        #         print pt.X,pt.Y,0
        #     print "-----"
        # print "finish printing parcels"
        
        # for street in streetGraph.graph.keys():
        #     for pt in street.GetGeometry():
        #         print pt.X,pt.Y,0
        #     print "-----"
        # print "finish printing streets"
        
        intialdoubleSideTag = doubleSideTag                    # This is the tag that determine if you need to force double sides connected

        for parcel in currQ:                                   # Check accessibility and collect all inaccesible parcels, the accessibility property will be changed while checking
            RF.CheckAccessibility(parcel,EDict)
        inaccessibleParcels = RF.CollectAllInaccesibleParcels(currQ)
        

        ######
        # CASE1: If all the parcels are accessible, no new road needed, return
        ######
        if inaccessibleParcels == []:                          
            return 0  

        ######
        # CASE2: There are only 2 parcels and no road assigned, the mutual edge will be assigned as a new road
        ######
        if len(streetGraph.graph.keys()) == 0:                                                                                  
            clusterParcelCollection,clusterEdgeCollection = RF.ClusterInAccessibleParcels_Simplified(inaccessibleParcels)
            newStreet = RF.Street.CreateStreet([clusterEdgeCollection[0][0]] ,EDict,streetGraph)
            
            streetGraph.AddStreet(newStreet,EDict)
            
            for parcel in inaccessibleParcels:              # Update accessibility property will be changed while checking
                RF.CheckAccessibility(parcel,EDict)
            return 0

        ######
        # CASE3: The most usual case, need to do a road finding
        ######
        
        whileCount = 0
        while len(inaccessibleParcels)!=0:
            abstractPEGraphWithStreet,abstractDestination = currParcEdgeGraph.AbstractSubGraph(PL,streetGraph,EDict)  # Must keep it updated in the loop, some action like adding a street in will change the relationship
            doubleSideTag_InUse = intialdoubleSideTag
            
            # Just to aviod infinite loop
            whileCount+=1
            if whileCount>300:
                print ("FindRoadForThisDepth_New whileCount>300")
                break
            
            # Cluster, and sort the order, we want to process to the cluster with more parcels
            clusterParcelCollection,clusterEdgeCollection = RF.ClusterInAccessibleParcels(inaccessibleParcels)      # Update accessibility property will be changed while checking
            relatedNumClusters = []
            for cluster in clusterParcelCollection:
                relatedNumClusters.append([cluster,len(cluster)])
            relatedNumClusters = sorted(relatedNumClusters,key=lambda x: (-x[1]))                                   # Cluster, num
            relatedNumCluster_Sorted = [relatedNumCluster[0] for relatedNumCluster in relatedNumClusters]           # Sorted cluster list

            ######
            # CASE_A: This cluster has mutiple parcels, try their mutual edge by I or L searching
            ######
            
            if len(relatedNumCluster_Sorted[0])!=1:                                                                 # Check the first cluster in the list : If this cluster has mutiple parcels
                #print "len(relatedNumCluster_Sorted[0])!=1"
                newStreet = RF.FindRoadForCluster_MultipleParcels_MixScore_Extend(PL,GRP,EDict,relatedNumCluster_Sorted,abstractPEGraphWithStreet,abstractDestination,streetGraph,wA,doubleSideTag_InUse)
                
                if newStreet == "NotFound": # treat it as single parcel
                    newStreet = RF.FindRoadForCluster_SingleParcel_MixScore_Extend(PL,EDict,relatedNumCluster_Sorted[0],currParcEdgeGraph,abstractPEGraphWithStreet,abstractDestination,streetGraph,wA,doubleSideTag_InUse)

            ######
            # CASE_B: This cluster has only one parcel, try all the edges of this parcel
            ######
            elif len(relatedNumCluster_Sorted[0])==1:
                # print "len(relatedNumCluster_Sorted[0])==1"
                # print relatedNumCluster_Sorted[0][0].ID
                newStreet = RF.FindRoadForCluster_SingleParcel_MixScore_Extend(PL,EDict,relatedNumCluster_Sorted[0],currParcEdgeGraph,abstractPEGraphWithStreet,abstractDestination,streetGraph,wA,doubleSideTag_InUse)

    
            # Finally, add a street into the streetGraph, if found
            if newStreet != "NotFound":
                streetGraph.AddStreet(newStreet,EDict) 
            
            
            # If not found, need to consider the naked
            elif newStreet == "NotFound":
                newStreet = RF.FindNakedRoadForSingleParcelFromCluster(PL,GRP,relatedNumCluster_Sorted[0][0],EDict,streetGraph,wA)
                streetGraph.AddStreet(newStreet,EDict) 
     
            # print "newStreet!"
            # newStreet.PrintVIDHeadToEnd()
            # newStreet.PrintVIDEndToHead()
            # for pt in newStreet.GetGeometry():
            #     print pt.X,pt.Y,0
                
            # if newStreet.ID == 13:
            #     # print newStreet.GetAllParcEdgeID()
            #     # for edge in newStreet.GetAllParcEdge():
            #     #     print "edgeID",edge.ID,edge.startVertex.ID, edge.endVertex.ID
            #     return why
            # After adding a road to streetGraph , need to update accessibility property
            for parcel in inaccessibleParcels:
                RF.CheckAccessibility(parcel,EDict)
            
            # Re-collect the inaccessibleParcels, if the length is no 0, will continue the loop
            inaccessibleParcels = RF.CollectAllInaccesibleParcels(inaccessibleParcels)

    @staticmethod
    def AssignFirstRoad(PL,GRP,currStreetGraph,shareEdge,currE_Dict,wA):
        allStreetNodeIDs_Before = currStreetGraph.GetAllParcVertexID() 
        newStreet = RF.Street.CreateStreet([shareEdge], currE_Dict, currStreetGraph)
    
        # Check if double side connected
        if shareEdge.endVertex.ID not in allStreetNodeIDs_Before or shareEdge.startVertex.ID not in allStreetNodeIDs_Before:
            newNakedStreet = None
            mixParcEdgeGraph = GRP.ParcEdgeGraph.CreateMixParcEdgeGraph(currE_Dict, [shareEdge])
            nakedStreets = [street for street in currStreetGraph.graph.keys() if street.naked]
            abstractMixPEGraphWithStreet, abstractMixDestination = mixParcEdgeGraph.AbstractSubGraphWithNakedStreet(PL, nakedStreets, currE_Dict)
            newStreet_First, minScore = RF.FindOptimalPath(abstractMixPEGraphWithStreet, shareEdge, abstractMixDestination, wA, currE_Dict, currStreetGraph, None, True, True)
            
            #### if it is itself, pass
            if newStreet_First.GetAllParcEdge()[0].ID == shareEdge.ID or newStreet_First.GetAllParcEdge()[0].ID == shareEdge.twinID:
                pass
            else:
                newNakedStreet = newStreet_First
                currStreetGraph.AddStreet(newNakedStreet, currE_Dict)


        # If extend needed
        if shareEdge.endVertex.ID not in allStreetNodeIDs_Before or shareEdge.startVertex.ID not in allStreetNodeIDs_Before:
            if newNakedStreet != None:
                
                # Check for exclued:
                if newNakedStreet.head.node.ID == shareEdge.startVertex.ID:
                    commonVId = shareEdge.startVertex.ID
                elif newNakedStreet.head.node.ID == shareEdge.endVertex.ID:
                    commonVId = shareEdge.endVertex.ID


                excludedEdges= []  # newNakedStreet.head.nextConnection will be insde
                for pE in currE_Dict.values():
                    if pE.naked == True:
                        if pE.startVertex.ID == commonVId or pE.endVertex.ID == commonVId :
                            excludedEdges.append(pE)
                #print [pE.ID for pE in excludedEdges]
                mixParcEdgeGraph = GRP.ParcEdgeGraph.CreateMixParcEdgeGraph(currE_Dict, [shareEdge],excludedEdges)
                abstractMixPEGraphWithStreet, abstractMixDestination = mixParcEdgeGraph.AbstractSubGraphWithNakedStreet(PL, nakedStreets, currE_Dict)  # no need to update nakedStreets
                newNakedStreet, minScore = RF.FindOptimalPath(abstractMixPEGraphWithStreet, shareEdge, abstractMixDestination, wA, currE_Dict, currStreetGraph, None, True, True)
                currStreetGraph.AddStreet(newNakedStreet, currE_Dict)  # The naked one 
                
                #newNakedStreet.PrintVIDEndToHead()
                #newNakedStreet.PrintVIDHeadToEnd()
            elif newNakedStreet == None:
                # Get the connected nodeID
                connectedNodeID = None
                if shareEdge.endVertex.ID in allStreetNodeIDs_Before:
                 
                    connectedNodeID = shareEdge.endVertex.ID
                    
                elif shareEdge.startVertex.ID in allStreetNodeIDs_Before:
      
                    connectedNodeID = shareEdge.startVertex.ID

                # Find the connected nakedStreet edges that should be excluded
                excludedEdges = []
                allEdges = []
                for street in nakedStreets:
                    allEdges.extend(street.GetAllParcEdge())
                
                for edge in allEdges:
                    if edge.startVertex.ID == connectedNodeID or edge.endVertex.ID == connectedNodeID:
                        excludedEdges.append(edge)

                mixParcEdgeGraph = GRP.ParcEdgeGraph.CreateMixParcEdgeGraph(currE_Dict, [shareEdge],excludedEdges)
                abstractMixPEGraphWithStreet, abstractMixDestination = mixParcEdgeGraph.AbstractSubGraphWithNakedStreet(PL, nakedStreets, currE_Dict)  # no need to update nakedStreets
                
                newNakedStreet, minScore = RF.FindOptimalPath(abstractMixPEGraphWithStreet, shareEdge, abstractMixDestination, wA, currE_Dict, currStreetGraph, None, True, True)
                currStreetGraph.AddStreet(newNakedStreet, currE_Dict)  # The naked one 

        # Finally, add the shareEdge one new street
        currStreetGraph.AddStreet(newStreet, currE_Dict)  # The shareEdge one
        # for street in currStreetGraph.graph.keys():
        #     print street.ID,[edge.ID for edge in street.GetAllParcEdge()]
    ##################
    ### Choose optimal from possible choices (between quickPath and minScore path)
    ##################
    @staticmethod
    def FindOptimalPath(theGraph,startNode,destinationNode,wA,currE_Dict,currStreetGraph,mutualPath = False, extraPop = False, naked = False):
        # print "FindOptimalPath"
        # print "theGraph",theGraph.GetIDNumWeightGraph().graph
        quickPath, minScore_Quick = theGraph.CheckQuickPath(startNode, destinationNode, wA)
        minscorePath, minScore_NonQuick = RF.FindTheMixScorePathToAbstractNode_PE(theGraph, startNode, destinationNode, wA)


        # Determine which path to choose based on minimum score
        if quickPath and minScore_Quick <= minScore_NonQuick:
            chosenPath = quickPath
            minScore = minScore_Quick
        else:
            chosenPath = minscorePath
            minScore = minScore_NonQuick

        # print "FindOptimalPath, chosenPath", [edge.ID for edge in chosenPath]
        if len(chosenPath)>2:
            chosenPath.pop()
            if extraPop:
                chosenPath.pop(0)  # Pop the shareEdge
            if mutualPath:
                newStreet = RF.Street.CreateStreet(chosenPath, currE_Dict, currStreetGraph, mutualPath, True)
            else:
                
                newStreet = RF.Street.CreateStreet(chosenPath, currE_Dict, currStreetGraph)

            if naked:
                newStreet.naked = True
            return newStreet, minScore
        
        elif len(chosenPath)==2:
            newStreet = RF.Street.CreateStreet([startNode], currE_Dict, currStreetGraph)    
            return newStreet, minScore
        else:
            return "NotFound", "NotFound"
    
    ##################
    ### Check and Update Accessibility
    ##################
    @staticmethod
    def CollectAllInaccesibleParcels(currQ):
        inaccessibleParcels = []
        for parcel in currQ:   
            if parcel.accessible != True:
                inaccessibleParcels.append(parcel)
                
        return  inaccessibleParcels      
        
    @staticmethod     
    def CheckAccessibility(parcel,Edict): 
        # Case 1 : if it is accessible, just return
        if parcel.accessible == True:
            
            return 0
        
        # Case 2 : if it is NOT accessible, just check see if it needs update
        thisParcelEdges = parcel.edges
        for edge in thisParcelEdges:
            #print "this Edge edge.ID",edge.ID
            if edge.naked == False:
                #print "this Edge edge.twinID",edge.twinID,Edict[edge.twinID].streetID
                if edge.streetID != None or Edict[edge.twinID].streetID != None:
                    parcel.accessible = True
                    #print  (parcel.ID) , ("is accessible now  ")
                    break 
                
            elif  edge.naked ==True:
                if edge.streetID != None:
                    parcel.accessible = True
                    #print  (parcel.ID) , ("is accessible now  ")
                    break    
        
    ##################
    ### Cluster Inaccessible Parcels
    ##################
    
    @staticmethod    
    def ClusterInAccessibleParcels(inaccessibleParcels):
        ### Deepcopy the inaccessible parcel list, the items inside will be gradually popped 
        treatParcels = [parcel for parcel in inaccessibleParcels]
        
        ### Initialze the store space
        clusterParcelCollection = []                        
        clusterEdgeCollection = []
        
        ### These 2 whileCount are to avoid infinite loop
        whileCount = 0
        whileCount2 = 0
        
        while len(treatParcels)!= 0:
            
            if whileCount == 1000:                          ### Max iteration, avoid infinite loop, force it to stop
                print ("ClusterInAccessibleParcels whileCount1".error)  
            whileCount +=1
            
            ### Initialze a new cluster
            newParcelCluster = []                           # Store parcels
            newEdgeCluster= []                              # Store edges
            newParcelCluster.append(treatParcels[0])        # Store the first parcel in this cluster
            treatParcels.pop(0)                             # Pop it
            
            tag = True                                      # If Tag == True, means this cluster collection is not finished, should continue
            while tag == True:              
                whileCount2 += 1                            ### Max iteration, avoid infinite loop, force it to stop
                if whileCount2 == 1000:
                    print  ("ClusterInAccessibleParcels whileCount2".error )
                    break
                
                prevCusterLength  = len(newParcelCluster)   # Update the current num of the cluster
                
                for pF in treatParcels:
                    currClusterEdgeAndTwinIDs = RF.GetCurrClusterEdgeAndTwinIDs(newParcelCluster)    # Keep updating the edges in this cluster
                    for edge in pF.edges:                               
                        if edge.ID in currClusterEdgeAndTwinIDs:                # If there is an edge(or its twinEdge) of this parcel exsit in this cluster edges collection
                            newParcelCluster.append(pF)                         # Should add it into this cluster
                            newEdgeCluster.append(edge)
                            break
                
                for parcel in newParcelCluster:                                 # If parcels are added into a cluster , should be removed        
                    if parcel in treatParcels:
                        treatParcels.remove(parcel)
                
                currCusterLength  = len(newParcelCluster)                       
                if currCusterLength == prevCusterLength:                        # If the num of this cluster stop increasing, should stop this cluster searching 
                    clusterParcelCollection.append(newParcelCluster)            # Add into ClusterCollection
                    clusterEdgeCollection.append(newEdgeCluster)        
                    tag = False                                                 # turn off the toggle
                
        return clusterParcelCollection,clusterEdgeCollection  
    
    @staticmethod    
    def ClusterInAccessibleParcels_Simplified(inaccessibleParcels):
        ### In this case, there must be ONLY 2 parcels
        ### We only need to take the mutual edge of this 2 parcels
        ### There is only 1 edge and its twinEdge are not naked
        newParcelCluster = [inaccessibleParcels[0],inaccessibleParcels[1]]
        newEdgeCluster= [] 
        
        for edge in newParcelCluster[0].edges:
            if edge.naked!=True:
                newEdgeCluster.append(edge)
        
        for edge in newParcelCluster[1].edges:
            if edge.naked!=True:
                newEdgeCluster.append(edge)
                

        clusterParcelCollection =[newParcelCluster] 
        clusterEdgeCollection = [newEdgeCluster]
        
        return clusterParcelCollection,clusterEdgeCollection    
           
    @staticmethod
    def GetCurrClusterEdgeAndTwinIDs(currCluster):
        currClusterEdgeAndTwinIDs = []
        for parcel in currCluster:
            for edge in parcel.edges:
                currClusterEdgeAndTwinIDs.append(edge.ID)
                if edge.naked == False:
                    currClusterEdgeAndTwinIDs.append(edge.twinID)
        
        return currClusterEdgeAndTwinIDs
    

    ##################
    ### Road finding logic
    ##################
        
     
    @staticmethod   
    def SortParcEdgeOrder(parcEdgeColletion,Edict):
        #print ("before SortParcEdgeOrder")
        # for pE in parcEdgeColletion:
        #     print pE.startVertex.geometry.X,pE.startVertex.geometry.Y,0
        #print "-----"
        
        newParcEdgeColletion = [pE for pE in parcEdgeColletion ]
        if len(newParcEdgeColletion) >= 2:
     
            ### sort the order
            # check the first parcEdge direction
            if newParcEdgeColletion[0].endVertex ==  newParcEdgeColletion[1].startVertex  or newParcEdgeColletion[0].endVertex ==  newParcEdgeColletion[1].endVertex:
                #print ("same order")
                pass
            else:
                newParcEdgeColletion[0] = Edict[newParcEdgeColletion[0].twinID]
                #print ("reverse the first")
            
            # keep sorting order
            
            for i in range(len(newParcEdgeColletion)-1):
                if newParcEdgeColletion[i+1].startVertex!= newParcEdgeColletion[i].endVertex:
                    #print ("reverse the index"), i 
                    
                    newParcEdgeColletion[i+1] = Edict[newParcEdgeColletion[i+1].twinID]
        
        #print "after SortParcEdgeOrder "            
        #print len(newParcEdgeColletion)
        # for pE in newParcEdgeColletion:
        #     print pE.startVertex.geometry.X,pE.startVertex.geometry.Y,0
        #print "-----"
        return newParcEdgeColletion
  
    @staticmethod
    def GetSideGeo(newEdgeResult):
        sidePtList = []    
        for edge in newEdgeResult:
            edgeGeo = edge.GetGeometry()
            for i in range(len(edgeGeo)-1):
                sidePtList.append(edgeGeo[i])
        sidePtList.append(newEdgeResult[-1].endVertex.geometry)
        sideGeo = rg.Polyline(sidePtList)
        return sideGeo
                
    @staticmethod    
    def ReturnParcSide(inaccessibleParcel,startEdge,Edict):
        # see if need to choose the side
        # print ("ReturnParcSide")
        # print ("startEdge.ID"), startEdge.ID,"startEdge.twinID",startEdge.twinID
        
        sides = inaccessibleParcel.sides
        
        for side in sides:
            if startEdge.ID in side or startEdge.twinID in side:
                chosenSide = side
                break
            
        if len(chosenSide) ==1:
            return startEdge, startEdge.ID,False
        
        else:
            startEgdeCollection = []
            startEgdeIDCollection = []
            for edgeID in chosenSide:
                startEgdeCollection.append(Edict[edgeID])
                startEgdeIDCollection.append(edgeID)
            #print (startEdge.ID), startEgdeIDCollection
            return startEgdeCollection, startEgdeIDCollection, True
     
    @staticmethod 
    def FindRoadForCluster_MultipleParcels_MixScore_Extend(PL,GRP,EDict,relatedNumCluster_Sorted,abstractPEGraphWithStreet,abstractDestination,streetGraph,wA,doubleSideTag_InUse):
        # print "FindRoadForCluster_MultipleParcels_MixScore_Extend"
        mutualPathList = RF.TryClusterRoadFinding(GRP,relatedNumCluster_Sorted,EDict)                       # Try the to get the mutual path for this cluster, I or L
        # print "mutualPathList"
        # print [edge.ID for edge in mutualPathList]
        
        # print "street"
        # for street in streetGraph.graph.keys():
        #     for pt in street.GetGeometry():
        #         print pt.X,pt.Y,0
        #     print "-----"
        # To create the geometry of this path
        mutualPtList = []       
        newEdgeResult = RF.SortParcEdgeOrder(mutualPathList,EDict)                                          # Sorting the order of the edge it is important
        for edge in newEdgeResult:
            edgeGeo = edge.GetGeometry()
            for i in range(len(edgeGeo)-1):
                mutualPtList.append(edgeGeo[i])
        mutualPtList.append(newEdgeResult[-1].endVertex.geometry)
        mutualPathGeo = rg.Polyline(mutualPtList)
        
    
        # Check if its either side is connected to the exsiting road network , 2 cases
        allStreetNodeIDs = streetGraph.GetAllParcVertexID()                                                 # Get all the vertex ID in this street Graph              

        # case1 : One of the side is connected to the exsiting road network 
        if newEdgeResult[-1].endVertex.ID in allStreetNodeIDs or newEdgeResult[0].startVertex.ID in allStreetNodeIDs:           
            newStreet= RF.Street.CreateStreet(newEdgeResult,EDict,streetGraph)
            pass
        
        # case2 : It is still isolated
        else:
            # for street in streetGraph.graph.keys():
            #     for pt in street.GetGeometry():
            #         print pt.X,pt.Y,0
            #     print "-----"
            # print "finish printing streets"
            abstractPEGraphWithStart,abstractMutualStart = abstractPEGraphWithStreet.AbstractSubGraphWithMutualStart(PL,newEdgeResult,mutualPathGeo,EDict)    # Abstract this mutual edge collection as a node 

            # Check all the path possibilities 
            newStreet,minScore = RF.FindOptimalPath(abstractPEGraphWithStart,abstractMutualStart,abstractDestination,wA,EDict,streetGraph,mutualPathList)
    
        if newStreet == "NotFound":
            return newStreet    
        # [DEBUG or CHECK] print ("before checking if double sides are connecting exsiting streets, do I need to find:"), doubleSideTag_InUse 
        # Check if double sides are connecting exsiting streets 
        allStreetNodeIDs = streetGraph.GetAllParcVertexID()
        
        if newStreet.end.node.ID in allStreetNodeIDs and newStreet.head.node.ID in allStreetNodeIDs:
            doubleSideTag_InUse = False    ### Better double check here. If It is double side connected, no need to find from other side. 
        
        # [DEBUG or CHECK] print("after checking if double sides are connecting exsiting streets, do I need to find:"), doubleSideTag_InUse   
        if doubleSideTag_InUse == True:
            newStreet,minScore = RF.ExtendRoadFromOtherSide(newStreet,EDict,streetGraph,abstractPEGraphWithStreet,wA)
                    
        return newStreet
    
    @staticmethod 
    def FindRoadForCluster_SingleParcel_MixScore_Extend(PL,EDict,clusterParcel,currParcEdgeGraph,parcEdgeGraph_Sim,abstractPENode,streetGraph,wA,doubleSideTag_InUse):
        #print "FindRoadForCluster_SingleParcel_MixScore_Extend"
        originalDoubleSideTag = doubleSideTag_InUse
        thisParcel = clusterParcel[0]
        allParcEdgeID = parcEdgeGraph_Sim.GetAllParcEdgeID()
        
        ####################################### 
        ### Check if mutiple edge in one side
        #######################################
        startEdgeResults = []
 
        ### [DEBUG or CHECK] print "thisParcel.sides",thisParcel.sides
        for edge in thisParcel.edges:
            edgeResult,IDresult,tag = RF.ReturnParcSide(thisParcel,edge,EDict)
            startEdgeResults.append(edgeResult)
        
        #######################################
        ### Make sure they are in the parcEdgeGraph , Get the ID , Get the instances
        #######################################
        startEdgeIDs = []
        startEdges = []
        for sEdgeResult in startEdgeResults:
            if isinstance(sEdgeResult, list): ### mutiple edges
                
                IDColletion = []
                instanceCollection = []
                for edge in sEdgeResult:
                    
                    if edge.naked == False:
                        if edge.ID in allParcEdgeID:
                            IDColletion.append(edge.ID)
                            instanceCollection.append(EDict[edge.ID])
                            
                        else:
                            IDColletion.append(edge.twinID)
                            instanceCollection.append(EDict[edge.twinID])
                
                if IDColletion!=[]:
                    startEdgeIDs.append(IDColletion)
                    startEdges.append(instanceCollection)
                
            else:
                
                if sEdgeResult.naked == False:
                    if sEdgeResult.ID in allParcEdgeID:
                        startEdgeIDs.append(sEdgeResult.ID)
                        startEdges.append(EDict[sEdgeResult.ID])
                    else:
                        startEdgeIDs.append(sEdgeResult.twinID)
                        startEdges.append(EDict[sEdgeResult.twinID])

        startEdgeIDs_Clean = []
        startEdges_Clean = []
        for item in startEdgeIDs:
            if item not in startEdgeIDs_Clean:
                    startEdgeIDs_Clean.append(item)
                    
        for item in startEdges:
            if item not in startEdges_Clean:
                    startEdges_Clean.append(item)

      
        
        startEdgeIDs = startEdgeIDs_Clean
        startEdges = startEdges_Clean

        #######################################
        ### Try all options
        #######################################
        street_Collection = []
        minScore_Collection = []
        
        for selectedEdge in startEdges:
            doubleSideTag_InUse = originalDoubleSideTag 
            minScore_First, minScore_Second, midScore = 0, 0, 0
            
            ############
            ### First
            ############
            if isinstance(selectedEdge, list)!=True:
                # print "--------------"
                # print "selectedEdge",selectedEdge.ID
                quickPath,minScore_First= parcEdgeGraph_Sim.CheckQuickPath(selectedEdge,abstractPENode,wA)
                
                if quickPath !=None:
                    minScorePath = quickPath  # pop later
                    minScore_First = minScore_First
                elif quickPath == None:
                    minScorePath,minScore_First = RF.FindTheMixScorePathToAbstractNode_PE(parcEdgeGraph_Sim,selectedEdge,abstractPENode,wA)
                
                if abstractPENode in minScorePath:
                    minScorePath.remove(abstractPENode)
                else:
                    return "NotFound"    # Might neet to consider the naked edges here

            elif isinstance(selectedEdge, list)==True:      
                newEdgeResult = RF.SortParcEdgeOrder(selectedEdge,EDict)    
                sideGeo = RF.GetSideGeo(newEdgeResult)
                
                parcEdgeGraph_SimStart,startAbstract = parcEdgeGraph_Sim.AbstractSubGraphWithMutualStart(PL,newEdgeResult,sideGeo,EDict)   ### use the re-sorted edge collection!!!
                quickPath,minScore_First= parcEdgeGraph_SimStart.CheckQuickPath(startAbstract,abstractPENode,wA)
                
                if quickPath !=None:
                    minScorePath = quickPath  # pop later
                    minScore_First = minScore_First
                elif quickPath == None:
                    minScorePath,minScore_First = RF.FindTheMixScorePathToAbstractNode_PE(parcEdgeGraph_SimStart,startAbstract,abstractPENode,wA) # pop later
                
                
                if abstractPENode in minScorePath:
                    minScorePath.remove(abstractPENode)
                else:
                    return "NotFound" # Might neet to consider the naked edges here

   
            if minScorePath[0].ID != "abstractStart":
                newStreet= RF.Street.CreateStreet(minScorePath,EDict,streetGraph)

            elif minScorePath[0].ID == "abstractStart":
                newStreet= RF.Street.CreateStreet(minScorePath,EDict,streetGraph,selectedEdge,True)
            
            
            ############
            ### Mid - Special detection for single edge road. It will stop Second step if it proceed.
            ############
            ### Check if double sides are connecting exsiting streets 
            # print ("before checking if double sides are connecting exsiting streets, do I need to find:"), doubleSideTag_InUse  
            allStreetNodeIDs = streetGraph.GetAllParcVertexID()
            if newStreet.end.node.ID in allStreetNodeIDs and newStreet.head.node.ID in allStreetNodeIDs:
               doubleSideTag_InUse = False
            # print ("after checking if double sides are connecting exsiting streets, do I need to find:"), doubleSideTag_InUse  

            abstractPEGraphWithStreet,abstractDestination = currParcEdgeGraph.AbstractSubGraph(PL,streetGraph,EDict)
            doubleSideTag_InUse,midScore = RF.FindRoadForCluster_SingleEdgeStreet(PL,EDict,newStreet,streetGraph,currParcEdgeGraph,abstractPEGraphWithStreet,abstractDestination,allStreetNodeIDs,wA,doubleSideTag_InUse)

          
            ############
            ### Second - For muti edges road. It will stop Second step if it proceed.
            ############
            # print ("after checking if double sides are connecting exsiting streets, do I need to find:"), doubleSideTag_InUse   
            if doubleSideTag_InUse == True:
               
               
                newStreet,minScore_Second = RF.ExtendRoadFromOtherSide(newStreet,EDict,streetGraph,abstractPEGraphWithStreet,wA)
         
                    
            # print ("minScore_Second"),minScore_Second
            totalScoreCost = minScore_First + midScore + minScore_Second  # It is either midScore or minScore_Second
            street_Collection.append(newStreet)
            minScore_Collection.append(totalScoreCost)
            # print ("this round I found "),[pE.ID for pE in newStreet.GetAllParcEdge()],("totalScoreCost"),totalScoreCost
            #print ("-----")
            
        finalStreet = street_Collection[minScore_Collection.index(min(minScore_Collection))]
        #print ("final found "),[pE.ID for pE in finalStreet.GetAllParcEdge()]
            
     
        return finalStreet

    @staticmethod
    def FindRoadForCluster_SingleEdgeStreet(PL,EDict,newStreet,streetGraph,currParcEdgeGraph,abstractPEGraphWithStreet,abstractDestination,allStreetNodeIDs,wA,doubleSideTag_InUse):
        midScore = 0
        if len(newStreet.GetAllParcEdge())==1:
            ### Find all its neighbors
            thisPEInstance = newStreet.GetAllParcEdge()[0]
            thisPEInstanceVIDs = [thisPEInstance.startVertex.ID , thisPEInstance.endVertex.ID ]
            allThisSinglePENb = []
            

            if thisPEInstance in abstractPEGraphWithStreet.graph.keys():
                thisPEInstance = thisPEInstance
            else:
                thisPEInstance = EDict[thisPEInstance.twinID]
            allThisSinglePENb = abstractPEGraphWithStreet.graph[thisPEInstance]
            
            ### [DEBUG or CHECK] 
            # print ("allThisSinglePENb"), [pE.ID for pE in allThisSinglePENb]
            
            validThisSinglePENb = []

            for pE in allThisSinglePENb:
                if pE.ID != "abstractNode":
                    if pE.startVertex.ID not in allStreetNodeIDs and pE.endVertex.ID not in allStreetNodeIDs:
                        validThisSinglePENb.append(pE)
                    
                    elif pE.startVertex.ID  in allStreetNodeIDs or pE.endVertex.ID  in allStreetNodeIDs:
                        if pE.startVertex.ID in thisPEInstanceVIDs:
                            commonID =  pE.startVertex.ID
                        elif pE.endVertex.ID in thisPEInstanceVIDs:
                            commonID =  pE.endVertex.ID
                        
                        if commonID not in allStreetNodeIDs:
                            validThisSinglePENb.append(pE)
                            
            ### [DEBUG or CHECK] 
            # print ("validThisSinglePENb"), [pE.ID for pE in validThisSinglePENb]
            
            ### Check if quick path inside          
            possiblePath = [pE for pE in validThisSinglePENb if pE.startVertex.ID in allStreetNodeIDs or pE.endVertex.ID in allStreetNodeIDs]
            ### [DEBUG or CHECK] print ("possiblePath is "),[pE.ID for pE in possiblePath]
            
            ### if there is quick path,score them 
            if possiblePath!=[]:
                ### [DEBUG or CHECK] print ("possiblePath!=[]"),[pE.ID for pE in possiblePath]
                minScorePath, minScore_First = abstractPEGraphWithStreet.CheckQuickPath_Eva(thisPEInstance,possiblePath,abstractDestination,wA)
                minScorePath.pop()
                minScorePath.remove(minScorePath[0])
                
                newStreet.Extend_PE(minScorePath,EDict)
                doubleSideTag_InUse = False
                midScore = minScore_First
                
            ### else, there is not quick path
            elif possiblePath==[]:
              
                ### [DEBUG or CHECK] print ("possiblePath==[]")
                minScorePE, minScore_First = abstractPEGraphWithStreet.CheckQuickPath_Eva(thisPEInstance,validThisSinglePENb,abstractDestination,wA)
                
                if minScorePE == None:  # Special case , direct connect 
                    return True,0
         
                minScorePE.pop()
                minScorePE.remove(minScorePE[0])
                
                ### [DEBUG or CHECK] print ("minScorePE"),[pE.ID for pE in minScorePE]
                ##### I should forbidden it looks back!change the graph
                abstractPEGraphWithStreetWithNew,abstractDestination = currParcEdgeGraph.AbstractSubGraph(PL,streetGraph,EDict)  ### must keep it updated, some action like add a street in will change the connection

                
                affectedNb = abstractPEGraphWithStreetWithNew.graph[thisPEInstance]
                ### [DEBUG or CHECK] print ("affectedNb"),[pE.ID for pE in affectedNb]
                for nbE in affectedNb:
                    abstractPEGraphWithStreetWithNew.graph[nbE].pop(thisPEInstance)
                abstractPEGraphWithStreetWithNew.graph.pop(thisPEInstance)
              

                minScorePath,minScore_Second = RF.FindTheMixScorePathToAbstractNode_PE(abstractPEGraphWithStreetWithNew,minScorePE[0],abstractDestination,wA)  ### dont use abstarctPENodeWithST
                ### [DEBUG or CHECK] print ("minScorePath"),[pE.ID for pE in minScorePath]
                minScorePath.pop()
                ### not need to remove index 0,beacsue i am using next
                newStreet.Extend_PE(minScorePath,EDict)
                ### [DEBUG or CHECK] print ("newStreet.Extend_PE(minScorePath,EDict)Geo")
                doubleSideTag_InUse = False
                midScore = minScore_First+minScore_Second
 
        return doubleSideTag_InUse,midScore
   
    @staticmethod
    def FindNakedRoadForSingleParcelFromCluster(PL,GRP,thisParcel,EDict,streetGraph,wA):
        # print "in FindNakedRoadForSingleParcelFromCluster"
     
        street_Collection,minScore_Collection = [],[]
        parcelNakedEdges = [edge for edge in thisParcel.edges if edge.naked and edge.isValid]

        # print "parcelNakedEdges"
        # for nPE in parcelNakedEdges:
        #     for pt in nPE.GetGeometry():
        #         print pt.X,pt.Y,0
        #     print "-----"
        ### Create a naked edge graph
        
        allStreetEdges = []
        for street in streetGraph.graph.keys():
            allStreetEdges.extend(street.GetAllParcEdge())
            
        mixParcEdgeGraph = GRP.ParcEdgeGraph.CreateMixParcEdgeGraph(EDict,allStreetEdges)


        for pNakedEdge in parcelNakedEdges: 
            abstractMixPEGraphWithStreet,abstractMixDestination = mixParcEdgeGraph.AbstractSubGraph(PL,streetGraph,EDict)
            newStreet,minScore = RF.FindOptimalPath(abstractMixPEGraphWithStreet,pNakedEdge,abstractMixDestination,wA,EDict,streetGraph, None, False,True)

            street_Collection.append(newStreet)
            minScore_Collection.append(minScore)
            
        finalStreet = street_Collection[minScore_Collection.index(min(minScore_Collection))]
        return finalStreet
 
    @staticmethod
    def ExtendRoadFromOtherSide(newStreet,EDict,streetGraph,abstractPEGraphWithStreet,wA):
        #print "ExtendRoadFromOtherSide"
        #print abstractPEGraphWithStreet.GetIDNumWeightGraph().graph
        #  # Find the current connected node and the unconnected node
        # if newStreet.head.node.ID  in allStreetNodeIDs:
        #     connectedNode = newStreet.head.node
        #     unconnnectedNode = newStreet.end.node
        
        # elif newStreet.end.node.ID in allStreetNodeIDs:
        #     connectedNode = newStreet.head.node
        #     unconnnectedNode = newStreet.head.node
                    
        # If the head is connected, I need to revsere the street, so later it will start from the unconnected side    
        if newStreet.head.node.ID in streetGraph.GetAllParcVertexID():
            # [DEBUG or CHECK] print ("newStreet.Reverse(),original head ID is ") ,newStreet.head.node.ID,("next connection is "),newStreet.head.nextConnection.ID
            newStreet.Reverse(EDict)
            
        # Abstarct with new street to avoid going back in the searching
        abstractPEGraphWithST,abstarctPENodeWithST = abstractPEGraphWithStreet.AbstractSubGraphWithNewStreet(EDict,newStreet,streetGraph)
        newStartPENode = newStreet.head.nextConnection

        # [DEBUG or CHECK] print ("new street pe ID"),newStreet.GetAllParcEdgeID()
        # [DEBUG or CHECK] newStreet.PrintVIDHeadToEnd()
        # [DEBUG or CHECK] newStreet.PrintVIDEndToHead()
        # [DEBUG or CHECK]  print ("Start find doubleside connection, current newStartPENode"), newStartPENode.ID 
        
        # Make sure the this start edge is in the graph (Because there is twin edge)
        # abstractPEGraphWithSTIDs = [pE.ID for pE in abstractPEGraphWithST.graph.keys()]
        abstractPEGraphWithSTIDs = [pE.ID for pE in abstractPEGraphWithST.graph.keys()]
        if newStartPENode.ID in abstractPEGraphWithSTIDs:
            pass
        else:
            newStartPENode = EDict[newStartPENode.twinID]
 
        minScorePath,minScore  = RF.FindTheMixScorePathToAbstractNode_PE(abstractPEGraphWithST,newStartPENode,abstarctPENodeWithST,wA)
        #print ("find this path to extend"),[node.ID for node in minScorePath],("cost"),minScore_Second
        
        if minScorePath == []:
            pass
        ###Find the new StartPE
        elif len(minScorePath)!=2:
            #totalScoreCost = angleCost + minScore
            minScorePath.pop()
            minScorePath.remove(minScorePath[0])
            newStreet.Extend_PE(minScorePath,EDict)

        return newStreet,minScore
    
    ##################
    ### Graph alogirthm
    ##################
    
    @staticmethod    
    def Dijkstra_ParcEdgeGraph_Mix(parcEdgeDistanceGraph, parcEdgeAngleGraph, start,wA):
        #print ("Dijkstra_ParcEdgeGraph_Mix") 
        ### prepare the range of distance 
        ### prepare the range of angle
        wD = 1 - wA
        distanceList = []
        distanceDict = {}
        geoDict = {}
        for pE in parcEdgeDistanceGraph.graph.keys():

            geo = pE.GetGeometry()
         
    
            length = geo.Length
            distanceList.append(length)
            distanceDict[pE] = length
            geoDict[pE] = geo
            
        minDist = min(distanceList)
        maxDist = max(distanceList)

        
        minAngle = 0
        maxAngle = 180
        

        scoreSum = {node: float('inf') for node in parcEdgeAngleGraph.graph}
        scoreSum[start] = 0
        pq = [(0, start)]
        predecessors = {node: None for node in parcEdgeAngleGraph.graph}
        whileCount = 0
        while pq:
            whileCount+=1
            if whileCount == 4000:
                print ("Dijkstra_ParcEdgeGraph_Mix".error)   
            current_score, current_node = heapq.heappop(pq)
            if current_score > scoreSum[current_node]:
                continue
                   
            #print ("current_node"),current_node.ID
            # for pt in current_node.GetGeometry():
            #     print pt.X,pt.Y,0
            for neighbor, theirAngle in parcEdgeAngleGraph.graph[current_node].items():
                # print ("current_node.ID,neighbor.ID"),current_node.ID,neighbor.ID
                # print "predecessors[neighbor] == predecessors[current_node]"
         
                if predecessors[neighbor] == predecessors[current_node] and predecessors[neighbor]!=None and current_node.ID!="abstractNode" and neighbor.ID!="abstractNode":
                    # print current_node.startVertex.ID,current_node.endVertex.ID
                    # print neighbor.startVertex.ID,neighbor.endVertex.ID
                    if current_node.startVertex != neighbor.startVertex and current_node.startVertex != neighbor.endVertex:
                        thisChosen = current_node.endVertex
                        thisChosen_End = current_node.startVertex
                    elif current_node.startVertex == neighbor.startVertex or current_node.startVertex == neighbor.endVertex:
                        thisChosen = current_node.startVertex
                        thisChosen_End = current_node.endVertex
                    # print "thisChosen",thisChosen.ID,thisChosen.geometry
                    
                    if neighbor.startVertex == thisChosen :
                        nbChosen = neighbor.startVertex
                        nbChosen_End = neighbor.endVertex
                    elif neighbor.endVertex == thisChosen :
                        nbChosen = neighbor.endVertex
                        nbChosen_End = neighbor.startVertex
                        
                    # print "nbChosen",nbChosen.ID,nbChosen.geometry
                    # count = parcEdgeDistanceGraph.graph.keys().count(current_node)

                    # print "count:",(count)
                    # print "debug, in node itself "
                    # print current_node.GetGeometry()[0]
                    # print "debug, in parcEdgeDistanceGraph  "
                    # for pE in parcEdgeDistanceGraph.graph.keys():
                    #     if pE == current_node:
                    #         print pE.GetGeometry()[0]

                    # print "debug, in parcEdgeAngleGraph  "
                    # for pE in parcEdgeAngleGraph.graph.keys():
                    #             if pE == current_node:
                    #                 print pE.GetGeometry()[0]
                    # print "debug, in dictGeo  "
                    # print geoDict[current_node][0]

                    # # ### get This node geo 
                    # if thisChosen == current_node.startVertex:
                    #     print "thisChosen no reverse"
                    #     thisGeo = geoDict[current_node]
                        
                    # elif thisChosen == current_node.endVertex:
                        
                    #     thisGeo = geoDict[current_node]
                    #     print "thisGeo.First",thisGeo.First
                    #     thisGeo.Reverse()
                    #     print "thisChosen reverse"
                    #     print "after thisGeo.First",thisGeo.First
                        
                    # # ### get nb node geo 
                    # if nbChosen == neighbor.startVertex:
                    #     nbGeo =  geoDict[neighbor]
                    #     print "nbChosen no reverse"
                        
                    # elif thisChosen == neighbor.endVertex:
                    #     nbGeo = geoDict[neighbor]
                    #     nbGeo.Reverse()
                    #     print "nbChosen  reverse"

                    # thisVec = rg.Vector3d (thisGeo[1] - thisGeo[0])
                    # nbVec = rg.Vector3d (nbGeo[1] - nbGeo[0])

                    # print "thisGeo.First",thisGeo.First
                    # print "nbGeo.First",nbGeo.First
                    # print "thisGeo.Last",thisGeo.Last
                    # print "nbGeo.Last",nbGeo.Last
                    # thisVec = rg.Vector3d (thisGeo.First - thisGeo.Last)
                    # nbVec = rg.Vector3d (nbGeo.First - nbGeo.Last)
                    
                    thisVec = rg.Vector3d (thisChosen_End.geometry - thisChosen.geometry)
                    nbVec = rg.Vector3d (nbChosen_End.geometry - nbChosen.geometry)
                    
                    costAngle = rm.ToDegrees(rg.Vector3d.VectorAngle(thisVec,nbVec))
                    #print "costAngle" ,costAngle
                else:
                    costAngle = theirAngle
                    #print "theirAngle",theirAngle
                
                if  current_node.ID!="abstractNode":
                    costDist = distanceDict[neighbor]
                else:
                    costDist = 0
                #print "wD * costDist + wA * costAngle",wD,costDist,wA,costAngle
                costDist_Remap = (costDist-minDist) / (maxDist- minDist)
                costAngle_Remap = (costAngle-minAngle) / (maxAngle- minAngle)
                #print "wD * costDist_Remap + wA * costAngle_Remap",wD,costDist_Remap,wA,costAngle_Remap
                costMix = wD * costDist_Remap + wA * costAngle_Remap
                #print "costMix",costMix
                totalCost = current_score + costMix
                # print "totalCost",totalCost
                #print "asdasdasdads",current_node.ID,neighbor.ID
                
                if totalCost < scoreSum[neighbor]:
                    scoreSum[neighbor] = totalCost
                    predecessors[neighbor] = current_node
                    heapq.heappush(pq, (totalCost, neighbor))
                    # print ("update, predecessors_Angle[neighbor] = current_node"), neighbor.ID,current_node.ID
                    # print "----"
                
        return  scoreSum, predecessors        
    
    @staticmethod       
    def FindTheMixScorePathToAbstractNode_PE(graph,startPENode,abstractPENode,wA):
        angleGraph = graph.CreateParcEdgeAngleGraph()
        distGraph = graph
  
 
        angleSum, anglePredecessors = RF.Dijkstra_ParcEdgeGraph_Mix(distGraph,angleGraph,startPENode,wA)

        minAngle = angleSum[abstractPENode]
        minAnglePath = RF.FindPath(anglePredecessors, startPENode, abstractPENode)

        # print ("FindTheMixScorePathToAbstractNode_PE"), ("startPENode.ID"),startPENode.ID,("path"),[node.ID for node in minAnglePath]
        # print ("cost"),(minAngle)
        return minAnglePath,minAngle  
    
    @staticmethod  
    def FindPath(predecessors, start, end):
        path = []
        node = end
        whileCount = 0
        while node is not None:
            whileCount+=1
            if whileCount == 300:
                
                print ("startGeo")
                for pt in start.GetGeometry():
                    print (pt.X),pt.Y,0
                    
                print ("-----")
                print ("endGeo")
                for pt in end.GetGeometry():
                    print (pt.X),pt.Y,0
                    
                print ("-----")
                
                print ("node.ID"),node.ID
                for pt in node.GetGeometry():
                    print (pt.X),pt.Y,0
                
                print ("-----")
                print ("predecessors[node].ID"),predecessors[node].ID
                for pt in predecessors[node].GetGeometry():
                    print (pt.X),pt.Y,0
                print ("-----")
                
                print ("FindPath".error)   
            path.append(node)
            #print ("FindPath node.ID"),node.ID
            node = predecessors[node]
        path.reverse()
        if path[0] == start:

            return path
        else:
            
            return []
        

    ###########
    ### Help Func： Intialization 
    ###########
    
    ###### Get threshold
    @staticmethod
    def GetRoadFindingThreshold(boundary, idealArea,percentageRF):

        totalArea = rg.AreaMassProperties.Compute(boundary.ToPolylineCurve()).Area
        estimatedMaxNum = totalArea/idealArea
        estimatedMaxDepth = math.log(estimatedMaxNum, math.e) / math.log(2, math.e)
        roadFindingThreshold = estimatedMaxDepth * percentageRF
        
        if percentageRF ==1 :
            print ("roadFindingThreshold:"), 999999
            print ("estimatedMaxDepth:"), estimatedMaxDepth
            return 99999
        
        print ("Estimated Max Depth:"), estimatedMaxDepth
        print ("RoadFinding Threshold:"), roadFindingThreshold
        return roadFindingThreshold
    
    @staticmethod
    def GetselectedEdgeIndices(catList):
        selectedEdgeIndices = [] 
        for i in range(len(catList)):
            if catList[i] != None and catList[i]!= 6:
                selectedEdgeIndices.append(i)
        return selectedEdgeIndices

    @staticmethod
    def SetInitialStreets(PC,allIntialEdgesAreRoad, crv, selectedEdgesIndices, p0, E_Dict_L0, streetGraph_L0):
        if allIntialEdgesAreRoad:
            allEdgeIDLists = PC.ProcessMesh().GetCombindedEgdeIndices(crv)
            allStreets = RF.InitializedStreets(p0, allEdgeIDLists, E_Dict_L0, streetGraph_L0)
        else:
            # Check if reverse needed
            # if crv.ToPolylineCurve().ClosedCurveOrientation().ToString() == "Clockwise":
            #     selectedEdgesIndices = [crv.SegmentCount - 1 - index for index in selectedEdgesIndices]
                
            
            allEdgeIDLists = [[index] for index in selectedEdgesIndices]
            allStreets = RF.InitializedStreets(p0, allEdgeIDLists, E_Dict_L0, streetGraph_L0)
        
        [streetGraph_L0.AddStreet(street, E_Dict_L0) for street in allStreets]
    
        
    @staticmethod
    def InitializedStreets(firstParcel,allEdgeIDLists,E_Dict_L0,streetGraph_L0):
        initializedStreets = []
        
        for edgeIDList in allEdgeIDLists:
            ### one list to be one street
            edgeCollection = []
            for edgeID in edgeIDList:
                
                edgeCollection.append(firstParcel.edges[edgeID])
            newStreet = RF.Street.CreateStreet(edgeCollection,E_Dict_L0,streetGraph_L0)
            newStreet.original = True
            newStreet.naked = True
            initializedStreets.append(newStreet)
        return initializedStreets
        

    ###########
    ### Help Func： Before Road Finding
    ###########
    @staticmethod
    def UpdateSideInfo (currQ,E_Dict_All,sameSideList):
        
        for pF in currQ:

            # print "UpdateSideInfo, before",pF.sides
            pF.GetSide(E_Dict_All)
            pF.CombineSide(E_Dict_All,sameSideList)
            # print "UpdateSideInfo, after",pF.sides
    

 
    ##################################################
    ### Cluster road finding
    ##################################################
    #########################
    ### I - L Path 
    #########################
    @staticmethod
    def TryClusterRoadFinding(GRP,clusterColletion,EDict):
        
        ### Create num related clusters
        # relatedNumClusters = []
        # for cluster in clusterColletion:
        #     relatedNumClusters.append([cluster,len(cluster)])
        
        # relatedNumClusters = sorted(relatedNumClusters,key=lambda x: (-x[1]))  ### cluster, num
        # relatedNumCluster_Sorted = [relatedNumCluster[0] for relatedNumCluster in relatedNumClusters]  
        
        mutualPath = None
        if len(clusterColletion) == 1:
            #print ("in TryClusterRoadFinding len(clusterColletion) == 1"),[pF.ID for pF in clusterColletion[0]]
            mutualPath,treatedNum = RF.TryGetMutualPath(GRP,clusterColletion[0],[],EDict)  ### input a empty list for the next cluster
        
        elif len(clusterColletion) != 1:    
            #print ("in TryClusterRoadFinding len(clusterColletion) != 1"),len(clusterColletion),[len(collection) for collection in clusterColletion]
            
            for i in range(len(clusterColletion)-1):
                #print ("in currCollection"),  [pF.ID for pF in clusterColletion[i]],("in nextCollection"),[pF.ID for pF in clusterColletion[i+1]]
                mutualPath,treatedNum = RF.TryGetMutualPath(GRP,clusterColletion[i],clusterColletion[i+1],EDict)
                

                if mutualPath !=None: 
                    break
                else:
                    pass
                
                if i == len(clusterColletion)-2:
                    lastSecondMutualPath = mutualPath
                    lastSecondTreatedNum = treatedNum
                
            if mutualPath == None:
                lastMutualPath,lastTreatedNum = RF.TryGetMutualPath(GRP,clusterColletion[len(clusterColletion)-1],[],EDict)
                if lastTreatedNum>lastSecondTreatedNum:
                    mutualPath = lastMutualPath
                else:
                    mutualPath = mutualPath
                
        
        if mutualPath!=None:
            mutualPathList = mutualPath[0]

        # else:
        #     mutualPathList = None


        return mutualPathList

    @staticmethod
    def TryGetMutualPath(GRP,currCluster,nextCluster,EDict):
        inaccessibleParcels = [parcel for parcel in currCluster]
        mutualEdges_Extended = RF.GetExtendedMutualEdges(inaccessibleParcels,EDict)
        
        #print ("in new TryGetMutualPath, printing mutualEdges")
        #print ([pE.ID for pE in mutualEdges])
        # for pE in mutualEdges:
        #     for pt in pE.GetGeometry():
        #         print (pt.X),pt.Y,0
        #     print ("-----") 
            
        ####### Check if the simplest case
        if len(mutualEdges_Extended) == 1 and len(inaccessibleParcels) ==2:
            pathCollection =[]
            
            thisPath = deque()
            thisPath.append(mutualEdges_Extended[0])
            currAngleCost = 0
            currTreatedNum = 2
            finalParcel = None
            thisSolution = [thisPath, currAngleCost,currTreatedNum,finalParcel]
            pathCollection.append(thisSolution)   
        
        #### global info 
        unionRegion = RF.GetUnionRegion(inaccessibleParcels)
        
        ####### I path
        oneSideNakedMutualEdges = RF.GetOneSideNakedMutualEdges(unionRegion,mutualEdges_Extended)  #### global info 
        allEdges = RF.GetAllEdges(inaccessibleParcels,EDict)
        #IPathCollection = RF.FindIPathColletion(GRP,oneSideNakedMutualEdges,inaccessibleParcels,EDict,60)
        IPathCollection = RF.FindIPathColletion(GRP,oneSideNakedMutualEdges,allEdges,inaccessibleParcels,EDict,60)
        IPathCollection_Sorted = sorted(IPathCollection,key=lambda x: (-x[1], x[2]))
        
        # print ("in new TryGetMutualPath, printing IPathCollection_Sorted")
        # for solution in IPathCollection_Sorted:
        #     print ("solutionGeometry")
        #     for pE in solution[0]:
        #         for pt in pE.GetGeometry():
        #             print (pt.X),pt.Y,0
        #         print ("-----") 
          
        #     print ("TreatedNum"),(solution[1])
        #     print ("AngleCost"),(solution[2])
        #     print ("-------")
        fullAccessIPath = None
        
        for i in range(len(IPathCollection_Sorted)):
            #print ("ALLIPath") ,[edge.ID for edge in IPathCollection_Sorted[i][0]] 
            if IPathCollection_Sorted[i][1] == len(currCluster):
                fullAccessIPath = IPathCollection_Sorted[i]
                #print ("fullAccessIPath"), [edge.ID for edge in fullAccessIPath[0]]
                return fullAccessIPath, IPathCollection_Sorted[i][1]
        
        #print ("fullAccessIPath") ,fullAccessIPath  
       
        ####### L path
        if fullAccessIPath == None:
            fullNakedEdges,allEdges = RF.GetFullNakedEdges(unionRegion,inaccessibleParcels,EDict)
            # print ("in new TryGetMutualPath, Lpath, printing fullNakedEdges")
            # print ([pE.ID for pE in fullNakedEdges])
            # for pE in fullNakedEdges:
            #     for pt in pE.GetGeometry():
            #         print (pt.X),pt.Y,0
            #     print ("-----") 
 
            LPathCollection = RF.FindLPathColletion(GRP,inaccessibleParcels,fullNakedEdges,allEdges,EDict)
            LPathCollection_Sorted = sorted(LPathCollection,key=lambda x: (-x[1], x[2]))
            fullAccessLPath = None
            
            for i in range(len(LPathCollection_Sorted)):
                #print ("LPathCollection_Sorted[i][2] == len(currCluster)") ,LPathCollection_Sorted[i][1],LPathCollection_Sorted[i][2] , len(currCluster)
                if LPathCollection_Sorted[i][1] == len(currCluster):
                    fullAccessLPath = LPathCollection_Sorted[i]
                    return fullAccessLPath, LPathCollection_Sorted[i][1]
            
        ### Can not tackle all parcels
        if fullAccessIPath == None and fullAccessLPath == None:
            combinedAccessPath = []
            combinedAccessPath.extend(IPathCollection_Sorted) 
            combinedAccessPath.extend(LPathCollection_Sorted) 
            combinedCollection_Sorted = sorted(combinedAccessPath,key=lambda x: (-x[1], x[2]))
            # Check if the tackle num is >= next cluster num
            #print ("combinedCollection_Sorted[0][1] >= len(nextCluster)"),combinedCollection_Sorted[0][1] , len(nextCluster)

            if combinedCollection_Sorted[0][1] >= len(nextCluster):
                return combinedCollection_Sorted[0], combinedCollection_Sorted[0][1]
            
            else:
                return None,None


            
    @staticmethod
    def FindIPathColletion(GRP,oneSideNakedMutualEdges,relatedParcEdges,inaccessibleParcels,EDict,angleThreshold = 60):
        IpathCollection = []
        ### only 2 parcels, 1 mutual edge
    
        for currNakedMutualEdge in oneSideNakedMutualEdges:
            thisSolution = RF.FindIPath(GRP,currNakedMutualEdge,relatedParcEdges,inaccessibleParcels,EDict,angleThreshold = 60)
            IpathCollection.append(thisSolution)  

        return IpathCollection

    @staticmethod
    def FindIPath(GRP,currEdge,relatedParcEdges,inaccessibleParcels,EDict,angleThreshold = 60):
        #print ("in FindIPath ,startEdgeID"), currEdge.ID
        currAngleCost = 0
        thisPath = deque()
        thisPath.append(currEdge)
        
        currRelatedParcEdges = [pE for pE in relatedParcEdges]

        currRelatedParcEdgeGraph = GRP.ParcEdgeGraph.CreateRelatedEdgeGraph(currRelatedParcEdges)
        currRelatedParcEdgeAngleGraph = currRelatedParcEdgeGraph.CreateParcEdgeAngleGraph()

        whileCount = 0 
        while len(currRelatedParcEdgeAngleGraph.graph[thisPath[-1]].keys()) > 0: 
            whileCount+=1
            if whileCount == 30 :
                print ("FindIPath,whileCount == 30").error
                break 
            allNbEdges = currRelatedParcEdgeAngleGraph.graph[thisPath[-1]].keys()
            allNbAngles = currRelatedParcEdgeAngleGraph.graph[thisPath[-1]].values()
            
         
            #print ("in FindIPath ,allNbEdges"), [edge.ID for edge in allNbEdges]
            
            minAngle = min(allNbAngles)
            minIndex = allNbAngles.index(minAngle) 
            selectedEdge = allNbEdges[minIndex]
            
            #print ("minAngle < angleThreshold"), minAngle < angleThreshold
            if minAngle < angleThreshold:
                currAngleCost += minAngle
                thisPath.append(selectedEdge)
                #print ("thisPath.append(selectedEdge)"),selectedEdge.ID
            
            else: 
                break
     
            
            # print ("prevRelatedParcEdges"),[edge.ID for edge in prevRelatedParcEdges]
            # print ("currRelatedParcEdges before remove"),[edge.ID for edge in currRelatedParcEdges]
            
            ### Update currRelatedParcEdges
            
            #Related with thisPath[-2]
            avoidReturnEdges = currRelatedParcEdgeGraph.graph[thisPath[-2]].keys()
            avoidReturnEdges.remove(thisPath[-1])
            avoidReturnEdges.append(thisPath[-2])
            
            #print ("thisPath"),[pE.ID for pE in thisPath]
            for edge in avoidReturnEdges:
                #print ("in avoidReturnEdges"),edge.ID
                currRelatedParcEdges.remove(edge)
                
            currRelatedParcEdgeGraph = GRP.ParcEdgeGraph.CreateRelatedEdgeGraph(currRelatedParcEdges) 
            currRelatedParcEdgeAngleGraph = currRelatedParcEdgeGraph.CreateParcEdgeAngleGraph()

        
        ##### check how many parcels this path treated 
        treatedNum = RF.CheckTreatedParcelNum(thisPath,inaccessibleParcels,EDict)
        thisSolution = [thisPath,treatedNum,currAngleCost]
        #print ("------")
        return thisSolution

    @staticmethod
    def FindIPath_ForL(GRP,currEdge,relatedParcEdges,inaccessibleParcels,EDict,angleThreshold = 60,anthorPairEdge = None):
        #print ("in FindIPath ,startEdgeID"), currEdge.ID
        currAngleCost = 0
        thisPath = deque()
        thisPath.append(currEdge)
        
        currRelatedParcEdges = [pE for pE in relatedParcEdges]

        currRelatedParcEdgeGraph = GRP.ParcEdgeGraph.CreateRelatedEdgeGraph(currRelatedParcEdges)
        currRelatedParcEdgeAngleGraph = currRelatedParcEdgeGraph.CreateParcEdgeAngleGraph()

        
        if anthorPairEdge!=None:
            currEdge_nbEdges = currRelatedParcEdgeGraph.graph[currEdge].keys()
            anotherEdge_nbEdges = currRelatedParcEdgeGraph.graph[anthorPairEdge].keys()
            
            commonEdge = list(set(currEdge_nbEdges).intersection( set(anotherEdge_nbEdges)) )
            
            for edge in commonEdge:
                currRelatedParcEdges.remove(edge)
            currRelatedParcEdges.remove(anthorPairEdge)
            #print ("remove"),[pE.ID for pE in commonEdge],anthorPairEdge.ID
        
            currRelatedParcEdgeGraph = GRP.ParcEdgeGraph.CreateRelatedEdgeGraph(currRelatedParcEdges)
            currRelatedParcEdgeAngleGraph = currRelatedParcEdgeGraph.CreateParcEdgeAngleGraph()
  
        
         
        whileCount = 0        
        while len(currRelatedParcEdgeAngleGraph.graph[thisPath[-1]].keys()) > 0: 
            
            whileCount+=1
            if whileCount == 30 :
                print ("FindIPath_ForL,whileCount == 30").error
                 
            
            allNbEdges = currRelatedParcEdgeAngleGraph.graph[thisPath[-1]].keys()
            allNbAngles = currRelatedParcEdgeAngleGraph.graph[thisPath[-1]].values()
            
            # ### Check the one should be removed. the previous one
            # if len(thisPath) >=2:
            #     removedEdge = thisPath[-2]
            #     removedIndex = allNbEdges.index(removedEdge)
            #     allNbEdges.pop(removedIndex)
            #     allNbAngles.pop(removedIndex)
            #     if len(allNbEdges) == 0:
            #         break
            
            #print ("in FindIPath ,allNbEdges"), [edge.ID for edge in allNbEdges]
            
            minAngle = min(allNbAngles)
            minIndex = allNbAngles.index(minAngle) 
            selectedEdge = allNbEdges[minIndex]
            
            #print ("minAngle < angleThreshold"), minAngle < angleThreshold
            if minAngle < angleThreshold:
                currAngleCost += minAngle
                thisPath.append(selectedEdge)
                #print ("thisPath.append(selectedEdge)"),selectedEdge.ID
            
            else: 
                break
            
            # prevRelatedParcEdges = currRelatedParcEdges
            # prevRelatedParcEdgeGraph = currRelatedParcEdgeGraph
            # prevRelatedParcEdgeAngleGraph = currRelatedParcEdgeAngleGraph
            
            # print ("prevRelatedParcEdges"),[edge.ID for edge in prevRelatedParcEdges]
            # print ("currRelatedParcEdges before remove"),[edge.ID for edge in currRelatedParcEdges]
            
            ### Update currRelatedParcEdges
            
            #Related with thisPath[-2]
            avoidReturnEdges = currRelatedParcEdgeGraph.graph[thisPath[-2]].keys()
            avoidReturnEdges.remove(thisPath[-1])
            avoidReturnEdges.append(thisPath[-2])
            
            #print ("thisPath"),[pE.ID for pE in thisPath]
            for edge in avoidReturnEdges:
                #print ("in avoidReturnEdges"),edge.ID
                currRelatedParcEdges.remove(edge)
                
            currRelatedParcEdgeGraph = GRP.ParcEdgeGraph.CreateRelatedEdgeGraph(currRelatedParcEdges) 
            currRelatedParcEdgeAngleGraph = currRelatedParcEdgeGraph.CreateParcEdgeAngleGraph()

        
        ##### check how many parcels this path treated 
        treatedNum = RF.CheckTreatedParcelNum(thisPath,inaccessibleParcels,EDict)
        thisSolution = [thisPath,treatedNum,currAngleCost]
        #print ("------")
        return thisSolution


    @staticmethod
    def FindLPathColletion(GRP,inaccessibleParcels,fullNakedEdges,allEdges,EDict):
        validPairs,pairAngles = RF.GetLPathStartPair (GRP,fullNakedEdges,0)
        # print ("FindLPathColletion")
        # print ("in new TryGetMutualPath,Lpath, printing validPairs")
        # for pair in validPairs:
        #     print (pair[0],pair[1])
        
        LpathCollection = []
        
        # #Global 
        # currEdgeGraph = GRP.ParcEdgeGraph.CreateRelatedEdgeGraph(fullNakedEdges)  
        # currEdgeAngleGraph = currEdgeGraph.CreateParcEdgeAngleGraph()
        
        for i in range(len(validPairs)):
            
            currPair = validPairs[i]
            #print ("start"),currPair[0].ID,currPair[1].ID
            firstIPath = RF.FindIPath_ForL(GRP,currPair[0],allEdges,inaccessibleParcels,EDict,60,currPair[1])
            #print ("firstIPath"),[edge.ID for edge in firstIPath[0]]
            
            secondIPath = RF.FindIPath_ForL(GRP,currPair[1],allEdges,inaccessibleParcels,EDict,60,currPair[0])
            #print ("secondIPath"),[edge.ID for edge in secondIPath[0]]
            
            ###path
            firstIPath_Instances = firstIPath[0]
            secondIPath_Instances = secondIPath[0]

            combinedLPath_Instances = []
            
            firstIPath_Instances = list(firstIPath_Instances)
            secondIPath_Instances = list(secondIPath_Instances)
            
            firstIPath_Instances.reverse()
            combinedLPath_Instances.extend(firstIPath_Instances)
            combinedLPath_Instances.extend(secondIPath_Instances)
            
            for elem in combinedLPath_Instances:
                if combinedLPath_Instances.count(elem) > 1:
                    print("combinedLPath_Instances duplicated element!")
                else:
                    pass
                    
            
            
            ###treatedNum
            treatedNum = RF.CheckTreatedParcelNum(combinedLPath_Instances,inaccessibleParcels,EDict)
            
            ###angleCost
            firstAngleCost = firstIPath[2]
            secondAngleCost = secondIPath[2]
            totalAngleCost = firstAngleCost + secondAngleCost + pairAngles[i]
            
            LpathCollection.append([combinedLPath_Instances,treatedNum,totalAngleCost]) 
            # print ("combinedLPath_Instances"),[edge.ID for edge in combinedLPath_Instances]
            # print ("treatedNum"),treatedNum
        return LpathCollection
            
    #########################
    ### Edge Collection 
    #########################

    ### for I path
    @staticmethod
    def GetExtendedMutualEdges(inaccessibleParcels,EDict):
        #print ("in GetExtendedMutualEdges")
        
        # Collect mutual edges
        allEdgeIDAndTwinIDs = []
        
        for pF in inaccessibleParcels:
            for edge in pF.edges:
                allEdgeIDAndTwinIDs.append(edge.ID)

        mutualEdges = []
        for pF in inaccessibleParcels:
            #print ("pF.ID"), pF.ID,pF.sides
            for edge in pF.edges:
                # print ("edge.ID"), edge.ID
                if edge.ID in allEdgeIDAndTwinIDs and edge.twinID in allEdgeIDAndTwinIDs:  ### meaning it is a mutual edge
                    if edge not in mutualEdges and EDict[edge.twinID] not in mutualEdges: ### if the either one is not in the collection ,append it  
                        mutualEdges.append(edge)  
                        
                        # print ("mutualEdges.append(edge)" ),edge.ID
                        #print ("Get a mutual edge"),edge.ID
                        #print ("this parcel side"),pF.sides
                        #### check side to extend parcEdge collection
                        
                        
                    for currSide in pF.sides:
                        if edge.naked == False and (edge.ID in currSide or edge.twinID in currSide):
                            chosenSide = currSide
                        elif edge.naked ==True and edge.ID in currSide:
                            chosenSide = currSide
                            
                    #print ("chosenSide" ),chosenSide
                    for edgeIndex in chosenSide:
                        thisEdge = EDict[edgeIndex]
                        # print ("chosenSide thisEdge" ),edgeIndex
                        if thisEdge not in mutualEdges  and EDict[thisEdge.twinID] not in mutualEdges:
                            mutualEdges.append(thisEdge)  
                            # print ("mutualEdges.append(thisEdge)" )   ,thisEdge.ID

        
        
        #print [edge.ID for edge in mutualEdges]
        
        
        return mutualEdges

    @staticmethod
    def GetOneSideNakedMutualEdges(unionRegion,mutualEdges):

        #print ("GetOneSideNakedMutualEdges")
        #print [edge.ID for edge in mutualEdges]
        # Collect naked mutual edges
        nakedMutualEdges = []
        
        for edge in mutualEdges:
            #print edge.ID
            
            closestStartPt = unionRegion.ClosestPoint(edge.startVertex.geometry)
            closestEndPt = unionRegion.ClosestPoint(edge.endVertex.geometry)
            #print closestStartPt
            #print closestEndPt
            
            distanceStart  = closestStartPt.DistanceTo(closestStartPt)
            distanceEnd  = closestEndPt.DistanceTo(closestEndPt)    
            
            #print distanceStart,distanceEnd
            if distanceStart <= 0.001 or distanceEnd <= 0.001 :
                if edge.naked != True:                      # avoid having naked mutual edges
                    nakedMutualEdges.append(edge)

        return nakedMutualEdges

    ### for L path
    @staticmethod
    def GetFullNakedEdges(unionRegion,inaccessibleParcels,EDict):
        #print ("GetFullNakedEdges") 
        
        # print ("unionRegion")
        # for pt in unionRegion:
        #     print (pt.X),pt.Y,0


        allEdges = []
        for pF in inaccessibleParcels:
            for edge in pF.edges:
                if edge.naked ==True and edge not in allEdges:
                    allEdges.append(edge)
                elif edge.naked == False and edge not in allEdges and EDict[edge.twinID] not in allEdges:
                    allEdges.append(edge)
        
        #print ("len(allEdges)"),len(allEdges)

        fullNakedEdges = []
        for edge in allEdges:
            closestStartPt = unionRegion.ClosestPoint(edge.startVertex.geometry)
            closestEndPt = unionRegion.ClosestPoint(edge.endVertex.geometry)
            
            distanceStart  = closestStartPt.DistanceTo(edge.startVertex.geometry)
            distanceEnd  = closestEndPt.DistanceTo(edge.endVertex.geometry)    
            
            #print ("distanceStart,distanceEnd"),distanceStart,distanceEnd
            if distanceStart <= 0.001 and distanceEnd <= 0.001 :
                #print ("distanceStart,distanceEnd"),edge.ID,distanceStart,distanceEnd
                if edge.naked != True:                      # avoid having naked mutual edges
                    fullNakedEdges.append(edge)
        
        return fullNakedEdges,allEdges

    @staticmethod
    def GetAllEdges(inaccessibleParcels,EDict):
        allEdges = []
        for pF in inaccessibleParcels:
            for edge in pF.edges:
                if edge.naked ==True and edge not in allEdges:
                    allEdges.append(edge)
                elif edge.naked == False and edge not in allEdges and EDict[edge.twinID] not in allEdges:
                    allEdges.append(edge)
        return allEdges
        
    @staticmethod
    def GetLPathStartPair(GRP,fullNakedEdges,angleThreshold = 0):
        # print ("GetLPathStartPair")
        currEdgeGraph = GRP.ParcEdgeGraph.CreateRelatedEdgeGraph(fullNakedEdges)  
        currAngleEdgeGraph = currEdgeGraph.CreateParcEdgeAngleGraph()
        # print ("fullNakedEdges") , len(fullNakedEdges)
        #print ("currEdgeGraph"),[edge.ID for edge in currEdgeGraph.graph.keys()]
        
        validPairs = []  
        
        for currEdge in currEdgeGraph.graph.keys():
            #print ("currEdge"),currEdge.ID
            nbEdges = currEdgeGraph.graph[currEdge]
            #print ("nbEdges"),[edge.ID for edge in nbEdges]
            
   
            for nbEdge in nbEdges:
                if currAngleEdgeGraph.graph[currEdge][nbEdge] > angleThreshold:
                    validPair = [currEdge,nbEdge]
                    validPairs.append(validPair)
        
       
        
        validPairs_Clean = []
        validPairs_Clean_ID = []
        
        pairAngles = []
        for pair in validPairs:
            if [pair[0],pair[1]] not in validPairs_Clean and [pair[1],pair[0]] not in validPairs_Clean:
                validPairs_Clean.append(pair)
                pairAngles.append(currAngleEdgeGraph.graph[pair[0]][pair[1]])
                
                validPair_ID = [pair[0].ID,pair[1].ID]
                validPairs_Clean_ID.append(validPair_ID)
                
        #print ("validPairs_Clean_ID"), validPairs_Clean_ID
        # print ("pairAngles"),pairAngles
        
        return validPairs_Clean,pairAngles



    #########################
    ### Info HelpFunc
    #########################
    
    @staticmethod
    def CheckTreatedParcelNum(thisPath,inaccessibleParcels,EDict):
        treatedNum = 0 
        
        for parcel in inaccessibleParcels:
            for edge in parcel.edges:
                if edge.naked == False and (edge in thisPath or EDict[edge.twinID] in thisPath):
                    treatedNum+=1
                    break
                elif edge.naked ==True and edge in thisPath :
                    treatedNum+=1
                    break
        
        return treatedNum

    @staticmethod
    def GetUnionRegion(inaccessibleParcels):
        # Get the RegionUnion
        geoCollection = []
        
        for pF in inaccessibleParcels:
            geoCollection.append(pF.GetGeometry().ToPolylineCurve())
            
        unionRegion = rg.Curve.CreateBooleanUnion(geoCollection)[0]
        unionRegion = unionRegion.TryGetPolyline()[1]
        
        # print ("unionRegion")
        # for pt in unionRegion:
        #     print (pt.X),pt.Y,0
        # print ("finish printing unionRegion")
        return unionRegion


    ###########
    ### Help Func：Print 
    ###########
    
    @staticmethod
    def PrintInaccessibleParcels(currQ,EDict):
        ######## For diagram, show each depth inaccessible parcle clusters
        for parcel in currQ:
            RF.CheckAccessibility(parcel,EDict)
        inaccessibleParcels = RF.CollectAllInaccesibleParcels(currQ)
        clusterParcelCollection,clusterEdgeCollection = RF.ClusterInAccessibleParcels(inaccessibleParcels)
        
        parcelNum = []
        for cluster in clusterParcelCollection:
            parcelNum.append(len(cluster)) 
        
        print ("InaccessibleParcels parcelNum"), parcelNum    
        for parcelCluster in clusterParcelCollection:
            for parcel in parcelCluster:
                for pt in parcel.GetGeometry():
                    print (pt.X), pt.Y,0
                print ("-----")
# ---------- end ghpython_script_14 ----------
cluster = Cluster_5()  # disabled
minelongation = GetNumber(min_elongation, AtLeast=1, AtMost=1, Maximum=1.797693135e+308, Minimum=-1.797693135e+308, TreeAccess=False)
firstroad_2 = GetBoolean(firstroad, AtLeast=1, AtMost=1, FalseValue="False", TreeAccess=False, TrueValue="True")
coords = GetString(panel, AtLeast=1, AtMost=1, TreeAccess=False)
# Min area and ideal orientation
panel_2 = Panel("12500")

# ----
# first%
# second% will be 1-first%
road_percentage = Panel("1")
roads = GetNumber(road_percentage, AtLeast=1, AtMost=1, Maximum=1.797693135e+308, Minimum=-1.797693135e+308, TreeAccess=False)

streamline = GetBoolean(specificstreamlinetoggle, AtLeast=1, AtMost=1, FalseValue="False", TreeAccess=False, TrueValue="True")
pointay = GetNumber("153995.792942266", AtLeast=1, AtMost=1, Maximum=1.797693135e+308, Minimum=-1.797693135e+308, TreeAccess=False)
pointbx = GetNumber("11558651.038917674", AtLeast=1, AtMost=1, Maximum=1.797693135e+308, Minimum=-1.797693135e+308, TreeAccess=False)
pointax = GetNumber("11558311.947287912", AtLeast=1, AtMost=1, Maximum=1.797693135e+308, Minimum=-1.797693135e+308, TreeAccess=False)
pointby = GetNumber("154402.28424696176", AtLeast=1, AtMost=1, Maximum=1.797693135e+308, Minimum=-1.797693135e+308, TreeAccess=False)
# GIS_INPUT
ghpython_script_15 = GhPythonScript(input_string=coords)  # -> out, inputPolyline
# ---------- ghpython_script_15: Python ----------
import Rhino.Geometry as rg
#import Rhino.RhinoDoc as rd
import Rhino.RhinoMath as rm

# Added by Anna vvv
x_val = []
y_val = []
inputGIS = []
items = input_string.split(',')

for i in range(len(items)):
    print items[i]
    if i%2 == 0:
        x_val.append(float(items[i]))
    else:
        y_val.append(float(items[i]))

for i in range(len(x_val)):
    inputGIS.append([x_val[i], y_val[i]])
# Added by Anna ^^^

"""
inputGIS = [ [11572150.257125726,150540.92751019588],
          [11572293.031019911,150415.32117484743],
          [11572368.605708903,150244.4983472939],
          [11571811.542666271,149810.67580068656],
          [11571493.165541334,150216.41114526242],
          [11571905.981938206,150348.29488085952],
          [11572150.257125726,150540.92751019588]]
"""

inputVertices = []

for list in inputGIS:
    inputVertices.append(rg.Point3d(list[0],list[1],0))

inputPolyline = [rg.Polyline(inputVertices)]
# ---------- end ghpython_script_15 ----------

# ---- group: Simutalte the input. Replace with JS input
# Road Cat
cluster_2 = Cluster_4(curve=ghpython_script_15.inputPolyline)

# ----
edgecat = GetString(cluster_2, AtLeast=1, AtMost=1, TreeAccess=False)
ghpython_script_16 = GhPythonScript(input_string=edgecat)  # -> out, catList
# ---------- ghpython_script_16: Python ----------
__author__ = "Anna Yenardi"
__version__ = "2023.03.30"

import rhinoscriptsyntax as rs
catList = input_string.split(',')
# ---------- end ghpython_script_16 ----------
minarea = GetInteger(panel_2, AtLeast=1, AtMost=1, Maximum=2147483647, Minimum=-2147483648, TreeAccess=False)
orientation_2 = GetInteger("0", AtLeast=1, AtMost=1, Maximum=2147483647, Minimum=-2147483648, TreeAccess=False)
construct_point = ConstructPoint(XCoordinate=pointax, YCoordinate=pointay, ZCoordinate=0)
construct_point_2 = ConstructPoint(XCoordinate=pointbx, YCoordinate=pointby, ZCoordinate=0)
merge = Merge(
    Data1=vanchorstrength,
    Data2=voncrvstrength,
    Data3=panchorstrength,
    Data4=roadsmoothstrength,
    Data5=roadjunctionanglestrength,
    Data6=parcelsidesmoothstrength,
    Data7=parcelsideanglestrength,
    Data8=parcelsidelengthstrength,
    Data9=parceladjacencystrength)
crv = Curve(ghpython_script_15.inputPolyline)
# Road Selection para
lengthvsangle = GetNumber("1", AtLeast=1, AtMost=1, Maximum=1.797693135e+308, Minimum=-1.797693135e+308, TreeAccess=False)
# NakedEdgeIndicies
num = Number(roads)
geometry = Geometry(construct_point_2)
geometry_2 = Geometry(construct_point)

# ---- group: Area
# Total Site Area Display
area = Area(Geometry=crv)  # -> Area, Centroid
panel_3 = Panel(area.Area)

# ---- group: lentor
ghpython_script_17 = GhPythonScript()  # -> out, catList
# ---------- ghpython_script_17: Python ----------
catList = [5,5,6,4,6,6,3,3,3,3,3,3,3,3,3]
#catList = [6,4,4,4,4]
# ---------- end ghpython_script_17 ----------

# ----
merge_2 = Merge(Data1=geometry_2, Data2=geometry)

# ---- group: Web app scale func
# Input Parcel Boundary
python = GhPythonScript(WebApp_Func=ghpython_script_2.WebApp_Func, inputPolyline=crv, userInputPair=merge_2, minArea=minarea)  # -> out, inputPolyline_New, userInputPair, scale, sourceCenter, minArea; inputs inputPolyline: Polyline, userInputPair: list of Point3d
# ---------- python: Python ----------
import Rhino.Geometry as rg
import Rhino.RhinoDoc as rd
import Rhino.RhinoMath as rm
import ghpythonlib.components as ghc
import math


userInput_A = userInputPair[0]
userInput_B = userInputPair[1]

### Prepare
closestPoint_A_t = inputPolyline.ClosestParameter(userInput_A)
closestPoint_B_t = inputPolyline.ClosestParameter (userInput_B)

Xs = []
Ys =[]
for i in range(len(inputPolyline)):
    Xs.append(inputPolyline[i].X)
    Ys.append(inputPolyline[i].Y)

maxPt = rg.Point3d(max(Xs),max(Ys),0)
minPt = rg.Point3d(min(Xs),min(Ys),0)


obbFlat = rg.Rectangle3d(rg.Plane.WorldXY,maxPt,minPt)

area = obbFlat.Area
scale = math.sqrt(area/10000)
print area

### move to origin
sourceCenter = rg.AreaMassProperties.Compute(inputPolyline.ToPolylineCurve()).Centroid
inputPolyline_New = WebApp_Func.RelocateGeoToOrigin(inputPolyline,sourceCenter)   

### scale to 100x100
sourceCenter_New = rg.AreaMassProperties.Compute(inputPolyline_New.ToPolylineCurve()).Centroid
transform = rg.Transform.Scale(sourceCenter_New,1/scale)
inputPolyline_New.Transform(transform)
#
userInput_A_New = inputPolyline_New.PointAt(closestPoint_A_t)
userInput_B_New = inputPolyline_New.PointAt(closestPoint_B_t)

userInputPair = [userInput_A_New,userInput_B_New]     # output
inputPolyline_New = [inputPolyline_New] # output



minArea = minArea/(scale**2)
# ---------- end python ----------

# ----
weights = GetString("0.6,8.8,5.2,0,0,4.2,0", AtLeast=1, AtMost=1, TreeAccess=False)
geometry_3 = Geometry(python.inputPolyline_New)
# Doubleclick Me!
ghpython_script_18 = GhPythonScript(x=weights)  # -> out, flatten(a)
# ---------- ghpython_script_18: Python ----------
__author__ = "Anna Yenardi"
__version__ = "2023.08.03"

import rhinoscriptsyntax as rs
temp = x.split(",")
a = []
for e in temp:
    a.append(float(e))
# ---------- end ghpython_script_18 ----------
custom_preview = CustomPreview(Geometry=geometry_3, Material=ColourSwatch(SwatchColor=RGB(0, 0, 0)))

# ----
# Access point detail setting
idealorientation_2 = Slider(1, range=0..10)
idealelongation = Slider(1.5, range=0..10)
idealcompactness = Slider(1, range=0..10)
idealconvexity = Slider(1, range=0..10)
populatenum = Slider(30, range=0..100)
movedist = Slider(50, range=0..200)

# ----
# EvenArea
# Elongation
# Compactness
# Convexity
# Orientation
gene_pool = GenePool(Decimals=2, Maximum=2, Minimum=0, Value=[0.7, 0.4, 0.1, 0.1, 0.1])

allintialedgesareroad = BooleanToggle(False)

# ----
# Global computation setting
# global resolution control
# streamline spacing control
# maxium depth control
# Streamline split detail control
# Streamline split final result fliter
# Postprocess para
# Road Finding Para
resolution = Slider(30, range=0..30)
max_depth = Slider(100, range=0..100)
issurance = Slider(10000, range=0..10000)
areatol = Slider(0.8, range=0..1)
minconvexity = Slider(0.5, range=0..10)
mincompactness = Slider(0.5, range=0..10)
minorientation = Slider(0.5, range=0..10)
allowtop = Slider(20, range=0..20)
thresholdlvarrate = Slider(0.2, range=0..1)
# AllIntialEdgesAreRoad
sidelengthpercentage = Slider(0.2, range=0..1)
percentagerf = Slider(1, range=0..1)
disablerate = Slider(0.8, range=0..1)
pi = Pi(Factor=Slider(0.5, range=0..1))
multiplication = Multiplication(A=minorientation, B=pi)

# ----
# Access Points
ghpython_script_19 = GhPythonScript(
    PC=ghpython_script_3.PC,
    DM=ghpython_script_4.DM,
    SLG=ghpython_script_5.SLG,
    EV=ghpython_script_6.EV,
    EV_AccessPoint=ghpython_script.EV_AccessPoint,
    resolution=resolution,
    inputPolyline=python.inputPolyline_New,
    userInputPair=python.userInputPair,
    moveDist=movedist,
    populateNum=populatenum,
    idealElongation=idealelongation,
    idealCompactness=idealcompactness,
    idealConvexity=idealconvexity,
    idealOrientation=idealorientation_2,
    weight=gene_pool)  # -> out, Initialize_nodes, nodes, segments, Try_Compute_streamline, streamlineA, validity_A, streamlineB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; inputs inputPolyline: Polyline, divNum: Int32, userInputPair: list of Point3d, weight: list
# ---------- ghpython_script_19: Python ----------
###########################
####    Import Libs    ####
###########################
import Rhino.Geometry as rg
import Rhino.RhinoDoc as rd
import Rhino.RhinoMath as rm


###########################
####    Description    ####
###########################
### Evaluation_AccessPoint : Evaluation_AccessPoint
### This is a script to get a split line based on the pair of access point input


###########################
####        Code       ####
###########################

### Sort the input order

EV_AccessPoint.EnsureCounterClockwise(inputPolyline)

### Try Compute streamline
processMesh = PC.ProcessMesh()
processMesh.InitializeInput(inputPolyline,resolution*1.5)  


mappingGrid = DM.MappingGrid()
mappingGrid.CreateMappingGrid(inputPolyline,20,5)  #rows,columns 
mappingGrid.GetOverlappedTriangleIndex(processMesh,2)  #detectRadius 


seedpointList = SLG.SeedpointList()
seedpointList.CreateSeedpointList(processMesh,1,1)  #reduce points onEdge, on MA

streamlineNetwork=SLG.StreamlineNetwork()



closestPoint_A = inputPolyline.ClosestPoint (userInputPair[0])
closestPoint_B = inputPolyline.ClosestPoint (userInputPair[1])

streamlineA = streamlineNetwork.GetStreamlineOnSpecificPoint(closestPoint_A,mappingGrid,processMesh,2)
streamlineB = streamlineNetwork.GetStreamlineOnSpecificPoint(closestPoint_B,mappingGrid,processMesh,2)


### Detect Location 
validity_A = EV_AccessPoint.CheckStreamLineValidity (PC,inputPolyline,streamlineA,closestPoint_A,closestPoint_B)
validity_B = EV_AccessPoint.CheckStreamLineValidity (PC,inputPolyline,streamlineB,closestPoint_A,closestPoint_B)

### Connect point to get a straight line 
strightLine = rg.Line(closestPoint_A,closestPoint_B)

### Check if straight line valid
validity_Straight = EV_AccessPoint.CheckStrightLineValidity(strightLine,inputPolyline)


### Check if the user is satisfied with this straight line
 
### Create A detect Region and Populate random points to form BezierCrvs
detectRegion = EV_AccessPoint.GetDetectRegion(strightLine,moveDist)

bCurveList_Valid,randomPoints,bCurveList = EV_AccessPoint.GetBezierCrvOptions(detectRegion,inputPolyline,closestPoint_A,closestPoint_B,populateNum)


### Evaluate streamline Parcel Level Score

scoreResult = EV.Score_ParcelLevel_A(bCurveList_Valid,inputPolyline,idealElongation,idealCompactness,idealConvexity,idealOrientation,True,True,False,False,False)
score_EvenArea = scoreResult[0]
score_Elongation = scoreResult[1]
score_Compactness = scoreResult[2]
score_Convexity = scoreResult[3]
score_Orientation = scoreResult[4]


areaPairCollection = scoreResult[5]
elongationPairCollection = scoreResult[6]
compactnessPairCollection = scoreResult[7]
convexityPairCollection  = scoreResult[8]
orientationPairCollection = scoreResult[9]


### Remap the scores 
score_EvenArea = EV.RemapRange(score_EvenArea,1,0)
score_Elongation = EV.RemapRange(score_Elongation,1,0)
score_Compactness = EV.RemapRange(score_Compactness,1,0)
score_Convexity = EV.RemapRange(score_Convexity,1,0)
score_Orientation = EV.RemapRange(score_Orientation,1,0) 

score_Overall = EV.GetOverallScore([score_EvenArea,score_Elongation,score_Compactness,score_Convexity,score_Orientation],weight)



### Store in instances
sls = EV_AccessPoint.InitializeSplitlines(bCurveList_Valid,score_EvenArea,score_Elongation,score_Compactness,score_Convexity,score_Orientation,score_Overall,elongationPairCollection,areaPairCollection,convexityPairCollection,compactnessPairCollection,orientationPairCollection)

### Select the best
bestSl = EV_AccessPoint.SelectBestSplitline(sls)
bestSl = EV_AccessPoint.ConvertNurbcurveToPolyline(bestSl,10)

### Do the desicion and pass to next step
finalDesicion = EV_AccessPoint.DecideFinalStreamline(streamlineA,validity_A,streamlineB,validity_B,strightLine,validity_Straight,closestPoint_A,closestPoint_B,"bcrv",bestSl)


### Preview
# closestPoint_A=closestPoint_A
# closestPoint_B=closestPoint_B
# newedges = PC.ProcessMesh.GetNewEdges(inputPolyline)
# ---------- end ghpython_script_19 ----------
panel_4 = Panel(ghpython_script_19.out)

# ----
# Pass the Desicion
geometry_4 = Geometry(ghpython_script_19.finalDesicion)
# ----
# Sudivision
python_2 = GhPythonScript(
    PC=ghpython_script_3.PC,
    DM=ghpython_script_4.DM,
    SLG=ghpython_script_5.SLG,
    SPF=ghpython_script_8.SPF,
    PL=ghpython_script_7.PL,
    EV=ghpython_script_6.EV,
    RF=ghpython_script_14.RF,
    PP=ghpython_script_10.PP,
    GRP=ghpython_script_9.GRP,
    crv=python.inputPolyline_New,
    finalDesicion=geometry_4,
    firstRoad=firstroad_2,
    catList=ghpython_script_16.catList,
    allIntialEdgesAreRoad=allintialedgesareroad,
    resolution=resolution,
    disableRate=disablerate,
    percentageRF=percentagerf,
    specificStreamlineToggle=streamline,
    minArea=python.minArea,
    areaTol=areatol,
    allowTopNum=allowtop,
    minElongation=minelongation,
    minConvexity=minconvexity,
    minCompactness=mincompactness,
    minOrientation=multiplication,
    maxDepth=max_depth,
    maxIssurance=issurance,
    idealOrientation=orientation_2,
    weight=ghpython_script_18.a,
    wA=lengthvsangle,
    sideLengthPercentage=sidelengthpercentage,
    thresholdLVarRate=thresholdlvarrate)  # -> out, parcels, Solution_Collection_Space, p0, catList, collection_VP, collection_E, collection_E_All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; inputs crv: Polyline, finalDesicion: list of Polyline, catList: list, allowTopNum: Int32, maxDepth: Int32, maxIssurance: Int32, weight: list
# ---------- python_2: Python ----------
###########################
####    Import Libs    ####
###########################
import Rhino.Geometry as rg
import Rhino.RhinoDoc as rd
import Rhino.RhinoMath as rm
import Rhino.RhinoApp as ra
import time

startTime = time.time()

###########################
####    Description    ####
###########################
### Subdiv : Subdivision
### This is the script of Subdivision. It constructs the tree data structure.

###########################
####        Code       ####
###########################

##################
# Store for debug
##################
succeededTag = True

parcels=[]
streamlines = []
mergedEdgeColletion = []
mergedEdgeIDColletion = []

##################
# Create Tree
##################
tol = 0.001  

########
# Global Info: Parcellation
########
# Initialize Solution Space (for Vertex&Point,Edge,Face)
collection_VP= [] 
collection_E= [] 
collection_E_All= [] 
collection_F= [] 

# For redirection
redirectMap = {}

# Initialize the Root Node
p0 = PL.ParcFace()


p0.FormParcFace_First(crv,0,catList)
p0.name = 0
p0.depth=0

# The side info of the first node
p0.sides = PC.ProcessMesh().GetCombindedEgdeIndices(crv) 
allEdgeIDLists = PC.ProcessMesh().GetCombindedEgdeIndices(crv)
sameSideList = []
for side in p0.sides:
    if len(side) >=2:
        sameSideList.append(side)
        

# Create Global Dict for depth 0
VP_Dict_L0 = {}
VP_Istance_L0 =p0.GetVPInstance()
for instance in VP_Istance_L0:
    VP_Dict_L0[instance.ID] = instance
    
E_Dict_L0 = {}
E_Istance_L0 = p0.GetEInstance()
for instance in E_Istance_L0:
    E_Dict_L0[instance.ID] = instance
                            
currQ_Dict_L0 = {}
currQ_Dict_L0[p0.ID] = p0

# Store into collection
collection_VP.append(VP_Dict_L0)        ### they are dict
collection_E.append(E_Dict_L0)          ### they are dict
collection_E_All.append(E_Dict_L0)      ### they are dict
collection_F.append(currQ_Dict_L0)      ### they are list

# Currently this in the soluction space. It will become working space for the rest of the computation.
currQ = [p0]  


########
# Global Info: Road(Graph)
########

# Determine which depth should not force "double side connected"
#roadFindingThreshold = RF.GetRoadFindingThreshold(crv, minArea,percentageRF)
roadFindingThreshold = 99


# Initialize Solution Space (for Graph)
collection_ParcelGraph = []
collection_JunctionGraph = []
collection_ParcEdgeGraph = []
collection_StreetGraph = []

parcelGraph_L0 = GRP.ParcelGraph()                                                       # ParcelGraph 
parcelGraph_L0.graph[p0] = {}
collection_ParcelGraph.append(parcelGraph_L0)

streetGraph_L0 = GRP.StreetGraph()                                                       # StreetGraph

# Initialze streets
selectedEdgesIndices = RF.GetselectedEdgeIndices(catList)

RF.SetInitialStreets(PC,allIntialEdgesAreRoad, crv, selectedEdgesIndices, p0, E_Dict_L0, streetGraph_L0)


collection_StreetGraph.append(streetGraph_L0)

junctionGraph_L0  = GRP.JunctionGraph.CreateJunctionGraphForThisDepth(E_Dict_L0)         # JunctionGraph 
collection_JunctionGraph.append(junctionGraph_L0)

parcEdgeGraph_L0 = GRP.ParcEdgeGraph.CreateParcEdgeGraphForThisDepth(junctionGraph_L0)   # collection_ParcEdgeGraph 
collection_ParcEdgeGraph.append(parcEdgeGraph_L0)


##################
# Loop
##################
issurance = 0      # Maximun iteration times

lastDepth = 0      # Depth info
currDepth = 0      # Depth info     

# Deep copy to "working space" - Parcellation
currVP_Dict = SPF.GetDeepCopyDict_VP(VP_Dict_L0)
currE_Dict_All = SPF.GetDeepCopyDict_E_All(currVP_Dict,E_Dict_L0)
currE_Dict = SPF.GetDeepCopyDict_E(E_Dict_L0,currE_Dict_All)
currQ = SPF.GetDeepCopyParcFace_Q(currQ,currVP_Dict,currE_Dict,currE_Dict_All,redirectMap)
currQ_Dict =SPF.GetDeepCopyParcFace_Dict(currQ)

# Deep copy to "working space" - Graph
currParcelGraph = collection_ParcelGraph[-1].DeepCopy(currQ_Dict,currE_Dict)
currJunctionGraph = collection_JunctionGraph[-1].DeepCopy(currVP_Dict,currE_Dict)
currStreetGraph = collection_StreetGraph[-1].DeepCopy(currVP_Dict,currE_Dict)

# Log
print ("【【【【【【【【【【【【【【--- Moving to next depth %d---】】】】】】】】】】】】】】】】" %currDepth)
ra.WriteLine("【【【【【【【【【【【【【【--- Moving to next depth %d---】】】】】】】】】】】】】】】】" %currDepth)


while currQ[0].depth <= maxDepth:
    
#    try:
        #region Stop Condition Checking 
        ######################################
        #####  Stop Condition Checking   #####
        ######################################
        if issurance > maxIssurance:
            print ("End: Hit max issurance")
            ra.WriteLine("End: Hit max issurance")
            break
        
        allDeadTag = SPF.CheckIfAllNodesDead(currQ)
        if allDeadTag == True:
            print ("End: All nodes are dead")
            break
        #endregion

        #region Check If need Collection and DeepCopy  
        #####################################################
        #####   Check If need Collection and DeepCopy   #####
        #####################################################
        currNode = currQ[0]
        
        currDepth=max(currDepth,currNode.depth)
        
        
        if lastDepth != currDepth:

            print ("【【【【【【【【【【【【【【--- Moving to next depth %d---】】】】】】】】】】】】】】】】" %currDepth)
            ra.WriteLine("【【【【【【【【【【【【【【--- Moving to next depth %d---】】】】】】】】】】】】】】】】" %currDepth)
            

            ###################
            #   Update info after deepcopy
            ###################
            SPF.RedirectParentChildren(currQ,redirectMap)
            currQ = SPF.FindTheBottomElements_LevelOrder_Q(p0)
            RF.UpdateSideInfo (currQ,currE_Dict_All,sameSideList)
            

            ###################
            #     Merge
            ###################
            mergedEdgeIndices,mergedEdgeNewVs,mergedParcels = PP.CheckMergeEdge(PL,currQ,currE_Dict,currVP_Dict,sideLengthPercentage,mergedEdgeColletion,mergedEdgeIDColletion)
            PP.CheckStreetChangedByMerge(RF,currStreetGraph,mergedEdgeIndices,mergedEdgeNewVs)
            PP.CheckAccessibilityChangedByMerge(mergedParcels)
            PP.EraseParcelStartPointsIfMergedOrAffected(mergedParcels)
            ###################
            #     Store
            ###################
            collection_VP.append(currVP_Dict)
            collection_E.append(currE_Dict)
            collection_E_All.append(currE_Dict_All)
            collection_F.append(currQ_Dict)

            collection_ParcelGraph.append(GRP.ParcelGraph.CreateParcelGraphForThisDepth(currQ_Dict))
            collection_JunctionGraph.append(GRP.JunctionGraph.CreateJunctionGraphForThisDepth(currE_Dict)) 
            collection_ParcEdgeGraph.append(GRP.ParcEdgeGraph.CreateParcEdgeGraphForThisDepth(collection_JunctionGraph[-1])) 
            
            
            #  Once it append, update the depth (Q doesnot need to be updated)
            for instance in collection_VP[-1].values():
                instance.depth = len(collection_VP)-1
            for instance in collection_E_All[-1].values():
                instance.depth = len(collection_E_All)-1
                
            collection_ParcelGraph[-1].depth = len(collection_ParcelGraph)-1
            collection_JunctionGraph[-1].depth = len(collection_JunctionGraph)-1
            collection_ParcEdgeGraph[-1].depth = len(collection_ParcEdgeGraph)-1

            #####################################################
            #           Do Road Finding and Store          
            #####################################################
            
            
            # "double side" or not
            
            if currDepth <= roadFindingThreshold:
                RF.FindRoadForThisDepth_New(GRP,PL,currQ,collection_ParcEdgeGraph[-1],currStreetGraph,currE_Dict,wA, True)
            else:
                RF.FindRoadForThisDepth_New(GRP,PL,currQ,collection_ParcEdgeGraph[-1],currStreetGraph,currE_Dict,wA)
            
            
            collection_StreetGraph.append(currStreetGraph)

            ###################
            #     Update current variable for next depth
            ###################
            # New Instances for next depth, update the current variable
            currVP_Dict = SPF.GetDeepCopyDict_VP(currVP_Dict)
            currE_Dict_All = SPF.GetDeepCopyDict_E_All(currVP_Dict,currE_Dict_All)
            currE_Dict = SPF.GetDeepCopyDict_E(currE_Dict,currE_Dict_All)
            currQ = SPF.GetDeepCopyParcFace_Q(currQ,currVP_Dict,currE_Dict,currE_Dict_All,redirectMap)  
            currQ_Dict =SPF.GetDeepCopyParcFace_Dict(currQ)
            
            
            currStreetGraph = currStreetGraph.DeepCopy(currVP_Dict,currE_Dict)
            
            currNode = currQ[0]                                  # remember update the currNode

            SPF.RedirectNeighbors(currQ,currE_Dict,redirectMap)

            lastDepth = currDepth                                #  Update the depth 
            

        #endregion 
        
        #region Try to get a Streamline
        ##########################
        #     Try Streamline
        ##########################
        ### accessPt does not create a streamline
        if finalDesicion == []:     
            if currNode.situation==0:
                if currNode.alive == True:

                    newTriangleSize = SPF.StoreStreamlines(PC,DM,SLG,EV,currNode,currE_Dict_All,sameSideList,weight,None,idealOrientation,resolution,disableRate)
                    streamline = SPF.TryStreamlineOptions(currNode,minArea,minElongation,minConvexity,minCompactness,areaTol)
                
                else:
                    if currNode.alive == False:  ### just skip the caculation
                        streamline = None
                        
                if streamline ==None:
                    currQ.popleft()
                    
                    ### Important, Since this node fail to split without a streamline provided from "access point" . In order to move it to root and dont conflict with the exsiting , copy a new one
                    newCurrNode = currNode.DeepCopy(currVP_Dict,currE_Dict,currE_Dict_All)
                    newCurrNode.alive = False    # to avoid depth+2
                    newCurrNode.depth+=1

                    ### After Copying a new one, we need to make the new node replace the old one in their neighbors position
                    ### Mainly check "neighbors","mutualE_P","mutualP_E"
                    for node in currQ:
                        if currNode in node.neighbors:
                            ### update neighbors info
                            node.neighbors.remove(currNode)
                            node.neighbors.append(newCurrNode)
                            
                            ### update neighbors info
                            popParcFace = currNode
                            popEdge = node.mutualP_E[currNode]   ### will still keep it

                            ### Remove
                            node.mutualE_P.pop(popEdge)             
                            node.mutualP_E.pop(popParcFace)
                            
                            ### Add it back, update to the new node
                            node.mutualE_P[popEdge] = newCurrNode
                            node.mutualP_E[newCurrNode] = popEdge

                    currQ.append(newCurrNode)
                    
                    ### replace the new parc into currF_Dict
                    currQ_Dict[newCurrNode.ID] = newCurrNode
                    

            elif currNode.situation == 1:   
                #streamlines store inside, return the used triangleSize 
                newTriangleSize = SPF.StoreStreamlines(PC,DM,SLG,EV,currNode,currE_Dict_All,sameSideList,None,currNode.startPt.geometry,idealOrientation,resolution,disableRate)
                streamline = SPF.TrySpecificStreamline(EV,currNode,minArea,minElongation,minConvexity,minCompactness,0.7)
        
                if streamline == None:
                    #dont pop here , give another chance.
                    currNode.situation = 0

                else:
                    pass
        
        ### accessPt create a streamline , use it      
        elif finalDesicion!= []:
            newTriangleSize = resolution
            streamline = SLG.Streamline()
            streamline.CreateStreamlineInstance(finalDesicion[0])
            finalDesicion.pop(0)

        #endregion
        
        #region Split it with streamline
        #####################################
        ##### Split it with streamline ######
        #####################################
        if streamline != None:    
                
            if currNode.situation == 0 : #excluding Speical Case(startEdge == endEdge) already 
                ### Store the final chosen streamline into this instance
                currNode.chosenSL = streamline

                ### Check the hit position
                startEdge,endEdge,startEdgeIndex,endEdgeIndex,startSplitPointPair,endSplitPointPair,flag =SPF.DetectLocation(currNode,streamline)

                ### Get the share edges for two split parcels
                shareResult = SPF.GetNewShare(PL,currNode,streamline,currVP_Dict,currE_Dict,currE_Dict_All,startEdge,endEdge)
                shareEdge = shareResult[0]
                shareEdge_twin = shareResult[1]

                ### split the parcFace and return the new split edges
                splitResult = SPF.ConstructNewParcel_Normal(PL,currNode,currQ_Dict,currVP_Dict,currE_Dict,currE_Dict_All,shareEdge,shareEdge_twin,startEdge,endEdge,startEdgeIndex,endEdgeIndex,startSplitPointPair,endSplitPointPair,currStreetGraph)
                splitEdges_Start = splitResult[2]
                splitEdges_End = splitResult[3]

                ### Insert into tree and redirect the parent-children based on redirectMap
                SPF.InsertValue(splitResult,newTriangleSize,currQ,currQ_Dict)

                ### Check affected parcFace, the affected Edge(twin edge) will be split
                start_PF,end_PF = SPF.GetAffectedParcFace(currNode,startEdge,endEdge) 
                if start_PF!= None:
                    start_PF.startPt = shareEdge.startVertex
                    affectedEdge = startEdge
                    start_PF.UpdateAffectedInfo_Normal(shareEdge,affectedEdge,splitEdges_Start,currE_Dict,"start")
                    
                if end_PF!= None:
                    end_PF.startPt = shareEdge.endVertex
                    affectedEdge = endEdge
                    end_PF.UpdateAffectedInfo_Normal(shareEdge,affectedEdge,splitEdges_End,currE_Dict,"end")

                ## Constraint Specific streamline toggle 
                if specificStreamlineToggle == False:
                    if start_PF!= None:
                        start_PF.situation = 0
                    if end_PF!= None:
                        end_PF.situation = 0
                    
                ### Check neighbors
                parentNeighbor = currNode.neighbors
                for pneighbor in parentNeighbor:
                    SPF.CheckNeighbor(splitResult[0],pneighbor)
                    SPF.CheckNeighbor(splitResult[1],pneighbor)
                    
            elif currNode.situation == 1 :
                ### Get the share edges for two split parcels
                
                shareEdge,shareEdge_twin = SPF.GetNewShare_Constrained(PL,currNode,currVP_Dict,currE_Dict,currE_Dict_All)
                
                ### Check the hit position
                endEdge,endEdgeIndex,endSplitPointPair = SPF.DetectLocation_Constrained(currNode,shareEdge)
                startIndexPair = SPF.GetStartPtInfo(currNode)

                splitResult = SPF.ConstructNewParcel_Constrained(PL,currNode,currQ_Dict,currVP_Dict,currE_Dict,currE_Dict_All,shareEdge,shareEdge_twin,endEdge,startIndexPair,endEdgeIndex,endSplitPointPair,currStreetGraph)
                splitEdges_End = splitResult[2]
                ### Insert into tree and redirect the parent-children based on redirectMap
                SPF.InsertValue(splitResult,newTriangleSize,currQ,currQ_Dict)
        
                ### Check affected parcFace, the affected Edge(twin edge) will be split, in this case , only endPF
                end_PF = SPF.GetAffectedParcFace_Constrained(currNode,endEdge)
                
                if end_PF!= None:
                    end_PF.startPt = shareEdge.endVertex
                    affectedEdge = endEdge
                    end_PF.UpdateAffectedInfo_Normal(shareEdge,affectedEdge,splitEdges_End,currE_Dict,"end")

                ## Constraint Specific streamline toggle 
                if specificStreamlineToggle == False:
                    if end_PF!= None:
                        end_PF.situation = 0
                    
                ### Check Neighbors info by mutual edge, this must be conducted after inserting new edges for the affected parcFace
                parentNeighbor = currNode.neighbors
                for pneighbor in parentNeighbor:
                    SPF.CheckNeighbor(splitResult[0],pneighbor)
                    SPF.CheckNeighbor(splitResult[1],pneighbor)
                    
                    
            SPF.RemoveInvalidNeighbor(currNode,currQ)  # Dont forget
            
        #endregion

        # Add the first split line as road 
        try:
            if currDepth == 0 and firstRoad ==True:
                RF.AssignFirstRoad(PL,GRP,currStreetGraph,shareEdge,currE_Dict,wA)
                for parcel in currQ:                                 
                    RF.CheckAccessibility(parcel,currE_Dict)
        except:
            
            print ("something wrong with assigning the first road")
            pass

        
        # print ("Now, there are %d nodes in currQ  ") %len(currQ)
        ra.WriteLine("Now, there are %d nodes in currQ " %len(currQ))
        #print ("**************************************************")
            
        
        # Collect all geometry
        # parcels.append(splitResult[0].GetGeometry())  ###just for preview
        # parcels.append(splitResult[1].GetGeometry())
        
        issurance+=1    

#    except:
#        succeededTag = False
#        break    

endTime = time.time()
if succeededTag == True:
    msg_Subdiv = "Subdivision succeeded "
elif succeededTag == False:
    msg_Subdiv = "Something wrong with Subdivision, return current stage result "
    print (msg_Subdiv)
    
msg_Subdiv = msg_Subdiv + "Time: ", str(endTime-startTime)
print ("End: Finish Subdiv")
ra.WriteLine("End: Finish Subdiv")
# ---------- end python_2 ----------
panel_5 = Panel(python_2.out)

# ----
# Export whole tree data before optimization
# Tree Data
ghpython_script_20 = GhPythonScript(
    WebApp_Func=ghpython_script_2.WebApp_Func,
    SPF=ghpython_script_8.SPF,
    EV=ghpython_script_6.EV,
    p0=python_2.p0,
    targetPoint=python.sourceCenter,
    scale=python.scale)  # -> out, port, parcels_Mb_All, port_2, IDList, childrenList, simplify(graft(parentList)), simplify(graft(depthList))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; inputs targetPoint: Point3d; disabled
# ---------- ghpython_script_20: Python ----------
###########################
####    Import Libs    ####
###########################
import Rhino.Geometry as rg
#import Rhino.RhinoDoc as rd
import Rhino.RhinoMath as rm
import Rhino.RhinoApp as ra
import ghpythonlib.components as ghc
import ghpythonlib.treehelpers as th
import Rhino as rh
from collections import deque 
import Queue
import math

#########################################################
#################  Move and Scale  ######################
#########################################################
allNodes = SPF.TraverseCollectAllNodes(p0)
parcels_Origin = [node.GetGeometry() for node in allNodes]
parcels_Mb_All = WebApp_Func.MoveFromOriginAndScaleAllParcels(parcels_Origin,targetPoint,scale)

#########################################################
#################  Store Dict        ####################
#########################################################
meshDracos_Mb_All  = [WebApp_Func.DracoCompression_MoveZ(polyL) for polyL in parcels_Mb_All]
##### assign a WebTreeID
WebApp_Func.AssignWebTreeID(allNodes)
##### store info in to a dict
treeDict = WebApp_Func.StoreInfoIntoDict(allNodes,meshDracos_Mb_All)
    

####################################################################
#################  Store Info Sperately         ####################
####################################################################

IDList,childrenList,parentList,depthList,dracoList = WebApp_Func.ExportToSperateDict(treeDict)
childrenList = th.list_to_tree(childrenList)

####################################################################
#################         Evaluation            ####################
####################################################################

areaList_All,orientationList_All,elongationList_All,compactnessList_All,convexityList_All = WebApp_Func.GetEvaluationValueList(EV,parcels_Mb_All)
# ---------- end ghpython_script_20 ----------
curve = Curve(simplify(graft(ghpython_script_20.parcels_Mb_All)))  # disabled
number = Number(simplify(graft(ghpython_script_20.convexityList_All)))  # disabled
number_2 = Number(simplify(graft(ghpython_script_20.compactnessList_All)))  # disabled
number_3 = Number(simplify(graft(ghpython_script_20.orientationList_All)))  # disabled
number_4 = Number(simplify(graft(ghpython_script_20.elongationList_All)))  # disabled
number_5 = Number(simplify(graft(ghpython_script_20.areaList_All)))  # disabled
curve_to_polyline = CurveToPolyline(Curve=curve, ToleranceDistance=0, ToleranceAngle=0)  # -> Polyline, Segments; disabled
ghpython_script_21 = GhPythonScript(area=number_5, orientation=number_3, elongation=number_4, compactness=number_2, convexity=number)  # -> out, simplify(graft(eva)); inputs area: tree, orientation: tree, elongation: tree, compactness: tree, convexity: tree; disabled
# ---------- ghpython_script_21: Python ----------
__author__ = "Anna Yenardi"
__version__ = "2023.02.08"

import rhinoscriptsyntax as rs
import ghpythonlib.treehelpers as th

eva = []
for i in range(area.BranchCount):
    eva.append(str(area.Branch(i)[0])+','+str(orientation.Branch(i)[0])+','+str(elongation.Branch(i)[0])+','+str(compactness.Branch(i)[0])+','+str(convexity.Branch(i)[0]))

eva = th.list_to_tree(eva)
# ---------- end ghpython_script_21 ----------
ghpython_script_22 = GhPythonScript(x=ghpython_script_20.childrenList)  # -> out, a; inputs x: tree of Int32; disabled
# ---------- ghpython_script_22: Python ----------
__author__ = "Anna Yenardi"
__version__ = "2023.02.01"

import rhinoscriptsyntax as rs
import ghpythonlib.treehelpers as th
import ghpythonlib.components as gh

arr = th.tree_to_list(x)
resArr = []

for i in range(len(arr)):
    if arr[i] == []:
        resArr.append("empty")
    else:
        newStr = ""
        for k in range(len(arr[i])):
            newStr = newStr + str(arr[i][k]) + ","
        resArr.append(newStr[0:len(newStr) - 1])

a = th.list_to_tree(resArr)
# ---------- end ghpython_script_22 ----------
ghpython_script_23 = GhPythonScript(poly=flatten(curve_to_polyline.Polyline))  # -> out, simplify(res); inputs poly: tree of Polyline; disabled
# ---------- ghpython_script_23: Python ----------
__author__ = "Anna Yenardi"
__version__ = "2023.02.06"

import rhinoscriptsyntax as rs
import ghpythonlib.components as gh
import ghpythonlib.treehelpers as th

res =[]
arr = th.tree_to_list(poly)
for i in range(len(arr)):
    verts = gh.Explode(arr[i], True)[1]
    coords = ""
    for j in range(len(verts)):
        curr = (gh.Deconstruct(verts[j]))
        coords = coords + str(curr[0])+","+str(curr[1])+","+str(curr[2])+";"
    coords = coords[0:len(coords)-1]
    res.append(coords)

res = th.list_to_tree(res)
# ---------- end ghpython_script_23 ----------
path_mapper = PathMapper(ghpython_script_22.a, source="{i}", target="{0}")  # disabled
path_mapper_2 = PathMapper(ghpython_script_20.parentList, source="{i}", target="{0;0}")  # disabled
path_mapper_3 = PathMapper(ghpython_script_20.depthList, source="{i}", target="{0;0;0}")  # disabled
path_mapper_4 = PathMapper(ghpython_script_21.eva, source="{i}", target="{0;0;0;0;0;0}")  # disabled
path_mapper_5 = PathMapper(ghpython_script_23.res, source="{i}", target="{0;0;0;0;0}")  # disabled
path_mapper_6 = PathMapper(ghpython_script_20.dracoList, source="{i}", target="{0;0;0;0}")  # disabled
merge_3 = Merge(
    Data1=path_mapper,
    Data2=path_mapper_2,
    Data3=path_mapper_3,
    Data4=path_mapper_6,
    Data5=path_mapper_5,
    Data6=path_mapper_4)  # disabled
text = Text(merge_3)  # disabled

# ----
# Optimization
python_3 = GhPythonScript(
    GRP=ghpython_script_9.GRP,
    SPF=ghpython_script_8.SPF,
    PL=ghpython_script_7.PL,
    PP=ghpython_script_10.PP,
    RD=ghpython_script_11.RD,
    OP=ghpython_script_12.OP,
    collection_F=python_2.collection_F,
    collection_ParcEdgeGraph=python_2.collection_ParcEdgeGraph,
    collection_StreetGraph=python_2.collection_StreetGraph,
    inputPolyline=python.inputPolyline_New,
    simplifyChoice=simplifychoice_2,
    constraints=merge)  # -> out, port, Intial_Overall_Info, port_2, allV_Geo, allP_Geo, edges, edges_indices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; inputs collection_F: list, collection_ParcEdgeGraph: list, collection_StreetGraph: list, inputPolyline: Polyline, constraints: list
# ---------- python_3: Python ----------
###########################
####    Import Libs    ####
###########################
import Rhino.Geometry as rg
import Rhino.RhinoDoc as rd
import Rhino.RhinoMath as rm
import Rhino.RhinoApp as ra
import ghpythonlib.components as ghc
import math
import time




from System.Collections.Generic import List
import clr
clr.AddReference("KangarooSolver.dll")
import KangarooSolver as ks

import ghpythonlib.treehelpers as th


###########################
####    Description    ####
###########################
### Optimization : This is the script of the Optimization.


###########################
####        Code       ####
###########################

startTime = time.time()
############
# Some preparation
############
# Get the last depth parcels

collection = collection_F[-1].values()             

# Make a partial copy, becasue it does not want to affect the stored nodes
selectedParcFace = [parcel for parcel in collection]
copiedParcFace,currVP_Dict,currE_Dict,redirectMap = OP.MakePartialCopy(selectedParcFace)
OP.RedirectNeighbors_Temp(copiedParcFace,selectedParcFace,currE_Dict,redirectMap)

# Preview vertices, points ,edges and parcels
allV_Geo,allP_Geo = OP.PreviewAllParcVertexAndParcPoint(copiedParcFace)      # Preview
edges,edges_indices = OP.GetAllEdgeGeoAndIDFromDict(currE_Dict)              # Preview   
partParcels_Geo_Before = [parcF.GetGeometry() for parcF in copiedParcFace]   # Preview




############
# Geometry simplication 
############
# Turning Point
turningPtCollection = OP.GetTurningPtInfoCollection(copiedParcFace,20)                                  
OP.ModifyAllTurningPointsWithNewType(PL,turningPtCollection,copiedParcFace,currVP_Dict,currE_Dict)

turningParcPts,turningParcFs = OP.ExtractTurningPtInfo(turningPtCollection)                                                         # Preview
turningPts = [parcPt.geometry for parcPt in turningParcPts]                                                                         # Preview
partParcels_Geo_Turning = [parcF.GetGeometry_SimplifiedWithTurningPoints() for parcF in copiedParcFace]                             # Preview

# Resample Points
OP.GetResamplePointsForAllEdges(PL,currVP_Dict,currE_Dict,turningPtCollection,5,2)                                                  
edge_Resample_Geo = [edge.GetGeometry_SimplifiedWithResamplePoints() for edge in currE_Dict.values()]                               # Preview
partParcels_Geo_Resample = [parcF.GetGeometry_SimplifiedWithResamplePoints() for parcF in copiedParcFace]                           # Preview




############
# Network
############
# Get the last depth street
currStreetGraph = collection_StreetGraph[-1]
streets_Geo = [street.GetGeometry() for street in currStreetGraph.graph.keys()]             # Preview

# Explode and re-combine, reminder, now the instances are still in the previous E_Dict
edgeConnectionRecord, currStreetE_Dict = RD.CreateConnectionRecord(currStreetGraph,currE_Dict)
edgeCollection_All = RD.GetRoadCollection(edgeConnectionRecord,currStreetE_Dict)
roads = RD.CreateRoadInstances(edgeCollection_All)

# Re-create the road using the copied E_Dict
roads = [RD.Road([currE_Dict[pE.ID] for pE in road.edgeCollection]) for road in roads]      #Type: Road instance


# Get the naked roads using the copied E_Dict
nakedRoads = RD.CreateRoadInstances_Naked(currStreetGraph,currE_Dict)                 #Type: Road instance




############
# Kangaroo Optimization
############
# Reminder: This exclude the initial road

try:
    newParcels,oldParcels,newRoads,oldRoads,ptDict_New,ptDict_Old = OP.OptimizeWithConstraints(GRP,copiedParcFace,roads,inputPolyline,currE_Dict,constraints,simplifyChoice)   # Return new and old geometry, also two point dictionaries
    msg_Opt = "Optimization Succeeded "
except:
    msg_Opt = "Optimization failed, return non-optimizatized result "
    newParcels,oldParcels,newRoads,oldRoads,ptDict_New,ptDict_Old = OP.OptimizeWithConstraints_Failed(copiedParcFace,roads,simplifyChoice)
    pass

# Sort cat based on number of streetID edges
newRoads,roadMidPoints,roadCatOrder = RD.SortRoadCat(roads,newRoads)

# Add the old initial road back to collection
oldRoads.extend(road.GetGeometry_SimplifiedWithResamplePoints() for road in nakedRoads)

# Add the new initial road back to collection. It need to use the new point index the construct. Initial roads only have vertices.
nakedRoadGeos,nakedRoadGeosNum,nakedRoadGeos_WithoutJoined,nakedRoadCats_WithoutJoined = OP.GetNakedRoadAfterOpt(nakedRoads,ptDict_New)
newRoads.extend(nakedRoadGeos)

# Get the naked boundary after optimization
boundaryOpt = OP.GetBoundaryAfterOpt(currE_Dict,ptDict_New)

############
# For next step
############
ptDict_New = [ptDict_New]
currE_Dict = [currE_Dict]


endTime = time.time()
msg_Opt = msg_Opt + "Time: ", str(endTime-startTime)
# ---------- end python_3 ----------

# ----
# Preview for edge index
explode = Explode(Curve=geometry_3, Recursive=True)  # -> Segments, Vertices
midpt = CurveMiddle(Curve=explode.Segments)
points = PointList(Points=midpt, Size=Slider(48, range=0..100))

geometry_5 = Geometry(python_3.oldParcels)
geometry_6 = Geometry(python_3.newParcels)
geometry_7 = Geometry(python_3.newRoads)
geometry_8 = Geometry(python_3.boundaryOpt)
panel_6 = Panel(python_3.out)
tag = TextTag3D(Location=midpt, Text=ghpython_script_16.catList, Size=Slider(10, range=0..10), Justification=7)

# ----
# Preview access point and first road
cluster_3 = Cluster_3(
    geometry_7=ghpython_script_19.streamlineA,
    validity_A=ghpython_script_19.validity_A,
    geometry_6=ghpython_script_19.streamlineB,
    validity_B=ghpython_script_19.validity_B,
    geometry_3=ghpython_script_19.strightLine,
    validity_Straight=ghpython_script_19.validity_Straight,
    geometry_5=ghpython_script_19.detectRegion,
    geometry_8=ghpython_script_19.bCurveList_Valid,
    geometry_4=ghpython_script_19.bestSl,
    geometry_2=ghpython_script_19.anchors,
    vector=ghpython_script_19.normals,
    geometry=ghpython_script_19.newedges)  # disabled

# ----
# firstWidth
# secondWidth
# (Default)
road_width = Panel("""26
18""")

# ----
# Offset and Format the output
s = GhPythonScript(
    WebApp_Func=ghpython_script_2.WebApp_Func,
    targetPoint=python.sourceCenter,
    scale=python.scale,
    catList=python_2.catList,
    PL=ghpython_script_7.PL,
    OF=ghpython_script_13.OF,
    newRoads=python_3.newRoads,
    nakedRoadGeosNum=python_3.nakedRoadGeosNum,
    roadMidPoints=python_3.roadMidPoints,
    roadCatOrder=python_3.roadCatOrder,
    boundaryOpt=python_3.boundaryOpt,
    collection_StreetGraph=python_2.collection_StreetGraph,
    copiedParcFace=python_3.copiedParcFace,
    ptDict_New=python_3.ptDict_New,
    simplifyChoice=simplifychoice_2,
    roadPercentage=num,
    offsetDists=road_width,
    boundary=python.inputPolyline_New)  # -> out, port, resampleParcFaces, resamplePFGeos, resamplePFIndices, port_2, invalidStreetGeos, validStreetGeos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; inputs targetPoint: Point3d, catList: list of Int32, newRoads: list of Curve, nakedRoadGeosNum: Int32, roadMidPoints: list of Point3d, roadCatOrder: list, boundaryOpt: Curve, collection_StreetGraph: list, copiedParcFace: list, ptDict_New: list, offsetDists: list, boundary: Curve
# ---------- s: Python ----------
###########################
####    Import Libs    ####
###########################
import Rhino.Geometry as rg
import Rhino.RhinoDoc as rd
import Rhino.RhinoMath as rm
import ghpythonlib.components as gh
import ghpythonlib.treehelpers as th
import json

import time

startTime = time.time()
###########################
####    Description    ####
###########################
### Offset : This is the script of Offset.

###########################
####        Code       ####
###########################

### Get the scaled offset distance
offsetDists= [offsetDist/2/scale for offsetDist in offsetDists]    

### Reconstruct the parcel with simple data structure
resampleParcFaces,resamplePFGeos,resamplePFIndices = OF.ReconstructSimplifiedParcelAfterOptimization(PL,copiedParcFace,ptDict_New,simplifyChoice)

### Assign the road cat for surrounding edge to cat 1
#OF.AssignNakedEdgesHierarchy(collection_StreetGraph, resampleParcFaces)

### Simply classify the road from newRoads output to proceed
invalidStreetGeos,validStreetGeos,allStreetGeos = OF.PreClassifyRoads(newRoads,nakedRoadGeosNum,roadMidPoints,roadCatOrder)



### Get Hierarchy info
validStreetGeos_CatIndices = OF.CreateListWithProportions(len(validStreetGeos),roadPercentage)

chosenCats = OF.DecideCatToAssign(catList)

### If there are new roads, do the offset
if len(validStreetGeos)!=0:

    #try:
    allOffsets,allOffsets_Flatten,allOffsetRegions,offsetRegionUnion = OF.GetThisHierachyOffsetUnionRegion(validStreetGeos,boundaryOpt,offsetDists,validStreetGeos_CatIndices,chosenCats)
#    pFGeoCollection,pEGeoCollection,pECatCollection = OF.GetOffsetParcelAndEdgeCat(resampleParcFaces,validStreetGeos,allOffsets,allOffsetRegions,validStreetGeos_CatIndices,chosenCats)
#    msg_Offset = "Offset succeeded "
#    except:
    pFGeoCollection = [pF.GetGeometry_SimplifiedWithResamplePoints() for pF in resampleParcFaces]
    pEGeoCollection = [[edge.GetGeometry_SimplifiedWithResamplePoints() for edge in pF.edges] for pF in resampleParcFaces]
    pECatCollection = [[edge.hierarchy for edge in pF.edges] for pF in resampleParcFaces]
    msg_Offset = "Offset failed, return the non-offset result "
    print (msg_Offset)

    
    ### moveBack
    pFGeoCollection_Copy = [pF.Duplicate() for pF in pFGeoCollection]                                                    # PF
    pFGeoCollection_Mb = WebApp_Func.MoveFromOriginAndScaleAllParcels(pFGeoCollection_Copy,targetPoint,scale)            

    
    pEGeoCollection_Mb = []                                                                                              # PE
    for thisPFECollection in pEGeoCollection:
        thisPFECollection_Mb = []
        for edge in thisPFECollection:
            thisPFECollection_Mb.append(WebApp_Func.RelocateGeoFromOrigin(edge,targetPoint))
        pEGeoCollection_Mb.append(thisPFECollection_Mb)

    
    for i in range(len(pECatCollection)):
        thisPECatCollection = pECatCollection[i] 
        for j in range(len(thisPECatCollection)):
            if thisPECatCollection[j] == None:
                thisPECatCollection[j] = 6
    
    
    ParcelBoundaryPolyline = pFGeoCollection_Mb
    ParcelCategories = pECatCollection
    pEGeoCollection = pEGeoCollection


###  If there is no new road, no need to do offset
else:
    msg_Offset = "No Offset need"
    pFGeoCollection_Copy = [pF.GetGeometry_SimplifiedWithResamplePoints().ToPolylineCurve() for pF in resampleParcFaces]            # PF
    pFGeoCollection_Mb = WebApp_Func.MoveFromOriginAndScaleAllParcels(pFGeoCollection_Copy,targetPoint,scale)                       
    
    pEGeoCollection_Mb = []                                                                                                         # PE
    pECatCollection = []
    for pF in resampleParcFaces:                                                                                                    
        thisPFECollection_Mb = []
        thispECatCollection = []
        for edge in pF.edges:
            thisPFECollection_Mb.append(WebApp_Func.RelocateGeoFromOrigin(edge.GetGeometry_SimplifiedWithResamplePoints(),targetPoint))
            thispECatCollection.append(edge.hierarchy)
        pEGeoCollection_Mb.append(thisPFECollection_Mb)
        pECatCollection.append(thispECatCollection)

    ### Convert to tree, explode the polyline to lines, having corresponding edge CAT.
    pECatCollection_Explode = []
    for i in range(len(pEGeoCollection_Mb)):
        pEGeoList = pEGeoCollection_Mb[i]
        pECatList = pECatCollection[i]
        
        thisPECat_Explode = []
        for j in range(len(pEGeoList)):
            
            if isinstance(pEGeoList[j],rg.Polyline) != True:
                thisEdgeGeo = pEGeoList[j].TryGetPolyline()[1]
            else:
                thisEdgeGeo = pEGeoList[j]
            thisEdgeCat = pECatList[j]
            
            segCount = thisEdgeGeo.SegmentCount 
            for k in range(segCount):
                if thisEdgeCat == None:
                    thisPECat_Explode.append(6)
                else:
                    thisPECat_Explode.append(thisEdgeCat)
        pECatCollection_Explode.append(thisPECat_Explode)


    ParcelBoundaryPolyline = pFGeoCollection_Mb
    ParcelCategories = pECatCollection_Explode
    pEGeoCollection = pEGeoCollection


validStreetGeos_Cats = [chosenCats[index] for index in validStreetGeos_CatIndices]


endTime = time.time()
msg_Offset = msg_Offset + "Time: ", str(endTime-startTime)
# ---------- end s ----------

# ---- group: preview depth control
parceldepth = Slider(-1, range=-1..20)

# ----
boundary_surfaces = BoundarySurfaces(Edges=s.pFGeoCollection)
geometry_9 = Geometry(s.pFGeoCollection)

# ---- group: visualization preview for checking each depth before optimization
python_4 = GhPythonScript(
    depth=parceldepth,
    collection_F=python_2.collection_F,
    collection_F_Dict=python_2.collection_F_Dict,
    collection_E=python_2.collection_E,
    collection_VP=python_2.collection_VP,
    collection_ParcelGraph=python_2.collection_ParcelGraph,
    collection_JunctionGraph=python_2.collection_JunctionGraph,
    collection_ParcEdgeGraph=python_2.collection_ParcEdgeGraph,
    collection_StreetGraph=python_2.collection_StreetGraph)  # -> out, port, parcelIDs, parcelGeo, edgeIDs, edgeGeo, vIDs, vGeo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; inputs depth: Int32, collection_F: list, collection_F_Dict: list, collection_E: list, collection_VP: list, collection_ParcelGraph: list, collection_JunctionGraph: list, collection_ParcEdgeGraph: list, collection_StreetGraph: list
# ---------- python_4: Python ----------
__author__ = "asdbe"
__version__ = "2023.04.03"

import rhinoscriptsyntax as rs

### Check if collection and collection Dict are the same
#x = collection_F[-1]
#y = collection_F_Dict[-1]
#print x[0].depth
#print y[x[0].ID].depth
#for pf in x:
#    print id(pf),pf.ID
#print "-----------"
#
#for pf in y.values():
#    print id(pf),pf.ID

######################################
##### Check Parcel from Solution #####
######################################
parcelIDs = [pF.ID for pF in collection_F[depth].values()]
parcelGeo = [pF.GetGeometry() for pF in collection_F[depth].values()]

######################################
#####  Check Edge from Solution  #####
######################################
edgeIDs = [edge.ID for edge in collection_E[depth].values()]
edgeGeo = [edge.GetGeometry() for edge in collection_E[depth].values()]

######################################
####  Check Vertex from Solution  ####
######################################
vIDs = []
vGeo = []
for edge in collection_E[depth].values():
    if edge.startVertex.ID not in vIDs:
        vIDs.append(edge.startVertex.ID)
        vGeo.append(edge.startVertex.geometry)
    if edge.endVertex.ID not in vIDs:
        vIDs.append(edge.endVertex.ID)
        vGeo.append(edge.endVertex.geometry)
            

############################################################################
############################################################################
############################################################################

#currParcelGraph = collection_ParcelGraph[depth]
#currParcelGraph = currParcelGraph.GetIDNumWeightGraph()
#print currParcelGraph.graph
#
#currJunctionGraph = collection_JunctionGraph[depth]
#currJunctionGraph = currJunctionGraph.GetIDNumWeightGraph()
#print currJunctionGraph.graph
#
#currParcEdgeGraph = collection_ParcEdgeGraph[depth]
#currParcEdgeGraph = currParcEdgeGraph.GetIDNumWeightGraph()
#print currParcEdgeGraph.graph

currStreetGraph = collection_StreetGraph[depth]

streetGeo = []

streetDict = currStreetGraph.GetStreetDict()

for sID in streetDict.keys():

    streetGeo.append(streetDict[sID].GetGeometry())

for collection in collection_VP:
    for instance in collection.values():
        print "depth:", instance.depth,"id:",instance.ID
    
    print "----"
# ---------- end python_4 ----------

# ----
textsize = Slider(1, range=0..1000)

# ----
# Edge
geo = Geometry(python_4.edgeGeo)
midpt_2 = CurveMiddle(Curve=geo)
tag_2 = TextTag3D(Location=midpt_2, Text=python_4.edgeIDs, Size=textsize, Justification=5)

# ----
# Vertices
geo_2 = Geometry(python_4.vGeo)
tag_3 = TextTag3D(Location=geo_2, Text=python_4.vIDs, Size=textsize, Justification=5)

# ----
# Parcel
area_2 = Area(Geometry=python_4.parcelGeo, UseTasks=True)  # -> Area, Centroid
geo_3 = Geometry(python_4.parcelGeo)
srf = Surface(python_4.parcelGeo)
tag_4 = TextTag3D(Location=area_2.Centroid, Text=python_4.parcelIDs, Size=textsize, Justification=5)
preview = CustomPreview(Geometry=srf, Material=ColourSwatch(SwatchColor=RGB(122, 122, 122)))
preview_2 = CustomPreview(Geometry=geo_3, Material=ColourSwatch(SwatchColor=RGB(0, 0, 0)))

# ----
# roads
geometry_10 = Geometry(python_4.streetGeo)
previewlw = CustomPreviewLineweights(Geometry=geometry_10, Shader=ColourSwatch(SwatchColor=RGB(0, 0, 0)), Thickness=Slider(5, range=0..10), Absolute=False)

# ----
# mergeEdges
geo_4 = Geometry(python_2.debugColletion1)
pipe = Pipe(Curve=geo_4, Radius=Slider(1, range=0..10), Caps=0)

# ----
# NakedEdgeIndices
python_5 = GhPythonScript(collection_F=python_2.collection_F)  # -> out, edgeGeo_First, edgeID_First; inputs collection_F: list
# ---------- python_5: Python ----------
import Rhino.Geometry as rg

firstParcel = collection_F[0][0]

edgeGeo_First = []
edgeID_First = []
for edge in firstParcel.edges:
    edgeGeo_First.append(edge.GetGeometry())
    edgeID_First.append(edge.ID)

print firstParcel.sides
# ---------- end python_5 ----------
midpt_3 = CurveMiddle(Curve=python_5.edgeGeo_First)
tag_5 = TextTag3D(Location=midpt_3, Text=python_5.edgeID_First, Size=Slider(49, range=0..100), Justification=7)

panel_7 = Panel(s.out)

# ---- group: preview sorted road
cluster_4 = Cluster(geometry=python_3.oldRoads)

# ---- group: 0: before opt / 1: after opt
before_after = Slider(1, range=0..1)

# ---- group: parcel
filter = StreamFilter(Gate=before_after, Stream0=python_3.oldParcels, Stream1=python_3.newParcels)
preview_3 = CustomPreview(Geometry=filter, Material=ColourSwatch(SwatchColor=RGB(0, 0, 0)))

# ---- group: road
filter_2 = StreamFilter(Gate=before_after, Stream0=python_3.oldRoads, Stream1=python_3.newRoads)
previewlw_2 = CustomPreviewLineweights(Geometry=filter_2, Shader=ColourSwatch(SwatchColor=RGB(0, 0, 0)), Thickness=Slider(5, range=0..10), Absolute=False)

# ----
# Messages
merge_4 = Merge(Data1=python_2.msg_Subdiv, Data2=python_3.msg_Opt, Data3=s.msg_Offset)  # -> flatten(Result)

# ----
# Center Line
nakedoffsetdist = Slider(16, range=0..100)
python_6 = GhPythonScript(
    WebApp_Func=ghpython_script_2.WebApp_Func,
    nakedRoadGeos_WithoutJoined=python_3.nakedRoadGeos_WithoutJoined,
    validRoadGeos=s.validStreetGeos_2,
    nakedOffsetDist=nakedoffsetdist,
    boundaryOpt=python_3.boundaryOpt,
    targetPoint=python.sourceCenter,
    scale=python.scale)  # -> out, dashes_MB; inputs nakedRoadGeos_WithoutJoined: list of Curve, validRoadGeos: list of Curve, boundaryOpt: Curve, targetPoint: Point3d
# ---------- python_6: Python ----------
###########################
####    Import Libs    ####
###########################
import Rhino.Geometry as rg
import Rhino.RhinoDoc as rd
import Rhino.RhinoMath as rm
import ghpythonlib.components as ghc


centerLines_Naked = []
centerLines_NonNaked = []
#### The naked roads
for i in range(len(nakedRoadGeos_WithoutJoined)):
    road = nakedRoadGeos_WithoutJoined[i]
    if isinstance(road,rg.Polyline)!=True:
        road = nakedRoadGeos_WithoutJoined[i].TryGetPolyline()[1]
    centerLines_Naked.append(road)

    

#### The non-naked roads 
for i in range(len(validRoadGeos)):
    road = validRoadGeos[i]
    if isinstance(road,rg.Polyline)!=True:
        road = validRoadGeos[i].TryGetPolyline()[1]
    centerLines_NonNaked.append(road)

    
    
centerLines_Naked = rg.Curve.JoinCurves([geo.ToPolylineCurve() for geo in centerLines_Naked])

centerLines_Naked_Offset = []
wxy_Plane=rg.Plane.WorldXY
tol = 0.001   
offsetDist = nakedOffsetDist/2/scale 
for nakeCenterLine in centerLines_Naked:
    nakeCenterLine_curve = nakeCenterLine
    offset1= nakeCenterLine_curve.Offset(wxy_Plane,offsetDist,tol,rg.CurveOffsetCornerStyle.Sharp)[0]
    offset2= nakeCenterLine_curve.Offset(wxy_Plane,-offsetDist,tol,rg.CurveOffsetCornerStyle.Sharp)[0]
    
    mid1 = offset1.PointAtLength(offset1.GetLength()/2)
    mid2 = offset2.PointAtLength(offset1.GetLength()/2)
    if int(boundaryOpt.Contains(mid1))==1 :
        offsetnakeCenterLine = offset2
    else:
        offsetnakeCenterLine = offset1
    centerLines_Naked_Offset.append(offsetnakeCenterLine)
    
    
    
allCenterlines = centerLines_Naked_Offset + centerLines_NonNaked

dashes = ghc.DashPattern(allCenterlines,7)[0]
dashes_MB = []


for dash in dashes:
    geo_New = WebApp_Func.RelocateGeoFromOrigin(dash,targetPoint)
    transform = rg.Transform.Scale(targetPoint,scale)
    geo_New.Transform(transform)
    dashes_MB.append(geo_New)
# ---------- end python_6 ----------
geo_5 = Geometry(python_6.dashes_MB)
ghpython_script_24 = GhPythonScript(poly=flatten(geo_5))  # -> out, simplify(res); inputs poly: tree of Polyline; same code as ghpython_script_23
path_mapper_7 = PathMapper(ghpython_script_24.res, source="{i}", target="{0;0}")

panel_8 = Panel(merge_4)
path_mapper_8 = PathMapper(merge_4, source="{i}", target="{0}")

# ----
# DEBUG
panel_9 = Panel("""18.7111673648 -22.2381398848 0
19.9777503756 -24.2740927598 0
21.4697935270 -26.6795104078 0
22.9602504418 -29.0860483039 0
24.4510075278 -31.4923354807 0
-----
24.4510075278 -31.4923354807 0
28.6183554454 -28.8558100740 0
-----
28.6183554454 -28.8558100740 0
36.4846200756 -21.7693248124 0
-----
36.4846200756 -21.7693248124 0
44.3219663803 -12.5999353941 0
-----
44.3219663803 -12.5999353941 0
47.1306565200 -8.47789548261 0
-----
47.1306565200 -8.47789548261 0
45.0199505879 -6.88135660985 0
42.8893953804 -5.26703770243 0
40.7673812390 -3.65682643434 0
38.8754425200 -2.22772946031 0
-----
38.8754425200 -2.22772946031 0
34.1100922294 -7.95827370816 0
29.3528060091 -13.1168372407 0
24.2025917119 -17.8581896258 0
18.7111673648 -22.2381398848 0
-----""")  # disabled
ghpython_script_25 = GhPythonScript(data=panel_9)  # -> out, a; inputs data: list; disabled
# ---------- ghpython_script_25: Python ----------
import ghpythonlib.components as ghc
import Rhino.Geometry as rg
polyLList = []
ptList = []
clusterColletion = []
for str in data:
    if str == "--------------------": 
        
        cluster = []
        cluster.append(ptList)
        clusterColletion.append(cluster)
        
    elif str == "-----":
        polyLList.append(rg.Polyline(ptList))
        
        ptList = []
    else:
        
        result = ghc.TextSplit(str," ")
        ptList.append(rg.Point3d(float(result[0]),float(result[1]),0))

a = polyLList
# ---------- end ghpython_script_25 ----------
geometry_11 = Geometry(ghpython_script_25.a)  # disabled
number_slider = Slider(5, range=0..10)  # disabled
colour_swatch = ColourSwatch(SwatchColor=RGB(13, 0, 0))  # disabled
end_points = EndPoints(Curve=geometry_11)  # -> Start, End; disabled
custom_preview_lineweights = CustomPreviewLineweights(Geometry=geometry_11, Shader=colour_swatch, Thickness=number_slider, Absolute=False)  # disabled
panel_10 = Panel("-9.77571928001619,-14.1498070480212,0")  # disabled
panel_11 = Panel(",")  # disabled
text_split = TextSplit(Text=panel_10, Separators=panel_11)  # disabled
list_item = ListItem(List=text_split, Index=0, Wrap=True)  # -> Item, Item1, Item2; disabled
construct_point_3 = ConstructPoint(XCoordinate=list_item.Item, YCoordinate=list_item.Item1, ZCoordinate=list_item.Item2)  # disabled
polyline = PolyLine(Vertices=flatten(construct_point_3), Closed=False)  # disabled

# ---- group: RH_OUT:Messages
text_2 = Text(path_mapper_8)

# ----
# firstWidth
# secondWidth
# (Default)
ghpython_script_26 = GhPythonScript(
    nakedRoadGeos_WithoutJoined=python_3.nakedRoadGeos_WithoutJoined,
    nakedRoadCats_WithoutJoined=python_3.nakedRoadCats_WithoutJoined,
    validRoadGeos=s.validStreetGeos_2,
    validStreetGeos_Cats=s.validStreetGeos_Cats,
    boundaryOpt=python_3.boundaryOpt,
    nakedOffsetDist=nakedoffsetdist,
    scale=python.scale)  # -> out, RoadLines, RoadCategories, RoadJSON, centerLines_Naked, centerLines_NonNaked, centerLines_Naked_Offset; inputs nakedRoadGeos_WithoutJoined: list, nakedRoadCats_WithoutJoined: list, validRoadGeos: list of Polyline, validStreetGeos_Cats: list, boundaryOpt: Curve; disabled
# ---------- ghpython_script_26: Python ----------
###########################
####    Import Libs    ####
###########################
import Rhino.Geometry as rg
#import Rhino.RhinoDoc as rd
import Rhino.RhinoMath as rm
import ghpythonlib.components as ghc
import math

import json


RoadCategories = []
RoadLines = []

centerLines_Naked = []
centerLines_NonNaked = []
#### The naked roads
for i in range(len(nakedRoadGeos_WithoutJoined)):
    road = nakedRoadGeos_WithoutJoined[i]
    if isinstance(road,rg.Polyline)!=True:
        road = nakedRoadGeos_WithoutJoined[i].TryGetPolyline()[1]
        
    
    centerLines_Naked.append(road)
    RoadLines.extend(road.GetSegments())
    for j in range(road.SegmentCount):
        RoadCategories.append(nakedRoadCats_WithoutJoined[i])
    

#### The non-naked roads 
for i in range(len(validRoadGeos)):
    road = validRoadGeos[i]
    if isinstance(road,rg.Polyline)!=True:
        road = validRoadGeos[i].TryGetPolyline()[1]
    
    centerLines_NonNaked.append(road)
    RoadLines.extend(road.GetSegments())
    for j in range(road.SegmentCount):
        RoadCategories.append(validStreetGeos_Cats[i])
    
    
centerLines_Naked = rg.Curve.JoinCurves([geo.ToPolylineCurve() for geo in centerLines_Naked])
print centerLines_Naked
centerLines_Naked_Offset = []
wxy_Plane=rg.Plane.WorldXY
tol = 0.001   
offsetDist = nakedOffsetDist/2/scale 
for nakeCenterLine in centerLines_Naked:
    nakeCenterLine_curve = nakeCenterLine
    offset1= nakeCenterLine_curve.Offset(wxy_Plane,offsetDist,tol,rg.CurveOffsetCornerStyle.Sharp)[0]
    offset2= nakeCenterLine_curve.Offset(wxy_Plane,-offsetDist,tol,rg.CurveOffsetCornerStyle.Sharp)[0]
    
    mid1 = offset1.PointAtLength(offset1.GetLength()/2)
    mid2 = offset2.PointAtLength(offset1.GetLength()/2)
    if int(boundaryOpt.Contains(mid1))==1 :
        offsetnakeCenterLine = offset2
    else:
        offsetnakeCenterLine = offset1
    centerLines_Naked_Offset.append(offsetnakeCenterLine)
    

RoadJSON = {}
RoadVertices = []
RoadEdgeConnectivity = []

for index in range(len(RoadLines)):
    line = RoadLines[index]
    
    RoadVertices.append(line.From)
    RoadEdgeConnectivity.append([index,index+1])
    
RoadVertices.append(RoadLines[-1].To)

RoadJSON['Vertices'] = [[pt[0],pt[1],pt[2]]for pt in RoadVertices]
RoadJSON['EdgeConnectivity'] = RoadEdgeConnectivity
RoadJSON['EdgeCategory'] = RoadCategories
RoadJSON = json.dumps(RoadJSON)
# ---------- end ghpython_script_26 ----------
curve_middle = CurveMiddle(Curve=ghpython_script_26.RoadLines)  # disabled
size = Slider(3, range=0..10)  # disabled
# Final Offset Data
# Final Offset Data
# average
# average
# vAnchorStrength
# vOnCrvStrength
# pAnchorStrength
# roadSmoothStrength
# roadJunctionAngleStrength
# parcelSideSmoothStrength
# parcelSideAngleStrength
# parcelSideLengthStrength
# parcelSideSimLengthStrength
# parcelAdjacencyStrength
panel_12 = Panel(ghpython_script_26.out)
dash_pattern = DashPattern(Curve=ghpython_script_26.RoadLines, Pattern=7)  # -> Dashes, Gaps; disabled
colour_swatch_2 = ColourSwatch(SwatchColor=RGB(33, 184, 128))  # disabled
text_tag_3d = TextTag3D(Location=curve_middle, Text=ghpython_script_26.RoadCategories, Size=size, Colour=colour_swatch_2, Justification=5)  # disabled
custom_preview_2 = CustomPreview(Geometry=dash_pattern.Dashes, Material=colour_swatch_2)  # disabled

curve_middle_2 = CurveMiddle(Curve=ghpython_script_25.a)  # disabled
list_item_2 = ListItem(Index=0, Wrap=True)  # disabled
panel_13 = Panel(ghpython_script_26.out)  # disabled
point_list = PointList(Points=curve_middle_2)  # disabled

# ---- group: RH_OUT:CenterLines
text_3 = Text(path_mapper_7)

# ---- group: RH_OUT:RoadGenerationJSON
text_4 = Text(ghpython_script_26.RoadJSON)  # disabled

# ----
# Export the last depth data after optimization
# Final Offset Data
ghpython_script_27 = GhPythonScript(
    WebApp_Func=ghpython_script_2.WebApp_Func,
    SPF=ghpython_script_8.SPF,
    EV=ghpython_script_6.EV,
    parcels_Offset=s.ParcelBoundaryPolyline)  # -> out, parcels_Offset, simplify(graft(meshDraco_Offset)), areaList, orientationList, elongationList, compactnessList, convexityList; inputs parcels_Offset: list of Polyline
# ---------- ghpython_script_27: Python ----------
###########################
####    Import Libs    ####
###########################
import Rhino.Geometry as rg
#import Rhino.RhinoDoc as rd
import Rhino.RhinoMath as rm
import Rhino.RhinoApp as ra
import ghpythonlib.components as ghc
import ghpythonlib.treehelpers as th
import Rhino as rh
from collections import deque 
import Queue
import math


#meshDraco_Offset = [WebApp_Func.DracoCompression_MoveZ(polyL.TryGetPolyline()[1]) for polyL in parcels_Offset]
areaList,orientationList,elongationList,compactnessList,convexityList = WebApp_Func.GetEvaluationValueList(EV,parcels_Offset)
# ---------- end ghpython_script_27 ----------
number_6 = Number(simplify(graft(ghpython_script_27.convexityList)))
number_7 = Number(simplify(graft(ghpython_script_27.compactnessList)))
number_8 = Number(simplify(graft(ghpython_script_27.orientationList)))
number_9 = Number(simplify(graft(ghpython_script_27.elongationList)))
number_10 = Number(simplify(graft(ghpython_script_27.areaList)))
ghpython_script_28 = GhPythonScript(poly=flatten(ghpython_script_27.parcels_Offset))  # -> out, simplify(res); inputs poly: tree of Polyline; same code as ghpython_script_23
ghpython_script_29 = GhPythonScript(area=number_10, orientation=number_8, elongation=number_9, compactness=number_7, convexity=number_6)  # -> out, simplify(graft(eva)); inputs area: tree, orientation: tree, elongation: tree, compactness: tree, convexity: tree; same code as ghpython_script_21
panel_14 = Panel(ghpython_script_29.eva)
path_mapper_9 = PathMapper(ghpython_script_27.meshDraco_Offset, source="{i}", target="{0;0;0;0}")
path_mapper_10 = PathMapper(ghpython_script_29.eva, source="{i}", target="{0;0;0;0;0;0}")
path_mapper_11 = PathMapper(ghpython_script_28.res, source="{i}", target="{0;0;0;0;0}")
path_mapper_12 = PathMapper(ghpython_script_20.dracoList, source="{i}", target="{0;0;0;0;0;0;0}")

# ----
# average
average = Average(Input=ghpython_script_27.areaList)
average_2 = Average(Input=ghpython_script_27.orientationList)
average_3 = Average(Input=ghpython_script_27.elongationList)
average_4 = Average(Input=ghpython_script_27.convexityList)
average_5 = Average(Input=ghpython_script_27.compactnessList)

ghpython_script_30 = GhPythonScript(x=average, y=average_2, z=average_3, u=average_5, v=average_4)  # -> out, simplify(graft(a))
# ---------- ghpython_script_30: Python ----------
__author__ = "Anna Yenardi"
__version__ = "2023.02.16"

import rhinoscriptsyntax as rs
import ghpythonlib.treehelpers as th

arr = [x,y,z,u,v]
a = th.list_to_tree(arr)
# ---------- end ghpython_script_30 ----------
path_mapper_13 = PathMapper(ghpython_script_30.a, source="{i}", target="{0;0;0;0;0;0;0;0}")
merge_5 = Merge(Data1=path_mapper_9, Data2=path_mapper_11, Data3=path_mapper_10, Data4=path_mapper_12, Data5=path_mapper_13)

ghpython_script_31 = GhPythonScript(
    ParcelBoundaryPolyline=s.ParcelBoundaryPolyline,
    ParcelCategories=s.ParcelCategories,
    dracomeshes=flatten(ghpython_script_27.meshDraco_Offset),
    area=ghpython_script_27.areaList,
    orientation=ghpython_script_27.orientationList,
    elongation=ghpython_script_27.elongationList,
    compactness=ghpython_script_27.compactnessList,
    convexity=ghpython_script_27.convexityList)  # -> out, graft(ParcelBoundaryPolyline), ParcelCategories, ParcelJSON; inputs ParcelBoundaryPolyline: list, ParcelCategories: list, dracomeshes: list, area: list, orientation: list, elongation: list, compactness: list, convexity: list
# ---------- ghpython_script_31: Python ----------
__author__ = "jingz"
__version__ = "2023.03.24"

import rhinoscriptsyntax as rs
import ghpythonlib.components as gh
import ghpythonlib.treehelpers as th
import json

print("This script extracts parcel polylines and assign road category from edge category.")
print("Cat 3 = Major Arterial, Cat 4 = Minor Arterial, Cat 6 = Adjacent to Parcel")


ParcelJSON = {}


for i,(polyline, categories) in enumerate(zip(ParcelBoundaryPolyline,ParcelCategories)):
    parcelKey = str(i)
    
    ParcelJSON[parcelKey] = {}
    ParcelJSON[parcelKey]["EdgeCategory"] = categories
    ParcelJSON[parcelKey]["ParcelCoordinates"] = [[pt[0],pt[1],pt[2]] for pt in gh.ControlPoints(polyline)[0]]
    #ParcelJSON[parcelKey]["Draco"] = dracomeshes[i]
    ParcelJSON[parcelKey]["Area"] = area[i]
    ParcelJSON[parcelKey]["Scores"] = [orientation[i], elongation[i], compactness[i], convexity[i]]

ParcelBoundaryPolyline = th.list_to_tree(ParcelBoundaryPolyline)
ParcelCategories = th.list_to_tree(ParcelCategories)
ParcelJSON = json.dumps(ParcelJSON)
# ---------- end ghpython_script_31 ----------
panel_15 = Panel(ghpython_script_31.out)
explode_2 = Explode(Curve=ghpython_script_31.ParcelBoundaryPolyline, Recursive=True)  # -> Segments, Vertices
geometry_12 = Geometry(ghpython_script_31.ParcelBoundaryPolyline)
trim_tree = TrimTree(Tree=explode_2.Segments, Depth=1)
curve_middle_3 = CurveMiddle(Curve=trim_tree)
size_2 = Slider(10, range=0..10)
colour_swatch_3 = ColourSwatch(SwatchColor=RGB(184, 33, 153))
custom_preview_3 = CustomPreview(Geometry=trim_tree, Material=colour_swatch_3)
text_tag_3d_2 = TextTag3D(Location=curve_middle_3, Text=ghpython_script_31.ParcelCategories, Size=size_2, Colour=colour_swatch_3, Justification=5)
path_mapper_14 = PathMapper(ghpython_script_31.ParcelJSON, source="{0;0;0;0;0;0;0}", target="{0}")
path_mapper_15 = PathMapper(ghpython_script_30.a, source="{i}", target="{2}")
path_mapper_16 = PathMapper(ghpython_script_20.dracoList, source="{i}", target="{1}")
merge_6 = Merge(Data1=path_mapper_14, Data2=path_mapper_16, Data3=path_mapper_15)

explode_3 = Explode(Curve=geometry_12, Recursive=True)  # -> Segments, Vertices

# ---- group: RH_OUT:Offset
text_5 = Text(merge_5)

# ---- group: RH_OUT:ParcelGenerationJSON
text_6 = Text(merge_6)

# ==== cluster Cluster
geometry = ClusterInput()

# ----
# sort road
geometry_2 = Geometry(geometry)
length = Length(Curve=geometry_2)
list_length = ListLength(List=length)
random = Random(Range=Domain(0, 1), Number=list_length, Seed=2)
bounds = Bounds(Numbers=random)
remap_numbers = RemapNumbers(Value=random, Source=bounds, Target=Domain(0, 1))  # -> Mapped, Clipped
bounds_2 = Bounds(Numbers=remap_numbers.Mapped)
deconstruct_domain = DeconstructDomain(Domain=bounds_2)  # -> Start, End
gradient = Gradient(
    LowerLimit=deconstruct_domain.Start,
    UpperLimit=deconstruct_domain.End,
    Parameter=random,
    stops=[0: RGB(243, 57, 0), 0.1: RGB(236, 27, 60), 0.2: RGB(210, 0, 118), 0.3: RGB(103, 0, 120), 0.4: RGB(39, 72, 161), 0.5: RGB(1, 192, 229), 0.6: RGB(18, 178, 90), 0.7: RGB(79, 186, 8), 0.8: RGB(220, 237, 32), 0.9: RGB(247, 159, 20), 1: RGB(243, 57, 0)])
custom_preview_lineweights = CustomPreviewLineweights(Geometry=geometry_2, Shader=gradient, Thickness=Slider(6, range=0..10), Absolute=False)

# ==== cluster Cluster_3
geometry = ClusterInput()
geometry_2 = ClusterInput()
geometry_3 = ClusterInput()
geometry_4 = ClusterInput()
vector = ClusterInput()
geometry_5 = ClusterInput()
geometry_6 = ClusterInput()
geometry_7 = ClusterInput()
geometry_8 = ClusterInput()

# ----
# edge classification preview
cluster = Cluster_2(geometry=geometry)

# ----
# node indices
geometry_9 = Geometry(geometry_2)
point_list = PointList(Points=geometry_9, Size=Slider(2, range=0..10))

# ----
# streamline
panel = Panel(ClusterInput())
panel_2 = Panel(ClusterInput())
geometry_10 = Geometry(geometry_6)
geometry_11 = Geometry(geometry_7)

# ----
# StraightLine
panel_3 = Panel(ClusterInput())
geometry_12 = Geometry(geometry_3)

# ----
# Best Crv
geometry_13 = Geometry(geometry_4)

# ----
# node normals
vector_display_ex = VectorDisplayEx(Point=geometry_2, Vector=vector, Colour=RGB(0, 0, 0), Width=2)

# ----
# DetectRegion
geometry_14 = Geometry(geometry_5)

# ----
# Crv Options
geometry_15 = Geometry(geometry_8)

# ==== cluster Cluster_4
curve = ClusterInput()
explode = Explode(Curve=curve, Recursive=True)  # -> Segments, Vertices
list_length = ListLength(List=explode.Segments)
ghpython_script = GhPythonScript(length=list_length)  # -> out, EdgeCat
# ---------- ghpython_script: Python ----------
def generate_ones_string(num):
    return ','.join(['4'] * num)


EdgeCat = generate_ones_string(length)
# ---------- end ghpython_script ----------
edgecat = ClusterOutput(ghpython_script.EdgeCat)

# ==== cluster Cluster_5
file_path = FilePath("C:\Users\asdbe\OneDrive - Singapore University of Technology and Design\2022_UrbanDesignOptimization\03_Models\02_Parametric GH models\ParcellationScript\proj\Modules\WebApp_Func.py")
file_path_2 = FilePath("C:\Users\asdbe\OneDrive - Singapore University of Technology and Design\2022_UrbanDesignOptimization\03_Models\02_Parametric GH models\ParcellationScript\proj\Modules\EV_AccessPoint.py")
file_path_3 = FilePath("C:\Users\asdbe\OneDrive - Singapore University of Technology and Design\2022_UrbanDesignOptimization\03_Models\02_Parametric GH models\ParcellationScript\proj\Modules\DM.py")
file_path_4 = FilePath("C:\Users\asdbe\OneDrive - Singapore University of Technology and Design\2022_UrbanDesignOptimization\03_Models\02_Parametric GH models\ParcellationScript\proj\Modules\EV.py")
file_path_5 = FilePath("C:\Users\asdbe\OneDrive - Singapore University of Technology and Design\2022_UrbanDesignOptimization\03_Models\02_Parametric GH models\ParcellationScript\proj\Modules\PL.py")
file_path_6 = FilePath("C:\Users\asdbe\OneDrive - Singapore University of Technology and Design\2022_UrbanDesignOptimization\03_Models\02_Parametric GH models\ParcellationScript\proj\Modules\SPF.py")
file_path_7 = FilePath("C:\Users\asdbe\OneDrive - Singapore University of Technology and Design\2022_UrbanDesignOptimization\03_Models\02_Parametric GH models\ParcellationScript\proj\Modules\RF.py")
file_path_8 = FilePath("C:\Users\asdbe\OneDrive - Singapore University of Technology and Design\2022_UrbanDesignOptimization\03_Models\02_Parametric GH models\ParcellationScript\proj\Modules\GRP.py")
file_path_9 = FilePath("C:\Users\asdbe\OneDrive - Singapore University of Technology and Design\2022_UrbanDesignOptimization\03_Models\02_Parametric GH models\ParcellationScript\proj\Modules\PP.py")
file_path_10 = FilePath("C:\Users\asdbe\OneDrive - Singapore University of Technology and Design\2022_UrbanDesignOptimization\03_Models\02_Parametric GH models\ParcellationScript\proj\Modules\RD.py")
file_path_11 = FilePath("C:\Users\asdbe\OneDrive - Singapore University of Technology and Design\2022_UrbanDesignOptimization\03_Models\02_Parametric GH models\ParcellationScript\proj\Modules\OP.py")
file_path_12 = FilePath("C:\Users\asdbe\OneDrive - Singapore University of Technology and Design\2022_UrbanDesignOptimization\03_Models\02_Parametric GH models\ParcellationScript\proj\Modules\PC.py")
file_path_13 = FilePath("C:\Users\asdbe\OneDrive - Singapore University of Technology and Design\2022_UrbanDesignOptimization\03_Models\02_Parametric GH models\ParcellationScript\proj\Modules\SLG.py")
file_path_14 = FilePath("C:\Users\asdbe\OneDrive - Singapore University of Technology and Design\2022_UrbanDesignOptimization\03_Models\02_Parametric GH models\ParcellationScript\proj\Modules\OF.py")

read_file = ReadFile(File=file_path_2, PerLineParse=False)
ghpython_script = GhPythonScript(Code=read_file)  # -> Out, EV_AccessPoint

read_file_2 = ReadFile(File=file_path, PerLineParse=False)
ghpython_script_2 = GhPythonScript(Code=read_file_2)  # -> Out, WebApp_Func

read_file_3 = ReadFile(File=file_path_12, PerLineParse=False)
ghpython_script_3 = GhPythonScript(Code=read_file_3)  # -> Out, PC

read_file_4 = ReadFile(File=file_path_3, PerLineParse=False)
ghpython_script_4 = GhPythonScript(Code=read_file_4)  # -> Out, DM

read_file_5 = ReadFile(File=file_path_13, PerLineParse=False)
ghpython_script_5 = GhPythonScript(Code=read_file_5)  # -> Out, SLG

read_file_6 = ReadFile(File=file_path_4, PerLineParse=False)
ghpython_script_6 = GhPythonScript(Code=read_file_6)  # -> Out, EV

read_file_7 = ReadFile(File=file_path_5, PerLineParse=False)
ghpython_script_7 = GhPythonScript(Code=read_file_7)  # -> Out, PL

read_file_8 = ReadFile(File=file_path_6, PerLineParse=False)
ghpython_script_8 = GhPythonScript(Code=read_file_8)  # -> Out, SPF

read_file_9 = ReadFile(File=file_path_7, PerLineParse=False)
ghpython_script_9 = GhPythonScript(Code=read_file_9)  # -> Out, RF

read_file_10 = ReadFile(File=file_path_8, PerLineParse=False)
ghpython_script_10 = GhPythonScript(Code=read_file_10)  # -> Out, GRP

read_file_11 = ReadFile(File=file_path_9, PerLineParse=False)
ghpython_script_11 = GhPythonScript(Code=read_file_11)  # -> Out, PP

read_file_12 = ReadFile(File=file_path_10, PerLineParse=False)
ghpython_script_12 = GhPythonScript(Code=read_file_12)  # -> Out, RD

read_file_13 = ReadFile(File=file_path_11, PerLineParse=False)
ghpython_script_13 = GhPythonScript(Code=read_file_13)  # -> Out, OP

read_file_14 = ReadFile(File=file_path_14, PerLineParse=False)
ghpython_script_14 = GhPythonScript(Code=read_file_14)  # -> Out, OF

# ==== cluster Cluster_2
geometry = ClusterInput()
geometry_2 = Geometry(geometry)
colour_swatch = ColourSwatch(SwatchColor=RGB(255, 255, 255))
list_length = ListLength(List=geometry_2)
curve_middle = CurveMiddle(Curve=geometry_2)
range = Range(Domain=list_length, Steps=expr("x-1", list_length))
point_list = PointList(Points=curve_middle, Size=Slider(3, range=0..10))
gradient = Gradient(
    LowerLimit=0,
    UpperLimit=list_length,
    Parameter=range,
    stops=[0: RGB(0, 128, 0), 0.5: RGB(255, 255, 0), 1: RGB(255, 0, 0)])
custom_preview_lineweights = CustomPreviewLineweights(Geometry=geometry_2, Shader=gradient, Thickness=Slider(3, range=0..10), Absolute=False)
