# Grasshopper definition ParcellationSmoothNew.gh (Grasshopper 1.0.7)
# plug-ins: Human

# Input Parcel Boundary
panel = Panel("11559602.370696694,142727.33276195035,11559717.830303703,142861.26834958218,11559974.317727262,142713.1315186136,11559888.428321244,142583.57212056455,11559722.808706393,142489.22759215147,11559602.370696694,142727.33276195035")

# ----
# Access points
panel_2 = Panel("11559664.379624356")

# ----
# Min area and ideal orientation
min_area = Slider(10000, range=0..150000)
idealorientation = Slider(0, range=0..1)

# ---- group: parcellation model
# Road Selection para
continuity = Slider(0.2, range=0..4)
sidenumber = Slider(3.5, range=0..4)
anglevar = Slider(2.1, range=0..4)
lengthvar = Slider(4, range=0..4)
access = Slider(0, range=0..4)
evenarea = Slider(1.7, range=0..4)
orientation = Slider(0, range=0..4)
entwine = Entwine(
    Branch00=continuity,
    Branch01=sidenumber,
    Branch02=anglevar,
    Branch03=lengthvar,
    Branch04=access,
    Branch05=evenarea,
    Branch06=orientation,
    FlattenInputs=True)  # -> flatten(Result)

# ---- group: road length/angle-dominance : 0 for length, 1 for angle
# Road Selection para
wa = Slider(0.6, range=0..1)

# ---- group: Make the parcel side length equal
parcelsidelengthstrength = Slider(0, range=0..10000)

# ---- group: Keep the vertices in the initial position
# Optimization para ( set default first )
vanchorstrength = Slider(1000, range=0..10000)

# ---- group: Keep the naked vertices on the boundary crv
voncrvstrength = Slider(0, range=0..10000)

# ---- group: Keep the between points in the initial position
panchorstrength = Slider(10, range=0..10000)

# ---- group: Make the continuous road smooth
roadsmoothstrength = Slider(50000, range=0..100000)

# ---- group: Make the road junction angle orthogonal
roadjunctionanglestrength = Slider(0, range=0..50000)

# ---- group: Make the parcel side smooth
parcelsidesmoothstrength = Slider(10000, range=0..10000)

# ---- group: Make the parcel angle orthogonal
parcelsideanglestrength = Slider(0, range=0..50000)

# ---- group: Make the adjacency parcels smoothly arranged
parceladjacencystrength = Slider(10000, range=0..10000)

# ----
# Split parcel
python = GhPythonScript()  # -> out, PC
# ---------- python: Python ----------
###########################
####    Import Libs    ####
###########################
import Rhino.Geometry as rg
#import Rhino.RhinoDoc as rd
import Rhino.RhinoMath as rm

import ghpythonlib.components as ghc
import math

import clr
clr.AddReference("PlanktonGh.dll")
#clr.AddReferenceToFileAndPath("C:/Users/Anna Yenardi/OneDrive - Singapore University of Technology and Design/2022_UrbanDesignOptimization/03_Models/03_Web dev JS materials/2212_arcgis_trial/gh/PlanktonGh.dll")
#clr.AddReferenceToFileAndPath(r"C:\Users\jingz\AppData\Roaming\Grasshopper\Libraries\plankton\PlanktonGH.dll")
#clr.AddReferenceToFileAndPath("C:/Users/Administrator/Desktop/Plankton/PlanktonGh.dll")


import PlanktonGh
clr.ImportExtensions(PlanktonGh.RhinoSupport)

# clr.AddReferenceToFile("Wrapper.dll")
# import Eigen.Wrapper

# from System.Collections.Generic import List

try:
    clr.AddReference("CGAL.Wrapper.dll")
    import CGAL.Wrapper
except:
    print ("not using CGAL")
from System.Collections.Generic import List


##########################
####    Processing    ####
##########################
class PC:
    class ProcessVertex:
        def __init__(self,vh,index): 
            self.vh = vh                    
            self.index = index 
            self.geometry = rg.Point3d(vh.X,vh.Y,vh.Z)      
            self.closestPoint = None                   
            self.crossField = None   
            
            self.distanceEverySegment = None   
            self.closestEdgeIndex = None     
            self.is_OnEdge = None
            self.is_MedialAxisVertex = None
            self.incident=[]
            self.standard=None
            self.boundaryConstraint=None
            self.corner=None
            self.constraintA=None
            self.is_OnConstraintA = None

            self.const = None
            self.prev_onEdgeIndex = None
            self.next_onEdgeIndex = None
            self.prev_const = None
            self.next_const = None
            self.segmentLength = None
            
        def __del__(self):
            self.vh = None
            self.index = None
            self.crossField = None
            self.distanceEverySegment = None
            self.closestEdgeIndex = None
            self.is_OnEdge = None
            self.is_MedialAxisVertex = None
            
            self.distanceEverySegment = None   
            self.closestEdgeIndex = None     
            self.is_OnEdge = None
            self.is_MedialAxisVertex = None
            self.incident=None
            self.standard=None
            self.corner=None
            self.constraintA=None
            self.is_OnConstraintA = None

            self.const = None
            self.prev_onEdgeIndex = None
            self.next_onEdgeIndex = None
            self.prev_const = None
            self.next_const = None
            self.segmentLength = None
            
    class ProcessTriangle:
        def __init__(self,fh,index):  
            self.triangleFh = fh                   
            self.index = index 
            self.triangleVertices = None         
            self.triangleBoundary = None       
            self.centroid = None                       
            self.is_MedialAxis = None                      
            self.is_Singularity = None                     
        
        def __del__(self):
            self.triangleFh = None                   
            self.index = None 
            self.triangleVertices = None         
            self.triangleBoundary = None       
            self.centroid = None                       
            self.is_MedialAxis = None                      
            self.is_Singularity = None  
            
    class ProcessMesh:
        def __init__(self):
            self.vertexList = None
            self.triangleList = None
            self.triRemeshBoundary = None
            self.delaunayMesh= None
            self.halfEdgeMesh=None
            self.length=None
            self.singularities= None

        def __del__(self):
            self.vertexList = None
            self.triangleList = None
            self.triRemeshBoundary = None
            self.delaunayMesh= None
            self.halfEdgeMesh=None
            self.length=None
            
        def InitializeInput(self,input,length):
            
            
            # print ("SimplifyVertices before "),len(input)
            # input = PC.SimplifyVertices(input)
            # input = PC.ConvertPolylineCurveToPolyline(input)
            # print ("SimplifyVertices after "),len(input)


            ###Get the vertices, pop the last one
            inputVertices=[]
            for index in range(len(input)-1):
                inputVertices.append(input[index])


            ### Make Sure there is not too close points, pending to delect this  
            # newPtList = []
            # newPtList.append(inputVertices[0])
            # for i in range(1,len(inputVertices) - 1,1):
            #     if inputVertices[i].DistanceTo(inputVertices[i+1]) < 0.01:
            #         pass
            #     else:
            #         newPtList.append(inputVertices[i])
            
            # newPtList.append(inputVertices[-1])
            
            # if newPtList[len(newPtList)-1].DistanceTo(newPtList[len(newPtList)-2]) < 0.01:
            #     newPtList.pop(len(newPtList)-2)
            ### Make Sure there is not too close points, pending to delect this  
 
            newPtList = inputVertices
            newPtList = List[rg.Point3d](newPtList)

            # # # # # # # # # # # # # # # # 
            # CGAL_Remesh : start
            # print "CGAL_Remesh : start"
            
            # for pt in newPtList:
            #     print (pt.X),pt.Y, 0
            delaunayMesh = CGAL.Wrapper.GeometryProcessingMethods.CGAL_Remesh(newPtList,0.125,length,20) 
            facecount=delaunayMesh.Faces.Count
            whileCount = 0
            
            while facecount<200:
                whileCount+=1

                length=length * 0.8
                whileCount+=1
                newPtList = List[rg.Point3d](inputVertices)
                delaunayMesh = CGAL.Wrapper.GeometryProcessingMethods.CGAL_Remesh(newPtList,0.125,length,20) 
                try:
                    facecount=delaunayMesh.Faces.Count

                except:
                    print ("CGAL_Remesh failed")
                    break

                #print ("Inside InitializeInput while loop, checking facecount:"),facecount

                if whileCount>10:
                    print ("I am going to break the while loop")
                    print ("currently the length is %f"%(length)), "facecount:",facecount
                    break
            
            while facecount>400:
                whileCount+=1

                length=length * 1.2
                whileCount+=1
                newPtList = List[rg.Point3d](inputVertices)
                delaunayMesh = CGAL.Wrapper.GeometryProcessingMethods.CGAL_Remesh(newPtList,0.125,length,20) 
                try:
                    facecount=delaunayMesh.Faces.Count

                except:
                    print ("CGAL_Remesh failed")
                    break

                #print ("Inside InitializeInput while loop, checking facecount:"),facecount

                if whileCount>10:
                    print ("I am going to break the while loop_larger")
                    print ("currently the length is %f"%(length)), "facecount:",facecount
                    break
                    
            # CGAL_Remesh : end 
            # # # # # # # # # # # # # # # # 

            # # # # # # # # # # # # # # # #
            # ghc_Remesh : start 
            # mesh= rg.Mesh.CreateFromClosedPolyline(input)
            # print ("Convert a polyline into mesh, its ") ,mesh.IsValid

            # if mesh.IsValid  == False:
            #     print ("mesh IsValid!!!!!!!!!!!!!!!!!!!!!!!!!!!!!!!!!!!!!!!!!!!!!!!!!!!!!!!!!!!!!!!!!!!!!!!!!!!!!!!")
            #     for pt in input:
            #         print (pt.X),",",(pt.Y),",",(pt.Z)
    
            # delaunayMesh, dual, creases= ghc.Kangaroo2Component.TriRemesh(
            # geometry = mesh,
            # sharp = True,
            # features = inputVertices,
            # length = length,
            # iterations = 50,)     
                 
            # facecount=delaunayMesh.Faces.Count
            # whileCount=0
            # while facecount<200:
                
            #     length=length * 0.8
            #     whileCount+=1
            #     #print ("trying length: %f"%(length))
            #     delaunayMesh, dual, creases= ghc.Kangaroo2Component.TriRemesh(
            #                 geometry = mesh,
            #                 sharp = True,
            #                 features = inputVertices,
            #                 length = length,
            #                 iterations = 50,)
            #     if whileCount>5:
            #         print ("I am going to break the while loop")
            #         print ("currently the length is %f"%(length)), "facecount:",facecount
            #         break
            #     try:
            #         facecount=delaunayMesh.Faces.Count
            #     except:
            #         print ("inputcurve")
            #         for pt in input:
            #             print (pt.X),",",(pt.Y),",",(pt.Z)
            #         print ("mesh.Vertices")
            #         for i in range(len(mesh.Vertices)):
            #             print (mesh.Vertices[i])
                        
            #         print ("mesh.Faces")
            #         for i in range(len(mesh.Faces)):
            #             print (mesh.Faces[i])
                        
            #         print ("inputVertices")
            #         for pt in inputVertices:
            #             print (pt.X),",",(pt.Y),",",(pt.Z)
            #         break
            
            # ghc_Remesh : end        
            # # # # # # # # # # # # # # # #       
            
            halfEdgeMesh = delaunayMesh.ToPlanktonMesh()
            facecount=delaunayMesh.Faces.Count
            print ("outside while loop, checking facecount" ),facecount
            

            ###Get the offset boundary
            wxy_Plane=rg.Plane.WorldXY
            #tol = rd.ActiveDoc.ModelAbsoluteTolerance
            tol = 0.001
            triRemeshBoundary = input
            triRemeshBoundary_curve = input.ToPolylineCurve()
            
            
            offset1= triRemeshBoundary_curve.Offset(wxy_Plane,tol,tol,rg.CurveOffsetCornerStyle.Sharp)[0]
            offset2= triRemeshBoundary_curve.Offset(wxy_Plane,-tol,tol,rg.CurveOffsetCornerStyle.Sharp)[0]
            
            
            if offset1.GetLength() > offset2.GetLength() :
                offsetTriRemeshBoundary = offset1
            else:
                offsetTriRemeshBoundary = offset2
            
            faceList_HEM=halfEdgeMesh.Faces
            edgeList_HEM=halfEdgeMesh.Halfedges
            vertexList_HEM=halfEdgeMesh.Vertices
            
            
            ##################################
            ###store vertices in vertexList###
            ##################################
            processVertexList=[]
            for i in range(vertexList_HEM.Count):
                processVertex=PC.ProcessVertex(vertexList_HEM[i],i)
                processVertexList.append(processVertex)
            
            #closestEdgeIndices=[]
            #result = self.GetEdgeIndices(triRemeshBoundary)
            #newEdgeIndices =  result[0]
            #newEdgeSegments = result[1]

            ###add the rest info
            for processVertex in processVertexList:
                
                self.GetClosestPointOnOffsetBoundary(processVertex,offsetTriRemeshBoundary)
                self.CreateCrossField(processVertex)
                #self.GetDistanceToEverySegment(processVertex,newEdgeSegments)
                #self.GetClosestEdgeIndex(processVertex,newEdgeIndices)
                self.CheckVertexOnEdge(processVertex,halfEdgeMesh)
                
            self.RenewVerticesOnEdgeCrossfield_TangentMethod(processVertexList,halfEdgeMesh,input)
            
            ##################################
            ###   store faces in faceList  ###
            ##################################
            
            ###store triFace in faceList
            processTriangleList=[]
            for i in range(faceList_HEM.Count):
                processTriangle=PC.ProcessTriangle(faceList_HEM[i],i)
                processTriangleList.append(processTriangle)
            
            ###add the rest info
            for i in range(faceList_HEM.Count):
                threeVerticesIndices = faceList_HEM.GetVertices(i)
                try:
                    triangleVertices=[processVertexList[threeVerticesIndices[0]],processVertexList[threeVerticesIndices[1]],processVertexList[threeVerticesIndices[2]]]
                except:
                    print ("in initializeInput ")
                    print ("this lengthL"),length, (" face num"),halfEdgeMesh.Faces.Count
                    
                    
                processTriangleList[i].triangleVertices=triangleVertices
            
                self.GetTriangle(processTriangleList[i])
                self.GetTriangleCentroid(processTriangleList[i])
                #self.CheckMedialAxisTriangle(processTriangleList[i])
                
            

            #####################################
            ###   store all in to ProcessMesh ###
            #####################################
            
            
            self.vertexList = processVertexList
            self.triangleList = processTriangleList
            self.triRemeshBoundary = triRemeshBoundary
            self.delaunayMesh= delaunayMesh
            self.halfEdgeMesh= halfEdgeMesh
            self.length = length
            #print "pMesh recording:",length
            self.CalculateOriginalBigD()
            
            sinIndices,coefficients_Collection = self.GetSingularityTriangleInfo()
            singularities = self.Getsingularities(sinIndices,coefficients_Collection)
            self.singularities = singularities
            
        def InitializeInput_DB(self,input,length):
            
            
            print ("SimplifyVertices before "),len(input)
            input = PC.SimplifyVertices(input)
            input = PC.ConvertPolylineCurveToPolyline(input)
            print ("SimplifyVertices after "),len(input)


            ###Get the vertices, pop the last one
            inputVertices=[]
            for index in range(len(input)-1):
                inputVertices.append(input[index])


            ### Make Sure there is not too close points, pending to delect this  
            newPtList = []
            newPtList.append(inputVertices[0])
            for i in range(1,len(inputVertices) - 1,1):
                if inputVertices[i].DistanceTo(inputVertices[i+1]) < 0.01:
                    pass
                else:
                    newPtList.append(inputVertices[i])
            
            newPtList.append(inputVertices[-1])
            
            if newPtList[len(newPtList)-1].DistanceTo(newPtList[len(newPtList)-2]) < 0.01:
                newPtList.pop(len(newPtList)-2)
            ### Make Sure there is not too close points, pending to delect this  
 
            
            newPtList = List[rg.Point3d](newPtList)

            # # # # # # # # # # # # # # # # 
            # CGAL_Remesh : start
            #delaunayMesh = CGAL.Wrapper.GeometryProcessingMethods.CGAL_Remesh(newPtList,0.125,length,50) 
            #facecount=delaunayMesh.Faces.Count
            #whileCount = 0
            # CGAL_Remesh : end 
            # # # # # # # # # # # # # # # # 

            # # # # # # # # # # # # # # #
            #ghc_Remesh : start 
            mesh= rg.Mesh.CreateFromClosedPolyline(input)
            # print ("Convert a polyline into mesh, its ") ,mesh.IsValid

            # if mesh.IsValid  == False:
            #     print ("mesh IsValid!!!!!!!!!!!!!!!!!!!!!!!!!!!!!!!!!!!!!!!!!!!!!!!!!!!!!!!!!!!!!!!!!!!!!!!!!!!!!!!")
            #     for pt in input:
            #         print (pt.X),",",(pt.Y),",",(pt.Z)
    
            delaunayMesh, dual, creases= ghc.Kangaroo2Component.TriRemesh(
            geometry = mesh,
            sharp = True,
            features = inputVertices,
            length = length,
            iterations = 50,)     
                 
            # facecount=delaunayMesh.Faces.Count
            # whileCount=0
            # while facecount<200:
                
            #     length=length * 0.8
            #     whileCount+=1
            #     #print ("trying length: %f"%(length))
            #     delaunayMesh, dual, creases= ghc.Kangaroo2Component.TriRemesh(
            #                 geometry = mesh,
            #                 sharp = True,
            #                 features = inputVertices,
            #                 length = length,
            #                 iterations = 50,)
            #     if whileCount>5:
            #         print ("I am going to break the while loop")
            #         print ("currently the length is %f"%(length)), "facecount:",facecount
            #         break
            #     try:
            #         facecount=delaunayMesh.Faces.Count
            #     except:
            #         print ("inputcurve")
            #         for pt in input:
            #             print (pt.X),",",(pt.Y),",",(pt.Z)
            #         print ("mesh.Vertices")
            #         for i in range(len(mesh.Vertices)):
            #             print (mesh.Vertices[i])
                        
            #         print ("mesh.Faces")
            #         for i in range(len(mesh.Faces)):
            #             print (mesh.Faces[i])
                        
            #         print ("inputVertices")
            #         for pt in inputVertices:
            #             print (pt.X),",",(pt.Y),",",(pt.Z)
            #         break
            
            # ghc_Remesh : end        
            # # # # # # # # # # # # # # # #       
            
            halfEdgeMesh = delaunayMesh.ToPlanktonMesh()
            facecount=delaunayMesh.Faces.Count
            print ("outside while loop, checking facecount" ),facecount
            

            ###Get the offset boundary
            wxy_Plane=rg.Plane.WorldXY
            #tol = rd.ActiveDoc.ModelAbsoluteTolerance
            tol = 0.001
            triRemeshBoundary = input
            triRemeshBoundary_curve = input.ToPolylineCurve()
            
            
            offset1= triRemeshBoundary_curve.Offset(wxy_Plane,tol,tol,rg.CurveOffsetCornerStyle.Sharp)[0]
            offset2= triRemeshBoundary_curve.Offset(wxy_Plane,-tol,tol,rg.CurveOffsetCornerStyle.Sharp)[0]
            
            
            if offset1.GetLength() > offset2.GetLength() :
                offsetTriRemeshBoundary = offset1
            else:
                offsetTriRemeshBoundary = offset2
            
            faceList_HEM=halfEdgeMesh.Faces
            edgeList_HEM=halfEdgeMesh.Halfedges
            vertexList_HEM=halfEdgeMesh.Vertices
            
            
            ##################################
            ###store vertices in vertexList###
            ##################################
            processVertexList=[]
            for i in range(vertexList_HEM.Count):
                processVertex=PC.ProcessVertex(vertexList_HEM[i],i)
                processVertexList.append(processVertex)
            
            closestEdgeIndices=[]
            #result = self.GetEdgeIndices(triRemeshBoundary)
            #newEdgeIndices =  result[0]
            #newEdgeSegments = result[1]
            newEdgeIndices =  range(input.SegmentCount )
            newEdgeSegments = input.GetSegments()
            ###add the rest info
            for processVertex in processVertexList:
                
                self.GetClosestPointOnOffsetBoundary(processVertex,offsetTriRemeshBoundary)
                self.CreateCrossField(processVertex)
                self.GetDistanceToEverySegment(processVertex,newEdgeSegments)
                self.GetClosestEdgeIndex(processVertex,newEdgeIndices)
                self.CheckVertexOnEdge(processVertex,halfEdgeMesh)
                
            self.RenewVerticesOnEdgeCrossfield_TangentMethod(processVertexList,halfEdgeMesh,input)
            
            ##################################
            ###   store faces in faceList  ###
            ##################################
            
            ###store triFace in faceList
            processTriangleList=[]
            for i in range(faceList_HEM.Count):
                processTriangle=PC.ProcessTriangle(faceList_HEM[i],i)
                processTriangleList.append(processTriangle)
            
            ###add the rest info
            for i in range(faceList_HEM.Count):
                threeVerticesIndices = faceList_HEM.GetVertices(i)
                try:
                    triangleVertices=[processVertexList[threeVerticesIndices[0]],processVertexList[threeVerticesIndices[1]],processVertexList[threeVerticesIndices[2]]]
                except:
                    print ("in initializeInput ")
                    print ("this lengthL"),length, (" face num"),halfEdgeMesh.Faces.Count
                    
                    
                processTriangleList[i].triangleVertices=triangleVertices
            
                self.GetTriangle(processTriangleList[i])
                self.GetTriangleCentroid(processTriangleList[i])
                #self.CheckMedialAxisTriangle(processTriangleList[i])

            #for i in  range(faceList_HEM.Count):
                #self.CheckMedialAxisVertex(processTriangleList[i])   
            

            #####################################
            ###   store all in to ProcessMesh ###
            #####################################
            
            
            self.vertexList = processVertexList
            self.triangleList = processTriangleList
            self.triRemeshBoundary = triRemeshBoundary
            self.delaunayMesh= delaunayMesh
            self.halfEdgeMesh= halfEdgeMesh
            self.length = length
            #print "pMesh recording:",length
            self.CalculateOriginalBigD()
            
            sinIndices,coefficients_Collection = self.GetSingularityTriangleInfo()
            singularities = self.Getsingularities(sinIndices,coefficients_Collection)
            self.singularities = singularities
            
            return newEdgeIndices , newEdgeSegments
            
        def InitializeInput_H(self,input,length):
            
            ###Get the vertices, pop the last one
            inputVertices=[]
            for index in range(len(input)-1):
                inputVertices.append(input[index])

            
            print ("SimplifyVertices before "),len(input)
            input = PC.SimplifyVertices(input)
            input = PC.ConvertPolylineCurveToPolyline(input)
            print ("SimplifyVertices after "),len(input)



            ptList = List[rg.Point3d](inputVertices)


            # # # # # # # # # # # # # # # # 
            # CGAL_Remesh : start
            #delaunayMesh = CGAL.Wrapper.GeometryProcessingMethods.CGAL_Remesh(ptList,0.125,length,50) 
            #facecount=delaunayMesh.Faces.Count
            #whileCount = 0
            # CGAL_Remesh : end 
            # # # # # # # # # # # # # # # # 


            # ghc_Remesh : start 
            mesh= rg.Mesh.CreateFromClosedPolyline(input)
            print ("Convert a polyline into mesh, its ") ,mesh.IsValid
            delaunayMesh, dual, creases= ghc.Kangaroo2Component.TriRemesh(
                        geometry = mesh,
                        sharp = True,
                        features = inputVertices,
                        length = length,
                        iterations = 50,)
            #if mesh.IsValid  == False:
                #print ("mesh IsValid!!!!!!!!!!!!!!!!!!!!!!!!!!!!!!!!!!!!!!!!!!!!!!!!!!!!!!!!!!!!!!!!!!!!!!!!!!!!!!!")
                #for pt in input:
                    #print (pt.X),",",(pt.Y),",",(pt.Z)

            # while facecount<200:
                
            #     length=length * 0.8
            #     whileCount+=1
            #     #print ("trying length: %f"%(length))
            #     delaunayMesh, dual, creases= ghc.Kangaroo2Component.TriRemesh(
            #                 geometry = mesh,
            #                 sharp = True,
            #                 features = inputVertices,
            #                 length = length,
            #                 iterations = 50,)
            #     if whileCount>5:
            #         print ("I am going to break the while loop")
            #         print ("currently the length is %f"%(length)), "facecount:",facecount
            #         break
            #     try:
            #         facecount=delaunayMesh.Faces.Count
            #     except:
            #         print ("inputcurve")
            #         for pt in input:
            #             print (pt.X),",",(pt.Y),",",(pt.Z)
            #         print ("mesh.Vertices")
            #         for i in range(len(mesh.Vertices)):
            #             print (mesh.Vertices[i])
                        
            #         print ("mesh.Faces")
            #         for i in range(len(mesh.Faces)):
            #             print (mesh.Faces[i])
                        
            #         print ("inputVertices")
            #         for pt in inputVertices:
            #             print (pt.X),",",(pt.Y),",",(pt.Z)
            #         break
                    
        
            
            halfEdgeMesh = delaunayMesh.ToPlanktonMesh()
            facecount=delaunayMesh.Faces.Count
            print ("outside while loop, checking facecount" ),facecount
            
    
            ##Get the new boundary
            # try:
            #     triRemeshBoundary_vIndices = self.GetBoundaryVertexIndices(halfEdgeMesh,input)
            # except:
            #     print ("this polyline")
            #     for pt in input:
            #         print (pt.X),",",(pt.Y),",",(pt.Z)
            # triRemeshBoundary_v = []
            
            # for i in triRemeshBoundary_vIndices:
            #     vertex =  rg.Point3d(halfEdgeMesh.Vertices[i].X,halfEdgeMesh.Vertices[i].Y,halfEdgeMesh.Vertices[i].Z)
            #     triRemeshBoundary_v.append(vertex)
            
            # triRemeshBoundary_v.append(triRemeshBoundary_v[0])
            # triRemeshBoundary = rg.Polyline(triRemeshBoundary_v)
            # triRemeshBoundary_curve = triRemeshBoundary.ToPolylineCurve()
            
            ###Get the offset boundary
            wxy_Plane=rg.Plane.WorldXY
            #tol = rd.ActiveDoc.ModelAbsoluteTolerance
            tol = 0.001
            triRemeshBoundary = input
            triRemeshBoundary_curve = input.ToPolylineCurve()
            
            
            offset1= triRemeshBoundary_curve.Offset(wxy_Plane,tol,tol,rg.CurveOffsetCornerStyle.Sharp)[0]
            offset2= triRemeshBoundary_curve.Offset(wxy_Plane,-tol,tol,rg.CurveOffsetCornerStyle.Sharp)[0]
            
            
            if offset1.GetLength() > offset2.GetLength() :
                offsetTriRemeshBoundary = offset1
            else:
                offsetTriRemeshBoundary = offset2
            
            faceList_HEM=halfEdgeMesh.Faces
            edgeList_HEM=halfEdgeMesh.Halfedges
            vertexList_HEM=halfEdgeMesh.Vertices
            
            
            ##################################
            ###store vertices in vertexList###
            ##################################
            processVertexList=[]
            for i in range(vertexList_HEM.Count):
                processVertex=PC.ProcessVertex(vertexList_HEM[i],i)
                processVertexList.append(processVertex)
            
            closestEdgeIndices=[]
            result = self.GetEdgeIndices(triRemeshBoundary)
            newEdgeIndices =  result[0]
            newEdgeSegments = result[1]

            ###add the rest info
            for processVertex in processVertexList:
                
                self.GetClosestPointOnOffsetBoundary(processVertex,offsetTriRemeshBoundary)
                self.CreateCrossField(processVertex)
                self.GetDistanceToEverySegment(processVertex,newEdgeSegments)
                self.GetClosestEdgeIndex(processVertex,newEdgeIndices)
                self.CheckVertexOnEdge(processVertex,halfEdgeMesh)
                
            self.RenewVerticesOnEdgeCrossfield_TangentMethod(processVertexList,halfEdgeMesh,input)
            
            ##################################
            ###   store faces in faceList  ###
            ##################################
            
            ###store triFace in faceList
            processTriangleList=[]
            for i in range(faceList_HEM.Count):
                processTriangle=PC.ProcessTriangle(faceList_HEM[i],i)
                processTriangleList.append(processTriangle)
            
            ###add the rest info
            for i in range(faceList_HEM.Count):
                threeVerticesIndices = faceList_HEM.GetVertices(i)
                try:
                    triangleVertices=[processVertexList[threeVerticesIndices[0]],processVertexList[threeVerticesIndices[1]],processVertexList[threeVerticesIndices[2]]]
                except:
                    print ("in initializeInput ")
                    print ("this lengthL"),length, (" face num"),halfEdgeMesh.Faces.Count
                    
                    
                processTriangleList[i].triangleVertices=triangleVertices
            
                self.GetTriangle(processTriangleList[i])
                self.GetTriangleCentroid(processTriangleList[i])
                self.CheckMedialAxisTriangle(processTriangleList[i])
                
            for i in  range(faceList_HEM.Count):
                self.CheckMedialAxisVertex(processTriangleList[i])

            #####################################
            ###   store all in to ProcessMesh ###
            #####################################
            
            
            self.vertexList = processVertexList
            self.triangleList = processTriangleList
            self.triRemeshBoundary = triRemeshBoundary
            self.delaunayMesh= delaunayMesh
            self.halfEdgeMesh= halfEdgeMesh
            self.length = length
            #print "pMesh recording:",length
            self.CalculateOriginalBigD()
            
            sinIndices,coefficients_Collection = self.GetSingularityTriangleInfo()
            singularities = self.Getsingularities(sinIndices,coefficients_Collection)
            self.singularities = singularities
            

        def CalculateOriginalBigD(self):
            
            for v in self.vertexList:
                vec = (v.crossField[0].X + 1j * v.crossField[0].Y) **4
                vecD = rg.Vector3d(vec.real,vec.imag,0)
                v.standard = vecD
            
        def GetBoundaryVertexIndices(self,HEM,curve):
            
            boundaryVIndices=[]
            
            for i in range(HEM.Vertices.Count):
                if HEM.Vertices.IsBoundary(i)==True:
                    startIndex = i
                    break
            try:
                boundaryVIndices.append(startIndex)
            except:
                print ("sth wrong in GetBoundaryVertexIndices")
                for i in range(HEM.Vertices.Count):
                    print (HEM.Vertices.IsBoundary(i))
                    print (HEM.Vertices[i].ToXYZ().X),",",(HEM.Vertices[i].ToXYZ().Y),",",(HEM.Vertices[i].ToXYZ().Z)
                
                print ("curve to be mesh")
                for pt in curve:
                    print (pt.X),",",(pt.Y),",",(pt.Z)
            set = HEM.Vertices.GetVertexNeighbours(startIndex)
            
            whileCount = 0
            while (len(boundaryVIndices)==1 or boundaryVIndices[len(boundaryVIndices)-1]!=boundaryVIndices[0]):
                whileCount+=1
                if whileCount>10000:
                    break
                curri=boundaryVIndices[len(boundaryVIndices)-1]
                set = HEM.Vertices.GetVertexNeighbours(curri)
                for index in set:
                    if HEM.Vertices.IsBoundary(index)==True:
                        boundaryVIndices.append(index)
                        break
            
            boundaryVIndices.pop()
            return boundaryVIndices
            
        def GetEdgeIndices(self,input):
            crv = self.MakeCounterClockwiseDirection(input)
            count=0
        
            ### get vertices
            vertices=[]
            for index in range(len(crv)-1):
                vertices.append(crv[index])
                
            edgeIndices=[]
            edgeSegments=[]
            
            for i in range(len(vertices)):
                if i==0:
                    vector1=rg.Vector3d(vertices[len(vertices)-1]-vertices[0])
                    vector2=rg.Vector3d(vertices[1]-vertices[0])    
                    edgeSegments.append(rg.Line(vertices[0],vertices[1]))     
                    
                elif i==len(vertices)-1:
                    vector1=rg.Vector3d(vertices[i-1]-vertices[len(vertices)-1])
                    vector2=rg.Vector3d(vertices[0]-vertices[len(vertices)-1])
                    edgeSegments.append(rg.Line(vertices[len(vertices)-1],vertices[0])) 
        
                else: 
                    vector1=rg.Vector3d(vertices[i-1]-vertices[i])
                    vector2=rg.Vector3d(vertices[i+1]-vertices[i])
                    edgeSegments.append(rg.Line(vertices[i],vertices[i+1])) 
                    
                angle = rm.ToDegrees(rg.Vector3d.VectorAngle(vector1,vector2))
                
                if rg.Vector3d.CrossProduct(vector1,vector2).Z>0:
                    angle=360-angle
                

                if angle<135 or angle>225:
                    count+=1
                
                edgeIndices.append(count)
                
            
            #[original,new]
            if edgeIndices[0]==1:
                for i in range(len(edgeIndices)):
                    edgeIndices[i]=edgeIndices[i]-1
            
            #check the seam position
            vector1=rg.Vector3d(vertices[len(vertices)-1]-vertices[0])
            vector2=rg.Vector3d(vertices[1]-vertices[0])
            
            angle = rm.ToDegrees(rg.Vector3d.VectorAngle(vector1,vector2))
            
            if rg.Vector3d.CrossProduct(vector1,vector2).Z>0:
                angle=360-angle
            
            lastIndex = edgeIndices[len(edgeIndices)-1]
            if angle>135 and angle<225 :
                for i in range(len(edgeIndices)):
                    if edgeIndices[i] ==lastIndex:
                        edgeIndices[i] =0
        
            return [edgeIndices,edgeSegments]
        
        @staticmethod
        def GetJoinedEdge(input,newIndex,edgeIndices):
            segments_curve = []
            segments_originalIndex = []
            for i in range(len(edgeIndices)):
                if edgeIndices[i] == newIndex:
                    segments_curve.append(input.SegmentAt(i))
                    segments_originalIndex.append(i)
            pts_curve = []
            
            maxIndex = len(edgeIndices)-1
            minIndex = 0
            
            if maxIndex in segments_originalIndex and minIndex in segments_originalIndex:
                # special case
                # sort the indices
                newOrder_Indices = []
                newOrder_Segments = []

                
                distToMax = []
                distToMin = []

                # caculate the distance
                for index in segments_originalIndex:
                    distToMax.append(abs(index-maxIndex))
                    distToMin.append(abs(index-minIndex))

                # store the First part
                for i in range(len(segments_originalIndex)):
                    if distToMax[i] < distToMin[i]:
                        newOrder_Indices.append(segments_originalIndex[i])

                # store the Second part
                for i in range(len(segments_originalIndex)):
                    if distToMin[i] < distToMax[i]:
                        newOrder_Indices.append(segments_originalIndex[i])
                
                # store the geometry
                for i in newOrder_Indices:
                    newOrder_Segments.append(input.SegmentAt(i))
        
                
                for seg in newOrder_Segments:
                    pts_curve.append(seg.From)
                pts_curve.append(newOrder_Segments[-1].To)
                
                curve = rg.Polyline(pts_curve)
                
                return curve
            else:
                for seg in segments_curve:
                    pts_curve.append(seg.From)
                    
                pts_curve.append(segments_curve[-1].To)
                
                curve = rg.Polyline(pts_curve)
                
                return curve
            
        @staticmethod
        def GetNewEdges(input):
            edgeIndices,edges= PC.ProcessMesh().GetEdgeIndices(input)
            newEdges = []
            numEdge = max(edgeIndices) + 1
            
            for index in range(numEdge):
                newEdges.append(PC.ProcessMesh.GetJoinedEdge(input,index,edgeIndices))
            
            return newEdges
            
        def MakeCounterClockwiseDirection(self,inputPolyline):
            inputPolyline_copy = rg.Polyline(inputPolyline)
            inputPolylineCurve = inputPolyline_copy.ToPolylineCurve()
            if inputPolylineCurve.ClosedCurveOrientation().ToString() == "Clockwise":
                inputPolyline_copy.Reverse()
        
            else:
                pass
            
            return inputPolyline_copy
            
        def GetClosestPointOnOffsetBoundary (self,processVertex,offsettriRemeshBoundary):
            vertex = processVertex.geometry
            
            t=offsettriRemeshBoundary.ClosestPoint(vertex)[1]
            closestPoint=offsettriRemeshBoundary.PointAt(t)
            processVertex.closestPoint = closestPoint
            
        def CreateCrossField(self,processVertex):
            wxy_Plane=rg.Plane.WorldXY
            ZAxis=wxy_Plane.ZAxis
            
           
            vector_A = rg.Vector3d(processVertex.closestPoint - processVertex.geometry)
            vector_A.Unitize()
            vector_B = rg.Vector3d(vector_A)
            vector_C = rg.Vector3d(vector_A)
            vector_D = rg.Vector3d(vector_A)

            vector_B.Rotate(rm.ToRadians(90),ZAxis)
            vector_C.Rotate(rm.ToRadians(180),ZAxis)
            vector_D.Rotate(rm.ToRadians(270),ZAxis)
     
            processVertex.crossField = [vector_A,vector_B,vector_C,vector_D]
            
        def GetDistanceToEverySegment(self,processVertex,segments):
            distances=[]
        
            for i in range(len(segments)):
                distances.append(segments[i].DistanceTo(processVertex.geometry,True))
        
            processVertex.distanceEverySegment = distances
        
        def GetClosestEdgeIndex(self,processVertex,newEdgeIndices):
            minIndex = processVertex.distanceEverySegment.index(min(processVertex.distanceEverySegment))
            
            processVertex.closestEdgeIndex = newEdgeIndices[minIndex]
            
        def CheckVertexOnEdge(self,processVertex,HEM):
            if HEM.Vertices.IsBoundary(processVertex.index)==True:
                processVertex.is_OnEdge = 1
            else:
                processVertex.is_OnEdge = 0
                
        def RenewVerticesOnEdgeCrossfield(self,processVertexList,HEM,crv):
            boundaryVIndices=self.GetBoundaryVertexIndices(HEM,crv)
            OnEdgeVertices=[]
            OnEdgeVertices_Geo=[]
            for index in boundaryVIndices:
                OnEdgeVertices.append(processVertexList[index])
                OnEdgeVertices_Geo.append(processVertexList[index].geometry)
        
            #tol = rd.ActiveDoc.ModelAbsoluteTolerance
            tol = 0.001
            newPointList_1 = self.MakeOffsetPoly(OnEdgeVertices_Geo,tol)
            newPointList_2 = self.MakeOffsetPoly(OnEdgeVertices_Geo,-tol)
            
            polyline_1 = rg.Polyline(newPointList_1)
            polyline_2 = rg.Polyline(newPointList_2)
            
            if polyline_1.Length > polyline_2.Length :
                newPointList = newPointList_1
            else:
                newPointList = newPointList_2
        
            for i in range(len(OnEdgeVertices)):
                OnEdgeVertices[i].closestPoint=newPointList[i]
                self.CreateCrossField(OnEdgeVertices[i])
                
        def RenewVerticesOnEdgeCrossfield_TangentMethod_2(self,processVertexList,HEM,crv):
            boundaryVIndices=self.GetBoundaryVertexIndices(HEM,crv)
            OnEdgeVertices=[]
            OnEdgeVertices_Geo=[]
            for index in boundaryVIndices:
                OnEdgeVertices.append(processVertexList[index])
                OnEdgeVertices_Geo.append(processVertexList[index].geometry)
        
            #tol = rd.ActiveDoc.ModelAbsoluteTolerance
            tol = 0.001
            wxy_Plane=rg.Plane.WorldXY
            ZAxis=wxy_Plane.ZAxis
            for i in range(len(OnEdgeVertices_Geo)):
                if i!= 0 and i!= len(OnEdgeVertices_Geo)-1:
                    vec1 = rg.Vector3d(OnEdgeVertices_Geo[i+1]-OnEdgeVertices_Geo[i])
                    vec3 = rg.Vector3d(OnEdgeVertices_Geo[i-1]-OnEdgeVertices_Geo[i])
                elif i==0:
                    vec1 = rg.Vector3d(OnEdgeVertices_Geo[i+1]-OnEdgeVertices_Geo[i])
                    vec3 = rg.Vector3d(OnEdgeVertices_Geo[len(OnEdgeVertices_Geo)-1]-OnEdgeVertices_Geo[i])
                elif i==len(OnEdgeVertices_Geo)-1:
                    vec1 = rg.Vector3d(OnEdgeVertices_Geo[0] - OnEdgeVertices_Geo[i])
                    vec3 = rg.Vector3d(OnEdgeVertices_Geo[i-1] - OnEdgeVertices_Geo[i])
                
                #vec0 = rg.Vector3d(vec1)
                #vec0.Rotate(rm.ToRadians(90),ZAxis)
                #vec2 = rg.Vector3d(vec3)
                #vec2.Rotate(rm.ToRadians(90),ZAxis)
                vec1.Unitize()
                vec3.Unitize()
                vec0 = (vec1+vec3)
                vec2 = -(vec1+vec3)
                vec0.Unitize()
                vec1.Unitize()
                vec2.Unitize()
                vec3.Unitize()
                newCrossfield = [vec0,vec1,vec2,vec3]
                
                OnEdgeVertices[i].crossField = newCrossfield

        def RenewVerticesOnEdgeCrossfield_TangentMethod(self,processVertexList,HEM,crv):
            boundaryVIndices=self.GetBoundaryVertexIndices(HEM,crv)
            OnEdgeVertices=[]
            OnEdgeVertices_Geo=[]
            for index in boundaryVIndices:
                OnEdgeVertices.append(processVertexList[index])
                OnEdgeVertices_Geo.append(processVertexList[index].geometry)
        
            #tol = rd.ActiveDoc.ModelAbsoluteTolerance
            tol = 0.001
            wxy_Plane=rg.Plane.WorldXY
            ZAxis=wxy_Plane.ZAxis
            for i in range(len(OnEdgeVertices_Geo)):
                if i!= 0 and i!= len(OnEdgeVertices_Geo)-1:
                    vec1 = rg.Vector3d(OnEdgeVertices_Geo[i+1]-OnEdgeVertices_Geo[i])

                elif i==0:
                    vec1 = rg.Vector3d(OnEdgeVertices_Geo[i+1]-OnEdgeVertices_Geo[i])

                elif i==len(OnEdgeVertices_Geo)-1:
                    vec1 = rg.Vector3d(OnEdgeVertices_Geo[0] - OnEdgeVertices_Geo[i])

                
                vec0 = rg.Vector3d(vec1)
                vec2 = rg.Vector3d(vec1)
                vec3 = rg.Vector3d(vec1)
                
                vec0.Unitize()
                vec1.Unitize()
                vec2.Unitize()
                vec3.Unitize()
                
                vec1.Rotate(rm.ToRadians(-90),ZAxis)
                vec2.Rotate(rm.ToRadians(90),ZAxis)
                vec3.Rotate(rm.ToRadians(180),ZAxis)
                
                newCrossfield = [vec0,vec1,vec2,vec3]
                
                OnEdgeVertices[i].crossField = newCrossfield
                
        def NormalizeVec(self,x,y):
            distance = math.sqrt(x*x+y*y)
            return x/distance, y/distance
        
        def MakeOffsetPoly(self,inputVertices,offset,outer_ccw = 1):
            oldX =[]
            oldY =[]
            num_points = len(inputVertices)
            
            for i in range(num_points):
                oldX.append(inputVertices[i].X)
                oldY.append(inputVertices[i].Y)
                
            newX=[]
            newY=[]
            
            for curr in range(num_points):
                prev = (curr + num_points - 1) % num_points
                next = (curr + 1) % num_points
            
                vnX =  oldX[next] - oldX[curr]
                vnY =  oldY[next] - oldY[curr]
                vnnX, vnnY = self.NormalizeVec(vnX,vnY)
                nnnX = vnnY
                nnnY = -vnnX
            
                vpX =  oldX[curr] - oldX[prev]
                vpY =  oldY[curr] - oldY[prev]
                vpnX, vpnY = self.NormalizeVec(vpX,vpY)
                npnX = vpnY * outer_ccw
                npnY = -vpnX * outer_ccw
            
                bisX = (nnnX + npnX) * outer_ccw
                bisY = (nnnY + npnY) * outer_ccw
            
                bisnX, bisnY = self.NormalizeVec(bisX,  bisY)
                bislen = offset /  math.sqrt((1 + nnnX*npnX + nnnY*npnY)/2)
            
                newX.append(oldX[curr] + bislen * bisnX)
                newY.append(oldY[curr] + bislen * bisnY)
            
            outputVertices=[]
            for i in range(num_points):
                outputVertices.append(rg.Point3d(newX[i],newY[i],0))
            
            
            return outputVertices
            
        def GetTriangle(self,processTriangle):
            threeVertices = processTriangle.triangleVertices
            processTriangle.triangleBoundary =  rg.Polyline([threeVertices[0].geometry,threeVertices[1].geometry,threeVertices[2].geometry,threeVertices[0].geometry])
        
        def GetTriangleCentroid(self,processTriangle):
            processTriangle.centroid = processTriangle.triangleBoundary.CenterPoint()
        
        def CheckMedialAxisVertex(self,processTriangle):
            
            if processTriangle.is_MedialAxis  == 1:
                processTriangle.triangleVertices[0].is_MedialAxisVertex = 1
                processTriangle.triangleVertices[1].is_MedialAxisVertex = 1
                processTriangle.triangleVertices[2].is_MedialAxisVertex = 1
                
        def CheckMedialAxisTriangle(self,processTriangle):
        
            a=processTriangle.triangleVertices[0]
            b=processTriangle.triangleVertices[1]
            c=processTriangle.triangleVertices[2]
            
            if a.closestEdgeIndex!=b.closestEdgeIndex or a.closestEdgeIndex!=c.closestEdgeIndex or b.closestEdgeIndex!=c.closestEdgeIndex:
                processTriangle.is_MedialAxis = 1
         
                
            else:
                processTriangle.is_MedialAxis = 0
               
        
        def CheckSingularity(self,processTriangle):
        
            a=processTriangle.triangleVertices[0]
            b=processTriangle.triangleVertices[1]
            c=processTriangle.triangleVertices[2]
            
            if a.closestEdgeIndex!=b.closestEdgeIndex and a.closestEdgeIndex!=c.closestEdgeIndex and b.closestEdgeIndex!=c.closestEdgeIndex:
                processTriangle.is_Singularity = 1
            else:
                processTriangle.is_Singularity = 0
                

        def GetSingularityTriangleInfo_Old(self):
            sinIndices = []
            coefficients_Collection = []
            for index in range(len(self.triangleList)):
                # get threeRelated
                processTriangle = self.triangleList[index]
                threeVertices = processTriangle.triangleVertices
                
                
                # find the minVec for every neighbor
                
                vi=threeVertices[0].geometry
                vj=threeVertices[1].geometry
                vk=threeVertices[2].geometry
                
                vecD_i = threeVertices[0].standard
                vecD_j = threeVertices[1].standard
                vecD_k = threeVertices[2].standard
                
                #Matrix A
                A = [vecD_i.X,vecD_j.X,vecD_k.X,vecD_i.Y,vecD_j.Y,vecD_k.Y,1.0,1.0,1.0]
                A = List[float](A)
                rankA = Eigen.Wrapper.OptimizationMethods.GetMatrixRank(3,3,A)
                
                
                #augmented Matrix A
                aA = [vecD_i.X,vecD_j.X,vecD_k.X,0.0,vecD_i.Y,vecD_j.Y,vecD_k.Y,0.0,1.0,1.0,1.0,1.0]
                aA = List[float](aA)
                rankaA = Eigen.Wrapper.OptimizationMethods.GetMatrixRank(3,4,aA)
                

                
                if rankA == rankaA: # there might be a singularity
                
                    A = [vecD_i.X,vecD_j.X,vecD_k.X,vecD_i.Y,vecD_j.Y,vecD_k.Y,1.0,1.0,1.0]
                    b = [0.0,0.0,1.0]
                    
                    A = List[float](A)
                    b = List[float](b)
                    
                    coefficients = Eigen.Wrapper.OptimizationMethods.SolveLinearSystem(3,3,A,b)
                    
                    if coefficients[0]>0 and coefficients[1]>0 and coefficients[2]>0:
                        sinIndices.append(index)
                        coefficients_Collection.append(coefficients)
                else:
                    pass
                    #print ("ranks are not equal")

            return sinIndices,coefficients_Collection

        def GetSingularityTriangleInfo(self):
            
            sinIndices = []
            coefficients_Collection = []
            for index in range(len(self.triangleList)):
                # get threeRelated
                processTriangle = self.triangleList[index]
                threeVertices = processTriangle.triangleVertices
                
                
                # find the minVec for every neighbor
                
                vi=threeVertices[0].geometry
                vj=threeVertices[1].geometry
                vk=threeVertices[2].geometry
                
                vecD_i = threeVertices[0].standard
                vecD_j = threeVertices[1].standard
                vecD_k = threeVertices[2].standard
                
                #Matrix A
                A = [[vecD_i.X,vecD_j.X,vecD_k.X],
                     [vecD_i.Y,vecD_j.Y,vecD_k.Y],
                     [1.0,1.0,1.0]]

                rankA = PC.ProcessMesh.Get3x3MatrixRank(A)
                
                
                #augmented Matrix A
                aA =[ [vecD_i.X,vecD_j.X,vecD_k.X,0.0],
                     [vecD_i.Y,vecD_j.Y,vecD_k.Y,0.0],
                     #[0.0,0.0,0.0,0.0,1.0]]
                     [1.0,1.0,1.0,1.0]]

                rankaA = PC.ProcessMesh.Get3x4MatrixRank(aA)
                
                
                
                if rankA == rankaA: # there might be a singularity
                    

                    #solverInput = [vecD_i.X,vecD_j.X,vecD_k.X,0.0, vecD_i.Y,vecD_j.Y,vecD_k.Y,0.0,1.0,1.0,1.0,1.0]
                    try:
                        coefficients = PC.ProcessMesh.Solve3x3Equations(vecD_i.X,vecD_j.X,vecD_k.X,0.0, vecD_i.Y,vecD_j.Y,vecD_k.Y,0.0,1.0,1.0,1.0,1.0)
                    except:
                        coefficients = [0,0,0]
                    
                    if coefficients[0]>0 and coefficients[1]>0 and coefficients[2]>0:
                        
                        sinIndices.append(index)
                        coefficients_Collection.append(coefficients)
                        
                else:
                    pass
                    #print ("ranks are not equal")

            return sinIndices,coefficients_Collection
            
        
        def Getsingularities(self,sinIndices,coefficients_Collection):
            fList = self.triangleList
            
            singularities = []
            
            if sinIndices != [] and coefficients_Collection!=[]:
                for i in range(len(sinIndices)):
                    fIndex = sinIndices[i]
                    threeVertices = fList[fIndex].triangleVertices
                    vi = threeVertices[0].geometry
                    vj = threeVertices[1].geometry
                    vk = threeVertices[2].geometry
                    
                    coefficients = coefficients_Collection[i]
                    coi = coefficients[0]
                    coj = coefficients[1]
                    cok = coefficients[2]
                    
                    singularity = vi*coi + vj*coj + vk*cok
                    singularities.append(singularity)
            
            return singularities
        
        
        
        def GetCombindedEgdeIndices(self,boundary):
            edgeIndices,edgeSegments = self.GetEdgeIndices(boundary)
            output_list = [[i for i, x in enumerate(edgeIndices) if x == unique_val]
                           for unique_val in set(edgeIndices)]
            
            return output_list
            
        ######################################################
        ################        Matrix         ###############
        ######################################################
        @staticmethod
        def Solve3x3Equations(a, b, c, d, e, f, g, h, i, j, k, l):
            """
            Solve a 3x3 system of equations using Cramer's rule.
            The system is in the form of:
                a * x + b * y + c * z = d
                e * x + f * y + g * z = h
                i * x + j * y + k * z = l
            where x, y, z are the variables to be solved for.
            """
            # Compute the determinant of the coefficient matrix
            det = a * (f * i - g * j) - b * (e * i - g * k) + c * (e * j - f * k)
            
            # Compute the determinant of the matrix formed by replacing each column of the coefficient matrix 
            # with the constants vector
            det_x = d * (f * i - g * j) - b * (h * i - g * l) + c * (h * j - f * l)
            det_y = a * (h * i - g * l) - d * (e * i - g * k) + c * (e * l - h * k)
            det_z = a * (f * l - h * j) - b * (e * l - h * k) + d * (e * j - f * k)
            
            # compute the value of x, y, z
            x = det_x / det
            y = det_y / det
            z = det_z / det
            return x, y, z
        
        @staticmethod
        def Get3x3MatrixRank(matrix):
            det = matrix[0][0] * (matrix[1][1] * matrix[2][2] - matrix[1][2] * matrix[2][1]) - matrix[0][1] * (matrix[1][0] * matrix[2][2] - matrix[1][2] * matrix[2][0]) + matrix[0][2] * (matrix[1][0] * matrix[2][1] - matrix[1][1] * matrix[2][0])
            if det == 0:
                return 2
            else:
                return 3
        
        @staticmethod
        def Get3x4MatrixRank_Wrong(matrix):
         
            num_rows = len(matrix)
            num_cols = len(matrix[0])
            rank = min(num_rows, num_cols)
        
            for i in range(num_rows):
                for j in range(i+1, num_cols):
                    if matrix[i][j] != 0:
                        rank -= 1
                        break

            return rank

        @staticmethod
        def Get3x4MatrixRank(matrix):
            num_rows = len(matrix)
            num_cols = len(matrix[0])
            rank = min(num_rows, num_cols)

            for i in range(num_rows):
                if matrix[i][i] != 0:
                    for j in range(i + 1, num_rows):
                        ratio = matrix[j][i] / matrix[i][i]
                        for k in range(i, num_cols):
                            matrix[j][k] -= ratio * matrix[i][k]
                else:
                    reduce = True
                    for j in range(i + 1, num_rows):
                        if matrix[j][i] != 0:
                            matrix[i], matrix[j] = matrix[j], matrix[i]
                            reduce = False
                            break
                    if reduce:
                        rank -= 1
                        for j in range(num_rows):
                            matrix[j][i] = matrix[j][num_cols - 1]
                        num_cols -= 1
                        i -= 1
            
            return rank


    @staticmethod
    def SimplifyVertices(poly):
        if isinstance(poly,rg.Curve):
            polyL = poly.TryGetPolyline()[1]
        elif isinstance(poly,rg.Polyline):
            polyL = poly
        
        newPtList = []
        segments = polyL.GetSegments()
        
        newPtList.append(polyL.First)
        for i in range(len(segments)-1):
            currSeg = segments[i]
            nextSeg = segments[i+1]
        
            vecA = rg.Vector3d(currSeg.To - currSeg.From)
            vecB = rg.Vector3d(nextSeg.To - nextSeg.From)
            
            if rg.Vector3d.VectorAngle(vecA,vecB) > 0.001:
                newPtList.append(nextSeg.From)
                
        newPtList.append(polyL.Last)
        simplifiedPolyL = rg.Polyline(newPtList)
        simplifiedPolyCrv = simplifiedPolyL.ToPolylineCurve()
        
        return simplifiedPolyCrv



        

        
    @staticmethod
    def ConvertPolylineCurveToPolyline(polyCrv):
        #convert back to polyline
        if isinstance(polyCrv,rg.PolylineCurve):
            pointCount = polyCrv.PointCount

        polyline = rg.Polyline(pointCount)
        for i in range(pointCount):
            polyline.Add(polyCrv.Point(i))
        return polyline
# ---------- end python ----------
python_2 = GhPythonScript()  # -> out, DM
# ---------- python_2: Python ----------
###########################
####    Import Libs    ####
###########################
import Rhino.Geometry as rg
#import Rhino.RhinoDoc as rd
import Rhino.RhinoMath as rm
import ghpythonlib.components as ghc





###########################
####    Data Mapping   ####
###########################
class DM:
    class MappingPixel:
        def __init__(self,pixel,rowIndex,columnIndex):
            self.pixel = pixel                             
            self.centroid = rg.AreaMassProperties.Compute(self.pixel).Centroid
            self.position = rg.Point3d(rowIndex,columnIndex,0)
            self.documentedTriangle = []   
        
        def __del__(self):
            self.pixel = None
            self.centroid = None
            self.position = None
            self.documentedTriangle = None
            #rh.RhinoApp.WriteLine("Kill a MappingPixel ")
    class MappingGrid:
        def __init__(self):
            self.grid = None                     
            self.rows = None                     
            self.columns = None
            self.origin = None
            self.e = None
        
        def __del__(self):
            for i in range(self.rows):
                self.grid[i] = None
            self.grid = None
            self.columns = None
            self.rows = None
            self.origin = None
            self.e = None
            #rh.RhinoApp.WriteLine("Kill a MappingGrid ")
            
        def GetSqaure(self,halfSize,Xcord,Ycord):
            
            pt1=rg.Point3d(Xcord - halfSize , Ycord - halfSize ,0)
            pt2=rg.Point3d(Xcord - halfSize , Ycord + halfSize ,0)
            pt3=rg.Point3d(Xcord + halfSize , Ycord + halfSize ,0)
            pt4=rg.Point3d(Xcord + halfSize , Ycord - halfSize ,0)
            
            #remember to add the last point
            return rg.Polyline([pt1,pt2,pt3,pt4,pt1]).ToPolylineCurve()
        
        def CreateMappingGrid(self,input,density=100,extendNum=5):
            # get BoundingBox
            obb = input.BoundingBox
            
            # get the edge length
            dist1 = obb.Max.X - obb.Min.X
            dist2 = obb.Max.Y - obb.Min.Y
            
            e1 = dist1/density
            e2 = dist2/density
            
            if e1<=e2:
                
                num1 = int(dist1/e1)
                num2 = int(int(dist2/e1)+1)
            
            else:
                num1 = int(int(dist1/e2)+1)
                num2 = int(dist2/e2)
                
            eMin = min([e1,e2])
            
            e=eMin
            
            ## set the origin
            originX = obb.Min.X - extendNum*e
            originY = obb.Min.Y - extendNum*e
            
            #print obb.Min.X,obb.Min.Y
            ###########
            #so far all the info is prepared
            #originX,originY,e,num1,num2
        
        
            # create a store
            gridlist=[]
            
            for i in range(num1+extendNum*2):
               gridlist.append([])
        
            for rowIndex in range(num1+extendNum*2):
                for columnIndex in range(num2+extendNum*2):
                    mappingPixel = DM.MappingPixel(self.GetSqaure(e*0.5,rowIndex*e+originX,columnIndex*e+originY),rowIndex,columnIndex )
                    gridlist[rowIndex].append(mappingPixel)
                    
            self.grid = gridlist
            
            self.rows = num1+extendNum*2
            self.columns = num2+extendNum*2
            self.origin = rg.Point3d(originX,originY,0)
            
            self.e = e
    

    
        ###################################################
        def GetTriangleDetectRegion(self,triangle,time=2):
            e = self.e
            # print "asd"
            # print triangle[0].X,triangle[0].Y,0
            # print triangle[1].X,triangle[1].Y,0
            # print triangle[2].X,triangle[2].Y,0
            # obb = ghc.BoundingBox(triangle,rg.Plane.WorldXY)[0].BoundingBox 
            
            Xs = [triangle[0].X,triangle[1].X,triangle[2].X]
            Ys = [triangle[0].Y,triangle[1].Y,triangle[2].Y]
            
            maxPt = rg.Point3d(max(Xs),max(Ys),0)
            minPt = rg.Point3d(min(Xs),min(Ys),0)

            minPt_New = rg.Point3d(minPt.X-time*e,minPt.Y-time*e,0)
            maxPt_New = rg.Point3d(maxPt.X+time*e,maxPt.Y+time*e,0)
            obbFlat = rg.Rectangle3d(rg.Plane.WorldXY,maxPt_New,minPt_New)
            
            
            startRowIndex,startColumnIndex = self.RemapPosition(minPt_New)
            endRowIndex,endColumnIndex = self.RemapPosition(maxPt_New)
            
            
            detectRegion = []
            for i in range(startRowIndex,endRowIndex,1):
                for j in range(startColumnIndex,endColumnIndex,1):
                    
                    detectRegion.append(self.grid[i][j])
            
            return detectRegion
        
        def GetTriangleDetectRegion_Old(self,centroid,detectRadius):


            intCentroidRow,intCentroidColumn= self.RemapPosition(centroid)
            
             
            newRowIndex=intCentroidRow-detectRadius
            newColumnIndex=intCentroidColumn-detectRadius
            
        
            detectRegion=[]
            
            for i in range(detectRadius*2):
                for j in range(detectRadius*2):
                    detectRegion.append(self.grid[newRowIndex][newColumnIndex+j])
                newRowIndex+=1
            
       
            return detectRegion
            
            
        def GetOverlappedTriangleIndex(self,processMesh,detectRadius=2):
            
            triangleList=processMesh.triangleList
            
            
            #################################
            ### calculate the overlapping ###
            #################################
            
            #tol = rd.ActiveDoc.ModelAbsoluteTolerance
            tol = 0.001
            for faceIndex in range(len(triangleList)):
                
                triangle=triangleList[faceIndex].triangleBoundary
                
                detectRegion=self.GetTriangleDetectRegion(triangle,detectRadius)


                    
                for detectPixel in detectRegion:
                    
                    if rg.Intersect.Intersection.CurveCurve(detectPixel.pixel, triangle.ToPolylineCurve(),tol,tol).Count!=0 or int(triangle.ToPolylineCurve().Contains(detectPixel.centroid))==1 or int(detectPixel.pixel.Contains(triangleList[faceIndex].centroid)==1):

                        pixelPosition=detectPixel.position
                    
                        pixelLocation=(int(pixelPosition.X),int(pixelPosition.Y))
       
                        self.grid[pixelLocation[0]][pixelLocation[1]].documentedTriangle.append(faceIndex)
                        
             
        def RemapPosition(self,pt):
            originX = self.origin.X
            originY = self.origin.Y
            e = self.e
            
            remapX = int(round((pt.X-originX)/e))
            remapY = int(round((pt.Y-originY)/e))
            
            return (remapX,remapY)
# ---------- end python_2 ----------
ghpython_script = GhPythonScript()  # -> out, SLG
# ---------- ghpython_script: Python ----------
###########################
####    Import Libs    ####
###########################
import Rhino.Geometry as rg
#import Rhino.RhinoDoc as rd
import Rhino.RhinoMath as rm


import random





######################################
####    Streamline Generation     ####
######################################
class SLG:
    #########################
    ########streamline#######
    #########################
    class StreamlineVertex:
        def __init__(self,vertex):
            self.geometry=vertex   
            
        def __del__(self):
            self.vertex=None
            
    class StreamlinePoint:
        def __init__(self,point):
            self.geometry=point   
            
        def __del__(self):
            self.point=None
            
    class Streamline:
        def __init__(self):
            self.startVertex = None              
            self.endVertex = None                  
            self.betweenPoints = []          
            #self.geometry = None
            
            self.scoreSingularity = None
            self.scoreContinuity = None
            self.scoreDivergence = None

            self.scoreEvenArea = None
            self.scoreElongation = None
            self.scoreCompactness = None
            self.scoreConvexity = None
            self.scoreOrientation = None
            
            self.evenAreaValue = None
            self.elongationPair = None
            self.areaPair = None
            self.convexityPair = None
            self.compactnessPair = None
            self.orientationPair = None
            
            self.score_Part1 = None
            self.score_Part2 = None
            self.scoreOverall = None
        
        def __del__(self):
            self.startVertex = None              
            self.endVertex = None                  
            self.betweenPoints = None          
            #self.geometry = None
            
            self.scoreSingularity = None
            self.scoreContinuity = None
            self.scoreDivergence = None
            self.scoreEvenArea = None
            self.scoreElongation = None
            self.scoreCompactness = None
            self.scoreConvexity = None
            self.scoreOrientation = None

            self.evenAreaValue = None
            self.elongationPair = None
            self.areaPair = None
            self.convexityPair = None
            self.compactnessPair = None
            self.orientationPair = None
            
            self.score_Part1 = None
            self.score_Part2 = None
            self.scoreOverall = None
            
        def GetGeometry(self):
            allPoints=[]
            
            allPoints.append(self.startVertex.geometry)
            for point in self.betweenPoints:
                
                allPoints.append(point.geometry)
            
            allPoints.append(self.endVertex.geometry)
            
            return rg.Polyline(allPoints)
        
        def CreateStreamlineInstance(self,streamline):
            streamlinePoints = [] 
            for i in range(len(streamline)):
                streamlinePoints.append(streamline[i])
            
            betweenPoints=[]

            for i in range(len(streamlinePoints)):
                if i==0:
                    self.startVertex = SLG.StreamlineVertex(streamlinePoints[i])
                elif i == len(streamlinePoints)-1:
                    self.endVertex = SLG.StreamlineVertex(streamlinePoints[i])
                
                else:
                    self.betweenPoints.append(SLG.StreamlinePoint(streamlinePoints[i]))
  
        def Reverse(self):
            temp=self.startVertex
            self.startVertex=self.endVertex
            self.endVertex=temp
            self.betweenPoints.reverse()
            
            
    class StreamlineNetwork:
        def __init__(self):
            self.network = []
            

        def DetectVertices(self,pointList,seedpointList,streamline,detectDistance):
                spL = seedpointList.list
                detectedVertices=[]
                if len(pointList)>1:
                    for seedpoint in spL:

                        pt=streamline.ClosestPoint (seedpoint.vh.geometry)
                        distance=seedpoint.vh.geometry.DistanceTo(pt)
                        if distance<=detectDistance:
                            detectedVertices.append(seedpoint)
                
                return detectedVertices
    
        def UpdateActivityStatus(self,processMesh,seedpointList,streamline,thisSeedpoint,tag):
            
            streamlineClosestPt=streamline.ClosestPoint(thisSeedpoint.vh.geometry)
            thisVector=rg.Vector3d(streamlineClosestPt-thisSeedpoint.vh.geometry)
            
            
            if thisSeedpoint.vh.crossField[0]!=None and thisVector.Length!=0:
                
                angle1=rm.ToDegrees(rg.Vector3d.VectorAngle(thisVector,thisSeedpoint.vh.crossField[0]))
                angle2=rm.ToDegrees(rg.Vector3d.VectorAngle(thisVector,thisSeedpoint.vh.crossField[1]))
                angle3=rm.ToDegrees(rg.Vector3d.VectorAngle(thisVector,thisSeedpoint.vh.crossField[2]))
                angle4=rm.ToDegrees(rg.Vector3d.VectorAngle(thisVector,thisSeedpoint.vh.crossField[3]))
                
                anglelist=[angle1,angle2,angle3,angle4]
                minAngleIndex=anglelist.index(min(anglelist))
        
                
                if minAngleIndex == 0 or minAngleIndex == 2:
                    thisSeedpoint.secondActivityStatus= False
                     
                    
                elif minAngleIndex == 1 or minAngleIndex == 3:
                    thisSeedpoint.firstActivityStatus= False
            
            #if its the startPoint
            elif thisSeedpoint.vh.crossField[0]==None or thisVector.Length==0:
                if tag=="first":
                    thisSeedpoint.firstActivityStatus=False
                    
                elif tag=="second":
                    thisSeedpoint.secondActivityStatus=False


        def UpdateSeedPointList(self,seedpointList,detectedVertices):
            spL = seedpointList.list
            #print "in UpdateSeedPointList"
            #print [detectedVertex.vh.index for detectedVertex in detectedVertices]
            for detectedVertex in detectedVertices:
                
                if detectedVertex.firstActivityStatus == False and  detectedVertex.secondActivityStatus == False :
                    detectedVertex.validity = False
                    if detectedVertex in spL:
                        spL.remove(detectedVertex)
                        
        def GetBarycentricCoefficient(self,threeVertices,ptX):
            #get the vertices of triangle
            pointA=threeVertices[0]
            pointB=threeVertices[1]
            pointC=threeVertices[2]
            
            #area of this triangle

            areaABC=rg.Vector3d.CrossProduct(rg.Vector3d(pointB-pointA) ,rg.Vector3d(pointC-pointA) ).Length *0.5
            
            #area of first subtriangle
            Nc=rg.Vector3d.CrossProduct(rg.Vector3d(pointB-pointA),rg.Vector3d(ptX-pointA))
            Ncc=rg.Vector3d.CrossProduct(rg.Vector3d(pointB-pointA),rg.Vector3d(pointC-pointA))
            mc=rg.Vector3d.Multiply(Nc,Ncc)
            
            if mc>=0:
                areaABX=0.5*Nc.Length
            
            else:
                areaABX=-0.5*Nc.Length
            
            coefficientc=areaABX/areaABC
            
            #area of second subtriangle
            Nb=rg.Vector3d.CrossProduct(rg.Vector3d(pointA-pointC),rg.Vector3d(ptX-pointC))
            Nbb=rg.Vector3d.CrossProduct(rg.Vector3d(pointA-pointC),rg.Vector3d(pointB-pointC))
            mb=rg.Vector3d.Multiply(Nb,Nbb)
            
            if mb>=0:
                areaAXC=0.5*Nb.Length
            
            else:
                areaAXC=-0.5*Nb.Length
            
            coefficientb=areaAXC/areaABC
            
            
            
            #area of third subtriangle
            Na=rg.Vector3d.CrossProduct(rg.Vector3d(pointC-pointB),rg.Vector3d(ptX-pointB))
            Naa=rg.Vector3d.CrossProduct(rg.Vector3d(pointC-pointB),rg.Vector3d(pointA-pointB))
            ma=rg.Vector3d.Multiply(Na,Naa)
            
            if ma>=0:
                areaXBC=0.5*Na.Length
            
            else:
                areaXBC=-0.5*Na.Length
            
            coefficienta=areaXBC/areaABC
            
            
            return (coefficienta,coefficientb,coefficientc)
        
            
        def GetNewVector(self,mappingGrid,processMesh,point,pointList):
            triRemeshBoundary =  processMesh.triRemeshBoundary.ToPolylineCurve()
            vList = processMesh.vertexList
            fList = processMesh.triangleList
            
        
            
            thisPointRow=int(round(point.X))
            thisPointColumn=int(round(point.Y))
            thisPointRow,thisPointColumn = mappingGrid.RemapPosition(point)
            coefficient=[]
            
            #situation:out of boundary
            #tol = rd.ActiveDoc.ModelAbsoluteTolerance
            tol = 0.001
            if int(triRemeshBoundary.Contains (point,rg.Plane.WorldXY,tol))==2:

                return None,None,"case4"
                
            #situation:out of canvas
            if thisPointRow > mappingGrid.rows or thisPointColumn > mappingGrid.columns or thisPointRow < 0 or thisPointColumn < 0:

                return None,None,"case4"

            if int(triRemeshBoundary.Contains (point,rg.Plane.WorldXY,tol))==3:

                return None,None,"case5"    # coincident

            for triangleIndex in mappingGrid.grid[thisPointRow][thisPointColumn].documentedTriangle:
                threeVertices = fList[triangleIndex].triangleVertices
                threeVertices_geo = [threeVertices[0].geometry,threeVertices[1].geometry,threeVertices[2].geometry]
                
                coefficients=self.GetBarycentricCoefficient(threeVertices_geo,point)
                
                if coefficients[0]>=0 and coefficients[1]>=0 and coefficients[2]>=0:
                    break
            
            
            u=float(coefficients[0])
            v=float(coefficients[1])
            w=float(coefficients[2])
            
            
            
            ptListLength=len(pointList)
            
            thisVector=rg.Vector3d(pointList[ptListLength-2]-pointList[ptListLength-1])
            
            vec_a,vec_b,vec_c = self.GetAccordingMaxVec(threeVertices,thisVector)
            newVector=u * vec_a + v * vec_b +w * vec_c
            newVector.Unitize()
            
            flag = "Normal"
            ##### medial axis case or concave case#####
            if fList[triangleIndex].is_MedialAxis == 1:
                flag = "Special"

            return newVector,triangleIndex,flag
            
        def GetAccordingMaxVec(self,threeVertices,thisVector):
            vertex_a = threeVertices[0]
            vertex_b = threeVertices[1]
            vertex_c = threeVertices[2]
            
            
            ###
            vectorangle1=rm.ToDegrees(rg.Vector3d.VectorAngle(thisVector,vertex_a.crossField[0]))
            vectorangle2=rm.ToDegrees(rg.Vector3d.VectorAngle(thisVector,vertex_a.crossField[1]))
            vectorangle3=rm.ToDegrees(rg.Vector3d.VectorAngle(thisVector,vertex_a.crossField[2]))
            vectorangle4=rm.ToDegrees(rg.Vector3d.VectorAngle(thisVector,vertex_a.crossField[3]))

            angleList = [vectorangle1,vectorangle2,vectorangle3,vectorangle4]
            maxAngleIndex=angleList.index(max(angleList))
            chosenVector_a =vertex_a.crossField[maxAngleIndex]
            ###
            vectorangle1=rm.ToDegrees(rg.Vector3d.VectorAngle(thisVector,vertex_b.crossField[0]))
            vectorangle2=rm.ToDegrees(rg.Vector3d.VectorAngle(thisVector,vertex_b.crossField[1]))
            vectorangle3=rm.ToDegrees(rg.Vector3d.VectorAngle(thisVector,vertex_b.crossField[2]))
            vectorangle4=rm.ToDegrees(rg.Vector3d.VectorAngle(thisVector,vertex_b.crossField[3]))
            
            angleList = [vectorangle1,vectorangle2,vectorangle3,vectorangle4]
            maxAngleIndex=angleList.index(max(angleList))
            chosenVector_b =vertex_b.crossField[maxAngleIndex]
            ###
            vectorangle1=rm.ToDegrees(rg.Vector3d.VectorAngle(thisVector,vertex_c.crossField[0]))
            vectorangle2=rm.ToDegrees(rg.Vector3d.VectorAngle(thisVector,vertex_c.crossField[1]))
            vectorangle3=rm.ToDegrees(rg.Vector3d.VectorAngle(thisVector,vertex_c.crossField[2]))
            vectorangle4=rm.ToDegrees(rg.Vector3d.VectorAngle(thisVector,vertex_c.crossField[3]))
            
            angleList = [vectorangle1,vectorangle2,vectorangle3,vectorangle4]
            maxAngleIndex=angleList.index(max(angleList))
            chosenVector_c =vertex_c.crossField[maxAngleIndex]
            
            return chosenVector_a,chosenVector_b,chosenVector_c

        def GetTempPoint_LowOrder(self,startPoint,dL,startPointVector):
            temppoint = rg.Point3d.Add(startPoint,startPointVector*dL)

            return temppoint
            
            
        def GetTempPoint_RungeKutta(self,startPoint,dL,startPointVector,mappingGrid,processMesh,pointList):
            insideTag = None
            #startPoint
            k1 = dL * startPointVector
            
            #secondPoint 
            secondPoint = rg.Point3d.Add(startPoint,k1/2)
            secondPointVector,triangleIndex,flag = self.GetNewVector(mappingGrid,processMesh,secondPoint,pointList)
            if flag == "case1" or flag == "case4":
                insideTag = "out"
            
            if insideTag!="out":
                k2 = dL * secondPointVector
            
                #thirdPoint
                thirdPoint = rg.Point3d.Add(startPoint,k2/2)
                thirdPointVector,triangleIndex,flag = self.GetNewVector(mappingGrid,processMesh,thirdPoint,pointList)
                if flag == "case1" or flag == "case4":
                    insideTag = "out"
                
                if insideTag!="out":
                    k3 = dL * thirdPointVector
                      
                    #fourPoint
                    fourthPoint = rg.Point3d.Add(startPoint,k3)
                    fourthPointVector,triangleIndex,flag = self.GetNewVector(mappingGrid,processMesh,fourthPoint,pointList)
                    if flag == "case1" or flag == "case4":
                        insideTag = "out"
                        
                    if insideTag!="out":
                        k4 = dL * fourthPointVector

                        temppoint = rg.Point3d.Add(startPoint,(k1+ 2*k2 + 2*k3 + k4)/6)
                        print ("use RK"), temppoint.X,temppoint.Y
                        temppoint_NO = rg.Point3d.Add(startPoint,startPointVector*dL)
                        print ("without RK"), temppoint_NO.X,temppoint_NO.Y
                        return temppoint 
            if insideTag =="out":
                temppoint = rg.Point3d.Add(startPoint,startPointVector*dL)
            return temppoint
            
            
        def CalculateMaxAngle_NormalCase_SS(self,processMesh,triangleIndex,pointList,newVector):
    
            fList = processMesh.triangleList
            
            ptListLength=len(pointList)
            thisVector=rg.Vector3d(pointList[ptListLength-2]-pointList[ptListLength-1])
    
            wxy_plane=rg.Plane.WorldXY
            ZAxis=wxy_plane.ZAxis
            
    
            vector13 = newVector 
            vector14 = rg.Vector3d(vector13)
            vector15 = rg.Vector3d(vector13)
            vector16 = rg.Vector3d(vector13)
            
            vector14.Rotate(rm.ToRadians(90),ZAxis)
            vector15.Rotate(rm.ToRadians(180),ZAxis)
            vector16.Rotate(rm.ToRadians(270),ZAxis)
            
            threeVertices = fList[triangleIndex].triangleVertices
            
            
     
            a=threeVertices[0]
            b=threeVertices[1]
            c=threeVertices[2]

            
            vector17=a.crossField[0]
            vector18=a.crossField[1]
            vector19=a.crossField[2]
            vector20=a.crossField[3]
            
            vector21=b.crossField[0]
            vector22=b.crossField[1]
            vector23=b.crossField[2]
            vector24=b.crossField[3]
            
            vector25=c.crossField[0]
            vector26=c.crossField[1]
            vector27=c.crossField[2]
            vector28=c.crossField[3]
            
            #################################################################
            vectorangle13=rm.ToDegrees(rg.Vector3d.VectorAngle(thisVector,vector13))
            vectorangle14=rm.ToDegrees(rg.Vector3d.VectorAngle(thisVector,vector14))
            vectorangle15=rm.ToDegrees(rg.Vector3d.VectorAngle(thisVector,vector15))
            vectorangle16=rm.ToDegrees(rg.Vector3d.VectorAngle(thisVector,vector16))
            vectorangle17=rm.ToDegrees(rg.Vector3d.VectorAngle(thisVector,vector17))
            vectorangle18=rm.ToDegrees(rg.Vector3d.VectorAngle(thisVector,vector18))
            vectorangle19=rm.ToDegrees(rg.Vector3d.VectorAngle(thisVector,vector19))
            vectorangle20=rm.ToDegrees(rg.Vector3d.VectorAngle(thisVector,vector20))
            vectorangle21=rm.ToDegrees(rg.Vector3d.VectorAngle(thisVector,vector21))
            vectorangle22=rm.ToDegrees(rg.Vector3d.VectorAngle(thisVector,vector22))
            vectorangle23=rm.ToDegrees(rg.Vector3d.VectorAngle(thisVector,vector23))
            vectorangle24=rm.ToDegrees(rg.Vector3d.VectorAngle(thisVector,vector24))
            vectorangle25=rm.ToDegrees(rg.Vector3d.VectorAngle(thisVector,vector25))
            vectorangle26=rm.ToDegrees(rg.Vector3d.VectorAngle(thisVector,vector26))
            vectorangle27=rm.ToDegrees(rg.Vector3d.VectorAngle(thisVector,vector27))
            vectorangle28=rm.ToDegrees(rg.Vector3d.VectorAngle(thisVector,vector28))
            
            

            vectorList=[vector13,vector14,vector15,vector16,vector17,vector18,vector19,vector20,vector21,vector22,vector23,vector24,vector25,vector26,vector27,vector28]
            angleList= [vectorangle13,vectorangle14,vectorangle15,vectorangle16,vectorangle17,vectorangle18,vectorangle19,vectorangle20,vectorangle21,vectorangle22,vectorangle23,vectorangle24,vectorangle25,vectorangle26,vectorangle27,vectorangle28]
            print ("use all " )

            # vectorList=[vector17,vector18,vector19,vector20,vector21,vector22,vector23,vector24,vector25,vector26,vector27,vector28]
            # angleList= [vectorangle17,vectorangle18,vectorangle19,vectorangle20,vectorangle21,vectorangle22,vectorangle23,vectorangle24,vectorangle25,vectorangle26,vectorangle27,vectorangle28]
            # print "dont use barycenter"    
            
            # vectorList=[vector13,vector14,vector15,vector16]
            # angleList= [vectorangle13,vectorangle14,vectorangle15,vectorangle16]
            # print "dont use original"

            maxAngleIndex=angleList.index(max(angleList))
    
            chosenVector=vectorList[maxAngleIndex]
            
            return chosenVector
            
        def CalculateMaxAngle_NormalCase(self,processMesh,triangleIndex,pointList,newVector):
    
            ptListLength=len(pointList)
            thisVector=rg.Vector3d(pointList[ptListLength-2]-pointList[ptListLength-1])
        
            wxy_plane=rg.Plane.WorldXY
            ZAxis=wxy_plane.ZAxis
            
            
            vector1=newVector
            vector2 = rg.Vector3d(vector1)
            vector3 = rg.Vector3d(vector1)
            vector4 = rg.Vector3d(vector1)
            
            vector2.Rotate(rm.ToRadians(90),ZAxis)
            vector3.Rotate(rm.ToRadians(180),ZAxis)
            vector4.Rotate(rm.ToRadians(270),ZAxis)
            
            vectorangle1=rm.ToDegrees(rg.Vector3d.VectorAngle(thisVector,vector1))
            vectorangle2=rm.ToDegrees(rg.Vector3d.VectorAngle(thisVector,vector2))
            vectorangle3=rm.ToDegrees(rg.Vector3d.VectorAngle(thisVector,vector3))
            vectorangle4=rm.ToDegrees(rg.Vector3d.VectorAngle(thisVector,vector4))

            vectorList=[newVector,vector2,vector3,vector4]
            angleList = [vectorangle1,vectorangle2,vectorangle3,vectorangle4]

            maxAngleIndex=angleList.index(max(angleList))
        
            chosenVector=vectorList[maxAngleIndex]
            
            return chosenVector
            
        def CalculateMaxAngle_SpecialCase(self,processMesh,triangleIndex,pointList,newVector):
            
            
            fList = processMesh.triangleList
            
            ptListLength=len(pointList)
            thisVector=rg.Vector3d(pointList[ptListLength-2]-pointList[ptListLength-1])
    
            wxy_plane=rg.Plane.WorldXY
            ZAxis=wxy_plane.ZAxis
            
    
            vector13 = newVector 
            vector14 = rg.Vector3d(vector13)
            vector15 = rg.Vector3d(vector13)
            vector16 = rg.Vector3d(vector13)
            
            vector14.Rotate(rm.ToRadians(90),ZAxis)
            vector15.Rotate(rm.ToRadians(180),ZAxis)
            vector16.Rotate(rm.ToRadians(270),ZAxis)
            
            threeVertices = fList[triangleIndex].triangleVertices
            
            
     
            a=threeVertices[0]
            b=threeVertices[1]
            c=threeVertices[2]

            
            vector17=a.crossField[0]
            vector18=a.crossField[1]
            vector19=a.crossField[2]
            vector20=a.crossField[3]
            
            vector21=b.crossField[0]
            vector22=b.crossField[1]
            vector23=b.crossField[2]
            vector24=b.crossField[3]
            
            vector25=c.crossField[0]
            vector26=c.crossField[1]
            vector27=c.crossField[2]
            vector28=c.crossField[3]
            
            #################################################################
            vectorangle13=rm.ToDegrees(rg.Vector3d.VectorAngle(thisVector,vector13))
            vectorangle14=rm.ToDegrees(rg.Vector3d.VectorAngle(thisVector,vector14))
            vectorangle15=rm.ToDegrees(rg.Vector3d.VectorAngle(thisVector,vector15))
            vectorangle16=rm.ToDegrees(rg.Vector3d.VectorAngle(thisVector,vector16))
            vectorangle17=rm.ToDegrees(rg.Vector3d.VectorAngle(thisVector,vector17))
            vectorangle18=rm.ToDegrees(rg.Vector3d.VectorAngle(thisVector,vector18))
            vectorangle19=rm.ToDegrees(rg.Vector3d.VectorAngle(thisVector,vector19))
            vectorangle20=rm.ToDegrees(rg.Vector3d.VectorAngle(thisVector,vector20))
            vectorangle21=rm.ToDegrees(rg.Vector3d.VectorAngle(thisVector,vector21))
            vectorangle22=rm.ToDegrees(rg.Vector3d.VectorAngle(thisVector,vector22))
            vectorangle23=rm.ToDegrees(rg.Vector3d.VectorAngle(thisVector,vector23))
            vectorangle24=rm.ToDegrees(rg.Vector3d.VectorAngle(thisVector,vector24))
            vectorangle25=rm.ToDegrees(rg.Vector3d.VectorAngle(thisVector,vector25))
            vectorangle26=rm.ToDegrees(rg.Vector3d.VectorAngle(thisVector,vector26))
            vectorangle27=rm.ToDegrees(rg.Vector3d.VectorAngle(thisVector,vector27))
            vectorangle28=rm.ToDegrees(rg.Vector3d.VectorAngle(thisVector,vector28))
            
            

            vectorList=[vector13,vector14,vector15,vector16,vector17,vector18,vector19,vector20,vector21,vector22,vector23,vector24,vector25,vector26,vector27,vector28]
            angleList= [vectorangle13,vectorangle14,vectorangle15,vectorangle16,vectorangle17,vectorangle18,vectorangle19,vectorangle20,vectorangle21,vectorangle22,vectorangle23,vectorangle24,vectorangle25,vectorangle26,vectorangle27,vectorangle28]
            #print "use all " 

            # vectorList=[vector17,vector18,vector19,vector20,vector21,vector22,vector23,vector24,vector25,vector26,vector27,vector28]
            # angleList= [vectorangle17,vectorangle18,vectorangle19,vectorangle20,vectorangle21,vectorangle22,vectorangle23,vectorangle24,vectorangle25,vectorangle26,vectorangle27,vectorangle28]
            # print "dont use barycenter"    
            
            # vectorList=[vector13,vector14,vector15,vector16]
            # angleList= [vectorangle13,vectorangle14,vectorangle15,vectorangle16]
            # print "dont use original"

            maxAngleIndex=angleList.index(max(angleList))
    
            chosenVector=vectorList[maxAngleIndex]
            
            return chosenVector
            
        def GetStreamlinePointList(self,mappingGrid,processMesh,startPoint,choice,dL,threshold=400):
            #tol = rd.ActiveDoc.ModelAbsoluteTolerance
            tol = 0.001
            if choice!= "Specific":

                triRemeshBoundary =  processMesh.triRemeshBoundary
                pointList=[]
                pointList.append(startPoint.vh.geometry)
                startPointVector=startPoint.vh.crossField[choice]
                startPoint=startPoint.vh.geometry
            
            elif choice == "Specific":
                triRemeshBoundary =  processMesh.triRemeshBoundary
                wxy_Plane=rg.Plane.WorldXY

                
                triRemeshBoundary_curve = triRemeshBoundary.ToPolylineCurve()
                offset1= triRemeshBoundary_curve.Offset(wxy_Plane,tol,tol,rg.CurveOffsetCornerStyle.Sharp)[0]
                offset2= triRemeshBoundary_curve.Offset(wxy_Plane,-tol,tol,rg.CurveOffsetCornerStyle.Sharp)[0]
                
                
                if offset1.GetLength() > offset2.GetLength() :
                    offsetTriRemeshBoundary = offset1
                else:
                    offsetTriRemeshBoundary = offset2

                pointList=[]
                
                pointList.append(startPoint)
                t =offsetTriRemeshBoundary.ClosestPoint(startPoint)[1]
                closestPt = offsetTriRemeshBoundary.PointAt(t)
                startPointVector=rg.Vector3d(startPoint-closestPt)
                startPointVector.Unitize()
            
            
            ### start calculating new point
            newPoint=self.GetTempPoint_LowOrder(startPoint,dL,startPointVector)
            pointList.append(newPoint)
            
            
            ######avoid possible infinite situation.  otherwise it shoule be while GetNewVector(...)!=None
            for i in range(threshold):
                caseResult= self.GetNewVector(mappingGrid,processMesh,newPoint,pointList)
            
                newVector = caseResult[0]
                triangleIndex = caseResult[1]
                flag = caseResult[2]
                #meaning its concave or medial axis situation
                
                if flag == "Special":
                    
                    maxVector=self.CalculateMaxAngle_SpecialCase(processMesh,triangleIndex,pointList,newVector)
                    newPoint=self.GetTempPoint_LowOrder(newPoint,dL,maxVector)
        
                    pointList.append(newPoint)
                    
                elif flag == "Normal":

                    maxVector=self.CalculateMaxAngle_NormalCase(processMesh,triangleIndex,pointList,newVector)
                    newPoint=self.GetTempPoint_LowOrder(newPoint,dL,maxVector)
                    pointList.append(newPoint)
                
                #it goes out of boundary already
                elif flag =="case1" or flag =="case4":
                    
                    
                    line=rg.Line((pointList[len(pointList)-2]),(pointList[len(pointList)-1]))
                    
                  
                    for i in range(triRemeshBoundary.SegmentCount) :
                        
                        if rg.Intersect.Intersection.LineLine(triRemeshBoundary.SegmentAt(i),line,tol,True)[0]==True:
                            
                            #make sure the end is perpendicular 
                            thisSegement = triRemeshBoundary.SegmentAt(i)
                            #lastPoint = thisSegement.ClosestPoint (pointList[len(pointList)-2],True)
                            
                            t = rg.Intersect.Intersection.LineLine(thisSegement,line,tol,True)[1]
                            lastPoint=triRemeshBoundary.SegmentAt(i).PointAt(t)
                            
                            pointList.pop()
                            pointList.append(lastPoint)
                    
                    if pointList[len(pointList)-1].DistanceTo(pointList[len(pointList)-2]) < tol:
                            pointList.pop(len(pointList)-2)
                            
                    break
                    
                elif flag=="case5":
                    coindicentPt = pointList[-1]
                    lastPt =triRemeshBoundary.ClosestPoint(coindicentPt)
                    pointList.pop()
                    pointList.append(lastPt)
                    
                    break

                #step is too small and it intersect with boundary:
                #checkPolyL = rg.Polyline(pointList)
                checkPolyL = rg.Polyline([pointList[-2],pointList[-1]])
                if rg.Intersect.Intersection.CurveCurve(checkPolyL.ToPolylineCurve(),triRemeshBoundary.ToPolylineCurve(),tol,tol).Count >1:
                    
          
                    # ptA = rg.Intersect.Intersection.CurveCurve(checkPolyL.ToPolylineCurve(),triRemeshBoundary.ToPolylineCurve(),tol,tol).Item[0].PointA
                    # ptB = rg.Intersect.Intersection.CurveCurve(checkPolyL.ToPolylineCurve(),triRemeshBoundary.ToPolylineCurve(),tol,tol).Item[1].PointA
                    # print "intersection PtA "
                    # print ptA.X,ptA.Y,ptA.Z
                    # print "intersection PtB "
                    # print ptB.X,ptB.Y,ptB.Z
                    # print "startPt"
                    # print startPoint.X,startPoint.Y,startPoint.Z
                    pointList.pop()

                    
                    closestEndPt =rg.Intersect.Intersection.CurveCurve(checkPolyL.ToPolylineCurve(),triRemeshBoundary.ToPolylineCurve(),tol,tol).Item[0].PointA
                    pointList.append(closestEndPt)
                    #print "closestEndPt", closestEndPt.X, closestEndPt.Y, closestEndPt.Z
                    if pointList[len(pointList)-1].DistanceTo(pointList[len(pointList)-2]) < tol:
                            pointList.pop(len(pointList)-2)


                    break
                
            return pointList

        def GetStreamlinePointList_RK(self,mappingGrid,processMesh,startPoint,choice,dL,threshold=400):
            #tol = rd.ActiveDoc.ModelAbsoluteTolerance
            tol = 0.001
            if choice!= "Specific":

                triRemeshBoundary =  processMesh.triRemeshBoundary
                pointList=[]
                pointList.append(startPoint.vh.geometry)
                startPointVector=startPoint.vh.crossField[choice]
                startPoint=startPoint.vh.geometry
            
            elif choice == "Specific":
                triRemeshBoundary =  processMesh.triRemeshBoundary
                wxy_Plane=rg.Plane.WorldXY

                
                triRemeshBoundary_curve = triRemeshBoundary.ToPolylineCurve()
                offset1= triRemeshBoundary_curve.Offset(wxy_Plane,tol,tol,rg.CurveOffsetCornerStyle.Sharp)[0]
                offset2= triRemeshBoundary_curve.Offset(wxy_Plane,-tol,tol,rg.CurveOffsetCornerStyle.Sharp)[0]
                
                
                if offset1.GetLength() > offset2.GetLength() :
                    offsetTriRemeshBoundary = offset1
                else:
                    offsetTriRemeshBoundary = offset2

                pointList=[]
                
                pointList.append(startPoint)
                t =offsetTriRemeshBoundary.ClosestPoint(startPoint)[1]
                closestPt = offsetTriRemeshBoundary.PointAt(t)
                startPointVector=rg.Vector3d(startPoint-closestPt)
                startPointVector.Unitize()
            
            
            ### start calculating new point
            newPoint=self.GetTempPoint_LowOrder(startPoint,dL,startPointVector)
            pointList.append(newPoint)
            
            
            ######avoid possible infinite situation.  otherwise it shoule be while GetNewVector(...)!=None
            for i in range(threshold):
                caseResult= self.GetNewVector(mappingGrid,processMesh,newPoint,pointList)
            
                newVector = caseResult[0]
                triangleIndex = caseResult[1]
                flag = caseResult[2]
                #meaning its concave or medial axis situation
                
                if flag == "Special":
                    
                    maxVector=self.CalculateMaxAngle_SpecialCase(processMesh,triangleIndex,pointList,newVector)
                    newPoint=self.GetTempPoint_RungeKutta(newPoint,dL,maxVector,mappingGrid,processMesh,pointList)
        
                    pointList.append(newPoint)
                    
                elif flag == "Normal":

                    maxVector=self.CalculateMaxAngle_NormalCase(processMesh,triangleIndex,pointList,newVector)
                    newPoint=self.GetTempPoint_RungeKutta(newPoint,dL,maxVector,mappingGrid,processMesh,pointList)
                    pointList.append(newPoint)
                
                #it goes out of boundary already
                elif flag =="case1" or flag =="case4":
                    
                    
                    line=rg.Line((pointList[len(pointList)-2]),(pointList[len(pointList)-1]))
                    
                  
                    for i in range(triRemeshBoundary.SegmentCount) :
                        
                        if rg.Intersect.Intersection.LineLine(triRemeshBoundary.SegmentAt(i),line,tol,True)[0]==True:
                            
                            #make sure the end is perpendicular 
                            thisSegement = triRemeshBoundary.SegmentAt(i)
                            #lastPoint = thisSegement.ClosestPoint (pointList[len(pointList)-2],True)
                            
                            t = rg.Intersect.Intersection.LineLine(thisSegement,line,tol,True)[1]
                            lastPoint=triRemeshBoundary.SegmentAt(i).PointAt(t)
                            
                            pointList.pop()
                            pointList.append(lastPoint)
                    
                    if pointList[len(pointList)-1].DistanceTo(pointList[len(pointList)-2]) < tol:
                            pointList.pop(len(pointList)-2)
                            
                    break
            
                #step is too small and it intersect with boundary:
                #checkPolyL = rg.Polyline(pointList)
                checkPolyL = rg.Polyline([pointList[-2],pointList[-1]])
                if rg.Intersect.Intersection.CurveCurve(checkPolyL.ToPolylineCurve(),triRemeshBoundary.ToPolylineCurve(),tol,tol).Count >1:
                    
          
                    # ptA = rg.Intersect.Intersection.CurveCurve(checkPolyL.ToPolylineCurve(),triRemeshBoundary.ToPolylineCurve(),tol,tol).Item[0].PointA
                    # ptB = rg.Intersect.Intersection.CurveCurve(checkPolyL.ToPolylineCurve(),triRemeshBoundary.ToPolylineCurve(),tol,tol).Item[1].PointA
                    # print "intersection PtA "
                    # print ptA.X,ptA.Y,ptA.Z
                    # print "intersection PtB "
                    # print ptB.X,ptB.Y,ptB.Z
                    # print "startPt"
                    # print startPoint.X,startPoint.Y,startPoint.Z
                    pointList.pop()

                    
                    closestEndPt =rg.Intersect.Intersection.CurveCurve(checkPolyL.ToPolylineCurve(),triRemeshBoundary.ToPolylineCurve(),tol,tol).Item[0].PointA
                    pointList.append(closestEndPt)
                    #print "closestEndPt", closestEndPt.X, closestEndPt.Y, closestEndPt.Z
                    if pointList[len(pointList)-1].DistanceTo(pointList[len(pointList)-2]) < tol:
                            pointList.pop(len(pointList)-2)


                    break
                
            return pointList


        def GetJoinedStreamline(self,mappingGrid,processMesh,startPoint,vectorIndex_1,vectorIndex_2,dL):
            
            triRemeshBoundary =  processMesh.triRemeshBoundary
            
            pointList1=self.GetStreamlinePointList(mappingGrid,processMesh,startPoint,vectorIndex_1,dL,threshold=400)
            pointList2=self.GetStreamlinePointList(mappingGrid,processMesh,startPoint,vectorIndex_2,dL,threshold=400)
            
            
            #reverse direction and delete the overlapping point
            pointList1.reverse()
             
            if len(pointList1)>=1:
                pointList1.pop()
                
            pointList1.extend(pointList2)
            fullPointList=pointList1
            
            if len(fullPointList)>1:
        
                return fullPointList
            else:
                return None
                    
        def GetStreamlineNetwork_Random(self,mappingGrid,processMesh,seedpointList,detectDistance,dL):
            
            streamlines=[]
            
            spL=seedpointList.list

            #    for num in testnum:
            #for i in range(10):
            whileCount = 0
            while len(spL)>0:
                if whileCount>1000:
                    break
                restSeedpoint = []
                for i in range(len(spL)):
                    restSeedpoint.append(i)
                ######### testing loop  ##########
                randomindex=random.sample(restSeedpoint,1)[0]
                #tol = rd.ActiveDoc.ModelAbsoluteTolerance
                tol = 0.001
                startPoint = spL[randomindex]
                ##### first direction #####
                if startPoint.firstActivityStatus == True:
                    startPoint.firstActivityStatus = False
                    pointList1=self.GetJoinedStreamline(mappingGrid,processMesh,startPoint,0,2,dL)
                    
                    if pointList1!=None:
                        if len(pointList1)>1:
                            streamline1=rg.Polyline(pointList1)
                            
                            if rg.Intersect.Intersection.CurveSelf(streamline1.ToPolylineCurve(),tol).Count ==0:
                                streamlines.append(streamline1)
                                
                        
                        if rg.Intersect.Intersection.CurveSelf(streamline1.ToPolylineCurve(),tol).Count==0 and len(pointList1)>0:
                            changenote1=self.DetectVertices(pointList1,seedpointList,streamline1,detectDistance)
                        else:
                            changenote1=[]
                    
                        if len(changenote1)>0:
                            for thisSeedpoint in changenote1:
                                self.UpdateActivityStatus(processMesh,seedpointList,streamline1,thisSeedpoint,"first")
                        
                        self.UpdateSeedPointList(seedpointList,changenote1)

                ##### second direction #####
                if startPoint.secondActivityStatus == True:
                    startPoint.secondActivityStatus = False
                    pointList2 = self.GetJoinedStreamline(mappingGrid,processMesh,startPoint,1,3,dL)
                    
                    if pointList2!=None:
                        if len(pointList2)>1:
                            streamline2=rg.Polyline(pointList2)
                
                            if rg.Intersect.Intersection.CurveSelf(streamline2.ToPolylineCurve(),tol).Count ==0:
                                streamlines.append(streamline2)
                                
                        if rg.Intersect.Intersection.CurveSelf(streamline2.ToPolylineCurve(),tol).Count ==0 and len(pointList2)>0:
                            changenote2=self.DetectVertices(pointList2,seedpointList,streamline2,detectDistance)
                        
                        else:
                            changenote2=[]
                            
                        if len(changenote2)>0:
                            for thisSeedpoint in changenote2:
                                self.UpdateActivityStatus(processMesh,seedpointList,streamline2,thisSeedpoint,"second")
        
                        self.UpdateSeedPointList(seedpointList,changenote2)
            
                whileCount+=1
            return streamlines

        def GetStreamlineNetwork(self,mappingGrid,processMesh,seedpointList,detectDistance,dL):
            
            streamlines=[]
            
            spL=seedpointList.list

            #    for num in testnum:
            #for i in range(10):
            whileCount = 0
            #print "-----"
            while len(spL)>0:
                if whileCount>1000:
                    break
                restSeedpoint = []
                for i in range(len(spL)):
                    restSeedpoint.append(i)
                ######### testing loop  ##########
                #print "len restSeedpoint",len(restSeedpoint)
                randomindex = restSeedpoint[0]
                #tol = rd.ActiveDoc.ModelAbsoluteTolerance
                tol = 0.001
                startPoint = spL[randomindex]
                #print "current seedPoint",startPoint.vh.index
                #print startPoint.firstActivityStatus, startPoint.secondActivityStatus
                
                ##### first direction #####
                if startPoint.firstActivityStatus == True:
                    startPoint.firstActivityStatus = False
                    pointList1=self.GetJoinedStreamline(mappingGrid,processMesh,startPoint,0,2,dL)
                    
                    if pointList1!=None:
                        if len(pointList1)>1:
                            streamline1=rg.Polyline(pointList1)
                            
                            if rg.Intersect.Intersection.CurveSelf(streamline1.ToPolylineCurve(),tol).Count ==0:
                                streamlines.append(streamline1)
                                
                        
                        if rg.Intersect.Intersection.CurveSelf(streamline1.ToPolylineCurve(),tol).Count==0 and len(pointList1)>0:
                            changenote1=self.DetectVertices(pointList1,seedpointList,streamline1,detectDistance)
                        else:
                            changenote1=[]
                    
                        if len(changenote1)>0:
                            for thisSeedpoint in changenote1:
                                self.UpdateActivityStatus(processMesh,seedpointList,streamline1,thisSeedpoint,"first")
                        
                        self.UpdateSeedPointList(seedpointList,changenote1)

                ##### second direction #####
                if startPoint.secondActivityStatus == True:
                    startPoint.secondActivityStatus = False
                    pointList2 = self.GetJoinedStreamline(mappingGrid,processMesh,startPoint,1,3,dL)
                    # print "pointList2"
                    # for pt in pointList2:
                    #     print pt.X,pt.Y,0
                    # print len(pointList2)
                    if pointList2!=None:
                        if len(pointList2)>1:
                            streamline2=rg.Polyline(pointList2)
                
                            if rg.Intersect.Intersection.CurveSelf(streamline2.ToPolylineCurve(),tol).Count ==0:
                                streamlines.append(streamline2)
                                
                        if rg.Intersect.Intersection.CurveSelf(streamline2.ToPolylineCurve(),tol).Count ==0 and len(pointList2)>0:
                            changenote2=self.DetectVertices(pointList2,seedpointList,streamline2,detectDistance)
                        
                        else:
                            changenote2=[]
                            
                        if len(changenote2)>0:
                            for thisSeedpoint in changenote2:
                                self.UpdateActivityStatus(processMesh,seedpointList,streamline2,thisSeedpoint,"second")
        
                        self.UpdateSeedPointList(seedpointList,changenote2)

                ##### make sure it is removed #####   
                spL = seedpointList.list
                if (startPoint.firstActivityStatus ==False and startPoint.secondActivityStatus ==False) and startPoint in spL:
                    
                    startPoint.validity = False
                    spL.remove(startPoint)
    
                    
                whileCount+=1
            return streamlines
        
        def GetStreamlineOnSpecificPoint(self,pt,mappingGrid,processMesh,dL):
        
            #tol=rd.ActiveDoc.ModelAbsoluteTolerance
            tol = 0.001
            startPoint=pt
            
            # this will only go for 1 direction
            pointList=self.GetStreamlinePointList(mappingGrid,processMesh,startPoint,"Specific",dL)
            streamline=None
            
            if pointList!=None:
                if len(pointList)>1:
                    streamline=rg.Polyline(pointList)
                
                else:
                    streamline=None
            
            return streamline
            

    #########################
    ########Seedpoint########
    #########################
    
    class Seedpoint:
        def __init__(self,vh):
            self.vh = vh           
            self.firstActivityStatus = True
            self.secondActivityStatus = True
            self.validity = True
            
        def __def__(self):
            self.vh = None           
            self.firstActivityStatus = None
            self.secondActivityStatus = None
            self.validity = None
            
    class SeedpointList:
        def __init__(self):     #Rhino: list[Plankton.vh]    C++:OpenMesh:: VertexHandle
            self.list = None
            
        def __def__(self):
            self.list = None
            
        def CreateSeedpointList(self,processMesh,boolean_onEdge,boolean_onMa):
            seedpointList=[]
            vertexList = processMesh.vertexList
            
            if boolean_onEdge == 1 and boolean_onMa == 1:
                for vertex in vertexList:
                    if vertex.is_OnEdge != 1 and vertex.is_MedialAxisVertex != 1:
                        seedpoint=SLG.Seedpoint(vertex)
                        seedpointList.append(seedpoint)
                        
                        
            
            elif boolean_onEdge == 0 and boolean_onMa == 1:
                for vertex in vertexList:
                    if  vertex.is_MedialAxisVertex != 1:
                        seedpoint=SLG.Seedpoint()
                        seedpoint.vh=vertex
                        seedpointList.append(seedpoint)
               
            elif boolean_onEdge == 1 and boolean_onMa == 0:
                for vertex in vertexList:
                    if  vertex.is_OnEdge != 1:
                        seedpoint=SLG.Seedpoint()
                        seedpoint.vh=vertex
                        seedpointList.append(seedpoint)
                        
            elif boolean_onEdge == 0 and boolean_onMa == 0:
                for vertex in vertexList:
                    seedpoint=SLG.Seedpoint()
                    seedpoint.vh=vertex
                    seedpointList.append(seedpoint)
            
            self.list = seedpointList
                

    #########################
    ######## Diagram ########
    #########################
    
    @staticmethod
    def PrintStreamlines(streamlines):
        print ("diagram for all streamlines")
        for streamline in streamlines:
  
            for pt in streamline:
                print (pt.X),pt.Y,0
            print ("-----")
        return 0
# ---------- end ghpython_script ----------
ghpython_script_2 = GhPythonScript()  # -> out, EV
# ---------- ghpython_script_2: Python ----------
#!/usr/bin/python
# coding=utf-8
###########################
####    Import Libs    ####
###########################
import Rhino.Geometry as rg
#import Rhino.RhinoDoc as rd
import Rhino.RhinoMath as rm

import ghpythonlib.components as ghc
import math

import clr
# clr.AddReferenceToFile("Wrapper.dll")
# clr.AddReference("Wrapper.dll")
# import Eigen.Wrapper

clr.AddReference("CGAL.Wrapper.dll")
import CGAL.Wrapper

from System.Collections.Generic import List

###########################
####    Evaluation     ####
###########################
class EV:
    ######################################################
    #########     Streamline Level Score     #############
    ######################################################
    
    
    ######################################################
    ##########           Continuity         ##############
    ######################################################
    @staticmethod
    def Score_Continuity(streamlines,degree,coefficient):
        scores=[]

        for streamline in streamlines:
            score=0
            
            streamlineVertices=[]
            for index in range(len(streamline)-1):
                streamlineVertices.append(streamline[index])

            
            #global values
            num=len(streamlineVertices)
            length=streamline.Length
            
            #Intermediate values
            direction = rg.Vector3d(0,0,0)
            newVec = rg.Vector3d(0,0,0)
            #mtol = rd.ActiveDoc.ModelAbsoluteTolerance
            mtol = 0.001
            #atol = rd.ActiveDoc.ModelAngleToleranceDegrees
            atol = 0.0174532925199
            for i in range(1,len(streamlineVertices)-1,1):
                direction = streamlineVertices[i]-streamlineVertices[i-1]
                newVec = streamlineVertices[i+1] - streamlineVertices[i]
                angle = rg.Vector3d.VectorAngle(newVec,direction)
                angle = rm.ToDegrees(angle)
                distance = streamlineVertices[i].DistanceTo(streamlineVertices[i+1])
                
                if distance <= (direction.Length +mtol) and angle< (degree+atol):
                    score+=1

            
            score=score/num
            
            #score=score*(1/(length**coefficient))
        
            scores.append(score)
            

        return scores
    
    @staticmethod
    def Score_Continuity_DB(streamlines,degree,coefficient):
        scores=[]

        for streamline in streamlines:
            streamline = streamline.ToPolylineCurve()
            ts = streamline.DivideByCount(100,True)
            divPts = [] 
            for t in ts:
                divPts.append(streamline.PointAt(t))
        
            ptList = divPts
            vecs = []
            for i in range(len(ptList)-1):
                vec = rg.Vector3d(ptList[i+1] - ptList[i])
                vec.Unitize()
                vecs.append(vec)

            score = 0 
            for i in range(len(vecs)-1) :
                
                angle = rg.Vector3d.VectorAngle(vecs[i+1], vecs[i])

                score += angle
            
            score = score/(len(vecs)-1)  # the less the better
            
    
        
            scores.append(score)
        

        return scores
    
    
    
    ######################################################
    ##########           Singularity        ##############
    ######################################################
    
    #abondoned
    @staticmethod
    def Score_Singularity_Abondoned(streamlines,processMesh):
        
        #collection singularities
        singularities = []
        
        for triangle in processMesh.triangleList:
            if triangle.is_Singularity == True:
                singularities.append(triangle.centroid)
        
        #print "len of singularities", len(singularities)
        distances=[]
        
        for i in range(len(streamlines)):
            distances.append([])
        
        for i in range(len(streamlines)):
            for j in range (len(singularities)):
                closestPt = streamlines[i].ClosestPoint(singularities[j])
                distance=closestPt.DistanceTo(singularities[j])
                distances[i].append(distance)
                
        
        shortestDistances=[]
        for i in range(len(distances)):
            shortestDistances.append(min(distances[i]))
            
        score = shortestDistances
        
        return score

    @staticmethod
    def GetSingularityTriangleInfo_Old(processMesh):
        sinIndices = []
        coefficients_Collection = []
        for index in range(len(processMesh.triangleList)):
            # get threeRelated
            processTriangle = processMesh.triangleList[index]
            threeVertices = processTriangle.triangleVertices
            
            
            # find the minVec for every neighbor
            
            vi=threeVertices[0].geometry
            vj=threeVertices[1].geometry
            vk=threeVertices[2].geometry
            
            vecD_i = threeVertices[0].standard
            vecD_j = threeVertices[1].standard
            vecD_k = threeVertices[2].standard
            
            #Matrix A
            A = [vecD_i.X,vecD_j.X,vecD_k.X,vecD_i.Y,vecD_j.Y,vecD_k.Y,1.0,1.0,1.0]
            A = List[float](A)
            rankA = Eigen.Wrapper.OptimizationMethods.GetMatrixRank(3,3,A)
            
            
            #augmented Matrix A
            aA = [vecD_i.X,vecD_j.X,vecD_k.X,0.0,vecD_i.Y,vecD_j.Y,vecD_k.Y,0.0,1.0,1.0,1.0,1.0]
            aA = List[float](aA)
            rankaA = Eigen.Wrapper.OptimizationMethods.GetMatrixRank(3,4,aA)
            

            
            if rankA == rankaA: # there might be a singularity
            
                A = [vecD_i.X,vecD_j.X,vecD_k.X,vecD_i.Y,vecD_j.Y,vecD_k.Y,1.0,1.0,1.0]
                b = [0.0,0.0,1.0]
                
                A = List[float](A)
                b = List[float](b)
                
                coefficients = Eigen.Wrapper.OptimizationMethods.SolveLinearSystem(3,3,A,b)
                
                if coefficients[0]>0 and coefficients[1]>0 and coefficients[2]>0:
                    sinIndices.append(index)
                    coefficients_Collection.append(coefficients)
            else:
                pass
                #print ("ranks are not equal")

        return sinIndices,coefficients_Collection
    
    @staticmethod
    def GetSingularityTriangleInfo(processMesh):
            sinIndices = []
            coefficients_Collection = []
            for index in range(len(processMesh.triangleList)):
                # get threeRelated
                processTriangle = processMesh.triangleList[index]
                threeVertices = processTriangle.triangleVertices
                
                
                # find the minVec for every neighbor
                
                vi=threeVertices[0].geometry
                vj=threeVertices[1].geometry
                vk=threeVertices[2].geometry
                
                vecD_i = threeVertices[0].standard
                vecD_j = threeVertices[1].standard
                vecD_k = threeVertices[2].standard
                
                #Matrix A
                A = [[vecD_i.X,vecD_j.X,vecD_k.X],
                     [vecD_i.Y,vecD_j.Y,vecD_k.Y],
                     [1.0,1.0,1.0]]

                rankA = EV.Get3x3MatrixRank(A)
                
                
                #augmented Matrix A
                aA =[ [vecD_i.X,vecD_j.X,vecD_k.X,0.0],
                     [vecD_i.Y,vecD_j.Y,vecD_k.Y,0.0],
                     [0.0,1.0,1.0,1.0,1.0]]

                rankaA = EV.Get3x4MatrixRank(aA)
                

                
                if rankA == rankaA: # there might be a singularity
                

                    #solverInput = [vecD_i.X,vecD_j.X,vecD_k.X,0.0, vecD_i.Y,vecD_j.Y,vecD_k.Y,0.0,1.0,1.0,1.0,1.0]
                    coefficients = EV.Solve3x3Equations(vecD_i.X,vecD_j.X,vecD_k.X,0.0, vecD_i.Y,vecD_j.Y,vecD_k.Y,0.0,1.0,1.0,1.0,1.0)
                    
                    if coefficients[0]>0 and coefficients[1]>0 and coefficients[2]>0:
                        sinIndices.append(index)
                        coefficients_Collection.append(coefficients)
                
                else:
                    pass
                    #print ("ranks are not equal")

            return sinIndices,coefficients_Collection
            
    @staticmethod
    def Getsingularities(processMesh,sinIndices,coefficients_Collection):
        fList = processMesh.triangleList
        
        singularities = []
        
        if sinIndices != [] and coefficients_Collection!=[]:
            for i in range(len(sinIndices)):
                fIndex = sinIndices[i]
                threeVertices = fList[fIndex].triangleVertices
                vi = threeVertices[0].geometry
                vj = threeVertices[1].geometry
                vk = threeVertices[2].geometry
                
                coefficients = coefficients_Collection[i]
                coi = coefficients[0]
                coj = coefficients[1]
                cok = coefficients[2]
                
                singularity = vi*coi + vj*coj + vk*cok
                singularities.append(singularity)
        
        return singularities
                
    @staticmethod
    def Score_Singularity(processMesh,streamlines):
        
        #sinIndices,coefficients_Collection = EV.GetSingularityTriangleInfo(processMesh)
        #singularities = EV.Getsingularities(processMesh,sinIndices,coefficients_Collection)
        singularities = processMesh.singularities
        
        distances =[]
        for i in range(len(streamlines)):
            distances.append([])
        shortestDistances = []
        
        if singularities != []:
            
            for i in range(len(streamlines)):
                for j in range(len(singularities)):
                    closestPt = streamlines[i].ClosestPoint(singularities[j])
                    distance = closestPt.DistanceTo(singularities[j])
                    distances[i].append(distance)
        
            for i in range(len(distances)):
                shortestDistances.append(min(distances[i]))
           
           
        else:
            for i in range(len(streamlines)):
                shortestDistances.append(0)
        
        scores = shortestDistances
        
        return scores
            

    

    ######################################################
    ##########           Divergence         ##############
    ######################################################
    
    ##############
    @staticmethod
    def GetBarycentricCoefficient(threeVertices,ptX):
        #get the vertices of triangle
        pointA=threeVertices[0]
        pointB=threeVertices[1]
        pointC=threeVertices[2]
        
        #area of this triangle

        areaABC=rg.Vector3d.CrossProduct(rg.Vector3d(pointB-pointA) ,rg.Vector3d(pointC-pointA) ).Length *0.5
        
        #area of first subtriangle
        Nc=rg.Vector3d.CrossProduct(rg.Vector3d(pointB-pointA),rg.Vector3d(ptX-pointA))
        Ncc=rg.Vector3d.CrossProduct(rg.Vector3d(pointB-pointA),rg.Vector3d(pointC-pointA))
        mc=rg.Vector3d.Multiply(Nc,Ncc)
        
        if mc>=0:
            areaABX=0.5*Nc.Length
        
        else:
            areaABX=-0.5*Nc.Length
        
        coefficientc=areaABX/areaABC
        
        #area of second subtriangle
        Nb=rg.Vector3d.CrossProduct(rg.Vector3d(pointA-pointC),rg.Vector3d(ptX-pointC))
        Nbb=rg.Vector3d.CrossProduct(rg.Vector3d(pointA-pointC),rg.Vector3d(pointB-pointC))
        mb=rg.Vector3d.Multiply(Nb,Nbb)
        
        if mb>=0:
            areaAXC=0.5*Nb.Length
        
        else:
            areaAXC=-0.5*Nb.Length
        
        coefficientb=areaAXC/areaABC
        
        
        
        #area of third subtriangle
        Na=rg.Vector3d.CrossProduct(rg.Vector3d(pointC-pointB),rg.Vector3d(ptX-pointB))
        Naa=rg.Vector3d.CrossProduct(rg.Vector3d(pointC-pointB),rg.Vector3d(pointA-pointB))
        ma=rg.Vector3d.Multiply(Na,Naa)
        
        if ma>=0:
            areaXBC=0.5*Na.Length
        
        else:
            areaXBC=-0.5*Na.Length
        
        coefficienta=areaXBC/areaABC
        
        
        return (coefficienta,coefficientb,coefficientc)
    
    #abondoned
    @staticmethod
    def GetNewVector_Inside(mappingGrid,processMesh,testPt):
        triRemeshBoundary =  processMesh.triRemeshBoundary
        vList = processMesh.vertexList
        fList = processMesh.triangleList
        
        thisPointRow=int(round(testPt.X))
        thisPointColumn=int(round(testPt.Y))
        thisPointRow,thisPointColumn = mappingGrid.RemapPosition(testPt)
        coefficient=[]
        
    
        for triangleIndex in mappingGrid.grid[thisPointRow][thisPointColumn].documentedTriangle:
            threeVertices = fList[triangleIndex].triangleVertices
            threeVertices_geo = [threeVertices[0].geometry,threeVertices[1].geometry,threeVertices[2].geometry]
            
            coefficients=EV.GetBarycentricCoefficient(threeVertices_geo,testPt)
            
            if coefficients[0]>=0 and coefficients[1]>=0 and coefficients[2]>=0:
                break
        
        
        u=float(coefficients[0])
        v=float(coefficients[1])
        w=float(coefficients[2])
        
        
        newVector=u * threeVertices[0].crossField[0]+threeVertices[1].crossField[0]+w * threeVertices[2].crossField[0]
        newVector.Unitize()
        
        
         ##### medial axis case or concave case#####
        if fList[triangleIndex].is_MedialAxis == 1:

            result=["medialaxiscase",triangleIndex,newVector]
            return result
            
        return newVector
    
    #abondoned
    @staticmethod
    def GetDivergenceVector(pointList,pointIndex,newVector):
        
            #ending situation
            if pointIndex==len(pointList)-1:
                thisvector = rg.Vector3d(pointList[pointIndex]-pointList[pointIndex-1])

            else:
                thisvector = rg.Vector3d(pointList[pointIndex+1]-pointList[pointIndex])


            wxy_Plane=rg.Plane.WorldXY
            ZAxis=wxy_Plane.ZAxis
            
    
            vector1=newVector
            vector2 = rg.Vector3d(vector1)
            vector3 = rg.Vector3d(vector1)
            vector4 = rg.Vector3d(vector1)
            
            vector2.Rotate(rm.ToRadians(90),ZAxis)
            vector3.Rotate(rm.ToRadians(180),ZAxis)
            vector4.Rotate(rm.ToRadians(270),ZAxis)
 
            
            vectorangle1=rm.ToDegrees(rg.Vector3d.VectorAngle(thisvector,vector1))
            vectorangle2=rm.ToDegrees(rg.Vector3d.VectorAngle(thisvector,vector2))
            vectorangle3=rm.ToDegrees(rg.Vector3d.VectorAngle(thisvector,vector3))
            vectorangle4=rm.ToDegrees(rg.Vector3d.VectorAngle(thisvector,vector4))
            
            vectorlist=[newVector,vector2,vector3,vector4]
            anglelist= [vectorangle1,vectorangle2,vectorangle3,vectorangle4]
    
            maxangleindex=anglelist.index(max(anglelist))
            minangleindex=anglelist.index(min(anglelist))
            
            maxvector=vectorlist[maxangleindex]
            minvector=vectorlist[minangleindex]
            
            vectorlist.remove(maxvector)
            vectorlist.remove(minvector)
            
            chosenVector=vectorlist[0]
            
            return chosenVector
    
    #abondoned
    @staticmethod
    def FlipVectors(vectorList):
        baseVector=vectorList[0]
        newVectorList=[]
        for vector in vectorList:
            vector_r = rg.Vector3d(vector.X,vector.Y,vector.Z)
            vectors=[vector,vector_r]
            angle1=rm.ToDegrees(rg.Vector3d.VectorAngle(baseVector,vectors[0]))
            angle2=rm.ToDegrees(rg.Vector3d.VectorAngle(baseVector,vectors[1]))
            
            if angle1>angle2:
                newVector=vectors[1]
            else:
                newVector=vectors[0]
            
            newVectorList.append(newVector)
        
        return newVectorList
    
    #abondoned
    @staticmethod
    def GetPerpendicularVectorLength(segment,vector):
        segment=segment.ToPolyline()
        endPoint=segment.First
        startPoint=segment.Last
        
        thisVector=rg.Vector3d(endPoint-startPoint)
        
        angle=rm.ToDegrees(rg.Vector3d.VectorAngle(thisVector,vector))
        
        if angle>90:
            angle=180-angle
        
        
        perpendicularVectorLength=math.sin((angle/180)*math.pi)*vector.Length
        
        return perpendicularVectorLength
    
    #abondoned
    @staticmethod
    def Score_Divergence_Abondoned(streamlines,mappingGrid,processMesh,factor=0.9):
        scores=[]
        
        for streamline in streamlines:
            #basicinfo

            
            
            pts=[]
            for index in range(len(streamline)-1):
                pts.append(streamline[index])
            
            ts=[]
            for pt in pts:
                t=streamline.ClosestParameter(pt)
                ts.append(t)
            
            segments = streamline.ToPolylineCurve().Split(ts)
            
        
            vectorsAnchorPts=[]
            
            chosenVectors=[]
            for pointIndex in range(1,len(pts),1):

                testPt=pts[pointIndex]
                vectorsAnchorPts.append(testPt)
                newVector= EV.GetNewVector_Inside(mappingGrid,processMesh,testPt)
                
                if type(newVector)==type([]):
                    newVector=newVector[2]
                
                if type(newVector)==type("str"):
                    break
                    
                chosenVector=EV.GetDivergenceVector(pts,pointIndex,newVector)
                chosenVectors.append(chosenVector)
            

            chosenVectors=EV.FlipVectors(chosenVectors)
            

            totalScore=0

            fullLength=streamline.Length
            
            
            for i in range(len(vectorsAnchorPts)):
        
                perpendicularVectorLength=EV.GetPerpendicularVectorLength(segments[i],chosenVectors[i])
                score=segments[i].GetLength()*perpendicularVectorLength
                totalScore+=score

            totalScore*=(1/fullLength)**factor
            
            scores.append(totalScore)
        
        return scores

    ##############
    
    ##### New updated #####
    @staticmethod
    def GetDividedPoints_ByCount(segment,divideNum):
        ts = segment.DivideByCount(divideNum,True)
        divPts = [] 
        for t in ts:
            divPts.append(segment.PointAt(t))
        return divPts
        
    @staticmethod
    def GetDividedPoints_ByLength(thisSLcurve,divideLength):
        
        thisSLcurve = thisSLcurve.ToPolylineCurve()
        if thisSLcurve.GetLength()< divideLength:
            ts = thisSLcurve.DivideByCount(2,True)
        else:
            ts = thisSLcurve.DivideByLength(divideLength,True)
            
        divPts = []
        for t in ts:
            divPts.append(thisSLcurve.PointAt(t))
        return divPts
        
    @staticmethod
    def GetTriangleArea(processMesh,triIndex):
        
        processTriangle = processMesh.triangleList[triIndex]
        triangle = processTriangle.triangleBoundary
        
        area = rg.AreaMassProperties.Compute(triangle.ToPolylineCurve()).Area
        return area
    
    @staticmethod
    def CheckTriangleIndex (processMesh,mappingGrid,thisPt):
        fList = processMesh.triangleList
        thisPointRow=int(round(thisPt.X))
        thisPointColumn=int(round(thisPt.Y))
        
        thisPointRow,thisPointColumn = mappingGrid.RemapPosition(thisPt)
        coefficient = []
        for triangleIndex in mappingGrid.grid[thisPointRow][thisPointColumn].documentedTriangle:
            threeVertices = fList[triangleIndex].triangleVertices
            threeVertices_geo = [threeVertices[0].geometry,threeVertices[1].geometry,threeVertices[2].geometry]
            coefficients=EV.GetBarycentricCoefficient(threeVertices_geo,thisPt)
            if coefficients[0]>=0 and coefficients[1]>=0 and coefficients[2]>=0:
                break
                
        u=float(coefficients[0])
        v=float(coefficients[1])
        w=float(coefficients[2])
        
        triIndex = triangleIndex 
        
        return triIndex
        
    @staticmethod
    def GetMinVector(processMesh,index,thisVec):
        vList = processMesh.vertexList
        
        vec0 = vList[index].crossField[0]
        vec1 = vList[index].crossField[1]
        vec2 = vList[index].crossField[2]
        vec3 = vList[index].crossField[3]
        
        vecs = [vec0,vec1,vec2,vec3]
        angles=[]
        angles.append(rg.Vector3d.VectorAngle(thisVec,vec0))
        angles.append(rg.Vector3d.VectorAngle(thisVec,vec1))
        angles.append(rg.Vector3d.VectorAngle(thisVec,vec2))
        angles.append(rg.Vector3d.VectorAngle(thisVec,vec3))
        
        minIndex = angles.index(min(angles))
        chosenVec = vecs[minIndex]
        
        return chosenVec
        
    @staticmethod
    def GetMinVector_FromProcessVertex(processVertex,thisVec):

        vec0 = processVertex.crossField[0]
        vec1 = processVertex.crossField[1]
        vec2 = processVertex.crossField[2]
        vec3 = processVertex.crossField[3]
        
        vecs = [vec0,vec1,vec2,vec3]
        angles=[]
        angles.append(rg.Vector3d.VectorAngle(thisVec,vec0))
        angles.append(rg.Vector3d.VectorAngle(thisVec,vec1))
        angles.append(rg.Vector3d.VectorAngle(thisVec,vec2))
        angles.append(rg.Vector3d.VectorAngle(thisVec,vec3))
        
        minIndex = angles.index(min(angles))
        chosenVec = vecs[minIndex]
        
        return chosenVec
        
    @staticmethod
    def CalculateOperatorValue(chosenPt,thisPt,chosenVec,thisVec):
        var_ptX = chosenPt.X - thisPt.X
        var_ptY = chosenPt.Y - thisPt.Y
                
        var_Vector = chosenVec - thisVec
    
        var_VectorX = var_Vector.X
        var_VectorY = var_Vector.Y
        
        
        operator = var_VectorX/var_ptX + var_VectorY/var_ptY
        
        return operator
    
    @staticmethod
    def Score_Divergence(processMesh,mappingGrid,streamlines,divLength):
        scores=[]
        
        for streamline in streamlines:
            divPts = EV.GetDividedPoints_ByLength(streamline,divLength)
            fullLength = streamline.Length
            factor = 0.9
            totalScore = 0
            for ptIndex in range(len(divPts)-1):
            
                thisPt = divPts[ptIndex]
                
                # check which triangle its in
                triIndex = EV.CheckTriangleIndex (processMesh,mappingGrid,thisPt)
                
                # get triangleArea
                triangleArea = EV.GetTriangleArea(processMesh,triIndex)
                
                # get threeRelated
                processTriangle = processMesh.triangleList[triIndex]
                threeVertices = processTriangle.triangleVertices

                
                # find the minVec for every neighbor
                thisVec=rg.Vector3d(divPts[ptIndex+1]-divPts[ptIndex])
                vi=threeVertices[0].geometry
                vj=threeVertices[1].geometry
                vk=threeVertices[2].geometry
                minVec_i = EV.GetMinVector_FromProcessVertex(threeVertices[0],thisVec)
                minVec_j = EV.GetMinVector_FromProcessVertex(threeVertices[1],thisVec)
                minVec_k = EV.GetMinVector_FromProcessVertex(threeVertices[2],thisVec)
                
                # get the surrounding triangles
                vN = rg.Vector3d(0,0,1)
                
                vkj_Vertical = rg.Vector3d.CrossProduct(rg.Vector3d(vk-vj),vN)
                vik_Vertical = rg.Vector3d.CrossProduct(rg.Vector3d(vi-vk),vN)
                vji_Vertical = rg.Vector3d.CrossProduct(rg.Vector3d(vj-vi),vN)
                
                operator = ((vkj_Vertical.X*minVec_i.X) + (vik_Vertical.X*minVec_j.X) + (vji_Vertical.X*minVec_k.X)
                        + (vkj_Vertical.Y*minVec_i.Y) + (vik_Vertical.Y*minVec_j.Y) + (vji_Vertical.Y*minVec_k.Y))/(2*triangleArea)
                
                operator=abs(operator)
                
                d = divPts[ptIndex].DistanceTo(divPts[ptIndex+1])
                score =operator*d
                totalScore+=score
                
            
            totalScore*=1/(fullLength**factor)
            scores.append(totalScore)
            
        return scores




    ######################################################
    ##########      Parcel Level Score      ##############
    ######################################################
    @staticmethod
    def EvaluateAreaRatio(polygons):
        polygon1=polygons[0]
        polygon2=polygons[1]

        area1=rg.AreaMassProperties.Compute(polygon1).Area
        area2=rg.AreaMassProperties.Compute(polygon2).Area
        
        areaPair= [area1,area2]

        ### smallArea/BigArea
        if area1>=area2:
            ratio = area2/area1
        else:
            ratio = area1/area2
            
        return ratio,areaPair
    
    @staticmethod
    def EvaluateOrientation(geo,idealOrientation):
        obb = EV.GetOBB(geo,5)
        obb = EV.MakeCounterClockwiseDirection(obb)
        #construct the local coordinate
        obbOrigin = None
        distance = []
        for i in range(len(obb)-1):
            distance.append(obb[i].DistanceTo(rg.Point3d(0,0,0)))
        
        
        
        ptIndex = distance.index(min(distance))
        obbOrigin =obb[ptIndex]
        
        
        if ptIndex != 0 and ptIndex != 3:
            Xend = obb[ptIndex+1]
            Yend = obb[ptIndex-1]
        
        elif ptIndex==0:
            Xend = obb[ptIndex+1]
            Yend = obb[3]
        elif ptIndex==3:
            
            Xend = obb[0]
            Yend = obb[ptIndex-1]
        
        obbXaxis = rg.Vector3d(Xend - obbOrigin)
        obbYaxis = rg.Vector3d(Yend - obbOrigin)
        
        globalXaxis = rg.Vector3d(1,0,0)
        globalYaxis = rg.Vector3d(0,1,0)
        
        
        #compare the longer obbedge
        if obbXaxis.Length >=obbYaxis.Length:
            compare = obbXaxis
        else:
            compare = obbYaxis
            
        angle = rg.Vector3d.VectorAngle(compare,globalXaxis)
        
        ### this is optional
        if angle > rm.HalfPI:
            angle = rm.TwoPI/2 - angle
                        
        return angle

    @staticmethod
    def EvaluateElongation(geo):
        box = EV.GetOBB(geo,5)
                
                
        edge1=box.SegmentAt(0)
        edge2=box.SegmentAt(1)
        
        if edge1.Length>edge2.Length:
            ratio=edge1.Length/edge2.Length
        
        else:
            ratio=edge2.Length/edge1.Length
        
        return ratio
        
    @staticmethod
    def EvaluateCompactness(geo): 
        return 4 * math.pi * rg.AreaMassProperties.Compute(geo).Area/geo.GetLength()**2
        
    @staticmethod
    def EvaluateConvexity_OldOld(geo):
        
        ### random NurbsCurve instance 
        
        nc = rg.NurbsCurve.Create(False, 3, [rg.Point3d(0,0,0),rg.Point3d(0,2,0),rg.Point3d(2, 3, 0),rg.Point3d(4, 2, 0),rg.Point3d(4, 0, 0)])
    
        if type(geo) == type(rg.PolylineCurve()) or type(geo) == type(nc) or type(geo) == type(rg.PolyCurve()) :
            ts = []
            step = geo.Domain[1]/100
            for i in range(100):
            
                ts.append(step*i)

            pts = []
            for t in ts:
                pts.append(geo.PointAt(t))

            try:
                convexHull = ghc.ConvexHull(pts)[0]
                convexity = convexHull.GetLength()  / geo.GetLength()
            except:
                convexity = 0
            
        else:
            geo = geo.ToPolyline()
            Vertices=[]
            for index in range(len(geo)-1):
                Vertices.append(geo[index])
            
            try:
                convexHull = ghc.ConvexHull(Vertices)[0]
                convexity = convexHull.GetLength()  / geo.Length
            except:
                convexity = 0
                
        return convexity
    
    @staticmethod
    def EvaluateConvexity(geo):
        if isinstance(geo,rg.Polyline)!= True:
            if isinstance(geo,rg.PolylineCurve) or isinstance(geo,rg.NurbsCurve) or isinstance(geo,rg.PolyCurve):
                ts = []
                step = geo.Domain[1]/100
                for i in range(100):
                
                    ts.append(step*i)
    
                pts = []
                for t in ts:
                    pts.append(geo.PointAt(t))
            ptList = List[rg.Point3d](pts)
            
        else:
            
            ptList = [geo[index] for index in range(len(geo)-1)]
            ptList = List[rg.Point3d](ptList)
        
        try:
            ptList_Con = CGAL.Wrapper.GeometryProcessingMethods.CGAL_2DConvexHull(ptList)
            convexHull = rg.Polyline(ptList_Con)
            convexity = convexHull.Length/geo.Length
        
        except:
            convexity = 0
        return convexity
        
    
    @staticmethod
    def EvaluateConvexity_Old(geo):
        
        ### random NurbsCurve instance 
       
        if isinstance(geo,rg.PolylineCurve) or isinstance(geo,rg.NurbsCurve) or isinstance(geo,rg.PolyCurve):
            ts = []
            step = geo.Domain[1]/100
            for i in range(100):
            
                ts.append(step*i)

            pts = []
            for t in ts:
                pts.append(geo.PointAt(t))
    
            convexHull = EV.GetConvexHull(pts)
            if convexHull == None:
                convexity = 0
            else:
                convexity = convexHull.Length  / geo.GetLength()
            
        else:
            geo = geo.ToPolyline()
            Vertices=[]
            for index in range(len(geo)-1):
                Vertices.append(geo[index])

            convexHull = EV.GetConvexHull(Vertices)
            if convexHull == None:
                convexity = 0
            else:
                convexity = convexHull.Length  / geo.Length
     
        
        return convexity


    @staticmethod
    def Score_ParcelLevel_EvenArea(streamlines,boundary):
        
        ###This is to record the Difference to the Ideal Value
        discrepancies_area=[]
     
        
        ###This is to record datas for each Pair
  
        areaPairCollection = []
     
        
        for i in range(len(streamlines)):
            
            
            polygons=EV.SplitPolygon(streamlines[i],boundary)
            
            ### check if the polygons valid
            checkTag1 = None
            checkTag2 = None
            
            if polygons !=None:
                checkTag1 = rg.AreaMassProperties.Compute(polygons[0])
                checkTag2 = rg.AreaMassProperties.Compute(polygons[1])
            
            if polygons !=None and checkTag1!=None and checkTag2!=None:
                
                ### EVEN AREA  ###
                
                ratio,areaPair = EV.EvaluateAreaRatio(polygons)
                areaPairCollection.append(areaPair)
                
                discrepancy_area=abs(ratio-1)          
                discrepancies_area.append(discrepancy_area)
                
               
        return discrepancies_area,areaPairCollection
      
      
    @staticmethod
    def Score_ParcelLevel_Orientation(streamlines,boundary,idealOrientation):
        
        ###This is to record the Difference to the Ideal Value
        discrepancies_orientation=[]
        
        ###This is to record datas for each Pair
        orientationPairCollection = []
        
        for i in range(len(streamlines)):
            
            
            polygons=EV.SplitPolygon(streamlines[i],boundary)
            
            ### check if the polygons valid
            checkTag1 = None
            checkTag2 = None
            
            if polygons !=None:
                checkTag1 = rg.AreaMassProperties.Compute(polygons[0])
                checkTag2 = rg.AreaMassProperties.Compute(polygons[1])
            
            if polygons !=None and checkTag1!=None and checkTag2!=None:
             
                ###       Orientation       ###
                # idealOrientation = 0  - > meaning prefer N-S
                # idealOrientation = 1  - > meaning prefer W-E
                
                orientationPair = []
                discrepancy_orientation_pair = []
                for geo in polygons:
                    
                    orientation = EV.EvaluateOrientation(geo,idealOrientation)  # 0 -> NS, 1-> WS
                    orientationPair.append(orientation)
                    
                    # get the discrepancy
                    if orientation > rm.HalfPI:
                        orientation = rm.TwoPI/2 - orientation
            
                    if idealOrientation == 0: # prefer NS
                        discrepancy_orientation = abs(orientation - rm.HalfPI)
                    
                    elif idealOrientation == 0.5: # prefer NS
                        discrepancy_orientation = abs(orientation - rm.HalfPI*0.5)
                    
                    elif idealOrientation == 1: # prefer WE
                        discrepancy_orientation = abs(orientation - 0)

                    discrepancy_orientation_pair.append(discrepancy_orientation)
                    
                orientationPairCollection.append(orientationPair)
                discrepancies_orientation.append( (discrepancy_orientation_pair[0] + discrepancy_orientation_pair[1])/2 )  ### take the average
                
            else:

                orientationPair = [999999,999999] 
                orientationPairCollection.append(orientationPair)
                discrepancies_orientation.append( 999999 )
       
        
                print ("SplitPolygon fails to split")
        return discrepancies_orientation,orientationPairCollection
      
      
    @staticmethod
    def Score_ParcelLevel(streamlines,boundary,idealElongation,idealCompactness,idealConvexity,idealOrientation):
        
        ###This is to record the Difference to the Ideal Value
        discrepancies_area=[]
        discrepancies_elongation=[]
        discrepancies_compactness=[]
        discrepancies_convexity=[]
        discrepancies_orientation=[]
        
        ###This is to record datas for each Pair
        elongationPairCollection = []
        areaPairCollection = []
        convexityPairCollection = []
        compactnessPairCollection = []
        orientationPairCollection = []
        
        for i in range(len(streamlines)):
            
            
            polygons=EV.SplitPolygon(streamlines[i],boundary)
            
            ### check if the polygons valid
            checkTag1 = None
            checkTag2 = None
            
            if polygons !=None:
                checkTag1 = rg.AreaMassProperties.Compute(polygons[0])
                checkTag2 = rg.AreaMassProperties.Compute(polygons[1])
            
            if polygons !=None and checkTag1!=None and checkTag2!=None:
                
                ### EVEN AREA  ###
                
                ratio,areaPair = EV.EvaluateAreaRatio(polygons)
                areaPairCollection.append(areaPair)
                
                discrepancy_area=abs(ratio-1)          
                discrepancies_area.append(discrepancy_area)
                
                ###       ELONGATION       ###
                elongationPair = []
                discrepancy_elongation_pair=[]
                for geo in polygons:
                    ratio = EV.EvaluateElongation(geo)
                    
                    elongationPair.append(ratio)
                    discrepancy_elongation=abs(ratio-idealElongation)
                    
                    discrepancy_elongation_pair.append(discrepancy_elongation)

                elongationPairCollection.append(elongationPair) 
                discrepancies_elongation.append( (discrepancy_elongation_pair[0] + discrepancy_elongation_pair[1])/2 )  ### take the average
            
                ###       Compactness       ###
                compactnessPair = [] 
                discrepancy_compactness_pair=[]
                for geo in polygons:
                    
                    compactness = EV.EvaluateCompactness(geo)
                    compactnessPair.append(compactness)
                    discrepancy_compactness = abs(compactness-idealCompactness)
                    discrepancy_compactness_pair.append(discrepancy_compactness)
                    
                compactnessPairCollection.append(compactnessPair)
                discrepancies_compactness.append( (discrepancy_compactness_pair[0] + discrepancy_compactness_pair[1])/2 )   ### take the average
                
                ###       Convexity       ###
                convexityPair = []
                discrepancy_convexity_pair = []
                for geo in polygons:

                    convexity = EV.EvaluateConvexity(geo) 
                    convexityPair.append(convexity)
                    discrepancy_convexity = abs(convexity-idealConvexity)
                    discrepancy_convexity_pair.append(discrepancy_convexity)
                    
                convexityPairCollection.append(convexityPair)
                discrepancies_convexity.append( (discrepancy_convexity_pair[0] + discrepancy_convexity_pair[1])/2 )  ### take the average
                
                ###       Orientation       ###
                # idealOrientation = 0  - > meaning prefer N-S
                # idealOrientation = 1  - > meaning prefer W-E
                
                orientationPair = []
                discrepancy_orientation_pair = []
                for geo in polygons:
                    
                    orientation = EV.EvaluateOrientation(geo,idealOrientation)  # 0 -> NS, 1-> WS
                    orientationPair.append(orientation)
                    
                    # get the discrepancy
                    if orientation > rm.HalfPI:
                        orientation = rm.TwoPI/2 - orientation
            
                    if idealOrientation == 0: # prefer NS
                        discrepancy_orientation = abs(orientation - rm.HalfPI)
                    
                    elif idealOrientation == 1: # prefer WE
                        discrepancy_orientation = abs(orientation - 0)

                    discrepancy_orientation_pair.append(discrepancy_orientation)
                    
                orientationPairCollection.append(orientationPair)
                discrepancies_orientation.append( (discrepancy_orientation_pair[0] + discrepancy_orientation_pair[1])/2 )  ### take the average
                
            else:

                areaPair = [999999,999999]
                areaPairCollection.append(areaPair)
                discrepancies_area.append(999999)
                
                elongationPair = [999999,999999] 
                elongationPairCollection.append(elongationPair) 
                discrepancies_elongation.append( 999999 )  ### take the average
                  
                
                convexityPair =[999999,999999] 
                convexityPairCollection.append(convexityPair)
                discrepancies_convexity.append(999999 )  ### take the average
                
                
                compactnessPair = [999999,999999] 
                compactnessPairCollection.append(compactnessPair)
                discrepancies_compactness.append( 999999 )   ### take the average
                
                orientationPair = [999999,999999] 
                orientationPairCollection.append(orientationPair)
                discrepancies_orientation.append( 999999 )
       
        
                print ("SplitPolygon fails to split")
        return (discrepancies_area,discrepancies_elongation,discrepancies_compactness,discrepancies_convexity,discrepancies_orientation,elongationPairCollection,areaPairCollection,convexityPairCollection, compactnessPairCollection,orientationPairCollection)
      
    ######################################################
    ##########      Graphic Paper  Score    ##############
    ###################################################### 

    
    
    @staticmethod 
    def Score_GeometrySide(SPF,SLG,parcFace,streamlines,EDict_All,currStreetGraph):
        continuityList = []
        numDifferenceList = []
        angleVarAveList = []
        lengthVarAveList = []
        accessAveList = []
        # print "parcFace;s ID",parcFace.ID
        # for sl in streamlines:
        #     for pt in sl:
        #         print (pt.X),pt.Y,0 
        #     print "-----"
        
        ###Check if it can split
        removeItems =[]
        for streamline in streamlines:
            if EV.SplitPolygon(streamline,parcFace.processMesh.triRemeshBoundary) == None:
                removeItems.append(streamline)
        
        for item in removeItems:
            streamlines.remove(item)
            
            
        for streamline in streamlines:
            #numDifference, angleVarAve, lengthVarAve = EV.EvaluateGeometrySideRelated(SPF,SLG,parcFace,streamline,EDict_All)
            numDifference,continuity, angleVarAve, lengthVarAve,aveAccessScore = EV.EvaluateGeometrySideRelated(SPF,SLG,parcFace,streamline,EDict_All,currStreetGraph)
            # print ("numDifference"), numDifference
            # print ("angleVarAve"), angleVarAve 
            # print ("lengthVarAve"), lengthVarAve
            
            
            numDifferenceList.append(numDifference)
            continuityList.append(continuity)
            angleVarAveList.append(angleVarAve)
            lengthVarAveList.append(lengthVarAve)
            accessAveList.append(aveAccessScore)
        # print ("continuityList"),continuityList
        # print ("numDifferenceList"), numDifferenceList
        # print ("angleVarAveList"), angleVarAveList 
        # print ("lengthVarAveList"), lengthVarAveList
        #print ("continuityList, angleVarAveList, lengthVarAveList"), len(continuityList), len(angleVarAveList), len(lengthVarAveList)
        # print (numDifferenceList)
        # print (angleVarAveList)
        # print (lengthVarAveList)
        #print (accessAveList)
        
        
        return continuityList,numDifferenceList,  angleVarAveList, lengthVarAveList,accessAveList
    
    ### Help Func
    @staticmethod 
    def EvaluateContinuity(streamline):
        score=0
        streamlineVertices=[]
        for index in range(len(streamline)-1):
            streamlineVertices.append(streamline[index])
    
        #global values
        num=len(streamlineVertices)
        length=streamline.Length
        
        #Intermediate values
        direction = rg.Vector3d(0,0,0)
        newVec = rg.Vector3d(0,0,0)

        mtol = 0.001
        atol = 0.0174532925199
        
        angleSum = 0
        for i in range(1,len(streamlineVertices)-1,1):
            direction = streamlineVertices[i]-streamlineVertices[i-1]
            newVec = streamlineVertices[i+1] - streamlineVertices[i]
            angle = rg.Vector3d.VectorAngle(newVec,direction)
            angle = rm.ToDegrees(angle)
            angleSum+=angle
        
        continuity=angleSum/num
        
        return continuity
        
        
    
    @staticmethod
    def EvaluateSideNum(sides):
        return len(sides)   
    
        
    @staticmethod
    def EvaluateSideLengthVariance(sides):
        totalLength = 0
        for side in sides:
            
            totalLength+= int(side.Length)
        
        
        meanLength = totalLength/len(sides)  
        if  meanLength== 0:
            return 99999999
        
        sumSquares = 0
        for side in sides:
 
            deviation = int(side.Length)/meanLength - 1 
            sumSquares = sumSquares + (deviation * deviation)

        variance = sumSquares/len(sides)
        #print ("lengthsvariance: "), [side.Length for side in sides], variance
        return variance  
    
    @staticmethod
    def EvaluateSideLengthVariance_Old(sides):
        totalLength = 0
        for side in sides:
            #print int(side.Length)
            totalLength+= int(side.Length)
            
        meanLength = totalLength/len(sides)  
        sumSquares = 0
        for side in sides:
           
            deviation = int(side.Length) - meanLength
            sumSquares = sumSquares + (deviation * deviation)

        variance = sumSquares/len(sides)
        #print ("lengthsvariance: "), [side.Length for side in sides], variance
        return variance   
    
    @staticmethod
    def EvaluateAngleVariance_Old_Old(sides):
        
        angles = []
        for i in range(len(sides)-1):
            currSide = sides[i]
            nextSide = sides[i+1]
            
            lastSeg = currSide.GetSegments()[-1]
            firstSeg = nextSide.GetSegments()[0]
            
            vecA = rg.Vector3d(lastSeg.From - lastSeg.To)
            vecB = rg.Vector3d(firstSeg.To - firstSeg.From)
            angle = rg.Vector3d.VectorAngle(vecA,vecB)
            angles.append(int(rm.ToDegrees(angle)))

        currSide = sides[-1]
        nextSide = sides[0]

        lastSeg = currSide.GetSegments()[-1]
        firstSeg = nextSide.GetSegments()[0]

        vecA = rg.Vector3d(lastSeg.From - lastSeg.To)
        vecB = rg.Vector3d(firstSeg.To - firstSeg.From)
        angle = rg.Vector3d.VectorAngle(vecA,vecB)
        angle = rm.ToDegrees(angle)
        angles.append(int(angle))
      
    
        
        sumAngle = 0
        for angle in angles:
            sumAngle+=angle
        meanAngle = sumAngle/len(sides)
        
        sumSquares = 0
        
        for i in range(len(sides)):
    
            deviation = angles[i] - meanAngle
            sumSquares += deviation * deviation

        variance = sumSquares/len(sides)
        
        #print ("angles: "),angles , "angleVariance",variance
        return variance
    
        
    @staticmethod
    def EvaluateAngleVariance_OOLD(sides):
        
        angles = []
        for i in range(len(sides)-1):
            currSide = sides[i]
            nextSide = sides[i+1]
            
      
            
            vecA = rg.Vector3d(currSide.First - currSide.Last)
            vecB = rg.Vector3d(nextSide.Last - nextSide.First)
            angle = rg.Vector3d.VectorAngle(vecA,vecB)
            #angles.append(angle)
            angles.append(int(rm.ToDegrees(angle)))

        currSide = sides[-1]
        nextSide = sides[0]


        vecA = rg.Vector3d(currSide.First - currSide.Last)
        vecB = rg.Vector3d(nextSide.Last - nextSide.First)
        angle = rg.Vector3d.VectorAngle(vecA,vecB)
        angles.append(angle)
        angle = rm.ToDegrees(angle)
        angles.append(int(angle))
      
        sumAngle = 0
        for angle in angles:
            sumAngle+=angle
        meanAngle = sumAngle/len(sides)
        
        sumSquares = 0
        
        for i in range(len(sides)):
    
            deviation = angles[i] - meanAngle
            sumSquares += deviation * deviation

        variance = sumSquares/len(sides)
        
        #print ("angles: "),angles , "angleVariance",variance
        return variance

    @staticmethod
    def EvaluateAngleVariance(sides):
        
        angles = []
        for i in range(len(sides)-1):
            currSide = sides[i]
            nextSide = sides[i+1]
            
      
            
            vecA = rg.Vector3d(rg.Point3d(currSide.First.X,currSide.First.Y,0) - rg.Point3d(currSide.Last.X,currSide.Last.Y,0))
            vecB = rg.Vector3d(rg.Point3d(nextSide.Last.X,nextSide.Last.Y,0) - rg.Point3d(nextSide.First.X,nextSide.First.Y,0))
            angle = rg.Vector3d.VectorAngle(vecA,vecB)
            angles.append(angle)
            #angles.append(int(rm.ToDegrees(angle)))

        currSide = sides[-1]
        nextSide = sides[0]


        vecA = rg.Vector3d(rg.Point3d(currSide.First.X,currSide.First.Y,0) - rg.Point3d(currSide.Last.X,currSide.Last.Y,0))
        vecB = rg.Vector3d(rg.Point3d(nextSide.Last.X,nextSide.Last.Y,0) - rg.Point3d(nextSide.First.X,nextSide.First.Y,0))
        angle = rg.Vector3d.VectorAngle(vecA,vecB)
        angles.append(angle)
        #angle = rm.ToDegrees(angle)
        angles.append(int(angle))
      
        sumAngle = 0
        for angle in angles:
            sumAngle+=angle
        meanAngle = sumAngle/len(sides)
        
        sumSquares = 0
        
        for i in range(len(sides)):
    
            deviation = angles[i] - meanAngle
            sumSquares += deviation * deviation

        variance = sumSquares/len(sides)
        
        #print ("angles: "),angles , "angleVariance",variance
        return variance
      
    @staticmethod  
    def EvaluateAccess(egdeIDList,currStreetGraph):
        relatedStreetEdgeIDs = currStreetGraph.GetAllParcEdgeAndTwinID()
        access = 0
        for eID in egdeIDList:
            if eID in relatedStreetEdgeIDs:
                access = 1
                break
        
        return access
    

    @staticmethod
    def GetGeometrySideTemporarily_New(SPF,SLG,parcFace,streamline,EDict_All):
        
        # print "parcFace edges"
        # print ([edge.ID for edge in parcFace.edges])
        # print "parcFace Geo"
        # for pt in parcFace.GetGeometry():
        #     print pt.X, pt.Y,0
        
        # print "parcFace sides"
        # print parcFace.sides
        for side in parcFace.sides:
            for edgeID in side:
                ptList = []
                currEdge = EDict_All[edgeID]
                if currEdge.isValid == True:
                    all =  currEdge.GetVPInstance()
                    for instance in all:
                        ptList.append(instance.geometry)
                        
            # for pt in ptList:
            #     print pt.X,pt.Y,0
            # print "-----"    
                
        streamlineInstance = SLG.Streamline()
        streamlineInstance.CreateStreamlineInstance(streamline)
        startEdge,endEdge,startEdgeIndex,endEdgeIndex,startSplitPointPair,endSplitPointPair,flag = SPF.DetectLocation(parcFace,streamlineInstance)     ### include reverse already
        #print "startEdgeIndex" , "endEdgeIndex",startEdgeIndex  ,endEdgeIndex
        # print "streamline"
        # for pt in streamlineInstance.GetGeometry():
        #     print pt.X,pt.Y,0
        ### Get the startSide
        startEdgeID = parcFace.edges[startEdgeIndex].ID
   
        for i in range(len(parcFace.sides)):
            side = parcFace.sides[i]
           
            if startEdgeID in side:
                startSideIndex = i
                break
        
        ### Get the endSide
        endEdgeID = parcFace.edges[endEdgeIndex].ID
    
        for i in range(len(parcFace.sides)):
            side = parcFace.sides[i]
            if endEdgeID in side:
                endSideIndex = i
                break
        
        ### Get startSide Geometry
        startSide = parcFace.sides[startSideIndex]
        
        startPtList = []
        for edgeID in startSide:
            
            currEdge = EDict_All[edgeID]
            if currEdge.isValid == True:
                
                all =  currEdge.GetVPInstance()
                for instance in all:
                    startPtList.append(instance.geometry)
                    
        startSideGeo = rg.Polyline(startPtList)
        
        ### Get endSide Geometry
        endSide = parcFace.sides[endSideIndex]
        
        endPtList = []
        for edgeID in endSide:
            
            
            currEdge = EDict_All[edgeID]
            if currEdge.isValid == True:
                
                all =  currEdge.GetVPInstance()
                for instance in all:
                    endPtList.append(instance.geometry)
                    
        endSideGeo = rg.Polyline(endPtList)
          
        slice_0=[]
        slice_1=[]
        slice_2=[]
                        
        for sideIndex in range(len(parcFace.sides)):
            if sideIndex < startSideIndex:
                slice_0.append(sideIndex)
            
            elif sideIndex > startSideIndex and sideIndex < endSideIndex:
                slice_1.append(sideIndex)
                
            elif sideIndex > endSideIndex:
                slice_2.append(sideIndex)

        
        slice_2.extend(slice_0)
 
        firstHalf = slice_2
        secondHalf = slice_1
               
        #print ("startSideIndex"),startSideIndex ,  "endSideIndex",endSideIndex
        #print ("firstHalf"), firstHalf, "secondHalf",secondHalf
        ### Get startSide IndexPair
        startIndexPair_Side=[]

        all = [pt for pt in startSideGeo]
        for i in range(len(all)-1):
            segment=rg.Line(all[i],all[i+1])
            if segment.DistanceTo(streamlineInstance.startVertex.geometry,True)<0.01:
                startIndexPair_Side=[i,i+1]
       
        ### Get endSide IndexPair
        endIndexPair_Side=[]

        all = [pt for pt in endSideGeo]
        # print "streamlineInstance.endVertex.geometry",streamlineInstance.endVertex.geometry.X,streamlineInstance.endVertex.geometry.Y,0
        # print "pt"
        # for pt in  endSideGeo:
        #     print pt.X,pt.Y,0
        for i in range(len(all)-1):
            segment=rg.Line(all[i],all[i+1])
            if segment.DistanceTo(streamlineInstance.endVertex.geometry,True)<0.01:
                endIndexPair_Side=[i,i+1]

        # print "startIndexPair_Side",startIndexPair_Side
        # print "endIndexPair_Side",endIndexPair_Side
        subSide_Start_0,subSide_Start_1 = EV.SplitSide_Temp(startSideGeo,streamlineInstance.startVertex.geometry,startIndexPair_Side)
        subSide_End_0,subSide_End_1 = EV.SplitSide_Temp(endSideGeo,streamlineInstance.endVertex.geometry,endIndexPair_Side)

        ###################
        ### p1 sides collection
        ###################
        p1_Sides = []
        ### Step 1
        p1_Sides.append(streamlineInstance.GetGeometry())
        ### Step 2
        p1_Sides.append(subSide_End_1)
        ### Step 3
        for sideIndex in firstHalf:
            ptList = []
            side = parcFace.sides[sideIndex]
            for edgeID in side:
                currEdge = EDict_All[edgeID]
                if currEdge.isValid == True:
                    all =  currEdge.GetVPInstance()
                    for instance in all:
                        ptList.append(instance.geometry)
                        
            sideGeo = rg.Polyline(ptList)
            p1_Sides.append(sideGeo)
        ### Step 4
        p1_Sides.append(subSide_Start_0)

        ###################
        ### p2 sides collection
        ###################   
        p2_Sides = []

        ### Step 1
        p2_Sides.append(subSide_Start_1)
        ### Step 2
        for sideIndex in secondHalf:
            ptList = []
            side = parcFace.sides[sideIndex]
            for edgeID in side:
                currEdge = EDict_All[edgeID]
                if currEdge.isValid == True:
                    all =  currEdge.GetVPInstance()
                    for instance in all:
                        ptList.append(instance.geometry)
            sideGeo = rg.Polyline(ptList)
            p2_Sides.append(sideGeo)
        ### Step 3
        p2_Sides.append(subSide_End_0)
        
        ### Step 4
        streamlineReverse = rg.Polyline(streamlineInstance.GetGeometry())
        streamlineReverse.Reverse()
        p2_Sides.append(streamlineReverse)
        
        
        ### Collection of side Edge
        p1_relatedEdgeIDs = []
        p2_relatedEdgeIDs = []
        slice_0_EdgeIDs = []
        slice_1_EdgeIDs = []
        slice_2_EdgeIDs = []
        
        for sideIndex in range(len(parcFace.sides)):
            
            if sideIndex < startSideIndex:
                slice_0_EdgeIDs.extend(parcFace.sides[sideIndex])
            
            elif sideIndex > startSideIndex and sideIndex < endSideIndex:
                slice_1_EdgeIDs.extend(parcFace.sides[sideIndex])
                
            elif sideIndex > endSideIndex:
                slice_2_EdgeIDs.extend(parcFace.sides[sideIndex])

        
        slice_2_EdgeIDs.extend(slice_0_EdgeIDs)
 
        p1_relatedEdgeIDs = slice_2_EdgeIDs
        p2_relatedEdgeIDs = slice_1_EdgeIDs
        
        p1_relatedEdgeIDs.extend([startEdgeID,endEdgeID])
        p2_relatedEdgeIDs.extend([startEdgeID,endEdgeID])
        
        
   
        
        return p1_Sides,p2_Sides,p1_relatedEdgeIDs,p2_relatedEdgeIDs
        
    @staticmethod
    def GetGeometrySideTemporarily(SPF,SLG,parcFace,streamline,EDict_All):
        #print ("GetGeometrySideTemporarily"),parcFace.ID
        # print ("original streamline")
        # for pt in streamline:
        #     print (pt.X),pt.Y,0
        
        streamlineInstance = SLG.Streamline()
        streamlineInstance.CreateStreamlineInstance(streamline)
        
        # print ("instance streamline")
        # for pt in streamlineInstance.GetGeometry():
        #     print (pt.X),pt.Y,0
        
       
        startEdge,endEdge,startEdgeIndex,endEdgeIndex,startSplitPointPair,endSplitPointPair,flag = SPF.DetectLocation(parcFace,streamlineInstance)     ### include reverse already
        slice_0=[]
        slice_1=[]
        slice_2=[]
        # print ("after detection streamline")
        # for pt in streamlineInstance.GetGeometry():
        #     print (pt.X),pt.Y,0
        # print ("---------------")
         
        for edgeIndex in range(len(parcFace.edges)):
            if edgeIndex < startEdgeIndex:
                slice_0.append(edgeIndex)
            
            elif edgeIndex > startEdgeIndex and edgeIndex < endEdgeIndex:
                slice_1.append(edgeIndex)
                
            elif edgeIndex > endEdgeIndex:
                slice_2.append(edgeIndex)
                
        
        
        slice_2.extend(slice_0)
        firstHalf = slice_2
        secondHalf = slice_1
        
        ### Check the ancestor ID in firstHalf
        firstHalfAncestorID = []
        for edgeIndex in firstHalf:
            thisEdge = parcFace.edges[edgeIndex]
            ancestorID = thisEdge.FindAncestorEdgeID(EDict_All)
            firstHalfAncestorID.append(ancestorID)
            
        secondHalfAncestorID = []
        for edgeIndex in secondHalf:
            thisEdge = parcFace.edges[edgeIndex]
            ancestorID = thisEdge.FindAncestorEdgeID(EDict_All)
            secondHalfAncestorID.append(ancestorID)
        
        #print "firstHalfAncestorID" ,firstHalfAncestorID
        #print "secondHalfAncestorID" ,secondHalfAncestorID
           
        ### split edge temporary 
        if startEdge.naked ==True:
            splitResult = EV.SplitEdge_Naked_Normal_Temp(startEdge,streamlineInstance.startVertex.geometry)   
            subEdge_Start_0 = splitResult[0]
            subEdge_Start_1 = splitResult[1]
            splitEdges_Start = [subEdge_Start_0,subEdge_Start_1]
            
        elif startEdge.naked == False:
            splitResult = EV.SplitEdge_Shared_Normal_Temp(startEdge,streamlineInstance.startVertex.geometry,startSplitPointPair)
            subEdge_Start_a = splitResult[0]
            subEdge_Start_b = splitResult[1]
            splitEdges_Start = [subEdge_Start_a,subEdge_Start_b]
            
        if endEdge.naked ==True:
            splitResult = EV.SplitEdge_Naked_Normal_Temp(endEdge,streamlineInstance.endVertex.geometry)
            subEdge_End_0 = splitResult[0]
            subEdge_End_1 = splitResult[1]
            splitEdges_End = [subEdge_End_0,subEdge_End_1]
        elif endEdge.naked == False:
            splitResult = EV.SplitEdge_Shared_Normal_Temp(endEdge,streamlineInstance.endVertex.geometry,endSplitPointPair)
            subEdge_End_a = splitResult[0]
            subEdge_End_b = splitResult[1]

            splitEdges_End = [subEdge_End_a,subEdge_End_b]
        
        ###################
        ### p1 sides collection
        ###################
        #print "GetGeometrySideTemporarily p1"
        p1_Sides = []
        ### Step 1
        p1_Sides.append(streamlineInstance.GetGeometry())
        # print "GetGeometrySideTemporarily,p1_Sides.append(streamlineInstance.GetGeometry())"
        # for pt in streamlineInstance.GetGeometry():
        #     print pt.X,pt.Y,0
        
        
        ### Step 2
        if endEdge.naked ==True:
            p1_Sides.append(subEdge_End_1)
        else:
            p1_Sides.append(subEdge_End_b)
        
        # print "GetGeometrySideTemporarily,endEdge"
        # for pt in p1_Sides[-1]:
        #     print pt.X,pt.Y,0
        
        ### Step 3
        ### cluster the firstHalf
        clusters_FirstHalf = []  
        sides_FirstHalf = []
        for i in range(len(firstHalfAncestorID)):
            element = firstHalfAncestorID[i]
            parcEdge = parcFace.edges[firstHalf[i]]  ### in pF
            if not any(element in cluster for cluster in clusters_FirstHalf):
                # if element is not in exsiting list 
                clusters_FirstHalf.append([element])
                sides_FirstHalf.append([parcEdge.GetGeometry()])
                #print "cluster the firstHalf",element
                # for pt in parcEdge.GetGeometry():
                #     print pt.X,pt.Y,0
            else:
                # if element is in exsiting list
                for i in range(len(clusters_FirstHalf)):
                    currCluster = clusters_FirstHalf[i]
                    currSide = sides_FirstHalf[i]
                    if element in currCluster:
                        currCluster.append(element)
                        currSide.append(parcEdge.GetGeometry())
                        #print "cluster the firstHalf" , element
                        # for pt in parcEdge.GetGeometry():
                        #     print pt.X,pt.Y,0
                        break        
        
        #print "sides_FirstHalf",sides_FirstHalf
        ### join the geometry Marked as same side
        for sideList in sides_FirstHalf:
            if len(sideList) ==1:
                p1_Sides.append(sideList[0])
                # print "GetGeometrySideTemporarily,Join"
                # for pt in p1_Sides[-1]:
                #     print pt.X,pt.Y,0
                
            else:
                # print "p1 mutiple"
                newPtList = []
                for polyL in sideList:
                    for i in range(len(polyL)-1):
                        newPtList.append(polyL[i])
                
                # print sideList[-1]
                # print len(sideList[-1])
                
                # for pt in sideList[-1]:
                #     print pt.X, pt.Y,0
                newPtList.append(sideList[-1].Last) ### add the last one
                newSide = rg.Polyline(newPtList)
                p1_Sides.append(newSide)
                # print "GetGeometrySideTemporarily,Join"
                # for pt in p1_Sides[-1]:
                #     print pt.X,pt.Y,0
        
        ### Step 4
        if startEdge.naked ==True:
            p1_Sides.append(subEdge_Start_0)
        else:
            p1_Sides.append(subEdge_Start_a)

        # print "GetGeometrySideTemporarily,startEdge"
        # for pt in p1_Sides[-1]:
        #     print pt.X,pt.Y,0
                    
        ###################
        ### p2 sides collection
        ###################    
        #print ("GetGeometrySideTemporarily,p2_Sides")
       
        p2_Sides = []
        ### Step 1
        if startEdge.naked ==True:
            p2_Sides.append(subEdge_Start_1)
        else:
            p2_Sides.append(subEdge_Start_b)
        
        # print ("--------------------")
        # print ("GetGeometrySideTemporarily,startEdge")
        
        # for pt in p2_Sides[-1]:
        #     print (pt.X),pt.Y,0
        # print ("startSplitPointPair"),startSplitPointPair
        # print ("startEdge")
        # sEdge =startEdge.GetGeometry()
        # for pt in sEdge:
        #     print (pt.X), pt.Y,0
        ### Step 2
        ### cluster the secondHalf
        clusters_SecondHalf = []  
        sides_SecondHalf = []
        for i in range(len(secondHalfAncestorID)):
            element = secondHalfAncestorID[i]
            parcEdge = parcFace.edges[secondHalf[i]]  ### in pF
            if not any(element in cluster for cluster in clusters_SecondHalf):
                # if element is not in exsiting list 
                clusters_SecondHalf.append([element])
                sides_SecondHalf.append([parcEdge.GetGeometry()])
            else:
                # if element is in exsiting list
                for i in range(len(clusters_SecondHalf)):
                    currCluster = clusters_SecondHalf[i]
                    currSide = sides_SecondHalf[i]
                    if element in currCluster:
                        currCluster.append(element)
                        currSide.append(parcEdge.GetGeometry())
                        break        
        
        ### join the geometry Marked as same side
        for sideList in sides_SecondHalf:
            if len(sideList) ==1:
                p2_Sides.append(sideList[0])

                # print "GetGeometrySideTemporarily,join"
                # for pt in p2_Sides[-1]:
                #     print pt.X,pt.Y,0
            else:
                # print "p2 mutiple"
                newPtList = []
                for polyL in sideList:
                    for i in range(len(polyL)-1):
                        newPtList.append(polyL[i])
                
                # print sideList[-1]
                # print len(sideList[-1])
                
                # for pt in sideList[-1]:
                #     print pt.X, pt.Y,0
                    
                newPtList.append(sideList[-1].Last) ### add the last one
                newSide = rg.Polyline(newPtList)
                p2_Sides.append(newSide)

                # print "GetGeometrySideTemporarily,join"
                # for pt in p2_Sides[-1]:
                #     print pt.X,pt.Y,0
                    
        #print "sides_SecondHalf",sides_SecondHalf
        ### Step 3
        if endEdge.naked ==True:
            p2_Sides.append(subEdge_End_0)
        else:
            p2_Sides.append(subEdge_End_a)
        
        # print "GetGeometrySideTemporarily,endEdge"
        # for pt in p2_Sides[-1]:
        #     print pt.X,pt.Y,0    
        ### Step 4
        streamlineReverse = rg.Polyline(streamlineInstance.GetGeometry())
        streamlineReverse.Reverse()
        p2_Sides.append(streamlineReverse)

        # print "GetGeometrySideTemporarily,streamline"
        # for pt in p2_Sides[-1]:
        #     print pt.X,pt.Y,0  
            
        return p1_Sides,p2_Sides
    
    @staticmethod
    def SimplifyVertices(polyL):
    
        newPtList = []
        segments = polyL.GetSegments()
        
        newPtList.append(polyL.First)
        for i in range(len(segments)-1):
            currSeg = segments[i]
            nextSeg = segments[i+1]
        
            vecA = rg.Vector3d(currSeg.To - currSeg.From)
            vecB = rg.Vector3d(nextSeg.To - nextSeg.From)
            
            if rg.Vector3d.VectorAngle(vecA,vecB) > 0.001:
                newPtList.append(nextSeg.From)
                
        newPtList.append(polyL.Last)
        simplifiedPolyL = rg.Polyline(newPtList)

        return simplifiedPolyL
    
    @staticmethod 
    def EvaluateGeometrySideRelated(SPF,SLG,parcFace,streamline,EDict_All,currStreetGraph):
        p1_Sides,p2_Sides,p1_relatedEdgeIDs,p2_relatedEdgeIDs =  EV.GetGeometrySideTemporarily_New(SPF,SLG,parcFace,streamline,EDict_All)  
        
        # print ("p1_relatedEdgeIDs"),p1_relatedEdgeIDs
        # print ("p2_relatedEdgeIDs"),p2_relatedEdgeIDs
        
        # currStreetGraphIDs = currStreetGraph.GetAllParcEdgeAndTwinID()
        # currStreetGraphIDs_Clean = []
        # for sID in currStreetGraphIDs:
        #     if sID != None:
        #         currStreetGraphIDs_Clean.append(sID)
        # print ("currStreetGraph.") ,currStreetGraphIDs_Clean 
        p1_accessScore = EV.EvaluateAccess(p1_relatedEdgeIDs,currStreetGraph)
        p2_accessScore = EV.EvaluateAccess(p2_relatedEdgeIDs,currStreetGraph)
        
        # print ("p1_accessScore"),p1_accessScore,("p2_accessScore"),p2_accessScore
        # print ("------")
        accessAve= (p1_accessScore + p2_accessScore)/2
        # print ("streamline")
        # for pt in streamline:
        #     print (pt.X),pt.Y,0
           
        
        #print "EvaluateGeometrySideRelated, len(p1_Sides) , len(p2_Sides)", len(p1_Sides) , len(p2_Sides)
        ###Get P1 Geometry
        # pt1List = []
        # for side in p1_Sides:
        #     for i in range(len(side)-1) :
        #         pt1List.append(side[i])
                
        # pt1List.append(p1_Sides[-1].Last)        
        
        # for pt in pt1List:
        #     print (pt.X),pt.Y,0
        # print "-----"
        # ###Get P2 Geometry
        # pt2List = []
        # for side in p2_Sides:
        #     for i in range(len(side)-1) :
        #         pt2List.append(side[i])
                
        # pt2List.append(p2_Sides[-1].Last)        
        
        # for pt in pt2List:
        #     print (pt.X),pt.Y,0
        
        
        # print "p1_Sides",len(p1_Sides)
        # for side in p1_Sides:
        #     for pt in side:
        #         print pt.X,pt.Y,0
        #     print "----"
        # print "*****************"
        
        # print "p2_Sides",len(p2_Sides)
        # for side in p2_Sides:
        #     for pt in side:
        #         print pt.X,pt.Y,0
        #     print "----"
        # print "*****************"
                
        ### clean zero length side
                
        p1_Sides_Clean = []
        for side in p1_Sides:
            if side.Length < 0.001:
                print ("p1 Length < 0.001")
                pass
            else:
                side = EV.SimplifyVertices(side)
                p1_Sides_Clean.append(side)
            
            
        
        p2_Sides_Clean = []
        for side in p2_Sides:
            if side.Length < 0.001:
                print ("p2 Length < 0.001")
                pass
            else:
                side = EV.SimplifyVertices(side)
                p2_Sides_Clean.append(side)
        
        
        # print "p1_Sides_clean",len(p1_Sides_Clean)
        # for side in p1_Sides_Clean:
        #     for pt in side:
        #         print pt.X,pt.Y,0
        #     print "----"
        # print "*****************"
        
        # print "p2_Sides_clean",len(p2_Sides_Clean)
        # for side in p2_Sides_Clean:
        #     for pt in side:
        #         print pt.X,pt.Y,0
        #     print "----"
        # print "*****************"
                         
        p1_Num = EV.EvaluateSideNum(p1_Sides_Clean)
        p2_Num = EV.EvaluateSideNum(p2_Sides_Clean)
        numDifference = abs((p1_Num - p2_Num))
        
        continuity = EV.EvaluateContinuity(streamline)
        
        
        p1_AngleVar = EV.EvaluateAngleVariance(p1_Sides_Clean)
        p2_AngleVar = EV.EvaluateAngleVariance(p2_Sides_Clean)
        angleVarAve = (p1_AngleVar + p2_AngleVar)/2

        #print "p1_AngleVar,p2_AngleVar" , p1_AngleVar,p2_AngleVar,"angleVarAve",angleVarAve
        
        p1_LengthVar = EV.EvaluateSideLengthVariance(p1_Sides_Clean)
        p2_LengthVar = EV.EvaluateSideLengthVariance(p2_Sides_Clean)
        lengthVarAve = (p1_LengthVar + p2_LengthVar )/2

        # print ("p1 length"), [side.Length for side in p1_Sides_Clean]
        # print ("p2 length"), [side.Length for side in p2_Sides_Clean]
        #print ("lengthVarAve"),lengthVarAve
        return numDifference,continuity, angleVarAve, lengthVarAve,accessAve
        
    
    ### Help to split the side temporarily    

    @staticmethod    
    def SplitSide_Temp(side,newV,indexPair_Side):
        all = [pt for pt in side]
        #print "len(all)", len(all)
        
        
        ### side 1
        newSide_1 = rg.Polyline()
        newSide_1.Add(side.First)
        for i in range(len(all)):
            #print i,indexPair_Side
            if i!=0 and i !=len(all)-1 and i <= indexPair_Side[0]:
                newSide_1.Add(all[i])
        newSide_1.Add(newV)
        
        ### side 2
        newSide_2 = rg.Polyline()
        newSide_2.Add(newV)
        for i in range(len(all)):
            if i!=0 and i !=len(all)-1 and i >= indexPair_Side[1]:
                newSide_2.Add(all[i])
        newSide_2.Add(side.Last)
            
        return newSide_1,newSide_2
    
    ### Help to split the edge temporarily    
    @staticmethod    
    def SplitEdge_Naked_Normal_Temp(parcEdge,newV):
        ### side 1
        newSide_1 = rg.Polyline()
        newSide_1.Add(parcEdge.startVertex.geometry)
        newSide_1.Add(newV)
        
        ### side 2
        newSide_2 = rg.Polyline()
        newSide_2.Add(newV)
        newSide_2.Add(parcEdge.endVertex.geometry)

        return newSide_1,newSide_2
    
    @staticmethod    
    def SplitEdge_Shared_Normal_Temp(parcEdge,newV,indexPair):
        all = parcEdge.GetVPInstance()
        
        # print ("in SplitEdge_Shared_Normal_Temp")
        # print ("newV"), newV.X,newV.Y,0
        # print ("indexPair") , indexPair
        # print ("original Edge is") 
        # edgeGeo = parcEdge.GetGeometry()
        # for pt in edgeGeo:
        #     print (pt.X), pt.Y,0
        
        
        ### side 1
        newSide_1 = rg.Polyline()
        newSide_1.Add(parcEdge.startVertex.geometry)
        for i in range(len(all)):
            if i!=0 and i !=len(all)-1 and i <= indexPair[0]:
                newSide_1.Add(all[i].geometry)
        newSide_1.Add(newV)
        
        ### side 2
        newSide_2 = rg.Polyline()
        newSide_2.Add(newV)
        for i in range(len(all)):
            if i!=0 and i !=len(all)-1 and i >= indexPair[1]:
                newSide_2.Add(all[i].geometry)
        newSide_2.Add(parcEdge.endVertex.geometry)
        
        # print ("new Side 1 is")
        # for pt in newSide_1:
        #     print (pt.X), pt.Y,0
        # print ("new Side 2 is")
        # for pt in newSide_2:
        #     print (pt.X), pt.Y,0 
                        
        return newSide_1,newSide_2
       
    ######################################################
    ##########          OverAll Score      ##############
    ######################################################
    @staticmethod
    def GetOverallScore(a,b,c,d,e,f,g,h,weight):
        
        overallScore=[]
        for i in range(len(a)):
            overallScore.append(a[i]*weight[0]+b[i]*weight[1]+c[i]*weight[2]+d[i]*weight[3]+e[i]*weight[4]+f[i]*weight[5]+g[i]*weight[6]+h[i]*weight[7])
            
        return overallScore
    
    @staticmethod
    def GetOverallScore_New_Old(a,b,c,d,e,f,g,h,weight):
        overallScore=[]
        
        
        for i in range(len(a)):
            overallScore.append(a[i]*weight[0]+b[i]*weight[1]+c[i]*weight[2]+d[i]*weight[3]+e[i]*weight[4]+f[i]*weight[5]+g[i]*weight[6]+h[i]*weight[7])
            
        return overallScore

    @staticmethod
    def GetOverallScore_New(a,b,c,d,e,f,g,weight):
        overallScore=[]
        
        
        for i in range(len(a)):
            overallScore.append(a[i]*weight[0]+b[i]*weight[1]+c[i]*weight[2]+d[i]*weight[3]+e[i]*weight[4]+f[i]*weight[5]+g[i]*weight[6])
            
        return overallScore
    
    @staticmethod
    def GetScore_Part1(a,b,c,weight):
        
        score_Part1=[]
        for i in range(len(a)):
            score_Part1.append(a[i]*weight[0]+b[i]*weight[1]+c[i]*weight[2])
            
        return score_Part1
    
    @staticmethod
    def GetScore_Part2(d,e,f,g,h,weight):
        
        score_Part2=[]
        for i in range(len(d)):
            score_Part2.append(d[i]*weight[3]+e[i]*weight[4]+f[i]*weight[5]+g[i]*weight[6]+h[i]*weight[7])
            
        return score_Part2
    
    @staticmethod
    def GetScore_ParcelLevel(d,e,f,g,h,weight):
        
        score_Part2=[]
        for i in range(len(d)):
            score_Part2.append(d[i]*weight[0]+e[i]*weight[1]+f[i]*weight[2]+g[i]*weight[3]+h[i]*weight[4])
            
        return score_Part2
      
    ######################################################
    ##########         GEO_HelpFunc         ##############
    ######################################################
    @staticmethod
    def SplitPolygon(streamline,boundary):
        
        if type(streamline) == type(rg.Polyline()):
            streamline = streamline.ToPolylineCurve()
        if type(boundary) == type(rg.Polyline()):
            boundary = boundary.ToPolylineCurve()
            
        streamline = streamline.Extend(rg.CurveEnd.Both,0.01,rg.CurveExtensionStyle.Line)
        tempCollection=[]
        tempCollection=[boundary,streamline]

        
        wxy_plane=rg.Plane.WorldXY
        #tol=rd.ActiveDoc.ModelAbsoluteTolerance
        tol = 0.001
        
        
        result=rg.Curve.CreateBooleanRegions(tempCollection,wxy_plane,False,tol)
        
        
        if result.PlanarCurveCount != 2:
            print ("SplitPolygon fails")
            print ("FAIL boundary:")
            boundary = boundary.TryGetPolyline()[1]
            for pt in boundary:
                print (pt.X), "," , (pt.Y), "," , (pt.Z)
                
            print ("FAIL streamline:")
            ts = streamline.DivideByLength(0.2,True)

            for t in ts:
                divpt = streamline.PointAt(t)
                print (divpt.X), "," , (divpt.Y), "," , (divpt.Z)
            return None
        
        try:    
            a=rg.CurveBooleanRegions.RegionCurves(result,0)[0]
            b=rg.CurveBooleanRegions.RegionCurves(result,1)[0]
        except:
            print ("fail to split")
            print ("FAIL boundary:")
            boundary = boundary.TryGetPolyline()[1]
            for pt in boundary:
                print (pt.X), "," , (pt.Y), "," , (pt.Z)
                
            print ("FAIL streamline:")
            streamline = streamline.TryGetPolyline()[1]
            for pt in streamline:
                print (pt.X), "," , (pt.Y), "," , (pt.Z)
            return None
        else:
            pass
        
        return[a,b]

    @staticmethod
    def MakeCounterClockwiseDirection(inputPolyline):
        inputPolyline_copy = rg.Polyline(inputPolyline)
        inputPolylineCurve = inputPolyline_copy.ToPolylineCurve()
        if inputPolylineCurve.ClosedCurveOrientation().ToString() == "Clockwise":
            inputPolyline_copy.Reverse()
    
        else:
            pass
        
        return inputPolyline_copy

    ### OBB 
    @staticmethod
    def CheckObjCoPlanarity(obj,tol=0.001):

        pt_list=[]
        
        rc,plane=obj.TryGetPlane(tol)
        if not rc: return
        nc = obj.ToNurbsCurve()
        if nc is None: return
        crv_pts=[nc.Points[i].Location for i in xrange(nc.Points.Count)]
        pt_list.extend(crv_pts)
            
        if rg.Point3d.ArePointsCoplanar(pt_list,tol):
            rc, plane = rg.Plane.FitPlaneToPoints(pt_list)
            if rc==rg.PlaneFitResult.Success: return plane
    
    @staticmethod
    def Objectbbox(geom,xform):
        if isinstance(geom,rg.Point):
            pt=geom.Location
            if xform: pt = xform * pt
            return rg.BoundingBox(pt,pt)
        if xform: return geom.GetBoundingBox(xform)
        return geom.GetBoundingBox(True)
    
    #gets a plane-aligned bounding box
    @staticmethod
    def BoundingBoxPlane(objs,plane,ret_pts=False,accurate=True):

        wxy_plane=rg.Plane.WorldXY

        
        xform = rg.Transform.ChangeBasis(wxy_plane, plane)
        bbox = rg.BoundingBox.Empty
        if type(objs) is list or type(objs) is tuple:
            for obj in objs:
                objectbbox = EV.Objectbbox(obj, xform)
                bbox = rg.BoundingBox.Union(bbox,objectbbox)
        else:
            objectbbox = EV.Objectbbox(objs, xform)
            bbox = rg.BoundingBox.Union(bbox,objectbbox)
            
        if not bbox.IsValid: return
        plane_to_world = rg.Transform.ChangeBasis(plane,wxy_plane)
        if ret_pts:
            corners = list(bbox.GetCorners())
            for pt in corners: pt.Transform(plane_to_world)
            return corners
        else:
            box=rg.Box(bbox)
            box.Transform(plane_to_world)
            return box
    
    #this is the main 2D bb calculation search function
    @staticmethod
    def PlanarMinBB(objs,plane,tot_ang,divs):
        inc=tot_ang/divs
        #rotate plane half total angle minus direction
        plane.Rotate(-tot_ang*0.5,plane.ZAxis,plane.Origin)
        bb = EV.BoundingBoxPlane(objs,plane)
        curr_plane=rg.Plane(plane)
        curr_area=EV.BoxArea(bb)
        #loop through angle increments
        for i in range(divs):
            plane.Rotate(inc,plane.ZAxis,plane.Origin)
            bb = EV.BoundingBoxPlane(objs,plane)
            new_area=EV.BoxArea(bb)
            if new_area<curr_area:

                curr_area=new_area
                curr_plane=rg.Plane(plane)
        return curr_plane, curr_area
    
    #2D planar bounding rectangle routine
    @staticmethod
    def MinBoundingRectanglePlane(obj,curr_plane,im_rep=False):
        #pass True argument above if you want to print intermediate results
        #initialize
        factor=0.01 #0.01 (1/100 of model abs tolerance)
        angle=math.pi*0.5 #start angle 90 degrees
        divs=90  #initial division 1 degree intervals
        #tol = rd.ActiveDoc.ModelAbsoluteTolerance
        tol = 0.001
        #get initial rough bounding box
        init_bb=EV.BoundingBoxPlane(obj,curr_plane,ret_pts=False)
        curr_area=EV.BoxArea(init_bb)

        #main calculation loop
        safe=10 #set safety limit at 10
        for i in range(safe):
            curr_plane,new_area = EV.PlanarMinBB(obj,curr_plane,angle,divs)
            #abort if area is 0 or extremely small
            #if new_area<tol*0.1:
                #print err_msg ; return
            #break out of loop if new area is the same as prev. area within limit
            if abs(curr_area-new_area)<factor*tol: break
            #otherwise, decrease increments and loop
            curr_area=new_area
            angle*=(1/divs)
            
            
        f_bb=EV.BoundingBoxPlane(obj,curr_plane,ret_pts=True)
        return f_bb,curr_area,i
    
    #used for planar bounding rectangle calculation
    @staticmethod
    def BoxArea(box):
        return (box.X[1]-box.X[0])*(box.Y[1]-box.Y[0])
    
    @staticmethod
    def GetOBB(G,N):
        
        obj = G
        plane=EV.CheckObjCoPlanarity(obj,tol=0.001)
        #launch planar bounding box routine
        f_bb,curr_area,passes=EV.MinBoundingRectanglePlane(obj,plane,False)
        #add polyline, report message
        bb=rg.Polyline([f_bb[0],f_bb[1],f_bb[2],f_bb[3],f_bb[0]])

        return bb
    
    
    
    
    ### Convex Hull
    @staticmethod
    def get_bottom_point(points):
        min_index = 0
        n = len(points)
        for i in range(0, n):
            if points[i][1] < points[min_index][1] or (points[i][1] == points[min_index][1] and points[i][0] < points[min_index][0]):
                min_index = i
        
        return min_index

    @staticmethod
    def sort_polar_angle_cos(points, center_point):

        n = len(points)
        cos_value = []
        rank = []
        norm_list = []
        for i in range(0, n):
            point_ = points[i]
            point = [point_[0]-center_point[0], point_[1]-center_point[1]]
            rank.append(i)
            norm_value = math.sqrt(point[0]*point[0] + point[1]*point[1])
            norm_list.append(norm_value)
            if norm_value == 0:
                cos_value.append(1)
            else:
                cos_value.append(point[0] / norm_value)
    
        for i in range(0, n-1):
            index = i + 1
            while index > 0:
                if cos_value[index] > cos_value[index-1] or (cos_value[index] == cos_value[index-1] and norm_list[index] > norm_list[index-1]):
                    temp = cos_value[index]
                    temp_rank = rank[index]
                    temp_norm = norm_list[index]
                    cos_value[index] = cos_value[index-1]
                    rank[index] = rank[index-1]
                    norm_list[index] = norm_list[index-1]
                    cos_value[index-1] = temp
                    rank[index-1] = temp_rank
                    norm_list[index-1] = temp_norm
                    index = index-1
                else:
                    break
        sorted_points = []
        for i in rank:
            sorted_points.append(points[i])
    
        return sorted_points

    @staticmethod
    def vector_angle(vector):
        norm_ = math.sqrt(vector[0]*vector[0] + vector[1]*vector[1])
        if norm_ == 0:
            return 0
    
        angle = math.acos(vector[0]/norm_)
        if vector[1] >= 0:
            return angle
        else:
            return 2*math.pi - angle
    
    @staticmethod
    def coss_multi(v1, v2):
        return v1[0]*v2[1] - v1[1]*v2[0]
    
    @staticmethod
    def graham_scan(points):
        bottom_index = get_bottom_point(points)
        
        bottom_point = points.pop(bottom_index)
        sorted_points = sort_polar_angle_cos(points, bottom_point)
    
        m = len(sorted_points)
        if m < 2:
            print("no enough points to form a hull")
            return None
    
        stack = []
        stack.append(bottom_point)
        stack.append(sorted_points[0])
        stack.append(sorted_points[1])
    
        for i in range(2, m):
            length = len(stack)
            top = stack[length-1]
            next_top = stack[length-2]
            v1 = [sorted_points[i][0]-next_top[0], sorted_points[i][1]-next_top[1]]
            v2 = [top[0]-next_top[0], top[1]-next_top[1]]
    
            while coss_multi(v1, v2) >= 0:
                stack.pop()
                length = len(stack)
                top = stack[length-1]
                next_top = stack[length-2]
                v1 = [sorted_points[i][0] - next_top[0], sorted_points[i][1] - next_top[1]]
                v2 = [top[0] - next_top[0], top[1] - next_top[1]]
    
            stack.append(sorted_points[i])
    
            
        return stack

    @staticmethod
    def ConvertPoint3dTo2DNumList(ptList):
        ptList_2D = []
        for pt in ptList:
            ptList_2D.append([])
        
        for i in range(len(ptList)):
            ptList_2D[i]= [ptList[i].X,ptList[i].Y]
            
        return ptList_2D

    @staticmethod
    def Convert2DNumListToPoint3d(PtList_2D):
        ptList_3D = []
        for pt in PtList_2D:
            ptList_3D.append(rg.Point3d(pt[0],pt[1],0))
        
        return ptList_3D
        
    @staticmethod    
    def GetConvexHull(ptList):
        
        ptList_2D = ConvertPoint3dTo2DNumList(ptList)
        result = graham_scan(ptList_2D)
        if result!=None:
            ptList_3D = Convert2DNumListToPoint3d(result)
            ptList_3D.append(ptList_3D[0])
            convexHull = rg.Polyline(ptList_3D)
        else:
            convexHull = None
        return convexHull
        

    
     
    
    
    
    
    
    ######################################################
    ################ Sort info to Instance ###############
    ######################################################
    @staticmethod
    def RemapRange(numlist,tartgetdomainstart,tartgetdomainend):

        tartgetdomain=ghc.ConstructDomain(tartgetdomainstart,tartgetdomainend)
    
        maxnum=max(numlist)
    
        minnum=min(numlist)
        
        sourcerdomain=ghc.ConstructDomain(minnum,maxnum)
        
        newrange=ghc.RemapNumbers(numlist,sourcerdomain,tartgetdomain)[0]
        
        return newrange
    

    @staticmethod
    def GetAllScoreToInstance_New(SPF,SLG,parcFace,EDict_All,currStreetGraph,sameSideList,streamlineNetwork,streamlines,weight,idealOrientation):  
        
        #print ("In GetAllScoreToInstance_New")
        print ("parcFace.ID"),parcFace.ID, ("Get streamlines"),len(streamlines)
        # for pt in parcFace.GetGeometry():
        #     print pt.X,pt.Y,0
        ###################
        #### for diagram 
        ###################
        
        
        #SLG.PrintStreamlines(streamlines)
        
        ###################
        #### update info
        ###################
        parcFace.GetSide(EDict_All)
        parcFace.CombineSide(EDict_All,sameSideList)

        ###################
        #### Intinal Score
        ###################
        #Related with side num
        result_A = EV.Score_GeometrySide(SPF,SLG,parcFace,streamlines,EDict_All,currStreetGraph)
        
        
        score_Continuity = result_A[0]
        score_SideNum = result_A[1]
        score_AngleVar = result_A[2]
        score_LengthVar = result_A[3]
        score_Access = result_A[4]
        
         
        
        score_EvenArea,areaPairCollection = EV.Score_ParcelLevel_EvenArea(streamlines,parcFace.processMesh.triRemeshBoundary)
        score_Orientation,orientationPairCollection = EV.Score_ParcelLevel_Orientation(streamlines,parcFace.processMesh.triRemeshBoundary,idealOrientation)
        #debug1 = [num for num in score_AngleVar]
        #print ("before remap"), len(score_SideNum) , len(score_AngleVar) , len(score_LengthVar)  
        
        #Other  
        
        
       
        
        #score_EvenArea = EV.Score_ParcelLevel_EvenArea(streamlines,parcFace.processMesh.triRemeshBoundary)
        # score_Elongation=[0 for sl in streamlines]
        # score_Compactness=[0 for sl in streamlines]
        # score_Convexity=[0 for sl in streamlines]
        # score_Orientation=[0 for sl in streamlines]
        
        # elongationPairCollection=[0 for sl in streamlines]
        # areaPairCollection=[0 for sl in streamlines]
        # convexityPairCollection = [0 for sl in streamlines]
        # compactnessPairCollection = [0 for sl in streamlines]
        # orientationPairCollection = [0 for sl in streamlines]
        
     
        # result_B = EV.Score_ParcelLevel(streamlines,parcFace.processMesh.triRemeshBoundary,1.5,1,1,idealOrientation)
        # score_EvenArea=result_B[0]
        # score_Elongation=result_B[1]
        # score_Compactness=result_B[2]
        # score_Convexity=result_B[3]
        # score_Orientation=result_B[4]
        
        # elongationPairCollection=result_B[5]
        # areaPairCollection=result_B[6]
        # convexityPairCollection = result_B[7]
        # compactnessPairCollection = result_B[8]
        # orientationPairCollection = result_B[9]
        
        ###################
        #### Remap
        ###################
        
        # print "before remap"
        # print "score_Continuity",score_Continuity
        # print "score_AngleVar",score_AngleVar, 
        # print "score_AngleVar Index ", score_AngleVar.index(min(score_AngleVar))
        
        # print "score_LengthVar",score_LengthVar, 
        # print "score_LengthVar Index ", score_LengthVar.index(min(score_LengthVar))
        
        
        score_Continuity = EV.RemapRange(score_Continuity,1,0)
        score_SideNum = EV.RemapRange(score_SideNum,1,0)  
        score_AngleVar = EV.RemapRange(score_AngleVar,1,0) 
        score_LengthVar = EV.RemapRange(score_LengthVar,1,0)
        score_Access= EV.RemapRange(score_Access,0,1)
        #print "after  remap"
        #print "score_Continuity",score_Continuity
        #print "score_AngleVar",score_AngleVar
        #print "score_AngleVar Index ", score_AngleVar.index(max(score_AngleVar))
        #print "score_LengthVar",score_LengthVar 
        #print "score_LengthVar Index ", score_LengthVar.index(max(score_LengthVar))
        
        #print ("after remap"), len(score_SideNum) , len(score_AngleVar) , len(score_LengthVar)  
        
        score_EvenArea = EV.RemapRange(score_EvenArea,1,0)        # the smaller difference to 1， meaning its more even
        # score_Elongation = EV.RemapRange(score_Elongation,1,0)    # the smaller difference to idealElongation， its better
        # score_Compactness = EV.RemapRange(score_Compactness,1,0)    # the smaller difference to idealCompactness， its better
        # score_Convexity = EV.RemapRange(score_Convexity,1,0)        # the smaller difference to idealConvexity， its better
        score_Orientation = EV.RemapRange(score_Orientation,1,0)     # the smaller difference, its better 
        
        #debug2 = [num for num in score_AngleVar]
        
        # if len(debug1)!=len(debug2):
        #     for i in range(len(debug1)):
        #         print (debug1[i]),debug2[i]
        ###################
        #### Overall
        ###################
        # for sl in streamlines:
        #     for pt in sl:
        #         print pt.X,pt.Y,0
        #     print "-----"
        
        #score_OverallScore = EV.GetOverallScore_New(score_SideNum,score_AngleVar,score_LengthVar,score_EvenArea,score_Elongation,score_Compactness,score_Convexity,score_Orientation,weight)
        #print ("weight"),weight
        
        score_OverallScore = EV.GetOverallScore_New(score_Continuity,score_SideNum,score_AngleVar,score_LengthVar,score_Access,score_EvenArea,score_Orientation,weight)
        # print ("weight"),weight
        # print "score_Continuity",score_Continuity
        # print "max score_Continuity", score_Continuity.index(max(score_Continuity),), max(score_Continuity)
        
        # print "score_SideNum",score_SideNum
        # print "max score_SideNum", score_SideNum.index(max(score_SideNum),), max(score_SideNum)
        
        # print "score_AngleVar",score_AngleVar
        # print "max score_AngleVar", score_AngleVar.index(max(score_AngleVar),), max(score_AngleVar)
        
        # print "score_LengthVar",score_LengthVar
        # print "max score_LengthVar", score_LengthVar.index(max(score_LengthVar),), max(score_LengthVar)
        
        # print "score_EvenArea",score_EvenArea
        # print "max score_EvenArea", score_EvenArea.index(max(score_EvenArea),), max(score_EvenArea)
        
        #print "score_OverallScore",score_OverallScore 
        #print "max score_OverallScore", score_OverallScore.index(max(score_OverallScore),), max(score_OverallScore)
        #print "score_OverallScore Index ", score_OverallScore.index(max(score_OverallScore))
        ###################
        #### Assign
        ###################
        #Assign to each instance
        for i in range(len(streamlines)):
            sl = SLG.Streamline()
            sl.CreateStreamlineInstance(streamlines[i])
            
            #sl.scoreSideNum = score_SideNum[i]
            sl.Continuity = score_Continuity[i]
            sl.scoreAngleVar = score_AngleVar[i]
            sl.scoreLengthVar = score_LengthVar[i]
            sl.scoreEvenArea = score_EvenArea[i]
            # sl.scoreElongation = score_Elongation[i]
            # sl.scoreCompactness = score_Compactness[i]
            # sl.scoreConvexity = score_Convexity[i]
            sl.scoreOrientation = score_Orientation[i]
            
        
            sl.scoreOverall = score_OverallScore[i]
            
            # sl.elongationPair = elongationPairCollection[i]
            # sl.areaPair = areaPairCollection[i]
            # sl.convexityPair = convexityPairCollection[i]
            # sl.compactnessPair = compactnessPairCollection[i]
            sl.orientationPair = orientationPairCollection[i]
            
            ######## Temp!
            sl.areaPair = [1,1]
            sl.elongationPair =  [1,1]
            sl.areaPair =  areaPairCollection[i]
            sl.convexityPair =  [1,1]
            sl.compactnessPair = [1,1]
           
            
            if sl.areaPair[0] >= sl.areaPair[1]:
                sl.evenAreaValue = sl.areaPair[1]/sl.areaPair[0]
            else:
                sl.evenAreaValue = sl.areaPair[0]/sl.areaPair[1]
            
            streamlineNetwork.network.append(sl)
    
        
    @staticmethod
    def GetAllScoreToInstance(SLG,mappingGrid,processMesh,streamlineNetwork,streamlines,dL,weight,idealOrientation):
        
        score_Divergence = EV.Score_Divergence(processMesh,mappingGrid,streamlines,20)
        score_Continuity = EV.Score_Continuity(streamlines,20,0.9) ### without setting dectect radius
        score_Singularity = EV.Score_Singularity(processMesh,streamlines)
        result = EV.Score_ParcelLevel(streamlines,processMesh.triRemeshBoundary,1.5,1,1,idealOrientation)
        score_EvenArea=result[0]
        score_Elongation=result[1]
        score_Compactness=result[2]
        score_Convexity=result[3]
        score_Orientation=result[4]
        
        
        elongationPairCollection=result[5]
        areaPairCollection=result[6]
        convexityPairCollection = result[7]
        compactnessPairCollection = result[8]
        orientationPairCollection = result[9]
        
        #Remap
        score_Divergence = EV.RemapRange(score_Divergence,0,1)    # currently this is not correct       
        score_Continuity = EV.RemapRange(score_Continuity,0,1)    # the larger the better
        score_Singularity = EV.RemapRange(score_Singularity,1,0)  # the closer (smaller value) the better
        
        score_EvenArea = EV.RemapRange(score_EvenArea,1,0)        # the smaller difference to 1， meaning its more even
        score_Elongation = EV.RemapRange(score_Elongation,1,0)    # the smaller difference to idealElongation， its better
        score_Compactness = EV.RemapRange(score_Compactness,1,0)    # the smaller difference to idealCompactness， its better
        score_Convexity = EV.RemapRange(score_Convexity,1,0)        # the smaller difference to idealConvexity， its better
        score_Orientation = EV.RemapRange(score_Orientation,1,0)     # the smaller difference, its better 
        
        score_Part1 = EV.GetScore_Part1(score_Divergence,score_Continuity,score_Singularity,weight)
        score_Part2 = EV.GetScore_Part2(score_EvenArea,score_Elongation,score_Compactness,score_Convexity,score_Orientation,weight)
        score_OverallScore = EV.GetOverallScore(score_Divergence,score_Continuity,score_Singularity,score_EvenArea,score_Elongation,score_Compactness,score_Convexity,score_Orientation,weight)
        
        
        #Assign to each instance
        for i in range(len(streamlines)):
            sl = SLG.Streamline()
            sl.CreateStreamlineInstance(streamlines[i])
            
            sl.scoreSingularity = score_Singularity[i]
            sl.scoreContinuity = score_Continuity[i]
            sl.scoreDivergence = score_Divergence[i]
            sl.scoreEvenArea = score_EvenArea[i]
            sl.scoreElongation = score_Elongation[i]
            sl.scoreCompactness = score_Compactness[i]
            sl.scoreConvexity = score_Convexity[i]
            sl.scoreOrientation = score_Orientation[i]
            
            sl.score_Part1 = score_Part1[i]
            sl.score_Part2 = score_Part2[i]
            sl.scoreOverall = score_OverallScore[i]
            
            sl.elongationPair = elongationPairCollection[i]
            sl.areaPair = areaPairCollection[i]
            sl.convexityPair = convexityPairCollection[i]
            sl.compactnessPair = compactnessPairCollection[i]
            sl.orientationPair = orientationPairCollection[i]
            
            if sl.areaPair[0] >= sl.areaPair[1]:
                sl.evenAreaValue = sl.areaPair[1]/sl.areaPair[0]
            else:
                sl.evenAreaValue = sl.areaPair[0]/sl.areaPair[1]
            
            streamlineNetwork.network.append(sl)
            
    @staticmethod
    def SortStreamlines_Overall(streamlineNetwork):
        
        list = streamlineNetwork.network
        
        sortedList = list
        num = len(list)

        for i in range(num):

            for j in range(i+1,num):

                if list[i].scoreOverall < sortedList[j].scoreOverall:
                    swp = sortedList[i]
                    sortedList[i] = sortedList[j]
                    sortedList[j] = swp

                        
        return sortedList
        
    @staticmethod
    def SortStreamlines_Streamline(streamlineNetwork):
        list = streamlineNetwork.network
        
        sortedList = list
        num = len(list)
        
        for i in range(num):
            for j in range(i+1,num):
                if sortedList[i].score_Part1<sortedList[j].score_Part1:
                    swp = sortedList[i]
                    sortedList[i] = sortedList[j]
                    sortedList[j] = swp
                    
        return sortedList
    
    @staticmethod
    def SortStreamlines_Parcel(streamlineNetwork):
        list = streamlineNetwork.network
        
        sortedList = list
        num = len(list)
        
        for i in range(num):
            for j in range(i+1,num):
                if sortedList[i].score_Part2<sortedList[j].score_Part2:
                    swp = sortedList[i]
                    sortedList[i] = sortedList[j]
                    sortedList[j] = swp
                    
        return sortedList 

    


    ######################################################
    ################        Matrix         ###############
    ######################################################
    @staticmethod
    def Solve3x3Equations(a, b, c, d, e, f, g, h, i, j, k, l):
        """
        Solve a 3x3 system of equations using Cramer's rule.
        The system is in the form of:
            a * x + b * y + c * z = d
            e * x + f * y + g * z = h
            i * x + j * y + k * z = l
        where x, y, z are the variables to be solved for.
        """
        # Compute the determinant of the coefficient matrix
        det = a * (f * i - g * j) - b * (e * i - g * k) + c * (e * j - f * k)
        
        # Compute the determinant of the matrix formed by replacing each column of the coefficient matrix 
        # with the constants vector
        det_x = d * (f * i - g * j) - b * (h * i - g * l) + c * (h * j - f * l)
        det_y = a * (h * i - g * l) - d * (e * i - g * k) + c * (e * l - h * k)
        det_z = a * (f * l - h * j) - b * (e * l - h * k) + d * (e * j - f * k)
        
        # compute the value of x, y, z
        x = det_x / det
        y = det_y / det
        z = det_z / det
        return x, y, z
    
    @staticmethod
    def Get3x3MatrixRank(matrix):
        det = matrix[0][0] * (matrix[1][1] * matrix[2][2] - matrix[1][2] * matrix[2][1]) - matrix[0][1] * (matrix[1][0] * matrix[2][2] - matrix[1][2] * matrix[2][0]) + matrix[0][2] * (matrix[1][0] * matrix[2][1] - matrix[1][1] * matrix[2][0])
        if det == 0:
            return 2
        else:
            return 3
    
    @staticmethod
    def Get3x4MatrixRank(matrix):
        num_rows = len(matrix)
        num_cols = len(matrix[0])
        rank = min(num_rows, num_cols)
    
        for i in range(num_rows):
            for j in range(i+1, num_cols):
                if matrix[i][j] != 0:
                    rank -= 1
                    break
        return rank
# ---------- end ghpython_script_2 ----------
ghpython_script_3 = GhPythonScript()  # -> out, PL
# ---------- ghpython_script_3: Python ----------
###########################
####    Import Libs    ####
###########################
import Rhino.Geometry as rg
#import Rhino.RhinoDoc as rd
import Rhino.RhinoMath as rm
import Queue
import ghpythonlib.components as ghc
import math

###########################
####    Parcellation   ####
###########################
class PL:
    class ParcVertex:
        def __init__(self,vertex,ID):
            self.geometry = vertex     
            self.ID = ID 
            self.onBoundary = False 
            self.original = False 
            
            self.depth = None
            
            
        def __del__(self):
            self.geometry = None
            self.ID = None
            self.onBoundary = None 
            self.original = None 
            
        def DeepCopy(self):
            newParcV = PL.ParcVertex(self.geometry,self.ID)
            newParcV.onBoundary = self.onBoundary 
            newParcV.original = self.original 
            newParcV.depth = self.depth
            return newParcV
        
        def GetAllEdges_AsStartV(self,currEdict):
            allEdges = currEdict.values()
            edgeCollection = []
            for edge in allEdges:
                if edge.startVertex == self:
                    edgeCollection.append(edge)
            return edgeCollection
                    
    class ParcPoint:
        def __init__(self,point,ID):
            self.geometry = point
            self.ID = ID 
            
            self.depth = None
            
        def __del__(self):
            self.geometry = None
            self.ID = None
            
        def DeepCopy(self):
            newParcPoint =  PL.ParcPoint(self.geometry,self.ID)
            newParcPoint.depth = self.depth
            return newParcPoint
    
    class ParcTurningPoint:
        def __init__(self,point,ID):
            self.geometry = point
            self.ID = ID 
            self.onBoundary = False 
            
            self.depth = None
            
        def __del__(self):
            self.geometry = None
            self.ID = None
            
        def DeepCopy(self):
            newParcTurningPoint = PL.ParcTurningPoint(self.geometry,self.ID)
            
            newParcTurningPoint.depth = self.depth
            return newParcTurningPoint
        
    class ParcResamplePoint:
        def __init__(self,point,ID):
            self.geometry = point
            self.ID = ID 
            self.turning = False
            self.onBoundary = False 
             
            self.depth = None
             
        def __del__(self):
            self.geometry = None
            self.ID = None
            
        def DeepCopy(self):
            newParcResamplePoint = PL.ParcResamplePoint(self.geometry,self.ID)
            
            newParcResamplePoint.depth = self.depth
            return newParcResamplePoint

        
    class ParcEdge:
        def __init__(self,ID):  
            
            self.depth = None
            
            self.startVertex = None              
            self.endVertex = None                   
            self.betweenPoints = []  
            self.turningPoints = []   
            self.resamplePoints = []  
            self.ID = ID
            self.twin = None
            self.twinID = None
            
            self.naked = False
            
            self.generation = None
            self.offsetDistance = 0
            self.hierarchy = None
            
            self.accessibility = True  ### currently for Access Point
            self.shrink = None
            
            ####too close, it becomes invalid
            self.isValid = True
            
            ####for road finding
            self.touchBoundary = None 
            self.parentID = None 
            self.childrenIDs = []
            
            ####for road finding
            self.isStreet = False
            self.streetID = None
            
        def __del__(self):
            self.startVertex = None
            self.endVertex = None
            self.betweenPoints = None 
            self.ID = None
            self.twin = None
            self.twinID = None
        
            self.generation = None
            self.offsetDistance = None
            self.hierarchy = None
            
            self.accessibility = None  ### currently for Access Point
            self.shrink = None
            
            self.isStreet = None
            self.streetID = None
            
        def FillInfo(self,list):
            for i in range(len(list)):
                if i == 0:
                    self.startVertex = list[0]
                elif i == len(list)-1:
                    self.endVertex = list[len(list)-1]
                else:
                    self.betweenPoints.append(list[i])
        
        def Reverse(self):
            temp=self.startVertex
            self.startVertex=self.endVertex
            self.endVertex=temp
            self.betweenPoints.reverse()
            
        def CreateTwin(self,ID):
            newEdge = PL.ParcEdge(ID)
            newEdge.startVertex = self.endVertex
            newEdge.endVertex = self.startVertex
            for i in range(len(self.betweenPoints)-1,-1,-1):

                newEdge.betweenPoints .append(self.betweenPoints[i])
            
            newEdge.twin = self
            newEdge.twinID = self.ID
            self.twin = newEdge
            self.twinID = ID
            
            return newEdge
                    
        def DeepCopy(self,PV_Dict):
            #Use Active PV_Dict
            #Add Edge 
            #Later need to redirect to get the twin address
            
            newEdge = PL.ParcEdge(self.ID)
            
            newEdge.startVertex = PV_Dict[self.startVertex.ID]
            newEdge.endVertex = PV_Dict[self.endVertex.ID]
            
            
            for bPt in self.betweenPoints:
                newEdge.betweenPoints.append(PV_Dict[bPt.ID])
        
    

            newEdge.twinID = self.twinID
            
            newEdge.naked = self.naked
            newEdge.generation = self.generation
            newEdge.offsetDistance = self.offsetDistance
            newEdge.hierarchy = self.hierarchy
            
            
            newEdge.accessibility = self.accessibility
            


            newEdge.isValid = self.isValid

            #### for road finding
            newEdge.childrenIDs = [id for id in self.childrenIDs]
            newEdge.parentID = self.parentID
            
            newEdge.isStreet = self.isStreet
            newEdge.streetID = self.streetID
            
            newEdge.depth = self.depth
            return newEdge
        
        def FindAncestorEdgeID(self,EDict_All):
            ancestorID = None
            queue =Queue.Queue()
            queue.put(self)
            while (queue.empty()!=True):
                node = queue.get()
                ancestorID = node.ID
                if node.parentID != None:
                    queue.put(EDict_All[node.parentID]) 
            return ancestorID
             
        def SplitEdge_Naked_Normal(self,shareEdge,newV,choice,E_Dict,E_Dict_All,VP_Dict):
            shareEdgeTwin = E_Dict[shareEdge.twinID]
            #Check if newV is too close to exsiting V
            distToStart = newV.geometry.DistanceTo(self.startVertex.geometry)
            distToEnd = newV.geometry.DistanceTo(self.endVertex.geometry)
            if distToStart<0.01:

                    
                theNewEdge = E_Dict[self.ID]
                newV =  theNewEdge.startVertex
                if choice == "start":
                    shareEdge.startVertex = newV
                    shareEdgeTwin.endVertex = newV
                elif choice == "end":
                    shareEdge.endVertex = newV  
                    shareEdgeTwin.startVertex = newV


                print ("VV too close happened!")
                print ("shareEdge.startVertex"),shareEdge.startVertex.geometry.X,shareEdge.startVertex.geometry.Y,0
                print ("shareEdge.endVertex"),shareEdge.endVertex.geometry.X,shareEdge.endVertex.geometry.Y,0
                print ("newV"),newV.geometry.X,newV.geometry.Y,0

            elif distToEnd<0.01:
          
                theNewEdge = E_Dict[self.ID]

                newV =  theNewEdge.endVertex
                if choice == "start":
                    shareEdge.startVertex = newV
                    shareEdgeTwin.endVertex = newV
                elif choice == "end":
                    shareEdge.endVertex = newV  
                    shareEdgeTwin.startVertex = newV
          
                print ("VV too close happened!")
                print ("shareEdge.startVertex"),shareEdge.startVertex.geometry.X,shareEdge.startVertex.geometry.Y,0
                print ("shareEdge.endVertex"),shareEdge.endVertex.geometry.X,shareEdge.endVertex.geometry.Y,0
                print ("newV"),newV.geometry.X,newV.geometry.Y,0
                
            currMaxID = max(E_Dict.Keys)
            newEdge_1 = PL.ParcEdge(currMaxID+1)
            newEdge_2 = PL.ParcEdge(currMaxID+2)
            
            newEdge_1.startVertex = self.startVertex
            newEdge_1.endVertex = newV
            
            newEdge_2.startVertex = newV
            newEdge_2.endVertex = self.endVertex
            
            E_Dict[newEdge_1.ID] = newEdge_1
            E_Dict[newEdge_2.ID] = newEdge_2
            
            E_Dict_All[newEdge_1.ID] = newEdge_1
            E_Dict_All[newEdge_2.ID] = newEdge_2
            # remove the split edge
            # print ("in SplitEdge_Naked_Normal")
            # print ("E_Dict.pop(self.ID): ", self.ID , id(E_Dict[self.ID]))
            E_Dict.pop(self.ID)
            
            # For road  
            newEdge_1.generation = self.generation
            newEdge_2.generation = self.generation
            
            newEdge_1.naked = self.naked
            newEdge_2.naked = self.naked
            
            newEdge_1.accessibility = self.accessibility
            newEdge_2.accessibility = self.accessibility
            
            if newEdge_1.startVertex== newEdge_1.endVertex:
                newEdge_1.isValid = False
            if newEdge_2.startVertex == newEdge_2.endVertex:
                newEdge_2.isValid = False

            # For road finding
            newEdges = [newEdge_1,newEdge_2]
            for edge in newEdges:
                self.childrenIDs.append(edge.ID)
                edge.parentID = self.ID


            edge.streetID = self.streetID



            return newEdge_1,newEdge_2
        
        def SplitEdge_Shared_Normal(self,shareEdge,newV,choice,E_Dict,E_Dict_All,VP_Dict,indexPair):
            shareEdgeTwin = E_Dict[shareEdge.twinID]
            #Check if newV is too close to exsiting V
            distToStart = newV.geometry.DistanceTo(self.startVertex.geometry)
            distToEnd = newV.geometry.DistanceTo(self.endVertex.geometry)
            
            if distToStart<0.01:
                theNewEdge = E_Dict[self.ID]
                newV =  theNewEdge.startVertex
                if choice == "start":
                    shareEdge.startVertex = newV
                    shareEdgeTwin.endVertex = newV                                 ### Remember to change the twin shareEdge 
                elif choice == "end":
                    shareEdge.endVertex = newV  
                    shareEdgeTwin.startVertex = newV   
  
                
                # print ("here ")
                # for pt in theNewEdge.GetGeometry():
                #     print (pt.X),pt.Y,0
                
                # print ("newV ")
                # print (newV.geometry.X),newV.geometry.Y,0
                
              
                print ("VV too close happened!")
                print ("shareEdge.startVertex"),shareEdge.startVertex.geometry.X,shareEdge.startVertex.geometry.Y,0
                print ("shareEdge.endVertex"),shareEdge.endVertex.geometry.X,shareEdge.endVertex.geometry.Y,0
                print ("newV"),newV.geometry.X,newV.geometry.Y,0

                #print newV.geometry.X,newV.geometry.Y,0
            elif distToEnd<0.01:
                theNewEdge = E_Dict[self.ID]
                # print ("here ")
                # for pt in theNewEdge.GetGeometry():
                #     print (pt.X),pt.Y,0
                    
                # print ("before changing shareEdge ")
                # for pt in shareEdge.GetGeometry():
                #     print (pt.X),pt.Y,0
                newV =  theNewEdge.endVertex
                
                ### check change shareEdge startVertex or endVertex
                if choice == "start":
                    shareEdge.startVertex = newV
                    shareEdgeTwin.endVertex = newV
                elif choice == "end":
                    shareEdge.endVertex = newV    
                    shareEdgeTwin.startVertex = newV
                # print ("after changing shareEdge")
                # for pt in shareEdge.GetGeometry():
                #     print (pt.X),pt.Y,0
                # print ("newV ")
                # print (newV.geometry.X),newV.geometry.Y,0
                
                
                print ("VV too close happened!")         
                print ("shareEdge.startVertex"),shareEdge.startVertex.geometry.X,shareEdge.startVertex.geometry.Y,0
                print ("shareEdge.endVertex"),shareEdge.endVertex.geometry.X,shareEdge.endVertex.geometry.Y,0
                print ("newV"),newV.geometry.X,newV.geometry.Y,0
                #print newV.geometry.X,newV.geometry.Y,0
            
 
            currMaxID = max(E_Dict.keys())
            all = self.GetVPInstance()

            #ID gap for their twins
            newEdge_1 = PL.ParcEdge(currMaxID+1)
            newEdge_2 = PL.ParcEdge(currMaxID+3)
            
            #fill info for newEdge_1
            newEdge_1.startVertex = self.startVertex
            newEdge_1.endVertex = newV
            
            for i in range(len(all)):
                if i!=0 and i !=len(all)-1 and i <= indexPair[0]:
                    newEdge_1.betweenPoints.append(all[i])
                    
            ### check if the last seg length
            if newEdge_1.betweenPoints != []:
                dist = newEdge_1.betweenPoints[-1].geometry.DistanceTo(newV.geometry)
                if dist < 0.01:
                    print ("VP too close happened!")
                    #print newEdge_1.betweenPoints[-1].geometry.X,newEdge_1.betweenPoints[-1].geometry.Y,newEdge_1.betweenPoints[-1].geometry.Z
                    newEdge_1.betweenPoints.pop() 
                    
                    
            #fill info for newEdge_2
            newEdge_2.startVertex = newV
            newEdge_2.endVertex = self.endVertex
            
            
            for i in range(len(all)):
                if i!=0 and i !=len(all)-1 and i >= indexPair[1]:
                    newEdge_2.betweenPoints.append(all[i])
                    
            ### check if the last seg length
            if newEdge_2.betweenPoints != []:
                dist = newEdge_2.betweenPoints[0].geometry.DistanceTo(newV.geometry)
                if dist < 0.01:
                    print ("VP too close happened!")
                    #print newEdge_2.betweenPoints[-1].geometry.X,newEdge_2.betweenPoints[-1].geometry.Y,newEdge_2.betweenPoints[-1].geometry.Z
 
                    newEdge_2.betweenPoints.pop(0) 
                    
                
            #create twins
            newEdge_1_twin = newEdge_1.CreateTwin(currMaxID+2)
            newEdge_2_twin = newEdge_2.CreateTwin(currMaxID+4)
            
            #store in Dict
            E_Dict[newEdge_1.ID] = newEdge_1
            E_Dict[newEdge_1_twin.ID] = newEdge_1_twin
            E_Dict[newEdge_2.ID] = newEdge_2
            E_Dict[newEdge_2_twin.ID] = newEdge_2_twin
            
            E_Dict_All[newEdge_1.ID] = newEdge_1
            E_Dict_All[newEdge_1_twin.ID] = newEdge_1_twin
            E_Dict_All[newEdge_2.ID] = newEdge_2
            E_Dict_All[newEdge_2_twin.ID] = newEdge_2_twin

            #remove the split edge
            #print ("in SplitEdge_Shared_Normal")
            #print ("E_Dict.pop(self.ID): ", self.ID , id(E_Dict[self.ID])),"streetID",E_Dict[self.ID].streetID, "twinID",self.twinID, "twinEdge street ID",E_Dict[self.twinID].streetID
            
            
            E_Dict.pop(self.ID)
            print ("in SplitEdge_Shared_Normal")
            print ("E_Dict.pop(self.ID)"),self.ID, ("self.twinID"),self.twinID
            
            # For road  
            newEdge_1.generation = self.generation
            newEdge_1_twin.generation = self.generation
            newEdge_2.generation = self.generation
            newEdge_2_twin.generation = self.generation
            
            newEdge_1.naked = self.naked
            newEdge_1_twin.naked = self.naked
            newEdge_2.naked = self.naked
            newEdge_2_twin.naked = self.naked
            
            
            newEdge_1.accessibility = self.accessibility
            newEdge_1_twin.accessibility = self.accessibility
            newEdge_2.accessibility = self.accessibility
            newEdge_2_twin.accessibility = self.accessibility
            
            
            if newEdge_1.startVertex== newEdge_1.endVertex:
                newEdge_1.isValid = False
            if newEdge_2.startVertex== newEdge_2.endVertex:
                newEdge_2.isValid = False
            if newEdge_1_twin.startVertex== newEdge_1_twin.endVertex:
                newEdge_1_twin.isValid = False
            if newEdge_2_twin.startVertex== newEdge_2_twin.endVertex:
                newEdge_2_twin.isValid = False
                

            # For road finding
            newEdges = [newEdge_1,newEdge_1_twin,newEdge_2,newEdge_2_twin]
            
            
            # Need to add seperately to have the right order
            for edge in newEdges:
                edge.parentID = self.ID

            self.childrenIDs.append(newEdge_1.ID)
            self.childrenIDs.append(newEdge_2.ID)
            E_Dict_All[self.twinID].childrenIDs.append(newEdge_2_twin.ID)
            E_Dict_All[self.twinID].childrenIDs.append(newEdge_1_twin.ID)

            #print ("newEdgeID"), newEdge_1.ID,newEdge_1.isValid,newEdge_2.ID,newEdge_2.isValid
            #print ("newEdgeID"), newEdge_1_twin.ID,newEdge_1_twin.isValid,newEdge_2_twin.ID,newEdge_2_twin.isValid
            
            
            edge.streetID = self.streetID
            
            ### debuging
            if newEdge_1.betweenPoints!= [] and (newEdge_1.startVertex == newEdge_1.betweenPoints[0] or newEdge_1.endVertex == newEdge_1.betweenPoints[-1]):
                print ("split edge1 warning!!!!!!" )
            
            if newEdge_2.betweenPoints!= [] and (newEdge_2.startVertex == newEdge_2.betweenPoints[0] or newEdge_2.endVertex == newEdge_2.betweenPoints[-1]):
                print ("split edge1 warning!!!!!!" )

            # if self.ID == 201:
            #     print "newEdge_1"
            #     for pt in newEdge_1.GetGeometry():
            #         print pt.X,pt.Y,0
            #     print "-----"
            
            #     print "newEdge_2"
            #     for pt in newEdge_2.GetGeometry():
            #         print pt.X,pt.Y,0
            #     print "-----"
            
            return newEdge_1,newEdge_1_twin,newEdge_2,newEdge_2_twin
       
        def SplitEdge_Naked_Special(self,shareEdge,newV_Start,newV_End,E_Dict,E_Dict_All,VP_Dict):
            print ("specialN")
            #Check if newV is too close to exsiting V
            distToStart = newV.geometry.DistanceTo(self.startVertex.geometry)
            distToEnd = newV.geometry.DistanceTo(self.endVertex.geometry)
            if distToStart<0.01:
                theNewEdge = E_Dict[self.ID]
                newV =  theNewEdge.startVertex
                shareEdge.startVertex = newV
                print ("VV too close happened!_Special")
            elif distToEnd<0.01:
                theNewEdge = E_Dict[self.ID]
                newV =  theNewEdge.endVertex
                shareEdge.endVertex = newV
                print ("VV too close happened!_Special")
            currMaxID = max(E_Dict.Keys)
            newEdge_1 = PL.ParcEdge(currMaxID+1)
            newEdge_2 = PL.ParcEdge(currMaxID+2)
            newEdge_3 = PL.ParcEdge(currMaxID+3)
            
            newEdge_1.startVertex = self.startVertex
            newEdge_1.endVertex = newV_End
            
            newEdge_2.startVertex = newV_End
            newEdge_2.endVertex = newV_Start
            
            newEdge_3.startVertex = newV_Start
            newEdge_3.endVertex = self.endVertex
            
            E_Dict[newEdge_1.ID] = newEdge_1
            E_Dict[newEdge_2.ID] = newEdge_2
            E_Dict[newEdge_3.ID] = newEdge_3

            E_Dict_All[newEdge_1.ID] = newEdge_1
            E_Dict_All[newEdge_2.ID] = newEdge_2
            E_Dict_All[newEdge_3.ID] = newEdge_3
            #remove the split edge
            del E_Dict[self.ID]
            
            
            # For road  
            newEdge_1.generation = self.generation
            newEdge_2.generation = self.generation
            newEdge_3.generation = self.generation

            newEdge_1.accessibility = self.accessibility
            newEdge_2.accessibility = self.accessibility
            newEdge_3.accessibility = self.accessibility
            
            if newEdge_1.startVertex== newEdge_1.endVertex:
                newEdge_1.isValid = False
            if newEdge_2.startVertex== newEdge_2.endVertex:
                newEdge_2.isValid = False
            if newEdge_3.startVertex== newEdge_3.endVertex:
                newEdge_3.isValid = False
            

            # For road finding
            newEdges = [newEdge_1,newEdge_2,newEdge_3]
            for edge in newEdges:
                
                self.childrenIDs.append(edge.ID)
                edge.parentID = self.ID
            
            
            return newEdge_1,newEdge_2,newEdge_3
        
        def SplitEdge_Shared_Special(self,shareEdge,newV_Start,newV_End,E_Dict,E_Dict_All,VP_Dict,startIndexPair,endIndexPair):
            print ("special")
            #Check if newV is too close to exsiting V
            distToStart = newV_Start.geometry.DistanceTo(self.startVertex.geometry)
            distToEnd = newV_Start.geometry.DistanceTo(self.endVertex.geometry)
            
            if distToStart<0.01:
                theNewEdge = E_Dict[self.ID]
                newV_Start =theNewEdge.startVertex
                shareEdge.startVertex = newV_Start
                print ("VV too close happened!_Special")
            elif distToEnd<0.01:
                theNewEdge = E_Dict[self.ID]
                newV_End =theNewEdge.endVertex
                shareEdge.endVertex = newV_End
                print ("VV too close happened!_Special")    

                
            currMaxID = max(E_Dict.Keys)
            all = self.GetVPInstance()
            
            #ID gap for their twins
            newEdge_1 = PL.ParcEdge(currMaxID+1)
            newEdge_2 = PL.ParcEdge(currMaxID+3)
            newEdge_3 = PL.ParcEdge(currMaxID+5)
            
            #fill info for newEdge_1
            newEdge_1.startVertex = self.startVertex
            newEdge_1.endVertex = newV_End
            
            for i in range(len(all)):
                if i!=0 and i !=len(all)-1 and i <= endIndexPair[0]:
                    newEdge_1.betweenPoints.append(all[i])
            
            
            ### check if the last seg length
            if newEdge_1.betweenPoints != []:
                dist = newEdge_1.betweenPoints[-1].geometry.DistanceTo(newV_End.geometry)
                if dist < 0.01:
                    newEdge_1.betweenPoints.pop() 
                    print ("VP too close happened!_Special")


            #fill info for newEdge_2
            newEdge_2.startVertex = newV_End
            newEdge_2.endVertex = newV_Start
            
            for i in range(len(all)):
                if i!=0 and i!=len(all)-1 and i >= endIndexPair[1] and i <= startIndexPair[0]:
                    newEdge_2.betweenPoints.append(all[i])
            
            ### check if the last seg length
            if newEdge_2.betweenPoints != []:
                dist = newEdge_2.betweenPoints[0].geometry.DistanceTo(newV_End.geometry)
                if dist < 0.01:
                    newEdge_2.betweenPoints.pop(0) 
                    print ("VP too close happened!_Special")
            
            if newEdge_2.betweenPoints != []:
                dist = newEdge_2.betweenPoints[-1].geometry.DistanceTo(newV_Start.geometry)
                if dist < 0.01:
                    newEdge_2.betweenPoints.pop() 
                    print ("VP too close happened!_Special")
            
               
            #fill info for newEdge_3
            newEdge_3.startVertex = newV_Start
            newEdge_3.endVertex = self.endVertex
            
            for i in range(len(all)):
                if i!=0 and i !=len(all)-1 and i >= startIndexPair[1]:
                    newEdge_3.betweenPoints.append(all[i])
           
           
            ### check if the last seg length
            if newEdge_3.betweenPoints != []:
                dist = newEdge_3.betweenPoints[0].geometry.DistanceTo(newV_Start.geometry)
                if dist < 0.01:
                    newEdge_3.betweenPoints.pop(0) 
                    print ("VP too close happened!_Special" )   
                
                     
            #create twins
            newEdge_1_twin = newEdge_1.CreateTwin(currMaxID+2)
            newEdge_2_twin = newEdge_2.CreateTwin(currMaxID+4)
            newEdge_3_twin = newEdge_3.CreateTwin(currMaxID+6)
            
            #store in Dict
            E_Dict[newEdge_1.ID] = newEdge_1
            E_Dict[newEdge_1_twin.ID] = newEdge_1_twin
            E_Dict[newEdge_2.ID] = newEdge_2
            E_Dict[newEdge_2_twin.ID] = newEdge_2_twin
            E_Dict[newEdge_3.ID] = newEdge_3
            E_Dict[newEdge_3_twin.ID] = newEdge_3_twin
            
            E_Dict_All[newEdge_1.ID] = newEdge_1
            E_Dict_All[newEdge_1_twin.ID] = newEdge_1_twin
            E_Dict_All[newEdge_2.ID] = newEdge_2
            E_Dict_All[newEdge_2_twin.ID] = newEdge_2_twin
            E_Dict_All[newEdge_3.ID] = newEdge_3
            E_Dict_All[newEdge_3_twin.ID] = newEdge_3_twin




            #remove the split edge
            del E_Dict[self.ID]
            
            newEdge_1.generation = self.generation
            newEdge_1_twin.generation = self.generation
            newEdge_2.generation = self.generation
            newEdge_2_twin.generation = self.generation
            newEdge_3.generation = self.generation
            newEdge_3_twin.generation = self.generation
            
            
            # For road  
            newEdge_1.accessibility = self.accessibility
            newEdge_1_twin.accessibility = self.accessibility
            newEdge_2.accessibility = self.accessibility
            newEdge_2_twin.accessibility = self.accessibility
            newEdge_3.accessibility = self.accessibility
            newEdge_3_twin.accessibility = self.accessibility
            
            

            if newEdge_1.startVertex== newEdge_1.endVertex:
                newEdge_1.isValid = False
            if newEdge_2.startVertex== newEdge_2.endVertex:
                newEdge_2.isValid = False
            if newEdge_3.startVertex== newEdge_3.endVertex:
                newEdge_3.isValid = False
                
            if newEdge_1_twin.startVertex== newEdge_1_twin.endVertex:
                newEdge_1_twin.isValid = False
            if newEdge_2_twin.startVertex== newEdge_2_twin.endVertex:
                newEdge_2_twin.isValid = False
            if newEdge_3_twin.startVertex== newEdge_3_twin.endVertex:
                newEdge_3_twin.isValid = False
                

           # For road finding
            newEdges = [newEdge_1,newEdge_1_twin,newEdge_2,newEdge_2_twin,newEdge_3,newEdge_3_twin]
            for edge in newEdges:
              
                self.childrenIDs.append(edge.ID)
                edge.parentID = self.ID

            return newEdge_1,newEdge_1_twin,newEdge_2,newEdge_2_twin,newEdge_3,newEdge_3_twin
        
        def GetGeometry(self):
            allPoints=[]
            
            
            allPoints.append(self.startVertex.geometry)
            
            if self.betweenPoints != []:
                for point in self.betweenPoints:
                    allPoints.append(point.geometry)
                    
            allPoints.append(self.endVertex.geometry)
            
            return rg.Polyline(allPoints)
        
        def GetGeometry_SimplifiedWithResamplePoints(self):
            allPoints=[]
            
            
            allPoints.append(self.startVertex.geometry)
            
            if self.resamplePoints != []:
                for point in self.resamplePoints:
                    allPoints.append(point.geometry)
                    
            allPoints.append(self.endVertex.geometry)
            
            return rg.Polyline(allPoints)
        
        def GetGeometry_Simplified(self):
            return rg.Line(self.startVertex.geometry,self.endVertex.geometry)
        
        def GetGeometry_SimplifiedWithTurningPoints(self):
            v_Geo = []
            v_Geo.append(self.startVertex.geometry)
            if self.turningPoints!=[]:
                for tPt in self.turningPoints:   
                    v_Geo.append(tPt.geometry)
            
            v_Geo.append(self.endVertex.geometry)
            
            if len(v_Geo) == 2:
                newPolyL = rg.Polyline(2)
                newPolyL.Add(v_Geo[0])
                newPolyL.Add(v_Geo[1])
                return newPolyL
            else:
                return rg.Polyline(v_Geo)
            
            
            
        def GetVPInstance(self):
            allPoints=[]
            allPoints.append(self.startVertex)
            
            if self.betweenPoints != None:
                for point in self.betweenPoints:
                    allPoints.append(point)
            
            ### small differentfrom the parcFace method, need to get the last vertex 
            allPoints.append(self.endVertex)
            return allPoints
        
        def GetVPInstance_Resample(self):
            allPoints=[]
            allPoints.append(self.startVertex)
            
            if self.resamplePoints != None:
                for point in self.resamplePoints:
                    allPoints.append(point)
            
            ### small differentfrom the parcFace method, need to get the last vertex 
            allPoints.append(self.endVertex)
            return allPoints
                    
        def GetVPID(self):
            allPoints=[]
            allPoints.append(self.startVertex.ID)
            
            if self.betweenPoints != None:
                for point in self.betweenPoints:
                    allPoints.append(point.ID)
            
            ### small differentfrom the parcFace method, need to get the last vertex 
            allPoints.append(self.endVertex.ID)
            return allPoints
            
    class ParcFace:
        def __init__(self):
            self.ID = None
            self.processMesh = None
            
            self.vertices = []          
            self.edges = []                           
            self.area = None
            self.elongation = None
            self.sortedSL = None
            
            self.startPt = None
            self.specificStreamline = None
            
            
            # tree info
            self.alive = True
            self.identity = None
            self.child_A = None
            self.child_B = None
            self.child_C = None  ### This is to store Dead Node, if this is not None, child A and B must be None
            
            self.parent = None
            self.depth = None
            self.neighbors=[] 
            #self.mutualVP={} 
            self.mutualE_P={} 
            self.mutualP_E={}
            self.situation = 0   #decide which method is going to use
            self.triangleSize = None #the triangleSize that is used for remesh
            
            ####for road finding
            self.accessible = False      
            #self.roads = []
            self.roadIDs = []
            
            
            ####for road finding
            self.sides = []
            
         
        def __del__(self):
            self.vertices = None          
            self.edges = None                          
            self.geometery = None
            self.area = None
            self.elongation = None
            self.sortedSL = None
            self.specificStreamline = None
            self.status = ["Proceed"]
            
            # tree info
            self.alive = None
            self.identity = None
            self.child_A = None
            self.child_B = None
            self.child_C = None
            
            self.parent = None
            self.depth = None
            self.neighbors=[] 
            #self.mutualVP={} 
            self.mutualE_P = None
            self.mutualP_E = None
            self.situation = 0   #decide which method is going to use
            self.triangleSize = None #the triangleSize that is used for remesh
        
            ####for graph
            self.ID = None
            
            ####for road finding
            self.sides = None
            
        def InitializeParcFaceWithID(self,F_Dict):
            self.ID = max(F_Dict.keys())+1
            F_Dict[self.ID]  = self
  
            
        def DeepCopy(self,VP_Dict,E_Dict,E_Dict_All):
            newParcFace = PL.ParcFace()
            
            newParcFace.identity = self.identity
            for edge in self.edges:
                #Add vertices 
                newParcFace.AddFaceV(VP_Dict[edge.startVertex.ID])
                
                
                #Add Edge  (wrong)
                try:
                    newEdge = E_Dict[edge.ID]
                except:
                    print ("doing newEdge = E_Dict[edge.ID], edge.ID:"),edge.ID
                    return "something wrong......."
                else:
                    pass
                newParcFace.edges.append(newEdge)
            
            newParcFace.sortedSL = self.sortedSL
            newParcFace.specificStreamline = self.specificStreamline 
            
            newParcFace.alive = self.alive
            
            newParcFace.child_A = self.child_A
            newParcFace.child_B = self.child_B
            newParcFace.child_C = self.child_C    ### This is to store Dead Node
            
            newParcFace.parent = self.parent     # parent is correct , no need to change
            
            #if self.alive == False:
                #newParcFace.depth = self.depth +1        ### this might cause +2: from working - >solution, from solution -> working
            #else:
            newParcFace.depth = self.depth 
                
            newParcFace.neighbors = []
            for neigbor in self.neighbors:
                newParcFace.neighbors.append(neigbor)
            # neighbors is linking to previous depth, need to relink ### be careful, this need to append one by one
            
            newParcFace.mutualE_P = {}
            for key in self.mutualE_P:
                newParcFace.mutualE_P[key] = self.mutualE_P[key]

            newParcFace.mutualP_E = {}
            for key in self.mutualP_E:
                newParcFace.mutualP_E[key] = self.mutualP_E[key]

            newParcFace.situation = self.situation
            newParcFace.triangleSize = self.triangleSize

            if self.startPt != None:
                startPtID = self.startPt.ID
                newParcFace.startPt = VP_Dict[startPtID]
            
            ### for road finding 
            newParcFace.roadIDs = self.roadIDs
            newParcFace.accessible = self.accessible

            ### for graph
            newParcFace.ID = self.ID
          

            ### find side
            newParcFace.sides = self.sides
            return newParcFace
        
        def GetSide(self,EDict_All):
            ancestorIDs = []
            for edge in self.edges:
                ancestorIDs.append(edge.FindAncestorEdgeID(EDict_All))
            
            ### Cluster 
            clusters = []  
            sides = []
            for i in range(len(ancestorIDs)):
                element = ancestorIDs[i]
                parcEdge = self.edges[i]
                if not any(element in cluster for cluster in clusters):
                    # if element is not in exsiting list 
                    clusters.append([element])
                    sides.append([parcEdge.ID])
                else:
                    # if element is in exsiting list 
                    for i in range(len(clusters)):
                        currCluster = clusters[i]
                        currSide = sides[i]
                        if element in currCluster:
                            currCluster.append(element)
                            currSide.append(parcEdge.ID)
                            break
            
            self.sides = sides
                        
            # sides = []
            # for cluster in clusters:
            #     sides.append([])
                
            # for i in range(len(ancestorIDs)):
            #     currAncestorID = ancestorIDs[i]
            #     for clusterIndex in range(len(clusters)):
            #         currCluster = clusters[clusterIndex]
            #         if currAncestorID in currCluster:
            #             sides[clusterIndex].append(self.edges[i])
            #             break
                

        def FindSideIDList_Outdated(self,EDict_All):
            #### for side
            newSides = []
            for sideIDList in self.sides:
       
                newSideList = []
                sideInstanceList = [EDict_All[eID] for eID in sideIDList]
                
                for parcEdge in sideInstanceList:
                    queue =Queue.Queue()
                    queue.put(parcEdge)
                    while (queue.empty()!=True):
                        node = queue.get()
                        if node.childrenIDs != []:
                            for cID in node.childrenIDs:
                                queue.put(EDict_All[cID]) 
                        else:
                            newSideList.append(node.ID)
            newSides.append(newSideList)
            self.sides = newSides
             
             
        def AddFaceV(self,item):
            self.vertices.append(item)
            #print "add vertex",item.ID
            

        def FormParcFace_First(self,input,ID):
            #The first input only have vertices
            input = self.MakeCounterClockwiseDirection(input)
            inputVertices=[]
            for index in range(len(input)-1):
                inputVertices.append(input[index])
                
            vertices=[]
            for index in range(len(inputVertices)):
                vertex = PL.ParcVertex(inputVertices[index],index)
                vertex.original = True
                vertex.onBoundary = True
                vertex.depth = 0
                vertices.append(vertex)
                

            self.vertices = vertices
            
            edges=[]
            
            edgeCount = 0
            for i in range(len(self.vertices)):
                edge=PL.ParcEdge(edgeCount)
                edge.depth = 0
                edge.naked = True ### for road hierarchy
                
                if i !=len(self.vertices)-1:
                    edge.startVertex = self.vertices[i]
                    edge.endVertex = self.vertices[i+1]
                    
                else:
                    edge.startVertex = self.vertices[i]
                    edge.endVertex = self.vertices[0]
                edges.append(edge)
                
                edgeCount+=1
            
            
            self.edges=edges
            self.depth = 0
            self.roads = edges
            self.roadIDs = [edge.ID for edge in self.edges]
            self.accessible = True
            
            ####for graph
            self.ID = ID
            
            ####for roadFinding
            for edge in self.edges:
                self.sides.append([edge.ID])
            
            
        ### GetGeometry 
        def GetGeometry(self):
            all=[]
            
            for edge in self.edges:
                all.append(edge.startVertex.geometry)
                
                for point in edge.betweenPoints:
                    all.append(point.geometry)
            

            all.append(self.vertices[0].geometry)
            
            return rg.Polyline(all)
        
        def GetGeometry_Simplified(self): 

            vertices = self.vertices
            v_Geo = [v.geometry for v in vertices]
            v_Geo.append(v_Geo[0])
            
            return rg.Polyline(v_Geo)

        def GetGeometry_SimplifiedWithTurningPoints(self): 
            v_Geo = []
            for edge in self.edges:
                
                v_Geo.append(edge.startVertex.geometry)
                if edge.turningPoints!=[]:
                    for tPt in edge.turningPoints:
                            
                        v_Geo.append(tPt.geometry)
            
            v_Geo.append(v_Geo[0])

            return rg.Polyline(v_Geo)
    
        def GetGeometry_SimplifiedWithResamplePoints(self):
            v_Geo = []
            for edge in self.edges:
                
                v_Geo.append(edge.startVertex.geometry)
                if edge.resamplePoints!=[]:
                    for rPt in edge.resamplePoints:
                            
                        v_Geo.append(rPt.geometry)
            
            v_Geo.append(v_Geo[0])

            return rg.Polyline(v_Geo)
        
        def GetSideGeometry(self):
            sideGeometry = []
            for side in self.sides:
                thisSidePEs = []
                for edgeIndex in side:
                    for edge in self.edges:
                        if edgeIndex == edge.ID:
                            thisSidePEs.append(edge)
                
                thisSidePts =[]
                for pE in thisSidePEs:
                    thisSidePts.append(pE.startVertex.geometry)
                    for rPt in pE.betweenPoints:
                        thisSidePts.append(rPt.geometry)
                    
                thisSidePts.append(thisSidePEs[-1].endVertex.geometry)
                sideGeometry.append(rg.Polyline(thisSidePts))
            
            return sideGeometry
        
        def GetSideGeometry_Resample(self):
            sideGeometry = []
            for side in self.sides:
                thisSidePEs = []
                for edgeIndex in side:
                    for edge in self.edges:
                        if edgeIndex == edge.ID:
                            thisSidePEs.append(edge)
                
                thisSidePts =[]
                for pE in thisSidePEs:
                    thisSidePts.append(pE.startVertex.geometry)
                    for rPt in pE.resamplePoints:
                        thisSidePts.append(rPt.geometry)
                    
                thisSidePts.append(thisSidePEs[-1].endVertex.geometry)
                sideGeometry.append(rg.Polyline(thisSidePts))
            
            return sideGeometry
                    
        def GetSideGeometry_Simplified(self):
            sideGeometry = []
            for side in self.sides:
                thisSidePEs = []
                for edgeIndex in side:
                    for edge in self.edges:
                        if edgeIndex == edge.ID:
                            thisSidePEs.append(edge)
                
                thisSidePts =[]
                for pE in thisSidePEs:
                    thisSidePts.append(pE.startVertex.geometry)

                thisSidePts.append(thisSidePEs[-1].endVertex.geometry)
                sideGeometry.append(rg.Polyline(thisSidePts))
            
            return sideGeometry            
        
        ### Get V P E
        def GetVPID(self):
            all=[]
            
            for edge in self.edges:
                all.append(edge.startVertex.ID)
                
                for point in edge.betweenPoints:
                    all.append(point.ID)
                    
            #all.append(self.vertices[0].ID)
            return all
            
        def GetVID(self):
            all=[]
            for v in self.vertices:
                all.append(v.ID)
            return all
        
        def GetVPInstance(self):
            all=[]
            
            for edge in self.edges:
                all.append(edge.startVertex)
                
                for point in edge.betweenPoints:
                    all.append(point)
                    
            #all.append(self.vertices[0])
            return all
            
        def GetVPGeo(self):
            all=[]
            
            for edge in self.edges:
                all.append(edge.startVertex.geometry)
                for point in edge.betweenPoints:
                    all.append(point.geometry)
            
            return all
        

        def GetVPID_SimplifiedWithResamplePoints(self):
            all=[]
            
            for edge in self.edges:
                all.append(edge.startVertex.ID)
                
                for point in edge.resamplePoints:
                    all.append(point.ID)
                    
            #all.append(self.vertices[0].ID)
            return all
        
        def GetVPInstance_SimplifiedWithResamplePoints(self):
            all=[]
            
            for edge in self.edges:
                all.append(edge.startVertex)
                
                for point in edge.resamplePoints:
                    all.append(point)
                    
            #all.append(self.vertices[0])
            return all
        
        def GetVPGeo_SimplifiedWithResamplePoints(self):
            all=[]
            
            for edge in self.edges:
                all.append(edge.startVertex.geometry)
                for point in edge.resamplePoints:
                    all.append(point.geometry)
            
            return all
        
        def GetVPID_SimplifiedWithTurningPoints(self):
            all=[]
            
            for edge in self.edges:
                all.append(edge.startVertex.ID)
                
                for point in edge.turningPoints:
                    all.append(point.ID)
                    
            #all.append(self.vertices[0].ID)
            return all
        
        def GetVPInstance_SimplifiedWithTurningPoints(self):
            all=[]
            
            for edge in self.edges:
                all.append(edge.startVertex)
                
                for point in edge.turningPoints:
                    all.append(point)
                    
            #all.append(self.vertices[0])
            return all
        
        def GetVPGeo_SimplifiedWithTurningPoints(self):
            all=[]
            
            for edge in self.edges:
                all.append(edge.startVertex.geometry)
                for point in edge.turningPoints:
                    all.append(point.geometry)
            
            return all
            
        def GetVPInstance_Simplified(self):
            all=[]
            
            for edge in self.edges:
                all.append(edge.startVertex)

            #all.append(self.vertices[0])
            return all
        
        
        def GetEID(self):
            all=[]
            for edge in self.edges:
                
                all.append(edge.ID)
            return all
            
        def GetEInstance(self):
            all=[]
            for edge in self.edges:
                all.append(edge)
            return all
            
        def MakeCounterClockwiseDirection(self,inputPolyline):
            inputPolyline_copy = rg.Polyline(inputPolyline)
            inputPolylineCurve = inputPolyline_copy.ToPolylineCurve()
            if inputPolylineCurve.ClosedCurveOrientation().ToString() == "Clockwise":
                inputPolyline_copy.Reverse()
        
            else:
                pass
            
            return inputPolyline_copy

        def UpdateAffectedInfo_Normal(self,shareEdge,affectedEdge,newEdges,currEDict,choice):
            ### step1: Get the affectedEdge'twin 
            ### step2: Detect the insert position(id or indices) on this edge, get the pair
            
            ### step3: insert the new vertex to vertices List  (switch step4)
            ### step4: insert new Edges , be careful ,these should be the twin version, delete the affected edge
            ### step5: remove the affected Edge from currE dict (also the tiwn)
        
            #tol = rd.ActiveDoc.ModelAbsoluteTolerance
            tol = 0.001
            ### STEP1
            targetEdge = affectedEdge.twin
            if choice == "start":
                checkPt = shareEdge.startVertex
            elif choice == "end":
                checkPt = shareEdge.endVertex
                
            ### STEP2
            if len(targetEdge.betweenPoints) == 0:
                pass
                ### impossible, only the boundary edge has no betweenPoints
            
            elif len(targetEdge.betweenPoints) != 0:
                all = targetEdge.GetVPInstance()

                for i in range(len(all)-1):
                    segment = rg.Line(all[i].geometry,all[+1].geometry)
                    if segment.DistanceTo(checkPt.geometry,True)<tol:
                        insertPair = [i,i+1] ### this is index on Edge, not ID
                    

            # ### STEP3
            # startID = targetEdge.startVertex.ID
            # endID = targetEdge.endVertex.ID
            
            # allVertexIndices = self.GetVPID()

            # ### mind the insert order
            # index_of_start = allVertexIndices.index(startID)
            # index_of_end = allVertexIndices.index(endID)
 
            # if index_of_start < index_of_end:
            #     self.vertices.insert(index_of_start+1, checkPt)

            # elif index_of_end < index_of_start:
            #     self.vertices.insert(index_of_end+1, checkPt)
    
            
            ### STEP4
            edgeReplaceIndex = self.edges.index(targetEdge)
            if newEdges[3].isValid == True:
                self.edges.insert(edgeReplaceIndex,newEdges[3])  ### insert the twin one
            if newEdges[1].isValid == True:
                self.edges.insert(edgeReplaceIndex+1,newEdges[1]) ### insert the twin one
            self.edges.remove(targetEdge)  ### remove the old one
            
            
            ### STEP3
            newVertices = []
            for pE in self.edges:
                newVertices.append(pE.startVertex)
            
            self.vertices = newVertices
      
            
            ### STEP5
            #print "targetEdge:",targetEdge,targetEdge.ID
            
            #if targetEdge.twin !=None:
                #print "targetEdge.twin:",targetEdge.twin,targetEdge.twin.ID
            
            #for key in currEDict:
                #print key
            #print ("removing edge ID",targetEdge.ID)
            
            #print ("in UpdateAffectedInfo_Normal"),
            #print ("treating this node :"), id(self)
            #print ("E_Dict.pop(targetEdge.ID): "), targetEdge.ID ,("E_Dict.pop(targetEdge.address): "), id(currEDict[targetEdge.ID])
            currEDict.pop(targetEdge.ID)
            ##### has been remove when constructing the children of currNode
            #if targetEdge.twin !=None:
                #currEDict.pop(targetEdge.twin.ID)
                
        def UpdateAffectedInfo_Special(self,shareEdge,affectedEdge,newEdges,startSplitPointPair,endSplitPointPair,currEDict):
            ### step1: Get the affectedEdge'twin 
            ### step2: Get the insert position(id or indices) on this edge,insert the new vertex to vertices List
            ### step3: insert new Edges , be careful ,these should be the twin version, delete the affected edge
            ### step4: remove the affected Edge from currE dict, also its t
        
            #tol = rd.ActiveDoc.ModelAbsoluteTolerance
            tol = 0.001
            ### STEP1
            targetEdge = affectedEdge.twin
            
                
            ### STEP2
            if len(targetEdge.betweenPoints) == 0:
                pass
                ### impossible, only the boundary edge has no betweenPoints
            num = len(targetEdge.GetVPID())
            firstInsertIndex = num - startSplitPointPair[1]
            secondInsertIndex = num - endSplitPointPair[1]  

            self.vertices.insert(firstInsertIndex,shareEdge.startVertex)
            self.vertices.insert(secondInsertIndex,shareEdge.endVertex)
            
            ### STEP4
            edgeReplaceIndex = self.edges.index(targetEdge)
            if newEdges[5].isValid == True:
                self.edges.insert(edgeReplaceIndex,newEdges[5])  ### insert the twin one
            #print "inserting  " ,newEdges[5].ID
            if newEdges[3].isValid == True:
                self.edges.insert(edgeReplaceIndex+1,newEdges[3]) ### insert the twin one
            #print "inserting  " ,newEdges[3].ID
            if newEdges[1].isValid == True:
                self.edges.insert(edgeReplaceIndex+2,newEdges[1]) ### insert the twin one
            #print "inserting  " ,newEdges[1].ID
            
            self.edges.remove(targetEdge)  ### remove the old one
            
            ### STEP5

            currEDict.pop(targetEdge.ID)
            #if targetEdge.twin !=None:
                #currEDict.pop(targetEdge.twin.ID)
            
            
        ### Accessibility
        def CheckAccessibility_Naked(self):
            for edge in self.edges:
                if edge.naked ==True:
                    self.accessible = True
                    #self.roads.append(edge)
                    self.roadIDs.append(edge.ID)
            

        ### temporary  
        def CombineSide_Old(self,EDict_All):
            sides = self.sides
            changeIndices = []
            for sideIndex in range(len(sides)):
                currSide = sides[sideIndex]
                thisEdge = EDict_All[currSide[0]]
                ancestorEdgeID = thisEdge.FindAncestorEdgeID(EDict_All)
                
                if ancestorEdgeID == 1 or ancestorEdgeID == 2:
                    changeIndices.append(sideIndex)
            
            if len(changeIndices) == 2:
                removedSide = sides[changeIndices[1]]
                sides.remove(removedSide)
                sides[changeIndices[0]].extend(removedSide)
        
            self.sides = sides   
             
        def CombineSide(self,EDict_All,sameSideList):
            #print sameSideList
            #print "sides", self.sides
            sides = self.sides
            newSides = []
            sameSideCollection = {}
            for sideIndex in range(len(sides)):
                currSide = sides[sideIndex]
                
                ### check the first edge
                thisEdge = EDict_All[currSide[0]]
                ancestorEdgeID = thisEdge.FindAncestorEdgeID(EDict_All)
                
                for i in range(len(sameSideList)):
                    sameSide = sameSideList[i]
                    if ancestorEdgeID in sameSide:
                        sameSideIndex = i
                        if sameSideIndex not in sameSideCollection.keys():
                            sameSideCollection[sameSideIndex] = []
                            sameSideCollection[sameSideIndex].append(thisEdge.ID)
                            newSides.append(sameSideCollection[i])
                            
                        elif sameSideIndex  in sameSideCollection.keys():
                            sameSideCollection[sameSideIndex].append(thisEdge.ID)
                            
                        break 
                else:
                    newSides.append(currSide)
            
            self.sides = newSides
            #print "new sides", self.sides
            # print "sameSideList",sameSideList
            # print "before self.sides",self.sides
            # for sameSide in sameSideList:
                
            #     sides = self.sides
            #     changeIndices = []
                
                
                
            #     for sideIndex in range(len(sides)):
            #         currSide = sides[sideIndex]
            #         thisEdge = EDict_All[currSide[0]]
            #         ancestorEdgeID = thisEdge.FindAncestorEdgeID(EDict_All)
                    
            #         if ancestorEdgeID in sameSide:
            #             changeIndices.append(sideIndex)
                
                
            #     print "changeIndices",changeIndices
            #     if len(changeIndices) >= 2:
            #         for i in range(1,len(changeIndices),1):
            #             print "changeIndices[i]",changeIndices[i]
            #             removedSide = sides[changeIndices[i]]
            #             # sides.remove(removedSide)
            #             # print "remove",removedSide
            #             sides[changeIndices[0]].extend(removedSide)
            #             print sides[changeIndices[0]], "extend",removedSide

            #     print "now self.sides",self.sides
            #     self.sides = sides    

            # print "after self.sides",self.sides
            # print "---------"
    ##########################
    ###    Inaccessible    ### 
    ##########################
    #@staticmethod
    #def MarkInaccessibleEdges(self,indices):
        #for inaccessibleIndex in indices:
            #self.edges[inaccessibleIndex].accessibility = False
# ---------- end ghpython_script_3 ----------
ghpython_script_4 = GhPythonScript()  # -> out, SPF
# ---------- ghpython_script_4: Python ----------
###########################
####    Import Libs    ####
###########################
import Rhino.Geometry as rg
#import Rhino.RhinoDoc as rd
import Rhino.RhinoMath as rm
import Rhino.RhinoApp as ra

from collections import deque 
import Queue
import math

class SPF:
    ######################################
    ####            Debug           ####
    ######################################
    @staticmethod 
    def PrintCurrQAddress(currQ):
        address = []
        for node in currQ:
            address.append(id(node))
        print (address)

    @staticmethod 
    def PrintDictionaryAddress(redirectMap):
        collection = []
        for key in redirectMap:
            collection.append(str(id(key))+":"+str(id(redirectMap[key])))

        print (collection)

    @staticmethod 
    def PrintDictionaryAddress_VPE(dict):
        collection = []
        for key in dict:

            collection.append(str(key)+":"+str(id(dict[key])))
        print (collection)
            
    @staticmethod 
    def PrintCurrNodeNeighbors(currNode):
        ids = []
        for neighbor in currNode.neighbors:
            ids.append(id(neighbor))
        print (ids)
    
    @staticmethod
    def PrintThisNodeP_E(Node):
        print ("this Node address: "), id(Node),
        for key in Node.mutualP_E.keys():
            print ("this neighbor address: "), id(key), ("this edge address: "), id(Node.mutualP_E[key]), ("this edge ID: "), Node.mutualP_E[key].ID

    @staticmethod
    def PrintThisNodeE_P(Node):
        print ("this Node address: "), id(Node),
        for key in Node.mutualE_P.keys():
            print ("this edge address: "), id(key),("this edge ID: "),key.ID , ("this neighbor address: "), id(Node.mutualE_P[key])
            
    @staticmethod         
    def PrintAllEdgeIDinCurrQ(currQ):
        IDs = []
        for node in currQ:
             edges =    node.edges
             for edge in edges:
                 if edge.ID not in  IDs:
                        IDs.append(edge.ID)
        
        print (IDs)
        
    @staticmethod 
    def PrintAllNodesAddress(root):
        address = []
        if(root==None):
            return
    
        queue =Queue.Queue()
        queue.put(root)
        
        while (queue.empty()!=True):
            node = queue.get()
            address.append(id(node))
            
            if (node.child_A != None ):
                queue.put(node.child_A)
            
            if (node.child_B != None ):
                queue.put(node.child_B) 
            
            if (node.child_C != None ):
                queue.put(node.child_C) 
        
        print(address)    
    
    @staticmethod 
    def PrintAllNodesAlive(root):
        alives = []
        if(root==None):
            return
    
        queue =Queue.Queue()
        queue.put(root)
        
        while (queue.empty()!=True):
            node = queue.get()
            alives.append(node.alive)
            
            if (node.child_A != None ):
                queue.put(node.child_A)
            
            if (node.child_B != None ):
                queue.put(node.child_B) 
            
            if (node.child_C != None ):
                queue.put(node.child_C) 
        
        print(alives)    
        
    @staticmethod 
    def CheckRedirectParentChildren(redirectMap,currQ,p0):
        print ("CurrRedirectMap:")
        SPF.PrintDictionaryAddress(redirectMap)
        print ("CurrQAddress:")
        SPF.PrintCurrQAddress(currQ)
        
        print ("before Redirection:")
        SPF.PrintAllNodesAddress(p0)
        ##############SPF.RedirectParentChildren(currQ,redirectMap)   replace
        print ("after Redirection:")
        SPF.PrintAllNodesAddress(p0)
        
    @staticmethod 
    def PrintThisDepthNodeAddrss(collection):
        address = []
        for node in collection: 
            address.append(id(node))
        
        print (address)

    @staticmethod 
    def PrintThisDepthNodeAlive(collection):
        alives = []
        for node in collection: 
            alives.append(node.alive)
        
        print (alives)
  
  
    @staticmethod
    def PrintNeighborInfo(node):

        neighbors = node.neighbors
        address_neighbors = []
        for n in neighbors:
            address_neighbors.append(id(n))
        
        print (id(node)),address_neighbors   
        mutualE_P = node.mutualE_P
        # print ("printing mutualE_P")
        # for key in mutualE_P:
        #     print (key.ID), ":", id(mutualE_P[key])
        # print ("--------------------------------------------")
        # print ("printing mutualP_E")
        mutualP_E = node.mutualP_E
        for key in mutualP_E:
            
            print (id(key)), ":", mutualP_E[key].ID
    
    @staticmethod
    def TraversePrintNeighbor(root):
        
        if(root==None):
            return
    
        queue =Queue.Queue()
        queue.put(root)
        
        while (queue.empty()!=True):
            node = queue.get()
            neighborsAddress = []
            if node.neighbors!=[]:
                for i in range(len(node.neighbors)):
                    neighborsAddress.append(id(node.neighbors[i]))
                    
            if node.neighbors!=[]:        
                print ("this node ID: "),id(node),"its neighbors:",neighborsAddress
                
            else:
                print ("this node ID: "),id(node),"no neighbors"
            
                    
            if (node.child_A != None ):
                queue.put(node.child_A)
            
            if (node.child_B != None ):
                queue.put(node.child_B) 
                
            if (node.child_C != None ):
                queue.put(node.child_C) 
        
    @staticmethod 
    def PrintThisVPDepth(thisVP,collection_VP):
        depth = []
        for i in range(len(collection_VP)):
            if thisVP in collection_VP[i].values():
                depth.append(i)
        
        print (depth)
        
    @staticmethod 
    def PrintThisEDepth(thisE,collection_E):
        depth = []
        for i in range(len(collection_E)):
            if thisE in collection_E[i].values():
                depth.append(i)
        
        print (depth)     
    

    @staticmethod
    def CheckCurrQDepth(currQ):
        depths = []
        for node in currQ:
            depths.append(node.depth)   
        print (depths) 
           
    @staticmethod
    def CheckCurrQAlives(currQ):       
        alives = []
        for node in currQ:
            alives.append(node.alive)   
        print (alives) 
   
   

    ######################################
    ####            PreView           ####
    ######################################
    @staticmethod
    def ShowCurrPts(currVP_Dict):
        pts=[]
        
        keys = currVP_Dict.Keys
        for ID in keys:
            pts.append(currVP_Dict[ID].geometry)
            
        indices = []
        for ID in keys:
            indices.append(currVP_Dict[ID].ID)
        return pts,indices
    
    @staticmethod
    def ShowCurrEdge(currE_Dict):
        edges=[]
        
        keys = currE_Dict.Keys

        
        for ID in keys:
            edges.append(currE_Dict[ID].GetGeometry())
            
        indices = []
        for ID in keys:
            indices.append(currE_Dict[ID].ID)
        return edges,indices
    
    @staticmethod
    def ShowCurrParcFace(currQ):
        parcels = []
        address = []
        for node in currQ:
            parcels.append(node.GetGeometry())
            address.append(id(node))
        
        return parcels,address
    
    
    ############################################################################
    ####            Import Chekcing to ensure the address correct           ####
    ############################################################################
    @staticmethod 
    def CheckIfEdgeCorrect(currQ,currE_Dict):
        EInstances = [] 
        for parcFace in currQ:
            temp = parcFace.GetEInstance()
            EInstances.extend(temp)
            
        EInstances = set(EInstances)
        
        new_Dict = {}
        for edge in EInstances:
            new_Dict[edge.ID]=edge
            
        #print ("currEdict"),
        #SPF.PrintDictionaryAddress_VPE(currE_Dict)
        #print ("edges in currQ"),
        #SPF.PrintDictionaryAddress_VPE(new_Dict)
        
        ### some becomes invalid, need to reduce the num
        currE_Dict_Counter = 0
        for key in currE_Dict.keys():
            if currE_Dict[key].isValid ==True:
                currE_Dict_Counter +=1

        if currE_Dict_Counter!= len(new_Dict.keys()):
            print ("currE_Dict_Counter"),currE_Dict_Counter
            print ("len(new_Dict.keys())"),len(new_Dict.keys())

            edgeIDinQ = []

            for pF in currQ:
                for edge in pF.edges:
                    edgeIDinQ.append(edge)

            for edge in edgeIDinQ:
                if edge.isValid == False:
                    print (edge.ID)
                    print (edge.startVertex.geometry)
                    print (edge.endVertex.geometry)
     

            return False
        else :
            return True

    @staticmethod
    def CheckIfCurrQNeighborsInCurrQ(currQ):
        tag = None
        currQIDs = []
        for node in currQ:
            currQIDs.append(id(node))
            
        for node in currQ:
            ids = []
            for neighbor in node.neighbors:
                ids.append((id(neighbor)))
            for ID in ids:
                if ID not in currQIDs:
                    print ("this node : "), id(node),"'s neigbor not in currQ, ", "id: ",ID
                    tag =1
        if tag ==1:
            return False
        else:
            return True
    
    @staticmethod
    def CheckIfAllNodesDead(currQ):
        checkAlive = []
        for node in currQ:
            checkAlive.append(node.alive)
        if True not in checkAlive:
            return True
        else:
            return False

    @staticmethod
    def CheckIfP_EAndE_PCorrect(currQ):
        tag = 0
        for node in currQ:
            ### check if num are the same
            numNeighbor = len(node.neighbors)
            numP_E = len(node.mutualP_E.keys())
            numE_P = len(node.mutualE_P.keys())
            
            if numNeighbor == numP_E and numP_E == numE_P and numE_P == numNeighbor:
                pass
            else:
                print ("numNeighbor,numP_E,numE_P"),numNeighbor,numP_E,numE_P
                tag = 1
                SPF.PrintThisNodeE_P(node)
                SPF.PrintThisNodeP_E(node)
                
        if tag == 0:
            return True
        elif tag == 1:
            return False
    
    
    ######################################
    ####            SpeedUp           ####
    ######################################
    @staticmethod
    def KillNodesInAdvance(currQ,minArea):
        for node in currQ:
            if node.alive == True:
                parcelGeo = node.GetGeometry()
                if rg.AreaMassProperties.Compute(parcelGeo.ToPolylineCurve()).Area < 2*minArea:
                    node.alive == False
                        
    
    ######################################
    ####          Tree Data           ####
    ######################################
    @staticmethod
    def InsertValue(splitResult,newTriangleSize,Q,currQ_Dict):
        
        thisNode = Q[0]
        parcel_A = splitResult[0]
        parcel_B = splitResult[1]
        
        parcel_A.triangleSize = newTriangleSize
        parcel_B.triangleSize = newTriangleSize
        
        # The left child of the current Node is used if its available
        if thisNode.child_A == None:
            thisNode.child_A = parcel_A
            thisNode.child_A.parent=thisNode
            
            
            thisNode.child_A.depth = thisNode.child_A.parent.depth+1
            Q.append(parcel_A)
            
        if thisNode.child_B == None:
            thisNode.child_B = parcel_B
            thisNode.child_B.parent=thisNode
            thisNode.child_B.depth = thisNode.child_B.parent.depth+1
            Q.append(parcel_B)
        

        # print ("A")
        # for pt in parcel_A.GetGeometry():
        #     print (pt.X),",",(pt.Y),",",(pt.Z)
        # print ("B")
        # for pt in parcel_B.GetGeometry():
        #     print (pt.X),",",(pt.Y),",",(pt.Z)
        #succeed and pop  
        Q.popleft()
        currQ_Dict.pop(thisNode.ID)
        
        #parcel_A.CheckAccessibility_Naked()
        #parcel_B.CheckAccessibility_Naked()

    @staticmethod
    def InsertValueAndFindRoad(RF,splitResult,newTriangleSize,Q,currR_Dict,currE_Dict_All,roadFindingThreshold):
        
        thisNode = Q[0]
        parcel_A = splitResult[0]
        parcel_B = splitResult[1]
        
        parcel_A.triangleSize = newTriangleSize
        parcel_B.triangleSize = newTriangleSize
        
        # The left child of the current Node is used if its available
        if thisNode.child_A == None:
            thisNode.child_A = parcel_A
            thisNode.child_A.parent=thisNode
            
            
            thisNode.child_A.depth = thisNode.child_A.parent.depth+1
            Q.append(parcel_A)
            
        if thisNode.child_B == None:
            thisNode.child_B = parcel_B
            thisNode.child_B.parent=thisNode
            thisNode.child_B.depth = thisNode.child_B.parent.depth+1
            Q.append(parcel_B)
        

        # print ("A")
        # for pt in parcel_A.GetGeometry():
        #     print (pt.X),",",(pt.Y),",",(pt.Z)
        # print ("B")
        # for pt in parcel_B.GetGeometry():
        #     print (pt.X),",",(pt.Y),",",(pt.Z)
        #succeed and pop  
        Q.popleft()
        
        #############   Find Road   #############
                
        #parcel_A.CheckAccessibility_Naked()
        #parcel_B.CheckAccessibility_Naked()
        RF.DoRoadFindForTwoNewParcels(parcel_A,parcel_B,currR_Dict,currE_Dict_All,roadFindingThreshold)

    @staticmethod
    def FindTheBottomElements_LevelOrder(root):
        
        bottomElements = []
        if(root==None):
            return
        
        queue =Queue.Queue()
        queue.put(root)
        
        while (queue.empty()!=True):
            node = queue.get()
            #print (node)
            if node.child_A == None and node.child_B == None and node.child_C == None:
                bottomElements.append(node)
            
            if (node.child_A != None ):
                queue.put(node.child_A)
            
            if (node.child_B != None ):
                queue.put(node.child_B)
                
            if (node.child_C != None ):
                queue.put(node.child_C)
                
        return bottomElements

    @staticmethod
    def FindTheBottomElements_LevelOrder_Q(root):
        
        bottomElements = deque()
        if(root==None):
            return
        
        queue =Queue.Queue()
        queue.put(root)
        
        while (queue.empty()!=True):
            node = queue.get()
            if node.child_A == None and node.child_B == None and node.child_C == None:  
                bottomElements.append(node)
            
            if (node.child_A != None ): 
                queue.put(node.child_A)
            
            if (node.child_B != None ):
                queue.put(node.child_B)
                
            if (node.child_C != None ):
                queue.put(node.child_C)
                
        return bottomElements
        
    @staticmethod
    def CheckNeighbor(thisParcFace, comparedParcFace):
        c_Edges = comparedParcFace.edges
        this_Edges =thisParcFace.edges

        for edge in this_Edges:
            
            
            if edge.twin in c_Edges:   #edge in c_Edges or 
                thisParcFace.neighbors.append(comparedParcFace)
                comparedParcFace.neighbors.append(thisParcFace)
                
                thisParcFace.mutualP_E[comparedParcFace] = edge
                thisParcFace.mutualE_P[edge] = comparedParcFace
                
                comparedParcFace.mutualP_E[thisParcFace] = edge.twin
                comparedParcFace.mutualE_P[edge.twin] = thisParcFace
                break
    
    @staticmethod
    def RemoveInvalidNeighbor(thisParcFace,currQ):
        #print ("IN RemoveInvalidNeighbor")
       # print ("should remove "),id(thisParcFace)
        for node in currQ:
            #print ("node:"),id(node)
            #print ("thisnode's neighbor"), SPF.PrintCurrNodeNeighbors(node)
            if thisParcFace in node.neighbors:
                # remove from neighbors
                node.neighbors.remove(thisParcFace)

                # remove from mutualE_P,mutualP_E
                removedE = node.mutualP_E[thisParcFace]
                removedP = thisParcFace
                
                #print ("this Node address"), id(node)
                #print ("removedE "),"address: ",id(removedE),"ID: ",removedE.ID,("removedP"),id(removedP)
                
                try:
                    if node.mutualE_P[removedE] == removedP:   ### because RedirectNeigbor might have updated this dict!!!
                        node.mutualE_P.pop(removedE)
                
                except:
                    print ("mutualE_P.")
                    SPF.PrintThisNodeE_P(node)
                    print ("mutualP_E.")
                    SPF.PrintThisNodeP_E(node)
                    print ("mistake in RemoveInvalidNeighbor")
                    print (node.mutualP_E[removedP])
                    print ("thisnode's neighbor"), SPF.PrintCurrNodeNeighbors(node)
                    print ("currNode Address"), SPF.PrintCurrQAddress(currQ)
                
                node.mutualP_E.pop(removedP)
                #print (node.mutualE_P)
                #print (node.mutualP_E)
                

    
    @staticmethod
    def TraverseCollectAllNodes(root):
        allNodes = []
        if(root==None):
            return
    
        queue =Queue.Queue()
        queue.put(root)
        
        while (queue.empty()!=True):
            node = queue.get()
            allNodes.append(node)
            
                    
            if (node.child_A != None ):
                queue.put(node.child_A)
            
            if (node.child_B != None ):
                queue.put(node.child_B) 
                
            if (node.child_C != None ):
                queue.put(node.child_C)     
                
        return allNodes
         
    ######################################
    ####           DeepCopy           ####
    ######################################
    @staticmethod
    def GetDeepCopyDict_VP_Old(currQ):
        VPInstances = [] 
        for parcFace in currQ:
            temp = parcFace.GetVPInstance()
            VPInstances.extend(temp)
            
        VPInstances = set(VPInstances)
        
        
        new_Dict = {}
        for item in VPInstances:
            new_Dict[item.ID] = item.DeepCopy()
        return new_Dict
    

    @staticmethod
    def GetDeepCopyDict_VP(oldPV_Dict):
        VPInstances = oldPV_Dict.values()
        new_Dict = {}
        for vp in VPInstances:
            new_Dict[vp.ID] = vp.DeepCopy()
        return new_Dict

    @staticmethod
    def GetDeepCopyDict_E_All(newVPDict,oldEDict_All):
        EInstances = oldEDict_All.values()
        new_Dict = {}
        for edge in EInstances:
            new_Dict[edge.ID] = edge.DeepCopy(newVPDict)


        for key in new_Dict:
            if new_Dict[key].twinID!=None:
                new_Dict[key].twin = new_Dict[new_Dict[key].twinID]   
                
        ### update Side info
        
                
        return new_Dict
    

    @staticmethod
    def GetDeepCopyDict_E(oldEDict, newEdict_All):
        new_Dict = {}
        for key in oldEDict.keys():
            new_Dict[key] = newEdict_All[key]

        return new_Dict


    @staticmethod
    def GetDeepCopyDict_E_Old(currQ,newVPDict,collection_E):
        EInstances = [] 
        for parcFace in currQ:
            temp = parcFace.GetEInstance()
            EInstances.extend(temp)
            
        EInstances = set(EInstances)

        
        new_Dict = {}
        for edge in EInstances:
            new_Dict[edge.ID] = edge.DeepCopy(newVPDict)
            
            
        #RedirectToTwinEdge
        #for key in new_Dict:
            #print key
            #if new_Dict[key].twinID!=None:
                #print key,new_Dict[key].twinID
            
        for key in new_Dict:
            
            if new_Dict[key].twinID!=None:
                try:
                    new_Dict[key].twin = new_Dict[new_Dict[key].twinID]
                    
                except:
                    print ("something wrong with GetDeepCopyDict_E")
                    #print ("this is the new E Dict")
                    #print (new_Dict)
                    print (key),"is finding twinID",new_Dict[key].twinID
                    for parcFace in currQ:
                        Es = parcFace.GetEInstance()
                        for edge in Es:
                            if edge.ID == key: 
                                print ("thisNodeAddress: "), id(parcFace)
                                print ("thisNode's parent Address: "), id(parcFace.parent)
                                print ("thisNodeDepth: "), parcFace.depth
                                #allVP = parcFace.GetVPInstance()
                                #for vp in allVP:
                                    #print (vp.geometry)
                                #print ("thisEdgeStart: "), edge.startVertex.geometry,("thisEdgeEnd: "), edge.endVertex.geometry
                                SPF.PrintCurrQAddress(currQ)
                                depths = []
                                for node in currQ:
                                    depths.append(node.depth)   
                                print (depths) 
                                alives = []
                                for node in currQ:
                                    alives.append(node.alive)   
                                print (alives) 
                                print (parcFace.situation   )
                                print ("currEdict")
                                SPF.PrintDictionaryAddress_VPE(collection_E[-1])
                                print ("newEdict by Einstances")
                                SPF.PrintDictionaryAddress_VPE(new_Dict)
                                #print (parcFace.startPt.geometry    )
                                
                                
                    return ("something happens")
                else:
                    pass
                    
            
        return new_Dict
    


    @staticmethod
    def GetDeepCopyParcFace(currQ,newVPDict,newEDict,redirectMap):
    
        newParcFaces = []
        for parcFace in currQ:
            newParcFaces.append(parcFace.DeepCopy(newVPDict,newEDict))
            
        for i in range(len(newParcFaces)):
            #insert both key:value and value:key
            redirectMap[newParcFaces[i]] = currQ[i] 
            redirectMap[currQ[i]] = newParcFaces[i]
        # this is for the working space
        
        return newParcFaces
    
    @staticmethod
    def GetDeepCopyParcFace_Q(currQ,newVPDict,newEDict,newE_Dict_All,redirectMap):
        
        newParcFaces = deque()
        
        #print "currQ",currQ
        #print ("in GetDeepCopyParcFace_Q")
        for parcFace in currQ:
            newParcFace = parcFace.DeepCopy(newVPDict,newEDict,newE_Dict_All)
            #if newParcFace.alive == False:
               # newParcFace.depth = newParcFace.depth +1
            #print ("the solution node, "),id(parcFace), ("copy to a new working node "),id(newParcFace)
            newParcFaces.append(newParcFace)
            
        for i in range(len(newParcFaces)):
            #insert both key:value and value:key
            redirectMap[newParcFaces[i]] = currQ[i] 
            redirectMap[currQ[i]] = newParcFaces[i]
        
        #print "newCOpy",newParcFaces
        #print "redirectMap",redirectMap
        # this is for the working space
        return newParcFaces
    
    @staticmethod
    def GetDeepCopyParcFace_Dict(currQ):
        currQ_Dict_new = {}
        for parcF in currQ:
            currQ_Dict_new[parcF.ID] = parcF
        return currQ_Dict_new
    
    
    ######################################
    ####           Redirect           ####
    ######################################
    @staticmethod
    def RedirectParentChildren(currQ,redirectMap):
        #print ("in RedirectParentChildren")
        for parcFace in currQ:
            ### If this is a dead node, let the origianl node become its parent, depth has +1 already
            if parcFace.alive == False:
                # print ("In RedirectParentChildren treating this node:" ,id(parcFace))
                # print ("before, this node's parent is :" ,id(parcFace.parent))
                # print ("identity: "),parcFace.identity
                
                if parcFace.identity =="A":
                    parcFace.parent = parcFace.parent.child_A
                    
                elif parcFace.identity =="B":
                    parcFace.parent = parcFace.parent.child_B
                
                elif parcFace.identity =="C":
                    parcFace.parent = parcFace.parent.child_C
                
                parcFace.identity = "C"    
                #print ("after, this node's parent is :" ,id(parcFace.parent))
                ### No Matter A or B , just attach to A    
                parcFace.parent.child_C = parcFace    

        
    ###redirect the parcFaces to find the real parents

            elif parcFace.alive == True:
                #print ("inCurrQ before:"),id(parcFace), "'s parent is : ", id(parcFace.parent)
                if parcFace.parent!=None:
                    #rediect parent
                    parcFace.parent  = redirectMap[parcFace.parent]
                    #print ("inCurrQ now:"),id(parcFace), "'s parent is : ", id(parcFace.parent)
                    #rediect children
                    
                    if parcFace.identity =="A":
                        parcFace.parent.child_A = parcFace
                    
                    elif parcFace.identity =="B":
                        parcFace.parent.child_B = parcFace

    @staticmethod
    def RedirectNeighbors(currQ,newEDict,redirectMap):
        ### this is after deepcopy all the parcFaces in this depth
        ### redirect the parcFaces to find the real parents
        
        ### correct the parcFace's neighbors, let them point to current DeepCopy parcFace
        ### correct each parcFace's mutualE, let them point to current DeepCopy Edge 
        
        for parcFace in currQ:
            
            # update the "neighbors" 
            for i in range(len(parcFace.neighbors)):
                thisNeighbor = parcFace.neighbors[i] 
                parcFace.neighbors[i] = redirectMap[thisNeighbor]
                #print ("before redirection:"),id(parcFace),"'s neighbor is :",id(thisNeighbor)
                #print ("after redirection:"),id(parcFace),"'s neighbor is :",id(redirectMap[thisNeighbor])  
                
                 
            # update the "mutualP_E" 
            for key in parcFace.mutualP_E.Keys:
                edgeID = parcFace.mutualP_E[key].ID
                newMutualEdge = newEDict[edgeID]
                
                newParcFace = redirectMap[key]
                
                # add the new map
                parcFace.mutualP_E[newParcFace]=newMutualEdge
                
                # del the old one
                parcFace.mutualP_E.pop(key)
            
            # update the "mutualE_P" 
            for key in parcFace.mutualE_P.Keys:
                edgeID = key.ID
                newMutualEdge = newEDict[edgeID]
                
                newParcFace = redirectMap[parcFace.mutualE_P[key]]

                # add the new map
                parcFace.mutualE_P[newMutualEdge]=newParcFace
                
                # del the old one
                parcFace.mutualE_P.pop(key)

    @staticmethod
    def GetAffectedParcFace(parcFace,startEdge,endEdge,p0,collection_F,currQ,redirectMap):
        # get this parcFace's neighbors
        
        allNeighbors= parcFace.neighbors
        
        start_PF = None
        end_PF = None
        
        try:
            for neighbor in allNeighbors:
                if neighbor.mutualP_E[parcFace] == startEdge or neighbor.mutualP_E[parcFace] == startEdge.twin:
                    start_PF=neighbor
                    break

        except:
            print ("something wrong in GetAffectedParcFace")
            print ("this node(later be removed) depth:"),parcFace.depth, ("this (later be removed) address:"),id(parcFace)
            print ("this neighbor depth:"),neighbor.depth, ("this neighbor address:"),id(neighbor)
            print ("currQ ")
            SPF.PrintCurrQAddress(currQ)
            print ("this neighbor info ")
            SPF.PrintNeighborInfo(neighbor)
            SPF.CheckIfCurrQNeighborsInCurrQ(currQ)
            SPF.PrintDictionaryAddress(redirectMap)
            for i in range(len(collection_F)):
                print ("ThisDepth address")
                SPF.PrintThisDepthNodeAddrss(collection_F[i])
                SPF.PrintThisDepthNodeAlive(collection_F[i])
            return "something happens"
        else:
            pass
        
        try:
            for neighbor in allNeighbors:
                if neighbor.mutualP_E[parcFace] == endEdge or neighbor.mutualP_E[parcFace] == endEdge.twin:
                    end_PF=neighbor
                    break
            
        except:
            print ("something wrong in GetAffectedParcFace")
            print ("this node depth:"),parcFace.depth, ("this node address:"),id(parcFace)
            print ("this neighbor depth:"),neighbor.depth, ("this neighbor address:"),id(neighbor)
            print ("currQ ")
            SPF.PrintCurrQAddress(currQ)
            
            SPF.CheckIfCurrQNeighborsInCurrQ(currQ)
            for i in range(len(collection_F)):
                print ("ThisDepth address")
                SPF.PrintThisDepthNodeAddrss(collection_F[i])
            return "something happens"
        else:
            pass
            
        # if start_PF != None:
        #     start_PF.situation = 1
            
        # if end_PF != None:
        #     end_PF.situation = 1
            
        return start_PF,end_PF

    @staticmethod
    def GetAffectedParcFace_Constrained(parcFace,endEdge,p0,collection_F,currQ,redirectMap):
        # get this parcFace's neighbors
        
        allNeighbors= parcFace.neighbors

        end_PF = None
        
        for neighbor in allNeighbors:
            try:
                if neighbor.mutualP_E[parcFace] == endEdge or neighbor.mutualP_E[parcFace] == endEdge.twin:
                    end_PF=neighbor
                    break
            except:
                print ("something wrong in GetAffectedParcFace")
                print ("this node depth:"),parcFace.depth, ("this node address:"),id(parcFace)
                print ("this neighbor depth:"),neighbor.depth, ("this neighbor address:"),id(neighbor)
                print ("currQ ")
                SPF.PrintCurrQAddress(currQ)
                SPF.PrintDictionaryAddress(redirectMap)
                SPF.CheckIfCurrQNeighborsInCurrQ(currQ)
                for i in range(len(collection_F)):
                    print ("ThisDepth address")
                    SPF.PrintThisDepthNodeAddrss(collection_F[i])
        
                
          
                return "something happens"  
            else:
                pass
        if end_PF != None:
            end_PF.situation = 1
            
        return end_PF


    @staticmethod
    def StoreAffectedPoint(parcFace,streamline):
        #tol = rd.ActiveDoc.ModelAbsoluteTolerance
        tol = 0.001
        sl_Geo = streamline.GetGeometry().ToPolylineCurve()
        parcel_Geo = parcFace.GetGeometry().ToPolylineCurve()
        
        pt = rg.Intersect.Intersection.CurveCurve(sl_Geo,parcel_Geo,tol,tol).Item[0].PointA
        parcFace.startPt = pt
       


    ######################################
    ####      Geometry Processing     ####
    ######################################
    @staticmethod
    def DetectLocation(parcFace,streamline):
        
        
        #tol = rd.ActiveDoc.ModelAbsoluteTolerance
        tol = 0.01 # simplify with cause discrepancy, so this one is set bigger 
        currEdges = parcFace.edges
        
        
        #SPF.HitBoundary(parcFace,streamline,10)
        
        ############### detect startpoint and endpoint location ###############
        
        ###first round locate
        ###locate edge
        startEdge=None
        endEdge=None
        startEdgeIndex=None
        endEdgeIndex=None
        startSplitPointPair=[]
        endSplitPointPair=[]
    
        for i in range(len(currEdges)):
            # for edge in currEdges:
            #     for pt in edge.GetGeometry():
            #         print pt.X,pt.Y,0
            #     print "-----"   
            if startEdge==None:
                closestPt = currEdges[i].GetGeometry().ClosestPoint(streamline.startVertex.geometry)
                # print "streamline.startVertex.geometry"
                # print streamline.startVertex.geometry.X,streamline.startVertex.geometry.Y,0
                # print "closestPt"
                # print closestPt.X,closestPt.Y,0
                if closestPt.DistanceTo(streamline.startVertex.geometry) <=tol: #tol a bit weird here , so i change it to value
                    #print closestPt.DistanceTo(streamline.startVertex.geometry) 
                    startEdge=currEdges[i]
                    startEdgeIndex = i
                
            if endEdge==None:
                # print "streamline.endVertex.geometry"
                # print streamline.endVertex.geometry.X,streamline.endVertex.geometry.Y,0
                # print "closestPt"
                # print closestPt.X,closestPt.Y,0
                closestPt = currEdges[i].GetGeometry().ClosestPoint(streamline.endVertex.geometry)
                #print closestPt.DistanceTo(streamline.endVertex.geometry)
                if closestPt.DistanceTo(streamline.endVertex.geometry) <=tol:
                    endEdge=currEdges[i]
                    endEdgeIndex = i
                    
            if startEdge and endEdge:
                break
                
        #######################
        ####  Normal  case ####
        #######################
        if startEdgeIndex!=endEdgeIndex:
            flag=0  # to check if its special case 
            #classify the startEdge and endEdge to 1st touch egde and 2nd touch edge

            if startEdgeIndex>endEdgeIndex:
                streamline.Reverse()
                
                temp=startEdgeIndex
                startEdgeIndex=endEdgeIndex
                endEdgeIndex=temp
                
                temp=startEdge
                startEdge=endEdge
                endEdge=temp
            
            ####second round locate

        
            # if startEdge instance has "between points", conduct second round 
            
            try:
                if len(startEdge.betweenPoints)!=0:
                    all = startEdge.GetVPInstance()
                    
                    for i in range(len(all)-1):
    
                        segment=rg.Line(all[i].geometry,all[i+1].geometry)
                        if segment.DistanceTo(streamline.startVertex.geometry,True)<tol:   #tol a bit weird here , so i change it to value
                            
                            #print "DetectLocation" 
                            #print "hello",segment.DistanceTo(streamline.startVertex.geometry,True)
                            #print "start"
                            #print streamline.startVertex.geometry.X,streamline.startVertex.geometry.Y,0
                            #print "thisSeg"
                            #for v in all:
                                #print v.geometry.X,v.geometry.Y,0
                            startSplitPointPair=[i,i+1]
                            break
            except:
                print ("Inside DetectLocation: startEdge Error")
                for i in range(len(currEdges)):
                    closestPt = currEdges[i].GetGeometry().ClosestPoint(streamline.startVertex.geometry)
                    print (i),(closestPt.DistanceTo(streamline.startVertex.geometry)) ,"tol",tol
       
                #print ("startEdge:"), i
                #print (startEdge.startVertex.geometry.X),",",startEdge.startVertex.geometry.Y,",",startEdge.startVertex.geometry.Z
                #for point in startEdge.betweenPoints:
                   # print (point.geometry.X),",",point.geometry.Y,",",point.geometry.Z
                #print (startEdge.endVertex.geometry.X),",",startEdge.endVertex.geometry.Y,",",startEdge.endVertex.geometry.Z
                print ("(startEdgeIndex),startEdge"),(startEdgeIndex),startEdge
                print ("streamline,startVertex")
                print (streamline.startVertex.geometry.X),",",streamline.startVertex.geometry.Y,",",streamline.startVertex.geometry.Z
                
                for i in range(len(parcFace.edges)):
                    print ("edge:"), i
                    print (parcFace.edges[i].startVertex.geometry.X),",",parcFace.edges[i].startVertex.geometry.Y,",",parcFace.edges[i].startVertex.geometry.Z
                    for point in parcFace.edges[i].betweenPoints:
                        print (point.geometry.X),",",point.geometry.Y,",",point.geometry.Z
                    print (parcFace.edges[i].endVertex.geometry.X),",",parcFace.edges[i].endVertex.geometry.Y,",",parcFace.edges[i].endVertex.geometry.Z

                    
                print ("streamline")
                print (streamline.startVertex.geometry.X),",",streamline.startVertex.geometry.Y,",",streamline.startVertex.geometry.Z
                for point in streamline.betweenPoints:
                    print (point.geometry.X),",",point.geometry.Y,",",point.geometry.Z
                print (streamline.endVertex.geometry.X),",",streamline.endVertex.geometry.Y,",",streamline.endVertex.geometry.Z

   
            # if endEdge instance has "between points", conduct second round 
    
            if len(endEdge.betweenPoints)!=0:
                all = endEdge.GetVPInstance()
                for i in range(len(all)-1):
                    
                    segment=rg.Line(all[i].geometry,all[i+1].geometry)
                    if segment.DistanceTo(streamline.endVertex.geometry,True)<tol:
                        endSplitPointPair=[i,i+1]
                        break
                        
        #######################
        #### sepecial case ####
        #######################
        elif startEdgeIndex == endEdgeIndex:
            
            flag=1
            # sort the streamline order first
            comparedPosition=startEdge.startVertex.geometry
            
            streamlineStartPosition = streamline.startVertex.geometry
            streamlineEndPosition = streamline.endVertex.geometry
    
            
            distance1 = streamlineStartPosition.DistanceTo(comparedPosition)
            distance2 = streamlineEndPosition.DistanceTo(comparedPosition)
            
            if distance1 < distance2:
                streamline.Reverse()
            
    
            # in this case startedge will be split into 3 parts, which means I will store 4 indices here
            if len(startEdge.betweenPoints)!=0:
                all = startEdge.GetVPInstance()
                for i in range(len(all)-1):
                    segment=rg.Line(all[i].geometry,all[i+1].geometry)
                    if segment.DistanceTo(streamline.startVertex.geometry,True)<tol:
                        startSplitPointPair=[i,i+1]
    
            if len(endEdge.betweenPoints)!=0:
                for i in range(len(all)-1):
                    segment=rg.Line(all[i].geometry,all[i+1].geometry)
                    if segment.DistanceTo(streamline.endVertex.geometry,True)<tol:
                        endSplitPointPair=[i,i+1]
                        
        return startEdge,endEdge,startEdgeIndex,endEdgeIndex,startSplitPointPair,endSplitPointPair,flag

    @staticmethod
    def GetStartPtInfo(thisNode):
        for i in range(len(thisNode.edges)):
            edge = thisNode.edges[i]
            if edge.endVertex == thisNode.startPt:
                startPt_PrevE = edge
                startPt_PrevE_Index = i

            if edge.startVertex == thisNode.startPt:
                startPt_NextE = edge
                startPt_NextE_Index = i
        
        
        return [startPt_PrevE_Index,startPt_NextE_Index]
    
    
    @staticmethod
    def DetectLocation_Constrained(parcFace,streamline):
        #### Only Need to Detect The end
        
        #tol = rd.ActiveDoc.ModelAbsoluteTolerance
        tol = 0.01 # change because of simplification
        currEdges = parcFace.edges

        ############### detect startpoint and endpoint location ###############
        
        ###first round locate
        ###locate edge

        endEdge=None
        endEdgeIndex=None
        endSplitPointPair=[]
    
        for i in range(len(currEdges)):
                
            if endEdge==None:
                closestPt = currEdges[i].GetGeometry().ClosestPoint(streamline.endVertex.geometry)
                if closestPt.DistanceTo(streamline.endVertex.geometry) <=tol:
                    endEdge=currEdges[i]
                    endEdgeIndex = i
                    
            if endEdge:
                break


        # if endEdge instance has "between points", conduct second round 
        if len(endEdge.betweenPoints)!=0:
            all = endEdge.GetVPInstance()
            for i in range(len(all)-1):
                
                segment=rg.Line(all[i].geometry,all[i+1].geometry)
                if segment.DistanceTo(streamline.endVertex.geometry,True)<tol:
                    
                    endSplitPointPair=[i,i+1]
                        
       
        return endEdge,endEdgeIndex,endSplitPointPair
    
    
    @staticmethod
    def GetNewShare(PL,thisNode,sl,VP_Dict,E_Dict,E_Dict_All,startEdge,endEdge):
        # the new shared list order is same as the corrected streamline
        
        currVPIDs=[]
        for ID in VP_Dict.keys():
            currVPIDs.append(ID)
        currMaxVPID = max(currVPIDs)
       
        newShareList = []
        
        ### initialze streamline to parc vertex and point
        for i in range(len(sl.GetGeometry())):
            pts = sl.GetGeometry()
            if i == 0:
                newShareList.append(PL.ParcVertex(pts[0],currMaxVPID+i+1))
            elif i == len(sl.GetGeometry())-1:
                newShareList.append(PL.ParcVertex(pts[len(sl.GetGeometry())-1],currMaxVPID+i+1))
            else:
                newShareList.append(PL.ParcPoint(pts[i],currMaxVPID+i+1))
        
        ### initialze the twin parcEdge
        currEIDs=[]
        for ID in E_Dict.keys():
            currEIDs.append(ID)
            currMaxEID = max(currEIDs)
        
        newEdge = PL.ParcEdge(currMaxEID+1)
        newEdge.FillInfo(newShareList)
        newEdge_twin = newEdge.CreateTwin(newEdge.ID+1)
        
        ### store in current dict
        SPF.ExtendCurrVPDict(VP_Dict,newShareList)
        SPF.ExtendCurrEDict(E_Dict,newEdge)
        SPF.ExtendCurrEDict(E_Dict,newEdge_twin)
        SPF.ExtendCurrEDict_All(E_Dict_All,newEdge)
        SPF.ExtendCurrEDict_All(E_Dict_All,newEdge_twin)
        ### For road
        newEdge.generation = thisNode.depth + 1
        newEdge_twin.generation = thisNode.depth +1
        
        ### Check If vertex on the boundary, if so ,update "onBoundary"
        if startEdge.naked ==True:
            newEdge.startVertex.onBoundary = True
            
        if endEdge.naked ==True:
            newEdge.endVertex.onBoundary = True
        return newEdge,newEdge_twin

    @staticmethod
    def GetNewShare_Constrained(PL,thisNode,sl,VP_Dict,E_Dict,E_Dict_All):
        # the new shared list order is same as the corrected streamline
        
        currVPIDs=[]
        for ID in VP_Dict.keys():
            currVPIDs.append(ID)
        currMaxVPID = max(currVPIDs)
       
        newShareList = []
        
        ### initialze streamline to parc vertex and point
        for i in range(len(sl.GetGeometry())):
            pts = sl.GetGeometry()
            if i == 0:
                newShareList.append(thisNode.startPt)
            elif i == len(sl.GetGeometry())-1:
                newShareList.append(PL.ParcVertex(pts[len(sl.GetGeometry())-1],currMaxVPID+i))
            else:
                newShareList.append(PL.ParcPoint(pts[i],currMaxVPID+i))
        
        ### initialze the twin parcEdge
        currEIDs=[]
        for ID in E_Dict.keys():
            currEIDs.append(ID)
            currMaxEID = max(currEIDs)
        
        newEdge = PL.ParcEdge(currMaxEID+1)
        newEdge.FillInfo(newShareList)
        newEdge_twin = newEdge.CreateTwin(newEdge.ID+1)
        
        ### store in current dict
        #Before extention, remove the first exsiting one
        
        newShareList.remove(thisNode.startPt)
        SPF.ExtendCurrVPDict(VP_Dict,newShareList)
        
        SPF.ExtendCurrEDict(E_Dict,newEdge)
        SPF.ExtendCurrEDict(E_Dict,newEdge_twin)
        SPF.ExtendCurrEDict_All(E_Dict_All,newEdge)
        SPF.ExtendCurrEDict_All(E_Dict_All,newEdge_twin)


        newEdge.generation = thisNode.depth
        newEdge_twin.generation = thisNode.depth
        
        ### Check If vertex on the boundary, if so ,update "onBoundary"  -> this add outside
        
        return newEdge,newEdge_twin
        
    @staticmethod
    def ConstructNewParcel_Normal(PL,parcFace,F_Dict,VP_Dict,E_Dict,E_Dict_All,shareEdge,shareEdge_twin,startEdge,endEdge,startEdgeIndex,endEdgeIndex,startSplitPointPair,endSplitPointPair,currStreetGraph):

        p1,p2,splitEdges_Start, splitEdges_End= SPF.Construct_NormalCase(PL,parcFace,F_Dict,VP_Dict,E_Dict,E_Dict_All,shareEdge,shareEdge_twin,startEdge,endEdge,startEdgeIndex,endEdgeIndex,startSplitPointPair,endSplitPointPair,currStreetGraph)
        #fill the relationship here
        p1.identity = "A"
        p2.identity = "B"
        
        #fill neighbors relationship
        p1.neighbors.append(p2)
        p2.neighbors.append(p1)
        
        
        p1.mutualP_E[p2] = shareEdge
        p1.mutualE_P[shareEdge] = p2
        
        p2.mutualP_E[p1] = shareEdge_twin
        p2.mutualE_P[shareEdge_twin] = p1

        for edge in p1.edges:
            if edge.isValid== False:
                print ("Invalid edge error")
        for edge in p2.edges:
            if edge.isValid== False:
                print ("Invalid edge error" )

        ####for roadFinding
        
        # print "before GetSide "
        # print p1.sides
        # print p2.sides
        # p1.GetSide(E_Dict_All)
        # p2.GetSide(E_Dict_All)
        # p1.CombineSide(E_Dict_All)
        # p2.CombineSide(E_Dict_All)
    
        # print "after GetSide "
        # print p1.sides
        # print p2.sides
  
     
                 
        return p1,p2,splitEdges_Start, splitEdges_End

    @staticmethod
    def ConstructNewParcel_Special(PL,parcFace,F_Dict,VP_Dict,E_Dict,E_Dict_All,shareEdge,shareEdge_twin,startEdge,endEdge,startEdgeIndex,endEdgeIndex,startSplitPointPair,endSplitPointPair):

        p1,p2,splitEdges_Special= SPF.Construct_SpecialCase(PL,parcFace,F_Dict,VP_Dict,E_Dict,E_Dict_All,shareEdge,shareEdge_twin,startEdge,endEdge,startEdgeIndex,endEdgeIndex,startSplitPointPair,endSplitPointPair)
        #fill the relationship here
        p1.identity = "A"
        p2.identity = "B"
        
        #fill neighbors relationship
        p1.neighbors.append(p2)
        p2.neighbors.append(p1)
        
        
        p1.mutualP_E[p2] = shareEdge
        p1.mutualE_P[shareEdge] = p2
        
        p2.mutualP_E[p1] = shareEdge_twin
        p2.mutualE_P[shareEdge_twin] = p1

        for edge in p1.edges:
            if edge.isValid== False:
                print ("Invalid edge error")
        for edge in p2.edges:
            if edge.isValid== False:
                print ("Invalid edge error" ) 

        return p1,p2,splitEdges_Special

    @staticmethod
    def Construct_Constrained(PL,thisNode,F_Dict,startIndexPair,endEdgeIndex,shareEdge,shareEdge_twin,newEdges):
        
        #print "Construct_Constrained"
        #for edge in newEdges:
            #print edge.ID,edge.isValid
        numEdge = len(thisNode.edges)
        edges = thisNode.edges
        
        ### collect edges in corret order
        slice1 = []
        slice2 = []

        if endEdgeIndex>max(startIndexPair) and endEdgeIndex == numEdge-1:
            slice1.append(shareEdge)
            slice1.append(newEdges[1])
            for i in range(0,startIndexPair[1],1):
                slice1.append(edges[i]) 
            
            for i in range(startIndexPair[1],endEdgeIndex,1):
                slice2.append(edges[i]) 
            slice2.append(newEdges[0])
            slice2.append(shareEdge_twin)
        
        elif endEdgeIndex>max(startIndexPair) and endEdgeIndex != numEdge-1:
            slice1.append(shareEdge)
            slice1.append(newEdges[1])
            for i in range(endEdgeIndex+1,numEdge,1):
                slice1.append(edges[i])
            
            for i in range(0,startIndexPair[1],1):
                slice1.append(edges[i]) 
            
            for i in range(startIndexPair[1],endEdgeIndex,1):
                slice2.append(edges[i]) 
            slice2.append(newEdges[0])
            slice2.append(shareEdge_twin)
            
        elif 0 not in startIndexPair and endEdgeIndex<max(startIndexPair):
            slice1.append(shareEdge)
            slice1.append(newEdges[1])
            for i in range(endEdgeIndex+1,startIndexPair[1],1):
                slice1.append(edges[i])
            
            for i in range(startIndexPair[1],numEdge,1):
                slice2.append(edges[i])
            
            for i in range(0,endEdgeIndex,1):
                slice2.append(edges[i])
                
            slice2.append(newEdges[0])
            slice2.append(shareEdge_twin)
        
        elif 0 in startIndexPair:
            slice1.append(shareEdge)
            slice1.append(newEdges[1])
            for i in range(endEdgeIndex+1,numEdge,1):
                slice1.append(edges[i])
                
            for i in range(0,endEdgeIndex,1):
                slice2.append(edges[i])
        
            slice2.append(newEdges[0])
            
        ### construct parcels
        parcel_1=PL.ParcFace()
        parcel_1.InitializeParcFaceWithID(F_Dict)
        for edge in slice1:
            if edge.isValid == True: #VV to close
                parcel_1.AddFaceV(edge.startVertex)
                parcel_1.edges.append(edge)
        
        parcel_2=PL.ParcFace()
        parcel_2.InitializeParcFaceWithID(F_Dict)
        for edge in slice2:
            if edge.isValid == True: #VV to close
                parcel_2.AddFaceV(edge.startVertex)
                parcel_2.edges.append(edge)
            
        
        #fill the relationship here
        parcel_1.identity = "A"
        parcel_2.identity = "B"
        
        #fill neighbors relationship
        parcel_1.neighbors.append(parcel_2)
        parcel_2.neighbors.append(parcel_1)
        
        
        parcel_1.mutualP_E[parcel_2] = shareEdge
        parcel_1.mutualE_P[shareEdge] = parcel_2
        
        parcel_2.mutualP_E[parcel_1] = shareEdge_twin
        parcel_2.mutualE_P[shareEdge_twin] = parcel_1
        

        for edge in parcel_1.edges:
            if edge.isValid== False:
                print ("Invalid edge error")
        for edge in parcel_2.edges:
            if edge.isValid== False:
                print ("Invalid edge error" )

      
        
        return parcel_1,parcel_2
    
    
    
    @staticmethod
    def Construct_NormalCase(PL,parcFace,F_Dict,VP_Dict,E_Dict,E_Dict_All,shareEdge,shareEdge_twin,startEdge,endEdge,startEdgeIndex,endEdgeIndex,startSplitPointPair,endSplitPointPair,currStreetGraph):
        #print "parcFace.ID",parcFace.ID
        #print ("in Construct_NormalCase"), "startEdgeID", startEdge.ID,"endEdgeID",endEdge.ID
        #print ("shareEdge"),shareEdge.ID,shareEdge_twin.ID
        # for debugPt in endEdge.GetGeometry():
        #     print (debugPt.X),debugPt.Y,0
        #print "endEdge.parentID", endEdge.parentID

        # if endEdge.ID== 201:
        #     print "endEdge.parent"
        #     for debugPt in E_Dict_All[endEdge.parentID].GetGeometry():
        #         print (debugPt.X),debugPt.Y,0
        
        #print startEdge,endEdge,startEdgeIndex,endEdgeIndex,startSplitPointPair,endSplitPointPair
        currEdges =parcFace.edges
        #slice the vertices list into 3 segments
        slice_0=[]
        slice_1=[]
        slice_2=[]
        
        for edgeIndex in range(len(currEdges)):
            if edgeIndex < startEdgeIndex:
                slice_0.append(edgeIndex)
            
            elif edgeIndex > startEdgeIndex and edgeIndex < endEdgeIndex:
                slice_1.append(edgeIndex)
                
            elif edgeIndex > endEdgeIndex:
                slice_2.append(edgeIndex)
                
        
        
        
        slice_2.extend(slice_0)
        firstHalf = slice_2
        secondHalf = slice_1
        
        
        ############### prepare the splitEdge ###############
        splitEdges_Start = []
        splitEdges_End= []
        if startEdge.naked ==True:
            splitResult = startEdge.SplitEdge_Naked_Normal(shareEdge,shareEdge.startVertex,"start",E_Dict,E_Dict_All,VP_Dict)
            subEdge_Start_0 = splitResult[0]
            subEdge_Start_1 = splitResult[1]
            splitEdges_Start = [subEdge_Start_0,subEdge_Start_1]
            
        elif startEdge.naked == False:
            splitResult = startEdge.SplitEdge_Shared_Normal(shareEdge,shareEdge.startVertex,"start",E_Dict,E_Dict_All,VP_Dict,startSplitPointPair)
            subEdge_Start_a = splitResult[0]
            subEdge_Start_a_twin = splitResult[1]
            subEdge_Start_b = splitResult[2]
            subEdge_Start_b_twin = splitResult[3]
            splitEdges_Start = [subEdge_Start_a,subEdge_Start_a_twin,subEdge_Start_b,subEdge_Start_b_twin]
            
        if endEdge.naked ==True:
            splitResult = endEdge.SplitEdge_Naked_Normal(shareEdge,shareEdge.endVertex,"end",E_Dict,E_Dict_All,VP_Dict)
            subEdge_End_0 = splitResult[0]
            subEdge_End_1 = splitResult[1]
            splitEdges_End = [subEdge_End_0,subEdge_End_1]
            

        elif endEdge.naked == False:
            splitResult = endEdge.SplitEdge_Shared_Normal(shareEdge,shareEdge.endVertex,"end",E_Dict,E_Dict_All,VP_Dict,endSplitPointPair)
            subEdge_End_a = splitResult[0]
            subEdge_End_a_twin = splitResult[1]
            subEdge_End_b = splitResult[2]
            subEdge_End_b_twin = splitResult[3]
            splitEdges_End = [subEdge_End_a,subEdge_End_a_twin,subEdge_End_b,subEdge_End_b_twin]
            
            
        ############### construct new parcel ###############
        parcel_1=PL.ParcFace()
        parcel_1.InitializeParcFaceWithID(F_Dict)
        ########################
        ###  from streamline 
        ########################
        ### add 2 verties
        

            
        #if abs(shareEdge.endVertex.geometry.X - -12.1437911977  ) <0.01:
            #print "bug 2" , shareEdge.endVertex.ID
            #print "shareEdge.endVertex ID",shareEdge.endVertex.ID 
            #print "shareEdge address",id(shareEdge)
        #if shareEdge.startVertex not in parcel_1.vertices:  ### avoid VV to close
        parcel_1.AddFaceV(shareEdge.startVertex)
            
        #if shareEdge.endVertex not in parcel_1.vertices:  ### avoid VV to close
        parcel_1.AddFaceV(shareEdge.endVertex)
        
        ### add 1 edge
        parcel_1.edges.append(shareEdge)
        
        # print "shareEdge"
        # for pt in shareEdge.GetGeometry():
        #     print pt.X, pt.Y, 0
        ########################
        ### when it hit endEdge 
        ########################
        ### add 1 vertex 
        #if endEdge.endVertex not in parcel_1.vertices:  ### avoid VV to close
        parcel_1.AddFaceV(VP_Dict[endEdge.endVertex.ID])


        ### add 1 edge 
        if endEdge.naked ==True and subEdge_End_1.isValid == True: # VV to close,edge invalid
            parcel_1.edges.append(subEdge_End_1)
            #print '!!!!!!!!!!!!!!!!',subEdge_End_1.ID
            
        elif endEdge.naked == False and subEdge_End_b.isValid == True:
            parcel_1.edges.append(subEdge_End_b)
            #print '!!!!!!!!!!!!!!!!',subEdge_End_b.ID
            
      
        ########################
        ### from firstHalf
        ########################
        
        ### add vertices and edges
        for i in range(len(firstHalf)):
            thisEdge = currEdges[firstHalf[i]]
            #if VP_Dict[thisEdge.endVertex.ID] not in parcel_1.vertices:  ### avoid VV to close
            parcel_1.AddFaceV(VP_Dict[thisEdge.endVertex.ID])
            newEdge = E_Dict[thisEdge.ID]
            parcel_1.edges.append(newEdge)
        
        ############################
        ### when it hit startEdge
        ############################
        
        ### no need to add verteices

        if startEdge.naked ==True and subEdge_Start_0.isValid == True:
            parcel_1.edges.append(subEdge_Start_0)
            
        elif startEdge.naked == False and subEdge_Start_a.isValid == True:
            parcel_1.edges.append(subEdge_Start_a)
        
       
        ###################
        ###form parcel_2###
        ###################
        parcel_2=PL.ParcFace()
        parcel_2.InitializeParcFaceWithID(F_Dict)
        ########################
        ### when it hit startEdge
        ########################
        ### add 2 vertices 
        #if shareEdge.startVertex not in parcel_2.vertices:
        parcel_2.AddFaceV(shareEdge.startVertex)
        #if startEdge.endVertex not in parcel_2.vertices:
        parcel_2.AddFaceV(VP_Dict[startEdge.endVertex.ID])
        
        ### add 1 edge
        if startEdge.naked ==True and subEdge_Start_1.isValid == True:
            parcel_2.edges.append(subEdge_Start_1)
        elif startEdge.naked == False and subEdge_Start_b.isValid == True:
            parcel_2.edges.append(subEdge_Start_b)
    
        
        ########################
        ### from secondHalf
        ########################
        ### add vertices and edges
        for i in range(len(secondHalf)):
            thisEdge = currEdges[secondHalf[i]]
            #if VP_Dict[thisEdge.endVertex.ID] not in parcel_2.vertices:  ### avoid VV to close
            parcel_2.AddFaceV(VP_Dict[thisEdge.endVertex.ID])
            newEdge=E_Dict[thisEdge.ID]
            parcel_2.edges.append(newEdge)

            
        ########################
        ### when it hit endEdge
        ########################
        
        ### add 1 vertex
        if shareEdge.endVertex not in parcel_2.vertices:
            parcel_2.AddFaceV(shareEdge.endVertex)
    
        ### add 1 edge
        if endEdge.naked ==True and subEdge_End_0.isValid == True:
            parcel_2.edges.append(subEdge_End_0)
    
        elif endEdge.naked == False and subEdge_End_a.isValid == True:
            parcel_2.edges.append(subEdge_End_a)
        
        ########################
        ###  from streamline
        ########################

        ### no need to add vertex
        ### add 1 edge
        
        parcel_2.edges.append(shareEdge_twin)
        

        p1=parcel_1
        p2=parcel_2
        
        
        ########################
        ###  for streetGraph
        ########################
        #print "In construct for streetGraph for streetGraph for streetGraph for streetGraph,startEdge.streetID,endEdge.streetID"
        #print startEdge.streetID,endEdge.streetID,"///"
        #print "startEdge.ID,endEdge.ID",startEdge.ID,endEdge.ID
        
      
        if startEdge.streetID!=None:
            if startEdge.naked ==True :
                targetStreet,startNode,endNode,order =  currStreetGraph.CheckInsertLocation(startEdge)
                # no twin edge,must be true
                targetStreet.Insert(startNode,endNode,subEdge_Start_0,subEdge_Start_1,E_Dict)
                #print "caseA"
                
            elif startEdge.naked == False :
                #print "caseB"
                #print currStreetGraph.graph,startEdge
                targetStreet,startNode,endNode,order =  currStreetGraph.CheckInsertLocation(startEdge)
                
                if order == True:
                    #print "caseB-1"
                    #print startEdge.streetID,startEdge.ID
                    #print targetStreet.GetAllParcEdgeID()
                    #print "startNode.nextConnection.ID",startNode.nextConnection.ID,"startNode.prevConnection.ID",startNode.prevConnection
                    #print "endNode.nextConnection.ID",endNode.nextConnection.ID,"endNode.prevConnection.ID",endNode.prevConnection.ID
                    #print "endNode.next.nextConnection.ID",endNode.next.nextConnection.ID,"endNode.next.prevConnection.ID",endNode.next.prevConnection.ID
                    targetStreet.Insert(startNode,endNode,subEdge_Start_a,subEdge_Start_b,E_Dict)
                    
                elif order != True:
                    targetStreet.Insert(startNode,endNode,subEdge_Start_b_twin,subEdge_Start_a_twin,E_Dict)
                    #print "caseB-2"

            p1.accessible = True
            p2.accessible = True
            #print ("targetStreet.GetAllParcEdgeID()"), (targetStreet.GetAllParcEdgeID())
        if endEdge.streetID!=None:
            if endEdge.naked ==True :
                #print "endEdge",endEdge.ID
                targetStreet,startNode,endNode,order =  currStreetGraph.CheckInsertLocation(endEdge)
                # no twin edge,must be true
                targetStreet.Insert(startNode,endNode,subEdge_End_0,subEdge_End_1,E_Dict)
                #print "caseC"
            elif endEdge.naked == False :
                
                targetStreet,startNode,endNode,order =  currStreetGraph.CheckInsertLocation(endEdge)
                
                if order == True:
                    targetStreet.Insert(startNode,endNode,subEdge_End_a,subEdge_End_b,E_Dict)
                elif order != True:
                    targetStreet.Insert(startNode,endNode,subEdge_End_b_twin,subEdge_End_a_twin,E_Dict)
                #print "caseD"
                
            p1.accessible = True
            p2.accessible = True    
            #print ("targetStreet.GetAllParcEdgeID()"), (targetStreet.GetAllParcEdgeID())   
        # if len(currStreetGraph.graph.keys())!= 0:
        #     print ("currStreetGraph"), 
        #     print currStreetGraph.graph.keys()[0].GetAllParcEdge()
        #     currStreetGraph.graph.keys()[0].PrintGeometry()
        # for street in currStreetGraph.graph.keys():
        #     edgeID = street.GetAllParcEdgeID()
        
            # for edge in edges:
            #     print edge
            #     print edge.ID
        # print "p1,p2",parcFace.ID
        # for pt in p1.GetGeometry() :
        #     print pt.X,pt.Y,0
        
        # print "-----"
        # for pt in p2.GetGeometry() :
        #     print pt.X,pt.Y,0
    
            
        return p1,p2,splitEdges_Start,splitEdges_End
    
    @staticmethod
    def Construct_SpecialCase(PL,parcFace,F_Dict,VP_Dict,E_Dict,E_Dict_All,shareEdge,shareEdge_twin,startEdge,endEdge,startEdgeIndex,endEdgeIndex,startSplitPointPair,endSplitPointPair):
        print ("warning: a special split case")
        currEdges =parcFace.edges
        #slice the vertices list into 2 segments
        slice_0=[]
        slice_1=[]
        
        for edgeIndex in range(len(currEdges)):
            if edgeIndex < startEdgeIndex:
                slice_0.append(edgeIndex)
            
            elif edgeIndex > startEdgeIndex:
                slice_1.append(edgeIndex)
                
        slice_1.extend(slice_0)
        restIndices = slice_1
        
        
        newV_Start=shareEdge.startVertex
        ########## prepar the splitEdge ##########
        if startEdge.naked ==True and endEdge.naked ==True:
            splitEdges_Special = []
            splitResult = startEdge.SplitEdge_Naked_Special(shareEdge.startVertex,shareEdge.endVertex,E_Dict,E_Dict_All,VP_Dict)
            subEdge_0 = splitResult[0]
            subEdge_1 = splitResult[1]
            subEdge_2 = splitResult[2]
            splitEdges_Special = [subEdge_0,subEdge_1,subEdge_2]
        
        else:
            splitResult = startEdge.SplitEdge_Shared_Special(shareEdge.startVertex,shareEdge.endVertex,E_Dict,E_Dict_All,VP_Dict,startSplitPointPair,endSplitPointPair)
            subEdge_a = splitResult[0]
            subEdge_a_twin = splitResult[1]
            subEdge_b = splitResult[2]
            subEdge_b_twin = splitResult[3]
            subEdge_c = splitResult[4]
            subEdge_c_twin = splitResult[5]
            splitEdges_Special = [subEdge_a,subEdge_a_twin,subEdge_b,subEdge_b_twin,subEdge_c,subEdge_c_twin]

        ###################
        ###form parcel_1###
        ###################
        parcel_1=PL.ParcFace()
        parcel_1.InitializeParcFaceWithID(F_Dict)
        ##########################
        ###  from streamline
        ##########################
        ### add 2 verties
        parcel_1.AddFaceV(shareEdge.startVertex)
        parcel_1.AddFaceV(shareEdge.endVertex)

        ### add 1 edge
        parcel_1.edges.append(shareEdge)
        
        ##########################
        ### when it hit startEdge/endEdge
        ##########################
        if startEdge.naked ==True and endEdge.naked ==True and subEdge_1.isValid == True:
            parcel_1.edges.append(subEdge_1)
            #print ("subEdge_1"),subEdge_1.startVertex.ID
            #print ("subEdge_1"),subEdge_1.endVertex.ID
        elif startEdge.naked == False and endEdge.naked == False and subEdge_b.isValid == True:
            
            parcel_1.edges.append(subEdge_b)

        print ("finish one")
        ###################
        ###form parcel_2###
        ###################
        
        parcel_2=PL.ParcFace()
        parcel_2.InitializeParcFaceWithID(F_Dict)
        ######################################
        ### when it hit startEdge/endEdge
        ######################################
        parcel_2.AddFaceV(shareEdge.startVertex)
        parcel_2.AddFaceV(startEdge.endVertex)
        
        if startEdge.naked ==True and endEdge.naked ==True and subEdge_2.isValid == True:
            parcel_2.edges.append(subEdge_2)
        
        elif startEdge.naked == False and endEdge.naked == False and subEdge_c.isValid == True:
            parcel_2.edges.append(subEdge_c)
            
        ######################################
        ### from the restIndices
        ######################################
        for i in range(len(restIndices)):
            thisEdge = currEdges[restIndices[i]]
            parcel_2.AddFaceV(VP_Dict[thisEdge.endVertex.ID])
            newEdge = E_Dict[thisEdge.ID]
            parcel_2.edges.append(newEdge)

        ######################################
        ### when it hit startEdge/endEdge
        ######################################

        
        if startEdge.naked ==True and endEdge.naked ==True and subEdge_0.isValid == True:
            parcel_2.edges.append(subEdge_0)
        
        elif startEdge.naked == False and endEdge.naked == False and subEdge_a.isValid == True:
            parcel_2.edges.append(subEdge_a)
        
        ######################################
        ###  from streamline
        ######################################
        ### no need to add vertex
        ### add 1 edge
        
        parcel_2.edges.append(shareEdge_twin)

        parcel_1.identity = "A"
        parcel_2.identity = "B"
        
        p1=parcel_1
        p2=parcel_2
        
        return p1,p2,splitEdges_Special
    
    @staticmethod
    def ExtendCurrVPDict(currDict,newSharedList):
        for i in range(len(newSharedList)):
            currDict[newSharedList[i].ID] = newSharedList[i]
        
    @staticmethod
    def ExtendCurrEDict(currDict,newEdge):
        currDict[newEdge.ID] = newEdge
       
    @staticmethod   
    def ExtendCurrEDict_All(currDict_All,newEdge):
        currDict_All[newEdge.ID] = newEdge  
       
       
    ######################################
    ####     Streamline Selection     ####
    ######################################    
    @staticmethod   
    def GetCurrentWeight(weight,coefficient,currDepth):

        currentWeight=[]

        for i in range(len(weight)):
            currentWeight.append( round(weight[i] * math.pow(coefficient[i],currDepth),3))

        return currentWeight
    
    @staticmethod
    def StoreStreamlines(PC,DM,SLG,EV,thisNode,weight,pt,idealOrientation,resolution):
        
        ### create processMesh
        
        crv = thisNode.GetGeometry()
        processMesh = PC.ProcessMesh()
        
        ### Get the resoluion processMesh
        if thisNode.parent == None:
            useTriangleSize = resolution
            thisNode.triangleSize = resolution
            #print "case1"
        else:
            useTriangleSize = thisNode.triangleSize
            #print "case2"
        #print "its using resolution useTriangleSize" , useTriangleSize
        processMesh.InitializeInput(crv,useTriangleSize)   #length 
        
        
        ### create dataMapping
        mappingGrid = DM.MappingGrid()
        mappingGrid.CreateMappingGrid(crv,20,5)    #rows,columns 
        mappingGrid.GetOverlappedTriangleIndex(processMesh,2)  #detectRadius 
        ### create seedPoint
        
        seedpointList = SLG.SeedpointList()
        seedpointList.CreateSeedpointList(processMesh,1,1)  #reduce points onEdge, on MA
    
        ### creat streamline network instance with score
        
        newTriangleSize = processMesh.length
        
        dL = newTriangleSize
        disableDistance=newTriangleSize * 0.8
        
        streamlineNetwork=SLG.StreamlineNetwork()
    
        if weight!=None and pt == None:
            #print ("【Free】using TOP N Streamlines")
            streamlineNetwork=SLG.StreamlineNetwork()
            

            streamlines = streamlineNetwork.GetStreamlineNetwork(mappingGrid,processMesh,seedpointList,disableDistance,dL)  #disable distance, dL
            
            
            EV().GetAllScoreToInstance(SLG,mappingGrid,processMesh,streamlineNetwork,streamlines,dL,weight,idealOrientation)
            if rg.AreaMassProperties.Compute(crv.ToPolylineCurve()).Area >300:  
                sortStreamlines = EV.SortStreamlines_Overall(streamlineNetwork)
                #print ("area:"), rg.AreaMassProperties.Compute(crv.ToPolylineCurve()).Area, "sorted by Overall Score "
            else:
                sortStreamlines = EV.SortStreamlines_Parcel(streamlineNetwork)
                #print ("area:"), rg.AreaMassProperties.Compute(crv.ToPolylineCurve()).Area, "sorted by Parcel Score "
            thisNode.sortedSL = sortStreamlines
            
            #print "we get ",len(sortStreamlines), "streamlines"
            
        elif weight == None and pt != None:
            print ("【Constarined】using Streamline On Specific Point ")
            streamline=streamlineNetwork.GetStreamlineOnSpecificPoint(pt,mappingGrid,processMesh,dL)
            
            if streamline!=None:
                sl = SLG.Streamline()
                sl.CreateStreamlineInstance(streamline)
                thisNode.specificStreamline = sl
            else:
                thisNode.specificStreamline = None
        
        else:
            
            print ("input error")
        
        
        ### Optional, for debug
        thisNode.processMesh = processMesh
        
        #document the triangle size
        return newTriangleSize
    
    @staticmethod
    def StoreStreamlines_New(PC,DM,SLG,EV,thisNode,EDict_All,currStreetGraph,sameSideList,weight,pt,idealOrientation,resolution,disableRate):
        
        
        ### create processMesh
        
        crv = thisNode.GetGeometry()
        processMesh = PC.ProcessMesh()
        
        ### Get the resoluion processMesh
        if thisNode.parent == None:
            useTriangleSize = resolution
            thisNode.triangleSize = resolution
            #print "case1"
        else:
            useTriangleSize = thisNode.triangleSize
            #print "case2"
        #print "its using resolution useTriangleSize" , useTriangleSize
        
        #print "in StoreStreamlines_New"
        #print thisNode.sides
        # print [edge.ID for edge in thisNode.edges]
        # for edge in thisNode.edges:
        #     for edgePt in edge.GetGeometry():
        #         print edgePt.X, edgePt.Y,0
        #     print ("-----")

        #print ("thisNode"),thisNode.ID
        processMesh.InitializeInput(crv,useTriangleSize)   #length 
        
        ### Optional, for debug
        thisNode.processMesh = processMesh
        
        ### create dataMapping
        mappingGrid = DM.MappingGrid()
        mappingGrid.CreateMappingGrid(crv,20,5)    #rows,columns 
        mappingGrid.GetOverlappedTriangleIndex(processMesh,2)  #detectRadius 
        ### create seedPoint
        
        seedpointList = SLG.SeedpointList()
        seedpointList.CreateSeedpointList(processMesh,1,1)  #reduce points onEdge, on MA
    
        ### creat streamline network instance with score
        
        newTriangleSize = processMesh.length
        
        #dL = newTriangleSize*0.3
        dL = newTriangleSize
        disableDistance=newTriangleSize * disableRate
        
        streamlineNetwork=SLG.StreamlineNetwork()
    
        if weight!=None and pt == None:
            #print ("【Free】using TOP N Streamlines")
            streamlineNetwork=SLG.StreamlineNetwork()
            

            streamlines = streamlineNetwork.GetStreamlineNetwork(mappingGrid,processMesh,seedpointList,disableDistance,dL)  #disable distance, dL
            
           
            EV().GetAllScoreToInstance_New(SPF,SLG,thisNode,EDict_All,currStreetGraph,sameSideList,streamlineNetwork,streamlines,weight,idealOrientation)
             
            sortStreamlines = EV.SortStreamlines_Overall(streamlineNetwork)
            #print "after sortStremline , ",sortStreamlines[0].scoreOverall,sortStreamlines[-1].scoreOverall
            thisNode.sortedSL = sortStreamlines
            
            #print "we get ",len(sortStreamlines), "streamlines"
            
        elif weight == None and pt != None:
            print ("【Constarined】using Streamline On Specific Point ")
            streamline=streamlineNetwork.GetStreamlineOnSpecificPoint(pt,mappingGrid,processMesh,dL)
            
            if streamline!=None:
                sl = SLG.Streamline()
                sl.CreateStreamlineInstance(streamline)
                thisNode.specificStreamline = sl
            else:
                thisNode.specificStreamline = None
        
        else:
            
            print ("input error")
        
        
     
        
        #document the triangle size
        return newTriangleSize
    
    
    @staticmethod
    def TryStreamlineOptions(thisNode,minArea,minElongation,minConvexity,minCompactness,tolerance,allowTopNum,thresholdLVarRate):
        minElongation = None  #### Temp
        #print "TryStreamlineOptions chose index begin ",0,thisNode.sortedSL[0].scoreOverall
        if minElongation == None:
            # scoreLengthVarCollection = []
            # for i in range(len(thisNode.sortedSL)):
            #     scoreLengthVarCollection.append(thisNode.sortedSL[i].scoreLengthVar)
            
            # thresholdLVar = int(len(thisNode.sortedSL) * thresholdLVarRate)
            # thresholdLVarScore = scoreLengthVarCollection[thresholdLVar]
            for i in range(len(thisNode.sortedSL)):
           
                elongation_a = thisNode.sortedSL[i].elongationPair[0]
                elongation_b = thisNode.sortedSL[i].elongationPair[1]
                area_a = thisNode.sortedSL[i].areaPair[0]
                area_b = thisNode.sortedSL[i].areaPair[1]
                
                convexity_a = thisNode.sortedSL[i].convexityPair[0]
                convexity_b = thisNode.sortedSL[i].convexityPair[1]
                compactness_a = thisNode.sortedSL[i].compactnessPair[0]
                compactness_b = thisNode.sortedSL[i].compactnessPair[1]
                orientation_a = thisNode.sortedSL[i].orientationPair[0]  # not used currently
                orientation_b = thisNode.sortedSL[i].orientationPair[1]  # not used currently
                
                if area_a >= minArea and area_b >= minArea :
                    #if thisNode.sortedSL[i].scoreLengthVar>thresholdLVarScore:
                    streamline = thisNode.sortedSL[i]
                        
                    #print "TryStreamlineOptions chose index",i,thisNode.sortedSL[i].scoreOverall
                    break
                    #print ("Get a streamline!"), i, "elongation: ",elongation_a, elongation_b,"area: ",area_a,area_b,"orientation: ",orientation_a,orientation_b
                    
                elif  area_a < minArea or  area_b < minArea :
                    if i!=len(thisNode.sortedSL)-1:
                        #print ("track back!"), "elongation: ",elongation_a, elongation_b,"area: ",area_a,area_b,"orientation: ",orientation_a,orientation_b
                        streamline = None
                    elif i ==len(thisNode.sortedSL)-1:
                        #print ("【stop here!】"),"elongation: ",elongation_a, elongation_b,"area: ",area_a,area_b,"orientation: ",orientation_a,orientation_b
                        streamline = None

            ### if it fails to use the strict condition,try another round
            if streamline == None:
                scoreLengthVarCollection = []
                for i in range(len(thisNode.sortedSL)):
                    scoreLengthVarCollection.append(thisNode.sortedSL[i].scoreLengthVar)
                
                thresholdLVar = int(len(thisNode.sortedSL) * thresholdLVarRate)
                thresholdLVarScore = scoreLengthVarCollection[thresholdLVar]
                
                for i in range(len(thisNode.sortedSL)):
                   
                    elongation_a = thisNode.sortedSL[i].elongationPair[0]
                    elongation_b = thisNode.sortedSL[i].elongationPair[1]
                    area_a = thisNode.sortedSL[i].areaPair[0]
                    area_b = thisNode.sortedSL[i].areaPair[1]
                    convexity_a = thisNode.sortedSL[i].convexityPair[0]
                    convexity_b = thisNode.sortedSL[i].convexityPair[1]
                    compactness_a = thisNode.sortedSL[i].compactnessPair[0]
                    compactness_b = thisNode.sortedSL[i].compactnessPair[1]
                    orientation_a = thisNode.sortedSL[i].orientationPair[0]  
                    orientation_b = thisNode.sortedSL[i].orientationPair[1]  
                    if area_a >= minArea and area_b < minArea and area_b>=tolerance*minArea:
                        if thisNode.sortedSL[i].scoreLengthVar>thresholdLVarScore:
                            streamline = thisNode.sortedSL[i]
                            break

                        #print ("Get a streamline with tolerance!"), "elongation: ",elongation_a, elongation_b,"area: ",area_a,area_b,"orientation: ",orientation_a,orientation_b
                    elif area_a < minArea and area_b >=  minArea and area_a>=tolerance*minArea:
                         if thisNode.sortedSL[i].scoreLengthVar>thresholdLVarScore:
                            streamline = thisNode.sortedSL[i]
                            break
                        #print ("Get a streamline with tolerance!"), "elongation: ",elongation_a, elongation_b,"area: ",area_a,area_b,"orientation: ",orientation_a,orientation_b   
                
                
                
        elif minElongation != None:
            for i in range(len(thisNode.sortedSL)):
                elongation_a = thisNode.sortedSL[i].elongationPair[0]
                elongation_b = thisNode.sortedSL[i].elongationPair[1]
                area_a = thisNode.sortedSL[i].areaPair[0]
                area_b = thisNode.sortedSL[i].areaPair[1]

                convexity_a = thisNode.sortedSL[i].convexityPair[0]
                convexity_b = thisNode.sortedSL[i].convexityPair[1]
                compactness_a = thisNode.sortedSL[i].compactnessPair[0]
                compactness_b = thisNode.sortedSL[i].compactnessPair[1]

                orientation_a = thisNode.sortedSL[i].orientationPair[0]
                orientation_b = thisNode.sortedSL[i].orientationPair[1]
                
                if (area_a >= minArea and  area_b >= minArea 
                    and elongation_a <= minElongation and elongation_b <= minElongation
                    and convexity_a >= minConvexity and convexity_b >= minConvexity
                    and compactness_a >= minCompactness and compactness_b >= minCompactness):
                    
                    streamline = thisNode.sortedSL[i]
                    #print ("Get a streamline! Its index is %d,Elongation: %f,%f,Area: %f,%f, Convexity: %f,%f, Compactness: %f,%f,"%(i, elongation_a,elongation_b,area_a,area_b,convexity_a,convexity_b,compactness_a,compactness_b))
                    ra.WriteLine("Get a streamline! Its index is %d,Elongation: %f,%f,Area: %f,%f, Convexity: %f,%f, Compactness: %f,%f,orientation: %f,%f,"%(i, elongation_a,elongation_b,area_a,area_b,convexity_a,convexity_b,compactness_a,compactness_b,orientation_a,orientation_b))                        
                    break

                elif(area_a < minArea or  area_b < minArea 
                    or elongation_a > minElongation or elongation_b > minElongation
                    or convexity_a< minConvexity or convexity_b< minConvexity
                    or compactness_a < minCompactness or compactness_b < minCompactness):
                    if i!=len(thisNode.sortedSL)-1:
                        #print ("track back!"), i, "elongation: ",elongation_a, elongation_b,"area: ",area_a,area_b,"convexity:",convexity_a,convexity_b,"compactness",compactness_a,compactness_b            
                        ra.WriteLine("track back! Tried No.%d streamline, Elongation: %f,%f,Area: %f,%f, Convexity: %f,%f, Compactness: %f,%f,orientation: %f,%f,"%(i, elongation_a,elongation_b,area_a,area_b,convexity_a,convexity_b,compactness_a,compactness_b,orientation_a,orientation_b))                        
                    elif i ==len(thisNode.sortedSL)-1:
                        streamline = None
                        #print ("【stop here!】"), i, "elongation: ",elongation_a, elongation_b,"area: ",area_a,area_b,"convexity:",convexity_a,convexity_b,"compactness",compactness_a,compactness_b   
                        ra.WriteLine("stop here! Tried No.%d streamline, Elongation: %f,%f,Area: %f,%f, Convexity: %f,%f, Compactness: %f,%f,orientation: %f,%f,"%(i, elongation_a,elongation_b,area_a,area_b,convexity_a,convexity_b,compactness_a,compactness_b,orientation_a,orientation_b))   
                        
            ### if it fails to use the strict condition,try another round            
            if streamline == None:
                scoreLengthVarCollection = []
                for i in range(len(thisNode.sortedSL)):
                    scoreLengthVarCollection.append(thisNode.sortedSL[i].scoreLengthVar)
                
                thresholdLVar = int(len(thisNode.sortedSL) * thresholdLVarRate)
                thresholdLVarScore = scoreLengthVarCollection[thresholdLVar]
                
                for i in range(len(thisNode.sortedSL)):
                    elongation_a = thisNode.sortedSL[i].elongationPair[0]
                    elongation_b = thisNode.sortedSL[i].elongationPair[1]
                    area_a = thisNode.sortedSL[i].areaPair[0]
                    area_b = thisNode.sortedSL[i].areaPair[1]
                    convexity_a = thisNode.sortedSL[i].convexityPair[0]
                    convexity_b = thisNode.sortedSL[i].convexityPair[1]
                    compactness_a = thisNode.sortedSL[i].compactnessPair[0]
                    compactness_b = thisNode.sortedSL[i].compactnessPair[1]
                    orientation_a = thisNode.sortedSL[i].orientationPair[0]  
                    orientation_b = thisNode.sortedSL[i].orientationPair[1]  
                    
                    if (convexity_a >= minConvexity and convexity_b >= minConvexity
                    and compactness_a >= minCompactness and compactness_b >= minCompactness
                    and elongation_a<=minElongation and elongation_b<=minElongation):
                    
                        if (area_a >= minArea and area_b < minArea and area_b>=tolerance*minArea) or (area_a < minArea and area_b >=  minArea and area_a>=tolerance*minArea):
                            if thisNode.sortedSL[i].scoreLengthVar>thresholdLVarScore:
                                streamline = thisNode.sortedSL[i]
                            ra.WriteLine("Get No.%d streamline with tolerance!Elongation: %f,%f,Area: %f,%f, Convexity: %f,%f, Compactness: %f,%f,orientation: %f,%f,"%(i, elongation_a,elongation_b,area_a,area_b,convexity_a,convexity_b,compactness_a,compactness_b,orientation_a,orientation_b))               
                            #print ("Get a streamline with tolerance!"), "elongation: ",elongation_a, elongation_b,"area: ",area_a,area_b,"orientation: ",orientation_a,orientation_b
                            break

        
        return streamline
    
    @staticmethod
    def TrySpecificStreamline(EV,thisNode,minArea,minElongation,minConvexity,minCompactness,tolerance):
        if thisNode.specificStreamline == None:
            return None
        streamline = thisNode.specificStreamline.GetGeometry()
        boundary = thisNode.GetGeometry()
        
        splitResult = EV.SplitPolygon(streamline,boundary)
        
        if splitResult == None:
            return None
        
        parc_a = splitResult[0]
        parc_b = splitResult[1]
        try:
            area_a =rg.AreaMassProperties.Compute(parc_a).Area
            area_b =rg.AreaMassProperties.Compute(parc_b).Area
            ### record score
            if area_a>= area_b:
                evenAreaValue = area_b/area_a
            else:
                evenAreaValue = area_a/area_b
        except:
            print ("SplitPolygon fails")
            print ("FAIL boundary:")
            for pt in boundary:
                print (pt.X), "," , pt.Y, "," , pt.Z
                
            print ("FAIL streamline:")
            for pt in streamline:
                print (pt.X), "," , pt.Y, "," , pt.Z
        
        elongation_a = EV.EvaluateElongation(parc_a) 
        elongation_b = EV.EvaluateElongation(parc_b)
        convexity_a = EV.EvaluateConvexity(parc_a)
        convexity_b = EV.EvaluateConvexity(parc_b)
        compactness_a = EV.EvaluateCompactness(parc_a)
        compactness_b = EV.EvaluateCompactness(parc_b)
    
        orientation_a = EV.EvaluateOrientation(parc_a,0)
        orientation_b = EV.EvaluateOrientation(parc_b,0)

        if minElongation == None:
            if area_a >= minArea and area_b >= minArea :
                print ("Get a streamline!"), "elongation: ",elongation_a, elongation_b,"area: ",area_a,area_b
                streamline = thisNode.specificStreamline

            
            elif   area_a < minArea or area_b < minArea :
                #print ("should stop here, but its converted to FREE"), "elongation: ",elongation_a, elongation_b,"area: ",area_a,area_b
                streamline = None

            ### if it fails to use the strict condition,try another round
            if streamline == None:
                
                if (area_a >= minArea and area_b < minArea and area_b>=tolerance*minArea) or (area_a < minArea and area_b >=  minArea and area_a>=tolerance*minArea):
                    streamline = thisNode.specificStreamline
                    print ("Get a streamline with tolerance!"), "elongation: ",elongation_a, elongation_b,"area: ",area_a,area_b


            
        elif minElongation != None:
            if (area_a >= minArea and area_b >= minArea and elongation_a<=minElongation and elongation_b<=minElongation
                and convexity_a >= minConvexity and convexity_b >= minConvexity
                and compactness_a >= minCompactness and compactness_b >= minCompactness):
                
                streamline = thisNode.specificStreamline    
                #print ("Get a streamline! Elongation: %f,%f,Area: %f,%f, Convexity: %f,%f, Compactness: %f,%f,orientation: %f,%f,"%(elongation_a,elongation_b,area_a,area_b,convexity_a,convexity_b,compactness_a,compactness_b,orientation_a,orientation_b))               
                ra.WriteLine("Get a streamline! Elongation: %f,%f,Area: %f,%f, Convexity: %f,%f, Compactness: %f,%f,orientation: %f,%f,"%(elongation_a,elongation_b,area_a,area_b,convexity_a,convexity_b,compactness_a,compactness_b,orientation_a,orientation_b))   
                        

            elif(area_a < minArea or  area_b < minArea 
                or elongation_a > minElongation or elongation_b > minElongation
                or convexity_a< minConvexity or convexity_b< minConvexity
                or compactness_a < minCompactness or compactness_b < minCompactness):
                    
                streamline = None

            ### if it fails to use the strict condition,try another round
            if streamline == None:
                if (convexity_a >= minConvexity and convexity_b >= minConvexity
                and compactness_a >= minCompactness and compactness_b >= minCompactness
                and elongation_a<=minElongation and elongation_b<=minElongation):
                    
                    if (area_a >= minArea and area_b < minArea and area_b>=tolerance*minArea) or (area_a < minArea and area_b >=  minArea and area_a>=tolerance*minArea):
                        streamline = thisNode.specificStreamline
                        #print ("Get a streamline with tolerance! Elongation: %f,%f,Area: %f,%f, Convexity: %f,%f, Compactness: %f,%f,orientation: %f,%f,"%(elongation_a,elongation_b,area_a,area_b,convexity_a,convexity_b,compactness_a,compactness_b,orientation_a,orientation_b))               
                        ra.WriteLine("Get a streamline with tolerance! Elongation: %f,%f,Area: %f,%f, Convexity: %f,%f, Compactness: %f,%f,orientation: %f,%f,"%(elongation_a,elongation_b,area_a,area_b,convexity_a,convexity_b,compactness_a,compactness_b,orientation_a,orientation_b))   
                        

        
        if streamline == None:
            #print ("should stop here, but its converted to 【 FREE 】"), "elongation: ",elongation_a, elongation_b,"area: ",area_a,area_b
            ra.WriteLine("should stop here, but its converted to 【 FREE 】 ! Elongation: %f,%f,Area: %f,%f, Convexity: %f,%f, Compactness: %f,%f,orientation: %f,%f,"%(elongation_a,elongation_b,area_a,area_b,convexity_a,convexity_b,compactness_a,compactness_b,orientation_a,orientation_b))   
                        
        thisNode.specificStreamline.evenAreaValue = evenAreaValue
        thisNode.specificStreamline.elongationPair = [elongation_a,elongation_b]
        thisNode.specificStreamline.compactnessPair=[compactness_a,compactness_b]
        thisNode.specificStreamline.convexityPair=[convexity_a,convexity_b]
        thisNode.specificStreamline.orientationPair=[orientation_a,orientation_b]
        return streamline
    
    
    
    
    
    ######################################
    ####         PreProcessing        ####
    ######################################
    @staticmethod
    def MergeShortEdgeAndUpdateGraph(PL,PP,VP_Dict,Edict,newParcels,minLength,parcelGraph,junctionGraph):
        for targetParcel in newParcels:
            targetEdges = []
            #print ("newParcels"), targetParcel.ID
            for edge in targetParcel.edges:
                if edge.GetGeometry().Length < minLength and edge.naked == False and edge.isValid == True:
                    #print "targetEdges",edge.startVertex.geometry, edge.endVertex.geometry
                    targetEdges.append(edge)
                    
            
            if len(targetEdges) != 0:
                for selectedEdge in targetEdges:
                    startV = selectedEdge.startVertex   ### store here, later I cant get this by selected edge
                    endV = selectedEdge.endVertex       ### store here, later I cant get this by selected edge

                    ### create a new vertex, if on the boundary , merge it to the boundary
                    if startV.onBoundary == True:
                        newV = startV
                    elif endV.onBoundary == True: 
                        newV = endV 
                    else:
                        startPt =  selectedEdge.GetGeometry().First
                        EndPt =  selectedEdge.GetGeometry().Last
                        avePt = (startPt+EndPt)/2
                        currMaxVPID = max(VP_Dict.Keys)
                        newV = PL.ParcVertex(avePt,currMaxVPID+1)
                        
                    ### find the parcels to treat with
                    
                    nbParcel = targetParcel.mutualE_P[selectedEdge]
                    twinEdge = nbParcel.mutualP_E[targetParcel]

                    ### check if its going to be a triangle
                    testTriPts = []
                    for i in range(len(targetParcel.edges)):
                        currEdge = targetParcel.edges[i]
                        if currEdge!= selectedEdge:
                            testTriPts.append(currEdge.startVertex.geometry)
                        else:
                            testTriPts.append(avePt)

                    testPolyL = rg.Polyline(testTriPts)

                    testTriPts_Twin = []
                    for i in range(len(nbParcel.edges)):
                        currEdge = nbParcel.edges[i]
                        if currEdge!= selectedEdge:
                            testTriPts_Twin.append(currEdge.startVertex.geometry)
                        else:
                            testTriPts_Twin.append(avePt)

                    testPolyL_Twin = rg.Polyline(testTriPts_Twin)
                    
                    testPolyL_Sim = PP.ConvertPolylineCurveToPolyline(PP.SimplifyVertices(testPolyL))
                    testPolyL_Twin_Sim = PP.ConvertPolylineCurveToPolyline(PP.SimplifyVertices(testPolyL_Twin))

                    if len(testPolyL_Sim) == 3 or len(testPolyL_Twin_Sim) ==3:
                        
                        continue   ### dont do it 
    
                    ### replace the edge startVertex and endVertex  /  this treatment for all parcels / this will change the selected edge  
                    relatedParcels = targetParcel.parent.neighbors  ## not include  newParcels
                    for neighbor in targetParcel.neighbors: ### add the sibling
                        if neighbor not in relatedParcels:
                            relatedParcels.append(neighbor)
                            
                    for parcel in relatedParcels:
                        #print ("relatedParcels"), parcel.ID
                        if parcel != targetParcel and parcel != nbParcel:
                            edges = parcel.edges
                            for edge in edges:
                                if edge.startVertex == startV:
                                    edge.startVertex = newV
                                if edge.endVertex == startV:
                                    edge.endVertex = newV
                                if edge.startVertex == endV:
                                    edge.startVertex = newV
                                if edge.endVertex == endV:
                                    edge.endVertex = newV

                            for i in range(len(parcel.vertices)):
                                vertex = parcel.vertices[i]
                                if vertex == startV or vertex == endV:
                                    parcel.vertices[i] = newV
                    
                    #print ("targetParcel"), targetParcel.ID
                    #print ("nbParcel"), nbParcel.ID
                    ### targetParcel: remove the edge， change affected edge vertices  
                    targetParcel.edges.remove(selectedEdge)
                    for edge in targetParcel.edges:
                        if edge.endVertex == startV:
                            edge.endVertex = newV
                        if edge.startVertex == endV:
                            edge.startVertex = newV
                            pass
                        
                    ### targetParcel: remove 2 original V and insert new V    
                    v_TargetParcel = targetParcel.vertices
                    index_Start = v_TargetParcel.index(startV)
                    index_End = v_TargetParcel.index(endV)

                    newVertices = v_TargetParcel[:index_Start]+[newV]+v_TargetParcel[index_Start+1:]    
                    newVertices.pop(index_End)    

                    if index_End == 0:    ### to sort the vertices order
                        newVertices = [newVertices[-1]]+ newVertices[0:-1]
                    targetParcel.vertices = newVertices    
                    
                    #print "------------"
                    ### nbParcel: remove the twinedge  
                    nbParcel.edges.remove(twinEdge) 
                    
                    for edge in nbParcel.edges:
                        if edge.endVertex == endV:
                            edge.endVertex = newV
                        if edge.startVertex == startV:
                            edge.startVertex = newV   
                    
                    ### nbParcel: remove 2 original V and insert new V        
                    v_nbParcel = nbParcel.vertices
                    index_Start_nb = v_nbParcel.index(endV)    #twin, end->start
                    index_End_nb = v_nbParcel.index(startV)
            
                    newVertices_nb = v_nbParcel[:index_Start_nb]+[newV]+v_nbParcel[index_Start_nb+1:] 
                    newVertices_nb.pop(index_End_nb)
                    
                    if index_End_nb == 0:    ### to sort the vertices order
                        newVertices_nb = [newVertices_nb[-1]]+ newVertices_nb[0:-1]
                    nbParcel.vertices = newVertices_nb                   
                    
                    ### update neighbor info 
                    targetParcel.neighbors.pop(targetParcel.neighbors.index(nbParcel))
                    nbParcel.neighbors.pop(nbParcel.neighbors.index(targetParcel))
                    
                    targetParcel.mutualE_P.pop(selectedEdge)
                    nbParcel.mutualE_P.pop(twinEdge)
                    
                    targetParcel.mutualP_E.pop(nbParcel)
                    nbParcel.mutualP_E.pop(targetParcel)   

                    ### remove from Edict
                    if selectedEdge.ID in Edict.keys():
                        Edict.pop(selectedEdge.ID)
                        print ("in MergeShortEdgeAndUpdateGraph Edict.pop(selectedEdge.ID) "),  selectedEdge.ID
                    if selectedEdge.twinID in Edict.keys():
                        Edict.pop(selectedEdge.twinID)
                        print ("in MergeShortEdgeAndUpdateGraph Edict.pop(selectedEdge.twinID)"),  selectedEdge.twinID

                    ### add newPoint to VPdict
                    VP_Dict[newV.ID] = newV
                    
                    ###############################
                    ###############################
                    ###############################
                    ### treat parcelGraph
                    parcelGraph.graph[targetParcel.ID].remove(nbParcel.ID)
                    parcelGraph.graph[nbParcel.ID].remove(targetParcel.ID)
                    
                    ### treat junctionGraph
                    #newKey 
                    newVIDDict = junctionGraph.graph[startV.ID].copy()
                    newVIDDict.update(junctionGraph.graph[endV.ID])
                    newVIDDict.pop(startV.ID)
                    newVIDDict.pop(endV.ID)
                    junctionGraph.graph[newV.ID] = newVIDDict
                    
                    for vID in junctionGraph.graph.keys():
                        thisDict = junctionGraph.graph[vID]
                        if startV.ID in junctionGraph.graph[vID].keys():
                            thisDict[newV.ID] = thisDict.pop(startV.ID)
                        if endV.ID in junctionGraph.graph[vID].keys():
                            thisDict[newV.ID] = thisDict.pop(endV.ID)  

     
    @staticmethod
    def MergeShortEdge(PL,PP,VP_Dict,Edict,newParcels,minLength,streetGraph):
         for targetParcel in newParcels:
            targetEdges = []
            #print ("newParcels"), targetParcel.ID
            for edge in targetParcel.edges:
                if edge.GetGeometry().Length < minLength and edge.naked == False and edge.isValid == True:
                    #print "targetEdges",edge.startVertex.geometry, edge.endVertex.geometry
                    targetEdges.append(edge)
                    
            
            if len(targetEdges) != 0:
                for selectedEdge in targetEdges:
                    startV = selectedEdge.startVertex   ### store here, later I cant get this by selected edge
                    endV = selectedEdge.endVertex       ### store here, later I cant get this by selected edge

                    ### create a new vertex, if on the boundary , merge it to the boundary
                    if startV.onBoundary == True:
                        newV = startV
                    elif endV.onBoundary == True: 
                        newV = endV 
                    else:
                        startPt =  selectedEdge.GetGeometry().First
                        EndPt =  selectedEdge.GetGeometry().Last
                        avePt = (startPt+EndPt)/2
                        currMaxVPID = max(VP_Dict.Keys)
                        newV = PL.ParcVertex(avePt,currMaxVPID+1)
                        
                    ### find the parcels to treat with
                    
                    nbParcel = targetParcel.mutualE_P[selectedEdge]
                    twinEdge = nbParcel.mutualP_E[targetParcel]

                    ### check if its going to be a triangle
                    testTriPts = []
                    for i in range(len(targetParcel.edges)):
                        currEdge = targetParcel.edges[i]
                        if currEdge!= selectedEdge:
                            testTriPts.append(currEdge.startVertex.geometry)
                        else:
                            testTriPts.append(avePt)

                    testPolyL = rg.Polyline(testTriPts)

                    testTriPts_Twin = []
                    for i in range(len(nbParcel.edges)):
                        currEdge = nbParcel.edges[i]
                        if currEdge!= selectedEdge:
                            testTriPts_Twin.append(currEdge.startVertex.geometry)
                        else:
                            testTriPts_Twin.append(avePt)

                    testPolyL_Twin = rg.Polyline(testTriPts_Twin)
                    
                    testPolyL_Sim = PP.ConvertPolylineCurveToPolyline(PP.SimplifyVertices(testPolyL))
                    testPolyL_Twin_Sim = PP.ConvertPolylineCurveToPolyline(PP.SimplifyVertices(testPolyL_Twin))

                    if len(testPolyL_Sim) == 3 or len(testPolyL_Twin_Sim) ==3:
                        
                        continue   ### dont do it 
    
                    ### replace the edge startVertex and endVertex  /  this treatment for all parcels / this will change the selected edge  
                    relatedParcels = targetParcel.parent.neighbors  ## not include  newParcels
                    for neighbor in targetParcel.neighbors: ### add the sibling
                        if neighbor not in relatedParcels:
                            relatedParcels.append(neighbor)
                            
                    for parcel in relatedParcels:
                        print ("relatedParcels"), parcel.ID
                        if parcel != targetParcel and parcel != nbParcel:
                            edges = parcel.edges
                            for edge in edges:
                                if edge.startVertex == startV:
                                    edge.startVertex = newV
                                if edge.endVertex == startV:
                                    edge.endVertex = newV
                                if edge.startVertex == endV:
                                    edge.startVertex = newV
                                if edge.endVertex == endV:
                                    edge.endVertex = newV

                            for i in range(len(parcel.vertices)):
                                vertex = parcel.vertices[i]
                                if vertex == startV or vertex == endV:
                                    parcel.vertices[i] = newV
                    
                    print ("targetParcel"), targetParcel.ID
                    print ("nbParcel"), nbParcel.ID
                    ### targetParcel: remove the edge， change affected edge vertices  
                    targetParcel.edges.remove(selectedEdge)
                    for edge in targetParcel.edges:
                        if edge.endVertex == startV:
                            edge.endVertex = newV
                        if edge.startVertex == endV:
                            edge.startVertex = newV
                            pass
                        
                    ### targetParcel: remove 2 original V and insert new V    
                    v_TargetParcel = targetParcel.vertices
                    index_Start = v_TargetParcel.index(startV)
                    index_End = v_TargetParcel.index(endV)

                    newVertices = v_TargetParcel[:index_Start]+[newV]+v_TargetParcel[index_Start+1:]    
                    newVertices.pop(index_End)    

                    if index_End == 0:    ### to sort the vertices order
                        newVertices = [newVertices[-1]]+ newVertices[0:-1]
                    targetParcel.vertices = newVertices    
                    
                    #print "------------"
                    ### nbParcel: remove the twinedge  
                    nbParcel.edges.remove(twinEdge) 
                    
                    for edge in nbParcel.edges:
                        if edge.endVertex == endV:
                            edge.endVertex = newV
                        if edge.startVertex == startV:
                            edge.startVertex = newV   
                    
                    ### nbParcel: remove 2 original V and insert new V        
                    v_nbParcel = nbParcel.vertices
                    index_Start_nb = v_nbParcel.index(endV)    #twin, end->start
                    index_End_nb = v_nbParcel.index(startV)
            
                    newVertices_nb = v_nbParcel[:index_Start_nb]+[newV]+v_nbParcel[index_Start_nb+1:] 
                    newVertices_nb.pop(index_End_nb)
                    
                    if index_End_nb == 0:    ### to sort the vertices order
                        newVertices_nb = [newVertices_nb[-1]]+ newVertices_nb[0:-1]
                    nbParcel.vertices = newVertices_nb                   
                    
                    ### update neighbor info 
                    targetParcel.neighbors.pop(targetParcel.neighbors.index(nbParcel))
                    nbParcel.neighbors.pop(nbParcel.neighbors.index(targetParcel))
                    
                    targetParcel.mutualE_P.pop(selectedEdge)
                    nbParcel.mutualE_P.pop(twinEdge)
                    
                    targetParcel.mutualP_E.pop(nbParcel)
                    nbParcel.mutualP_E.pop(targetParcel)   

                    ### remove from Edict
                    if selectedEdge.ID in Edict.keys():
                        Edict.pop(selectedEdge.ID)
                        print ("in MergeShortEdgeAndUpdateGraph Edict.pop(selectedEdge.ID) "),  selectedEdge.ID
                    if selectedEdge.twinID in Edict.keys():
                        Edict.pop(selectedEdge.twinID)
                        print ("in MergeShortEdgeAndUpdateGraph Edict.pop(selectedEdge.twinID) "),  selectedEdge.twinID
                    ### add newPoint to VPdict
                    VP_Dict[newV.ID] = newV
                    print ("in MergeShortEdgeAndUpdateGraph startV,endV "),  startV.ID,endV.ID
                    
                    
                    streetGraph.CheckIfPopEdgeInStreet(selectedEdge.ID)
# ---------- end ghpython_script_4 ----------

# ----
# Road finding
ghpython_script_5 = GhPythonScript()  # -> out, RF
# ---------- ghpython_script_5: Python ----------
###########################
####    Import Libs    ####
###########################
import Rhino.Geometry as rg
#import Rhino.RhinoDoc as rd
import Rhino.RhinoMath as rm

import ghpythonlib.components as ghc
import math
import Queue
import heapq
import itertools
from collections import deque
import gc
import time
###########################
####    RoadFinding    ####
###########################
class RF:
    class Street:
        def __init__(self,head,end):
            self.head = head
            self.end = end
            self.ID = None
            self.doubleSize = False
            self.original = False
            self.hierarchy = None
            
        def __del__(self):
            self.head = None
            self.end = None
            self.ID = None
            self.doubleSize = None
        def DeepCopy(self,currPV_Dict,currE_Dict):
            #print "In street DeepCopy,currE_Dict.ID " ,currE_Dict.keys()
            oldStreetNodes = self.GetAllStreetNodes()
            #print ("in street copy, street ID"), self.ID
            #print ("in street copy, all oldStreetNodes,"), [sNode.ID for sNode in oldStreetNodes]
            allPVID = self.GetAllParcVertexID()
            currPV = [currPV_Dict[vID] for vID in allPVID]
            
            newStreetNodes = [RF.StreetNode(parcVertex) for parcVertex in currPV] 
            #print ("in street copy, all newStreetNodes,"), [sNode.ID for sNode in newStreetNodes]
            newStreetNodeDict = {}
            for streetNode in newStreetNodes:
                newStreetNodeDict[streetNode.ID] = streetNode
            
            ### fill Info
            for i in range(len(newStreetNodes)):
                currNewStreetNode = newStreetNodes[i]
                if oldStreetNodes[i].prev!= None:
                    try:
                        currNewStreetNode.prev = newStreetNodeDict [oldStreetNodes[i].prev.ID]
                    except:
                        print ("doubleside?"),self.doubleSize
                        print ("in street copy, "), "oldStreetNodes[i].ID",oldStreetNodes[i].ID , ",oldStreetNodes[i].prev.ID",oldStreetNodes[i].prev.ID 
                        currNewStreetNode.prev = newStreetNodeDict [oldStreetNodes[i].prev.ID]  
                else:
                    currNewStreetNode.prev = None
                
                if oldStreetNodes[i].next!= None:
                    #print ("In street DeepCopy,next.ID ") ,oldStreetNodes[i].next.ID
                    currNewStreetNode.next = newStreetNodeDict[oldStreetNodes[i].next.ID]  
                    
                    #print "In street DeepCopy,next.ID " ,oldStreetNodes[i].next.ID
                else:
                    currNewStreetNode.next = None
                
                if oldStreetNodes[i].prevConnection!= None:  
                    #print ("oldStreetNodes[i].prevConnection.ID") , oldStreetNodes[i].prevConnection.ID
                    currNewStreetNode.prevConnection = currE_Dict [oldStreetNodes[i].prevConnection.ID]  
                else:
                    currNewStreetNode.prevConnection = None
                    
                if oldStreetNodes[i].nextConnection!= None:
                    #print ("nextConnection.ID"),oldStreetNodes[i].nextConnection.ID
                    #print oldStreetNodes[i].nextConnection.GetGeometry().Length
                    #print currE_Dict.keys()
                    currNewStreetNode.nextConnection = currE_Dict [oldStreetNodes[i].nextConnection.ID]  
                else:
                    currNewStreetNode.nextConnection = None
                
            newStreet = RF.Street(newStreetNodes[0],newStreetNodes[-1])
            
            newStreet.ID = self.ID 
            newStreet.doubleSize = self.doubleSize
            newStreet.original = self.original
            
            return newStreet

        def Insert(self,startNode,endNode,newEdge1,newEdge2,EDict):
            # print ("before insert")
            # self.PrintVIDHeadToEnd()
            # self.PrintVIDEndToHead()
            
            newEdge1.streetID = startNode.nextConnection.streetID
            newEdge2.streetID = startNode.nextConnection.streetID
            
            
            if newEdge1.naked == False:
                EDict[newEdge1.twinID].streetID = newEdge1.streetID 
            if newEdge2.naked == False:
                EDict[newEdge2.twinID].streetID = newEdge2.streetID     
            
            #print "in streetInsert", startNode.nextConnection.ID, "becoming", newEdge1.ID, "and ", newEdge2.ID

            streetNode = self.head
            #print "self.head",self.head
            #print streetNode.node.geometry
            while streetNode.nextConnection!=None:

                #print (streetNode.prev),streetNode.prevConnection, streetNode.next,streetNode.nextConnection
                streetNode = streetNode.next    
            #print "----------------start changing--------------------"
            newStreetNode = RF.StreetNode(newEdge1.endVertex)
            
            # print "edge1Geo"
            # edge1Geo =  newEdge1.GetGeometry()
            # for pt in edge1Geo:
            #     print pt.X,",",pt.Y,",",0
            # print "edge2Geo"
            # edge2Geo =  newEdge2.GetGeometry()
            # for pt in edge2Geo:
            #     print pt.X,",",pt.Y,",",0
            
            #change info of startNode
            #print "previous startNode.next",startNode.next.node.geometry,startNode.next
            startNode.next = newStreetNode
            #print "after startNode.next",startNode.next.node.geometry , startNode.next
            
            
            #print "previous startNode.nextConnection",startNode.nextConnection
            startNode.nextConnection = newEdge1
            #print "after startNode.next",startNode.nextConnection
            
            #add info for the new startNode
            newStreetNode.prev = startNode
            newStreetNode.prevConnection = newEdge1
            newStreetNode.next = endNode
            newStreetNode.nextConnection = newEdge2
            
            #change info of endNode
            #print "previous endNode.prev",endNode.prev.node.geometry,endNode.prev
            endNode.prev = newStreetNode
            #print "after endNode.prev",endNode.prev.node.geometry,endNode.prev
            
            #print "previous endNode.prevConnection",endNode.prevConnection
            endNode.prevConnection = newEdge2
            #print "after endNode.prevConnection",endNode.prevConnection
            
            streetNode = self.head
            #print "self.head",self.head
            #print streetNode.node.geometry
            while streetNode.nextConnection!=None:

                #print (streetNode.prev),streetNode.prevConnection, streetNode.next,streetNode.nextConnection
        
                streetNode = streetNode.next 
                #print streetNode
            
            # print ("after insert")
            # self.PrintVIDHeadToEnd()
            # self.PrintVIDEndToHead()
            #self.PrintGeometry()
            
        def Extend(self,pVCollection,lastParcEdge,abstractPVGraph,EDict):
            print ("before Extend")
            self.PrintVIDHeadToEnd()
            self.PrintVIDEndToHead()
            
            print ("before street extend now  start and end ID is"), self.head.ID,self.end.ID
            if len(pVCollection)!=1:
                parcEdgeColletion = []
                for i in range(len(pVCollection)-1):
                    startVertex = pVCollection[i]
                    endVertex = pVCollection[i+1]
                    relatedParcEdge = abstractPVGraph.graph[startVertex][endVertex]
                    print ("thisrelatedParcEdge"),relatedParcEdge.startVertex.ID, relatedParcEdge.endVertex.ID,relatedParcEdge.startVertex.geometry,relatedParcEdge.endVertex.geometry
                    # ### Check if the corret direction
                    # if relatedParcEdge.startVertex==startVertex:
                    #     pass
                    # else:
                    #     relatedParcEdge = EDict[relatedParcEdge.twinID]
                    parcEdgeColletion.append(relatedParcEdge)
                    print ("parcEdgeColletion"),len(parcEdgeColletion)
                    
                if len(parcEdgeColletion) >=2:
                    ### sort the order
                    # check the first parcEdge direction
                    # they must have twin becasue they are not naked
                    if parcEdgeColletion[0].endVertex ==  parcEdgeColletion[1].startVertex  or parcEdgeColletion[0].endVertex ==  parcEdgeColletion[1].endVertex:
                        pass
                    else:
                        parcEdgeColletion[0] = EDict[parcEdgeColletion[0].twinID]
                    
                    
                    # keep sorting order
                    
                    for i in range(len(parcEdgeColletion)-1):
                        if parcEdgeColletion[i+1].startVertex!= parcEdgeColletion[i].endVertex:
                            parcEdgeColletion[i+1] = EDict[parcEdgeColletion[i+1].twinID]

                    print (" after the first round order:")
                    for i in range(len(parcEdgeColletion)):
                        print  (parcEdgeColletion[i].startVertex.ID),parcEdgeColletion[i].endVertex.ID
                    
                    # sort order second round 
                                                                                # if parcEdgeColletion[0].startVertex == self.head.node:
                                                                                #     print "self.head.node",self.head.node.ID
                    for i in range(len(parcEdgeColletion)):
                        parcEdgeColletion[i] = EDict[parcEdgeColletion[i].twinID]

                    parcEdgeColletion.reverse()  ### important
                    print (" after the second round order:")
                    for i in range(len(parcEdgeColletion)):
                        print  (parcEdgeColletion[i].startVertex.ID),parcEdgeColletion[i].endVertex.ID
                    
                    ### add into street
                    # Create StreetNode instance
                    
                    print (" Creating streetNodes:")
                    streetNodes = []
                    for i in range(len(parcEdgeColletion)):
                        streetNodes.append(RF.StreetNode(parcEdgeColletion[i].startVertex)) # the last one does not need to be added,its original head
                        print (parcEdgeColletion[i].startVertex.geometry.X),parcEdgeColletion[i].startVertex.geometry.Y,0, "ID",parcEdgeColletion[i].startVertex.ID
                    

                    # Fill info for Street Node instances
                    if len(streetNodes)!=1:
                        for i in range(len(streetNodes)):
                            currStreetNode = streetNodes[i]
                            if i == 0:
                                currStreetNode.prev = None
                                currStreetNode.next = streetNodes[i+1]
                                currStreetNode.prevConnection = None
                                currStreetNode.nextConnection = parcEdgeColletion[i]
                                
                            elif i != 0 and i != len(streetNodes)-1:
                                currStreetNode.prev = streetNodes[i-1]
                                currStreetNode.next = streetNodes[i+1]
                                currStreetNode.prevConnection = parcEdgeColletion[i-1]
                                currStreetNode.nextConnection = parcEdgeColletion[i]    


                    # print "finish Fill info for Street Node instances"
                    # currStreetNode = streetNodes[0]
                    # count = 0
                    
                    # while currStreetNode.next!=None:
                    #     if count >100:
                    #         print "wrong while!!!
                    #         break
                    #     count+=1
                    #     currStreetNode = currStreetNode.next
                    #     print "Count",count
                        
                    elif len(streetNodes)==1:
                        pass
                    
                elif len(parcEdgeColletion) ==1:
                    if parcEdgeColletion[0].endVertex == pVCollection[0]:
                        pass
                    else:
                        parcEdgeColletion[0] = EDict[parcEdgeColletion[0].twinID]
                    streetNodes = []
                    for i in range(len(parcEdgeColletion)):
                        streetNodes.append(RF.StreetNode(parcEdgeColletion[i].startVertex)) # the last one does not need to be added,its original head      
                                  
                ##### Connect the original head
                originalHead = self.head
                originalHead.prev = streetNodes[-1]
                originalHead.prevConnection = parcEdgeColletion[-1]
                
                
                streetNodes[-1].next = originalHead    #cover the case that there is only 1 street node
                streetNodes[-1].nextConnection = parcEdgeColletion[-1]
                
                newHead = streetNodes[0]  
                print ("originalHead"),originalHead.ID
                print ("newHead")  ,newHead.ID  
                ### check the last parcEdge
                print ("lastParcEdge,lastParcEdge.startVertex,lastParcEdge.endVertex "), lastParcEdge.startVertex.ID,lastParcEdge.endVertex.ID
                if lastParcEdge.endVertex == pVCollection[-1]:
                    pass
                elif lastParcEdge.startVertex == pVCollection[-1]:
                    lastParcEdge = EDict[lastParcEdge.twinID]
                    
                ### connect to the last parcEdge
                finalHead = RF.StreetNode(lastParcEdge.startVertex)
                
                newHead.prev = finalHead
                newHead.prevConnection =lastParcEdge
                finalHead.next = newHead
                finalHead.nextConnection = lastParcEdge
                
                self.head = finalHead
                
                finalHead.prev = None
                finalHead.prevConnection = None
                
                
                self.doubleSize = True
                
            elif len(pVCollection)==1:
                
           
                if lastParcEdge.endVertex ==  pVCollection[0]:
                    pass
                else:
                    lastParcEdge = EDict[lastParcEdge.twinID]
              
                ### connect to the last parcEdge
                finalHead = RF.StreetNode(lastParcEdge.startVertex)
                originalHead = self.head
                originalHead.prev = finalHead
                originalHead.prevConnection =lastParcEdge
        
       
                finalHead.next = originalHead    #cover the case that there is only 1 street node
                finalHead.nextConnection = lastParcEdge
                
                self.head = finalHead 
                self.doubleSize = True    
            
            print ("finish street extend now  start and end ID is"), self.head.ID,self.end.ID
            if self.head.ID == self.end.ID:
                wtf = self.whatTheFuck
            ### Assign streetID
            self.AssignStreetIDForParcEdge(EDict)
            
            #self.PrintGeometry()
            print ("after Extend")
            self.PrintVIDHeadToEnd()    
            self.PrintVIDEndToHead()
        def Extend_PE(self,PECollection,EDict):
            #print  ("Extend_PE"),self.ID
            #print ("before Extend")
            # self.PrintVIDHeadToEnd()
            # self.PrintVIDEndToHead()
            #### sort PECollection
            # print len(PECollection),[PE.ID for PE in PECollection]
            # print "before sort order", [PE.startVertex.ID for PE in PECollection]
            
            if len(PECollection) >=2:
                ### sort the order
                # check the first parcEdge direction
                # they must have twin becasue they are not naked
                if PECollection[0].endVertex ==  PECollection[1].startVertex  or PECollection[0].endVertex ==  PECollection[1].endVertex:
                    pass
                else:
                    PECollection[0] = EDict[PECollection[0].twinID]
                    
                # keep sorting order
                for i in range(len(PECollection)-1):
                    
                    if PECollection[i+1].startVertex!= PECollection[i].endVertex:
                        PECollection[i+1] = EDict[PECollection[i+1].twinID]
                
                for i in range(len(PECollection)):
                    PECollection[i] = EDict[PECollection[i].twinID]
                PECollection.reverse()  ### important

                print (len(PECollection)),[PE.ID for PE in PECollection]
                print ("after sort order"), [PE.startVertex.ID for PE in PECollection]
                ### add into street
                # Create StreetNode instance
                streetNodes = []
                for i in range(len(PECollection)):
                    streetNodes.append(RF.StreetNode(PECollection[i].startVertex)) # the last one does not need to be added,its original head
                    
                # Fill info for Street Node instances
                if len(streetNodes)!=1:
                    for i in range(len(streetNodes)):
                        currStreetNode = streetNodes[i]
                        if i == 0:
                            currStreetNode.prev = None
                            currStreetNode.next = streetNodes[i+1]
                            currStreetNode.prevConnection = None
                            currStreetNode.nextConnection = PECollection[i]
                            
                        elif i != 0 and i != len(streetNodes)-1:
                            currStreetNode.prev = streetNodes[i-1]
                            currStreetNode.next = streetNodes[i+1]
                            currStreetNode.prevConnection = PECollection[i-1]
                            currStreetNode.nextConnection = PECollection[i]    
                            #print "elif 2 streetNodes[i].prev =  streetNodes[i-1]", i, ",,",streetNodes[i].prev.ID, streetNodes[i-1].ID
                        elif i == len(streetNodes)-1 :  ###important to add this condition,prevent later error
                            
                            streetNodes[i].prev =  streetNodes[i-1]
                            streetNodes[i].prevConnection =  PECollection[i-1]
                            #print "streetNodes[i].prev =  streetNodes[i-1]", i, ",,",streetNodes[i].prev.ID, streetNodes[i-1].ID
                        
                elif len(streetNodes)==1:
                    pass
            
            elif len(PECollection) ==1:
                if PECollection[0].endVertex == self.head.node:
                    pass
                else:
                    PECollection[0] = EDict[PECollection[0].twinID]
                streetNodes = []
                for i in range(len(PECollection)):
                    streetNodes.append(RF.StreetNode(PECollection[i].startVertex)) # the last one does not need to be added,its original head      

                # streetNodes[0].next = streetNodes[-1] 
                # streetNodes[0].nextConnection =  PECollection[0]
                # streetNodes[-1].prev =  streetNodes[0]
                # streetNodes[-1].prevConnection =  PECollection[0]
                
                
                
            ##### Connect the original head
            originalHead = self.head
            #print ("originalHead"),originalHead.ID
            originalHead.prev = streetNodes[-1]
            #print ("originalHead.prev"),originalHead.prev.ID
            originalHead.prevConnection = PECollection[-1]
            
            
            streetNodes[-1].next = originalHead    #cover the case that there is only 1 street node
            streetNodes[-1].nextConnection = PECollection[-1]
            
            self.head = streetNodes[0]                       
            # print ("after Extend")
            # self.PrintVIDHeadToEnd()    
            # self.PrintVIDEndToHead()                         
               
        def AssignStreetIDForParcEdge(self,EDict):
            allParcEdge = self.GetAllParcEdge()
            for pE in allParcEdge:
                pE.streetID = self.ID
                #try:
                if pE.naked == False:
                    #print "in AssignStreetIDForParcEdge",  pE.ID, pE.twinID
                    #print pE.generation
                    #print pE.twinID
                    EDict[pE.twinID]. streetID = self.ID
                
               
                #except:
                    #print pE.ID,pE.twinID
                
        def PrintGeometry(self):     
            parcEdgeCollection = []
            streetNode = self.head
            
            
            whileCount = 0
            while streetNode.nextConnection!=None:
                if whileCount>1000:
                    break
                whileCount +=1
                #print ("info of currNode"), "currNode ID", streetNode.ID, 
                #if streetNode.prev!=None:
                    #print ("prev ID"), streetNode.prev.ID
                #if streetNode.next!=None:
                    #print ("next ID"), streetNode.next.ID
                parcEdgeCollection.append(streetNode.nextConnection)
                streetNode = streetNode.next
            
            vGeo = []
            IDs = []
            
            for pEdge in parcEdgeCollection:
                vGeo.append(pEdge.startVertex.geometry)  
                IDs.append(pEdge.startVertex.ID)
                if pEdge.betweenPoints!= []:
                    for bPt in pEdge.betweenPoints:
                        vGeo.append(bPt.geometry)  
                        IDs.append(bPt.ID)
                        #print (bPt.geometry.X),",",bPt.geometry.Y,",",0
            vGeo.append(parcEdgeCollection[-1].endVertex.geometry)  
            IDs.append(parcEdgeCollection[-1].endVertex.ID)
            #print (parcEdgeCollection[-1].endVertex.geometry.X),",",parcEdgeCollection[-1].endVertex.geometry.Y,",",0   
            
            #print ("doubleSize"),self.doubleSize
            # for i in range(len(vGeo)):
            #     print (vGeo[i].X),",",vGeo[i].Y,",",0, ("ID:"),IDs[i]
            return 0
                
        def GetGeometry(self):
            parcEdgeCollection = []
            streetNode = self.head
            
            
            whileCount = 0
            while streetNode.nextConnection!=None:
                if whileCount>1000:
                    break
                whileCount +=1
                
                parcEdgeCollection.append(streetNode.nextConnection)
                streetNode = streetNode.next
            
            vGeo = []
            for pEdge in parcEdgeCollection:
                vGeo.append(pEdge.startVertex.geometry)  
                if pEdge.betweenPoints!= []:
                    for bPt in pEdge.betweenPoints:
                        vGeo.append(bPt.geometry)  
            vGeo.append(parcEdgeCollection[-1].endVertex.geometry)  
            return rg.Polyline(vGeo)
       
        def Reverse(self,EDict):
            #print ("before reverse")
            #self.PrintVIDHeadToEnd()
            #print  self.GetAllParcEdgeID()    
            allEdges = self.GetAllParcEdge()
            allNodes = self.GetAllStreetNodes()
            for i in range(len(allNodes)-2,-1,-1):
                allNodes[i+1].next = allNodes[i]
                allNodes[i].prev = allNodes[i+1]
                
                
            allNodes[-1].prev = None
            allNodes[0].next = None

            for i in range(len(allNodes)-2,-1,-1):
                allNodes[i+1].nextConnection = EDict[allEdges[i].twinID]
                
                allNodes[i].prevConnection = EDict[allEdges[i].twinID]

            allNodes[-1].prevConnection = None
            allNodes[0].nextConnection = None

            self.head = allNodes[-1] 
            self.end = allNodes[0] 

            #print "after reverse"
            #self.PrintVIDHeadToEnd()
            #print  self.GetAllParcEdgeID()   
        @staticmethod    
        def SortOrderForStreet(parcEdgeColletion,Edict):
            if len(parcEdgeColletion) >= 2:
                ### sort the order
                # check the first parcEdge direction
                if parcEdgeColletion[0].endVertex ==  parcEdgeColletion[1].startVertex  or parcEdgeColletion[0].endVertex ==  parcEdgeColletion[1].endVertex:
                    pass
                else:
                    parcEdgeColletion[0] = Edict[parcEdgeColletion[0].twinID]
                
                # keep sorting order
                for i in range(len(parcEdgeColletion)-1):
                    if parcEdgeColletion[i+1].startVertex!= parcEdgeColletion[i].endVertex:
                        parcEdgeColletion[i+1] = Edict[parcEdgeColletion[i+1].twinID]

        def GetAllParcEdge(self):
            whileCount = 0
            allParcEdge = []
            streetNode = self.head
            while streetNode.next!=None:
                if whileCount>1000:
                    break
                whileCount +=1
 
                allParcEdge.append(streetNode.nextConnection)
                streetNode = streetNode.next
            return allParcEdge
        
        def GetAllParcEdgeID(self):
            whileCount = 0
            allParcEdge = []
            streetNode = self.head
            while streetNode.next!=None:
                if whileCount>1000:
                    break
                whileCount +=1

                allParcEdge.append(streetNode.nextConnection.ID)
                
                streetNode = streetNode.next
            
            return allParcEdge

        def GetAllParcEdgeTwinID(self):
            whileCount = 0
            allParcEdge = []
            streetNode = self.head
            
            while streetNode.next!=None:
                if whileCount>1000:
                    break
                whileCount +=1
                if streetNode.nextConnection.naked == False:
                    allParcEdge.append(streetNode.nextConnection.twinID)
                streetNode = streetNode.next
            return allParcEdge
        
    
        
        
        def GetAllParcEdgeAndTwinID(self):
            whileCount = 0
            allParcEdge = []
            streetNode = self.head
            while streetNode.next!=None:
                if whileCount>1000:
                    break
                whileCount +=1
 
                allParcEdge.append(streetNode.nextConnection.ID)
                allParcEdge.append(streetNode.nextConnection.twinID)
                streetNode = streetNode.next
            return allParcEdge

        
        def GetAllParcVertexID(self):
            whileCount = 0
            allParcVertex = []
            streetNode = self.head
            while streetNode.next!=None:
                if whileCount>1000:
                    break
                whileCount +=1
 
                allParcVertex.append(streetNode.node.ID)
                streetNode = streetNode.next
                
            allParcVertex.append(self.end.node.ID)
            
            return allParcVertex
 
        def GetAllParcVertex(self):
            whileCount = 0
            allParcVertex = []
            streetNode = self.head
            while streetNode.next!=None:
                if whileCount>1000:
                    break
                whileCount +=1
 
                allParcVertex.append(streetNode.node)
                streetNode = streetNode.next
                
            allParcVertex.append(self.end.node)
            
            return allParcVertex
 
        def GetAllStreetNodes(self):
            whileCount = 0
            allStreetNodes = []
            streetNode = self.head
            while streetNode.next!=None:
                if whileCount>1000:
                    break
                whileCount +=1
 
                allStreetNodes.append(streetNode)
                streetNode = streetNode.next
            allStreetNodes.append(self.end)
            
            return allStreetNodes
        
        def PrintVIDHeadToEnd(self):
            print ("In CreateStreet,head to end ")
            whileCount = 0
            allParcVertex = []
            streetNode = self.head
            while streetNode.next!=None:
                if whileCount>1000:
                    break
                whileCount +=1
 
                allParcVertex.append(streetNode.node.ID)
                streetNode = streetNode.next
                
            allParcVertex.append(self.end.node.ID)
            print (allParcVertex)
    
        def PrintVIDEndToHead(self):
            print ("In CreateStreet,end to head ")
            whileCount = 0
            allParcVertex = []
            streetNode = self.end
            while streetNode.prev!=None:
                if whileCount>1000:
                    break
                whileCount +=1
 
                allParcVertex.append(streetNode.node.ID)
                streetNode = streetNode.prev
                
            allParcVertex.append(self.head.node.ID)
            print (allParcVertex)
            
        @staticmethod   
        def CreateStreet(parcEdgeColletion,Edict,streetGraph,sideEdgeCollection = None,abstartStartFlag = False):
            streetNodes = []
            
            if abstartStartFlag == True and sideEdgeCollection != None:
                ### pop the abstartStart
                parcEdgeColletion.pop(0)
                
                newSideEdgeCollection = RF.SortParcEdgeOrder(sideEdgeCollection,Edict)
                
                ### check the order
                if newSideEdgeCollection[-1].endVertex == parcEdgeColletion[0].startVertex or newSideEdgeCollection[-1].endVertex == parcEdgeColletion[0].endVertex: 
                    
                    pass
                else:
              
                    newSideEdgeCollection.reverse()
                    for i in range(len(newSideEdgeCollection)):
                        newSideEdgeCollection[i] = Edict[newSideEdgeCollection[i].twinID]
                
                parcEdgeColletion = newSideEdgeCollection + parcEdgeColletion
            
            
            if len(parcEdgeColletion) >= 2:
         
                ### sort the order
                # check the first parcEdge direction
                if parcEdgeColletion[0].endVertex ==  parcEdgeColletion[1].startVertex  or parcEdgeColletion[0].endVertex ==  parcEdgeColletion[1].endVertex:
                    
                    pass
                else:
                    
                    parcEdgeColletion[0] = Edict[parcEdgeColletion[0].twinID]
                
              
           
                # keep sorting order
                
                for i in range(len(parcEdgeColletion)-1):
                    if parcEdgeColletion[i+1].startVertex!= parcEdgeColletion[i].endVertex:
                        parcEdgeColletion[i+1] = Edict[parcEdgeColletion[i+1].twinID]
             
                # Create StreetNode instance
                for i in range(len(parcEdgeColletion)):
                    streetNodes.append(RF.StreetNode(parcEdgeColletion[i].startVertex))
                streetNodes.append(RF.StreetNode(parcEdgeColletion[len(parcEdgeColletion)-1].endVertex))
                
                # Fill info for Street Node instances
                for i in range(len(streetNodes)):
                    currStreetNode = streetNodes[i]
                    if i == 0:
                        currStreetNode.prev = None
                        currStreetNode.next = streetNodes[i+1]
                        currStreetNode.prevConnection = None
                        currStreetNode.nextConnection = parcEdgeColletion[i]
                        
                    elif i != 0 and i != len(streetNodes)-1:
                        currStreetNode.prev = streetNodes[i-1]
                        currStreetNode.next = streetNodes[i+1]
                        currStreetNode.prevConnection = parcEdgeColletion[i-1]
                        currStreetNode.nextConnection = parcEdgeColletion[i]
                        
                    elif i == len(streetNodes)-1:
                        currStreetNode.prev = streetNodes[i-1]
                        currStreetNode.next = None
                        currStreetNode.prevConnection = parcEdgeColletion[i-1]
                        currStreetNode.nextConnection = None
                
                # Assign it to street and create Street instance
                newStreet = RF.Street(streetNodes[0],streetNodes[len(streetNodes)-1])
                
   
            elif len(parcEdgeColletion) == 1: 
                
                ### Check if startNode is connecting exsiting streets 
                allStreetNodeIDs = streetGraph.GetAllParcVertexID()
                if parcEdgeColletion[0].startVertex.ID in allStreetNodeIDs:
                   parcEdgeColletion[0] = Edict[parcEdgeColletion[0].twinID] 
                
                
                # Create Street Node instances
                streetNode_Start = RF.StreetNode(parcEdgeColletion[0].startVertex)
                streetNode_End = RF.StreetNode(parcEdgeColletion[0].endVertex)
                
                # Fill info for Street Node instances
                streetNode_Start.prev = None
                streetNode_Start.next = streetNode_End
                streetNode_Start.prevConnection = None
                streetNode_Start.nextConnection = parcEdgeColletion[0]
                
                streetNode_End.prev = streetNode_Start
                streetNode_End.next = None
                streetNode_End.prevConnection = parcEdgeColletion[0]
                streetNode_End.nextConnection = None
                
                # Create Street instance
                newStreet = RF.Street(streetNode_Start,streetNode_End)

           
            
            #print "In CreateStreet,end to head "
            whileCount = 0
            allParcVertex = []
            streetNode = newStreet.end
            while streetNode.prev!=None:
                if whileCount>1000:
                    break
                whileCount +=1
 
                allParcVertex.append(streetNode.node.ID)
                streetNode = streetNode.prev
                
            allParcVertex.append(newStreet.head.node.ID)
            #print allParcVertex
            
            
            return newStreet

        @staticmethod  
        def GetStreet(parcEdgeColletion,Edict,choice,streetGraph):
            if choice == "Naked":
                newStreet = RF.Street.CreateStreet(parcEdgeColletion,streetGraph)
            
            elif choice == None:
                RF.Street.SortOrderForStreet(parcEdgeColletion,Edict)
                newStreet = RF.Street.CreateStreet(parcEdgeColletion,streetGraph)
            
            return newStreet
        
        
    class StreetNode:
        def __init__(self,node):
            self.node = node   ### it stores parcVertex, even the parcVertex are the same , they can be in different street
            self.prev = None   ### it stores StreetNode
            self.next = None   ### it stores StreetNode 
            self.prevConnection = None ### it stores parcEdge
            self.nextConnection = None ### it stores parcEdge
            self.ID = node.ID
        
        def __del__(self):
            self.node = None
            self.prev = None   ### it stores parcVertex
            self.next = None   ### it stores parcVertex 
            self.prevConnection = None ### it stores parcEdge
            self.nextConnection = None ### it stores parcEdge
            self.ID = None
        
   
        
    @staticmethod   
    def SortParcEdgeOrder(parcEdgeColletion,Edict):
        #print ("before SortParcEdgeOrder")
        # for pE in parcEdgeColletion:
        #     print pE.startVertex.geometry.X,pE.startVertex.geometry.Y,0
        #print "-----"
        
        newParcEdgeColletion = [pE for pE in parcEdgeColletion ]
        if len(newParcEdgeColletion) >= 2:
            ### sort the order
            # check the first parcEdge direction
            if newParcEdgeColletion[0].endVertex ==  newParcEdgeColletion[1].startVertex  or newParcEdgeColletion[0].endVertex ==  newParcEdgeColletion[1].endVertex:
                #print ("same order")
                pass
            else:
                print ("newParcEdgeColletion[0].ID"),newParcEdgeColletion[0].ID,newParcEdgeColletion[0].twinID
                newParcEdgeColletion[0] = Edict[newParcEdgeColletion[0].twinID]
                #print ("reverse the first")
            
            # keep sorting order
            
            for i in range(len(newParcEdgeColletion)-1):
                if newParcEdgeColletion[i+1].startVertex!= newParcEdgeColletion[i].endVertex:
                    #print ("reverse the index"), i 
                    
                    newParcEdgeColletion[i+1] = Edict[newParcEdgeColletion[i+1].twinID]
        
        #print "after SortParcEdgeOrder "            
        #print len(newParcEdgeColletion)
        # for pE in newParcEdgeColletion:
        #     print pE.startVertex.geometry.X,pE.startVertex.geometry.Y,0
        #print "-----"
        return newParcEdgeColletion
        
    @staticmethod     
    def CheckAccessibility(parcel,Edict): 
        if parcel.accessible == True:
            return 0
        #print ("in CheckAccessibility,  checking  "), parcel.ID
        thisParcelEdges = parcel.edges
        
        for edge in thisParcelEdges:
            #print "this Edge edge.ID",edge.ID
            if edge.naked == False:
                #print "this Edge edge.twinID",edge.twinID,Edict[edge.twinID].streetID
                if edge.streetID != None or Edict[edge.twinID].streetID != None:
                    parcel.accessible = True
                    #print  (parcel.ID) , ("is accessible now  ")
                    break 
                
            elif  edge.naked ==True:
                if edge.streetID != None:
                    parcel.accessible = True
                    #print  (parcel.ID) , ("is accessible now  ")
                    break    
            
    @staticmethod
    def CollectAllInaccesibleParcels(currQ):
        inaccessibleParcels = []
        for parcel in currQ:   
            if parcel.accessible != True:
                inaccessibleParcels.append(parcel)
                
        return  inaccessibleParcels      
        

    @staticmethod    
    def ClusterInAccessibleParcels(inaccessibleParcels):
        ### deep copy the inaccessible Parcels
        treatParcels = [parcel for parcel in inaccessibleParcels]
        
        clusterParcelCollection = []
        clusterEdgeCollection = []
        whileCount = 0
        whileCount2 = 0
        while len(treatParcels)!= 0:
            if whileCount == 100:
                print ("ClusterInAccessibleParcels".error)
            whileCount +=1
            
            newParcelCluster = []
            newEdgeCluster= []
            newParcelCluster.append(treatParcels[0])
            treatParcels.pop(0)
            
            tag = True
            while tag == True:
                whileCount2 += 1
                if whileCount2 == 1000:
                    print  ("ClusterInAccessibleParcels whileCount2".error )
                    break
                
                prevCusterLength  = len(newParcelCluster)
                #print "newParcelCluster",newParcelCluster
                for pF in treatParcels:
                    currClusterEdgeAndTwinIDs = RF.GetCurrClusterEdgeAndTwinIDs(newParcelCluster)
                    #print "currClusterEdgeAndTwinIDs" , currClusterEdgeAndTwinIDs
                    for edge in pF.edges:
                        #print "for edge in pF.edges:",edge.ID
                       
                        if edge.ID in currClusterEdgeAndTwinIDs:
                            newParcelCluster.append(pF)
                            newEdgeCluster.append(edge)
                            #print "newParcelCluster.append(pF)",pF
                            #print "newEdgeCluster.append(edge)",edge
                            break
                
                for parcel in newParcelCluster:
                    if parcel in treatParcels:
                        treatParcels.remove(parcel)
                
                currCusterLength  = len(newParcelCluster)     
                if currCusterLength == prevCusterLength:
                    ### should stop this cluster searching
                    tag = False
                    ### add into ClusterCollection
                    clusterParcelCollection.append(newParcelCluster)
                    clusterEdgeCollection.append(newEdgeCluster)
                
        
        # ### check parcel number
        # for cluster in clusterParcelCollection:
        #     print ("this cluster length")
        #     print (len(cluster))
        #     for pF in cluster:
        #         parcelGeo = pF.GetGeometry()
        #         for pt in parcelGeo:
        #             print (pt.X),pt.Y,0
        #         print ("-----")
        #     print ("--------------------")
        return clusterParcelCollection,clusterEdgeCollection  
    
    @staticmethod    
    def ClusterInAccessibleParcels_Simplified(inaccessibleParcels):
        ### deep copy the inaccessible Parcels
        treatParcels = [parcel for parcel in inaccessibleParcels]
        
        clusterParcelCollection = []
        clusterEdgeCollection = []
        whileCount = 0
        whileCount2 = 0
        while len(treatParcels)!= 0:
            if whileCount == 10000:
                print  ("ClusterInAccessibleParcels_Simplified".error )
                break
            whileCount +=1
            
            newParcelCluster = []
            newEdgeCluster= []
            newParcelCluster.append(treatParcels[0])
            treatParcels.pop(0)
            
            tag = True
            while tag == True:
                whileCount2 += 1
                if whileCount2 == 10:
                    print ("whileCount2 ==10 ")
                    break
                
                prevCusterLength  = len(newParcelCluster)
                
                for pF in treatParcels:
                    currClusterEdgeAndTwinIDs = RF.GetCurrClusterEdgeAndTwinIDs(newParcelCluster)
                    
                    for edge in pF.edges:

                        if edge.ID in currClusterEdgeAndTwinIDs:
                            newParcelCluster.append(pF)
                            newEdgeCluster.append(edge)
                            
                            
                
                for parcel in newParcelCluster:
                    if parcel in treatParcels:
                        treatParcels.remove(parcel)
                
                currCusterLength  = len(newParcelCluster)  
                
                if  currCusterLength!=prevCusterLength:
                    clusterParcelCollection.append(newParcelCluster)
                    clusterEdgeCollection.append(newEdgeCluster)
                    return clusterParcelCollection,clusterEdgeCollection    #one cluster has more than 2 parcels
                
                if currCusterLength == prevCusterLength:
                    ### should stop this cluster searching
                    tag = False
                    ### add into ClusterCollection
                    clusterParcelCollection.append(newParcelCluster)
                    clusterEdgeCollection.append(newEdgeCluster)
                    return clusterParcelCollection,clusterEdgeCollection    #this cluster is a single parcel
            
    @staticmethod    
    def ReturnParcSide(inaccessibleParcel,startEdge,Edict):
        # see if need to choose the side
        # print ("ReturnParcSide")
        # print ("startEdge.ID"), startEdge.ID,"startEdge.twinID",startEdge.twinID
        
        sides = inaccessibleParcel.sides
        
        for side in sides:
            if startEdge.ID in side or startEdge.twinID in side:
                chosenSide = side
                break
            
        if len(chosenSide) ==1:
            return startEdge, startEdge.ID,False
        
        else:
            startEgdeCollection = []
            startEgdeIDCollection = []
            for edgeID in chosenSide:
                startEgdeCollection.append(Edict[edgeID])
                startEgdeIDCollection.append(edgeID)
            #print (startEdge.ID), startEgdeIDCollection
            return startEgdeCollection, startEgdeIDCollection, True
     
 
    @staticmethod
    def FindRoadForCluster_MutipleParcel_MixScore(PL,EDict,currClusterParcel,clusterEdge,parcEdgeGraph_Sim,abstractPENode,streetGraph,wA):
        
        allParcEdgeID = parcEdgeGraph_Sim.GetAllParcEdgeID()
        
        startEdge = clusterEdge[0]
        startParcel = currClusterParcel[0]
        ### check if mutiple edge in one side
        startEdgeResults = []
        tags = []
        
        print ("currInaccessible parcel.ID "),startParcel.ID
        edgeResult,IDresult,tag = RF.ReturnParcSide(startParcel,startEdge,EDict)
      
        ### make sure they are in the parcEdgeGraph , Get the ID , Get the instances
        
        if isinstance(edgeResult, list): ### mutiple edges
            startEdgeID = []
            startEdge = []
            for edge in edgeResult:
                if edge.naked == False:
                    if edge.ID in allParcEdgeID:
                        startEdgeID.append(edge.ID)
                        startEdge.append(EDict[edge.ID])
                    else:
                        startEdgeID.append(edge.twinID)
                        startEdge.append(EDict[edge.twinID])
            
            sidePtList = []       
            
            newEdgeResult = RF.SortParcEdgeOrder(edgeResult,EDict)    
            for edge in newEdgeResult:
                edgeGeo = edge.GetGeometry()
                for i in range(len(edgeGeo)-1):
                    sidePtList.append(edgeGeo[i])
            
            sidePtList.append(newEdgeResult[-1].endVertex.geometry)
            sideGeo = rg.Polyline(sidePtList)
            
          
            
          
        else:
       
            if edgeResult.naked == False:
                if edgeResult.ID in allParcEdgeID:
                    startEdgeID = edgeResult.ID
                    startEdge = EDict[edgeResult.ID]
                else:
                    startEdgeID = edgeResult.twinID
                    startEdge = EDict[edgeResult.twinID]
        
        
        if isinstance(startEdge, list)!=True:
            minscorePath,minScore = RF.FindTheMixScorePathToAbstractNode_PE(parcEdgeGraph_Sim,startEdge,abstractPENode,wA)
            minscorePath.pop()
            newStreet= RF.Street.CreateStreet(minscorePath,EDict,streetGraph)
        
        elif isinstance(startEdge, list)==True:
            parcEdgeGraph_SimStart,startAbstract = parcEdgeGraph_Sim.AbstractSubGraphWithSide(PL,startEdge,sideGeo,EDict)
            ### check if there is quick path
            quickPath, minScore = parcEdgeGraph_SimStart.CheckQuickPath(startAbstract,abstractPENode,wA)
            if quickPath !=None:
                quickPath.pop()
                newStreet= RF.Street.CreateStreet(quickPath,EDict,streetGraph,startEdge,True)
            elif quickPath ==None:
                minscorePath,minScore = RF.FindTheMixScorePathToAbstractNode_PE(parcEdgeGraph_SimStart,startAbstract,abstractPENode,wA)
                
                # print ("sideGeo")
                # for pt in sideGeo:
                #     print (pt.X),pt.Y,0

                # print ("streetGraph",len(streetGraph.GetAllParcEdgeID()))
                # allPEIDs = streetGraph.GetAllParcEdgeID()
                # allPEInstance = [EDict[eID] for eID in allPEIDs]
                
                # for pE in allPEInstance:
                #     pEGeo = pE.GetGeometry()
                #     for pt in pEGeo:
                #         print (pt.X),pt.Y,0
                #     print ("-------")
                
                
                # allPEIDs = []
                # pEGeo = []
              
                # allPEIDs = parcEdgeGraph_Sim.GetAllParcEdgeID()
                # for eID in allPEIDs:
                #     if eID != "abstractNode":
                #         pEGeo.append(EDict[eID].GetGeometry()) 
                #     else:
                #         pEGeo.append([rg.Point3d(0,0,0)]) 

                # print "allPEIDs",allPEIDs
                # for ptlist in pEGeo:
                #     for pt in ptlist:
                #         print (pt.X),pt.Y,0
                #     print ("-------")
                
                
                
                minscorePath.pop()
                newStreet= RF.Street.CreateStreet(minscorePath,EDict,streetGraph,startEdge,True)
        
        return newStreet
           

    @staticmethod 
    def FindRoadForCluster_SingleParcel_MixScore(PL,EDict,clusterParcel,parcEdgeGraph_Sim,abstractPENode,streetGraph,wA):
        thisParcel = clusterParcel[0]
        #print ("currInaccessible parcel.ID "),thisParcel.ID
        allParcEdgeID = parcEdgeGraph_Sim.GetAllParcEdgeID()
        
        ### check if mutiple edge in one side
        startEdgeResults = []
        tags = []
        IDs = []
        edgeIDs = []
        #print "thisParcel.sides",thisParcel.sides
        for edge in thisParcel.edges:
            edgeResult,IDresult,tag = RF.ReturnParcSide(thisParcel,edge,EDict)
            startEdgeResults.append(edgeResult)
            tags.append(tag)
            IDs.append(IDresult)
            edgeIDs.append(edge.ID)
            # print (edge.ID)
            # for pt in edge.GetGeometry():
            #     print (pt.X),pt.Y,0
                
        print ("tags"),tags
        print ("IDs"),IDs
        print ("edgeIDs"),edgeIDs
        
        ### make sure they are in the parcEdgeGraph , Get the ID , Get the instances
        startEdgeIDs = []
        startEdges = []
        for sEdgeResult in startEdgeResults:
            if isinstance(sEdgeResult, list): ### mutiple edges
                
                IDColletion = []
                instanceCollection = []
                for edge in sEdgeResult:
                    
                    if edge.naked == False:
                        if edge.ID in allParcEdgeID:
                            IDColletion.append(edge.ID)
                            instanceCollection.append(EDict[edge.ID])
                            
                        else:
                            IDColletion.append(edge.twinID)
                            instanceCollection.append(EDict[edge.twinID])
                
                if IDColletion!=[]:
                    startEdgeIDs.append(IDColletion)
                    startEdges.append(instanceCollection)
                
            else:
                
                if sEdgeResult.naked == False:
                    if sEdgeResult.ID in allParcEdgeID:
                        startEdgeIDs.append(sEdgeResult.ID)
                        startEdges.append(EDict[sEdgeResult.ID])
                    else:
                        startEdgeIDs.append(sEdgeResult.twinID)
                        startEdges.append(EDict[sEdgeResult.twinID])
                        
            
            
        
        # print "len(startEdgeResults)  ",len(startEdgeResults)                  
        # for sER in startEdgeResults:
        #     IDs = []
        #     if isinstance(sER, list):
        #         for item in sER:
        #             IDs.append(item.ID)
                    
        #         print "IDs",IDs
        #     else:
        #         IDs.append(item.ID)
        #         print "IDs",IDs
            
        
        startEdgeIDs_Clean = []
        startEdges_Clean = []
        for item in startEdgeIDs:
            if item not in startEdgeIDs_Clean:
                    startEdgeIDs_Clean.append(item)
                    
        for item in startEdges:
            if item not in startEdges_Clean:
                    startEdges_Clean.append(item)

      
        
        startEdgeIDs = startEdgeIDs_Clean
        startEdges = startEdges_Clean
        
        # print ("###startEdgeIDs "),startEdgeIDs
        # print ("check")
    
        ### Try all options
        minScorePath_Collection = []
        minScore_Collection = []
        for selectedEdge in startEdges:
            if isinstance(selectedEdge, list)!=True:
                # print ("CheckQuickPath start isinstance(selectedEdge, list)!=True")
                # quickPath,minScore= parcEdgeGraph_Sim.CheckQuickPath(selectedEdge,abstractPENode,wA)
                # print "quickPath",quickPath
                # IDGraph = parcEdgeGraph_Sim.GetIDNumWeightGraph()
                # print IDGraph.graph
                minScorePath,minScore = RF.FindTheMixScorePathToAbstractNode_PE(parcEdgeGraph_Sim,selectedEdge,abstractPENode,wA)

            elif isinstance(selectedEdge, list)==True:
                sidePtList = []       
                newEdgeResult = RF.SortParcEdgeOrder(selectedEdge,EDict)    
                for edge in newEdgeResult:
                    edgeGeo = edge.GetGeometry()
                    for i in range(len(edgeGeo)-1):
                        sidePtList.append(edgeGeo[i])
                
                
                sidePtList.append(newEdgeResult[-1].endVertex.geometry)
                sideGeo = rg.Polyline(sidePtList)
                
                parcEdgeGraph_SimStart,startAbstract = parcEdgeGraph_Sim.AbstractSubGraphWithSide(PL,selectedEdge,sideGeo,EDict)
                
                ### check if there is quick path
                print ("CheckQuickPath start"), [node.ID for node in selectedEdge]
                quickPath,minScore= parcEdgeGraph_SimStart.CheckQuickPath(startAbstract,abstractPENode,wA)
                
                if quickPath !=None:
                    minScorePath = quickPath  # pop later
                    minScore = minScore
                elif quickPath == None:
                    minScorePath,minScore = RF.FindTheMixScorePathToAbstractNode_PE(parcEdgeGraph_SimStart,startAbstract,abstractPENode,wA) # pop later
                    
                  
                
            minScorePath_Collection.append(minScorePath)
            minScore_Collection.append(minScore)
 
        ###Find the shortest one
        minIndex = minScore_Collection.index(min(minScore_Collection))
        
        ###Remove abstractPENode
        #print ("final choice")
    
        #print ([node.ID for node in minScorePath_Collection[minIndex]]) 
            
        minScorePath_Collection[minIndex].remove(abstractPENode)
        
        ###Check the startEdge

        if minScorePath_Collection[minIndex][0].ID != "abstractStart":
            newStreet= RF.Street.CreateStreet(minScorePath_Collection[minIndex],EDict,streetGraph)

        elif minScorePath_Collection[minIndex][0].ID == "abstractStart":
            newStreet= RF.Street.CreateStreet(minScorePath_Collection[minIndex],EDict,streetGraph,startEdges[minIndex],True)
        
        
        
        return newStreet

    @staticmethod 
    def FindRoadForCluster_SingleParcel_MixScore_Extend(PL,EDict,clusterParcel,currParcEdgeGraph,parcEdgeGraph_Sim,abstractPENode,streetGraph,wA,doubleSideTag_InUse):
        originalDoubleSideTag = doubleSideTag_InUse
        
        thisParcel = clusterParcel[0]
        #print ("currInaccessible parcel.ID "),thisParcel.ID
        allParcEdgeID = parcEdgeGraph_Sim.GetAllParcEdgeID()
        
        ### check if mutiple edge in one side
        startEdgeResults = []
        tags = []
        IDs = []
        edgeIDs = []
        #print "thisParcel.sides",thisParcel.sides
        for edge in thisParcel.edges:
            edgeResult,IDresult,tag = RF.ReturnParcSide(thisParcel,edge,EDict)
            startEdgeResults.append(edgeResult)
            tags.append(tag)
            IDs.append(IDresult)
            edgeIDs.append(edge.ID)
            # print (edge.ID)
            # for pt in edge.GetGeometry():
            #     print (pt.X),pt.Y,0
        
        print ("in FindRoadForCluster_SingleParcel_MixScore_Extend")
        print ("thisSingleParcelID"),thisParcel.ID           
        print ("tags"),tags
        print ("IDs"),IDs
        print ("edgeIDs"),edgeIDs
        
        ### make sure they are in the parcEdgeGraph , Get the ID , Get the instances
        startEdgeIDs = []
        startEdges = []
        for sEdgeResult in startEdgeResults:
            if isinstance(sEdgeResult, list): ### mutiple edges
                
                IDColletion = []
                instanceCollection = []
                for edge in sEdgeResult:
                    
                    if edge.naked == False:
                        if edge.ID in allParcEdgeID:
                            IDColletion.append(edge.ID)
                            instanceCollection.append(EDict[edge.ID])
                            
                        else:
                            IDColletion.append(edge.twinID)
                            instanceCollection.append(EDict[edge.twinID])
                
                if IDColletion!=[]:
                    startEdgeIDs.append(IDColletion)
                    startEdges.append(instanceCollection)
                
            else:
                
                if sEdgeResult.naked == False:
                    if sEdgeResult.ID in allParcEdgeID:
                        startEdgeIDs.append(sEdgeResult.ID)
                        startEdges.append(EDict[sEdgeResult.ID])
                    else:
                        startEdgeIDs.append(sEdgeResult.twinID)
                        startEdges.append(EDict[sEdgeResult.twinID])
                        

        
        startEdgeIDs_Clean = []
        startEdges_Clean = []
        for item in startEdgeIDs:
            if item not in startEdgeIDs_Clean:
                    startEdgeIDs_Clean.append(item)
                    
        for item in startEdges:
            if item not in startEdges_Clean:
                    startEdges_Clean.append(item)

      
        
        startEdgeIDs = startEdgeIDs_Clean
        startEdges = startEdges_Clean
        
        # print ("###startEdgeIDs "),startEdgeIDs
        # print ("check")
    
        ### Try all options
        street_Collection = []
        minScore_Collection = []
        
        for selectedEdge in startEdges:
            doubleSideTag_InUse = originalDoubleSideTag 
            minScore_First = 0
            minScore_Second = 0
            midScore = 0
            if isinstance(selectedEdge, list)!=True:
                print ("CheckQuickPath start isinstance(selectedEdge, list)!=True")
                # quickPath,minScore= parcEdgeGraph_Sim.CheckQuickPath(selectedEdge,abstractPENode,wA)
                # print "quickPath",quickPath
                # IDGraph = parcEdgeGraph_Sim.GetIDNumWeightGraph()
                # print IDGraph.graph
                print ("CheckQuickPath start"),selectedEdge.ID #[node.ID for node in selectedEdge]
                quickPath,minScore_First= parcEdgeGraph_Sim.CheckQuickPath(selectedEdge,abstractPENode,wA)
                
                if quickPath !=None:
                    minScorePath = quickPath  # pop later
                    minScore_First = minScore_First
                elif quickPath == None:
                    minScorePath,minScore_First = RF.FindTheMixScorePathToAbstractNode_PE(parcEdgeGraph_Sim,selectedEdge,abstractPENode,wA)
                minScorePath.remove(abstractPENode)

            elif isinstance(selectedEdge, list)==True:
                sidePtList = []       
                newEdgeResult = RF.SortParcEdgeOrder(selectedEdge,EDict)    
                for edge in newEdgeResult:
                    edgeGeo = edge.GetGeometry()
                    for i in range(len(edgeGeo)-1):
                        sidePtList.append(edgeGeo[i])
                
                
                sidePtList.append(newEdgeResult[-1].endVertex.geometry)
                sideGeo = rg.Polyline(sidePtList)
                
                parcEdgeGraph_SimStart,startAbstract = parcEdgeGraph_Sim.AbstractSubGraphWithSide(PL,selectedEdge,sideGeo,EDict)
                print ("isinstance(selectedEdge, list)==True"),selectedEdge
                ### check if there is quick path
                print ("CheckQuickPath start"), [node.ID for node in selectedEdge]
                quickPath,minScore_First= parcEdgeGraph_SimStart.CheckQuickPath(startAbstract,abstractPENode,wA)
                
                if quickPath !=None:
                    minScorePath = quickPath  # pop later
                    minScore_First = minScore_First
                elif quickPath == None:
                    minScorePath,minScore_First = RF.FindTheMixScorePathToAbstractNode_PE(parcEdgeGraph_SimStart,startAbstract,abstractPENode,wA) # pop later
                    
                minScorePath.remove(abstractPENode)
                
            ###Check the startEdge

            
            if minScorePath[0].ID != "abstractStart":
                newStreet= RF.Street.CreateStreet(minScorePath,EDict,streetGraph)

            elif minScorePath[0].ID == "abstractStart":
                
                newStreet= RF.Street.CreateStreet(minScorePath,EDict,streetGraph,selectedEdge,True)
            
            print ("minScore_First"),minScore_First
            print ("newStreetPEid"),[pE.ID for pE in newStreet.GetAllParcEdge()]
            print ("-----Get a new street-----")
            ### Check if double sides are connecting exsiting streets 
            print ("before checking if double sides are connecting exsiting streets, do I need to find:"), doubleSideTag_InUse  
            allStreetNodeIDs = streetGraph.GetAllParcVertexID()
            if newStreet.end.node.ID in allStreetNodeIDs and newStreet.head.node.ID in allStreetNodeIDs:
               doubleSideTag_InUse = False
            print ("after checking if double sides are connecting exsiting streets, do I need to find:"), doubleSideTag_InUse  

            abstractPEGraphWithStreet,abstractDestination = currParcEdgeGraph.AbstractSubGraph(PL,streetGraph,EDict)
            doubleSideTag_InUse,midScore = RF.FindRoadForCluster_SingleEdgeStreet(PL,EDict,newStreet,streetGraph,currParcEdgeGraph,abstractPEGraphWithStreet,abstractDestination,allStreetNodeIDs,wA,doubleSideTag_InUse)
            print ("midScore"),midScore
            ### strange bug. see if I need to revsere the street
            if newStreet.head.node.ID in allStreetNodeIDs:
                print ("newStreet.Reverse(),original head ID is ") ,newStreet.head.node.ID,("next connection is "),newStreet.head.nextConnection.ID
                newStreet.Reverse(EDict)
            #doubleSideTag = False 
            print ("after checking if double sides are connecting exsiting streets, do I need to find:"), doubleSideTag_InUse   
            if doubleSideTag_InUse == True:
                ###abstarct with new street to avoid going back
                abstractPEGraphWithST,abstarctPENodeWithST = currParcEdgeGraph.AbstractSubGraphWithNewStreet(PL,streetGraph,EDict,newStreet)
                #newStartPENode,angleCost = abstractPEGraphWithST.FindNewStartPE_Mix(newStreet.head.nextConnection,EDict)
                newStartPENode = newStreet.head.nextConnection
                print ("Start find doubleside connection, current newStartPENode"), newStartPENode.ID 
                abstractPEGraphWithSTIDs = [pE.ID for pE in abstractPEGraphWithST.graph.keys()]
                if newStartPENode.ID in abstractPEGraphWithSTIDs:
                    pass
                else:
                    newStartPENode = EDict[newStartPENode.twinID]
                
                minScorePath,minScore_Second  = RF.FindTheMixScorePathToAbstractNode_PE(abstractPEGraphWithST,newStartPENode,abstarctPENodeWithST,wA)
                print ("find this path to extend"),[node.ID for node in minScorePath],("cost"),minScore_Second
                
                if minScorePath == []:
                    pass
                ###Find the new StartPE
                elif len(minScorePath)!=2:
                    #totalScoreCost = angleCost + minScore
                    minScorePath.pop()
                    minScorePath.remove(minScorePath[0])
                    newStreet.Extend_PE(minScorePath,EDict)

            print ("minScore_Second"),minScore_Second
            totalScoreCost = minScore_First + midScore + minScore_Second
            street_Collection.append(newStreet)
            minScore_Collection.append(totalScoreCost)
            print ("this round I found "),[pE.ID for pE in newStreet.GetAllParcEdge()],("totalScoreCost"),totalScoreCost
            print ("-----")
        finalStreet = street_Collection[minScore_Collection.index(min(minScore_Collection))]
        print ("final found "),[pE.ID for pE in finalStreet.GetAllParcEdge()]
            
        
        # print "in FindRoadForCluster_SingleParcel_MixScore_Extend"
        # print finalStreet
        # print minScore_Collection
        return finalStreet

    @staticmethod
    def FindRoadForCluster_SingleEdgeStreet(PL,EDict,newStreet,streetGraph,currParcEdgeGraph,abstractPEGraphWithStreet,abstractDestination,allStreetNodeIDs,wA,doubleSideTag_InUse):
        midScore = 0
        if len(newStreet.GetAllParcEdge())==1:
            ### Find all its neighbors
            thisPEInstance = newStreet.GetAllParcEdge()[0]
            thisPEInstanceVIDs = [thisPEInstance.startVertex.ID , thisPEInstance.endVertex.ID ]
            allThisSinglePENb = []
            print ("allThisSinglePENb"), [pE.ID for pE in allThisSinglePENb]
            if thisPEInstance in abstractPEGraphWithStreet.graph.keys():
                thisPEInstance = thisPEInstance
            else:
                thisPEInstance = EDict[thisPEInstance.twinID]
            allThisSinglePENb = abstractPEGraphWithStreet.graph[thisPEInstance]
            
            validThisSinglePENb = []
            print ("validThisSinglePENb"), [pE.ID for pE in validThisSinglePENb]
            for pE in allThisSinglePENb:
                if pE.ID != "abstractNode":
                    if pE.startVertex.ID not in allStreetNodeIDs and pE.endVertex.ID not in allStreetNodeIDs:
                        validThisSinglePENb.append(pE)
                    
                    elif pE.startVertex.ID  in allStreetNodeIDs or pE.endVertex.ID  in allStreetNodeIDs:
                        if pE.startVertex.ID in thisPEInstanceVIDs:
                            commonID =  pE.startVertex.ID
                        elif pE.endVertex.ID in thisPEInstanceVIDs:
                            commonID =  pE.endVertex.ID
                        
                        if commonID in allStreetNodeIDs:
                            pass
                        else:
                            validThisSinglePENb.append(pE)
                        
            ### Check if quick path inside          
            possiblePath = []
            for pE in validThisSinglePENb:
                if pE.startVertex.ID  in allStreetNodeIDs or pE.endVertex.ID  in allStreetNodeIDs:
                    
                    possiblePath.append(pE)
            print ("possiblePath is "),[pE.ID for pE in possiblePath]
            ### if there is quick path,score them 
            if possiblePath!=[]:
                print ("possiblePath!=[]"),[pE.ID for pE in possiblePath]
                minScorePath, minScore_First = abstractPEGraphWithStreet.CheckQuickPath_Eva(thisPEInstance,possiblePath,abstractDestination,wA)
                minScorePath.pop()
                minScorePath.remove(minScorePath[0])
                newStreet.Extend_PE(minScorePath,EDict)
                doubleSideTag_InUse = False
                midScore = minScore_First
            ### else, there is not quick path
            elif possiblePath==[]:
                print ("possiblePath==[]")
                minScorePE, minScore_First = abstractPEGraphWithStreet.CheckQuickPath_Eva(thisPEInstance,validThisSinglePENb,abstractDestination,wA)
                minScorePE.pop()
                minScorePE.remove(minScorePE[0])
                
                print ("minScorePE"),[pE.ID for pE in minScorePE]
                ##### I should forbidden it looks back!change the graph
                abstractPEGraphWithStreetWithNew,abstractDestination = currParcEdgeGraph.AbstractSubGraph(PL,streetGraph,EDict)  ### must keep it updated, some action like add a street in will change the connection

                
                affectedNb = abstractPEGraphWithStreetWithNew.graph[thisPEInstance]
                print ("affectedNb"),[pE.ID for pE in affectedNb]
                for nbE in affectedNb:
                    abstractPEGraphWithStreetWithNew.graph[nbE].pop(thisPEInstance)
                abstractPEGraphWithStreetWithNew.graph.pop(thisPEInstance)
              

                minScorePath,minScore_Second = RF.FindTheMixScorePathToAbstractNode_PE(abstractPEGraphWithStreetWithNew,minScorePE[0],abstractDestination,wA)  ### dont use abstarctPENodeWithST
                print ("minScorePath"),[pE.ID for pE in minScorePath]
                minScorePath.pop()
                ### not need to remove index 0,beacsue i am using next
                newStreet.Extend_PE(minScorePath,EDict)
                print ("newStreet.Extend_PE(minScorePath,EDict)Geo")
                newStreet.PrintGeometry()
                doubleSideTag_InUse = False
                midScore = minScore_First+minScore_Second
 
        return doubleSideTag_InUse,midScore
   
   
    @staticmethod
    def FindRoadForThisDepth_New(GRP,PL,currQ,currParcEdgeGraph,streetGraph,EDict,wA,currJunctionGraph =None, doubleSideTag=False):
        intialdoubleSideTag = doubleSideTag
        #print ("in FindRoadForThisDepth")
        
        for parcel in currQ:
            RF.CheckAccessibility(parcel,EDict)
        
        inaccessibleParcels = RF.CollectAllInaccesibleParcels(currQ)
        if inaccessibleParcels == []:
            return 0  
        #print (inaccessibleParcels)
        
        if len(streetGraph.graph.keys()) == 0:
            #clusterParcelCollection,clusterEdgeCollection = RF.ClusterInAccessibleParcels(inaccessibleParcels)
            clusterParcelCollection,clusterEdgeCollection = RF.ClusterInAccessibleParcels_Simplified(inaccessibleParcels)
            ### immediately add a road 
            
            newStreet = RF.Street.CreateStreet(clusterEdgeCollection[0] ,EDict,streetGraph)
            #print "FindRoadForThisDepth:newStreet",newStreet
            streetGraph.AddStreet(newStreet,EDict)
            #print ("streetGraph Add A Street")
            ### 
            #print ("add a street")
            
            for parcel in inaccessibleParcels:
                RF.CheckAccessibility(parcel,EDict)

            return 0
    
        whileCount = 0
        while len(inaccessibleParcels)!=0:
            abstractPEGraphWithStreet,abstractDestination = currParcEdgeGraph.AbstractSubGraph(PL,streetGraph,EDict)  ### must keep it updated, some action like add a street in will change the connection
            doubleSideTag_InUse = intialdoubleSideTag
            whileCount+=1
            if whileCount>300:
                print ("FindRoadForThisDepth_New whileCount>300")
                break
            
            clusterParcelCollection,clusterEdgeCollection = RF.ClusterInAccessibleParcels(inaccessibleParcels)
            relatedNumClusters = []
            for cluster in clusterParcelCollection:
                relatedNumClusters.append([cluster,len(cluster)])
 
            relatedNumClusters = sorted(relatedNumClusters,key=lambda x: (-x[1])) ### cluster, num
            relatedNumCluster_Sorted = [relatedNumCluster[0] for relatedNumCluster in relatedNumClusters] 

            if len(relatedNumCluster_Sorted[0])!=1:
                mutualPathList = RF.TryClusterRoadFinding(GRP,relatedNumCluster_Sorted,EDict)
                #print ("mutualPathList"), [pE.ID for pE in mutualPathList]
                
                mutualPtList = []       
                newEdgeResult = RF.SortParcEdgeOrder(mutualPathList,EDict)     
                for edge in newEdgeResult:
                    edgeGeo = edge.GetGeometry()
                    for i in range(len(edgeGeo)-1):
                        mutualPtList.append(edgeGeo[i])
                    
                mutualPtList.append(newEdgeResult[-1].endVertex.geometry)
                mutualPathGeo = rg.Polyline(mutualPtList)
                
                
                ### Check if it is connected 
                allStreetNodeIDs = streetGraph.GetAllParcVertexID()
                # print ("allStreetNodeIDs"),allStreetNodeIDs
                # print ("### Check if it is connected "), newEdgeResult[-1].endVertex.ID,newEdgeResult[0].startVertex.ID
                if newEdgeResult[-1].endVertex.ID in allStreetNodeIDs or newEdgeResult[0].startVertex.ID in allStreetNodeIDs:
                    newStreet= RF.Street.CreateStreet(newEdgeResult,EDict,streetGraph)
                    pass
                else:
                    
                    abstractPEGraphWithStart,abstractMutualStart = abstractPEGraphWithStreet.AbstractSubGraphWithMutualStart(PL,newEdgeResult,mutualPathGeo,EDict)
                    
                    # for pt in mutualPathGeo:
                    #     print (pt.X),pt.Y,0
                    # print ("mutualPathList"),[pE.startVertex.ID for pE in mutualPathList],[pE.endVertex.ID for pE in mutualPathList]
                    # print ("newEdgeResult"),[pE.startVertex.ID for pE in newEdgeResult],[pE.endVertex.ID for pE in newEdgeResult]
                    ### check if there is quick path
                    quickPath, minScore_Quick = abstractPEGraphWithStart.CheckQuickPath(abstractMutualStart,abstractDestination,wA)
                    minscorePath,minScore_NonQuick = RF.FindTheMixScorePathToAbstractNode_PE(abstractPEGraphWithStart,abstractMutualStart,abstractDestination,wA)
                    
                    if quickPath!=None:
                        if minScore_Quick<=minScore_NonQuick:
                            quickPath.pop()
                            newStreet= RF.Street.CreateStreet(quickPath,EDict,streetGraph,mutualPathList,True)
                            minScore = minScore_Quick
                            
                        elif minScore_Quick >minScore_NonQuick:
                            minscorePath.pop()
                            newStreet= RF.Street.CreateStreet(minscorePath,EDict,streetGraph,mutualPathList,True)
                            minScore = minScore_NonQuick
                            
                    elif quickPath==None:
                        minscorePath.pop()
                        newStreet= RF.Street.CreateStreet(minscorePath,EDict,streetGraph,mutualPathList,True)
                        minScore = minScore_NonQuick
                    
                    # if quickPath !=None:
                    #     quickPath.pop()
                    #     newStreet= RF.Street.CreateStreet(quickPath,EDict,streetGraph,mutualPathList,True)
                    
                    # elif quickPath ==None:
                    #     minscorePath,minScore = RF.FindTheMixScorePathToAbstractNode_PE(abstractPEGraphWithStart,abstractMutualStart,abstractDestination,wA)
                    #     minscorePath.pop()
                    #     newStreet= RF.Street.CreateStreet(minscorePath,EDict,streetGraph,mutualPathList,True)
                print ("newStreetPEid"),[pE.ID for pE in newStreet.GetAllParcEdge()]
                #doubleSideTag_InUse,midScore = RF.FindRoadForCluster_SingleEdgeStreet(EDict,newStreet,currParcEdgeGraph,abstractPEGraphWithStreet,abstractDestination,allStreetNodeIDs,wA,doubleSideTag_InUse)
                ### Check if double sides are connecting exsiting streets 
                print ("before checking if double sides are connecting exsiting streets, do I need to find:"), doubleSideTag_InUse  
                allStreetNodeIDs = streetGraph.GetAllParcVertexID()
                if newStreet.end.node.ID in allStreetNodeIDs and newStreet.head.node.ID in allStreetNodeIDs:
                    doubleSideTag_InUse = False

                ### strange bug. see if I need to revsere the street
                if newStreet.head.node.ID in allStreetNodeIDs:
                    print ("newStreet.Reverse(),original head ID is ") ,newStreet.head.node.ID,("next connection is "),newStreet.head.nextConnection.ID
                    newStreet.Reverse(EDict)
                
                #doubleSideTag = False 
                print ("after checking if double sides are connecting exsiting streets, do I need to find:"), doubleSideTag_InUse   
                if doubleSideTag_InUse == True:
                    ###abstarct with new street to avoid going back
                    abstractPEGraphWithST,abstarctPENodeWithST = currParcEdgeGraph.AbstractSubGraphWithNewStreet(PL,streetGraph,EDict,newStreet)
                    #newStartPENode,angleCost = abstractPEGraphWithST.FindNewStartPE_Mix(newStreet.head.nextConnection,EDict)
                    newStartPENode = newStreet.head.nextConnection
                    print ("new street pe ID"),newStreet.GetAllParcEdgeID()
                    newStreet.PrintVIDHeadToEnd()
                    newStreet.PrintVIDEndToHead()
                    print ("Start find doubleside connection, current newStartPENode"), newStartPENode.ID 
                    abstractPEGraphWithSTIDs = [pE.ID for pE in abstractPEGraphWithST.graph.keys()]
                    if newStartPENode.ID in abstractPEGraphWithSTIDs:
                        pass
                    else:
                        newStartPENode = EDict[newStartPENode.twinID]
                    
                    minScorePath,minScore  = RF.FindTheMixScorePathToAbstractNode_PE(abstractPEGraphWithST,newStartPENode,abstarctPENodeWithST,wA)
                    print ("find this path to extend"),[node.ID for node in minScorePath],("cost"),minScore
                    
                    if minScorePath == []:
                        pass
                    ###Find the new StartPE
                    elif len(minScorePath)!=2:
                        #totalScoreCost = angleCost + minScore
                        totalScoreCost =  minScore
                        minScorePath.pop()
                        minScorePath.remove(minScorePath[0])
                        newStreet.Extend_PE(minScorePath,EDict)

            
            
            elif len(relatedNumCluster_Sorted[0])==1:
                newStreet = RF.FindRoadForCluster_SingleParcel_MixScore_Extend(PL,EDict,relatedNumCluster_Sorted[0],currParcEdgeGraph,abstractPEGraphWithStreet,abstractDestination,streetGraph,wA,doubleSideTag_InUse)
                
                
            ### add a street
            streetGraph.AddStreet(newStreet,EDict) 
            
          
            
            #print ("streetGraph Add A Street")
            ### after adding a road to streetGraph , need to update info
            for parcel in inaccessibleParcels:
                RF.CheckAccessibility(parcel,EDict)
                
            inaccessibleParcels = RF.CollectAllInaccesibleParcels(inaccessibleParcels)
            abstractPEGraphWithStreet,abstractDestination = currParcEdgeGraph.AbstractSubGraph(PL,streetGraph,EDict)
            prevTime = time.time()
            #gc.collect() ### try
            # currTime = time.time()
            # usedTime = currTime - prevTime
            #print ("gc use time ")  ,  usedTime     
               
                                   
    @staticmethod    
    def Dijkstra_ParcEdgeGraph(parcEdgeGraph, start):
        print ("for getting info - index")
        nodeKey = []
        for key in parcEdgeGraph.graph.keys():
            nodeKey.append(key.ID)
        print (nodeKey)
        
        print ("for getting info - geo")
        for key in parcEdgeGraph.graph.keys():
            try:
                nodeGeo = key.GetGeometry()
            except:
                print ("abstract node")
            else:
                for pt in nodeGeo:
                    print (pt.X),",",pt.Y,",",0
                print ("-----------")
                
        print ("for getting info - nb")
        for key in parcEdgeGraph.graph.keys():
            nb = parcEdgeGraph.graph[key] 
            nbIDs = [nbNode.ID for nbNode in nb] 
            print (nbIDs)      
            print ("-----------")    
        print ("in Dijkstra_ParcEdgeGraph")
        IDgraph = parcEdgeGraph.GetIDNumWeightGraph()
        print (IDgraph.graph)
        print ("the start id is"),(start.ID)
        
        
        IDgraph_Length = parcEdgeGraph.GetIDNumWeightLengthGraph()
        print (IDgraph_Length.graph)
        print (start.ID)
        
        ### this is the shortest path for the full graph
        
        distances = {node: float('inf') for node in parcEdgeGraph.graph}
        distances[start] = 0
        pq = [(0, start)]
        predecessors = {node: None for node in parcEdgeGraph.graph}
        
        
        
        while pq:
            
            current_dist, current_node = heapq.heappop(pq)
            if current_dist > distances[current_node]:
                
                continue
            
            for neighbor, parcEdge in parcEdgeGraph.graph[current_node].items():
                print ("neighbor, parcEdge"), neighbor.ID,parcEdge.ID,parcEdge.GetGeometry().Length
                distance = current_dist + current_node.GetGeometry().Length
                if distance < distances[neighbor]:
                    distances[neighbor] = distance
                    predecessors[neighbor] = current_node
                    print ("update,distance,current_node"),distance,current_node.ID
                    #print "heapq.heappush" , neighbor
                    heapq.heappush(pq, (distance, neighbor))
         

        return  distances, predecessors
    
    @staticmethod    
    def Dijkstra_ParcEdgeGraph_Mix(parcEdgeDistanceGraph, parcEdgeAngleGraph, start,wA):
        #print ("Dijkstra_ParcEdgeGraph_Mix") 
        ### prepare the range of distance 
        ### prepare the range of angle
        wD = 1 - wA
        distanceList = []
        for pE in parcEdgeDistanceGraph.graph.keys():
            distanceList.append(pE.GetGeometry().Length)
        
        minDist = min(distanceList)
        maxDist = max(distanceList)

        
        minAngle = 0
        maxAngle = 180
        

        scoreSum = {node: float('inf') for node in parcEdgeAngleGraph.graph}
        scoreSum[start] = 0
        pq = [(0, start)]
        predecessors = {node: None for node in parcEdgeAngleGraph.graph}
        whileCount = 0
        while pq:
            whileCount+=1
            if whileCount == 4000:
                
                print ("Dijkstra_ParcEdgeGraph_Mix".error)   
            current_score, current_node = heapq.heappop(pq)
            if current_score > scoreSum[current_node]:
                continue
                   
            #print ("current_node"),current_node.ID
            # for pt in current_node.GetGeometry():
            #     print pt.X,pt.Y,0
            for neighbor, theirAngle in parcEdgeAngleGraph.graph[current_node].items():
                #print ("current_node.ID,neighbor.ID"),current_node.ID,neighbor.ID
                if predecessors[neighbor] == predecessors[current_node] and predecessors[neighbor]!=None and current_node.ID!="abstractNode" and neighbor.ID!="abstractNode":
                    if current_node.startVertex != neighbor.startVertex and current_node.startVertex != neighbor.endVertex:
                        thisChosen = current_node.endVertex
                    elif current_node.startVertex == neighbor.startVertex or current_node.startVertex == neighbor.endVertex:
                        thisChosen = current_node.startVertex

                    if neighbor.startVertex == thisChosen :
                        nbChosen = neighbor.startVertex
                    elif neighbor.endVertex == thisChosen :
                        nbChosen = neighbor.endVertex

                    ### get This node geo 
                    if thisChosen == current_node.startVertex:
                        thisGeo = rg.Polyline(current_node.GetGeometry())
                        
                    elif thisChosen == current_node.endVertex:
                        thisGeo = rg.Polyline(current_node.GetGeometry())
                        thisGeo.Reverse()
                        
                        
                    ### get nb node geo 
                    if nbChosen == neighbor.startVertex:
                        nbGeo = rg.Polyline(neighbor.GetGeometry())
                        
                    elif thisChosen == neighbor.endVertex:
                        nbGeo = rg.Polyline(neighbor.GetGeometry())
                        nbGeo.Reverse()

                    # thisVec = rg.Vector3d (thisGeo[1] - thisGeo[0])
                    # nbVec = rg.Vector3d (nbGeo[1] - nbGeo[0])

                    thisVec = rg.Vector3d (thisGeo.Last - thisGeo.First)
                    nbVec = rg.Vector3d (nbGeo.Last - nbGeo.First)
                    
                    costAngle = rm.ToDegrees(rg.Vector3d.VectorAngle(thisVec,nbVec))
                    #print "costAngle" ,costAngle
                else:
                    costAngle = theirAngle
                    #print "theirAngle",theirAngle
                
                if  current_node.ID!="abstractNode":
                    costDist = neighbor.GetGeometry().Length
                else:
                    costDist = 0
                #print "wD * costDist + wA * costAngle",wD,costDist,wA,costAngle
                costDist_Remap = (costDist-minDist) / (maxDist- minDist)
                costAngle_Remap = (costAngle-minAngle) / (maxAngle- minAngle)
                #print "wD * costDist_Remap + wA * costAngle_Remap",wD,costDist_Remap,wA,costAngle_Remap
                costMix = wD * costDist_Remap + wA * costAngle_Remap
                #print "costMix",costMix
                totalCost = current_score + costMix
                #print "totalCost",totalCost
                #print "asdasdasdads",current_node.ID,neighbor.ID
                if totalCost < scoreSum[neighbor]:
                    scoreSum[neighbor] = totalCost
                    predecessors[neighbor] = current_node
                    heapq.heappush(pq, (totalCost, neighbor))
                    #print ("update, predecessors_Angle[neighbor] = current_node"), neighbor.ID,current_node.ID
                    #print "asdasdasdasdasaaaaaaaaaaaa"
                
        return  scoreSum, predecessors        
    
    
    @staticmethod    
    def Dijkstra_JunctionGraph(junctionGraph, start):
        print ("Dijkstra_JunctionGraph"),start.ID
        print ("Dijkstra_JunctionGraph"),start.geometry
        ### this is the shortest path for the full graph
        distances = {node: float('inf') for node in junctionGraph.graph}
        IDgraph = junctionGraph.GetIDNumWeightGraph()
        print (IDgraph.graph)
        distances[start] = 0
        pq = [(0, start)]
        predecessors = {node: None for node in junctionGraph.graph}
        
        while pq:
            
            current_dist, current_node = heapq.heappop(pq)
            #print "current_dist, current_node",current_dist, current_node.ID
            if current_dist > distances[current_node]:
                continue
            #print ("current_node"),current_node.ID,current_node.onBoundary
            #print ("current_node"),current_node.geometry.X,current_node.geometry.Y,0
            for neighbor, parcEdge in junctionGraph.graph[current_node].items():
                #print ("current_node,neighbor,parcEdge"),current_node.ID,neighbor.ID,parcEdge.ID,"parcEdge.GetGeometry().Length",parcEdge.GetGeometry().Length
                #print "neighbor, parcEdge ",neighbor.ID, parcEdge.ID
                distance = current_dist + parcEdge.GetGeometry().Length
                #print ("current_dist"),current_dist,("distance"),distance
                if distance < distances[neighbor]:
                    distances[neighbor] = distance
                    predecessors[neighbor] = current_node
                    
                    heapq.heappush(pq, (distance, neighbor))

        return  distances, predecessors
    

    @staticmethod       
    def FindTheMixScorePathToAbstractNode_PE(graph,startPENode,abstractPENode,wA):
        angleGraph = graph.CreateParcEdgeAngleGraph()
        distGraph = graph
         
        angleSum, anglePredecessors = RF.Dijkstra_ParcEdgeGraph_Mix(distGraph,angleGraph,startPENode,wA)
        
        
        minAngle = angleSum[abstractPENode]
        
        #try:
        minAnglePath = RF.FindPath(anglePredecessors, startPENode, abstractPENode)
        
        # except:
        #     IDgraph = graph.GetIDNumWeightGraph()
        #     print ("FindTheMixScorePathToAbstractNode_PE")
        #     print ("startPENode,abstractPENode"), startPENode.ID,abstractPENode.ID
            
        #     print (IDgraph.graph)
            
        # else:
        #     print "FindPath".error  
        print ("FindTheMixScorePathToAbstractNode_PE"), ("startPENode.ID"),startPENode.ID,("path"),[node.ID for node in minAnglePath]
        print ("cost"),(minAngle)
        return minAnglePath,minAngle  
    
    @staticmethod       
    def FindTheClosestPathToAbstractNode_PV(graph,startPVNode,abstractPVNode):
        distances, predecessors = RF.Dijkstra_JunctionGraph(graph, startPVNode)
        
        
        shortestDisitance = distances[abstractPVNode]
        shortestPVPath = RF.FindPath(predecessors, startPVNode, abstractPVNode)
        if shortestPVPath == []:
            print ("in FindTheClosestPathToAbstractNode_PV, shortestPVPath == []")
            return [],None,None
        #print "in FindTheClosestPathToAbstractNode_PV"
        #for pv in shortestPVPath:
            #print pv.ID,pv.onBoundary,pv.geometry.X,pv.geometry.Y,0
        
        #print shortestPVPath[-2].ID,abstractPVNode.ID
        
        print ([node.ID for node in shortestPVPath])
        newIDgraph = graph.GetIDNumWeightGraph()
        print ("Check newIDgraph junction"), newIDgraph.graph
        
        lastParcEdge = graph.graph[shortestPVPath[-2]][abstractPVNode]  # -1 is abstractPVNode
        return shortestPVPath,lastParcEdge,shortestDisitance  
    
    @staticmethod  
    def FindPath(predecessors, start, end):
        path = []
        node = end
        whileCount = 0
        while node is not None:
            whileCount+=1
            if whileCount == 300:
                
                print ("startGeo")
                for pt in start.GetGeometry():
                    print (pt.X),pt.Y,0
                    
                print ("-----")
                print ("endGeo")
                for pt in end.GetGeometry():
                    print (pt.X),pt.Y,0
                    
                print ("-----")
                
                print ("node.ID"),node.ID
                for pt in node.GetGeometry():
                    print (pt.X),pt.Y,0
                
                print ("-----")
                print ("predecessors[node].ID"),predecessors[node].ID
                for pt in predecessors[node].GetGeometry():
                    print (pt.X),pt.Y,0
                print ("-----")
                
                print ("FindPath".error)   
            path.append(node)
            #print ("FindPath node.ID"),node.ID
            node = predecessors[node]
        path.reverse()
        if path[0] == start:

            return path
        else:
            
            return []
        
    @staticmethod
    def GetCurrClusterEdgeAndTwinIDs(currCluster):
        currClusterEdgeAndTwinIDs = []
        for parcel in currCluster:
            for edge in parcel.edges:
                currClusterEdgeAndTwinIDs.append(edge.ID)
                if edge.naked == False:
                    currClusterEdgeAndTwinIDs.append(edge.twinID)
        
        return currClusterEdgeAndTwinIDs
    

    ###########
    ### Help Func： Intialization 
    ###########
    
    ###### Get threshold
    @staticmethod
    def GetRoadFindingThreshold(boundary, idealArea,percentageRF):

        totalArea = rg.AreaMassProperties.Compute(boundary.ToPolylineCurve()).Area
        estimatedMaxNum = totalArea/idealArea
        estimatedMaxDepth = math.log(estimatedMaxNum, math.e) / math.log(2, math.e)
        roadFindingThreshold = estimatedMaxDepth * percentageRF
        
        if percentageRF ==1 :
            print ("roadFindingThreshold:"), 999999
            print ("estimatedMaxDepth:"), estimatedMaxDepth
            return 99999
        
        print ("estimatedMaxDepth:"), estimatedMaxDepth
        print ("roadFindingThreshold:"), roadFindingThreshold
        return roadFindingThreshold
    
    @staticmethod
    def InitializedStreets(firstParcel,allEdgeIDLists,E_Dict_L0,streetGraph_L0):
        initializedStreets = []
        
        for edgeIDList in allEdgeIDLists:
            ### one list to be one street
            edgeCollection = []
            for edgeID in edgeIDList:
                
                edgeCollection.append(firstParcel.edges[edgeID])
            newStreet = RF.Street.CreateStreet(edgeCollection,E_Dict_L0,streetGraph_L0)
            newStreet.original = True
            
            initializedStreets.append(newStreet)
        return initializedStreets
        

    ###########
    ### Help Func： Before Road Finding
    ###########
    @staticmethod
    def UpdateSideInfo (currQ,E_Dict_All,sameSideList):
        
        for pF in currQ:

            #print "before",pF.sides
            pF.GetSide(E_Dict_All)
            pF.CombineSide(E_Dict_All,sameSideList)
            
            #print "after",pF.sides
    ###########
    ### Help Func：Print 
    ###########
    @staticmethod
    def PrintInaccessibleParcels(currQ,EDict):
        ######## For diagram, show each depth inaccessible parcle clusters
        for parcel in currQ:
            RF.CheckAccessibility(parcel,EDict)
        inaccessibleParcels = RF.CollectAllInaccesibleParcels(currQ)
        clusterParcelCollection,clusterEdgeCollection = RF.ClusterInAccessibleParcels(inaccessibleParcels)
        
        parcelNum = []
        for cluster in clusterParcelCollection:
            parcelNum.append(len(cluster)) 
        
        print ("InaccessibleParcels parcelNum"), parcelNum    
        for parcelCluster in clusterParcelCollection:
            for parcel in parcelCluster:
                for pt in parcel.GetGeometry():
                    print (pt.X), pt.Y,0
                print ("-----")
        
    
    ##################################################
    ### Cluster road finding
    ##################################################
    #########################
    ### I - L Path 
    #########################
    @staticmethod
    def TryClusterRoadFinding(GRP,clusterColletion,EDict):
        
        ### Create num related clusters
        # relatedNumClusters = []
        # for cluster in clusterColletion:
        #     relatedNumClusters.append([cluster,len(cluster)])
        
        # relatedNumClusters = sorted(relatedNumClusters,key=lambda x: (-x[1]))  ### cluster, num
        # relatedNumCluster_Sorted = [relatedNumCluster[0] for relatedNumCluster in relatedNumClusters]  
        
        mutualPath = None
        if len(clusterColletion) == 1:
            print ("in TryClusterRoadFinding len(clusterColletion) == 1"),[pF.ID for pF in clusterColletion[0]]
            mutualPath,treatedNum = RF.TryGetMutualPath(GRP,clusterColletion[0],[],EDict)  ### input a empty list for the next cluster
        
        elif len(clusterColletion) != 1:    
            print ("in TryClusterRoadFinding len(clusterColletion) != 1"),len(clusterColletion),[len(collection) for collection in clusterColletion]
            
            for i in range(len(clusterColletion)-1):
                print ("in currCollection"),  [pF.ID for pF in clusterColletion[i]],("in nextCollection"),[pF.ID for pF in clusterColletion[i+1]]
                mutualPath,treatedNum = RF.TryGetMutualPath(GRP,clusterColletion[i],clusterColletion[i+1],EDict)
                
                if mutualPath !=None:
                    break
                else:
                    pass
                
                if i == len(clusterColletion)-2:
                    lastSecondMutualPath = mutualPath
                    lastSecondTreatedNum = treatedNum
                
            if mutualPath == None:
                lastMutualPath,lastTreatedNum = RF.TryGetMutualPath(GRP,clusterColletion[len(clusterColletion)-1],[],EDict)
                if lastTreatedNum>lastSecondTreatedNum:
                    mutualPath = lastMutualPath
                else:
                    mutualPath = mutualPath
                
        
        if mutualPath!=None:
            mutualPathList = mutualPath[0]

        # else:
        #     mutualPathList = None


        return mutualPathList

    @staticmethod
    def TryGetMutualPath(GRP,currCluster,nextCluster,EDict):
        inaccessibleParcels = [parcel for parcel in currCluster]
        mutualEdges_Extended = RF.GetExtendedMutualEdges(inaccessibleParcels,EDict)
        
        #print ("in new TryGetMutualPath, printing mutualEdges")
        #print ([pE.ID for pE in mutualEdges])
        # for pE in mutualEdges:
        #     for pt in pE.GetGeometry():
        #         print (pt.X),pt.Y,0
        #     print ("-----") 
            
        ####### Check if the simplest case
        if len(mutualEdges_Extended) == 1 and len(inaccessibleParcels) ==2:
            pathCollection =[]
            
            thisPath = deque()
            thisPath.append(mutualEdges_Extended[0])
            currAngleCost = 0
            currTreatedNum = 2
            finalParcel = None
            thisSolution = [thisPath, currAngleCost,currTreatedNum,finalParcel]
            pathCollection.append(thisSolution)   
        
        #### global info 
        unionRegion = RF.GetUnionRegion(inaccessibleParcels)
        
        ####### I path
        oneSideNakedMutualEdges = RF.GetOneSideNakedMutualEdges(unionRegion,mutualEdges_Extended)  #### global info 
        print ("in new TryGetMutualPath, printing oneSideNakedMutualEdges")
        print ([pE.ID for pE in oneSideNakedMutualEdges])
        for pE in oneSideNakedMutualEdges:
            for pt in pE.GetGeometry():
                print (pt.X),pt.Y,0
            print ("-----") 
        allEdges = RF.GetAllEdges(inaccessibleParcels,EDict)
        #IPathCollection = RF.FindIPathColletion(GRP,oneSideNakedMutualEdges,inaccessibleParcels,EDict,60)
        IPathCollection = RF.FindIPathColletion(GRP,oneSideNakedMutualEdges,allEdges,inaccessibleParcels,EDict,60)
        IPathCollection_Sorted = sorted(IPathCollection,key=lambda x: (-x[1], x[2]))
        
        print ("in new TryGetMutualPath, printing IPathCollection_Sorted")
        for solution in IPathCollection_Sorted:
            print ("solutionGeometry")
            for pE in solution[0]:
                for pt in pE.GetGeometry():
                    print (pt.X),pt.Y,0
                print ("-----") 
          
            print ("TreatedNum"),(solution[1])
            print ("AngleCost"),(solution[2])
            print ("-------")
        fullAccessIPath = None
        
        for i in range(len(IPathCollection_Sorted)):
            print ("ALLIPath") ,[edge.ID for edge in IPathCollection_Sorted[i][0]] 
            if IPathCollection_Sorted[i][1] == len(currCluster):
                fullAccessIPath = IPathCollection_Sorted[i]
                print ("fullAccessIPath"), [edge.ID for edge in fullAccessIPath[0]]
                return fullAccessIPath, IPathCollection_Sorted[i][1]
        
        print ("fullAccessIPath") ,fullAccessIPath  
       
        ####### L path
        if fullAccessIPath == None:
            fullNakedEdges,allEdges = RF.GetFullNakedEdges(unionRegion,inaccessibleParcels,EDict)
            print ("in new TryGetMutualPath, Lpath, printing fullNakedEdges")
            print ([pE.ID for pE in fullNakedEdges])
            for pE in fullNakedEdges:
                for pt in pE.GetGeometry():
                    print (pt.X),pt.Y,0
                print ("-----") 
 
            LPathCollection = RF.FindLPathColletion(GRP,inaccessibleParcels,fullNakedEdges,allEdges,EDict)
            LPathCollection_Sorted = sorted(LPathCollection,key=lambda x: (-x[1], x[2]))
            fullAccessLPath = None
            
            for i in range(len(LPathCollection_Sorted)):
                #print ("LPathCollection_Sorted[i][2] == len(currCluster)") ,LPathCollection_Sorted[i][1],LPathCollection_Sorted[i][2] , len(currCluster)
                if LPathCollection_Sorted[i][1] == len(currCluster):
                    fullAccessLPath = LPathCollection_Sorted[i]
                    return fullAccessLPath, LPathCollection_Sorted[i][1]
            
        ### Can not tackle all parcels
        if fullAccessIPath == None and fullAccessLPath == None:
            combinedAccessPath = []
            combinedAccessPath.extend(IPathCollection_Sorted) 
            combinedAccessPath.extend(LPathCollection_Sorted) 
            combinedCollection_Sorted = sorted(combinedAccessPath,key=lambda x: (-x[1], x[2]))
            # Check if the tackle num is >= next cluster num
            print ("combinedCollection_Sorted[0][1] >= len(nextCluster)"),combinedCollection_Sorted[0][1] , len(nextCluster)

            if combinedCollection_Sorted[0][1] >= len(nextCluster):
                return combinedCollection_Sorted[0], combinedCollection_Sorted[0][1]
            
            else:
                return None,None


            
    @staticmethod
    def FindIPathColletion(GRP,oneSideNakedMutualEdges,relatedParcEdges,inaccessibleParcels,EDict,angleThreshold = 60):
        IpathCollection = []
        ### only 2 parcels, 1 mutual edge
    
        for currNakedMutualEdge in oneSideNakedMutualEdges:
            thisSolution = RF.FindIPath(GRP,currNakedMutualEdge,relatedParcEdges,inaccessibleParcels,EDict,angleThreshold = 60)
            IpathCollection.append(thisSolution)  

        return IpathCollection

    @staticmethod
    def FindIPath(GRP,currEdge,relatedParcEdges,inaccessibleParcels,EDict,angleThreshold = 60):
        #print ("in FindIPath ,startEdgeID"), currEdge.ID
        currAngleCost = 0
        thisPath = deque()
        thisPath.append(currEdge)
        
        currRelatedParcEdges = [pE for pE in relatedParcEdges]

        currRelatedParcEdgeGraph = GRP.ParcEdgeGraph.CreateRelatedEdgeGraph(currRelatedParcEdges)
        currRelatedParcEdgeAngleGraph = currRelatedParcEdgeGraph.CreateParcEdgeAngleGraph()

        whileCount = 0 
        while len(currRelatedParcEdgeAngleGraph.graph[thisPath[-1]].keys()) > 0: 
            whileCount+=1
            if whileCount == 30000 :
                print ("FindIPath,whileCount == 30000").error
                break 
            allNbEdges = currRelatedParcEdgeAngleGraph.graph[thisPath[-1]].keys()
            allNbAngles = currRelatedParcEdgeAngleGraph.graph[thisPath[-1]].values()
            
         
            #print ("in FindIPath ,allNbEdges"), [edge.ID for edge in allNbEdges]
            
            minAngle = min(allNbAngles)
            minIndex = allNbAngles.index(minAngle) 
            selectedEdge = allNbEdges[minIndex]
            
            #print ("minAngle < angleThreshold"), minAngle < angleThreshold
            if minAngle < angleThreshold:
                currAngleCost += minAngle
                thisPath.append(selectedEdge)
                #print ("thisPath.append(selectedEdge)"),selectedEdge.ID
            
            else: 
                break
     
            
            # print ("prevRelatedParcEdges"),[edge.ID for edge in prevRelatedParcEdges]
            # print ("currRelatedParcEdges before remove"),[edge.ID for edge in currRelatedParcEdges]
            
            ### Update currRelatedParcEdges
            
            #Related with thisPath[-2]
            avoidReturnEdges = currRelatedParcEdgeGraph.graph[thisPath[-2]].keys()
            avoidReturnEdges.remove(thisPath[-1])
            avoidReturnEdges.append(thisPath[-2])
            
            #print ("thisPath"),[pE.ID for pE in thisPath]
            for edge in avoidReturnEdges:
                #print ("in avoidReturnEdges"),edge.ID
                currRelatedParcEdges.remove(edge)
                
            currRelatedParcEdgeGraph = GRP.ParcEdgeGraph.CreateRelatedEdgeGraph(currRelatedParcEdges) 
            currRelatedParcEdgeAngleGraph = currRelatedParcEdgeGraph.CreateParcEdgeAngleGraph()
          
        
        ##### check how many parcels this path treated 
        treatedNum = RF.CheckTreatedParcelNum(thisPath,inaccessibleParcels,EDict)
        thisSolution = [thisPath,treatedNum,currAngleCost]
        #print ("------")
        return thisSolution

    @staticmethod
    def FindIPath_ForL(GRP,currEdge,relatedParcEdges,inaccessibleParcels,EDict,angleThreshold = 60,anthorPairEdge = None):
        #print ("in FindIPath ,startEdgeID"), currEdge.ID
        currAngleCost = 0
        thisPath = deque()
        thisPath.append(currEdge)
        
        currRelatedParcEdges = [pE for pE in relatedParcEdges]

        currRelatedParcEdgeGraph = GRP.ParcEdgeGraph.CreateRelatedEdgeGraph(currRelatedParcEdges)
        currRelatedParcEdgeAngleGraph = currRelatedParcEdgeGraph.CreateParcEdgeAngleGraph()

        
        if anthorPairEdge!=None:
            currEdge_nbEdges = currRelatedParcEdgeGraph.graph[currEdge].keys()
            anotherEdge_nbEdges = currRelatedParcEdgeGraph.graph[anthorPairEdge].keys()
            
            commonEdge = list(set(currEdge_nbEdges).intersection( set(anotherEdge_nbEdges)) )
            
            for edge in commonEdge:
                currRelatedParcEdges.remove(edge)
            currRelatedParcEdges.remove(anthorPairEdge)
            #print ("remove"),[pE.ID for pE in commonEdge],anthorPairEdge.ID
        
            currRelatedParcEdgeGraph = GRP.ParcEdgeGraph.CreateRelatedEdgeGraph(currRelatedParcEdges)
            currRelatedParcEdgeAngleGraph = currRelatedParcEdgeGraph.CreateParcEdgeAngleGraph()
  
        
         
        whileCount = 0        
        while len(currRelatedParcEdgeAngleGraph.graph[thisPath[-1]].keys()) > 0: 
            
            whileCount+=1
            if whileCount == 30 :
                print ("FindIPath_ForL,whileCount == 30").error
                 
            
            allNbEdges = currRelatedParcEdgeAngleGraph.graph[thisPath[-1]].keys()
            allNbAngles = currRelatedParcEdgeAngleGraph.graph[thisPath[-1]].values()
            
            # ### Check the one should be removed. the previous one
            # if len(thisPath) >=2:
            #     removedEdge = thisPath[-2]
            #     removedIndex = allNbEdges.index(removedEdge)
            #     allNbEdges.pop(removedIndex)
            #     allNbAngles.pop(removedIndex)
            #     if len(allNbEdges) == 0:
            #         break
            
            #print ("in FindIPath ,allNbEdges"), [edge.ID for edge in allNbEdges]
            
            minAngle = min(allNbAngles)
            minIndex = allNbAngles.index(minAngle) 
            selectedEdge = allNbEdges[minIndex]
            
            #print ("minAngle < angleThreshold"), minAngle < angleThreshold
            if minAngle < angleThreshold:
                currAngleCost += minAngle
                thisPath.append(selectedEdge)
                #print ("thisPath.append(selectedEdge)"),selectedEdge.ID
            
            else: 
                break
            
            # prevRelatedParcEdges = currRelatedParcEdges
            # prevRelatedParcEdgeGraph = currRelatedParcEdgeGraph
            # prevRelatedParcEdgeAngleGraph = currRelatedParcEdgeAngleGraph
            
            # print ("prevRelatedParcEdges"),[edge.ID for edge in prevRelatedParcEdges]
            # print ("currRelatedParcEdges before remove"),[edge.ID for edge in currRelatedParcEdges]
            
            ### Update currRelatedParcEdges
            
            #Related with thisPath[-2]
            avoidReturnEdges = currRelatedParcEdgeGraph.graph[thisPath[-2]].keys()
            avoidReturnEdges.remove(thisPath[-1])
            avoidReturnEdges.append(thisPath[-2])
            
            #print ("thisPath"),[pE.ID for pE in thisPath]
            for edge in avoidReturnEdges:
                #print ("in avoidReturnEdges"),edge.ID
                currRelatedParcEdges.remove(edge)
                
            currRelatedParcEdgeGraph = GRP.ParcEdgeGraph.CreateRelatedEdgeGraph(currRelatedParcEdges) 
            currRelatedParcEdgeAngleGraph = currRelatedParcEdgeGraph.CreateParcEdgeAngleGraph()

        
        ##### check how many parcels this path treated 
        treatedNum = RF.CheckTreatedParcelNum(thisPath,inaccessibleParcels,EDict)
        thisSolution = [thisPath,treatedNum,currAngleCost]
        #print ("------")
        return thisSolution


    @staticmethod
    def FindLPathColletion(GRP,inaccessibleParcels,fullNakedEdges,allEdges,EDict):
        validPairs,pairAngles = RF.GetLPathStartPair (GRP,fullNakedEdges,0)
        # print ("FindLPathColletion")
        # print ("in new TryGetMutualPath,Lpath, printing validPairs")
        # for pair in validPairs:
        #     print (pair[0],pair[1])
        
        LpathCollection = []
        
        # #Global 
        # currEdgeGraph = GRP.ParcEdgeGraph.CreateRelatedEdgeGraph(fullNakedEdges)  
        # currEdgeAngleGraph = currEdgeGraph.CreateParcEdgeAngleGraph()
        
        for i in range(len(validPairs)):
            
            currPair = validPairs[i]
            #print ("start"),currPair[0].ID,currPair[1].ID
            firstIPath = RF.FindIPath_ForL(GRP,currPair[0],allEdges,inaccessibleParcels,EDict,60,currPair[1])
            #print ("firstIPath"),[edge.ID for edge in firstIPath[0]]
            
            secondIPath = RF.FindIPath_ForL(GRP,currPair[1],allEdges,inaccessibleParcels,EDict,60,currPair[0])
            #print ("secondIPath"),[edge.ID for edge in secondIPath[0]]
            
            ###path
            firstIPath_Instances = firstIPath[0]
            secondIPath_Instances = secondIPath[0]

            combinedLPath_Instances = []
            
            firstIPath_Instances = list(firstIPath_Instances)
            secondIPath_Instances = list(secondIPath_Instances)
            
            firstIPath_Instances.reverse()
            combinedLPath_Instances.extend(firstIPath_Instances)
            combinedLPath_Instances.extend(secondIPath_Instances)
            
            for elem in combinedLPath_Instances:
                if combinedLPath_Instances.count(elem) > 1:
                    print("combinedLPath_Instances duplicated element!")
                else:
                    pass
                    
            
            
            ###treatedNum
            treatedNum = RF.CheckTreatedParcelNum(combinedLPath_Instances,inaccessibleParcels,EDict)
            
            ###angleCost
            firstAngleCost = firstIPath[2]
            secondAngleCost = secondIPath[2]
            totalAngleCost = firstAngleCost + secondAngleCost + pairAngles[i]
            
            LpathCollection.append([combinedLPath_Instances,treatedNum,totalAngleCost]) 
            # print ("combinedLPath_Instances"),[edge.ID for edge in combinedLPath_Instances]
            # print ("treatedNum"),treatedNum
        return LpathCollection
            
    #########################
    ### Edge Collection 
    #########################

    ### for I path
    @staticmethod
    def GetExtendedMutualEdges(inaccessibleParcels,EDict):
        print ("in GetExtendedMutualEdges")
        
        # Collect mutual edges
        allEdgeIDAndTwinIDs = []
        
        for pF in inaccessibleParcels:
            for edge in pF.edges:
                allEdgeIDAndTwinIDs.append(edge.ID)

        mutualEdges = []
        for pF in inaccessibleParcels:
            print ("pF.ID"), pF.ID,pF.sides
            for edge in pF.edges:
                print ("edge.ID"), edge.ID
                if edge.ID in allEdgeIDAndTwinIDs and edge.twinID in allEdgeIDAndTwinIDs:  ### meaning it is a mutual edge
                    if edge not in mutualEdges and EDict[edge.twinID] not in mutualEdges: ### if the either one is not in the collection ,append it  
                        mutualEdges.append(edge)  
                        
                        print ("mutualEdges.append(edge)" ),edge.ID
                        #print ("Get a mutual edge"),edge.ID
                        #print ("this parcel side"),pF.sides
                        #### check side to extend parcEdge collection
                        
                        
                    for currSide in pF.sides:
                        if edge.naked == False and (edge.ID in currSide or edge.twinID in currSide):
                            chosenSide = currSide
                        elif edge.naked ==True and edge.ID in currSide:
                            chosenSide = currSide
                            
                    print ("chosenSide" ),chosenSide
                    for edgeIndex in chosenSide:
                        thisEdge = EDict[edgeIndex]
                        print ("chosenSide thisEdge" ),edgeIndex
                        if thisEdge not in mutualEdges  and EDict[thisEdge.twinID] not in mutualEdges:
                            mutualEdges.append(thisEdge)  
                            print ("mutualEdges.append(thisEdge)" )   ,thisEdge.ID

        
        
        print [edge.ID for edge in mutualEdges]
        
        
        return mutualEdges

    @staticmethod
    def GetOneSideNakedMutualEdges(unionRegion,mutualEdges):

        print ("GetOneSideNakedMutualEdges")
        print [edge.ID for edge in mutualEdges]
        # Collect naked mutual edges
        nakedMutualEdges = []
        
        for edge in mutualEdges:
            #print edge.ID
            
            closestStartPt = unionRegion.ClosestPoint(edge.startVertex.geometry)
            closestEndPt = unionRegion.ClosestPoint(edge.endVertex.geometry)
            #print closestStartPt
            #print closestEndPt
            
            distanceStart  = closestStartPt.DistanceTo(closestStartPt)
            distanceEnd  = closestEndPt.DistanceTo(closestEndPt)    
            
            print distanceStart,distanceEnd
            if distanceStart <= 0.001 or distanceEnd <= 0.001 :
                nakedMutualEdges.append(edge)
                
        #nakedMutualEdges = []
        
        # for edge in mutualEdges:

        #     closestStartPt = unionRegion.ClosestPoint(edge.startVertex.geometry)
        #     closestEndPt = unionRegion.ClosestPoint(edge.endVertex.geometry)
            
        #     distanceStart  = closestStartPt.DistanceTo(closestStartPt)
        #     distanceEnd  = closestStartPt.DistanceTo(closestEndPt)    
            
        #     if distanceStart <= 0.001 or distanceEnd <= 0.001 :
        #         nakedMutualEdges.append(edge)
        
        return nakedMutualEdges

    ### for L path
    @staticmethod
    def GetFullNakedEdges(unionRegion,inaccessibleParcels,EDict):
        #print ("GetFullNakedEdges") 
        
        # print ("unionRegion")
        # for pt in unionRegion:
        #     print (pt.X),pt.Y,0


        allEdges = []
        for pF in inaccessibleParcels:
            for edge in pF.edges:
                if edge.naked ==True and edge not in allEdges:
                    allEdges.append(edge)
                elif edge.naked == False and edge not in allEdges and EDict[edge.twinID] not in allEdges:
                    allEdges.append(edge)
        
        #print ("len(allEdges)"),len(allEdges)

        fullNakedEdges = []
        for edge in allEdges:
            closestStartPt = unionRegion.ClosestPoint(edge.startVertex.geometry)
            closestEndPt = unionRegion.ClosestPoint(edge.endVertex.geometry)
            
            distanceStart  = closestStartPt.DistanceTo(edge.startVertex.geometry)
            distanceEnd  = closestEndPt.DistanceTo(edge.endVertex.geometry)    
            
            #print ("distanceStart,distanceEnd"),distanceStart,distanceEnd
            if distanceStart <= 0.001 and distanceEnd <= 0.001 :
                #print ("distanceStart,distanceEnd"),edge.ID,distanceStart,distanceEnd
                fullNakedEdges.append(edge)
        
        return fullNakedEdges,allEdges

    @staticmethod
    def GetAllEdges(inaccessibleParcels,EDict):
        allEdges = []
        for pF in inaccessibleParcels:
            for edge in pF.edges:
                if edge.naked ==True and edge not in allEdges:
                    allEdges.append(edge)
                elif edge.naked == False and edge not in allEdges and EDict[edge.twinID] not in allEdges:
                    allEdges.append(edge)
        return allEdges
        
    @staticmethod
    def GetLPathStartPair (GRP,fullNakedEdges,angleThreshold = 0):
        print ("GetLPathStartPair")
        currEdgeGraph = GRP.ParcEdgeGraph.CreateRelatedEdgeGraph(fullNakedEdges)  
        currAngleEdgeGraph = currEdgeGraph.CreateParcEdgeAngleGraph()
        print ("fullNakedEdges") , len(fullNakedEdges)
        #print ("currEdgeGraph"),[edge.ID for edge in currEdgeGraph.graph.keys()]
        
        validPairs = []  
        
        for currEdge in currEdgeGraph.graph.keys():
            #print ("currEdge"),currEdge.ID
            nbEdges = currEdgeGraph.graph[currEdge]
            #print ("nbEdges"),[edge.ID for edge in nbEdges]
            
   
            for nbEdge in nbEdges:
                if currAngleEdgeGraph.graph[currEdge][nbEdge] > angleThreshold:
                    validPair = [currEdge,nbEdge]
                    validPairs.append(validPair)
        
       
        
        validPairs_Clean = []
        validPairs_Clean_ID = []
        
        pairAngles = []
        for pair in validPairs:
            if [pair[0],pair[1]] not in validPairs_Clean and [pair[1],pair[0]] not in validPairs_Clean:
                validPairs_Clean.append(pair)
                pairAngles.append(currAngleEdgeGraph.graph[pair[0]][pair[1]])
                
                validPair_ID = [pair[0].ID,pair[1].ID]
                validPairs_Clean_ID.append(validPair_ID)
                
        print ("validPairs_Clean_ID"), validPairs_Clean_ID
        print ("pairAngles"),pairAngles
        
        return validPairs_Clean,pairAngles



    #########################
    ### Info HelpFunc
    #########################
    
    @staticmethod
    def CheckTreatedParcelNum(thisPath,inaccessibleParcels,EDict):
        treatedNum = 0 
        
        for parcel in inaccessibleParcels:
            for edge in parcel.edges:
                if edge.naked == False and (edge in thisPath or EDict[edge.twinID] in thisPath):
                    treatedNum+=1
                    break
                elif edge.naked ==True and edge in thisPath :
                    treatedNum+=1
                    break
        
        return treatedNum

    @staticmethod
    def GetUnionRegion(inaccessibleParcels):
        # Get the RegionUnion
        geoCollection = []
        
        for pF in inaccessibleParcels:
            geoCollection.append(pF.GetGeometry().ToPolylineCurve())
            
        unionRegion = rg.Curve.CreateBooleanUnion(geoCollection)[0]
        unionRegion = unionRegion.TryGetPolyline()[1]
        
        print ("unionRegion")
        for pt in unionRegion:
            print (pt.X),pt.Y,0
        print ("finish printing unionRegion")
        return unionRegion
# ---------- end ghpython_script_5 ----------
ghpython_script_6 = GhPythonScript()  # -> out, GRP
# ---------- ghpython_script_6: Python ----------
###########################
####    Import Libs    ####
###########################
import Rhino.Geometry as rg
#import Rhino.RhinoDoc as rd
import Rhino.RhinoMath as rm

import ghpythonlib.components as ghc
import math

from itertools import combinations


### use dict represent graph
class GRP:
    class ParcelGraph:
        def __init__(self):
            self.graph = {} ### it doesnot has weight
            
            self.depth = None
            
        def __del__(self):
            self.graph = None

        def DeepCopy(self,currQ_Dict,currE_Dict):
            
            ### convert the IDGraph
            IDGraph = self.GetIDNumWeightGraph()
            newParcelGraph = GRP.ParcelGraph()
            
            ### create space
            for pFID in IDGraph.graph.keys():
                
                newParcelGraph.graph[currQ_Dict[pFID]] = {}
            
            for pFID in IDGraph.graph.keys():
                for nPFID in IDGraph.graph[pFID].keys():
                    newParcelGraph.graph[currQ_Dict[pFID]][currQ_Dict[nPFID]] = currE_Dict [IDGraph.graph[pFID][nPFID]]
            
            newParcelGraph.depth = self.depth
            
            return newParcelGraph
        
        ########################### 
        ######### Each depth
        ###########################
        @staticmethod
        def CreateParcelGraphForThisDepth_Old(currQ_Dict):
            newParcelGraph = GRP.ParcelGraph()
            for parcFace in currQ_Dict.values():
                thisNeighborPFInstances = parcFace.mutualP_E.keys()
                thisNeighborPFIDs = [nPF.ID for nPF in thisNeighborPFInstances]
                newParcelGraph.graph[parcFace.ID] = thisNeighborPFIDs
            
            return newParcelGraph

        @staticmethod
        def CreateParcelGraphForThisDepth(currQ_Dict):
            newParcelGraph = GRP.ParcelGraph()
            
            for parcFace in currQ_Dict.values():
                
                newParcelGraph.graph[parcFace] = {}
                thisNeighborPFInstances = parcFace.mutualP_E.keys()
                for nPF in thisNeighborPFInstances:
                    newParcelGraph.graph[parcFace][nPF] = parcFace.mutualP_E[nPF]
            
            return newParcelGraph


        
        
        ########################### 
        ######### Update Graph
        ###########################
        def Update(self,thisNode,splitParcels):
            ### pop the current node key
            self.graph.pop(thisNode.ID)
            
            ### update the neigbors
            
            self.graph[splitParcels[0].ID] = []
            self.graph[splitParcels[1].ID] = []
            
            ### add themselves
            self.graph[splitParcels[0].ID].append(splitParcels[1].ID)
            self.graph[splitParcels[1].ID].append(splitParcels[0].ID)
            
            parentNeighbor = thisNode.neighbors
            
            for result in splitParcels: 
                
                this_Edges = result.edges
                for pneighbor in parentNeighbor:
                    c_Edges = pneighbor.edges
                    for edge in this_Edges:
                        if edge.twin in c_Edges:
                            self.graph[result.ID].append(pneighbor.ID)
                            self.graph[pneighbor.ID].append(result.ID)
                            break
            
            ### RemoveInvalidNeighbor            
            for key in self.graph.keys():
                thisKeyNeighbor =   self.graph[key]
                if thisNode.ID in thisKeyNeighbor:
                    thisKeyNeighbor.remove(thisNode.ID)
              
                
        ########################### 
        ######### Check Info 
        ###########################
        def CheckItemDepth(self):
            ### check if deepcopy is corret
            for pF in self.graph.keys():
                print ("pF.ID"), pF.ID, "pF.depth",pF.depth
                for npF in self.graph[pF]:
                    print ("npF.ID"), npF.ID, "npF.depth", npF.depth
                print ("-----------")
        
        def PrintGraph(self):
            for item in self.graph:
                print (item) ,self.graph[item]
        
        def GetIDNumWeightGraph(self):
            newDict = {}
            
            for thisKey in self.graph.keys():
                newDict[thisKey.ID] = {}
                
                for nPF in self.graph[thisKey].keys():
                    newDict[thisKey.ID][nPF.ID] = self.graph[thisKey][nPF].ID

            newGraph = GRP.ParcelGraph() 
            newGraph.graph = newDict 
            return newGraph
                
            
    class JunctionGraph:
        def __init__(self):
            self.graph = {}
            self.node = {}   ### A dict can store the parcV
            
            self.depth = None
        def __del__(self):
            self.graph = None

        def DeepCopy(self,currVP_Dict,currE_Dict):
            ### convert the IDGraph
            IDGraph = self.GetIDNumWeightGraph()

            newJunctionGraph = GRP.JunctionGraph()
            
            ### create space
            for vID in IDGraph.graph.keys():
                newJunctionGraph.graph[currVP_Dict[vID]] = {}
                
            for vID in IDGraph.graph.keys():
                for nVID in IDGraph.graph[vID].keys():  
                    
                    newJunctionGraph.graph[currVP_Dict[vID]][currVP_Dict[nVID]] = currE_Dict[IDGraph.graph[vID][nVID]]
            
            newJunctionGraph.depth = self.depth
            return newJunctionGraph
        
        
        ########################### 
        ######### Each depth
        ###########################

        @staticmethod
        def CreateJunctionGraphForThisDepth(currE_Dict):
            newJunctionGraph = GRP.JunctionGraph()
            
            ### collect valid vertex ID
            validV = []
            for edge in currE_Dict.values():
                if edge.isValid == True:  ### this is so important becasue currE_Dict contains invalid edges
                    if edge.naked == False or (edge.naked ==True and edge.streetID != None):
                        if edge.startVertex not in validV:
                            validV.append(edge.startVertex)

                        if edge.endVertex not in validV:
                            validV.append(edge.endVertex)
                
            ### create space
            for vID in validV:
                newJunctionGraph.graph[vID] = {}
            
            for edge in currE_Dict.values():
                if edge.isValid == True:  ### this is so important becasue currE_Dict contains invalid edges
                    if edge.naked == False or (edge.naked ==True and edge.streetID != None):
                        newJunctionGraph.graph[edge.startVertex][edge.endVertex] = edge  ### useInstance, so I dont need to update number 
                        newJunctionGraph.graph[edge.endVertex][edge.startVertex] = edge  ### useInstance, so I dont need to update number
                
            
            return newJunctionGraph
        
        ########################### 
        ######### Update Graph
        ###########################
        def Update(self,originalEdgeA,edgeSplitResultA,originalEdgeB,edgeSplitResultB,sharedEdge):
            ##############################
            ##### deal with startEdge
            ##############################
            ### remove the original connection, First!!! To avoid invalid split result is actually keeping the same, but it got removed later
        
            self.graph[originalEdgeA.startVertex.ID].pop(originalEdgeA.endVertex.ID)
            self.graph[originalEdgeA.endVertex.ID].pop(originalEdgeA.startVertex.ID)
            
            edgeSplitResultA_Sorted = []
            if len(edgeSplitResultA) == 2:  ## naked
                edgeSplitResultA_Sorted = [edge for edge in edgeSplitResultA]
            elif len(edgeSplitResultA) == 4: ## normal
                edgeSplitResultA_Sorted.append(edgeSplitResultA[3])
                edgeSplitResultA_Sorted.append(edgeSplitResultA[1])
            elif len(edgeSplitResultA) == 6: ## special
                edgeSplitResultA_Sorted.append(edgeSplitResultA[5])
                edgeSplitResultA_Sorted.append(edgeSplitResultA[3])
                edgeSplitResultA_Sorted.append(edgeSplitResultA[1])
            
            ### add New edge into graph, create space
            for newEdge in edgeSplitResultA_Sorted:
                if newEdge.isValid == True:
                    if newEdge.startVertex.ID not in self.graph.keys():
                        self.graph[newEdge.startVertex.ID] = {}
                    if newEdge.endVertex.ID not in self.graph.keys():
                        self.graph[newEdge.endVertex.ID] = {}
            
            for newEdge in edgeSplitResultA_Sorted:
                if newEdge.isValid == True:
                    self.graph[newEdge.startVertex.ID][newEdge.endVertex.ID] = newEdge ### useInstance
                    self.graph[newEdge.endVertex.ID][newEdge.startVertex.ID] = newEdge ### useInstance
                    
            
            ##############################
            ##### deal with endEdge
            ##############################
            ### remove the original connection, First!!! To avoid invalid split result is actually keeping the same, but it got removed later
            if originalEdgeB != None and edgeSplitResultB!=None:
                edgeSplitResultB_Sorted = []
                if len(edgeSplitResultB) == 2:  ## naked
                    edgeSplitResultB_Sorted = [edge for edge in edgeSplitResultB]
                elif len(edgeSplitResultB) == 4: ## normal
                    edgeSplitResultB_Sorted.append(edgeSplitResultB[3])
                    edgeSplitResultB_Sorted.append(edgeSplitResultB[1])
                elif len(edgeSplitResultA) == 6: ## special
                    edgeSplitResultB_Sorted.append(edgeSplitResultB[5])
                    edgeSplitResultB_Sorted.append(edgeSplitResultB[3])
                    edgeSplitResultB_Sorted.append(edgeSplitResultB[1])
                
                ### add New edge into graph, create space
                for newEdge in edgeSplitResultB_Sorted:
                    if newEdge.isValid == True:
                        if newEdge.startVertex.ID not in self.graph.keys():
                            self.graph[newEdge.startVertex.ID] = {}
                        if newEdge.endVertex.ID not in self.graph.keys():
                            self.graph[newEdge.endVertex.ID] = {}
                
                for newEdge in edgeSplitResultB_Sorted:
                    if newEdge.isValid == True:
                        self.graph[newEdge.startVertex.ID][newEdge.endVertex.ID] = newEdge ### useInstance
                        self.graph[newEdge.endVertex.ID][newEdge.startVertex.ID] = newEdge ### useInstance   
            
            ##############################
            ##### deal with sharedEdge
            ##############################
            self.graph[sharedEdge.startVertex.ID][sharedEdge.endVertex.ID] = sharedEdge ### useInstance 
            self.graph[sharedEdge.endVertex.ID][sharedEdge.startVertex.ID] = sharedEdge ### useInstance
            
        ########################### 
        ######### Check Info 
        ###########################
        
        def CheckAddress(self,VPDict):
            for pV in  VPDict.values():
                print ("pV.ID"), pV.ID, "pV.address",id(pV) 
                print ("-----------------------")
            for pV in VPDict.graph.keys():
                print ("pV.ID"), pV.ID, "pV.address",id(pV)
                for npV in VPDict.graph[pV]:
                    print ("npV.ID"), npV.ID, "npV.address",id(npV)
                print ("-----------") 
        
        def PrintGraph(self):
            for item in self.graph:
                print (item) ,self.graph[item]
        
        def GetIDNumWeightGraph(self):
            newDict = {}
            for thisKey in self.graph.keys():
                newDict[thisKey.ID] = {}
                for neighKey in self.graph[thisKey]:
                    newDict[thisKey.ID][neighKey.ID] = self.graph[thisKey][neighKey].ID
                    
            newGraph = GRP.JunctionGraph() 
            newGraph.graph = newDict         
            return newGraph
    
        ########################### 
        ######### Abstract
        ###########################
        def AbstractSubGraph(self,PL,streetGraph,newStreet=None):
            if newStreet!= None:
                newStreetPVIDs =  newStreet.GetAllParcVertexID()
                newStreetPEAndTwinIDs = newStreet.GetAllParcEdgeAndTwinID()
                print ("newStreetPEAndTwinIDs"),newStreetPEAndTwinIDs
            else:
                newStreetPVIDs = [] 
                newStreetPEAndTwinIDs = []   
            
            #print ("in AbstractSubGraph" )
            
            
            IDgraph = self.GetIDNumWeightGraph()
            print ("original junction graph"), IDgraph.graph
            newJunctionGraph = GRP.JunctionGraph()
            abstarctParcVertexCollection = []
            for street in streetGraph.graph.keys():
                abstarctParcVertexCollection.extend(street.GetAllParcVertex())
            
            print ("abstarctParcVertexCollection"), [pV.ID for pV in abstarctParcVertexCollection]
            
     
            #merge it to a new node
            allRelatedParcVertices = []
            allRelatedParcEdges = []
            
            for pV in abstarctParcVertexCollection:
                #print pV.ID,id(pV)
                #print ([id(kkk) for kkk in self.graph.keys()]) 
                
                if pV in self.graph.keys():
                    #print "yes"
                    
                    thisPVRelated = self.graph[pV].keys()  #PV

                #print   "self.graph.keys():" ,self.graph.keys()
                #print "thisPVRelated",thisPVRelated
                
                for pVR in thisPVRelated:
                    if pVR not in abstarctParcVertexCollection and pVR.ID not in  newStreetPVIDs:   ### for new street:
                        if pVR in self.graph[pV].keys():
                            allRelatedParcVertices.append(pVR)
                            # if pV.ID == 195:
                            #     print "in adding newNode value,pV=",pV.ID,  " pVR=",pVR.ID
                            allRelatedParcEdges.append(self.graph[pV][pVR])  

            #new Node
            newNodeKey = PL.ParcVertex(rg.Point3d(0,0,0),"abstractNode")
            newNodeValue = {}
            for i in range(len(allRelatedParcVertices)):
                pVR = allRelatedParcVertices[i]
                pER = allRelatedParcEdges[i]
                
                newNodeValue[pVR] = pER
                
            newJunctionGraph.graph[newNodeKey] = newNodeValue
            
            #print  "newNodeValue", [pV.ID for pV in newNodeValue]
            #add the remain
            for restParcVertex in self.graph.keys():
                if restParcVertex not in abstarctParcVertexCollection:
                    newJunctionGraph.graph[restParcVertex] = {}
                    
            for restParcVertex in newJunctionGraph.graph.keys(): 
                if restParcVertex != newNodeKey:
                    for pVertex in self.graph[restParcVertex].keys():
                        if pVertex not in abstarctParcVertexCollection :
                            if restParcVertex not in  newStreetPVIDs and  pVertex not in  newStreetPVIDs:   ### for new street
                                newJunctionGraph.graph[restParcVertex][pVertex] = self.graph[restParcVertex][pVertex]
                    
                        elif pVertex in abstarctParcVertexCollection :
                            if restParcVertex not in  newStreetPVIDs and  pVertex not in  newStreetPVIDs:   ### for new street
                                newJunctionGraph.graph[restParcVertex][newNodeKey] = self.graph[restParcVertex][pVertex]
                        
            for nbPV in newJunctionGraph.graph[newNodeKey].keys():
                
                newJunctionGraph.graph[nbPV][newNodeKey] = newJunctionGraph.graph[newNodeKey][nbPV]

            newIDgraph = newJunctionGraph.GetIDNumWeightGraph()
            print ("newIDgraph junction"), newIDgraph.graph
            print ("finish remain junction graph - in AbstractSubGraph")
            
            
            
            ### Check the node which has the abstarct node as its neighbor has a shortest connection
            checkNodes = []
            #print "in outside checkNode"
            for node in newJunctionGraph.graph.keys():
                if node not in abstarctParcVertexCollection:
                    thisNodeNeighbors = newJunctionGraph.graph[node].keys()
                    if newNodeKey in thisNodeNeighbors:
                        checkNodes.append(node)  #### related to abstarct node
                    
            
            for node in checkNodes:
                originalConnection =[]
                ### collect the original connection for this node:
                for streetPV in abstarctParcVertexCollection:
                    if streetPV in self.graph[node].keys() and streetPV.ID not in newStreetPVIDs :
                        originalConnection.append(self.graph[node][streetPV])
                        # if node == 654:
                        #     print "originalConnection append",self.graph[node][streetPV].ID
                        
                #print "checkNodes",node.ID    
                #print "originalConnection", [parcEdge.ID for parcEdge in originalConnection]
                
                
                newOriginalConnection = []

                for connection in originalConnection:  ###
                    if connection.streetID==None:      #### exclude the street segment..。？ might not neccessary... no it seems nesssary
                        if connection.ID not in newStreetPEAndTwinIDs:
                
                            newOriginalConnection.append(connection)
                        
                #print "newOriginalConnection", [parcEdge.ID for parcEdge in newOriginalConnection]
                if len(newOriginalConnection)!=0:
 
                    pELengths = []
                    for parcEdge in newOriginalConnection:
                        pELengths.append(parcEdge.GetGeometry().Length)
                    
                    
                    minLength = min(pELengths)
                    minID = pELengths.index(minLength)
                    minConnection = newOriginalConnection[minID]    
                
                        
                    ### redirect
                    newJunctionGraph.graph[node][newNodeKey] = minConnection
                    newJunctionGraph.graph[newNodeKey][node] = minConnection
               
            print ("in AbstractSubGraph") 
            newIDgraph = newJunctionGraph.GetIDNumWeightGraph()
            print ("Check shortest junction"), newIDgraph.graph
            
            print ("kill the connection with newStreet which has not been added inside the graph " )
            if newStreet !=None:
            
            
                newStreetPVIDs =  newStreet.GetAllParcVertexID()
                print ("newStreetPVIDs"),newStreetPVIDs
                newStreetPV =  newStreet.GetAllParcVertex()
                
                newStreetPEAndTwinIDs = newStreet.GetAllParcEdgeAndTwinID()
                newNewGraph = GRP.JunctionGraph()
                for key1 in newJunctionGraph.graph.keys():
                    newNewGraph.graph[key1]={}
                    for key2 in newJunctionGraph.graph[key1].keys():
                        if (key1 in newStreetPV) and (key2 in newStreetPV):
                            pass
                        elif (key1==newNodeKey and key2 in newStreetPV and newJunctionGraph.graph[key1][key2].ID in newStreetPEAndTwinIDs)  or  (key2== newNodeKey and key1 in newStreetPV and newJunctionGraph.graph[key1][key2].ID in newStreetPEAndTwinIDs):
                            pass 
                        else:
                            newNewGraph.graph[key1][key2] = newJunctionGraph.graph [key1][key2]
                
                newIDgraph = newNewGraph.GetIDNumWeightGraph()
                print ("Check kill connection junction"), newIDgraph.graph
                print ("wtf inside newStreet??? " )
            # if newStreet!=None:
            #     currNode = newStreet.head
            #     print "currNode.node.ID, currNode.next.node.ID",currNode.node.ID, currNode.node, currNode.next.node,currNode.next.node.ID
            #     print "currNode.node.id, currNode.next.node.id",id(currNode.node), id(currNode.next.node)
            #     for key in newNewGraph.graph.keys():
            #         print id(key),type(key)
            #     print [(id(node),node.ID) for node in newNewGraph.graph[currNode.node]]
            #     print newIDgraph.graph[8][25]
            #     print newNewGraph.graph[currNode.node][currNode.next.node]
            #     print newNewGraph.graph[currNode.next.node][currNode.node]
            #     #print newNewGraph.graph
            #     while currNode.next!=None:
            #         if currNode.next.node in abstarctParcVertexCollection:
                        
            #             newNewGraph.graph[currNode.node][currNode.next.node] = float("inf")
            #             newNewGraph.graph[currNode.next.node][currNode.node]= float("inf")
            #             print "done once"
            #         currNode = currNode.next
            return newNewGraph, newNodeKey
        

        
    ###########################
    ### FindStreet    
    ###########################
    class ParcEdgeGraph:
        def __init__(self):
            self.graph = {}
            self.node = {}   ### store a parcEdge
            
            self.depth = None
        def __del__(self):
            self.graph = None
            self.node = None
        
        def DeepCopy(self,currE_Dict):
            
            ### convert the IDGraph
            IDGraph = self.GetIDNumWeightGraph()
            newParcEdgeGraph = GRP.ParcEdgeGraph()

            ### create space
            for eID in IDGraph.graph.keys():
                newParcEdgeGraph.graph[currE_Dict[eID]] = {}
            
            for eID in IDGraph.graph.keys():
                for nEID in IDGraph.graph[eID].keys():
                    
                    newParcEdgeGraph.graph[currE_Dict[eID]][currE_Dict[nEID]] = currE_Dict[IDGraph.graph[eID][nEID]]

            newParcEdgeGraph.depth = self.depth
            return newParcEdgeGraph
        
        def Clone(self):
            newParcEdgeGraph = GRP.ParcEdgeGraph()

            ### create space
            for pE in self.graph.keys():
                newParcEdgeGraph.graph[pE] = {}
            
            for pE in self.graph.keys():
                for nPE in self.graph[pE].keys():
                    
                    newParcEdgeGraph.graph[pE][nPE] = self.graph[pE][nPE]

            return newParcEdgeGraph
               

        @staticmethod
        def CreateParcEdgeGraphForThisDepth(junctionGraph):
            
            #print "CreateParcEdgeGraphForThisDepth"
            jIDGraph = junctionGraph.GetIDNumWeightGraph()
            #print jIDGraph.graph
            newParcEdgeGraph = GRP.ParcEdgeGraph()
            ### the TwinEdge will not be so clear
            newGraph = newParcEdgeGraph.graph
            ### create space
            
            for pV in junctionGraph.graph.keys():
                for parcEdge in junctionGraph.graph[pV].values():
                    if parcEdge.naked == False or (parcEdge.naked == True and parcEdge.streetID!=None) :######## avoid find road around the boundary  // allow first depth naked street
                        
                        newGraph[parcEdge] = {}

                    

            for pV in junctionGraph.graph.keys():
                allParcEdges = junctionGraph.graph[pV].values()
                for parcEdge in allParcEdges:   
                    #print parcEdge.ID ,  parcEdge.generation, parcEdge.streetID
                    if parcEdge.naked == False or (parcEdge.naked == True and parcEdge.streetID!=None) :######## avoid find road around the boundary // allow first depth naked street
                        for nbParcEdge in allParcEdges:
                            if    nbParcEdge!=parcEdge and nbParcEdge.naked == False: ######## avoid find road around the boundary
                                newGraph[parcEdge][nbParcEdge] = nbParcEdge
                                #print "parcEdge,nbParcEdge",parcEdge.ID,nbParcEdge.ID 
            return newParcEdgeGraph
            
        def GetAllParcEdgeID(self):
            allParcEdge = self.graph.keys()
            allParcEdgeID = [parcEdge.ID for parcEdge in allParcEdge]
            
            return allParcEdgeID
        
        def GetAllParcEdgeTwinID(self):
            allParcEdge = self.graph.keys()
            allParcEdgeTwinID = []
            for parcEdge in allParcEdge: 
                if parcEdge.naked == False:
                    allParcEdgeTwinID.append(parcEdge.twinID)
            
            return allParcEdgeTwinID   
         
        def GetIDNumWeightGraph(self):
            newDict = {}
            for thisKey in self.graph.keys():
                newDict[thisKey.ID] = {}
                for neighKey in self.graph[thisKey]:
                    newDict[thisKey.ID][neighKey.ID] = self.graph[thisKey][neighKey].ID
                    
            newGraph = GRP.ParcEdgeGraph() 
            newGraph.graph = newDict           
            return newGraph 
        
        def GetIDNumWeightLengthGraph(self):
            newDict = {}
            for thisKey in self.graph.keys():
                newDict[thisKey.ID] = {}
                for neighKey in self.graph[thisKey]:
                    newDict[thisKey.ID][neighKey.ID] = self.graph[thisKey][neighKey].GetGeometry().Length
                    
            newGraph = GRP.ParcEdgeGraph() 
            newGraph.graph = newDict           
            return newGraph 
  
        def GetIDNumWeightAngleGraph(self):
            newDict = {}
            angleGraph = self.CreateParcEdgeAngleGraph()
            for thisKey in self.graph.keys():
                newDict[thisKey.ID] = {}
                for neighKey in self.graph[thisKey]:
                    newDict[thisKey.ID][neighKey.ID] = angleGraph.graph[thisKey][neighKey]
                    
            newGraph = GRP.ParcEdgeGraph() 
            newGraph.graph = newDict           
            return newGraph 

        def AbstractSubGraph(self,PL,streetGraph,EDict): 
            #print " in AbstractSubGraph"
            ########################### 
            ### checking with ID 
            ########################### 
            # print ("in AbstractSubGraph")
            # IDGraph = self.GetIDNumWeightGraph()
            # print ("IDGraph"),IDGraph.graph
            
            newParcEdgeGraph = GRP.ParcEdgeGraph()
            
            abstarctParcEdgesCollection = []
            for street in streetGraph.graph.keys():
                abstarctParcEdgesCollection.extend(street.GetAllParcEdge())
            
            ###########################
            ### merge it to a new node
            ###########################
            #collect are related edges
            allRelatedParcEdges = []

            try:
                for pE in abstarctParcEdgesCollection: 
                    
                    if pE in self.graph.keys():
                        thisPERelated = self.graph[pE].values()
                    elif pE.naked == False and EDict[pE.twinID] in self.graph.keys():
                        thisPERelated = self.graph[EDict[pE.twinID]].values()
                    
                    for pER in thisPERelated:
                        if pER.naked ==True :
                            if pER not in allRelatedParcEdges and pER not in abstarctParcEdgesCollection:   ## havent added  and not in abstract node
                                allRelatedParcEdges.append(pER)
                                
                        else:
                            if pER not in allRelatedParcEdges and pER not in abstarctParcEdgesCollection and EDict[pER.twinID] not in abstarctParcEdgesCollection :
                                allRelatedParcEdges.append(pER)
            
            except:
                self = self.Clone()  
                for pE in abstarctParcEdgesCollection: 
                    print pE.ID
                    print [pE.ID for pE in  self.graph.keys()]
                    if pE in self.graph.keys():
                        thisPERelated = self.graph[pE].values()
                    elif pE.naked == False and EDict[pE.twinID] in self.graph.keys():
                        thisPERelated = self.graph[EDict[pE.twinID]].values()
                    
                    for pER in thisPERelated:
                        if pER.naked ==True :
                            if pER not in allRelatedParcEdges and pER not in abstarctParcEdgesCollection:   ## havent added  and not in abstract node
                                allRelatedParcEdges.append(pER)
                                
                        else:
                            if pER not in allRelatedParcEdges and pER not in abstarctParcEdgesCollection and EDict[pER.twinID] not in abstarctParcEdgesCollection :
                                allRelatedParcEdges.append(pER)
                       

            #new Node
            newNodeKey = PL.ParcEdge("abstractNode")
            newNodeKey.startVertex = PL.ParcVertex(rg.Point3d(0,0,0),"abstractNode")
            newNodeKey.endVertex = PL.ParcVertex(rg.Point3d(0,0,0),"abstractNode")
            newNodeValue = {}
            for pER in allRelatedParcEdges:
                newNodeValue[pER] = pER
            
            newParcEdgeGraph.graph[newNodeKey] = newNodeValue
            
            ###########################
            ### add the remain
            ###########################
            for restParcEdge in self.graph.keys():
                if restParcEdge.naked ==True:
                    if restParcEdge not in abstarctParcEdgesCollection:
                        newParcEdgeGraph.graph[restParcEdge] = {}
                elif restParcEdge.naked == False:
                    if  restParcEdge not in abstarctParcEdgesCollection and EDict[restParcEdge.twinID] not in abstarctParcEdgesCollection:
                        newParcEdgeGraph.graph[restParcEdge] = {}
                    
            for restParcEdge in newParcEdgeGraph.graph.keys(): 
                if restParcEdge!=newNodeKey:
                    for pEdge in self.graph[restParcEdge].keys():  ### be careful 
                        if pEdge.naked ==True:
                            if pEdge not in abstarctParcEdgesCollection :
                                newParcEdgeGraph.graph[restParcEdge][pEdge] = pEdge
                        
                            elif pEdge in abstarctParcEdgesCollection :
                                newParcEdgeGraph.graph[restParcEdge][newNodeKey] = pEdge
                    
                        elif pEdge.naked == False: 
                            if pEdge not in abstarctParcEdgesCollection and EDict[pEdge.twinID] not in abstarctParcEdgesCollection:
                                newParcEdgeGraph.graph[restParcEdge][pEdge] = pEdge
                            
                            elif pEdge in abstarctParcEdgesCollection or EDict[pEdge.twinID] in abstarctParcEdgesCollection:
                                newParcEdgeGraph.graph[restParcEdge][newNodeKey] = pEdge

            for nbPE in newParcEdgeGraph.graph[newNodeKey].keys():
                newParcEdgeGraph.graph[nbPE][newNodeKey] = nbPE
            
            
            # print ("in AbstractSubGraph Done")
            # IDGraph = newParcEdgeGraph.GetIDNumWeightGraph()
            # print ("IDGraph"),IDGraph.graph
            
            return newParcEdgeGraph , newNodeKey # the abstract one    
        
        def AbstractSubGraphWithSide(self,PL,startEdgeCollection,sideGeo,EDict):
            
            
                
            #print ("in AbstractSubGraphWithSide")
            # edgeIDs = []
            # for edge in startEdgeCollection:
            #     edgeIDs.append(edge.ID)
            #     edgeIDs.append(edge.twinID)
            # print "startEdgeCollection" , edgeIDs
            # print "sideGeo"
            # for pt in sideGeo:
            #     print pt.X, pt.Y,0
            # IDGraph = self.GetIDNumWeightGraph()
            # print ("IDGraph"),IDGraph.graph
            
            newParcEdgeGraph = GRP.ParcEdgeGraph()
            
            ###########################
            ### merge it to a new node
            ###########################
            #collect are related edges
            allRelatedParcEdges = []

            for pE in startEdgeCollection: 
                if pE in self.graph.keys():
                    thisPERelated = self.graph[pE].values()   
                elif pE.naked == False and EDict[pE.twinID] in self.graph.keys():
                    thisPERelated = self.graph[EDict[pE.twinID]].values()        

                for pER in thisPERelated:
                    if pER.naked ==True :
                        if pER not in allRelatedParcEdges and pER not in startEdgeCollection:
                            allRelatedParcEdges.append(pER)
                    else:
                        if pER not in allRelatedParcEdges and pER not in startEdgeCollection and EDict[pER.twinID] not in startEdgeCollection :
                            allRelatedParcEdges.append(pER)  
            
            #new Node
            newNodeKey = PL.ParcEdge("abstractStart")
            newNodeKey.startVertex = PL.ParcVertex(sideGeo.First,startEdgeCollection[0].startVertex.ID)
            newNodeKey.endVertex = PL.ParcVertex(sideGeo.Last,startEdgeCollection[-1].endVertex.ID)
            for i in range(1,len(sideGeo)-1,1):
                newNodeKey.betweenPoints.append(PL.ParcPoint(sideGeo[i],"abstractStart"))
            
            newNodeValue = {}
            for pER in allRelatedParcEdges:
                newNodeValue[pER] = pER
            
            newParcEdgeGraph.graph[newNodeKey] = newNodeValue
            
            ###########################
            ### add the remain
            ###########################
            for restParcEdge in self.graph.keys():
                if restParcEdge.naked ==True:
                    if restParcEdge not in startEdgeCollection:
                        newParcEdgeGraph.graph[restParcEdge] = {}
                elif restParcEdge.naked == False:
                    #print "restParcEdge",restParcEdge.ID,restParcEdge.twinID
                    
                    if restParcEdge.ID != "abstractNode":
                        if  restParcEdge not in startEdgeCollection and EDict[restParcEdge.twinID] not in startEdgeCollection:
                            newParcEdgeGraph.graph[restParcEdge] = {}
                    elif restParcEdge.ID == "abstractNode":
                        newParcEdgeGraph.graph[restParcEdge] = {}
              
      
                  
            for restParcEdge in newParcEdgeGraph.graph.keys(): 
                if restParcEdge!=newNodeKey:
                    for pEdge in self.graph[restParcEdge].keys():  ### be careful here
                        if pEdge.naked ==True:
                            if pEdge not in startEdgeCollection :
                                newParcEdgeGraph.graph[restParcEdge][pEdge] = pEdge
                                #print "case1","newParcEdgeGraph.graph[restParcEdge][pEdge] = pEdge" , restParcEdge.ID,pEdge.ID,pEdge.ID

                            elif pEdge in startEdgeCollection :
                                newParcEdgeGraph.graph[restParcEdge][newNodeKey] = pEdge
                                
                                
                        elif pEdge.naked == False and pEdge.ID != "abstractNode": 
                            if pEdge not in startEdgeCollection and EDict[pEdge.twinID] not in startEdgeCollection:
                                newParcEdgeGraph.graph[restParcEdge][pEdge] = pEdge
                                #print "case3","newParcEdgeGraph.graph[restParcEdge][pEdge] = pEdge" , restParcEdge.ID,pEdge.ID,pEdge.ID

                            elif pEdge in startEdgeCollection or EDict[pEdge.twinID] in startEdgeCollection:
                                newParcEdgeGraph.graph[restParcEdge][newNodeKey] = pEdge
                             
                        elif pEdge.naked == False and pEdge.ID == "abstractNode": 
                            newParcEdgeGraph.graph[restParcEdge][pEdge] = pEdge
                            
                                
            # print ("in AbstractSubGraphWithSide - create new abstractStart and add remain - before newParcEdgeGraph.graph[nbPE][newNodeKey] = nbPE")
            # IDGraph = newParcEdgeGraph.GetIDNumWeightGraph()
            # print ("IDGraph"),IDGraph.graph
            
            for nbPE in newParcEdgeGraph.graph[newNodeKey].keys():
                newParcEdgeGraph.graph[nbPE][newNodeKey] = nbPE

            # print ("in AbstractSubGraphWithSide - create new abstractStart and add remain")
            # IDGraph = newParcEdgeGraph.GetIDNumWeightGraph()
            # print ("IDGraph"),IDGraph.graph
            
            
            
            ###########################
            ### Kill connection - mutual
            ###########################
            for i in range(len(startEdgeCollection)-1):
                firstPE = startEdgeCollection[i]
                secondPE = startEdgeCollection[i+1]
                
                firstPE_Right = None
                secondPE_Right = None
                if firstPE in self.graph.keys():   ### use the original graph
                    firstPE_Right = firstPE
                elif EDict[firstPE.twinID] in self.graph.keys():
                    firstPE_Right = EDict[firstPE.twinID]

                if secondPE in self.graph.keys():
                    secondPE_Right = secondPE
                elif EDict[secondPE.twinID] in self.graph.keys():
                    secondPE_Right = EDict[secondPE.twinID]
                    
                if firstPE_Right !=None and secondPE_Right!=None:
                        firstNeighbors = self.graph[firstPE_Right].keys()
                        secondNeighbors = self.graph[secondPE_Right].keys()
                        
                        firstSet = set(firstNeighbors)
                        secondSet = set(secondNeighbors)
                        commonPEList = firstSet.intersection(secondSet)
                        
                        
                        for commonPE in commonPEList:
                            ### abstractNode might have 2 connection of startAbstart
                            #print "firstPE_Right, secondPE_Right, commonPE" , firstPE_Right.ID,secondPE_Right.ID,commonPE.ID
                            try:
                                newParcEdgeGraph.graph[commonPE].pop(newNodeKey)
                                newParcEdgeGraph.graph[newNodeKey].pop(commonPE)  
                            except:
                                pass
            
            # IDGraph = newParcEdgeGraph.GetIDNumWeightGraph()
            # print ("finish AbstractSubGraphWithSide editing"),IDGraph.graph
         
            
            
            
            
            return newParcEdgeGraph,newNodeKey
        
        def AbstractSubGraphWithMutualStart(self,PL,startEdgeCollection,sideGeo,EDict):
            
            
                
            #print ("in AbstractSubGraphWithSide")
            # edgeIDs = []
            # for edge in startEdgeCollection:
            #     edgeIDs.append(edge.ID)
            #     edgeIDs.append(edge.twinID)
            # print "startEdgeCollection" , edgeIDs
            # print "sideGeo"
            # for pt in sideGeo:
            #     print pt.X, pt.Y,0
            # IDGraph = self.GetIDNumWeightGraph()
            # print ("IDGraph"),IDGraph.graph
            
            newParcEdgeGraph = GRP.ParcEdgeGraph()
            
            ###########################
            ### merge it to a new node
            ###########################
            #collect are related edges
            allRelatedParcEdges = []

            for pE in startEdgeCollection: 
                
                thisPERelated = None
                if pE in self.graph.keys():
                    thisPERelated = self.graph[pE].values()   
                elif pE.naked == False and EDict[pE.twinID] in self.graph.keys():
                    thisPERelated = self.graph[EDict[pE.twinID]].values()        

                if thisPERelated == [] or thisPERelated == None:
                    continue
                
                for pER in thisPERelated:
                    if pER.naked ==True :
                        if pER not in allRelatedParcEdges and pER not in startEdgeCollection:
                            allRelatedParcEdges.append(pER)
                    else:
                        if pER not in allRelatedParcEdges and pER not in startEdgeCollection and EDict[pER.twinID] not in startEdgeCollection :
                            allRelatedParcEdges.append(pER)  
            
            #new Node
            newNodeKey = PL.ParcEdge("abstractStart")
            newNodeKey.startVertex = PL.ParcVertex(sideGeo.First,startEdgeCollection[0].startVertex.ID)
            newNodeKey.endVertex = PL.ParcVertex(sideGeo.Last,startEdgeCollection[-1].endVertex.ID)
            for i in range(1,len(sideGeo)-1,1):
                newNodeKey.betweenPoints.append(PL.ParcPoint(sideGeo[i],"abstractStart"))
            
            newNodeValue = {}
            for pER in allRelatedParcEdges:
                newNodeValue[pER] = pER
            
            newParcEdgeGraph.graph[newNodeKey] = newNodeValue
            
            ###########################
            ### add the remain
            ###########################
            for restParcEdge in self.graph.keys():
                if restParcEdge.naked ==True:
                    if restParcEdge not in startEdgeCollection:
                        newParcEdgeGraph.graph[restParcEdge] = {}
                elif restParcEdge.naked == False:
                    #print "restParcEdge",restParcEdge.ID,restParcEdge.twinID
                    
                    if restParcEdge.ID != "abstractNode":
                        if  restParcEdge not in startEdgeCollection and EDict[restParcEdge.twinID] not in startEdgeCollection:
                            newParcEdgeGraph.graph[restParcEdge] = {}
                    elif restParcEdge.ID == "abstractNode":
                        newParcEdgeGraph.graph[restParcEdge] = {}
              
      
                  
            for restParcEdge in newParcEdgeGraph.graph.keys(): 
                if restParcEdge!=newNodeKey:
                    for pEdge in self.graph[restParcEdge].keys():  ### be careful here
                        if pEdge.naked ==True:
                            if pEdge not in startEdgeCollection :
                                newParcEdgeGraph.graph[restParcEdge][pEdge] = pEdge
                                #print "case1","newParcEdgeGraph.graph[restParcEdge][pEdge] = pEdge" , restParcEdge.ID,pEdge.ID,pEdge.ID

                            elif pEdge in startEdgeCollection :
                                newParcEdgeGraph.graph[restParcEdge][newNodeKey] = pEdge
                                
                                
                        elif pEdge.naked == False and pEdge.ID != "abstractNode": 
                            if pEdge not in startEdgeCollection and EDict[pEdge.twinID] not in startEdgeCollection:
                                newParcEdgeGraph.graph[restParcEdge][pEdge] = pEdge
                                #print "case3","newParcEdgeGraph.graph[restParcEdge][pEdge] = pEdge" , restParcEdge.ID,pEdge.ID,pEdge.ID

                            elif pEdge in startEdgeCollection or EDict[pEdge.twinID] in startEdgeCollection:
                                newParcEdgeGraph.graph[restParcEdge][newNodeKey] = pEdge
                             
                        elif pEdge.naked == False and pEdge.ID == "abstractNode": 
                            newParcEdgeGraph.graph[restParcEdge][pEdge] = pEdge
                            
                                
            # print ("in AbstractSubGraphWithSide - create new abstractStart and add remain - before newParcEdgeGraph.graph[nbPE][newNodeKey] = nbPE")
            # IDGraph = newParcEdgeGraph.GetIDNumWeightGraph()
            # print ("IDGraph"),IDGraph.graph
            
            for nbPE in newParcEdgeGraph.graph[newNodeKey].keys():
                newParcEdgeGraph.graph[nbPE][newNodeKey] = nbPE

            # print ("in AbstractSubGraphWithSide - create new abstractStart and add remain")
            # IDGraph = newParcEdgeGraph.GetIDNumWeightGraph()
            # print ("IDGraph"),IDGraph.graph
            
            
            
            ###########################
            ### Kill connection - mutual
            ###########################
            for i in range(len(startEdgeCollection)-1):
                firstPE = startEdgeCollection[i]
                secondPE = startEdgeCollection[i+1]
                
                firstPE_Right = None
                secondPE_Right = None
                if firstPE in self.graph.keys():   ### use the original graph
                    firstPE_Right = firstPE
                elif EDict[firstPE.twinID] in self.graph.keys():
                    firstPE_Right = EDict[firstPE.twinID]

                if secondPE in self.graph.keys():
                    secondPE_Right = secondPE
                elif EDict[secondPE.twinID] in self.graph.keys():
                    secondPE_Right = EDict[secondPE.twinID]
                    
                if firstPE_Right !=None and secondPE_Right!=None:
                        firstNeighbors = self.graph[firstPE_Right].keys()
                        secondNeighbors = self.graph[secondPE_Right].keys()
                        
                        firstSet = set(firstNeighbors)
                        secondSet = set(secondNeighbors)
                        commonPEList = firstSet.intersection(secondSet)
                        
                        
                        for commonPE in commonPEList:
                            ### abstractNode might have 2 connection of startAbstart
                            #print "firstPE_Right, secondPE_Right, commonPE" , firstPE_Right.ID,secondPE_Right.ID,commonPE.ID
                            try:
                                newParcEdgeGraph.graph[commonPE].pop(newNodeKey)
                                newParcEdgeGraph.graph[newNodeKey].pop(commonPE)  
                            except:
                                pass
            
            # IDGraph = newParcEdgeGraph.GetIDNumWeightGraph()
            # print ("finish AbstractSubGraphWithSide editing"),IDGraph.graph
         
            
            
            
            
            return newParcEdgeGraph,newNodeKey
        
        
        
        
        def AbstractSubGraphWithNewStreet(self,PL,streetGraph,EDict,newStreet): 
       
            # print ("in AbstractSubGraphWithNewStreet")
            # IDGraph = self.GetIDNumWeightGraph()
            # print ("IDGraph"),IDGraph.graph
            
            newParcEdgeGraph = GRP.ParcEdgeGraph()
            
            abstarctParcEdgesCollection = []
            for street in streetGraph.graph.keys():
                abstarctParcEdgesCollection.extend(street.GetAllParcEdge())
            
            
            ###########################
            ### merge it to a new node
            ###########################
            #collect are related edges
            allRelatedParcEdges = []

            try:
                for pE in abstarctParcEdgesCollection: 
    
                    if pE in self.graph.keys():
                        thisPERelated = self.graph[pE].values()
                    elif pE.naked == False and EDict[pE.twinID] in self.graph.keys():
                        thisPERelated = self.graph[EDict[pE.twinID]].values()
                    
                    for pER in thisPERelated:
                        if pER.naked ==True :
                            if pER not in allRelatedParcEdges and pER not in abstarctParcEdgesCollection:   ## havent added  and not in abstract node
                                allRelatedParcEdges.append(pER)
                                
                        else:
                            if pER not in allRelatedParcEdges and pER not in abstarctParcEdgesCollection and EDict[pER.twinID] not in abstarctParcEdgesCollection :
                                allRelatedParcEdges.append(pER)
            
            except:
                #### strange error
                self = self.Clone()
                                     
                for pE in abstarctParcEdgesCollection: 

                    if pE in self.graph.keys():
                        thisPERelated = self.graph[pE].values()
                    elif pE.naked == False and EDict[pE.twinID] in self.graph.keys():
                        thisPERelated = self.graph[EDict[pE.twinID]].values()
                    
                    for pER in thisPERelated:
                        if pER.naked ==True :
                            if pER not in allRelatedParcEdges and pER not in abstarctParcEdgesCollection:   ## havent added  and not in abstract node
                                allRelatedParcEdges.append(pER)
                                
                        else:
                            if pER not in allRelatedParcEdges and pER not in abstarctParcEdgesCollection and EDict[pER.twinID] not in abstarctParcEdgesCollection :
                                allRelatedParcEdges.append(pER)
        
            #new Node
            newNodeKey = PL.ParcEdge("abstractNode")
            newNodeKey.startVertex = PL.ParcVertex(rg.Point3d(0,0,0),"abstractNode")
            newNodeKey.endVertex = PL.ParcVertex(rg.Point3d(0,0,0),"abstractNode")
            newNodeValue = {}
            for pER in allRelatedParcEdges:
                newNodeValue[pER] = pER
            
            # print "allRelatedParcEdges"
            # print [pE.ID for pE in allRelatedParcEdges]
            newParcEdgeGraph.graph[newNodeKey] = newNodeValue
            
            ###########################
            ### add the remain
            ###########################
            for restParcEdge in self.graph.keys():
                if restParcEdge.naked ==True:
                    if restParcEdge not in abstarctParcEdgesCollection:
                        newParcEdgeGraph.graph[restParcEdge] = {}
                elif restParcEdge.naked == False:
                    if  restParcEdge not in abstarctParcEdgesCollection and EDict[restParcEdge.twinID] not in abstarctParcEdgesCollection:
                        newParcEdgeGraph.graph[restParcEdge] = {}
                    
            for restParcEdge in newParcEdgeGraph.graph.keys(): 
                if restParcEdge!=newNodeKey:
                    for pEdge in self.graph[restParcEdge].keys(): ### be careful 
                        if pEdge.naked ==True:
                            if pEdge not in abstarctParcEdgesCollection :
                                newParcEdgeGraph.graph[restParcEdge][pEdge] = pEdge
                        
                            elif pEdge in abstarctParcEdgesCollection :
                                newParcEdgeGraph.graph[restParcEdge][newNodeKey] = pEdge
                    
                        elif pEdge.naked == False: 
                            if pEdge not in abstarctParcEdgesCollection and EDict[pEdge.twinID] not in abstarctParcEdgesCollection:
                                newParcEdgeGraph.graph[restParcEdge][pEdge] = pEdge
                            
                            elif pEdge in abstarctParcEdgesCollection or EDict[pEdge.twinID] in abstarctParcEdgesCollection:
                                newParcEdgeGraph.graph[restParcEdge][newNodeKey] = pEdge

            for nbPE in newParcEdgeGraph.graph[newNodeKey].keys():
                newParcEdgeGraph.graph[nbPE][newNodeKey] = nbPE

            #print ("in AbstractSubGraph - newParcEdgeGraph")
            #IDGraph = newParcEdgeGraph.GetIDNumWeightGraph()
            #print ("IDGraph") ,IDGraph.graph
                
            ###########################
            ### Kill connection in the street
            ###########################
            #print ("Kill connection")
            newStreetPEAndTwinIDs = newStreet.GetAllParcEdgeAndTwinID()
            #print ("newStreetPEAndTwinIDs"),newStreetPEAndTwinIDs
            
            newNewGraph = GRP.ParcEdgeGraph()
            for key1 in newParcEdgeGraph.graph.keys():
                newNewGraph.graph[key1]={}
                for key2 in newParcEdgeGraph.graph[key1].keys():
                    if (key1.ID in newStreetPEAndTwinIDs or key1.twinID in newStreetPEAndTwinIDs) and (key2.ID in newStreetPEAndTwinIDs or key2.twinID in newStreetPEAndTwinIDs):
                        #print ("pass , key1.ID , key2.ID"), key1.ID, key2.ID
                        pass
                    else:
                        #print ("append , key1.ID , key2.ID"), key1.ID, key2.ID
                        newNewGraph.graph[key1][key2] = newParcEdgeGraph.graph [key1][key2]
            
            # print ("in AbstractSubGraph - newNewGraph")
            # IDGraph = newNewGraph.GetIDNumWeightGraph()
            # print ("IDGraph"),IDGraph.graph
            
            ###########################
            ### Kill connection - mutual
            ###########################
            newStreetPEs = newStreet.GetAllParcEdge()
            for i in range(len(newStreetPEs)-1):
                firstPE = newStreetPEs[i]
                secondPE = newStreetPEs[i+1]
                
                firstPE_Right = None
                secondPE_Right = None
                if firstPE in newNewGraph.graph.keys():
                    firstPE_Right = firstPE
                elif EDict[firstPE.twinID] in newNewGraph.graph.keys():
                    firstPE_Right = EDict[firstPE.twinID]
                    
                if secondPE in newNewGraph.graph.keys():
                    secondPE_Right = secondPE
                elif EDict[secondPE.twinID] in newNewGraph.graph.keys():
                    secondPE_Right = EDict[secondPE.twinID]
                
                if firstPE_Right !=None and secondPE_Right!=None:
                    firstNeighbors = newNewGraph.graph[firstPE_Right].keys()
                    secondNeighbors = newNewGraph.graph[secondPE_Right].keys()
                    
                    firstSet = set(firstNeighbors)
                    secondSet = set(secondNeighbors)
                    commonPEList = firstSet.intersection(secondSet)
                    
                    for commonPE in commonPEList:
                        newNewGraph.graph[commonPE].pop(firstPE_Right)
                        newNewGraph.graph[commonPE].pop(secondPE_Right)
                        newNewGraph.graph[firstPE_Right].pop(commonPE)
                        newNewGraph.graph[secondPE_Right].pop(commonPE)
                
            # print ("in AbstractSubGraph - kill second newNewGraph")
            # IDGraph = newNewGraph.GetIDNumWeightGraph()
            # print ("IDGraph"),IDGraph.graph
            
            ###########################
            ### Kill connection - mutual caused by new street and original edge
            ###########################
            ### if edge is newEdgeNeighbor and its mutual edge of exsiting street segment
            # streetGraphEdgeIDs = streetGraph.GetAllParcEdgeID()
            # newStreetPEs = newStreet.GetAllParcEdge()
            # newStreetHead = newStreet.head.node
            # newStreetEnd = newStreet.end.node
            
            # headNbPE = []
            # endNbPE = []
            # for pE in EDict.values():
            #     if pE.startVertex == newStreetHead or pE.startVertex == newStreetEnd or pE.endVertex == newStreetHead or pE.endVertex == newStreetEnd:
            #         if pE.naked == False and EDict[pE.twinID] not in headNbPE:
            #             if pE!= newStreet.head.nextConnection and pE!= EDict[newStreet.head.nextConnection.ID ]:
            #                 headNbPE.append(pE)
            #     if pE.startVertex == newStreetEnd or pE.startVertex == newStreetEnd or pE.endVertex == newStreetEnd or pE.endVertex == newStreetEnd:
            #         if pE.naked == False and EDict[pE.twinID] not in headNbPE:
            #             if pE!= newStreet.end.prevConnection and pE!= EDict[newStreet.end.prevConnection.ID ]:
            #                 endNbPE.append(pE)
            
         
            # for NbPEList in [headNbPE,endNbPE]:
            #     for comb in combinations(NbPEList, 2):
            #         trueEdge_A = None
            #         trueEdge_B = None
            #         if comb[0].ID in streetGraphEdgeIDs:
            #             trueEdge_A = comb[0]
            #         elif comb[0].twinID in streetGraphEdgeIDs:  
            #             trueEdge_B = EDict[comb[0].twinID] 
                    
            #         if comb[1].ID in streetGraphEdgeIDs:
            #             trueEdge_A = comb[1]
            #         elif comb[1].twinID in streetGraphEdgeIDs:  
            #             trueEdge_B = EDict[comb[1].twinID] 
                    
            #         try:     #it might reduce already
            #             if trueEdge_A!=None and trueEdge_B!=None:
            #                 nb_A = newParcEdgeGraph.graph[trueEdge_A]
            #                 nb_B = newParcEdgeGraph.graph[trueEdge_B]
            #                 nb_mutual = list(nb_A.intersection(nb_B))
                            
            #                 for nbPE in nb_mutual:
                                
            #                     for nbNBPE in newNewGraph.graph[nbPE]:
            #                         newNewGraph.graph[nbNBPE].pop(nbPE)
            #                     newNewGraph.graph.pop(nbPE)
                  
            #         except:
            #             pass   
            
            ###########################
            ### Kill connection the end streetSegemnt with streetGraph
            ###########################
            pE = newStreet.end.prevConnection
            pETwin =  EDict[newStreet.end.prevConnection.twinID]
            
            if pE in newNewGraph.graph[newNodeKey].keys():
                chosenPE = pE
            else:
                chosenPE = pETwin

            ### it might be killed previously
            if chosenPE in newNewGraph.graph[newNodeKey].keys():
                newNewGraph.graph[newNodeKey].pop(chosenPE)
                newNewGraph.graph[chosenPE].pop(newNodeKey)
                
            # print ("in AbstractSubGraph - kill second newNewGraph")
            # IDGraph = newNewGraph.GetIDNumWeightGraph()
            # print ("IDGraph"),IDGraph.graph
            
            return newNewGraph , newNodeKey # the abstract one    
          
          
        def CheckQuickPath(self,abstarctStart,abstarctNode,wA):
            
            abstarctStartRelated = self.graph[abstarctStart].keys()
            print ("abstarctStartRelated" ), [pE.ID for pE in abstarctStartRelated]
            #print ("currUsedGraphNb" ),[parcEdge.ID for parcEdge in self.graph[abstarctNode].keys()]
            #print ("currUsedGraphNb" ),[parcEdge.ID for parcEdge in self.graph[abstarctNode].values()]
            possiblePath = []
            for parcEdge in abstarctStartRelated:
                if parcEdge in self.graph[abstarctNode].keys():
                    possiblePath.append(parcEdge)
                    
            
            ### special
            for parcEdge in abstarctStartRelated:
                if parcEdge.ID == "abstractNode":
                    print ("quick path connected with abstractNode")
                    minPath = [abstarctStart,abstarctNode]
                    minScore = 0
                    return minPath,minScore


            angleCosts = []
            distCosts = []
            scoreCosts = []
            distanceList = []
            for pE in self.graph.keys():
                if pE.ID !="abstractStart":
                    distanceList.append(pE.GetGeometry().Length)
                    minDist = min(distanceList)
                    maxDist = max(distanceList)

        
            minAngle = 0
            maxAngle = math.pi
            wD = 1 - wA
            
            # chose the optimal one 
            if len(possiblePath) == 0:
                print ("no QuickPath")
                return None,None
            
            elif len(possiblePath) == 1:
                minPath = [abstarctStart,possiblePath[0],abstarctNode]
                print ("QuickPath 1 "),[node.ID for node in minPath]
                pEdge = possiblePath[0]
                if pEdge.startVertex.geometry == abstarctStart.startVertex.geometry or pEdge.endVertex.geometry == abstarctStart.startVertex.geometry:
                    commonPt = abstarctStart.startVertex.geometry
                elif pEdge.startVertex.geometry == abstarctStart.endVertex.geometry or pEdge.endVertex.geometry == abstarctStart.endVertex.geometry:
                    commonPt = abstarctStart.endVertex.geometry
                
                if commonPt == pEdge.startVertex.geometry:
                    nextPEpt = pEdge.endVertex.geometry
                elif commonPt == pEdge.endVertex.geometry:
                    nextPEpt = pEdge.startVertex.geometry
                    
                if commonPt == abstarctStart.startVertex.geometry:
                    nextASpt = abstarctStart.endVertex.geometry
                elif commonPt == abstarctStart.endVertex.geometry:
                    nextASpt = abstarctStart.startVertex.geometry
                    
                vecA = rg.Vector3d(commonPt - nextPEpt)    
                vecB = rg.Vector3d(nextASpt -commonPt)    
                angle = rg.Vector3d.VectorAngle(vecA,vecB)
                
                angleCosts.append(angle)
                distCosts.append(pEdge.GetGeometry().Length + abstarctStart.GetGeometry().Length)
        
     
                costDist_Remap = (distCosts[0]-minDist) / (maxDist- minDist)
                costAngle_Remap = (angleCosts[0]-minAngle) / (maxAngle- minAngle)
        
                costMix = wD * costDist_Remap + wA * costAngle_Remap
                return minPath,costMix
            
            elif len(possiblePath) > 1:
                print ("len(possiblePath) > 1")
                print [pE.ID for pE in possiblePath]
                for pEdge in possiblePath:
                
                    # print ("pEdge.ID"), pEdge.ID
                    # print ("pEdge start and end " )
                    # pEGeo = pEdge.GetGeometry()
                    # for pt in pEGeo:
                    #     print pt.X, pt.Y, 0
                
                    # print ("abstarctStart start and end ")
                    # abGeo = abstarctStart.GetGeometry()
                    # for pt in abGeo:
                    #     print pt.X, pt.Y, 0

                    #print "-------"
                    # find common point
                    if pEdge.startVertex.geometry == abstarctStart.startVertex.geometry or pEdge.endVertex.geometry == abstarctStart.startVertex.geometry:
                        commonPt = abstarctStart.startVertex.geometry
                    elif pEdge.startVertex.geometry == abstarctStart.endVertex.geometry or pEdge.endVertex.geometry == abstarctStart.endVertex.geometry:
                        commonPt = abstarctStart.endVertex.geometry
                    
                    if commonPt == pEdge.startVertex.geometry:
                        nextPEpt = pEdge.endVertex.geometry
                    elif commonPt == pEdge.endVertex.geometry:
                        nextPEpt = pEdge.startVertex.geometry
                        
                    if commonPt == abstarctStart.startVertex.geometry:
                        nextASpt = abstarctStart.endVertex.geometry
                    elif commonPt == abstarctStart.endVertex.geometry:
                        nextASpt = abstarctStart.startVertex.geometry
                        
                    vecA = rg.Vector3d(commonPt-nextPEpt)    
                    vecB = rg.Vector3d(nextASpt -commonPt)    
                    angle = rg.Vector3d.VectorAngle(vecA,vecB)
                    
                    angleCosts.append(angle)
                    distCosts.append(pEdge.GetGeometry().Length + abstarctStart.GetGeometry().Length)


                for i in range(len(possiblePath)):    
                    costDist_Remap = (distCosts[i]-minDist) / (maxDist- minDist)
                    costAngle_Remap = (angleCosts[i]-minAngle) / (maxAngle- minAngle)
            
                    costMix = wD * costDist_Remap + wA * costAngle_Remap
                    scoreCosts.append(costMix)
                    
                minScore = min(scoreCosts)
                minIndex = scoreCosts.index(minScore)
                minPE = possiblePath[minIndex]
                minPath = [abstarctStart,minPE,abstarctNode]
                
                print ("angleCosts "), angleCosts 
                print ("distCosts"),distCosts
                print  ("scoreCosts "), scoreCosts
                print ("QuickPath n "),[node.ID for node in minPath]
                
                return minPath,minScore
        
        def CheckQuickPath_Eva(self,startEdge,possiblePath,abstarctNode,wA):
            
         
            
            
            angleCosts = []
            distCosts = []
            scoreCosts = []
            distanceList = []
            for pE in self.graph.keys():
                if pE.ID !="abstractStart":
                    distanceList.append(pE.GetGeometry().Length)
                    minDist = min(distanceList)
                    maxDist = max(distanceList)

        
            minAngle = 0
            maxAngle = math.pi
            wD = 1 - wA
            
            
            # chose the optimal one 
            if len(possiblePath) == 0:
                print ("no QuickPath")
                return None,None
            
            elif len(possiblePath) == 1:
                minPath = [startEdge,possiblePath[0],abstarctNode]
                print ("QuickPath 1 "),[node.ID for node in minPath]
                pEdge = possiblePath[0]
                if pEdge.startVertex.geometry == startEdge.startVertex.geometry or pEdge.endVertex.geometry == startEdge.startVertex.geometry:
                    commonPt = startEdge.startVertex.geometry
                elif pEdge.startVertex.geometry == startEdge.endVertex.geometry or pEdge.endVertex.geometry == startEdge.endVertex.geometry:
                    commonPt = startEdge.endVertex.geometry
                
                if commonPt == pEdge.startVertex.geometry:
                    nextPEpt = pEdge.endVertex.geometry
                elif commonPt == pEdge.endVertex.geometry:
                    nextPEpt = pEdge.startVertex.geometry
                    
                if commonPt == startEdge.startVertex.geometry:
                    nextASpt = startEdge.endVertex.geometry
                elif commonPt == startEdge.endVertex.geometry:
                    nextASpt = startEdge.startVertex.geometry
                    
                vecA = rg.Vector3d(commonPt - nextPEpt)    
                vecB = rg.Vector3d(nextASpt -commonPt)    
                angle = rg.Vector3d.VectorAngle(vecA,vecB)
                
                angleCosts.append(angle)
                distCosts.append(pEdge.GetGeometry().Length + startEdge.GetGeometry().Length)
        
     
                costDist_Remap = (distCosts[0]-minDist) / (maxDist- minDist)
                costAngle_Remap = (angleCosts[0]-minAngle) / (maxAngle- minAngle)
        
                costMix = wD * costDist_Remap + wA * costAngle_Remap
                return minPath,costMix
            
            elif len(possiblePath) > 1:
                print ("len(possiblePath) > 1")
                print [pE.ID for pE in possiblePath]
                for pEdge in possiblePath:
                
                    # print ("pEdge.ID"), pEdge.ID
                    # print ("pEdge start and end " )
                    # pEGeo = pEdge.GetGeometry()
                    # for pt in pEGeo:
                    #     print pt.X, pt.Y, 0
                
                    # print ("abstarctStart start and end ")
                    # abGeo = abstarctStart.GetGeometry()
                    # for pt in abGeo:
                    #     print pt.X, pt.Y, 0

                    #print "-------"
                    # find common point
                    if pEdge.startVertex.geometry == startEdge.startVertex.geometry or pEdge.endVertex.geometry == startEdge.startVertex.geometry:
                        commonPt = startEdge.startVertex.geometry
                    elif pEdge.startVertex.geometry == startEdge.endVertex.geometry or pEdge.endVertex.geometry == startEdge.endVertex.geometry:
                        commonPt = startEdge.endVertex.geometry
                    
                    # print pEdge.startVertex.geometry.X,pEdge.startVertex.geometry.Y,0
                    # print pEdge.endVertex.geometry.X,pEdge.endVertex.geometry.Y,0
                    # print startEdge.startVertex.geometry.X,startEdge.startVertex.geometry.Y,0
                    # print startEdge.endVertex.geometry.X,startEdge.endVertex.geometry.Y,0


                    if commonPt == pEdge.startVertex.geometry:
                        nextPEpt = pEdge.endVertex.geometry
                    elif commonPt == pEdge.endVertex.geometry:
                        nextPEpt = pEdge.startVertex.geometry
                        
                    if commonPt == startEdge.startVertex.geometry:
                        nextASpt = startEdge.endVertex.geometry
                    elif commonPt == startEdge.endVertex.geometry:
                        nextASpt = startEdge.startVertex.geometry
                        
                    vecA = rg.Vector3d(commonPt - nextPEpt)    
                    vecB = rg.Vector3d(nextASpt -commonPt)    
                    angle = rg.Vector3d.VectorAngle(vecA,vecB)
                    
                    angleCosts.append(angle)
                    distCosts.append(pEdge.GetGeometry().Length + startEdge.GetGeometry().Length)


                for i in range(len(possiblePath)):    
                    costDist_Remap = (distCosts[i]-minDist) / (maxDist- minDist)
                    costAngle_Remap = (angleCosts[i]-minAngle) / (maxAngle- minAngle)
            
                    costMix = wD * costDist_Remap + wA * costAngle_Remap
                    scoreCosts.append(costMix)
                    
                minScore = min(scoreCosts)
                minIndex = scoreCosts.index(minScore)
                minPE = possiblePath[minIndex]
                minPath = [startEdge,minPE,abstarctNode]
                
                print ("QuickPath n "),[node.ID for node in minPath]
                
                return minPath,minScore
                     
        def CheckAddress(self,EDict):
            for e in  EDict.values():
                print ("e.ID"), e.ID, "e.address",id(e) 
            print ("-----------------------")
            for e in EDict.graph.keys():
                print ("e.ID"), e.ID, "e.address",id(e)
                for nE in EDict.graph[e]:
                    print ("nE.ID"), nE.ID, "nE.address",id(nE)
                print ("-----------")
        
        
        @staticmethod                
        def CreateRelatedEdgeGraph(relatedEdges):
            # Create a mutual edge graph to search
            relatedEdgeGraph = GRP.ParcEdgeGraph()
            for edge in relatedEdges:
                relatedEdgeGraph.graph[edge] = {}
                for otherEdge in relatedEdges:
                    if otherEdge != edge:
                        # check if they are connected
                        if edge.startVertex.geometry == otherEdge.startVertex.geometry or edge.startVertex.geometry == otherEdge.endVertex.geometry:
                            relatedEdgeGraph.graph[edge][otherEdge] = otherEdge
                        elif edge.endVertex.geometry == otherEdge.startVertex.geometry or edge.endVertex.geometry == otherEdge.endVertex.geometry:
                            relatedEdgeGraph.graph[edge][otherEdge] = otherEdge
            
            return relatedEdgeGraph      
        
        
        def CreateParcEdgeAngleGraph(self):
            angleGraph = GRP.ParcEdgeGraph()
            for thisNode in self.graph.keys():
                angleGraph.graph[thisNode] = {}
                
            for thisNode in self.graph.keys():
                if thisNode.ID != "abstractNode":
                    for nb in self.graph[thisNode]:
                        thisChosen = None
                        nbChosen = None
                        nbGeo = None
                        thisGeo = None
                        #print nb.ID,nb.startVertex.ID,nb.endVertex.ID
                        #print thisNode.ID,thisNode.startVertex.ID,thisNode.endVertex.ID
                        
                        if nb.ID != "abstractNode":
                            if thisNode.startVertex.ID != nb.startVertex.ID and thisNode.startVertex.ID != nb.endVertex.ID:
                                thisChosen = thisNode.endVertex
                            elif thisNode.startVertex.ID == nb.startVertex.ID or thisNode.startVertex.ID == nb.endVertex.ID:
                                thisChosen = thisNode.startVertex

                            if nb.startVertex.ID == thisChosen.ID :
                                nbChosen = nb.startVertex
                            elif nb.endVertex.ID == thisChosen.ID :
                                nbChosen = nb.endVertex
                            
                            ### get This node geo 
                            if thisChosen.ID == thisNode.startVertex.ID:
                                thisGeo = rg.Polyline(thisNode.GetGeometry())
                            elif thisChosen.ID == thisNode.endVertex.ID:
                                thisGeo = rg.Polyline(thisNode.GetGeometry())
                                thisGeo.Reverse()
                                
                            ### get nb node geo 
                            if nbChosen == None or thisChosen == None:
                                angleGraph.graph[thisNode][nb] =float("inf")
                                continue
                                
                            if nbChosen.ID == nb.startVertex.ID:
                                nbGeo = rg.Polyline(nb.GetGeometry())
                            elif thisChosen.ID == nb.endVertex.ID:
                                nbGeo = rg.Polyline(nb.GetGeometry())
                                nbGeo.Reverse()
                            # except:
                            #     nbGeo = rg.Polyline(nb.GetGeometry())
                            #     print ("nbGeo")
                            #     for pt in nbGeo:
                            #         print (pt.X),pt.Y,0
                                
                            #     print ("thisNode")    
                            #     for pt in thisNode.GetGeometry():
                            #         print (pt.X),pt.Y,0    
                                    
                            
                            
                            
                            #thisVec = rg.Vector3d (thisGeo[0] - thisGeo[1])
                            #nbVec = rg.Vector3d (nbGeo[1] - nbGeo[0])
                            
                            thisVec = rg.Vector3d (thisGeo.First - thisGeo.Last)
                            nbVec = rg.Vector3d (nbGeo.Last - nbGeo.First)
                            
                            angle = rg.Vector3d.VectorAngle(thisVec,nbVec)
                            angleGraph.graph[thisNode][nb] = rm.ToDegrees(angle)

                        elif nb.ID =='abstractNode':
                            angleGraph.graph[thisNode][nb] = 0
                
                elif thisNode.ID =='abstractNode':
                    
                    for nb in self.graph[thisNode]:
                        #print thisNode.ID, nb.ID
                        angleGraph.graph[thisNode][nb] = 0
            
            return angleGraph
        
        def FindNewStartPE_Mix(self,newStreetConnection,EDict,wA=1):
            wD = 1- wA
            #print ("in FindNewStartPE_Mix")
            angleGraph = self.CreateParcEdgeAngleGraph()
            ### Find the connection of newStreetConnection
            selectedConnection = None
            if newStreetConnection in angleGraph.graph.keys():
                selectedConnection = newStreetConnection
            else:
                selectedConnection = EDict[newStreetConnection.twinID]
                
         
            relatedPE = angleGraph.graph[selectedConnection].keys()
            relatedAngle = [angleGraph.graph[selectedConnection][rPE] for rPE in relatedPE]
            relatedDist =  [self.graph[selectedConnection][rPE].GetGeometry().Length for rPE in relatedPE]
            
            minDist = min(relatedDist)
            maxDist = max(relatedDist)

            
            minAngle = 0
            maxAngle = math.pi

            costScore= []
 
            for i in range(len(relatedPE)):
                costDist_Remap = (relatedDist[i]-minDist) / (maxDist- minDist)
                costAngle_Remap = (relatedAngle[i]-minAngle) / (maxAngle- minAngle)

                costMix = wD * costDist_Remap + wA * costAngle_Remap
                costScore.append(costMix) 
                

            if len(relatedPE) == 0:
                return None,None

            else:
                minIndex = costScore.index(min(costScore))
                minPE = relatedPE[minIndex]
                scoreCost = min(costScore)
                return minPE,scoreCost
        
        def FindNewStartPE(self,newStreetConnection,EDict):
            #print ("in FindNewStartPE")
            angleGraph = self.CreateParcEdgeAngleGraph()
            ### Find the connection of newStreetConnection
            selectedConnection = None
            if newStreetConnection in angleGraph.graph.keys():
                selectedConnection = newStreetConnection
            else:
                selectedConnection = EDict[newStreetConnection.twinID]
                
            #print ("selectedConnection.ID"), selectedConnection.ID
            #angleGraphID = angleGraph.GetIDNumWeightGraph()
            #print ("angleGraphID"), angleGraphID
            relatedPE = angleGraph.graph[selectedConnection].keys()
            relatedAngle = [angleGraph.graph[selectedConnection][rPE] for rPE in relatedPE]
            
            if len(relatedPE) == 0:
                return None,None

            else:
                minIndex = relatedAngle.index(min(relatedAngle))
                #print ("relatedAngle"),relatedAngle
                minPE = relatedPE[minIndex]
                angleCost = min(relatedAngle)
                #print ("minPE"), minPE,minPE.ID,angleCost
                return minPE,angleCost
                
            
    class StreetGraph:
        def __init__(self):
            self.graph = {}
            self.depth = None
            
        def __del__(self):
            self.graph = None
        
        def DeepCopy(self,currPV_Dict,currE_Dict):
            #print "In StreetGraph DeepCopy"
            #print "prevous num = ", len(self.graph.keys())
            newStreetGraph = GRP.StreetGraph()
            
            #### Create a street redirection dict
            redirectionDict = {}  #newStreet:oldStreet
            #print "In StreetGraph DeepCopy,GetAllParcEdgeTwinID" , self.GetAllParcEdgeAndTwinID()
            for oldStreet in self.graph.keys():
                newStreet = oldStreet.DeepCopy(currPV_Dict,currE_Dict)
                redirectionDict[newStreet] = oldStreet
                redirectionDict[oldStreet] = newStreet
            
            #print redirectionDict
            for oldStreet in self.graph.keys(): # olad
                
                newStreetGraph.graph[redirectionDict[oldStreet]] = {}
                for nbOldStreet in self.graph[oldStreet].keys():
                    newStreetGraph.graph[redirectionDict[oldStreet]][ redirectionDict[nbOldStreet] ] = self.graph[oldStreet][nbOldStreet]
            
            #print "new num = ", len(newStreetGraph.graph.keys())
            newStreetGraph.depth = self.depth
            
            return newStreetGraph
        
            
        def GetAllParcEdgeID(self):
            allParcEdgeID = []
            for street in self.graph.keys():
                #print "in GetAllParcEdgeID"
                #print street
                allParcEdgeID.extend(street.GetAllParcEdgeID())
            return allParcEdgeID
        
        def GetAllParcEdge(self):
            allParcEdges = []
            for street in self.graph.keys():
                #print "in GetAllParcEdgeID"
                #print street
                allParcEdges.extend(street.GetAllParcEdge())
            return allParcEdges
        
   
            
        def GetAllParcEdgeTwinID(self):
            allParcEdgeID = []
            for street in self.graph.keys():
                allParcEdgeID.extend(street.GetAllParcEdgeTwinID())
            return allParcEdgeID
        
        def GetAllParcEdgeAndTwinID(self):
            allParcEdgeID = []
            for street in self.graph.keys():
                allParcEdgeID.extend(street.GetAllParcEdgeTwinID())
            return allParcEdgeID
        
        def GetAllParcVertexID(self):
            allParcVertexID = []
            for street in self.graph.keys():
                allParcVertexID.extend(street.GetAllParcVertexID())
            return allParcVertexID
     
  
        def AddStreet(self,newStreet,EDict):
            maxStreetID = len(self.graph.keys())
            newStreet.ID = maxStreetID+1
            newStreet.AssignStreetIDForParcEdge(EDict)
            #print "add a street and give ID", newStreet.ID
            if len(self.graph.keys())!=0:
   
                ### add the new street into graph
                self.graph[newStreet] = {}
                
                ### find the connected streetNode
                connectedStreetNode = newStreet.end
                #print ("in AddStreet connectedStreetNode.ID" ), connectedStreetNode.ID
                ### check the street with this node
                for street in self.graph.keys():
                    allpVID = self.GetAllParcVertexID()
                    if connectedStreetNode.node.ID in allpVID:
                        self.graph[newStreet][street] = connectedStreetNode.ID   ###### reminder: this might be dupilicated twice, so use ID to identify it here
                        self.graph[street][newStreet] = connectedStreetNode.ID   ###### reminder: this might be dupilicated twice, so use ID to identify it here
                        break
                #print "current street num", len(self.graph.keys())
             
            else:
                self.graph[newStreet] = {}
        
        def UpateStreet(self,newStreet,EDict):
            newStreet.AssignStreetIDForParcEdge(EDict)
            if len(self.graph.keys())!=0:
   
                ### add the new street into graph
                self.graph[newStreet] = {}
                
                ### find the connected streetNode
                connectedStreetNode = newStreet.end
                #print ("in AddStreet connectedStreetNode.ID" ), connectedStreetNode.ID
                ### check the street with this node
                for street in self.graph.keys():
                    allpVID = self.GetAllParcVertexID()
                    if connectedStreetNode.node.ID in allpVID:
                        self.graph[newStreet][street] = connectedStreetNode.ID   ###### reminder: this might be dupilicated twice, so use ID to identify it here
                        self.graph[street][newStreet] = connectedStreetNode.ID   ###### reminder: this might be dupilicated twice, so use ID to identify it here
                        break
                #print "current street num", len(self.graph.keys())
             
            else:
                self.graph[newStreet] = {}
        
        def GetStreetDict(self):
            streetDict = {}
            for street in self.graph.keys():
                streetDict[street.ID] = street
            return streetDict
            
        def CheckInsertLocation(self,splitEdge):
            streetDict = self.GetStreetDict()
            #print "streetDict" , streetDict
            
            targetStreet = streetDict[splitEdge.streetID]
          
            ### info of this 
            #IDs = targetStreet.GetAllParcEdgeID()
            #print "CheckInsertLocation GetAllParcEdgeID",IDs
            #twinIDs = targetStreet.GetAllParcEdgeTwinID()
            #print "CheckInsertLocation GetAllParcEdge twinIDs",twinIDs
            #print "targetStreet IDs",IDs
            #print "targetStreet twinIDs",twinIDs
            whileCount = 0

            streetNode = targetStreet.head
            #print ("in CheckInsertLocation"), streetNode
            targetStreet.PrintGeometry()
            
            #print ("wrong with ending?"),
            if targetStreet.end.next!=None:
                print (targetStreet.end.next.ID)
            
            #print "before while"
            while streetNode.next!=None:
                if whileCount>5000:
                    break
                whileCount +=1
                
                parcEdge = streetNode.nextConnection
                #print "parcEdgeVertices",parcEdge.startVertex.ID,parcEdge.startVertex.geometry,parcEdge.endVertex.ID,parcEdge.ID,parcEdge.endVertex.geometry
                #print "streetNode,streetNode.next",streetNode.ID,streetNode.node.geometry,streetNode.next.ID,streetNode.next.node.geometry
                if splitEdge.naked == True:
                    if splitEdge.ID == parcEdge.ID:
                        #print "parcEdge.ID in IDs",splitEdge.ID,IDs
                       
                        return (targetStreet,streetNode,streetNode.next,True)   ### True meaning in order
                
                elif splitEdge.naked == False:
                    if splitEdge.ID == parcEdge.ID:
                        
                        return (targetStreet,streetNode,streetNode.next,True)
                    
                    elif splitEdge.ID == parcEdge.twinID:
                    #print "parcEdge.ID in twinIDs",splitEdge.twinID,twinIDs
                       
                        return (targetStreet,streetNode,streetNode.next,False)   ### False meaning in order
                
                
                ### if it doesnt return, continue
                streetNode = streetNode.next
# ---------- end ghpython_script_6 ----------
# ----
# Optimization
#  &
# Offset
ghpython_script_7 = GhPythonScript()  # -> out, PP
# ---------- ghpython_script_7: Python ----------
###########################
####    Import Libs    ####
###########################
import Rhino.Geometry as rg
#import Rhino.RhinoDoc as rd
import Rhino.RhinoMath as rm
import ghpythonlib.components as ghc
import math

import clr


from System.Collections.Generic import List

class PP:
    @staticmethod
    def CheckMergeEdge(PL,currQ,EDict,VP_Dict,sideLengthPercentage,debugColletion1,debugColletion2):
        mergedEdgeIndicesCollection = []    
        mergedEdgeNewVCollection = []
        for currPF in currQ:
            for currSideIndex in range(len(currPF.sides)):
                currSide = currPF.sides[currSideIndex]
                if len(currSide) == 1:
                    continue
                
                else:
                    sideLength = 0
                    ### get side geometry
                    for edgeIndex in currSide:
                        # print EDict.keys()
                        # print currSide
                        # print edgeIndex
                        currEdge = EDict[edgeIndex]
                        currEdgeGeo = currEdge.GetGeometry()
                        sideLength += currEdgeGeo.Length
                    
                    for edgeIndex in currSide:
                        currEdge = EDict[edgeIndex]
                        currEdgeGeo = currEdge.GetGeometry()
                        if currEdgeGeo.Length < sideLength*sideLengthPercentage and currEdge.naked == False:
                            #print ("CheckMergeEdge happen,parcelID:"),currPF.ID
                            checkTag = PP.IfGoingToBeSelfIntersected(PL,currPF,currEdge,EDict,VP_Dict)
                            
                            if checkTag!=True: 
                                
                                
                                mergedEdgeIndices,mergedEdgeNewVs = PP.ReduceMergeEdge(PL,currQ,currPF,currEdge,currSideIndex,EDict,VP_Dict)
                                debugColletion1.append(currEdge.GetGeometry())
                                debugColletion2.append(currEdge.ID)
                                mergedEdgeIndicesCollection.extend(mergedEdgeIndices)
                                mergedEdgeNewVCollection.extend(mergedEdgeNewVs)
                               
                                
                                # EDict.pop(currEdge.ID)
                                # if currEdge.naked == False:
                                #     EDict.pop(currEdge.twinID)
                                
        
        return mergedEdgeIndicesCollection,mergedEdgeNewVCollection
    
    @staticmethod   
    def IfGoingToBeSelfIntersected(PL,currPF,selectedEdge,EDict,VP_Dict):   
        
        
        checkTag = None
        # print ("in ReduceMergeEdge"), [edge.ID for edge in currPF.edges]
        # print ("in ReduceMergeEdge"), currPF.sides
        # print ("in ReduceMergeEdge"), [v.ID for v in currPF.vertices]
        startV = selectedEdge.startVertex   ### store here, later I cant get this by selected edge
        endV = selectedEdge.endVertex       ### store here, later I cant get this by selected edge
        
        ### create a new vertex, if on the boundary , merge it to the boundary
        if startV.onBoundary == True:
            newV = startV
        elif endV.onBoundary == True: 
            newV = endV 
        else:
            startPt =  selectedEdge.GetGeometry().First
            EndPt =  selectedEdge.GetGeometry().Last
            avePt = (startPt+EndPt)/2
            currMaxVPID = max(VP_Dict.Keys)
            newV = PL.ParcVertex(avePt,currMaxVPID+1)
            
            VP_Dict[newV.ID] = newV ## add into VP dict
            
        #print ("CheckMergeEdge happen,newV"),newV.geometry.X,newV.geometry.Y,0
        ### find the parcels to treat with 
        targetParcel = currPF
            
        # check if there is nbParcel    
        if selectedEdge.twinID  == None:
            nbParcel = None
            twinEdge = None
        else:
            nbParcel = currPF.mutualE_P[selectedEdge]
            twinEdge = EDict[selectedEdge.twinID]
            
        ##### Get the newGeo
        targetParcelEdges = [edge for edge in targetParcel.edges]
        targetParcelEdges.remove(selectedEdge)
        targetParcelEdgeGeos = []
        targetParcelPts = []
        for edge in targetParcelEdges:
            thisEdgeGeo = edge.GetGeometry()
            if edge.endVertex == startV:
                thisEdgeGeo.Last = newV.geometry
            if edge.startVertex == endV:
                thisEdgeGeo.First = newV.geometry
            
            targetParcelEdgeGeos.append(thisEdgeGeo)
            
        for edgeGeo in targetParcelEdgeGeos:
            for i in range(len(edgeGeo)-1):
                targetParcelPts.append(edgeGeo[i])
        targetParcelPts.append(targetParcelEdgeGeos[-1].Last)
        targetParcelGeo = rg.Polyline(targetParcelPts) 
        
        if rg.Intersect.Intersection.CurveSelf(targetParcelGeo.ToPolylineCurve(),0.001).Count == 0:
            checkTag = False
        else:
            checkTag = True
            return checkTag
        
        ### Get the newGeo
        if nbParcel !=None:
      
            nbParcelEdges = [edge for edge in nbParcel.edges]
            nbParcelEdges.remove(twinEdge)  
            nbParcelEdgeGeos = []
            nbParcelPts = []  
            for edge in nbParcelEdges:  
                thisEdgeGeo = edge.GetGeometry()
                if edge.endVertex == endV:
                    thisEdgeGeo.Last = newV.geometry
                if edge.startVertex == startV:
                    thisEdgeGeo.First = newV.geometry
                nbParcelEdgeGeos.append(thisEdgeGeo)

            for edgeGeo in nbParcelEdgeGeos:
                for i in range(len(edgeGeo)-1):
                    nbParcelPts.append(edgeGeo[i])
            nbParcelPts.append(nbParcelEdgeGeos[-1].Last)
            nbParcelGeo = rg.Polyline(nbParcelPts) 
            
            if rg.Intersect.Intersection.CurveSelf(nbParcelGeo.ToPolylineCurve(),0.001).Count == 0:
                checkTag = False
            else:
                checkTag = True
        
        
            if rg.Intersect.Intersection.CurveCurve(targetParcelGeo.ToPolylineCurve(), nbParcelGeo.ToPolylineCurve(),0.001,0.001).Count  > 1: 
                checkTag = True     
        # print ("IfGoingToBeSelfIntersected,selectedEdge"),currPF.ID
        # for pt in selectedEdge.GetGeometry():
        #     print pt.X,pt.Y,0
        
        
        # print ("IfGoingToBeSelfIntersected,selectedEdge"),currPF.ID
        # for pt in targetParcel.vertices:
        #     print pt.geometry.X,pt.geometry.Y,0
            
        # print "-----"
        # for pt in nbParcel.vertices:
        #     print pt.geometry.X,pt.geometry.Y,0    
        # print "-----"
            
        # print ("IfGoingToBeSelfIntersected"),currPF.ID
        # for pt in targetParcel.GetGeometry():
        #     print pt.X,pt.Y,0
            
        # print "-----"
        # for pt in nbParcel.GetGeometry():
        #     print pt.X,pt.Y,0
        # print "-----"
        
        # print ("IfGoingToBeSelfIntersected"),currPF.ID
        # if nbParcel!=None:
        #     print nbParcel.ID
        
        # for pt in targetParcelPts:
        #     print pt.X,pt.Y,0
        # print "-----"
        
        # for pt in nbParcelPts:
        #     print pt.X,pt.Y,0
        # print "-----"
        # print ("checkTag")
        return checkTag
            
            
    @staticmethod   
    def ReduceMergeEdge(PL,currQ,currPF,selectedEdge,currSideIndex,EDict,VP_Dict):   
        # print ("in ReduceMergeEdge"), [edge.ID for edge in currPF.edges]
        # print ("in ReduceMergeEdge"), currPF.sides
        # print ("in ReduceMergeEdge"), [v.ID for v in currPF.vertices]
        startV = selectedEdge.startVertex   ### store here, later I cant get this by selected edge
        endV = selectedEdge.endVertex       ### store here, later I cant get this by selected edge
        
        ### create a new vertex, if on the boundary , merge it to the boundary
        if startV.onBoundary == True:
            newV = startV
        elif endV.onBoundary == True: 
            newV = endV 
        else:
            startPt =  selectedEdge.GetGeometry().First
            EndPt =  selectedEdge.GetGeometry().Last
            avePt = (startPt+EndPt)/2
            currMaxVPID = max(VP_Dict.Keys)
            newV = PL.ParcVertex(avePt,currMaxVPID+1)
            
            VP_Dict[newV.ID] = newV ## add into VP dict
            
        #print ("CheckMergeEdge happen,newV"),newV.geometry.X,newV.geometry.Y,0
        ### find the parcels to treat with 
        targetParcel = currPF
            
        # check if there is nbParcel    
        if selectedEdge.twinID  == None:
            nbParcel = None
            twinEdge = None
        else:
            nbParcel = currPF.mutualE_P[selectedEdge]
            twinEdge = EDict[selectedEdge.twinID]
            
        
        ### check if its going to be a triangle
        for side in targetParcel.sides:
            if selectedEdge.ID in side:
                if len(side) == 1:
                    return [],[]
        
        if nbParcel!= None:      
            for side in nbParcel.sides:
                if twinEdge.ID in side:
                    if len(side) == 1:
                        return [],[]
        
        
        ### check if its going to be self-intersected
        
            
        ### replace the edge startVertex and endVertex  /  this treatment for all parcels / this will change the selected edge
        for parcel in currQ:
            if parcel != targetParcel and parcel != nbParcel:
                edges = parcel.edges
                for edge in edges:
                    if edge.startVertex == startV:
                        edge.startVertex = newV
                    if edge.endVertex == startV:
                        edge.endVertex = newV
                    if edge.startVertex == endV:
                        edge.startVertex = newV
                    if edge.endVertex == endV:
                        edge.endVertex = newV

                for i in range(len(parcel.vertices)):
                    vertex = parcel.vertices[i]
                    if vertex == startV or vertex == endV:
                        parcel.vertices[i] = newV

        ### targetParcel: remove the edge， change affected edge vertices 
        targetParcel.edges.remove(selectedEdge)
        edges = targetParcel.edges
        for edge in edges:
            if edge.endVertex == startV:
                edge.endVertex = newV
            if edge.startVertex == endV:
                edge.startVertex = newV
        
        ### targetParcel: remove 2 original V and insert new V
        v_TargetParcel = targetParcel.vertices
        index_Start = v_TargetParcel.index(startV)
        index_End = v_TargetParcel.index(endV)
        # print ("index_Start"),index_Start
        # print ("index_End"),index_End
        
        newVertices = v_TargetParcel[:index_Start]+[newV]+v_TargetParcel[index_Start+1:]    
        newVertices.pop(index_End)    

        if index_End == 0:    ### to sort the vertices order
            newVertices = [newVertices[-1]]+ newVertices[0:-1]
        targetParcel.vertices = newVertices

        ### targetParcel: Update Side
        targetParcel.sides[currSideIndex].remove(selectedEdge.ID)
        
        ### nbParcel: remove the twinedge
        if nbParcel !=None:
            nbParcel.edges.remove(twinEdge)

            nbEdges = nbParcel.edges
            for edge in nbEdges:
                if edge.endVertex == endV:
                    edge.endVertex = newV
                if edge.startVertex == startV:
                    edge.startVertex = newV
            
            ### nbParcel: remove 2 original V and insert new V
            v_nbParcel = nbParcel.vertices
            index_Start_nb = v_nbParcel.index(endV)    #twin, end->start
            index_End_nb = v_nbParcel.index(startV)
            #print "index_Start_nb,index_End_nb:",index_Start_nb,index_End_nb
            #print "v_nbParcel",len(v_nbParcel)
            newVertices_nb = v_nbParcel[:index_Start_nb]+[newV]+v_nbParcel[index_Start_nb+1:] 
            newVertices_nb.pop(index_End_nb)
            
            if index_End_nb == 0:    ### to sort the vertices order
                
                newVertices_nb = [newVertices_nb[-1]]+ newVertices_nb[0:-1]
            nbParcel.vertices = newVertices_nb
                    
            ### nbParcel: Update Side
            for currNbSideIndex in range (len(nbParcel.sides)):
                currNbSide = nbParcel.sides[currNbSideIndex]
                if twinEdge.ID in currNbSide:
                    nbParcel.sides[currNbSideIndex].remove(twinEdge.ID)
                    break

            
            ### update neighbor info 
            targetParcel.neighbors.pop(targetParcel.neighbors.index(nbParcel))
            nbParcel.neighbors.pop(nbParcel.neighbors.index(targetParcel))
            
            targetParcel.mutualE_P.pop(selectedEdge)
            nbParcel.mutualE_P.pop(twinEdge)
            
            targetParcel.mutualP_E.pop(nbParcel)
            nbParcel.mutualP_E.pop(targetParcel)

        # print ("in ReduceMergeEdge,after"), [edge.ID for edge in targetParcel.edges]
        # print ("in ReduceMergeEdge,after"), currPF.sides
        # print ("in ReduceMergeEdge,after"), [v.ID for v in currPF.vertices]
        # print ("targetParcel"),targetParcel.ID
        # print ("selectedEdge"),selectedEdge.ID
        
        # if twinEdge!=None:
        #     print ("nbParcel"),nbParcel.ID
        #     print ("twinEdge"),twinEdge.ID
        # elif twinEdge==None:
        #     print ("nbParcel"),nbParcel
        #     print ("twinEdge"),twinEdge
        
        ### remove from Edict
        if selectedEdge.ID in EDict.keys():
            EDict.pop(selectedEdge.ID)
        if selectedEdge.twinID in EDict.keys():
            EDict.pop(selectedEdge.twinID)
        
        mergedEdgeIndices = []
        mergedEdgeIndices.append(selectedEdge.ID)
        if twinEdge!=None:
            mergedEdgeIndices.append(twinEdge.ID)
            
       
        mergedEdgeNewVs= [newV,newV]
        return mergedEdgeIndices,mergedEdgeNewVs
            
    
    @staticmethod
    def CheckStreetChangedByMerge_Old(RF,currStreetGraph,mergedEdgeIndices,mergedEdgeNewVs):
        if mergedEdgeIndices == []:
            return 
        allStreets = currStreetGraph.GetStreetDict().values()
        
        for street in allStreets:
            whileCount = 0
            streetNode = street.head
            
            ### check the special case
            if len(street.GetAllParcEdge()) == 1 and street.GetAllParcEdge()[0].ID in mergedEdgeIndices:
                ### remove this street from currStreetGraph
                
                print ("in CheckStreetChangedByMerge special before, whole street ID"),street.ID
                allNodes = street.GetAllStreetNodes()
                print ([sNode.ID for sNode in allNodes])

                
                
                
                currStreetGraph.graph.pop(street)
                for key in currStreetGraph.graph.keys():
                    if street in currStreetGraph.graph[key]:
                        currStreetGraph.graph[key].pop(street)
                print ("in CheckStreetChangedByMerge special case remove"),street.head.node.ID,street.end.node.ID
            
            else:
                
                while streetNode.next!=None:
                    if whileCount>1000:
                        break
                    whileCount +=1
                    currParcEdge = streetNode.nextConnection
                    
                    if currParcEdge.ID in mergedEdgeIndices:
                        
                        indexInList = mergedEdgeIndices.index(currParcEdge.ID)
                        
                        thisNewV = mergedEdgeNewVs[indexInList]
                        
                        thisNewStreetNode = RF.StreetNode(thisNewV)
                        print ("in CheckStreetChangedByMerge most case before, whole street ID"),street.ID
                        allNodes = street.GetAllStreetNodes()
                        print ([sNode.ID for sNode in allNodes])
                
                        if streetNode == street.head:
                            print ("in CheckStreetChangedByMerge most case before streetNode == street.head, whole street ID"),street.ID
                         
                            
                            nextStreetNode = streetNode.next
                            nextNextStreetNode = nextStreetNode.next
                            
                            street.head = thisNewStreetNode
                            street.head.prev = None
                            street.head.prevConnection = None
                            street.head.nextConnection = nextStreetNode.nextConnection
                            street.head.next = nextNextStreetNode
                            nextNextStreetNode.prev = street.head
                            
                        
                        elif currParcEdge.endVertex == street.end.node:
                            print ("in CheckStreetChangedByMerge most case before currParcEdge.endVertex == street.end.node, whole street ID"),street.ID
                            
                            
                            prevStreetNode = street.end.prev
        
                            street.end = thisNewStreetNode
                            street.end.next = None
                            street.end.nextConnection = None
                            street.end.prevConnection = prevStreetNode.prevConnection
                            street.end.prev = prevStreetNode
                            prevStreetNode.next = street.end
                            
                            break ### becasue end changed
                        
                        else:
                            print ("else case"), streetNode.ID
                            ### info of currStreetNode
                            currStreetNode = streetNode
                            prevStreetNode = currStreetNode.prev  
                            nextStreetNode = currStreetNode.next  
                            nextNextStreetNode = nextStreetNode.next 
                            
                            prevStreetNode.next = thisNewStreetNode
                            
                            thisNewStreetNode.prev = prevStreetNode
                            thisNewStreetNode.prevConnection = prevStreetNode.nextConnection
                            thisNewStreetNode.next = nextNextStreetNode
                            thisNewStreetNode.nextConnection = nextNextStreetNode.prevConnection
                            
                            nextNextStreetNode.prev = thisNewStreetNode
                            
                            #print ("in CheckStreetChangedByMerge most case after, whole street ID"),street.ID
                            #allNodes = street.GetAllStreetNodes()
                            #print ([sNode.ID for sNode in allNodes])
                        
                            #print ("in CheckStreetChangedByMerge remove"),nextStreetNode.node.ID
                            
                    
                    streetNode = streetNode.next
                            
                        
                    
                
                
                # streetNode = streetNode.next
        
    
    
    
    @staticmethod
    def CheckStreetChangedByMerge(RF,currStreetGraph,mergedEdgeIndices,mergedEdgeNewVs):
        if mergedEdgeIndices == []:
            return 
        allStreets = currStreetGraph.GetStreetDict().values()
        
        for street in allStreets:
            whileCount = 0
            streetNode = street.head
            
            ### check the special case
            if len(street.GetAllParcEdge()) == 1 and street.GetAllParcEdge()[0].ID in mergedEdgeIndices:
                ### remove this street from currStreetGraph
                
                print ("in CheckStreetChangedByMerge special before, whole street ID"),street.ID
                allNodes = street.GetAllStreetNodes()
                print ([sNode.ID for sNode in allNodes])

                
                
                
                currStreetGraph.graph.pop(street)
                for key in currStreetGraph.graph.keys():
                    if street in currStreetGraph.graph[key]:
                        currStreetGraph.graph[key].pop(street)
                print ("in CheckStreetChangedByMerge special case remove"),street.head.node.ID,street.end.node.ID
            
            else:
                
                while streetNode.next!=None:
                    if whileCount>1000:
                        break
                    whileCount +=1
                    currParcEdge = streetNode.nextConnection
                    
                    if currParcEdge.ID in mergedEdgeIndices:
                        
                        indexInList = mergedEdgeIndices.index(currParcEdge.ID)
                        
                        thisNewV = mergedEdgeNewVs[indexInList]
                        
                        thisNewStreetNode = RF.StreetNode(thisNewV)
                        print ("in CheckStreetChangedByMerge most case before, whole street ID"),street.ID
                        allNodes = street.GetAllStreetNodes()
                        print ([sNode.ID for sNode in allNodes])
                
                        if streetNode == street.head:
                            print ("in CheckStreetChangedByMerge most case before streetNode == street.head, whole street ID"),street.ID
                         
                            
                            nextStreetNode = streetNode.next
                            nextNextStreetNode = nextStreetNode.next
                            
                            street.head = thisNewStreetNode
                            street.head.prev = None
                            street.head.prevConnection = None
                            street.head.nextConnection = nextStreetNode.nextConnection
                            street.head.next = nextNextStreetNode
                            nextNextStreetNode.prev = street.head
                            
                        
                        elif currParcEdge.endVertex == street.end.node:
                            print ("in CheckStreetChangedByMerge most case before currParcEdge.endVertex == street.end.node, whole street ID"),street.ID
                            
                            
                            prevStreetNode = street.end.prev
        
                            street.end = thisNewStreetNode
                            street.end.next = None
                            street.end.nextConnection = None
                            street.end.prevConnection = prevStreetNode.prevConnection
                            street.end.prev = prevStreetNode
                            prevStreetNode.next = street.end
                            
                            break ### becasue end changed
                        
                        else:
                            print ("else case"), streetNode.ID
                            ### info of currStreetNode
                            currStreetNode = streetNode
                            prevStreetNode = currStreetNode.prev  
                            nextStreetNode = currStreetNode.next  
                            nextNextStreetNode = nextStreetNode.next 
                            
                            prevStreetNode.next = thisNewStreetNode
                            
                            thisNewStreetNode.prev = prevStreetNode
                            thisNewStreetNode.prevConnection = prevStreetNode.nextConnection
                            thisNewStreetNode.next = nextNextStreetNode
                            thisNewStreetNode.nextConnection = nextNextStreetNode.prevConnection
                            
                            nextNextStreetNode.prev = thisNewStreetNode
                            
                            #print ("in CheckStreetChangedByMerge most case after, whole street ID"),street.ID
                            #allNodes = street.GetAllStreetNodes()
                            #print ([sNode.ID for sNode in allNodes])
                        
                            #print ("in CheckStreetChangedByMerge remove"),nextStreetNode.node.ID
                            
                    
                    streetNode = streetNode.next
                            
                        
                    
                
                
                # streetNode = streetNode.next
# ---------- end ghpython_script_7 ----------
ghpython_script_8 = GhPythonScript()  # -> out, RD
# ---------- ghpython_script_8: Python ----------
###########################
####    Import Libs    ####
###########################
import Rhino.Geometry as rg
#import Rhino.RhinoDoc as rd
import Rhino.RhinoMath as rm

import ghpythonlib.components as ghc
import math
import Queue
import heapq
import itertools
from collections import deque
import gc
import time

from itertools import combinations
from collections import Counter
class RD:
    class Road:
        def __init__(self,edgeCollection):
            self.edgeCollection = edgeCollection # []
            #self.adjacencyParcF = {}      # {edge: parcF}                  
            #self.touchBoundary_S = None   # If start position of this road touch boundary 
            #self.touchBoundary_E = None   # If end position of this road touch boundary 
        
        def __del__(self):
            self.edgeCollection = None
            #self.adjacencyParcF = None
            #self.touchBoundary_S = None
            #self.touchBoundary_E = None
            
        def GetAllVertexInstance(self):
            allVertexInstance = []
            for edge in self.edgeCollection:
                allVertexInstance.append(edge.startVertex)
                
            allVertexInstance.append(self.edgeCollection[-1].endVertex)
            
            return allVertexInstance
        
        def GetRelevantPE(self,jV):
            relevantPEs = []
            for pE in self.edgeCollection:
                if jV == pE.startVertex or jV == pE.endVertex:
                    relevantPEs.append(pE)

            return relevantPEs
        ###################################
        ##########  Get Geometry  #########
        ###################################
        def GetGeometry(self):   #default one with betweenPoints
            newPts = []
            for edge in self.edgeCollection:
                newPts.append(edge.startVertex.geometry) 
                for bPt in edge.betweenPoints:
                    newPts.append(bPt.geometry)
            newPts.append(self.edgeCollection[-1].endVertex.geometry)

            return rg.Polyline(newPts)

        def GetGeometry_Simplified (self):   #StartPoint and EndPoint
            newPts = []
            for edge in self.edgeCollection:
                newPts.append(edge.startVertex.geometry) 
            newPts.append(self.edgeCollection[-1].endVertex.geometry)

            return rg.Polyline(newPts)

        def GetGeometry_SimplifiedWithTurningPoints (self):   #StartPoint and EndPoint
            newPts = []
            for edge in self.edgeCollection:
                newPts.append(edge.startVertex.geometry) 
                for tPt in edge.turningPoints:
                    newPts.append(tPt.geometry)
            newPts.append(self.edgeCollection[-1].endVertex.geometry)
            return rg.Polyline(newPts)
        
        def GetGeometry_SimplifiedWithResamplePoints (self):   #StartPoint and EndPoint
            newPts = []
            for edge in self.edgeCollection:
                newPts.append(edge.startVertex.geometry) 
                for rPt in edge.resamplePoints:
                    newPts.append(rPt.geometry)
            newPts.append(self.edgeCollection[-1].endVertex.geometry)
            return rg.Polyline(newPts)

        ###################################
        ##########  Get AllVP  #########
        ###################################
        def GetAllVPInstance_Resample(self):
            allVP = []
            for pE in self.edgeCollection:
                allVP.append(pE.startVertex)
                for rPt  in pE.resamplePoints:
                    allVP.append(rPt)
            allVP.append(self.edgeCollection[-1].endVertex)
            
            return allVP

        def GetAllVPInstance_TurningPoints(self):
            allVP = []
            for pE in self.edgeCollection:
                allVP.append(pE.startVertex)
                for rPt  in pE.turningPoints:
                    allVP.append(rPt)
            allVP.append(self.edgeCollection[-1].endVertex)
            
            return allVP
        
        def GetAllVPInstance_Simplified(self):
            allVP = []
            for pE in self.edgeCollection:
                allVP.append(pE.startVertex)

            allVP.append(self.edgeCollection[-1].endVertex)
            
            return allVP
        
    ###################################
    ##########  Create Road  #########
    ###################################

    @staticmethod
    def GetRoadCollection(edgeConnectionRecord,currE_Dict):
        edgeCollection_All = []
        for key in edgeConnectionRecord.keys():
            
            if edgeConnectionRecord[key] != True: 
                #print ("start from "),key     
                edgeCollection = RD.GetARoad(edgeConnectionRecord,currE_Dict,key,rm.ToRadians(45)) 
                #print ("rinish searching "),[edge.ID for edge in edgeCollection] 
                #print "-----"
                edgeCollection_All.append(edgeCollection)
            pass
        # key = 3367     
        # print ("start from "),key
        # edgeCollection = RD.GetARoad(edgeConnectionRecord,currE_Dict,key,rm.ToRadians(60)) 
        # edgeCollection_All.append(edgeCollection)

        return edgeCollection_All
    
    
    @staticmethod
    def GetARoad(edgeConnectionRecord,currE_Dict,key,angleTolerance):
        processEdge = currE_Dict[key]
        ### update Dict 
        edgeConnectionRecord[processEdge.ID] =True 
        edgeConnectionRecord[processEdge.twinID] =True
        
        ### get both halves
        edgeCollection_Start = RD.GetARoad_FirstHalf(edgeConnectionRecord,currE_Dict,processEdge,angleTolerance)
        edgeCollection_End = RD.GetARoad_SecondHalf(edgeConnectionRecord,currE_Dict,processEdge,angleTolerance)
        
        ############### Combine
        edgeCollection_Start_Twin = []
        for edge in edgeCollection_Start:
            edgeCollection_Start_Twin.append(currE_Dict[edge.twinID])
        
        edgeCollection_End.reverse()
        edgeCollection_End_Twin = []
        for edge in edgeCollection_End:
            edgeCollection_End_Twin.append(currE_Dict[edge.twinID])
            
        edgeCollection_Combined= edgeCollection_End_Twin + [currE_Dict[processEdge.twinID]] + edgeCollection_Start_Twin 

        #road = PP.GetContinueRoad(edgeCollection_All)
        return edgeCollection_Combined

    
    @staticmethod
    def GetARoad_FirstHalf(edgeConnectionRecord,currE_Dict,processEdge,angleTolerance):

        edgeCollection_Start = []
        ############### Part1 
        ### start from startVertex
        relatedEdges = RD.GetRelatedEdgeFromStart(processEdge,currE_Dict)
        # if relatedEdges!=[]:
        #     print ("GetARoad_FirstHalf relatedEdges"), [edge.ID for edge in relatedEdges]
        if relatedEdges == []:
            return edgeCollection_Start
        
        selectedEdge = RD.GetMinAngleEdge(processEdge,relatedEdges,angleTolerance,edgeConnectionRecord)
        # if selectedEdge!=None:
        #     print ("GetARoad_FirstHalf selectedEdge"), selectedEdge.ID 
        
        if selectedEdge == None or selectedEdge.naked ==True:
            return edgeCollection_Start
        
        else:
            edgeCollection_Start.append(selectedEdge)

            #print ("GET EDGE id:"),selectedEdge.ID
            ### update Dict 
            edgeConnectionRecord[selectedEdge.ID] =True 
            edgeConnectionRecord[selectedEdge.twinID] =True 

            #print selectedEdge.ID
            ### Continue
            for i in range(1000):
                if relatedEdges!=[]:
                    relatedEdges = RD.GetRelatedEdgeFromStart(selectedEdge,currE_Dict)
                # if relatedEdges != []:
                #     print ("GetARoad_FirstHalf relatedEdges"), [edge.ID for edge in relatedEdges]
                if relatedEdges == []:
                    break 
                selectedEdge = RD.GetMinAngleEdge(selectedEdge,relatedEdges,angleTolerance,edgeConnectionRecord)
                # if selectedEdge!=None:
                #     print ("GetARoad_FirstHalf selectedEdge"), selectedEdge.ID 
        
                if selectedEdge==None or selectedEdge.naked ==True:
                    break
                else:
                    ### update Dict 
                    edgeConnectionRecord[selectedEdge.ID] =True 
                    edgeConnectionRecord[selectedEdge.twinID] =True 
                    #print ("GET EDGE id:"),selectedEdge.ID
                    edgeCollection_Start.append(selectedEdge)


            return edgeCollection_Start
        
        
    @staticmethod
    def GetARoad_SecondHalf(edgeConnectionRecord,currE_Dict,processEdge,angleTolerance):

        edgeCollection_End = []
        
        ### start from endVertex
        relatedEdges = RD.GetRelatedEdgeFromEnd(processEdge,currE_Dict)
        # if relatedEdges!=[]:
        #     print ("GetARoad_SecondHalf relatedEdges"), [edge.ID for edge in relatedEdges]
        if relatedEdges == []:
            return edgeCollection_End
        selectedEdge = RD.GetMinAngleEdge(processEdge,relatedEdges,angleTolerance,edgeConnectionRecord)
        # if selectedEdge!=None:
        #     print ("GetARoad_SecondHalf selectedEdge"), selectedEdge.ID 
        if selectedEdge == None or selectedEdge.naked ==True:
            return edgeCollection_End
        
        else:
            edgeCollection_End.append(selectedEdge)
            #print ("GET EDGE id:"),selectedEdge.ID
            ### update Dict 
            edgeConnectionRecord[selectedEdge.ID] =True 
            edgeConnectionRecord[selectedEdge.twinID] =True 
            
            ### Continue
            for i in range(1000):
                relatedEdges = RD.GetRelatedEdgeFromEnd(selectedEdge,currE_Dict)
                # if relatedEdges!=[]:
                #     print ("GetARoad_SecondHalf relatedEdges"), [edge.ID for edge in relatedEdges]
                selectedEdge = RD.GetMinAngleEdge(selectedEdge,relatedEdges,angleTolerance,edgeConnectionRecord)
                # if selectedEdge!=None:
                #     print ("GetARoad_SecondHalf selectedEdge"), selectedEdge.ID 
                if selectedEdge==None or selectedEdge.naked ==True:
                    break
                else:
                    ### update Dict 
                    edgeConnectionRecord[selectedEdge.ID] =True 
                    edgeConnectionRecord[selectedEdge.twinID] =True 
                    #print ("GET EDGE id:"),selectedEdge.ID
                    edgeCollection_End.append(selectedEdge)
            
            return edgeCollection_End
        
    @staticmethod
    def GetRelatedEdgeFromStart(processEdge,currEDict):
        detectParcV = processEdge.startVertex
        
        relatedEdges = []
        alledges = currEDict.values()

        #becasue there are twins
        for edge in alledges:
            if edge.endVertex.ID == detectParcV.ID and edge.ID != processEdge.twinID:
                relatedEdges.append(edge)
        
        return relatedEdges
    
    @staticmethod
    def GetRelatedEdgeFromEnd(processEdge,currEDict):
        
        detectParcV = processEdge.endVertex
        
        relatedEdges = []
        alledges = currEDict.values()

        # if processEdge.ID == 3851:
        #     print ("processEdge.ID = 3851")
        #     print ("detectParcV.ID"),detectParcV.ID,id(detectParcV)
            
        #     print ("currE_Dict[7038].startVertex.ID,id(currE_Dict[7038].startVertex)")
        #     print currEDict[7038].startVertex.ID,id(currEDict[7038].startVertex)
        #     print ("currE_Dict[7038].endVertex.ID,id(currE_Dict[7038].endVertex)")
        #     print currEDict[7038].endVertex.ID,id(currEDict[7038].endVertex)
    
        # if processEdge.ID == 3850:
        #     print ("processEdge.ID = 3850")
        #     print ("detectParcV.ID"),detectParcV.ID,id(detectParcV)
            
        #     print ("currE_Dict[7038].startVertex.ID,id(currE_Dict[7038].startVertex)")
        #     print currEDict[7038].startVertex.ID,id(currEDict[7038].startVertex)
        #     print ("currE_Dict[7038].endVertex.ID,id(currE_Dict[7038].endVertex)")
        #     print currEDict[7038].endVertex.ID,id(currEDict[7038].endVertex)
            
        #becasue there are twins
        for edge in alledges:
            if edge.startVertex.ID == detectParcV.ID and edge.ID != processEdge.twinID:   #### copy parcels are not the same instances
                relatedEdges.append(edge)
        
        return relatedEdges
    
    
    @staticmethod
    def GetMinAngleEdge(processEdge,relatedEdges,toleranceAngle,record):
        angles = []
        ###simplified, so its a line 
        thisEdge_Vec = rg.Vector3d(processEdge.endVertex.geometry - processEdge.startVertex.geometry)

        relatedIDs = [relatedEdge.ID for relatedEdge in relatedEdges]
        #print ("relatedIDs:", relatedIDs)
        for relatedEdge in relatedEdges:
            relatedEdge_Vec = rg.Vector3d(relatedEdge.endVertex.geometry - relatedEdge.startVertex.geometry)
            angles.append(rg.Vector3d.VectorAngle(thisEdge_Vec,relatedEdge_Vec)) 
        
        if relatedEdges == []:
            return None
         
        relatedEdges,angles = RD.SortListsAccordingly(relatedEdges,angles)
        minEdge = None
        for i in range(len(relatedEdges)):
            currAngle = angles[i]
            currEdge = relatedEdges[i]

            
            if currAngle < toleranceAngle and record[currEdge.ID]==False:
                minEdge = currEdge
                #print ("processEdge"),processEdge.ID,("Get an edge"),minEdge.ID,rm.ToDegrees(currAngle)
                break
        
        
        return minEdge
    
    @staticmethod
    def SortListsAccordingly(listIstance,listNum):

        zipped_list = list(zip(listIstance, listNum))
        sorted_list = sorted(zipped_list, key=lambda x: x[1])
        listIstance_Sorted,listNum_Sorted = zip(*sorted_list)
        return listIstance_Sorted,listNum_Sorted
        

    @staticmethod
    def CreateConnectionRecord(currStreetGraph,currEDict):
        edgeConnectionRecord = {}

        #allPE = currStreetGraph.GetAllParcEdge()
        
        allPE = []
        for street in currStreetGraph.graph.keys():
            #print "in GetAllParcEdgeID"
            #print street
            allPE.extend(street.GetAllParcEdge())
        currStreetE_Dict = {}
        
        for pE in allPE:
            currStreetE_Dict[pE.ID] = pE
            
            #print "pE.ID,pE.twinID",pE.ID,pE.twinID,pE.generation

            if pE.naked == False:
                #print pE.isValid
                currStreetE_Dict[pE.twinID] = currEDict[pE.twinID]
        
        for pE in allPE:
            if pE.naked ==True:
                edgeConnectionRecord[pE.ID] = True
            else:
                
                edgeConnectionRecord[pE.ID] = False
                edgeConnectionRecord[pE.twinID] = False
                
                
        return edgeConnectionRecord,currStreetE_Dict

    
    
    ############################################
    ##########  Create Road Instance   #########
    ############################################
    @staticmethod 
    def CreateRoadInstances(edgeCollection_All):
        roads = []
        for edgeCollection in edgeCollection_All:
            roads.append(RD.Road(edgeCollection))
        return roads

    @staticmethod 
    def FillRoadInfo(roads):
        return None
    
    
    @staticmethod 
    def CreateRoadInstances_Original(currStreetGraph,currE_Dict):
        originalRoads = []
        
        for street in currStreetGraph.graph.keys():
            
            if street.original == True:
                allPE = street.GetAllParcEdge()
                allPEIDs = [pE.ID for pE in allPE]
                allPE_Curr = [currE_Dict[eID] for eID in allPEIDs]
                originalRoads.append(RD.Road(allPE_Curr))

        return originalRoads
    
    ############################################
    ##########       Road Graph        #########
    ############################################
    
    
    
    @staticmethod 
    def ClassifyVertices(currQ):
        innerV = []
        for parcF in currQ:
            vs = parcF.vertices 
            for v in vs:
                if v not in innerV and v.onBoundary == False:
                    innerV.append(v)
                    
        innerV_Geo = [v.geometry for v in innerV ]

        externV = []
        for parcF in currQ:
            vs = parcF.vertices
            for v in vs:
                if v not in externV and v.onBoundary == True:
                    externV.append(v)
                    
        externV_Geo = [v.geometry for v in externV ]

        allV = []
        allV.extend(innerV)
        allV.extend(externV)
        allV_Geo = [v.geometry for v in allV ]

        return allV,allV_Geo,innerV,innerV_Geo,externV,externV_Geo
# ---------- end ghpython_script_8 ----------
ghpython_script_9 = GhPythonScript()  # -> out, OP
# ---------- ghpython_script_9: Python ----------
import Rhino.Geometry as rg
#import Rhino.RhinoDoc as rd
import Rhino.RhinoMath as rm
import Rhino.RhinoApp as ra
import ghpythonlib.components as ghc

from System.Collections.Generic import List
import clr
clr.AddReference("KangarooSolver.dll")
import KangarooSolver as ks

from itertools import combinations
from collections import Counter

import math

class OP:

    ###########################################
    ########          Preview           #######
    ###########################################
    @staticmethod
    def PreviewAllParcVertexAndParcPoint(allParcF):
        allV = []
        allP = []
        for pF in allParcF:
            Vs = pF.vertices
            for v in Vs:
                if v not in allV:
                    allV.append(v)
            
            edges = pF.edges
            for e in edges:
                allP.extend(e.betweenPoints)

        allV_Geo = [v.geometry for v in allV]
        allP_Geo = [pt.geometry for pt in allP]
        
        return  allV_Geo,allP_Geo

        
    @staticmethod
    def GetAllEdgeGeoAndIDFromDict(currE_Dict):
        edges = []
        edges_indices = []
        for edge in currE_Dict.values():
            edges.append(edge.GetGeometry())
            edges_indices.append(edge.ID)
        return edges,edges_indices

    ### checkInfo
    @staticmethod
    def PrintParcelAddress(collection):
        for pF in collection:
            print ("selected original Ids：") ,id(pF)

    @staticmethod
    def GetNonNakedEdge(currE_Dict):
        edges = []
        for edge in currE_Dict.values():
            if edge.naked == False:
                edges.append(edge.GetGeometry())
        return edges


    ###################################
    ####           Copy            ####
    ###################################
    @staticmethod
    def MakePartialCopy(selectedParcFace):
        currVP_Dict = {}
        for parcFace in selectedParcFace:
            thisVPInstances = parcFace.GetVPInstance()
            for VPInstance in thisVPInstances:
                if VPInstance.ID not in currVP_Dict.keys():
                    currVP_Dict[VPInstance.ID] = VPInstance.DeepCopy()
            
            if parcFace.startPt!=None:
                if parcFace.startPt.ID not in currVP_Dict.keys():
                    currVP_Dict[parcFace.startPt.ID] = parcFace.startPt.DeepCopy()
        currE_Dict = {}

        for parcFace in selectedParcFace:
            thisEInstances = parcFace.edges
            for EInstance in thisEInstances:
                if EInstance.ID not in currE_Dict.keys():
                    newE =  EInstance.DeepCopy(currVP_Dict)
                    currE_Dict[EInstance.ID] = newE
                    #E_Redirect[newE] = EInstance

        currE_Dict_All = currE_Dict
        copiedParcFace = []
        for parcFace in selectedParcFace:
        
            copiedParcFace.append(parcFace.DeepCopy(currVP_Dict,currE_Dict,currE_Dict_All))
            #print ("before:"),len(parcFace.vertices),("after:"),len(copiedParcFace[-1].vertices)

        ########## build redirectMap
        redirectMap = {}
        for i in range(len(selectedParcFace)):
            redirectMap[selectedParcFace[i]] = copiedParcFace[i]
            redirectMap[copiedParcFace[i]] = selectedParcFace[i]


        return copiedParcFace,currVP_Dict,currE_Dict,redirectMap

    @staticmethod
    def RedirectNeighbors_Temp(currQ,prevQ,newEDict,redirectMap):

        for parcFace in currQ:
            # update the "neighbors" 
            for i in range(len(parcFace.neighbors)):
                thisNeighbor = parcFace.neighbors[i]
                if thisNeighbor in prevQ:
                    parcFace.neighbors[i] = redirectMap[thisNeighbor]
        
        #print "-----------------------before"
        for parcFace in currQ:
            NIDs = []
            for N in parcFace.neighbors:
                NIDs.append(id(N))
            #print id(parcFace),"NIDs:", NIDs
            
        for parcFace in currQ:
            #print "-----parcFace",id(parcFace)
            thisNs = parcFace.neighbors
            #print (len(thisNs))
            newNs = []
            for thisN in thisNs:
                
                if thisN  in currQ:
                    newNs.append(thisN)
            parcFace.neighbors=newNs
                    

        # update the "mutualP_E" 
        for parcFace in currQ:
            thisNeighbors = parcFace.neighbors
            parcFace.mutualP_E = {}
            parcFace.mutualE_P = {}
            
            for thisN in thisNeighbors:
                
                parcFace_prev = redirectMap[parcFace]
                thisN_prev = redirectMap[thisN]
                
                eID = thisN_prev.mutualP_E[parcFace_prev].twinID
                
                parcFace.mutualP_E[thisN] = newEDict[eID]
                parcFace.mutualE_P[newEDict[eID]] = thisN
            
    

    ###################################
    ####       Truning Points      ####
    ###################################
    @staticmethod
    def FindTurningPoint(polyL,detectAngle):
        segments = polyL.GetSegments()
        
        turningPts = []
        turningPtIndices = []
        for i in range(len(segments)-1):
            currSeg = segments[i]
            nextSeg = segments[i+1]
            currVec = rg.Vector3d(currSeg.To - currSeg.From)
            nextVec = rg.Vector3d(nextSeg.To - nextSeg.From)
            angle = rg.Vector3d.VectorAngle(currVec,nextVec)
            detectAngle_R = rm.ToRadians(detectAngle)
            if  angle>detectAngle_R:
                #print angle
                turningPts.append(currSeg.To)
                turningPtIndices.append(i+1)
        
        return turningPtIndices,turningPts

    @staticmethod
    def FindTurningPointsForParcel_BeforeMerge(parcel):
        edges = parcel.edges
        ### collect turningPoint indices
        turningPtCollection = []
        for i in range(len(edges)):
            turningPtCollection.append([])
            
        for i in range(len(edges)):
            currEdge = edges[i]
            turningPtIndices,turningPts = PP.FindTurningPoint(currEdge.GetGeometry())
            turningPtCollection[i].append(i)
            turningPtCollection[i].append(turningPtIndices)
            turningPtCollection[i].append(turningPts)
        return turningPtCollection

    @staticmethod
    def FindTurningPointsForParcel_AfterMerge(parcel,detectAngle):
        allVP = parcel.GetVPInstance()
        edges = parcel.edges
        ### collect turningPoint indices
        turningPtInfo = []
        for i in range(len(edges)):
            turningPtInfo.append([])
            
        for i in range(len(edges)):
            currEdge = edges[i]
            allVP = currEdge.GetVPInstance()
            
            turningPtIndices,turningPts = OP.FindTurningPoint(currEdge.GetGeometry(),detectAngle)
            

            turningPtIndices_Clean = []
            turningPts_Clean = []
            #print "now treating edge ",i
            for ptIndex in turningPtIndices:
                #print "ptIndex:",ptIndex, "len(allVP)",len(allVP)
                
                if ptIndex != 1 and ptIndex!= len(allVP)-2:  #betweenPt[0] or betweenPt[-1],dont consider
                    #print "before :",turningPtIndices_Clean
                    turningPtIndices_Clean.append(ptIndex)
                    turningPts_Clean.append(turningPts[turningPtIndices.index(ptIndex)])
                    #print "after :",turningPtIndices_Clean
            turningParcPoints_Clean = []
            for index in turningPtIndices_Clean:
                turningParcPoints_Clean.append(allVP[index])
                    
            turningPtInfo[i].append(i)
            
            turningPtInfo[i].append(turningPtIndices_Clean)
            turningPtInfo[i].append(turningPts_Clean)
            turningPtInfo[i].append(turningParcPoints_Clean)
            
            # [(edgeIndex,[turningPtIndices],[Point3d],[ParcPoint])
        return turningPtInfo

    @staticmethod
    def GetTurningPtInfoCollection(allParcel,detectAngle):
        turningPtCollection = []
        for parcel in allParcel:
            turningPtInfo =  OP.FindTurningPointsForParcel_AfterMerge(parcel,detectAngle)
            turningPtCollection.append([parcel,turningPtInfo])
            
        return turningPtCollection
        
    @staticmethod
    def ExtractTurningPtInfo(turningPtCollection):
        turningParcPts = []
        turningParcFs = []
        
        for parcelIndex in range(len(turningPtCollection)): 
            turningPtInfo = turningPtCollection[parcelIndex][1]
            thisParcel = turningPtCollection[parcelIndex][0]
        
            for egdeIndex in range(len(turningPtInfo)):

                for parcPt in turningPtInfo[egdeIndex][3]:
                    turningParcPts.append(parcPt)
                    turningParcFs.append(thisParcel)  
                        
        return turningParcPts,turningParcFs

    @staticmethod
    def ExtractEdgeTurningPtIndices(turningPtCollection):
        E_tPt_Collection = []
        for c in turningPtCollection:
            thisParcF = c[0]
            edges = thisParcF.edges
            edgesInfo = c[1]
            for edgeInfo in edgesInfo:
                thisEdgeIndex = edgeInfo[0]
                thisEdge = edges[thisEdgeIndex]
                turningPtIndices = edgeInfo[1]
                if edgeInfo[1] != []:
                    E_tPt_Collection.append([thisEdge,turningPtIndices])


        E_tPt_Collection_Clean = []
        IDRecord = []
        for collection in E_tPt_Collection:
            edge = collection[0]
            if edge.ID not in IDRecord:
                IDRecord.append(edge.ID) 
                IDRecord.append(edge.twinID) 
                E_tPt_Collection_Clean.append(collection)
        
        E_tPt_Dict = {}
        for collection in E_tPt_Collection_Clean:
            E_tPt_Dict[collection[0]] = collection[1]
        return E_tPt_Dict

    @staticmethod
    def CreateTurningPointModifyList(turningParcPts,turningParcFs):
        ###### Clean repeated ParcPoint becasue of twin
        newParcPtList = []
        newIndexList = []
        newParcFaceList = []
        for i in range(len(turningParcPts)):
            pt = turningParcPts[i]

            if pt not in newParcPtList:
                newParcPtList.append(pt)
                newIndexList.append(i)
                newParcFaceList.append(turningParcFs[i])
                print ("add:"),pt.ID

        modifyList = []
        ##### Create a dict to store which parcFace should be updated  format: {parcPoint, parcels}
        for i in range(len(newParcPtList)):
            parcPoint = newParcPtList[i]
            parcel = newParcFaceList[i]
            newDict = {parcPoint:parcel}
            modifyList.append(newDict)

        return  modifyList

    @staticmethod
    def ModifyAllTurningPoints(PL,modifyList,currVP_Dict,currE_Dict):
        for modifyIndex in range(len(modifyList)):

            targetModifyList = modifyList[modifyIndex]
            

            targetParcF= targetModifyList.values()[0]
            targetParcPt = targetModifyList.keys()[0]
            #print ("now doing targetParcF:"),targetParcF.ID, "targetParcPt:",targetParcPt.geometry
        
            edges = targetParcF.edges 
            for edge in edges:
                allVP = edge.GetVPInstance()
                if targetParcPt in allVP:
                    targetEdge = edge

            #print ("now doing targetEdge:"),targetEdge.ID
            #print ("targetEdge:"), targetEdge,"targetEdgeID:", targetEdge.ID 
            targetEdge_Geo = targetEdge.GetGeometry()
            targetPF_Geo = targetParcF.GetGeometry()
            targetPF_V_Geo = [v.geometry for v in targetParcF.vertices]


            
            print ("targetEdge.ID:"),targetEdge.ID
            print ("targetF.ID:"),targetParcF.ID
            print ("mutualE_P")
            mutualE_P = targetParcF.mutualE_P
            for key in mutualE_P.keys():
                print (key.ID),mutualE_P[key].ID
            print ("--------------")
            #print targetParcPt.geometry
            nbParcF = targetParcF.mutualE_P[targetEdge]         ### need to define here, otherwise the key will disapper
            nbEdge = currE_Dict[targetEdge.twinID]  
            

            betweenPts = targetEdge.betweenPoints
            betweenPtIndex = betweenPts.index(targetParcPt)
            first_part = betweenPts[:betweenPtIndex]
            second_part = betweenPts[betweenPtIndex+1:]

            #Convert the old parcPoint to parcVertex, and
            currVPMaxID = max(currVP_Dict.keys())
            newV = PL.ParcVertex(targetParcPt.geometry,currVPMaxID+1)
            currVP_Dict[newV.ID] = newV

            #create New Edges
            currMaxID = max(currE_Dict.keys())
            newEdge_1 = PL.ParcEdge(currMaxID+1)
            newEdge_2 = PL.ParcEdge(currMaxID+3)

            #fill info for newEdge_1
            newEdge_1.startVertex = targetEdge.startVertex
            newEdge_1.endVertex = newV
            newEdge_1.betweenPts = first_part

            #fill info for newEdge_2
            newEdge_2.startVertex = newV
            newEdge_2.endVertex = targetEdge.endVertex
            newEdge_2.betweenPts = second_part

            #create twins
            newEdge_1_twin = newEdge_1.CreateTwin(currMaxID+2)
            newEdge_2_twin = newEdge_2.CreateTwin(currMaxID+4)


            #####################################################
            ######### this parcel
            ### insert vertex/ replace and insert edges
            vertices_ThisPF = targetParcF.vertices
            #print "old vertices_ThisPF:",len(vertices_ThisPF)
            start_ThisPE  = targetEdge.startVertex 
            end_ThisPE =targetEdge.endVertex 

            index_Start = vertices_ThisPF.index(start_ThisPE)
            index_End = vertices_ThisPF.index(end_ThisPE)
            #print index_Start,index_End
            newVertices_ThisPF  = vertices_ThisPF[:index_Start+1] + [newV] + vertices_ThisPF[index_Start+1:]
            edges_ThisPF = targetParcF.edges
            index_TargetEdge = edges_ThisPF.index(targetEdge)
            newEdges_ThisPF  = edges_ThisPF[:index_TargetEdge] + [newEdge_1,newEdge_2] + edges_ThisPF[index_TargetEdge+1:]

            targetParcF.vertices = newVertices_ThisPF
            targetParcF.edges = newEdges_ThisPF
            #print "new vertices_ThisPF:",len(newVertices_ThisPF)
            #print "-------------"
            ######### theNeighbor parcel
            vertices_NeighborPF = nbParcF.vertices
            #print "old vertices_NeighborPF:",len(vertices_NeighborPF)
            start_nbEdge = nbEdge.startVertex
            end_nbEdge = nbEdge.endVertex
            index_nbEdge_Start = vertices_NeighborPF.index(start_nbEdge)
            index_nbEdge_End = vertices_NeighborPF.index(end_nbEdge)
            #print index_nbEdge_Start,index_nbEdge_End
            newVertices_nbParcF = vertices_NeighborPF[:index_nbEdge_Start+1] + [newV] + vertices_NeighborPF[index_nbEdge_Start+1:]

            edges_nbParcF = nbParcF.edges
            index_nbEdge = edges_nbParcF.index(nbEdge)
            newEdges_nbParcF = edges_nbParcF[:index_nbEdge] + [newEdge_2_twin,newEdge_1_twin] + edges_nbParcF[index_nbEdge+1:]

            nbParcF.vertices = newVertices_nbParcF
            nbParcF.edges = newEdges_nbParcF

            ### change E_P Dict and P_E Dict
            #targetParcF
            targetParcF.mutualE_P.pop(targetEdge)
            targetParcF.mutualP_E.pop(nbParcF)
            
            targetParcF.mutualE_P[newEdge_1] = nbParcF
            targetParcF.mutualE_P[newEdge_2] = nbParcF
            targetParcF.mutualP_E[nbParcF] = [newEdge_1,newEdge_2]

            #nbParcF
            nbParcF.mutualE_P[newEdge_1_twin] = targetParcF
            nbParcF.mutualE_P[newEdge_2_twin] = targetParcF
            nbParcF.mutualP_E[targetParcF] = [newEdge_1_twin,newEdge_2_twin]

            # Store other info  
            newEdge_1.generation = targetEdge.generation
            newEdge_1_twin.generation = targetEdge.generation
            newEdge_2.generation = targetEdge.generation
            newEdge_2_twin.generation = targetEdge.generation

            newEdge_1.accessibility = targetEdge.accessibility
            newEdge_1_twin.accessibility = targetEdge.accessibility
            newEdge_2.accessibility = targetEdge.accessibility
            newEdge_2_twin.accessibility = targetEdge.accessibility

            #copyInfo
            newEdge_1.generation = targetEdge.generation
            newEdge_1.offsetDistance = targetEdge.offsetDistance
            newEdge_1.hierarchy = targetEdge.hierarchy
            newEdge_2.generation = targetEdge.generation
            newEdge_2.offsetDistance = targetEdge.offsetDistance
            newEdge_2.hierarchy = targetEdge.hierarchy
            newEdge_1_twin.generation = targetEdge.generation
            newEdge_1_twin.offsetDistance = targetEdge.offsetDistance
            newEdge_1_twin.hierarchy = targetEdge.hierarchy
            newEdge_2_twin.generation = targetEdge.generation
            newEdge_2_twin.offsetDistance = targetEdge.offsetDistance
            newEdge_2_twin.hierarchy = targetEdge.hierarchy
            
            #remove the split edge
            currE_Dict.pop(targetEdge.ID)
            currE_Dict.pop(nbEdge.ID)

            #add the split edge
            currE_Dict[newEdge_1.ID] = newEdge_1    
            currE_Dict[newEdge_2.ID] = newEdge_2 
            currE_Dict[newEdge_1_twin.ID] = newEdge_1_twin 
            currE_Dict[newEdge_2_twin.ID] = newEdge_2_twin 
            #print ("------------------done once-------------------"  ) 

    @staticmethod
    def ModifyAllTurningPointsWithNewType(PL,turningPtCollection,allParcF,currVP_Dict,currE_Dict):
        finishedEdge_Record = []
        for i in range(len(turningPtCollection)):
            thisParcF = allParcF[i]
            turningPtInfo_ThisParcel = turningPtCollection[i][1]
            
            for edgeIndex  in range(len(turningPtInfo_ThisParcel)):
                turningPtInfo_ThisEdge = turningPtInfo_ThisParcel[edgeIndex]
                thisEdge = thisParcF.edges[edgeIndex]
                thisEdgeID = thisEdge.ID
                
                if thisEdgeID not in finishedEdge_Record:
                    
                    turningPoint3d = turningPtInfo_ThisEdge[2]
                    for pt3d in turningPoint3d:
                        
                        thisEdge.turningPoints.append(PL.ParcTurningPoint(pt3d,max(currVP_Dict.keys())+1))

                    finishedEdge_Record.append(thisEdgeID)
                    # treat the twinEdge, if any
                    thisTwinEdgeID = thisEdge.twinID
                    if thisTwinEdgeID != None :
                        thisTwinEdge = currE_Dict[thisTwinEdgeID]
                        for turingPt in thisEdge.turningPoints:
                            thisTwinEdge.turningPoints.append(turingPt)
                        thisTwinEdge.turningPoints.reverse()
                        finishedEdge_Record.append(thisTwinEdgeID)
                
            
            #print ("------------------done once-------------------"  ) 
        
    @staticmethod
    def CheckTurningPointSegmentLength(currE_Dict,minDist):
        allEdges = currE_Dict.values()
        for edge in allEdges:
            if edge.turningPoints!=[]:
                edgeWithTurningPt = edge.GetGeometry_SimplifiedWithTurningPoints()
                segs = edgeWithTurningPt.GetSegments()
                oldTurningPts = edge.turningPoints
                newTurningPts = []
                for i in range(len(segs)-1):
                    thisSeg = segs[i]
                    length  = thisSeg.Length
                    if length>minDist:
                        newTurningPts.append(oldTurningPts[i])
                if  segs[-1].Length < minDist and newTurningPts!=[]:
                    newTurningPts.pop()
                
                edge.turningPoints = newTurningPts
                

    ###################################
    ####      Resample points      ####
    ###################################    
    @staticmethod
    def DivideEdgeByNumAndClean(edge_Geo,divNum,tol):

        resamplePoints = []
        rebuildEdge = ghc.RebuildCurve(edge_Geo,1,divNum,False)
        segs,vertices = ghc.Explode(rebuildEdge,True)

        
        for time in range(len(vertices)-1):
            for i in range(len(vertices)-2):
                currPt = vertices[i]
                nextPt = vertices[i+1]
                dist = currPt.DistanceTo(nextPt)
                if dist<tol:
                    vertices.pop(i+1)
                    break
        
        ### check last segment
        lastDist = vertices[-1].DistanceTo(vertices[-2])
        if lastDist < tol and len(vertices) >2:
            vertices.pop(-2)
        
        
        
        if len(vertices) ==2:
            resamplePoints = []
        else:
            resamplePoints = vertices[1:-1]
        
        return resamplePoints

    @staticmethod
    def GetResamplePoints_Normal(PL,currVP_Dict,edge,divNum,tol = 1):
        edge_Geo = edge.GetGeometry()
        resamplePoints_Geo = OP.DivideEdgeByNumAndClean(edge_Geo,divNum,tol)
        resamplePoints = []
        for pt in resamplePoints_Geo:
            currVPMaxID = max(currVP_Dict.keys())
            newResamplePoint = PL.ParcResamplePoint(pt,currVPMaxID+1)
            currVP_Dict[currVPMaxID+1] = newResamplePoint

            edge.resamplePoints.append(newResamplePoint)
            if edge.naked ==True:
                newResamplePoint.onBoundary = True
            resamplePoints.append(newResamplePoint)
        edge.resamplePoints = resamplePoints
        #print "Normal: ",edge.ID
        
    @staticmethod
    def GetResamplePoints_WithTurningPoints(PL,currVP_Dict,edge,turningIndex,divNum,tol = 1):
        edge_Geo = edge.GetGeometry()
        pts = [pt for pt in edge_Geo]
        ts = []

        for pt in pts:
            ts.append(edge_Geo.ClosestParameter (pt))
        allIndices = [i for i in range(len(pts))]
        seg_PolyLs = []
        ptIndexSlices = []
        for i in range(len(turningIndex)):
            if i == 0 :
                ptIndexSlices.append(allIndices[0:turningIndex[i]+1])
            elif i != 0 and i!=len(turningIndex)-1:
                ptIndexSlices.append(allIndices[turningIndex[i-1]:turningIndex[i]+1])
            elif i==len(turningIndex)-1:
                ptIndexSlices.append(allIndices[turningIndex[i-1]:])
                
        if len(turningIndex) == 1:
            ptIndexSlices.append(allIndices[turningIndex[i-1]:])


        resamplePoints = []
        
        ### Assign div Number 
        divNumRest = divNum - len(ptIndexSlices)

        polyLs = []
        for sliceIndex in range(len(ptIndexSlices)):
            
            v_PolyL = []
            for index in ptIndexSlices[sliceIndex]:
                v_PolyL.append(pts[index])
                
            polyLs.append(rg.Polyline(v_PolyL))

        lengths = [polyL.Length for polyL in polyLs]
        totalLength = sum(lengths)
        divNums = []
        for i in range(len(lengths)):
            num = int(math.ceil(lengths[i]/totalLength * divNumRest))
            if num == 2:
                num +=1
            divNums.append(num)

        ### Process    
        for sliceIndex in range(len(ptIndexSlices)):

            PolyL = polyLs[sliceIndex]
            rPoints_Temp = OP.DivideEdgeByNumAndClean(PolyL,divNums[sliceIndex],tol)
            
            ### Convert point3d to instances
            
            for rPt in rPoints_Temp:
                currVPMaxID = max(currVP_Dict.keys())
                rPointInstance = PL.ParcResamplePoint(rPt,currVPMaxID+1)

                currVP_Dict[currVPMaxID+1] = rPointInstance
                resamplePoints.append(rPointInstance)
            
            if sliceIndex!= len(ptIndexSlices)-1:
                currVPMaxID = max(currVP_Dict.keys())
                rPointInstance = PL.ParcResamplePoint(pts[turningIndex[sliceIndex]],currVPMaxID+1)
                rPointInstance.turning = True
                currVP_Dict[currVPMaxID+1] = rPointInstance
                resamplePoints.append(rPointInstance)
                
            edge.resamplePoints = resamplePoints

    @staticmethod
    def GetResamplePointsForAllEdges(PL,currVP_Dict,currE_Dict,turningPtCollection,divNum=5,tol = 2):
        E_tPt_Dict = OP.ExtractEdgeTurningPtIndices(turningPtCollection)
        turningEdges = E_tPt_Dict.keys()
        turningEID = []

        for edge in E_tPt_Dict.keys():
            turningEID.append(edge.ID)
            turningEID.append(edge.twinID)

        ### Normal treatment 
        normalTreatmentRecord = []
        for key in currE_Dict.keys():
            currEdge = currE_Dict[key]
            if key not in turningEID and key not in normalTreatmentRecord and currEdge.naked == False:
                normalTreatmentRecord.append(key)
                OP.GetResamplePoints_Normal(PL,currVP_Dict,currEdge,divNum,tol)
                currResamplePoints =  currEdge.resamplePoints
                twinEdge = currE_Dict[currEdge.twinID]
                twinResamplePoints = []
                for rPt in currResamplePoints:
                    twinResamplePoints.append(rPt)
                twinResamplePoints.reverse()
                twinEdge.resamplePoints = twinResamplePoints

                

        for edge in turningEdges:
            
            currEdge = edge
            currTurningPtIndices = E_tPt_Dict[currEdge]
            OP.GetResamplePoints_WithTurningPoints(PL,currVP_Dict,currEdge,currTurningPtIndices,divNum,tol)
            
            currResamplePoints =  currEdge.resamplePoints
            twinEdge = currE_Dict[currEdge.twinID]
            twinResamplePoints = []
            for rPt in currResamplePoints:
                twinResamplePoints.append(rPt)
            twinResamplePoints.reverse()
            twinEdge.resamplePoints = twinResamplePoints

    @staticmethod
    def GetResamplePointsByNum(PL,currVP_Dict,edge,divNum,tol = 1):
        edge_Geo = edge.GetGeometry()
        rebuildEdge = ghc.RebuildCurve(edge_Geo,1,divNum,False)
        
        segs,vertices = ghc.Explode(rebuildEdge,True)
        
        
        for time in range(len(vertices)-1):
            for i in range(len(vertices)-2):
                currPt = vertices[i]
                nextPt = vertices[i+1]
                dist = currPt.DistanceTo(nextPt)
                if dist<tol:
                    vertices.pop(i+1)
                    break
        
        ### check last segment
        lastDist = vertices[-1].DistanceTo(vertices[-2])
        if lastDist < tol and len(vertices) >2:
            vertices.pop(-2)
        

        
        if len(vertices) ==2:
            resamplePoints = []
        else:
            resamplePoints = vertices[1:-1]
        
        for pt in resamplePoints:
            currVPMaxID = max(currVP_Dict.keys())
            newResamplePoint = PL.ParcResamplePoint(pt,currVPMaxID+1)
            currVP_Dict[currVPMaxID+1] = newResamplePoint
            edge.resamplePoints.append(newResamplePoint)
            if edge.naked ==True:
                newResamplePoint.onBoundary = True

    @staticmethod
    def GetResamplePointsByLength(PL,currVP_Dict,edge,divLength,tol = 1):
        edge_Geo = edge.GetGeometry()
        rebuildEdge = ghc.RebuildCurve(edge_Geo,1,divLength,False)
        resamplePoints = []
        if divLength > x.Length:
            
            return resamplePoints
        else:
            vertices,ts,ps = ghc.DivideLength(rebuildEdge,divLength)
            vertices.append(rebuildEdge.Last)

        
        
        for time in range(len(vertices)-1):
            for i in range(len(vertices)-2):
                currPt = vertices[i]
                nextPt = vertices[i+1]
                dist = currPt.DistanceTo(nextPt)
                if dist<tol:
                    vertices.pop(i+1)
                    break
        
        ### check last segment
        lastDist = vertices[-1].DistanceTo(vertices[-2])
        if lastDist < tol and len(vertices) >2:
            vertices.pop(-2)
        

        
        if len(vertices) ==2:
            resamplePoints = []
        else:
            resamplePoints = vertices[1:-1]
        
        for pt in resamplePoints:
            currVPMaxID = max(currVP_Dict.keys())
            newResamplePoint = PL.ParcResamplePoint(pt,currVPMaxID+1)
            currVP_Dict[currVPMaxID+1] = newResamplePoint
            edge.resamplePoints.append(newResamplePoint)
            if edge.naked ==True:
                newResamplePoint.onBoundary = True     

    
    
    ###################################
    ####    Constraint HelpFun     ####
    ################################### 
    @staticmethod 
    def AssignRoadID(roads):
        for i in range(len(roads)):
            roads[i].ID = i
        
            
    
    
    @staticmethod 
    def GetStreetAngleConstraintPair(roads):
        allRoads = []
        #allRoads.extend(originalRoads)
        
        allRoads.extend(roads)
        jvs = []
        
        OP.AssignRoadID(allRoads)
        allVertices = []
        for road in allRoads:
            allVertices.extend(road.GetAllVertexInstance())
        
    
                
        counter = Counter(allVertices)
        junctionVertices = [v for v, count in counter.items() if count >= 2]

       
            
        jvs = [jv.geometry for jv in junctionVertices]
        jVInfoCollection = []
        for jV in junctionVertices:
            thisJVInfo = [jV]  #[jv,[IDs]]
            roadIDs = []
            for road in allRoads:
                thisRoadVertices = road.GetAllVertexInstance()
                if jV in thisRoadVertices:
                    roadIDs.append(road.ID)
                    
            thisJVInfo.append(roadIDs)
            jVInfoCollection.append(thisJVInfo)
            
     
        roadDict = {}
        for road in allRoads:
            roadDict[road.ID] = road
        
        ### Get pairCollection
        pairColllection = []
        for info in jVInfoCollection:
            jV = info[0]
            combs = []

            for comb in combinations(info[1], 2):
                combs.append(comb)
                
            for comb in combs:
                relevantPEs_A =  roadDict[comb[0]].GetRelevantPE(jV)
                relevantPEs_B =  roadDict[comb[1]].GetRelevantPE(jV)
                
                for pE_A in relevantPEs_A:
                    for pE_B in relevantPEs_B:
                        pairColllection.append([pE_A,pE_B,jV])
                
        ### Check the direction of pair
        pairColllection_Check = []
        for pair in pairColllection:
            pE_A = pair[0]
            pE_B = pair[1]
            if pE_A.naked ==True and pE_B.naked ==True:
                continue
            
            commonV = pair[2]
            
            if pE_A.startVertex == commonV:
                if pE_A.resamplePoints!= []:
                    pE_A_Geo = rg.Line( commonV.geometry , pE_A.resamplePoints[0].geometry)
                else:
                    pE_A_Geo = rg.Line( commonV.geometry , pE_A.endVertex.geometry)
                    
            elif pE_A.endVertex == commonV:
                if pE_A.resamplePoints!= []:
                    pE_A_Geo = rg.Line( commonV.geometry, pE_A.resamplePoints[-1].geometry)
                else:
                    pE_A_Geo = rg.Line( commonV.geometry , pE_A.startVertex.geometry)
                    
                    
            if pE_B.startVertex == commonV:
                if pE_B.resamplePoints!= []:
                    pE_B_Geo = rg.Line(commonV.geometry,  pE_B.resamplePoints[0].geometry)
                else:
                    pE_B_Geo = rg.Line( commonV.geometry , pE_B.endVertex.geometry)
            
            elif pE_B.endVertex == commonV:
                if pE_B.resamplePoints!= []:
                    pE_B_Geo = rg.Line( commonV.geometry , pE_B.resamplePoints[-1].geometry)    
                else:
                    pE_B_Geo = rg.Line( commonV.geometry , pE_B.startVertex.geometry)
                    
            if  rm.ToDegrees(rg.Vector3d.VectorAngle(rg.Vector3d(pE_A_Geo.To -pE_A_Geo.From) ,rg.Vector3d(pE_B_Geo.To -pE_B_Geo.From)))  >  135:
                continue 
            
            pairColllection_Check.append([pE_A_Geo,pE_B_Geo])
            
        return pairColllection_Check,jvs
        
            
            
    ###################################
    ####         Kangaroo          ####
    ###################################

    @staticmethod
    def OptimizeToStraightLine(polyL):
        # Make solver system and goals list
        ps = ks.PhysicalSystem()
        goals = List[ks.IGoal]()
        tol = 0.0001 # points closer than this will get combined into a single particle
        ### collect all points 
        allPts = []
        for point in polyL:
            allPts.append(point)
        
        ### collect segements
        segments = polyL.GetSegments()
        
        
        VPAnchor_Constraint = []
        vAnchorStrength = 10000
        #tAnchorStrength = 2
        pAnchorStrength = 0
        
        for i in range(0,len(allPts),1):
            currObj = allPts[i]
            if i == 0 or i == len(allPts)-1:
                VPAnchor_Constraint.append(ks.Goals.Anchor(currObj, vAnchorStrength))

            else:
                VPAnchor_Constraint.append(ks.Goals.Anchor(currObj, pAnchorStrength))
                
        # Segment angle constrain 
        lineA = segments
        lineB = lineA[-1:] + lineA[:-1]
        restAngle = 0
        angleStrength = 2
        
        angle_Constraint = []
        for i in range(len(lineA)):
            angle_Constraint.append(ks.Goals.Angle(lineA[i],lineB[i],restAngle,angleStrength))
            
        # original Length constrain
        originalLength_Constraint = []
        originalLengthStrength = 0.000
        for segment in segments:
            originalLength_Constraint.append(ks.Goals.LengthMultiple(segment.From,segment.To,1,originalLengthStrength))
        
        # Equal Length constrain
        equalLength_Constraint = []
        equalLengthStrength = 10
        segmentsCrv = List[rg.Curve]()
        
        for segment in segments:
            segmentsCrv.Add(segment.ToNurbsCurve())
        equalLength_Constraint.append(ks.Goals.EqualLength(segmentsCrv,equalLengthStrength))
        
        ##### Assign to PhysicalSystem
        allConstraint = []
        
        
        allConstraint.extend(VPAnchor_Constraint)
        allConstraint.extend(angle_Constraint)
        allConstraint.extend(equalLength_Constraint)
        
        
        for g in allConstraint:
            ps.AssignPIndex(g,0.001)
            goals.Add(g)
            
        # Solve zombie style i.e. max N iterations, break when system kinetic energy drops below threshold
        counter = 0
        threshold = 0.001
        #threshold = 1e-10
        while counter < 100:
            ps.Step(goals,True,threshold)
            counter += 1
            #print ps.GetvSum()
            if ps.GetvSum() < threshold:
                break
        
        
        A = ps.GetOutput(goals)
        B = counter
        C = ps.GetPositionArray()
        
        ptList = []
        for pt in C:
            ptList.append(pt)

        return ptList

    @staticmethod
    def OptimizeWithConstraints(copiedParcFace,currE_Dict,allroads):
        ### global info   
        tol = 0.0001
      

        ### Get the optimization subjects _ Simpified
        allPts = []
        for parcEdge in currE_Dict.values():
            if parcEdge.startVertex not in allPts:
                allPts.append(parcEdge.startVertex)

            if parcEdge.endVertex not in allPts:
                allPts.append(parcEdge.endVertex)

        allPts_Geo = []
        for pt in allPts:
            allPts_Geo.append(pt.geometry)
           

        
        ### Get forming Order _ Simpified       
        orderCollection = []    
        for parcFace in copiedParcFace:
            v_Geo = []
            formingOrder = []
            for v in parcFace.vertices:
                index = allPts.index(v)
                formingOrder.append(index)
            
            orderCollection.append(formingOrder)
        
        ### Initialze Solver
        ps = ks.PhysicalSystem()
        goals = List[ks.IGoal]()
        
        ### Strength Control
        vAnchorStrength = 100000
        pAnchorStrength = 1
        areaStrength = 0
        angleStrength = 2000
        parcelAngleStrength = 2000
        
        ### Constraint: Closeness   
        VPAnchor_Constraint = []
        for i in range(len(allPts)):
            currObj = allPts[i]
            
            if currObj.onBoundary == True:
                VPAnchor_Constraint.append(ks.Goals.Anchor(currObj.geometry, vAnchorStrength))

            elif currObj.onBoundary == False:
                VPAnchor_Constraint.append(ks.Goals.Anchor(currObj.geometry, pAnchorStrength))
        
        ### Constraint: Area    
        area_Constraint = []
        idealArea = 70

        for parcFace in copiedParcFace:
            v_Geo = []
            for v in parcFace.vertices:
                index = allPts.index(v)
                v_Geo.append(v.geometry)

            v_Geo = List[rg.Point3d](v_Geo)
            area_Constraint.append(ks.Goals.PolygonArea(v_Geo,idealArea,areaStrength))
       
        ### Constrain: roadAngle   
        roadAngle_Constraint = []
        lowerLimit = 0
        upperLimit = rm.ToRadians(1)
        for polyL in allroads:
            segments = polyL.GetSegments()
            segments_List = [seg for seg in segments]
            lineA = segments_List[:-1]
            lineB =  segments_List[1:] 
            for i in range(len(lineA)):
                roadAngle_Constraint.append(ks.Goals.ClampAngle(lineA[i],lineB[i],upperLimit,lowerLimit,angleStrength))
        




        ### Constrain: parcelAngle
        parcelAngle_Constraint = []
        for parcFace in copiedParcFace:
            edges = parcFace.edges
            for i in range(len(edges)):
                if i != len(edges)-1:
                    currIndex = i
                    nextIndex = i+1
                else:
                    currIndex = i
                    nextIndex = 0
                
                currEdge= edges[currIndex]
                nextEdge = edges[nextIndex]
                
                currEdge_Geo= edges[currIndex].GetGeometry_Simplified() 
                nextEdge_Geo = edges[nextIndex].GetGeometry_Simplified() 
                
                currVec = rg.Vector3d(currEdge_Geo.To - currEdge_Geo.From)
                nextVec = rg.Vector3d(nextEdge_Geo.To - nextEdge_Geo.From)

                angle = rm.ToDegrees(rg.Vector3d.VectorAngle(currVec,nextVec))

                if currEdge.naked ==True and nextEdge.naked ==True:
                    pass
                
                else:
                    if angle>=0 and angle<30:
                        parcelAngle_Constraint.append(ks.Goals.Angle(currEdge_Geo,nextEdge_Geo,0,parcelAngleStrength))
                    elif angle >= 60 and angle <=120:
                        parcelAngle_Constraint.append(ks.Goals.Angle(currEdge_Geo,nextEdge_Geo,rm.ToRadians(90),parcelAngleStrength))



        ##### Assign to PhysicalSystem
        allConstraint = []
        allConstraint.extend(VPAnchor_Constraint)
        allConstraint.extend(area_Constraint)
        allConstraint.extend(roadAngle_Constraint)
        allConstraint.extend(parcelAngle_Constraint)

        for g in allConstraint:
            ps.AssignPIndex(g,0.001)
            goals.Add(g)




        ##### Save previous result
        oldParcels = []
        for order in orderCollection:
            vs =[]
            for index in order:
                vs.append(allPts[index].geometry)
            vs.append(vs[0])
            oldParcels.append(rg.Polyline(vs))
            
        ##### Solve
        counter = 0
        threshold = 0.001
        #threshold = 1e-10
        while counter < 100:
            ps.Step(goals,True,threshold)
            counter += 1
            #print ps.GetvSum()
            if ps.GetvSum() < threshold:
                break

        A = ps.GetOutput(goals)
        B = counter
        C = ps.GetPositionArray()

        ptList = []
        for pt in C:
            ptList.append(pt)


        ##### Get the final Result preview   
        newParcels = []
        for order in orderCollection:
            vs =[]
            for index in order:
                vs.append(ptList[index])
            vs.append(vs[0])
            newParcels.append(rg.Polyline(vs))

   
        
        return newParcels, oldParcels
            

    @staticmethod
    def OptimizeWithConstraints_TurningPoints(copiedParcFace,roads,inputPolyline):
        oldRoads = [road.GetGeometry_SimplifiedWithTurningPoints() for road in roads]
        
        ### global info   
        tol = 0.0001
      

        ### Get the optimization subjects _ TurningPoints
        allPts = []
        for parcF in copiedParcFace:
            
            for parcEdge in parcF.edges:
   
                if parcEdge.startVertex not in allPts:
                    allPts.append(parcEdge.startVertex)

                for tPt in parcEdge.turningPoints: 
                    if tPt not in allPts:
                        allPts.append(tPt)
                    
                if parcEdge.endVertex not in allPts:
                    allPts.append(parcEdge.endVertex)

        
     
        allPts_Geo = []
        for pt in allPts:
            allPts_Geo.append(pt.geometry)
           
        
        
        ### Get forming Order _ TurningPoints _Parcel      
        orderCollection = []    
        for parcFace in copiedParcFace:
          
            formingOrder = []
            allInstances = parcFace.GetVPInstance_SimplifiedWithTurningPoints()
            allInstances.append(allInstances[0])

                
            for v in allInstances:
                index = allPts.index(v)
                formingOrder.append(index)
            
  
                
            orderCollection.append(formingOrder)
        
        ### Get forming Order _ TurningPoints _Road      
        orderCollection_Road = []    
        for road in roads:
         
            formingOrder_Road = []
            allInstances = road.GetAllVPInstance_TurningPoints()
            for v in allInstances:
                index = allPts.index(v)
                formingOrder_Road.append(index)
            
            orderCollection_Road.append(formingOrder_Road)
        
        
        ### Initialze Solver
        ps = ks.PhysicalSystem()
        goals = List[ks.IGoal]()
        
        ### Strength Control
        vAnchorStrength = 100000   #fix the original position of those vertices on the boundary
        vOnCrvStrength = 100000   #keep those vertices on boundary
        pAnchorStrength = 5000     #fix the original position of non-boundary vertices on 
        areaStrength = 0        #force the polygon  to meet area target
        roadSmoothStrength = 150000  # treat each segment , the degree < upperLimit
        upperLimit = rm.ToRadians(0)
        parcelAngleStrength = 0  # treat each segment , the degree is either 0 or 90 
        
        #### not in use
        lengthFactor = 0
        angleFactor = 0
        axialStrength = 0
        bendStrength = 0

        ### Constraint: Closeness   
        VPAnchor_Constraint = []
        for i in range(len(allPts)):
            currObj = allPts[i]
            
            if currObj.onBoundary == True:
                VPAnchor_Constraint.append(ks.Goals.Anchor(currObj.geometry, vAnchorStrength))

            elif currObj.onBoundary == False:
                VPAnchor_Constraint.append(ks.Goals.Anchor(currObj.geometry, pAnchorStrength))
        
        ### Constraint: vOnCrvStrength
        vOnCrv_Constraint = []
        boundaryV = List[rg.Point3d]()
        for i in range(len(allPts)):
            currObj = allPts[i]
            if currObj.onBoundary == True:
                boundaryV.Add(currObj.geometry)
        
        vOnCrv_Constraint.append(ks.Goals.OnCurve(boundaryV,inputPolyline.ToPolylineCurve(),vOnCrvStrength))    
        
        ### Constraint: Area    
        area_Constraint = []
        idealArea = 70

        for parcFace in copiedParcFace:
            allInstances = parcFace.GetVPInstance_SimplifiedWithTurningPoints()
            allInstances.append(allInstances[0])
            v_Geo = List[rg.Point3d]()
            for v in allInstances:
                index = allPts.index(v)
                v_Geo.Add(v.geometry)

            area_Constraint.append(ks.Goals.PolygonArea(v_Geo,idealArea,areaStrength))
        
        ### Constrain: roadABend
        bend_Constraint = []

        for polyL in oldRoads:
        
            segCount = polyL.SegmentCount
    
            for i in range(segCount):
                if i == 0:
                    bend_Constraint.append(ks.Goals.Anchor(polyL.First,10000))
                if i == segCount - 1: 
                    bend_Constraint.append(ks.Goals.Anchor(polyL.Last,10000))
                    
                line = polyL.SegmentAt(i)
                bend_Constraint.append(ks.Goals.Spring(line,line.Length*lengthFactor,axialStrength))


            for j in range(segCount-1):
                currLine = polyL.SegmentAt(j)
                nextLine = polyL.SegmentAt(j+1)
                angle = rg.Vector3d.VectorAngle(currLine.Direction,nextLine.Direction)
                bend_Constraint.append(ks.Goals.Angle2(currLine,nextLine,angle * angleFactor,bendStrength))

        
        ### Constrain: roadAngle   
        roadAngle_Constraint = []
        lowerLimit = 0
        
        for polyL in oldRoads:
            segments = polyL.GetSegments()
            segments_List = [seg for seg in segments]
            lineA = segments_List[:-1]
            lineB =  segments_List[1:] 
            for i in range(len(lineA)):
                roadAngle_Constraint.append(ks.Goals.ClampAngle(lineA[i],lineB[i],upperLimit,lowerLimit,roadSmoothStrength))
        
        ### Constrain: parcelAngle_Every Vertices

        parcelAngle_Constraint = []
        for parcFace in copiedParcFace:
            edges = parcFace.edges
            for i in range(len(edges)):
                if i != len(edges)-1:
                    currIndex = i
                    nextIndex = i+1
                else:
                    currIndex = i
                    nextIndex = 0
                
                currEdge = edges[currIndex]
                nextEdge = edges[nextIndex]
                
                if currEdge.naked ==True and nextEdge.naked ==True:
                    pass
                
                else:
                    currEdge_Geo= currEdge.GetGeometry_SimplifiedWithTurningPoints() 
                    nextEdge_Geo = nextEdge.GetGeometry_SimplifiedWithTurningPoints()
                    currSegs = currEdge_Geo.GetSegments()
                    nextSegs = nextEdge_Geo.GetSegments()
                    for i in range(len(currSegs)-1):
                        currSeg = currSegs[i]
                        nextSeg = currSegs[i+1]
                        currVec = rg.Vector3d(currSeg.To - currSeg.From)
                        nextVec = rg.Vector3d(nextSeg.To - nextSeg.From)

                        angle = rm.ToDegrees(rg.Vector3d.VectorAngle(currVec,nextVec))

                        if angle>=0 and angle<30:
                            parcelAngle_Constraint.append(ks.Goals.Angle(currSeg,nextSeg,0,parcelAngleStrength))
                        elif angle >= 60 and angle <=120:
                            parcelAngle_Constraint.append(ks.Goals.Angle(currSeg,nextSeg,rm.ToRadians(90),parcelAngleStrength))

                    currSegs_Last = currSegs[len(currSegs)-1]
                    nextSegs_First = nextSegs[0]
                    currVec = rg.Vector3d(currSegs_Last.To - currSegs_Last.From)
                    nextVec = rg.Vector3d(nextSegs_First.To - nextSegs_First.From)

                    angle = rm.ToDegrees(rg.Vector3d.VectorAngle(currVec,nextVec))

                    if angle>=0 and angle<30:
                        parcelAngle_Constraint.append(ks.Goals.Angle(currSegs_Last,nextSegs_First,0,parcelAngleStrength))
                    elif angle >= 60 and angle <=120:
                        parcelAngle_Constraint.append(ks.Goals.Angle(currSegs_Last,nextSegs_First,rm.ToRadians(90),parcelAngleStrength))

        
        ### Constrain: parcelAngle_ Only Corner

        # parcelAngle_Constraint = []
        # for parcFace in copiedParcFace:
        #     edges = parcFace.edges
        #     for i in range(len(edges)):
        #         if i != len(edges)-1:
        #             currIndex = i
        #             nextIndex = i+1
        #         else:
        #             currIndex = i
        #             nextIndex = 0
                
        #         currEdge = edges[currIndex]
        #         nextEdge = edges[nextIndex]
                
        #         if currEdge.naked ==True and nextEdge.naked ==True:
        #             pass
                
        #         else:
        #             currEdge_Geo= currEdge.GetGeometry_SimplifiedWithResamplePoints() 
        #             nextEdge_Geo = nextEdge.GetGeometry_SimplifiedWithResamplePoints()
        #             currSegs = currEdge_Geo.GetSegments()
        #             nextSegs = nextEdge_Geo.GetSegments()
        #             currSegs_Last = currSegs[len(currSegs)-1]
        #             nextSegs_First = currSegs[0]
        #             currVec = rg.Vector3d(currSegs_Last.To - currSegs_Last.From)
        #             nextVec = rg.Vector3d(nextSegs_First.To - nextSegs_First.From)

        #             angle = rm.ToDegrees(rg.Vector3d.VectorAngle(currVec,nextVec))

        #             if angle>=0 and angle<30:
        #                 parcelAngle_Constraint.append(ks.Goals.Angle(currSegs_Last,nextSegs_First,0,parcelAngleStrength))
        #             elif angle >= 60 and angle <=120:
        #                 parcelAngle_Constraint.append(ks.Goals.Angle(currSegs_Last,nextSegs_First,rm.ToRadians(90),parcelAngleStrength))

        ##### Assign to PhysicalSystem
        allConstraint = []
        allConstraint.extend(VPAnchor_Constraint)
        allConstraint.extend(vOnCrv_Constraint)
        allConstraint.extend(area_Constraint)
        allConstraint.extend(roadAngle_Constraint)
        allConstraint.extend(parcelAngle_Constraint)
        allConstraint.extend(bend_Constraint)
        

        for g in allConstraint:
            ps.AssignPIndex(g,0.001)
            goals.Add(g)




        ##### Save previous result
        oldParcels = []
        for order in orderCollection:
            vs =[]
            for index in order:
                vs.append(allPts[index].geometry)
            vs.append(vs[0])
            oldParcels.append(rg.Polyline(vs))
            
        ##### Solve
        counter = 0
        threshold = 0.00001
        #threshold = 1e-10
        while counter < 100:
            ps.Step(goals,True,threshold)
            counter += 1
            #print ps.GetvSum()
            if ps.GetvSum() < threshold:
                break
            
        print   ("counter")      ,counter
        A = ps.GetOutput(goals)
        B = counter
        C = ps.GetPositionArray()

        ptList = []
        for pt in C:
            ptList.append(pt)

        ##### Get the final Result preview   
        newParcels = []
        for order in orderCollection:
            vs =[]
            for index in order:
                vs.append(ptList[index])
            vs.append(vs[0])
            newParcels.append(rg.Polyline(vs))

        ##### Get the final Result preview _Road  
        newRoads = []
        for order in orderCollection_Road:
            vs =[]
            for index in order:
                vs.append(ptList[index])
            
            newRoads.append(rg.Polyline(vs))

        
        return newParcels,oldParcels,newRoads,oldRoads

   
    @staticmethod
    def OptimizeWithConstraints_Resample(GRP,copiedParcFace,roads,inputPolyline,EDict,constraints):
        
        
        
        oldRoads = [road.GetGeometry_SimplifiedWithResamplePoints() for road in roads]
        
        ### global info   
        tol = 0.0001
      

        ### Get the optimization subjects _ Resample
        allPts = []
        for parcF in copiedParcFace:
            
            for parcEdge in parcF.edges:
   
                if parcEdge.startVertex not in allPts:
                    allPts.append(parcEdge.startVertex)

                for rPt in parcEdge.resamplePoints:
                    if rPt not in allPts:
                        allPts.append(rPt)
                    
                if parcEdge.endVertex not in allPts:
                    allPts.append(parcEdge.endVertex)

        
        
        allPts_Geo = []
        for pt in allPts:
            allPts_Geo.append(pt.geometry)
           
        
        
        ### Get forming Order _ Resample _Parcel      
        orderCollection = []    
        for parcFace in copiedParcFace:
          
            formingOrder = []
            allInstances = parcFace.GetVPInstance_SimplifiedWithResamplePoints()
            allInstances.append(allInstances[0])

            for v in allInstances:
                index = allPts.index(v)
                formingOrder.append(index)
            

                
            orderCollection.append(formingOrder)
        
        #### Temp solution
        allPtsIDDict = {}
        for pt in allPts:
            allPtsIDDict[pt.ID] = pt
        
        ### Get forming Order _ Resample _Road     
        orderCollection_Road = []  
        
          
        for road in roads:
        
            formingOrder_Road = []
            allInstances = road.GetAllVPInstance_Resample()
            for v in allInstances:
                
                
                index = allPts.index(allPtsIDDict[v.ID])
                formingOrder_Road.append(index)
            
            orderCollection_Road.append(formingOrder_Road)
        
        
        ### Initialze Solver
        ps = ks.PhysicalSystem()
        goals = List[ks.IGoal]()
        
        ### Strength Control
        
        vAnchorStrength = constraints[0]  #fix the original position of those vertices on the boundary
        vOnCrvStrength = constraints[1]   #keep those vertices on boundary
        pAnchorStrength = constraints[2]     #fix the original position of non-boundary vertices on 
        
        roadSmoothStrength = constraints[3]  # treat each segment , the degree < upperLimit
        upperLimit = rm.ToRadians(0)
        roadJunctionAngleStrength = constraints[4]
        
        parcelSideSmoothStrength = constraints[5]
        parcelSideAngleStrength = constraints[6]
        parcelSideLengthStrength = constraints[7]
        #parcelSideSimLengthStrength = constraints[8]
        
        parcelAdjacencyStrength = constraints[8]
        
        
        ##########
        
        #region Constraint: Closeness
        VPAnchor_Constraint = []
        for i in range(len(allPts)):
            currObj = allPts[i]
            
            if currObj.onBoundary == True:
                VPAnchor_Constraint.append(ks.Goals.Anchor(currObj.geometry, vAnchorStrength))

            elif currObj.onBoundary == False:
                VPAnchor_Constraint.append(ks.Goals.Anchor(currObj.geometry, pAnchorStrength))

        #endregion
        
        #region Constraint: vOnCrvStrength
        vOnCrv_Constraint = []
        boundaryV = List[rg.Point3d]()
        for i in range(len(allPts)):
            currObj = allPts[i]
            if currObj.onBoundary == True:
                boundaryV.Add(currObj.geometry)
        
        vOnCrv_Constraint.append(ks.Goals.OnCurve(boundaryV,inputPolyline.ToPolylineCurve(),vOnCrvStrength))    
        #endregion
        
        #region Constrain: roadAngle   
        roadAngle_Constraint = []
        lowerLimit = 0
        
        for polyL in oldRoads:
            segments = polyL.GetSegments()
            segments_List = [seg for seg in segments]
            lineA = segments_List[:-1]
            lineB =  segments_List[1:] 
            for i in range(len(lineA)):
                roadAngle_Constraint.append(ks.Goals.ClampAngle(lineA[i],lineB[i],upperLimit,lowerLimit,roadSmoothStrength))
        #endregion

        #region Constrain: roadJunctionAngle
        pairColllection, jvs = OP.GetStreetAngleConstraintPair(roads)
        roadJunctionAngle_Constraint = []
        for pair in pairColllection:
            lineA = rg.Line(pair[0].To,pair[0].From)
            lineB = pair[1]
            roadJunctionAngle_Constraint.append(ks.Goals.Angle(lineA,lineB,rm.ToRadians(90),roadJunctionAngleStrength))
        #endregion
        
        ##########
  
        
        #region Constrain: parcelSideSmooth
        parcelSideSmooth_Constraint = []
        for parcFace in copiedParcFace:
            # if len(parcFace.sides) == 3:
            #     continue
            for side in parcFace.sides:
                if EDict[side[0]].naked ==True:
                    continue
                else:
                    pEs = [EDict[edgeIndex] for edgeIndex in side]
                    thisSidePts = []
                    for pE in pEs:
                        thisSidePts.append(pE.startVertex.geometry)
                        for rPt in pE.resamplePoints:
                            thisSidePts.append(rPt.geometry)
                    
                    thisSidePts.append(pE.endVertex.geometry)
                   
                    thisSideGeometry = rg.Polyline(thisSidePts)
                    
                    
                    thisSegments =  thisSideGeometry.GetSegments()
                    
                    
                    for i in range(len(thisSegments)-1):
                        currSeg = thisSegments[i]
                        nextSeg = thisSegments[i+1]
                        # currVec = rg.Vector3d(currSeg.To - currSeg.From)
                        # nextVec = rg.Vector3d(nextSeg.To - nextSeg.From)

                        parcelSideSmooth_Constraint.append(ks.Goals.Angle(currSeg,nextSeg,rm.ToRadians(0),parcelSideSmoothStrength))

        #endregion
        
        #region Constrain: parcelSideAngle  
        parcelSideAngle_Constraint = []
        for parcFace in copiedParcFace:
            # if len(parcFace.sides) <= 3:
            #     print "tri ID" ,parcFace.ID
            #     continue
            idealAngle = (len(parcFace.sides)-2)*180 / len(parcFace.sides)
            for i in range(len(parcFace.sides)-1):
                currSide = parcFace.sides[i]
                nextSide =parcFace.sides[i+1]
                
                if EDict[currSide[0]].naked ==True or EDict[nextSide[0]].naked ==True:
                    continue
                
                else:
                    pEs = [EDict[edgeIndex] for edgeIndex in currSide]
                    currSidePts = []
                    for pE in pEs:
                        currSidePts.append(pE.startVertex.geometry)
                        for rPt in pE.resamplePoints:
                            currSidePts.append(rPt.geometry)
                        
                        currSidePts.append(pE.endVertex.geometry)
                        
                    currSideGeometry = rg.Polyline(currSidePts)  
                    currSegs = currSideGeometry.GetSegments()
                    
                    pEs = [EDict[edgeIndex] for edgeIndex in nextSide]
                    nextSidePts = []
                    for pE in pEs:
                        nextSidePts.append(pE.startVertex.geometry)
                        for rPt in pE.resamplePoints:
                            nextSidePts.append(rPt.geometry)
                            
                        nextSidePts.append(pE.endVertex.geometry)
                        
                    nextSideGeometry = rg.Polyline(nextSidePts)  
                    nextSegs = nextSideGeometry.GetSegments()
                    
                    currSegs_Last = currSegs[len(currSegs)-1]
                    nextSegs_First = nextSegs[0]
                    # currVec = rg.Vector3d(currSegs_Last.To - currSegs_Last.From)
                    # nextVec = rg.Vector3d(nextSegs_First.To - nextSegs_First.From)

    
                    parcelSideAngle_Constraint.append(ks.Goals.Angle(currSegs_Last,nextSegs_First,rm.ToRadians(idealAngle),parcelSideAngleStrength))
                    
            ### the last 
            currSide = parcFace.sides[len(parcFace.sides)-1]
            nextSide =parcFace.sides[0]      
            if EDict[currSide[0]].naked ==True or EDict[nextSide[0]].naked ==True:
                    continue
                
            else:
                pEs = [EDict[edgeIndex] for edgeIndex in currSide]
                currSidePts = []
                for pE in pEs:
                    currSidePts.append(pE.startVertex.geometry)
                    for rPt in pE.resamplePoints:
                        currSidePts.append(rPt.geometry)
                    currSidePts.append(pE.endVertex.geometry)
                    
                currSideGeometry = rg.Polyline(currSidePts)  
                currSegs = currSideGeometry.GetSegments()
                
                pEs = [EDict[edgeIndex] for edgeIndex in nextSide]
                nextSidePts = []
                for pE in pEs:
                    nextSidePts.append(pE.startVertex.geometry)
                    for rPt in pE.resamplePoints:
                        nextSidePts.append(rPt.geometry)
                    nextSidePts.append(pE.endVertex.geometry)
                nextSideGeometry = rg.Polyline(nextSidePts)  
                nextSegs = nextSideGeometry.GetSegments()
                
                currSegs_Last = currSegs[len(currSegs)-1]
                nextSegs_First = nextSegs[0]
                # currVec = rg.Vector3d(currSegs_Last.To - currSegs_Last.From)
                # nextVec = rg.Vector3d(nextSegs_First.To - nextSegs_First.From)


                parcelSideAngle_Constraint.append(ks.Goals.Angle(currSegs_Last,nextSegs_First,rm.ToRadians(idealAngle),parcelSideAngleStrength))
        
        #endregion 

        #region Constrain: parcelSideLength
        parcelSideLength_Constraint = []
        for parcFace in copiedParcFace:
            ### Get the ideal side length
            resampleSides = parcFace.GetSideGeometry_Resample()
            sumLength = 0
            for rSide in resampleSides:
                sumLength += rSide.Length
            idealLength = sumLength/len(parcFace.sides)
            
            ### ideal length for each segment by percentage
            for rSide in resampleSides:
                for segment in rSide.GetSegments():
                    idealSegmentLength = idealLength/rSide.SegmentCount
                    parcelSideLength_Constraint.append(ks.Goals.Spring(segment,idealSegmentLength,parcelSideLengthStrength))
        #endregion    
        
#        #region Constrain: parcelSideSimLength
#        parcelSideSimLength_Constraint = []
#        for parcFace in copiedParcFace:
#            ### Get the ideal side length
#            resampleSides = parcFace.GetSideGeometry_Resample()
#            sumLength = 0
#            
#            for rSide in resampleSides:
#                sumLength += rSide.Length
#                
#            idealSimSizeLength =  sumLength/len(parcFace.sides)
#            
#            ### ideal length for each segment by percentage
#            for rSide in resampleSides:
#                parcelSideSimLength_Constraint.append(ks.Goals.Spring(rg.Line(rSide.First,rSide.Last),idealSimSizeLength,parcelSideSimLengthStrength))
#                
#        #endregion    
                
        #region Constrain: parcelAdjacencyStrength
        parcelAdjacency_Constraint = []
        currJunctionGraph = GRP.JunctionGraph.CreateJunctionGraphForThisDepth(EDict)
        currParcEdgeGraph = GRP.ParcEdgeGraph.CreateParcEdgeGraphForThisDepth(currJunctionGraph) 

        for thisPE in currParcEdgeGraph.graph.keys():
            nbEdges = currParcEdgeGraph.graph[thisPE]

            for nbEdge in nbEdges:

                if thisPE.startVertex.geometry == nbEdge.startVertex.geometry or thisPE.endVertex.geometry == nbEdge.startVertex.geometry:
                    commonPt = nbEdge.startVertex.geometry
                elif thisPE.startVertex.geometry == nbEdge.endVertex.geometry or thisPE.endVertex.geometry == nbEdge.endVertex.geometry:
                    commonPt = nbEdge.endVertex.geometry
                
                if commonPt == thisPE.startVertex.geometry:
                    if thisPE.resamplePoints!=[]:
                        nextPEpt = thisPE.resamplePoints[0].geometry
                    else:
                        
                        nextPEpt = thisPE.endVertex.geometry
                elif commonPt == thisPE.endVertex.geometry:
                    if thisPE.resamplePoints!=[]:
                        nextPEpt = thisPE.resamplePoints[-1].geometry
                    else:
                        
                        nextPEpt = thisPE.endVertex.geometry
                
                    
                if commonPt == nbEdge.startVertex.geometry:
                    if nbEdge.resamplePoints!=[]:
                        nextNBpt = nbEdge.resamplePoints[0].geometry
                    else:
                        
                        nextNBpt = nbEdge.endVertex.geometry
                elif commonPt == nbEdge.endVertex.geometry:
                    if nbEdge.resamplePoints!=[]:
                        nextNBpt = nbEdge.resamplePoints[-1].geometry
                    else:
                        
                        nextNBpt = nbEdge.startVertex.geometry
                    
                lineA = rg.Line(nextPEpt,commonPt)
                lineB = rg.Line(commonPt,nextNBpt)
                
                vecA = rg.Vector3d(commonPt-nextPEpt)
                vecB = rg.Vector3d(nextNBpt-commonPt)
                angle = rg.Vector3d.VectorAngle(vecA,vecB)
                angle_Degree = rm.ToDegrees(angle)
                if angle_Degree>=0 and angle_Degree<30:
                    parcelAdjacency_Constraint.append(ks.Goals.Angle(lineA,lineB,rm.ToRadians(0),parcelAdjacencyStrength))
                elif angle_Degree>=60 and angle_Degree<=120:
                    parcelAdjacency_Constraint.append(ks.Goals.Angle(lineA,lineB,rm.ToRadians(90),parcelAdjacencyStrength))

               
        #endregion
        
        ##### Assign to PhysicalSystem
        allConstraint = []
        allConstraint.extend(VPAnchor_Constraint)
        allConstraint.extend(vOnCrv_Constraint)
      
        allConstraint.extend(roadAngle_Constraint)
        allConstraint.extend(roadJunctionAngle_Constraint)
        
        allConstraint.extend(parcelSideSmooth_Constraint)
        allConstraint.extend(parcelSideAngle_Constraint)
        allConstraint.extend(parcelSideLength_Constraint)
        #allConstraint.extend(parcelSideSimLength_Constraint)
        
        allConstraint.extend(parcelAdjacency_Constraint)
        

        for g in allConstraint:
            ps.AssignPIndex(g,0.001)
            goals.Add(g)




        ##### Save previous result
        oldParcels = []
        for order in orderCollection:
            vs =[]
            for index in order:
                vs.append(allPts[index].geometry)
            vs.append(vs[0])
            oldParcels.append(rg.Polyline(vs))
            
        ##### Solve
        counter = 0
        threshold = 0.0000001
        #threshold = 1e-10
        while counter < 1000:
            ps.Step(goals,True,threshold)
            counter += 1
            #print ps.GetvSum()
            if ps.GetvSum() < threshold:
                break
            
        print("counter"),counter
        A = ps.GetOutput(goals)
        B = counter
        C = ps.GetPositionArray()

        ptList = []
        for pt in C:
            ptList.append(pt)

        ##### Get the final Result preview _Road  
        newRoads = []
        for order in orderCollection_Road:
            vs =[]
            for index in order:
                vs.append(ptList[index])
            
            newRoads.append(rg.Polyline(vs))
            
        ##### Get the final Result preview   
        
        newParcels = []
        for order in orderCollection:
            vs =[]
            for index in order:
                vs.append(ptList[index])
            vs.append(vs[0])
            newParcels.append(rg.Polyline(vs))



        ##### this is to refer to the optimized geometry and do data analysis
        ptDict_New = {}
        ptDict_Old = {}
        #for instance in allInstances:
        
        #print "len(allPts) ",len(allPts)  
        #print "len(ptList) ",len(ptList)  
        
        for i in range(len(allPts)):
            thisInstance = allPts[i]
            ptDict_New[thisInstance.ID] = ptList[i] 
            ptDict_Old[thisInstance.ID] = thisInstance.geometry
            
        return newParcels,oldParcels,newRoads,oldRoads,ptDict_New,ptDict_Old #ptDict,orderCollection,orderCollection_Road
    
    @staticmethod
    def OptimizeWithConstraints_Simplified(GRP,copiedParcFace,roads,inputPolyline,EDict,constraints):
        oldRoads = [road.GetGeometry_Simplified() for road in roads]
        
        ### global info   
        tol = 0.0001
    

        ### Get the optimization subjects_Simplified
        allPts = []
        for parcF in copiedParcFace:
            
            for parcEdge in parcF.edges:

                if parcEdge.startVertex not in allPts:
                    allPts.append(parcEdge.startVertex)

                if parcEdge.endVertex not in allPts:
                    allPts.append(parcEdge.endVertex)

        
    
        allPts_Geo = []
        for pt in allPts:
            allPts_Geo.append(pt.geometry)
        
        
        
        ### Get forming Order _Simplified _Parcel      
        orderCollection = []    
        for parcFace in copiedParcFace:
        
            formingOrder = []
            allInstances = parcFace.GetVPInstance_Simplified()
            allInstances.append(allInstances[0])
        
            for v in allInstances:
                index = allPts.index(v)
                formingOrder.append(index)
        
                
            orderCollection.append(formingOrder)
        
        # ### Get forming Order Resample _Parcel 
        # pFSideDataColletion = []
        # for parcFace in copiedParcFace:
            
        #     thisPFInfo = [parcFace]
        #     thisPFSideInfo = []
        #     for side in parcFace.sides:
        #         thisSidePEs = []
        #         for edgeIndex in side:
        #             for edge in parcFace.edges:
        #                 if edgeIndex == edge.ID:
        #                     thisSidePEs.append(edge)
                
        #         thisSidePtIndices =[]
        #         for pE in thisSidePEs:
        #             thisSidePtIndices.append(allPts.index(pE.startVertex))
        #             for rPt in pE.resamplePoints:
        #                 thisSidePtIndices.append(allPts.index(rPt))
                    
        #         thisSidePtIndices.append(allPts.index(thisSidePEs[-1].endVertex))
        #         thisPFSideInfo.append(thisSidePtIndices)
        #     thisPFInfo.append(thisPFSideInfo)
        #     pFSideDataColletion.append(thisPFInfo)
        
        ### Get forming Order Simpified _Parcel 
        pFSideDataColletion = []
        for parcFace in copiedParcFace:
            
            thisPFInfo = [parcFace]
            thisPFSideInfo = []
            for side in parcFace.sides:
                thisSidePEs = []
                for edgeIndex in side:
                    for edge in parcFace.edges:
                        if edgeIndex == edge.ID:
                            thisSidePEs.append(edge)
                
                thisSidePtIndices =[]
                for pE in thisSidePEs:
                    thisSidePtIndices.append(allPts.index(pE.startVertex))

                thisSidePtIndices.append(allPts.index(thisSidePEs[-1].endVertex))
                thisPFSideInfo.append(thisSidePtIndices)
            thisPFInfo.append(thisPFSideInfo)
            pFSideDataColletion.append(thisPFInfo)
                
        #### Temp solution
        allPtsIDDict = {}
        for pt in allPts:
            allPtsIDDict[pt.ID] = pt
        
        ### Get forming Order _Simplifiede _Road      
        orderCollection_Road = []    
        for road in roads:
        
            formingOrder_Road = []
            allInstances = road.GetAllVPInstance_Simplified()
            for v in allInstances:
                index = allPts.index(allPtsIDDict[v.ID])
                formingOrder_Road.append(index)
            
            orderCollection_Road.append(formingOrder_Road)
        
        
        ### Initialze Solver
        ps = ks.PhysicalSystem()
        goals = List[ks.IGoal]()
        
        ### Strength Control
        vAnchorStrength = constraints[0]  #fix the original position of those vertices on the boundary
        vOnCrvStrength = constraints[1]   #keep those vertices on boundary
        pAnchorStrength = constraints[2]     #fix the original position of non-boundary vertices on 
        
        roadSmoothStrength = constraints[3]  # treat each segment , the degree < upperLimit
        upperLimit = rm.ToRadians(0)
        roadJunctionAngleStrength = constraints[4]
        
        parcelSideSmoothStrength = constraints[5]
        parcelSideAngleStrength = constraints[6]
        parcelSideLengthStrength = constraints[7]
        parcelSideSimLengthStrength = constraints[8]
        
        parcelAdjacencyStrength = constraints[9]
        
        ##########
        
        #region Constraint: Closeness
        ### Constraint: Closeness   
        VPAnchor_Constraint = []
        for i in range(len(allPts)):
            currObj = allPts[i]
            
            if currObj.onBoundary == True:
                VPAnchor_Constraint.append(ks.Goals.Anchor(currObj.geometry, vAnchorStrength))

            elif currObj.onBoundary == False:
                VPAnchor_Constraint.append(ks.Goals.Anchor(currObj.geometry, pAnchorStrength))
        
        #endregion
        
        #region Constraint: vOnCrvStrength
        vOnCrv_Constraint = []
        boundaryV = List[rg.Point3d]()
        for i in range(len(allPts)):
            currObj = allPts[i]
            if currObj.onBoundary == True:
                boundaryV.Add(currObj.geometry)
        
        vOnCrv_Constraint.append(ks.Goals.OnCurve(boundaryV,inputPolyline.ToPolylineCurve(),vOnCrvStrength))    
        #endregion

        #region Constrain: roadAngle   
        roadAngle_Constraint = []
        lowerLimit = 0
        
        for polyL in oldRoads:
            segments = polyL.GetSegments()
            segments_List = [seg for seg in segments]
            lineA = segments_List[:-1]
            lineB =  segments_List[1:] 
            for i in range(len(lineA)):
                roadAngle_Constraint.append(ks.Goals.ClampAngle(lineA[i],lineB[i],upperLimit,lowerLimit,roadSmoothStrength))
        #endregion
        
        #region Constrain: roadJunctionAngle
        pairColllection, jvs = OP.GetStreetAngleConstraintPair(roads)
        roadJunctionAngle_Constraint = []
        for pair in pairColllection:
            lineA = rg.Line(pair[0].To,pair[0].From)
            lineB = pair[1]
            roadJunctionAngle_Constraint.append(ks.Goals.Angle(lineA,lineB,rm.ToRadians(90),roadJunctionAngleStrength))
        #endregion

        #region Constrain: parcelSideSmooth
        parcelSideSmooth_Constraint = []
        for parcFace in copiedParcFace:
            # if len(parcFace.sides) == 3:
            #     continue
            for side in parcFace.sides:
                if EDict[side[0]].naked ==True:
                    continue
                else:
                    pEs = [EDict[edgeIndex] for edgeIndex in side]
                    thisSidePts = []
                    for pE in pEs:
                        thisSidePts.append(pE.startVertex.geometry)

                    thisSidePts.append(pE.endVertex.geometry)
                
                    thisSideGeometry = rg.Polyline(thisSidePts)
                    
                    
                    thisSegments =  thisSideGeometry.GetSegments()
                    
                    if len(thisSegments) == 1:
                        continue
                    else:
                        for i in range(len(thisSegments)-1):
                            currSeg = thisSegments[i]
                            nextSeg = thisSegments[i+1]
                            # currVec = rg.Vector3d(currSeg.To - currSeg.From)
                            # nextVec = rg.Vector3d(nextSeg.To - nextSeg.From)

                            parcelSideSmooth_Constraint.append(ks.Goals.Angle(currSeg,nextSeg,rm.ToRadians(0),parcelSideSmoothStrength))

        #endregion
        
        #region Constrain: parcelSideAngle  
        parcelSideAngle_Constraint = []
        for parcFace in copiedParcFace:
            # if len(parcFace.sides) <= 3:
            #     print "tri ID" ,parcFace.ID
            #     continue
            idealAngle = (len(parcFace.sides)-2)*180 / len(parcFace.sides)
            for i in range(len(parcFace.sides)-1):
                currSide = parcFace.sides[i]
                nextSide =parcFace.sides[i+1]
                
                if EDict[currSide[0]].naked ==True or EDict[nextSide[0]].naked ==True:
                    continue
                
                else:
                    pEs = [EDict[edgeIndex] for edgeIndex in currSide]
                    currSidePts = []
                    for pE in pEs:
                        currSidePts.append(pE.startVertex.geometry)
                        currSidePts.append(pE.endVertex.geometry)
                        
                    currSideGeometry = rg.Polyline(currSidePts)  
                    currSegs = currSideGeometry.GetSegments()
                    
                    pEs = [EDict[edgeIndex] for edgeIndex in nextSide]
                    nextSidePts = []
                    for pE in pEs:
                        nextSidePts.append(pE.startVertex.geometry)
                        nextSidePts.append(pE.endVertex.geometry)
                        
                    nextSideGeometry = rg.Polyline(nextSidePts)  
                    nextSegs = nextSideGeometry.GetSegments()
                    
                    currSegs_Last = currSegs[len(currSegs)-1]
                    nextSegs_First = nextSegs[0]
                    # currVec = rg.Vector3d(currSegs_Last.To - currSegs_Last.From)
                    # nextVec = rg.Vector3d(nextSegs_First.To - nextSegs_First.From)

    
                    parcelSideAngle_Constraint.append(ks.Goals.Angle(currSegs_Last,nextSegs_First,rm.ToRadians(idealAngle),parcelSideAngleStrength))
                    
            ### the last 
            currSide = parcFace.sides[len(parcFace.sides)-1]
            nextSide =parcFace.sides[0]      
            if EDict[currSide[0]].naked ==True or EDict[nextSide[0]].naked ==True:
                    continue
                
            else:
                pEs = [EDict[edgeIndex] for edgeIndex in currSide]
                currSidePts = []
                for pE in pEs:
                    currSidePts.append(pE.startVertex.geometry)
                    currSidePts.append(pE.endVertex.geometry)
                    
                currSideGeometry = rg.Polyline(currSidePts)  
                currSegs = currSideGeometry.GetSegments()
                
                pEs = [EDict[edgeIndex] for edgeIndex in nextSide]
                nextSidePts = []
                for pE in pEs:
                    nextSidePts.append(pE.startVertex.geometry)
                    nextSidePts.append(pE.endVertex.geometry)
                nextSideGeometry = rg.Polyline(nextSidePts)  
                nextSegs = nextSideGeometry.GetSegments()
                
                currSegs_Last = currSegs[len(currSegs)-1]
                nextSegs_First = nextSegs[0]
                # currVec = rg.Vector3d(currSegs_Last.To - currSegs_Last.From)
                # nextVec = rg.Vector3d(nextSegs_First.To - nextSegs_First.From)


                parcelSideAngle_Constraint.append(ks.Goals.Angle(currSegs_Last,nextSegs_First,rm.ToRadians(idealAngle),parcelSideAngleStrength))
        
        #endregion 
        
        #region Constrain: parcelSideLength
        parcelSideLength_Constraint = []
        for parcFace in copiedParcFace:
            ### Get the ideal side length
            simSides = []
            
            for side in parcFace.sides:
                if EDict[side[0]].naked ==True:
                    continue
                else:
                    pEs = [EDict[edgeIndex] for edgeIndex in side]
                    thisSidePts = []
                    for pE in pEs:
                        thisSidePts.append(pE.startVertex.geometry)

                    thisSidePts.append(pE.endVertex.geometry)
                
                    thisSideGeometry = rg.Polyline(thisSidePts)
                    simSides.append(thisSideGeometry)

            sumLength = 0
            for rSide in simSides:
                sumLength += rSide.Length
            idealLength = sumLength/len(parcFace.sides)
            
            ### ideal length for each segment by percentage
            for rSide in simSides:
                for segment in rSide.GetSegments():
                    idealSegmentLength = idealLength/rSide.SegmentCount
                    parcelSideLength_Constraint.append(ks.Goals.Spring(segment,idealSegmentLength,parcelSideLengthStrength))
        #endregion    
        
        #region Constrain: parcelSideSimLength
        parcelSideSimLength_Constraint = []
        for parcFace in copiedParcFace:
            ### Get the ideal side length
            
            
            simSides = []
            
            for side in parcFace.sides:
                if EDict[side[0]].naked ==True:
                    continue
                else:
                    pEs = [EDict[edgeIndex] for edgeIndex in side]
                    thisSidePts = []
                    for pE in pEs:
                        thisSidePts.append(pE.startVertex.geometry)

                    thisSidePts.append(pE.endVertex.geometry)
                
                    thisSideGeometry = rg.Polyline(thisSidePts)
                    simSides.append(thisSideGeometry)
            sumLength = 0
            
            for sSide in simSides:
                sumLength += sSide.Length
                
            idealSimSizeLength =  sumLength/len(parcFace.sides)
            
            ### ideal length for each segment by percentage
            for rSide in simSides:
                parcelSideSimLength_Constraint.append(ks.Goals.Spring(rg.Line(rSide.First,rSide.Last),idealSimSizeLength,parcelSideSimLengthStrength))
                
        #endregion  
        
        
        #region Constrain: parcelAdjacencyStrength
        parcelAdjacency_Constraint = []
        currJunctionGraph = GRP.JunctionGraph.CreateJunctionGraphForThisDepth(EDict)
        currParcEdgeGraph = GRP.ParcEdgeGraph.CreateParcEdgeGraphForThisDepth(currJunctionGraph) 

        for thisPE in currParcEdgeGraph.graph.keys():
            nbEdges = currParcEdgeGraph.graph[thisPE]

            for nbEdge in nbEdges:

                if thisPE.startVertex.geometry == nbEdge.startVertex.geometry or thisPE.endVertex.geometry == nbEdge.startVertex.geometry:
                    commonPt = nbEdge.startVertex.geometry
                elif thisPE.startVertex.geometry == nbEdge.endVertex.geometry or thisPE.endVertex.geometry == nbEdge.endVertex.geometry:
                    commonPt = nbEdge.endVertex.geometry
                
                if commonPt == thisPE.startVertex.geometry:
                    nextPEpt = thisPE.endVertex.geometry
                elif commonPt == thisPE.endVertex.geometry:
                    nextPEpt = thisPE.endVertex.geometry
                
                    
                if commonPt == nbEdge.startVertex.geometry:
                    nextNBpt = nbEdge.endVertex.geometry
                    
                elif commonPt == nbEdge.endVertex.geometry: 
                    nextNBpt = nbEdge.startVertex.geometry
                    
                lineA = rg.Line(nextPEpt,commonPt)
                lineB = rg.Line(commonPt,nextNBpt)
                
                vecA = rg.Vector3d(commonPt-nextPEpt)
                vecB = rg.Vector3d(nextNBpt-commonPt)
                angle = rg.Vector3d.VectorAngle(vecA,vecB)
                angle_Degree = rm.ToDegrees(angle)
                if angle_Degree>=0 and angle_Degree<30:
                    parcelAdjacency_Constraint.append(ks.Goals.Angle(lineA,lineB,rm.ToRadians(0),parcelAdjacencyStrength))
                elif angle_Degree>=60 and angle_Degree<=120:
                    parcelAdjacency_Constraint.append(ks.Goals.Angle(lineA,lineB,rm.ToRadians(90),parcelAdjacencyStrength))

        #endregion  
            
        ##### Assign to PhysicalSystem
        allConstraint = []
        allConstraint.extend(VPAnchor_Constraint)
        allConstraint.extend(vOnCrv_Constraint)
    
        allConstraint.extend(roadAngle_Constraint)
        allConstraint.extend(roadJunctionAngle_Constraint)
        
        allConstraint.extend(parcelSideSmooth_Constraint)
        allConstraint.extend(parcelSideAngle_Constraint)
        allConstraint.extend(parcelSideLength_Constraint)
        allConstraint.extend(parcelSideSimLength_Constraint)
        
        allConstraint.extend(parcelAdjacency_Constraint)
        

        for g in allConstraint:
            ps.AssignPIndex(g,0.001)
            goals.Add(g)




        ##### Save previous result
        oldParcels = []
        for order in orderCollection:
            vs =[]
            for index in order:
                vs.append(allPts[index].geometry)
            vs.append(vs[0])
            oldParcels.append(rg.Polyline(vs))
            
        ##### Solve
        counter = 0
        threshold = 0.0000001
        #threshold = 1e-10
        while counter < 1000:
            ps.Step(goals,True,threshold)
            counter += 1
            #print ps.GetvSum()
            if ps.GetvSum() < threshold:
                break
            
        print("counter"),counter
        A = ps.GetOutput(goals)
        B = counter
        C = ps.GetPositionArray()

        ptList = []
        for pt in C:
            ptList.append(pt)

        ##### Get the final Result preview   
        newParcels = []
        for order in orderCollection:
            vs =[]
            for index in order:
                vs.append(ptList[index])
            vs.append(vs[0])
            newParcels.append(rg.Polyline(vs))

        ##### Get the final Result preview _Road  
        newRoads = []
        for order in orderCollection_Road:
            vs =[]
            for index in order:
                vs.append(ptList[index])
            
            newRoads.append(rg.Polyline(vs))

        ##### this is to refer to the optimized geometry and do data analysis
        ptDict_New = {}
        ptDict_Old = {}
        #for instance in allInstances:
        
        # print "len(allPts) ",len(allPts)  
        # print "len(ptList) ",len(ptList)  
        
        for i in range(len(allPts)):
            thisInstance = allPts[i]
            ptDict_New[thisInstance.ID] = ptList[i] 
            ptDict_Old[thisInstance.ID] = thisInstance.geometry
            
        return newParcels,oldParcels,newRoads,oldRoads,ptDict_New,ptDict_Old,pFSideDataColletion #ptDict,orderCollection,orderCollection_Road
# ---------- end ghpython_script_9 ----------
ghpython_script_10 = GhPythonScript()  # -> out, NewOffset
# ---------- ghpython_script_10: Python ----------
###########################
####    Import Libs    ####
###########################
import Rhino.Geometry as rg
#import Rhino.RhinoDoc as rd
import Rhino.RhinoMath as rm


class NewOffset:

    ### Simply classify the road from newRoads output to proceed
    @staticmethod
    def PreClassifyRoads(newRoads):
        boundary = newRoads.pop()  
        newJoinedRoads= rg.Curve.JoinCurves(newRoads)
        validStreetGeos = newJoinedRoads ### Temp

        allStreetGeos = [geo for geo in validStreetGeos]
        allStreetGeos.append(boundary)

        return boundary,validStreetGeos,allStreetGeos
    
    
    ### Assign hierarchy for naked edges
    @staticmethod
    def AssignNakedEdgesHierarchy(collection_StreetGraph, copiedParcFace):
        firstLayerIDs =[ street.ID for street in collection_StreetGraph[0].graph.keys()]
        nakedRoadParcEdgeIDs = []

        allRoadParcEdgeIDs = []
        for street in collection_StreetGraph[-1].graph.keys():
            if  street.ID not in firstLayerIDs:
                allRoadParcEdgeIDs.extend(street.GetAllParcEdgeAndTwinID())
            
            else:
                nakedRoadParcEdgeIDs.extend(street.GetAllParcEdgeAndTwinID())
    
        for pF in copiedParcFace:

            for edge in pF.edges:
                edge.offsetDistance = 0
                if edge.ID in allRoadParcEdgeIDs:
                    edge.hierarchy = 3
                    
                elif edge.ID in nakedRoadParcEdgeIDs:
                    edge.hierarchy = 1
    
    @staticmethod
    def GetRelevantOffsets(edgeGeoList,validStreetGeos):
        validComparisionIndices = []
        for j in range(len(edgeGeoList)):
            edgeGeo = edgeGeoList[j]
            thisEdgeStart = edgeGeo.PointAtStart
            thisEdgeEnd = edgeGeo.PointAtEnd
            
            for i in range(len(validStreetGeos)):
                streetGeo = validStreetGeos[i]
                closestStartT = streetGeo.ClosestPoint(thisEdgeStart)[1]
                closestStartPoint = streetGeo.PointAt(closestStartT)
                startDistance = thisEdgeStart.DistanceTo(closestStartPoint)
                
                closestEndT = streetGeo.ClosestPoint(thisEdgeEnd)[1]
                closestEndPoint = streetGeo.PointAt(closestEndT)
                endDistance = thisEdgeEnd.DistanceTo(closestEndPoint)
                
                # if i ==1 and j==3:
                #     print "edgeGeo"
                #     for pt in edgeGeo.TryGetPolyline()[1]:
                #         print pt   
                
                #     print "streetGeo"
                #     for pt in streetGeo.TryGetPolyline()[1]:
                #         print pt  
                        
                #print "edgeGeoList",j,"validStreetGeos",i, "startDistance",startDistance,"endDistance",endDistance
                if startDistance<0.1 and endDistance<0.1:
                    
                    if i not in validComparisionIndices:
                        validComparisionIndices.append(i)

        return validComparisionIndices

    
    ### Reconstruct the parcel with simple data structure
    @staticmethod
    def ReconstructSimplifiedParcelAfterOptimization(PL,copiedParcFace,ptDict_New):
        
        ptDict_New = ptDict_New[0]  ### this is the dict from optimization part

        ### start with each parcFace
        resampleParcFaces = []
        for pF in copiedParcFace:
            
            newVs = []
            newEs = []  
            newF = PL.ParcFace()
            
            for edge in pF.edges:
                ### this is not needed anymore since we are going to trim it with region
                # edge.offsetDistance = 0
                # if edge.ID in allRoadParcEdgeIDs:
                #     edge.hierarchy = 3
                #     edge.offsetDistance = offsetDistance/2/scale

                startVertex = PL.ParcVertex(ptDict_New[edge.startVertex.ID],edge.startVertex.ID)
                if edge.startVertex.onBoundary == True:
                    startVertex.onBoundary = True
                
                
                endVertex = PL.ParcVertex(ptDict_New[edge.endVertex.ID],edge.endVertex.ID)
                if edge.endVertex.onBoundary == True:
                    endVertex.onBoundary = True
                
                
                
                rPoints = []
                for rPt in edge.resamplePoints:
                    rPoints.append(PL.ParcResamplePoint(ptDict_New[rPt.ID],rPt.ID))
                    #print ptDict_New[rPt.ID]
                newEdge = PL.ParcEdge(edge.ID)
                newEdge.hierarchy = edge.hierarchy
                newEdge.offsetDistance = edge.offsetDistance
                newEdge.startVertex = startVertex              
                newEdge.endVertex = endVertex     
                newEdge.resamplePoints = rPoints
                
                newEs.append(newEdge)
            
            newVs = [pE.startVertex for pE in newEs]
            newF.vertices = newVs
            newF.edges = newEs
            newF.ID = pF.ID
            
            resampleParcFaces.append(newF)
            
            
        resamplePFGeos = [PF.GetGeometry_SimplifiedWithResamplePoints() for PF in resampleParcFaces]
        resamplePFIndices = [PF.ID for PF in resampleParcFaces]
        
        return resampleParcFaces,resamplePFGeos,resamplePFIndices

    ### Get the offset curve and offset region 
    @staticmethod
    def GetValidStreetGeos(collection_StreetGraph):
        ### this function is to exclude the first depth of roads, collect the other road geometries
        
        firstLayerIDs =[ street.ID for street in collection_StreetGraph[0].graph.keys()]

        validStreets = [] ### collect street instance

        allRoadParcEdgeIDs = []
        for street in collection_StreetGraph[-1].graph.keys():
            if  street.ID not in firstLayerIDs:
                allRoadParcEdgeIDs.extend(street.GetAllParcEdgeAndTwinID())
                validStreets.append(street)

        validStreetGeos = [] ### collect street geometry
        for street in validStreets:
            validStreetGeos.append(street.GetGeometry().ToPolylineCurve())

        return validStreetGeos

    @staticmethod
    def ExtendOneSideToReach(crv,boundary,extensionSide,iteration,extension,targetCount,tol=0.01):
        
        ### make a copy
        crvCopy = rg.PolylineCurve(crv)
        
        ### extend the crv from a specific side
        for i in range(iteration):
            crvCopy= crvCopy.Extend(extensionSide,extension,rg.CurveExtensionStyle.Line)
            if rg.Intersect.Intersection.CurveCurve(crvCopy,boundary,tol,tol).Count == targetCount:
                break
        
        ### extend the last time and get the intersectionPt
        newPtList = []
        if extensionSide == rg.CurveEnd.Start:
            
            ### check the last seg
            crvCopyPL = crvCopy.TryGetPolyline()[1]
            lastPt = crvCopyPL[0]
            lastLastPt = crvCopyPL[1]
            lastSeg = rg.Polyline([lastPt,lastLastPt]).ToPolylineCurve()
            
            
            if rg.Intersect.Intersection.CurveCurve(lastSeg,boundary,tol,tol).Count != 0:
                
                intersectionPt = rg.Intersect.Intersection.CurveCurve(lastSeg,boundary,tol,tol).Item[0].PointB  ### important, it is the point on boundary
            
            # else:
            
            #     lastPt = crvCopy.PointAtStart
            #     crvCopy.Extend(extensionSide,extension,rg.CurveExtensionStyle.Line)
            #     lastLastPt = crvCopy.PointAtStart
            #     lastSeg = rg.Polyline([lastPt,lastLastPt]).ToPolylineCurve()
            #     intersectionPt = rg.Intersect.Intersection.CurveCurve(lastSeg,boundary,tol,tol).Item[0].PointB
                
            newPtList = [intersectionPt]
            for pt in crv.TryGetPolyline()[1]:
                newPtList.append(pt)
            
        
            
        elif extensionSide == rg.CurveEnd.End:
            ### check the last seg
            crvCopyPL = crvCopy.TryGetPolyline()[1]

            pts = [pt for pt in crvCopyPL]
            lastPt = pts[-1]
            lastLastPt = pts[-2]
            lastSeg = rg.Polyline([lastPt,lastLastPt]).ToPolylineCurve()
            
            if rg.Intersect.Intersection.CurveCurve(lastSeg,boundary,tol,tol).Count != 0:
                intersectionPt = rg.Intersect.Intersection.CurveCurve(lastSeg,boundary,tol,tol).Item[0].PointB
            
            # else:
            #     lastPt = crvCopy.PointAtStart
            #     crvCopy.Extend(extensionSide,extension,rg.CurveExtensionStyle.Line)
            #     lastLastPt = crvCopy.PointAtStart
            #     lastSeg = rg.Polyline([lastPt,lastLastPt]).ToPolylineCurve()
            #     intersectionPt = rg.Intersect.Intersection.CurveCurve(lastSeg,boundary,tol,tol).Item[0].PointB
            
            for pt in crv.TryGetPolyline()[1]:
                newPtList.append(pt)
            newPtList.append(intersectionPt)
        
        newCrv = rg.Polyline(newPtList).ToPolylineCurve()  

        return newCrv

    @staticmethod
    def ExtendOffsetCrvToReach(crv,boundary,iteration,extension,tol):
        
        intersectionCount = rg.Intersect.Intersection.CurveCurve(crv,boundary,tol,tol).Count
            
        if intersectionCount == 2:
            #print ("intersectionCount == 2")
            pass
            
        elif intersectionCount == 1:
            #print ("intersectionCount == 1")
            intersectionPt = rg.Intersect.Intersection.CurveCurve(crv,boundary,tol,tol).Item[0].PointA
            
            start1 = crv.PointAtStart
            end1 = crv.PointAtEnd
            
            distanceStart = intersectionPt.DistanceTo(start1)
            distanceEnd = intersectionPt.DistanceTo(end1)
            
            if distanceStart>distanceEnd:
                extensionSide = rg.CurveEnd.Start
                
            elif distanceStart<distanceEnd:
                extensionSide = rg.CurveEnd.End

            crv = NewOffset.ExtendOneSideToReach(crv,boundary,extensionSide,iteration,extension,2)

        elif intersectionCount == 0:
            #print ("intersectionCount == 0")
            crv = NewOffset.ExtendOneSideToReach(crv,boundary,extensionSide,iteration,extension,1)
            crv = NewOffset.ExtendOneSideToReach(crv,boundary,extensionSide,iteration,extension,2)

        return crv

    @staticmethod
    def ExtendOffsetCrvToReachOneEnd(crv,comparision,iteration,extension,extensionSide,tol):
       
        crvCopy = crv.Duplicate()
        newCrv = crvCopy
        intersectionCount = rg.Intersect.Intersection.CurveCurve(crv,comparision,tol,tol).Count

        #print "intersectionCount",intersectionCount
        if intersectionCount == 0:
            
            for i in range(iteration):
                
                crvCopy= crvCopy.Extend(extensionSide,extension,rg.CurveExtensionStyle.Line)
                
                #print crvCopy.PointAtStart
                #print rg.Intersect.Intersection.CurveCurve(crvCopy,comparision,tol,tol).Count
                if rg.Intersect.Intersection.CurveCurve(crvCopy,comparision,tol,tol).Count == 1:
                    break
           
            
            if extensionSide == rg.CurveEnd.End:
                intersectionPt = rg.Intersect.Intersection.CurveCurve(crvCopy,comparision,tol,tol).Item[0].PointB
                newPtList = []
                for pt in crv.TryGetPolyline()[1]:
                    newPtList.append(pt)
                newPtList.append(intersectionPt)
                
            if extensionSide == rg.CurveEnd.Start:
                
                # print "comparision"
                # for pt in comparision.TryGetPolyline()[1]:
                #     print pt 
                
                # print "crvCopy"
                # for pt in crvCopy.TryGetPolyline()[1]:
                #     print pt 
                    
                intersectionPt = rg.Intersect.Intersection.CurveCurve(crvCopy,comparision,tol,tol).Item[0].PointB
                newPtList = [intersectionPt]
                for pt in crv.TryGetPolyline()[1]:
                    newPtList.append(pt)
                    
            newCrv = rg.Polyline(newPtList).ToPolylineCurve()
        
        elif intersectionCount == 1:
            newCrv = crvCopy
            pass
        
       
        return newCrv


    @staticmethod
    def ExtendOffsetCrvToReachBoundaryBothSides(crv,comparision,iteration,extension,tol):
        #print "in ExtendOffsetCrvToReachBoundaryBothSides"
        wxy_Plane = rg.Plane.WorldXY
        ### comparision is the boundary
        
        crvCopy = crv.Duplicate()
        
        ### check startPoint Distance
        startPoint = crvCopy.PointAtStart
        closestStartT = comparision.ClosestPoint(startPoint)[1]
        closestStartPoint = comparision.PointAt(closestStartT)
        startDistance = startPoint.DistanceTo(closestStartPoint)
        
        whileCount = 0
        
        # for pt in comparision.TryGetPolyline()[1]:
        #     print pt.X,pt.Y,0
        # print "---"
        ### 2:out  3:Coincident
        if int (comparision.Contains(startPoint,wxy_Plane,tol)) == 2 or int (comparision.Contains(startPoint,wxy_Plane,tol)) == 3:
            # print startPoint.X,startPoint.Y,0
            # print int (comparision.Contains(startPoint))
            pass
        else:
            
            for i in range(iteration):
                
            #while startDistance > tol:
                # if whileCount >iteration:
                #     break
                #print crvCopy
                #debug = crvCopy
                
#                for pt in crvCopy.TryGetPolyline()[1]:
#                     print pt.X,pt.Y,0
#                print "---"
                crvCopy= crvCopy.Extend(rg.CurveEnd.Start,extension,rg.CurveExtensionStyle.Line)
                
                

         
                startPoint = crvCopy.PointAtStart
                startDistance = startPoint.DistanceTo(closestStartPoint)
             
                closestStartT = comparision.ClosestPoint(startPoint)[1]
                closestStartPoint = comparision.PointAt(closestStartT)
                startDistance = startPoint.DistanceTo(closestStartPoint)

                
                if int (comparision.Contains(startPoint)) == 2 or int (comparision.Contains(startPoint)) == 3:
                    break
               
            lastSeg = rg.Polyline([closestStartPoint,startPoint]).ToPolylineCurve()    
            intersectionPt = rg.Intersect.Intersection.CurveCurve(lastSeg,comparision,tol,tol).Item[0].PointB
            
            
            #print "start intersectionPt",intersectionPt
            newPtList = [intersectionPt]
            for pt in crv.TryGetPolyline()[1]:
                newPtList.append(pt)
                    
            crvCopy = rg.Polyline(newPtList).ToPolylineCurve()
        
        
        #print "now the start of the curve is", crvCopy.PointAtStart
        ### check endPoint Distance
        endPoint = crvCopy.PointAtEnd
        closestEndT = comparision.ClosestPoint(endPoint)[1]
        closestEndPoint = comparision.PointAt(closestEndT)
        endDistance = endPoint.DistanceTo(closestEndPoint)
        
        whileCount = 0
        if int (comparision.Contains(endPoint,wxy_Plane,tol)) == 2 or int (comparision.Contains(endPoint,wxy_Plane,tol)) == 3:
            pass
        
        else:
            #print "now the start of the curve is", crvCopy.PointAtStart
            for i in range(iteration):
            # while endDistance > tol:
            #     if whileCount >iteration:
            #         break
                
                whileCount+=1
                crvCopy = crvCopy.Extend(rg.CurveEnd.End,extension,rg.CurveExtensionStyle.Line)
                
                endPoint = crvCopy.PointAtEnd
                endDistance = endPoint.DistanceTo(closestEndPoint)

                
        
                if int (comparision.Contains(endPoint)) == 2 or int (comparision.Contains(endPoint)) == 3:
                    break
                closestEndT = comparision.ClosestPoint(endPoint)[1]
                closestEndPoint = comparision.PointAt(closestEndT)
                
                
            lastSeg = rg.Polyline([closestEndPoint,endPoint]).ToPolylineCurve()    
            
            # print closestEndPoint
            # print endPoint
            intersectionPt = rg.Intersect.Intersection.CurveCurve(lastSeg,comparision,tol,tol).Item[0].PointB 
            #print "end intersectionPt",intersectionPt
            newPtList = []
            
            for pt in crvCopy.TryGetPolyline()[1]:
                newPtList.append(pt)
            newPtList.append(intersectionPt)        
                        
            crvCopy = rg.Polyline(newPtList).ToPolylineCurve()
        
        
        #print "finally the start of the curve is", crvCopy.PointAtStart
        #print "-----------------"
        return crvCopy
        
    @staticmethod
    def GetThisHierachyOffsetUnionRegion(validStreetGeos,allStreetGeos,boundary,offsetDists,validStreetGeos_Cats,iteration=1000,extension=0.1,tol_Extension=0.001,tol_Intersection = 0.001,tol_Boolean = 0.01):
        
        
        
        
        ### global variable
        debug = []
        comparisionTriplet = []
        wxy_Plane = rg.Plane.WorldXY
        joinedRegions = []
        allOffsets_Flatten = []
        allOffsets = []
        allOffsetRegions = []
        
        ### Start one road by one road
        
        for i in range(len(validStreetGeos)):
            
            streetGeo = validStreetGeos[i]
            
            chosenCat = validStreetGeos_Cats[i]
            offsetDist = offsetDists[chosenCat]
            comparedGeos = [geo for geo in allStreetGeos]
            
            #### exclude itself
            comparedGeos.remove(streetGeo)

            #### join curves
            comparedGeos = rg.Curve.JoinCurves(comparedGeos)
            
            #### exclude the connected (optional,testing)
            thisStreetGeoStart = streetGeo.PointAtStart
            thisStreetGeoEnd = streetGeo.PointAtEnd    
            for geo in comparedGeos:
                if geo != boundary:
                    if geo.PointAtStart.DistanceTo(thisStreetGeoStart) <0.01 or geo.PointAtEnd.DistanceTo(thisStreetGeoStart)<0.01 or geo.PointAtStart.DistanceTo(thisStreetGeoEnd) <0.01 or geo.PointAtEnd.DistanceTo(thisStreetGeoEnd)<0.01:
                        debug.append(geo)
        
            ### collect the comparisionTriplet : [streetGeo,startComparsion,endComparsion]
            # check the startPoint
            thisStart = streetGeo.PointAtStart
            distances = []
            for comparedGeo in comparedGeos:
                closestT = comparedGeo.ClosestPoint(thisStart)[1]
                closestPoint = comparedGeo.PointAt(closestT)
                distances.append(closestPoint.DistanceTo(thisStart))
            
            startComparsion = comparedGeos[distances.index(min(distances))]
            
            # check the endPoint
            thisEnd= streetGeo.PointAtEnd
            distances = []
            for comparedGeo in comparedGeos:
                closestT = comparedGeo.ClosestPoint(thisEnd)[1]
                closestPoint = comparedGeo.PointAt(closestT)
                distances.append(closestPoint.DistanceTo(thisEnd))
        
            endComparsion = comparedGeos[distances.index(min(distances))]     
                    
            triplet = [streetGeo,startComparsion,endComparsion]
            comparisionTriplet.append([streetGeo,startComparsion,endComparsion])                
            
            
            ### Get the unionRegion
            crv = triplet[0]
            startCrv = triplet[1]
            endCrv = triplet[2]        
            
            #for pt in crv.TryGetPolyline()[1]:
            #    print pt.X,pt.Y,0
            #print "----crv----"


            # for pt in offset1.TryGetPolyline()[1]:
            #     print pt.X,pt.Y,0
            # print "----offset1----"

            
            # for pt in offset2.TryGetPolyline()[1]:
            #     print pt.X,pt.Y,0
            # print "----offset2----"
            
            ### Get 2 offsets
            offset1 = None
            offset2 = None
            
            offset1 = crv.Offset(wxy_Plane,offsetDist,tol_Extension,rg.CurveOffsetCornerStyle.Sharp)[0]
            offset2 = crv.Offset(wxy_Plane,-offsetDist,tol_Extension,rg.CurveOffsetCornerStyle.Sharp)[0]
            

  

            if startCrv != endCrv:
 
                offset1 = NewOffset.ExtendOffsetCrvToReachOneEnd(offset1,startCrv,10,extension,rg.CurveEnd.Start,tol_Extension)
                offset1 = NewOffset.ExtendOffsetCrvToReachOneEnd(offset1,endCrv,iteration,extension,rg.CurveEnd.End,tol_Extension)
                
                offset2 = NewOffset.ExtendOffsetCrvToReachOneEnd(offset2,startCrv,iteration,extension,rg.CurveEnd.Start,tol_Extension)
                offset2 = NewOffset.ExtendOffsetCrvToReachOneEnd(offset2,endCrv,iteration,extension,rg.CurveEnd.End,tol_Extension)
                
                
                #### Trim to get the exact one
            
                tA = rg.Intersect.Intersection.CurveCurve(offset1,startCrv,tol_Intersection,tol_Intersection).Item[0].ParameterA
                splitOffsetA =  offset1.Split(tA)
                
                if tA - 0 < 0.001 or offset1.Domain.T1 - tA  < 0.001:
                    pass
                else:
                    if splitOffsetA[0].GetLength()>splitOffsetA[1].GetLength():
                        offset1 = splitOffsetA[0]
                    
                    elif splitOffsetA[1].GetLength()>splitOffsetA[0].GetLength():
                        offset1 = splitOffsetA[1]
            
                tB = rg.Intersect.Intersection.CurveCurve(offset1,endCrv,tol_Intersection,tol_Intersection).Item[0].ParameterA
                splitOffsetB =  offset1.Split(tB)
                
                if tB - 0 < 0.001  or offset1.Domain.T1 - tB  < 0.001:
                    pass
                else:

                    if splitOffsetB[0].GetLength()>splitOffsetB[1].GetLength():
                        offset1 = splitOffsetB[0]
                    
                    elif splitOffsetB[1].GetLength()>splitOffsetB[0].GetLength():
                        offset1 = splitOffsetB[1]
                
                    
                #####
                
                tA = rg.Intersect.Intersection.CurveCurve(offset2,startCrv,tol_Intersection,tol_Intersection).Item[0].ParameterA
                splitOffsetA =  offset2.Split(tA)
                
                
                if tA - 0 < 0.001 or offset2.Domain.T1 - tA  < 0.001:
                    pass
                else:
                    if splitOffsetA[0].GetLength()>splitOffsetA[1].GetLength():
                        offset2 = splitOffsetA[0]
                    
                    elif splitOffsetA[1].GetLength()>splitOffsetA[0].GetLength():
                        offset2 = splitOffsetA[1]
            
                tB = rg.Intersect.Intersection.CurveCurve(offset2,endCrv,tol_Intersection,tol_Intersection).Item[0].ParameterA
                splitOffsetB =  offset2.Split(tB)
                
                if tB - 0 < 0.001 or offset2.Domain.T1 - tB  < 0.001:
                    pass
                else:
                    
                    if splitOffsetB[0].GetLength()>splitOffsetB[1].GetLength():
                        offset2 = splitOffsetB[0]
                    
                    elif splitOffsetB[1].GetLength()>splitOffsetB[0].GetLength():
                        offset2 = splitOffsetB[1]
 
            elif startCrv == endCrv:
                


                offset1 = NewOffset.ExtendOffsetCrvToReachBoundaryBothSides(offset1,startCrv,iteration,extension,tol_Extension)
                offset2 = NewOffset.ExtendOffsetCrvToReachBoundaryBothSides(offset2,startCrv,iteration,extension,tol_Extension)
                
                ts = []
                for i in range(rg.Intersect.Intersection.CurveCurve(offset1,startCrv,tol_Intersection,tol_Intersection).Count):
                    t = rg.Intersect.Intersection.CurveCurve(offset1,startCrv,tol_Intersection,tol_Intersection).Item[i].ParameterA
                    ts.append(t)
                
                splitOffsets =  offset1.Split(ts)
                
                lengths = [seg.GetLength() for seg in splitOffsets]
                
                maxIndex = lengths.index(max(lengths))
                
                offset1 = splitOffsets[maxIndex]
                
                ###
                ts = []
                for i in range(rg.Intersect.Intersection.CurveCurve(offset2,startCrv,tol_Intersection,tol_Intersection).Count):
                    t = rg.Intersect.Intersection.CurveCurve(offset2,startCrv,tol_Intersection,tol_Intersection).Item[i].ParameterA
                    ts.append(t)
                
                splitOffsets =  offset2.Split(ts)
                
                lengths = [seg.GetLength() for seg in splitOffsets]
                
                maxIndex = lengths.index(max(lengths))
                
                offset2 = splitOffsets[maxIndex]

             
            
            crvCollection = [offset1,offset2,startCrv,endCrv]
            
            
            booleanRegionResult = rg.Curve.CreateBooleanRegions(crvCollection,wxy_Plane,False,tol_Boolean)
            region = booleanRegionResult.RegionCurves(0)
            joinedRegions.append(region[0]) 
            
            allOffsets_Flatten.append(offset1)
            allOffsets_Flatten.append(offset2)
            allOffsets.append([offset1,offset2])
            allOffsetRegions.append(region[0])
        
        
        
        offsetRegionUnion =  rg.Curve.CreateBooleanUnion (joinedRegions,tol_Boolean)[0]
        
        return allOffsets,allOffsets_Flatten,allOffsetRegions,offsetRegionUnion
        
    ### Use the region union to trim the parcel
    @staticmethod
    def GetOffsetParcelAndEdgeCat(resampleParcFaces,validStreetGeos,allOffsets,allOffsetRegions,validStreetGeos_Cats):
        pFGeoCollection = []
        pEGeoCollection = []
        pECatCollection = []
        count=0
        for i in range(len(resampleParcFaces)):
            
            # if i >=1:
            #     break
            #print i
            # if i!=8:
            #     continue
            #i = 13
            tol_Intersection = 0.001
            testPF = resampleParcFaces[i]
            #print ("testPF.ID:"),testPF.ID,"i",i

            
            
            ### Initilaization - using current geometry
            thisRoundEdgeGeos = [edge.GetGeometry_SimplifiedWithResamplePoints().ToPolylineCurve() for edge in testPF.edges]
            thisRoundEdgeCats = [edge.hierarchy for edge in testPF.edges]
            thisRoundPFGeo = testPF.GetGeometry_SimplifiedWithResamplePoints().ToPolylineCurve()

            
            ### Iterate
            validComparisionIndices = NewOffset.GetRelevantOffsets(thisRoundEdgeGeos,validStreetGeos)
            
            validOffsetCat = [ validStreetGeos_Cats[index] + 3 for index in validComparisionIndices]
            
         
            
            validOffsetPair = [allOffsets[index] for index in validComparisionIndices]
            validOffsetRegions = [allOffsetRegions[index] for index in validComparisionIndices]
            
            
            #print "validComparisionIndices",validComparisionIndices
            #print len(validOffsetPair)
            for i in range(len(validOffsetPair)):
                
                offsetCat = validOffsetCat[i]
                
                # if i >=1:
                #     break
                #print "start a validOffsetPair"
                offsetPair = validOffsetPair[i] 
                offsetRegion = validOffsetRegions[i]

                chosenOffset = None
                if rg.Intersect.Intersection.CurveCurve(thisRoundPFGeo,offsetPair[0],tol_Intersection,tol_Intersection).Count != 0:
                    chosenOffset = offsetPair[0]
                elif rg.Intersect.Intersection.CurveCurve(thisRoundPFGeo,offsetPair[1],tol_Intersection,tol_Intersection).Count != 0:
                    chosenOffset = offsetPair[1]
                    
                
                # print "offsetRegion"
                # for pt in offsetRegion.TryGetPolyline()[1]:
                #     print pt    
                    
                    
                # print "chosenOffset"
                # for pt in chosenOffset.TryGetPolyline()[1]:
                #     print pt  
                #print "-------------------------------"    
                intersectedEdgeInfo = []
                intersectTs = []
                for i in range(len(thisRoundEdgeGeos)):
                    thisEdgeGeo = thisRoundEdgeGeos[i]
                    thisEdgeCat = thisRoundEdgeCats[i]
                    #print "i",i,"thisEdgeCat",thisEdgeCat
                    
  
                    intersectResult = rg.Intersect.Intersection.CurveCurve(thisEdgeGeo,chosenOffset,tol_Intersection,tol_Intersection)
#                    print "thisEdgeGeo"
#                    for pt in thisEdgeGeo.TryGetPolyline()[1]:
#                        print pt   
                        
                    if intersectResult.Count != 0:
                        
                        intersectPt = intersectResult.Item[0].PointA
                        intersectT = intersectResult.Item[0].ParameterA
                        intersectedEdgeInfo.append([chosenOffset,thisEdgeGeo,thisEdgeCat,i,intersectT,intersectPt])
                        intersectTs.append(intersectResult.Item[0].ParameterB)
                   
#                        print "there is a pt, "
#                        print intersectPt
                    
                    # print "intersectTs", intersectTs
                    # print "---"
   
                ### STEP1: check the edges should be trimmed by offset Curves
                cutEdges = []
                cutEdgeIndices = []
        
                for info in intersectedEdgeInfo:
                    currEdgeGeo = info[1]
                    currEdgeCat = info[2]
                    splitParts = currEdgeGeo.Split(info[4])
                    
                    # print "intersectT:", info[4]
                    # print "currEdgeGeo"
                    # for pt in currEdgeGeo.TryGetPolyline()[1]:
                    #     print pt 
                        
                    
                    ### check which part should keep
                    splitPartA =  splitParts[0]
                    splitPartB =  splitParts[1]
                    
                    midPtA = splitPartA.PointAtLength(splitPartA.GetLength()/2)
                    midPtB = splitPartB.PointAtLength(splitPartB.GetLength()/2)
                    chosenPart = None
                    
                    ## debug only
                    # print "splitPartA"
                    # for pt in splitPartA.TryGetPolyline()[1]:
                    #     print pt 
                    
                    # print "splitPartB"
                    # for pt in splitPartB.TryGetPolyline()[1]:
                    #     print pt 
                        
                    # print "midPt"
                    # print midPtA
                    # print midPtB
                    
                    # print "startPt"
                    # print splitPartA.PointAtStart
                    # print splitPartB.PointAtStart
        
                    # print "endPt"
                    # print splitPartA.PointAtEnd
                    # print splitPartB.PointAtEnd
                    
                    ### 
  
                    # print "int(offsetRegion.Contains(midPtA)",int(offsetRegion.Contains(midPtA))
                    # print "int(offsetRegion.Contains(midPtB)",int(offsetRegion.Contains(midPtB))                                         
                    if (int(offsetRegion.Contains(midPtA))==1 or int(offsetRegion.Contains(midPtA))==3)  and int(offsetRegion.Contains(midPtB))!=1:
                        chosenPart = splitPartB
                    
                    elif int(offsetRegion.Contains(midPtA))!=1 and (int(offsetRegion.Contains(midPtB))==1 or int(offsetRegion.Contains(midPtB))==3):
                        chosenPart = splitPartA

                    
                    
                    cutEdges.append([chosenOffset,chosenPart,currEdgeCat,info[3]])
                    cutEdgeIndices.append(info[3])
            
                
                
                cutEdgeGeoDict = {}
                cutEdgeCatDict = {}
                
                for cutEdge in cutEdges:
                    cutEdgeGeoDict[cutEdge[-1]] = cutEdge[1]
                    cutEdgeCatDict[cutEdge[-1]] = cutEdge[2]
                
                
                #print cutEdges
                #print cutEdgeGeoDict
                
                
                
                # print "cutEdges[0]"
                # for pt in cutEdges[0][1].TryGetPolyline()[1]:
                #     print pt 
                    
                # print "cutEdges[1]"
                # for pt in cutEdges[1][1].TryGetPolyline()[1]:
                #     print pt 
                    
                
                #print "cutEdgeIndices",cutEdgeIndices
                ### STEP2: check the edges should be reduced
                reduceEdgeIndices = []

                #print "len(thisRoundEdgeGeos)",len(thisRoundEdgeGeos)
                
                for eIndex in range(len(thisRoundEdgeGeos)):
                    
                    thisEdgeGeoPL = thisRoundEdgeGeos[eIndex].TryGetPolyline()[1]
                    

                    if (int(offsetRegion.Contains(thisEdgeGeoPL.First))==1 or int(offsetRegion.Contains(thisEdgeGeoPL.First))==3) and (int(offsetRegion.Contains(thisEdgeGeoPL.Last))==1 or int(offsetRegion.Contains(thisEdgeGeoPL.Last))==3):
                        # print "reduceEdgeInfo"
                        # print thisEdgeGeoPL.First
                        # print thisEdgeGeoPL.Last
                        reduceEdgeIndices.append(eIndex)
                #print "reduceEdgeIndices",reduceEdgeIndices
                
                
                #print "offset"
                #for pt in chosenOffset.TryGetPolyline()[1]:
                    #print pt 
                
                
                ### STEP3:  the new edge
                #print "intersectTs",intersectTs
                if intersectTs[0] in [chosenOffset.Domain.T0,chosenOffset.Domain.T1] and intersectTs[1] in [chosenOffset.Domain.T0,chosenOffset.Domain.T1]:
                    
                    chosenPart_offset = chosenOffset
                    
                else:
                    offsetSplitParts = chosenOffset.Split(intersectTs)
            
                    ### check which part should  keep
                    offsetSplitPartA =  offsetSplitParts[0]
                    offsetSplitPartB =  offsetSplitParts[1]
                    
                    tA =  offsetSplitPartA.Domain.Mid
                    tB =  offsetSplitPartB.Domain.Mid
                    
                    midPtA_offset = offsetSplitPartA.PointAt(tA)
                    midPtB_offset = offsetSplitPartB.PointAt(tB)
                    
                    chosenPart_offset = None
            
                    if (int(thisRoundPFGeo.Contains(midPtA_offset))==1 or int(thisRoundPFGeo.Contains(midPtA_offset))==3)  and int(thisRoundPFGeo.Contains(midPtB_offset))!=1:
                        chosenPart_offset = offsetSplitPartA
                        
                    elif int(thisRoundPFGeo.Contains(midPtA_offset))!=1 and (int(thisRoundPFGeo.Contains(midPtB_offset))==1 or int(thisRoundPFGeo.Contains(midPtB_offset))==3):
                        chosenPart_offset = offsetSplitPartB
                    
                ### STEP4: form the new parcel 
                newRoundEgdeGeos = []
                newRoundEgdeCats = []
                
                newTag = False
                
                for i in range(len(thisRoundEdgeGeos)):
                    
                    if i not in cutEdgeIndices and i not in reduceEdgeIndices:
                        newRoundEgdeGeos.append(thisRoundEdgeGeos[i])
                        newRoundEgdeCats.append(thisRoundEdgeCats[i])
                    
                        #print "add remaining",i ,thisRoundEdgeCats[i],"newIndex :", newRoundEgdeGeos.index(thisRoundEdgeGeos[i])
                        
                    elif i in reduceEdgeIndices and newTag == False:
                        newRoundEgdeGeos.append(chosenPart_offset)
                        newRoundEgdeCats.append(offsetCat)
                        newTag = True
                        #print "add newEdgeIndices",i ,"offsetCat","newIndex :", newRoundEgdeGeos.index(chosenPart_offset)
                    
                    elif i in cutEdgeIndices:
                        
                        newRoundEgdeGeos.append(cutEdgeGeoDict[i])
                        newRoundEgdeCats.append(cutEdgeCatDict[i])
                        
                        #print "add cutEdgeIndices",i ,cutEdgeCatDict[i],"newIndex :", newRoundEgdeGeos.index(cutEdgeGeoDict[i])
                

                    #print "in the loop:" ,newRoundEgdeCats
                #
                
                # minIndex = min(cutEdgeIndices[0] , cutEdgeIndices[1])
                # maxIndex = max(cutEdgeIndices[0] , cutEdgeIndices[1])
                
                # if minIndex == len(testPF.edges)-1:
                #     newRoundEgdeGeos.insert(cutEdgeIndices[1] + 1, chosenPart_offset)
                #     newRoundEgdeCats.insert(cutEdgeIndices[1] + 1, "offsetCat")
                #     print "case1 insert after",cutEdgeIndices[1]
                # else:
                #     newRoundEgdeGeos.insert(cutEdgeIndices[0] + 1, chosenPart_offset)
                #     newRoundEgdeCats.insert(cutEdgeIndices[0] + 1, "offsetCat")
                #     print "case2 insert after",cutEdgeIndices[0] 
                
                
                
                #print newRoundEgdeGeos
                ### sort Order
                newRoundEgdeGeosPL = [edgeGeo.TryGetPolyline()[1] for edgeGeo in newRoundEgdeGeos]
                
                # print "before"
                # for geo in newRoundEgdeGeosPL:
                #     print geo.First
                
                # print "----"
                
                for i in range(len(newRoundEgdeGeosPL)):
                    if i == 0 :
                        
                        if newRoundEgdeGeosPL[i].Last .DistanceTo(newRoundEgdeGeosPL[i+1].Last) > 0.01 and newRoundEgdeGeosPL[i].Last.DistanceTo(newRoundEgdeGeosPL[i+1].First)>0.01:
                            newRoundEgdeGeosPL[i].Reverse()
        

                    else:

                        if newRoundEgdeGeosPL[i].First.DistanceTo(newRoundEgdeGeosPL[i-1].Last)>0.01:
                            # print newRoundEgdeGeosPL[i].First
                            # print newRoundEgdeGeosPL[i-1].Last
                            # print newRoundEgdeGeosPL[i].First.DistanceTo(newRoundEgdeGeosPL[i-1].Last)
                            newRoundEgdeGeosPL[i].Reverse()
                            
                # print "after"            
                # for geo in newRoundEgdeGeosPL:
                #     print geo.First
                
                ptList = []
                for edgeGeoPL in newRoundEgdeGeosPL:  
                    for i in range(len(edgeGeoPL)-1):
                        
                        ptList.append(edgeGeoPL[i])
                ptList.append(ptList[0])
                
                # for pt in ptList:
                #     print pt
                # print "-----"
                thisRoundPFGeo = rg.Polyline(ptList).ToPolylineCurve()
                #print thisRoundPFGeo
                thisRoundEdgeGeos = newRoundEgdeGeos
                thisRoundEdgeCats = newRoundEgdeCats
                #print len(thisRoundEdgeGeos)
                #print [crv.PointAtStart  for crv in thisRoundEdgeGeos]
                #print thisRoundEdgeCats
                #thisRoundPFGeo = rg.Curve.JoinCurves(thisRoundEdgeGeos)[0]
                #print ("------finish one of the offset------")
            count=1    
            #print ("finish one offset")
            pFGeoCollection.append(thisRoundPFGeo)
            pEGeoCollection.append(thisRoundEdgeGeos)
            pECatCollection.append(thisRoundEdgeCats)
            
    
        return pFGeoCollection,pEGeoCollection,pECatCollection
        
    @staticmethod
    def CreateListWithProportions_Old(n,a_ratio,b_ratio,c_ratio):
        if n == 1:
            return [1]
        
        else:
            a_count = int(n * a_ratio)
            if a_count<1:
                a_count=1
            b_count = int(n * b_ratio)
            
            if b_count<1:
                b_count=1
            c_count = n - a_count - b_count
            #print a_count,b_count,c_count
            
            if a_ratio + b_ratio + c_count > n:
                c_count = 0
                
            if a_ratio + b_ratio > n:
                b_ratio = n - a_ratio
            
            result_list = [0] * a_count + [1] * b_count + [2] * c_count
            
            return result_list


    @staticmethod
    def CreateListWithProportions(n,a_ratio):
        b_ratio  = 1 - a_ratio
        if n == 1:
            return [1]
        
        else:
            a_count = int(n * a_ratio)
            if a_count<1:
                a_count=1
            b_count = int(n * b_ratio)
            
            if b_count<1:
                b_count=1

            #print a_count,b_count,c_count
            

            if a_count + b_count != n:
                b_count = n - a_count
            
            result_list = [0] * a_count + [1] * b_count
            return result_list
# ---------- end ghpython_script_10 ----------

# ----
# Modules
# Web App function
ghpython_script_11 = GhPythonScript()  # -> out, EV_AccessPoint
# ---------- ghpython_script_11: Python ----------
###########################
####    Import Libs    ####
###########################
import Rhino.Geometry as rg
#import Rhino.RhinoDoc as rd
import Rhino.RhinoMath as rm

import ghpythonlib.components as ghc




class EV_AccessPoint:
    ###########################
    ####       Class       ####
    ###########################
    class AccessPoint:
        def __init__(self,geometry,t):
            self.geometry = geometry
            self.t = t
            self.edgeIndex = None
            self.is_Vertex = False
            self.normal = None
            
    class AccessVertex:
        def __init__(self,geometry,t):
            self.geometry = geometry
            self.t = t
            self.edgeIndex = None
            self.is_Vertex = True
            self.normal = None
            
    class Splitline:
        def __init__(self,geometry):
            self.geometry = geometry
            
            self.scoreEvenArea = None
            self.scoreElongation = None
            self.scoreCompactness = None
            self.scoreConvexity = None
            self.scoreOrientation = None
            
            self.scoreParcelLevel = None

            self.elongationPair = None
            self.areaPair = None
            self.convexityPair  = None
            self.compactnessPair = None
            self.orientationPair = None


    ###########################
    ####     HelpFunc      ####
    ###########################
    @staticmethod
    def EnsureCounterClockwise(inputPolyline):
        inputPolylineCurve = inputPolyline.ToPolylineCurve()
        if inputPolylineCurve.ClosedCurveOrientation().ToString() == "Clockwise":
            inputPolyline.Reverse()
            #print ("reverse it from Clockwise to CounterClockwise")
        else:
            #print ("its CounterClockwise originally")
            pass

    @staticmethod
    def InitializeNodes(inputPolyline,segments,divNum):

        ### get vertices position
        vertices = []
        for point3d in inputPolyline:
            vertices.append(point3d)
            
        ### remove the seam point
        vertices.pop()

        vertices_t =[]
        for v in vertices:
            vertices_t.append(inputPolyline.ClosestParameter(v))
        
        ### get betweenPts position
        inputPolylineCurve= inputPolyline.ToPolylineCurve()
        divPts_t = inputPolylineCurve.DivideByCount(divNum,False)
        divPts=[]

        for t in divPts_t:
            divPts.append(inputPolylineCurve.PointAt(t))

        ### Join all the t , sort the order
        all_t = []
        for t in vertices_t:
            all_t.append(t)
        for t in divPts_t:
            all_t.append(t)

        all_t.sort()

        ### Retrieve the geometry in order
        accessPt_All = []
        for t in all_t:
            accessPt_All.append(inputPolylineCurve.PointAt(t))

        ### Initialize the nodes in orders. fill edge info for vertices first
        nodes=[]
        for i in range(len(all_t)):
            if all_t[i] in vertices_t:
                for j in range(len(vertices_t)):
                    if all_t[i] == vertices_t[j]:
                        temp = EV_AccessPoint.AccessVertex(inputPolylineCurve.PointAt(all_t[i]),all_t[i])
                        if j == 0:
                            temp.edgeIndex=[len(vertices_t)-1,j]
                        else:
                            temp.edgeIndex=[j-1,j]
            
                        nodes.append(temp)
                        

            else:
                nodes.append(EV_AccessPoint.AccessPoint(inputPolylineCurve.PointAt(all_t[i]),all_t[i]))
        
        
        ### extract the AccessPoint node to fill edge info        
        nodes_Pt=[]

        for node in nodes:
            if node.edgeIndex==None:
                nodes_Pt.append(node)


        for node in nodes_Pt:
            for i in range(len(vertices_t)):
                if node.t >= vertices_t[i]:
                    node.edgeIndex = i

        ### extract the AccessPoint node to fill edge info 
        

        for i in range(len(nodes)):
            if nodes[i].is_Vertex == True:
                nodes[i].normal = EV_AccessPoint.GetTheBisectorVec(nodes,i,segments)
            else:
                nodes[i].normal = EV_AccessPoint.GetThePerpendicularVec(nodes,i,segments)
                
        return nodes

    @staticmethod
    def CheckNodesNormal(nodes,inputPolyline):
        inputPolylineCrv = inputPolyline.ToPolylineCurve()
        for node in nodes:
            pt = node.geometry
            newPt = rg.Point3d.Add(pt,node.normal)
            if int(inputPolylineCrv.Contains(newPt)) != 1:
                node.normal = - node.normal
        
    @staticmethod
    def GetThePerpendicularVec(nodes,index,segments):
        edgeIndex = nodes[index].edgeIndex
        normal = segments[edgeIndex].To - segments[edgeIndex].From
        Zaxis = rg.Plane.WorldXY.Normal
        rg.Vector3d.Rotate(normal,rm.ToRadians(90),Zaxis)
        normal.Unitize()
        normal =  normal
        return normal

    @staticmethod   
    def GetTheBisectorVec(nodes,index,segments):
        
        edgeIndices = nodes[index].edgeIndex
        index_a = edgeIndices[0]
        index_b = edgeIndices[1]
        
        vc_a = segments[index_a].From - segments[index_a].To 
        vc_b = segments[index_b].To - segments[index_b].From
        vc_a.Unitize()
        vc_b.Unitize()
        normal = vc_a + vc_b
        normal.Unitize()
        normal =  normal
        return normal

    ### Not in use currently
    @staticmethod 
    def GetThePerpendicularLine(nodes,index,distance):
        
        newPt = rg.Point3d.Add(nodes[index].geometry,nodes[index].normal * distance)
        line = rg.Line(nodes[index].geometry,newPt)
        return line

    ### Not in use currently
    @staticmethod 
    def GetTheBisectorLine(nodes,index,distance):
        
        newPt = rg.Point3d.Add(nodes[index].geometry,nodes[index].normal * distance)
        line = rg.Line(nodes[index].geometry,newPt)
        return line

    ### Not in use currently
    @staticmethod 
    def CheckVaildBezierCurve(userInputPair,inputPolyline,nodes,segments,distance,minL,maxL):
        pt_intersected = None
        streamline = None
        
        lines = []
        for index in userInputPair:
            if nodes[index].is_Vertex == True:
                line = GetTheBisectorLine(nodes,index,segments,distance)
                lines.append(line)
            else:
                
                line = GetThePerpendicularLine(nodes,index,segments,distance)
                lines.append(line)

        rc, a, b = rg.Intersect.Intersection.LineLine(lines[0],lines[1])
        pt_a = nodes[userInputPair[0]].geometry
        pt_b = nodes[userInputPair[1]].geometry
        
        ### check if there is an intersection point  
        if (not rc) or a<0 or b<0:
            print ("No intersection found.")
            

        ### check if the intersection point inside
        else:
            pt_intersected = lines[0].PointAt(a)
            
            inputPolylineCurve = inputPolyline.ToPolylineCurve()
            if inputPolylineCurve.Contains(pt_intersected).ToString() == "Inside":
                ptList= [pt_a, pt_intersected,pt_b]
                streamline = rg.NurbsCurve.Create(False,2,ptList)
                mtol = 0.001
                atol = 0.001
                streamline = streamline.ToPolyline(mtol,atol,minL,maxL)
            
            else:
                print ("The intersetion point is outside.")
        
        return pt_intersected,streamline

    @staticmethod 
    def GetStrightLine(userInputPair,nodes):
        
        pt_a = nodes[userInputPair[0]].geometry
        pt_b = nodes[userInputPair[1]].geometry
        line = rg.Line(pt_a,pt_b)
        
        return line
   
            
    @staticmethod
    def CheckStrightLineValidity(line,inputPolyline):
        tol=0.001
        
        if rg.Intersect.Intersection.CurveLine(inputPolyline.ToPolylineCurve(),line,tol,tol).Count==2:
            return "valid"
        else:
            return "invalid"
        
    
    @staticmethod 
    def GetDetectRegion(line,moveDist):
        direction = rg.Vector3d(line.To - line.From)
        direction2 = rg.Vector3d(direction)

        wxy_Plane=rg.Plane.WorldXY
        ZAxis=wxy_Plane.ZAxis
        direction2.Rotate(rm.ToRadians(90),ZAxis)
        direction2.Unitize()

        
        pt1 = rg.Point3d.Add(line.From,direction2*moveDist)
        pt2 = rg.Point3d.Add(line.From,-direction2*moveDist)
        pt3 = rg.Point3d.Add(line.To,-direction2*moveDist)
        pt4 = rg.Point3d.Add(line.To,direction2*moveDist)
        detectRegion= rg.Polyline([pt1,pt2,pt3,pt4,pt1])

        newPlane = rg.Plane(rg.Point3d(0,0,0),direction2,direction)

        detectRegion = rg.Rectangle3d(newPlane,pt1,pt3)
        
        return detectRegion

    @staticmethod 
    def GetBezierCrvOptions_Old(detectRegion,inputPolyline,nodes,userInputPair,populateNum):
        points = ghc.Populate2D(detectRegion,populateNum,1)

        bCurveList = []
        bCurveList_Valid = []
        mtol = 0.001
        atol = 0.01745329

        ### bCrv 
        pt_a = nodes[userInputPair[0]].geometry
        pt_b = nodes[userInputPair[1]].geometry

        ### generate valid bCrvs
        for pt in points:
            ptList= [pt_a, pt,pt_b]
            streamline = rg.NurbsCurve.Create(False,2,ptList)
            bCurveList.append(streamline)

        inputPolylineCurve = inputPolyline.ToPolylineCurve()

        ### select valid bCrvs
        for bCurve in bCurveList:
            
            if rg.Intersect.Intersection.CurveCurve(bCurve,inputPolylineCurve,mtol,mtol).Count ==2 and int(inputPolylineCurve.Contains(bCurve.PointAt(bCurve.Domain.Mid))) == 1:
                bCurveList_Valid.append(bCurve)

        return bCurveList_Valid,points

    @staticmethod 
    def GetBezierCrvOptions(detectRegion,inputPolyline,closestPoint_A,closestPoint_B,populateNum):
        points = ghc.Populate2D(detectRegion,populateNum,1)
        #print points
        bCurveList = []
        bCurveList_Valid = []
        mtol = 0.001
        atol = 0.01745329

        ### bCrv 
        pt_a = closestPoint_A
        pt_b = closestPoint_B

        ### generate valid bCrvs
        for pt in points:
            ptList= [pt_a, pt,pt_b]
            streamline = rg.NurbsCurve.Create(False,2,ptList)
            bCurveList.append(streamline)

        inputPolylineCurve = inputPolyline.ToPolylineCurve()

        ### select valid bCrvs
        for bCurve in bCurveList:
            
            if rg.Intersect.Intersection.CurveCurve(bCurve,inputPolylineCurve,mtol,mtol).Count ==2 and int(inputPolylineCurve.Contains(bCurve.PointAt(bCurve.Domain.Mid))) == 1:
                bCurveList_Valid.append(bCurve)

        return bCurveList_Valid,points,bCurveList
        
        
    @staticmethod 
    def InitializeSplitlines(bCrvOptions,score_EvenArea,score_Elongation,score_Compactness,score_Convexity,score_Orientation,score_Overall,elongationPairCollection,areaPairCollection,convexityPairCollection,compactnessPairCollection,orientationPairCollection):
        sls = []
        for i in range(len(bCrvOptions)):
            sl = EV_AccessPoint.Splitline(bCrvOptions[i])
            
            sl.scoreEvenArea = score_EvenArea[i]
            sl.scoreElongation = score_Elongation[i]
            sl.scoreCompactness = score_Compactness[i]
            sl.scoreConvexity = score_Convexity[i]
            sl.scoreOrientation = score_Orientation[i]
            
            sl.scoreParcelLevel = score_Overall[i]

            sl.elongationPair = elongationPairCollection[i]
            sl.areaPair = areaPairCollection[i]
            sl.convexityPair  = convexityPairCollection[i]
            sl.compactnessPair = compactnessPairCollection[i]
            sl.orientationPair = orientationPairCollection[i]
            
            sls.append(sl)
        
        return sls

    @staticmethod 
    def SelectBestSplitline(sls):
        scores=[]
        for sl in sls:
        
            scores.append(sl.scoreParcelLevel)

        index = scores.index(max(scores))
        bestSl = sls[index].geometry
        
        return bestSl

    @staticmethod 
    def ConvertNurbcurveToPolyline(nCrv,divNum):
        ts = nCrv.DivideByCount(divNum,True)
        divPts = [] 
        for t in ts:
            divPts.append(nCrv.PointAt(t))
        
        polyL = rg.Polyline(divPts)
        
        return polyL
    ### for streamline compute
    @staticmethod 
    def CheckPositionIndex(inputPolyline,pt):
        tol = 0.001
        #### Method 1 : didnt simplify 
        numSegment = inputPolyline.SegmentCount
        for i in range(numSegment):
            thisSeg =  inputPolyline.SegmentAt(i)
            if thisSeg.DistanceTo(pt,True) < tol:
                position = i
        return position
    
    @staticmethod 
    def CheckPositionIndex_Simplified(newedges,pt):
        tol = 0.001
        
        ##### Method 2 : didnt simplified
        distances = []
        numedge= len(newedges)
        for i in range(numedge):
            thisEdge= newedges[i]
            closestPt_t = thisEdge.ClosestParameter (pt)
            closestPt = thisEdge.PointAt(closestPt_t)
            
            distances.append(closestPt.DistanceTo(pt))

        position = distances.index(min(distances))
        return position
    
    @staticmethod 
    def CheckStreamLineValidity_Old (PC,inputPolyline,streamline,nodes,userInputPair):  
        newedges = PC.ProcessMesh.GetNewEdges(inputPolyline)
        nodePosition_0 = EV_AccessPoint.CheckPositionIndex_Simplified(newedges,nodes[userInputPair[0]].geometry)
        nodePosition_1 = EV_AccessPoint.CheckPositionIndex_Simplified(newedges,nodes[userInputPair[1]].geometry)
        streamline_StartPosition = EV_AccessPoint.CheckPositionIndex_Simplified(newedges,streamline.First)
        streamline_EndPosition = EV_AccessPoint.CheckPositionIndex_Simplified(newedges,streamline.Last)
        #print ("nodePosition_0:",nodePosition_0,"nodePosition_1:",nodePosition_1,streamline_StartPosition,streamline_EndPosition)
        if (streamline_StartPosition == nodePosition_0 and streamline_EndPosition == nodePosition_1) or (streamline_StartPosition == nodePosition_1 and streamline_EndPosition == nodePosition_0):
            return "valid"
        else:
            return "invalid"
    
    @staticmethod 
    def CheckStreamLineValidity (PC,inputPolyline,streamline,closestPoint_A,closestPoint_B):  
        newedges = PC.ProcessMesh.GetNewEdges(inputPolyline)
        nodePosition_0 = EV_AccessPoint.CheckPositionIndex_Simplified(newedges,closestPoint_A)
        nodePosition_1 = EV_AccessPoint.CheckPositionIndex_Simplified(newedges,closestPoint_B)
        streamline_StartPosition = EV_AccessPoint.CheckPositionIndex_Simplified(newedges,streamline.First)
        streamline_EndPosition = EV_AccessPoint.CheckPositionIndex_Simplified(newedges,streamline.Last)
        print ("nodePosition_0:",nodePosition_0,"nodePosition_1:",nodePosition_1,streamline_StartPosition,streamline_EndPosition)
        if (streamline_StartPosition == nodePosition_0 and streamline_EndPosition == nodePosition_1) or (streamline_StartPosition == nodePosition_1 and streamline_EndPosition == nodePosition_0):
            return "valid"
        else:
            return "invalid"
            
    ### for desicion making
    @staticmethod
    def CompareStreamlineCloseToNode(streamlineA,streamlineB,closestPoint_A,closestPoint_B):
         
        distA =  streamlineA.Last.DistanceTo(closestPoint_A)
        distB =  streamlineB.Last.DistanceTo(closestPoint_B)
        
        if distA <= distB:
            return streamlineA
        else:
            return streamlineB
    
    @staticmethod
    def DecideFinalStreamline(streamlineA,validity_A,streamlineB,validity_B,strightLine,validity_Straight,closestPoint_A,closestPoint_B,preference,bestSl):
        finalDesicion = []

        if validity_A == "valid" and validity_B == "invalid":
            finalDesicion = streamlineA
            
        elif validity_A == "invalid" and validity_B == "valid":
            finalDesicion = streamlineB
            
        elif validity_A == "valid" and validity_B == "valid":
            
            finalDesicion = EV_AccessPoint.CompareStreamlineCloseToNode(streamlineA,streamlineB,closestPoint_A,closestPoint_B)
        
         
        elif validity_A == "invalid" and validity_B == "invalid":
            
            if preference == "straight":   
                if validity_Straight == "valid":
                    finalDesicion = strightLine
                elif validity_Straight == "invalid":
                    finalDesicion = bestSl
                    
            elif preference == "bcrv":
                 finalDesicion = bestSl
            
        return [finalDesicion]
        
    
    
    ###########################
    ####     PreView       ####
    ###########################
    @staticmethod 
    def PreviewNodeInfo(nodes):
        anchors=[]
        edgeLabel=[]
        normals=[]

        for node in nodes:
            anchors.append(node.geometry)
            edgeLabel.append(node.edgeIndex)
            normals.append(node.normal)

        return anchors,edgeLabel,normals
# ---------- end ghpython_script_11 ----------
ghpython_script_12 = GhPythonScript()  # -> out, WebApp_Func
# ---------- ghpython_script_12: Python ----------
import Rhino.Geometry as rg
#import Rhino.RhinoDoc as rd
import Rhino.RhinoMath as rm
import Rhino as rh

class WebApp_Func:
    @staticmethod
    def RelocateGeo(geo,sourceCenter,tartgetCenter):
        xChange = sourceCenter.X - tartgetCenter.X
        yChange = sourceCenter.Y - tartgetCenter.Y
        zChange = sourceCenter.Z - tartgetCenter.Z

        ### polyline case
        if isinstance(geo, rg.Polyline):
            newPts = []
            for point in geo:
                newPts.append(rg.Point3d(point.X - xChange,point.Y - yChange ,point.Z - zChange))
                newPolyL = rg.Polyline(newPts)
                newGeo = newPolyL
        elif isinstance(geo, rg.Point3d):
            newPt = rg.Point3d(geo.X - xChange,geo.Y - yChange ,geo.Z - zChange)
            newGeo = newPt
        return newGeo

    @staticmethod
    def RelocateGeoToOrigin(geo,sourceCenter):
        tartgetCenter = rg.Point3d(0,0,0)
        
        if isinstance(geo, rg.Polyline):
            sourceCenter = rg.AreaMassProperties.Compute(geo.ToPolylineCurve()).Centroid
            newPolyL = WebApp_Func.RelocateGeo(geo,sourceCenter,tartgetCenter)
            newGeo = newPolyL
        
        elif isinstance(geo, rg.Point3d):
            
            
            newPt = WebApp_Func.RelocateGeo(geo,sourceCenter,tartgetCenter)
            newGeo = newPt
            
        return newGeo
        
    @staticmethod
    def RelocateGeoFromorigin(geo,tartgetCenter):
    
        sourceCenter = rg.Point3d(0,0,0)
    
        if isinstance(geo, rg.Polyline) or isinstance(geo, rg.PolylineCurve):
            newPolyL = WebApp_Func.RelocateGeo(geo,sourceCenter,tartgetCenter)
            newGeo = newPolyL
        elif isinstance(geo, rg.Point3d):
            newPt = WebApp_Func.RelocateGeo(geo,sourceCenter,tartgetCenter)
            newGeo = newPt
        return newGeo
    
    @staticmethod
    def RelocateGeo(geo,sourceCenter,tartgetCenter):
        xChange = sourceCenter.X - tartgetCenter.X
        yChange = sourceCenter.Y - tartgetCenter.Y
        zChange = sourceCenter.Z - tartgetCenter.Z
    
        ### polyline case
        if isinstance(geo, rg.Polyline):
            newPts = []
            for point in geo:
                newPts.append(rg.Point3d(point.X - xChange,point.Y - yChange ,point.Z - zChange))
                newPolyL = rg.Polyline(newPts)
                newGeo = newPolyL
                
        elif isinstance(geo, rg.PolylineCurve) or isinstance(geo, rg.LineCurve) or isinstance(geo, rg.PolyCurve):
            newGeo = geo
            movingVec = tartgetCenter- sourceCenter
            newGeo.Transform(rg.Transform.Translation(movingVec.X,movingVec.Y,movingVec.Z))
            
        elif isinstance(geo, rg.Point3d):
            newPt = rg.Point3d(geo.X - xChange,geo.Y - yChange ,geo.Z - zChange)
            newGeo = newPt
        return newGeo

    @staticmethod
    def MoveFromOriginAndScaleAllParcels(parcels,targetPoint,scale):
        newParcels = []
        for parcel in parcels:
            newParcels.append(WebApp_Func.MoveFromOriginAndScale(parcel,targetPoint,scale))
        return newParcels
    
    @staticmethod
    def MoveFromOriginAndScale(geo,targetPoint,scale):
        geo_New = WebApp_Func.RelocateGeoFromOrigin(geo,targetPoint)
        transform = rg.Transform.Scale(targetPoint,scale)
        geo_New.Transform(transform)
        return geo_New
    
    @staticmethod
    def RelocateGeoFromOrigin(geo,tartgetCenter):
    
        sourceCenter = rg.Point3d(0,0,0)
    
        if isinstance(geo, rg.Polyline) or isinstance(geo, rg.PolylineCurve) or isinstance(geo, rg.LineCurve) or isinstance(geo, rg.PolyCurve):
            newPolyL = WebApp_Func.RelocateGeo(geo,sourceCenter,tartgetCenter)
            newGeo = newPolyL
        elif isinstance(geo, rg.Point3d):
            newPt = WebApp_Func.RelocateGeo(geo,sourceCenter,tartgetCenter)
            newGeo = newPt
        return newGeo
        


    @staticmethod     
    def DracoCompression_MoveZ(polyL):
        mesh= rg.Mesh.CreateFromClosedPolyline(polyL)
        movement = rg.Transform.Translation(0,0,1)
        mesh.Transform(movement)
        options =  rh.FileIO.DracoCompressionOptions()
        options.CompressionLevel = 5
        options.IncludeTextureCoordinates = False
        options.IncludeVertexColors = False

        compressed = rh.FileIO.DracoCompression.Compress(mesh, options)
        base64Draco = compressed.ToBase64String()
        return base64Draco
        
    #########################################################
    #############     OutPut to JS       ####################
    #########################################################
    @staticmethod  
    def AssignWebTreeID(allNodes):
        count = 0
        for node in allNodes:
            node.webTreeID = count
            count+=1
    
    @staticmethod
    def StoreInfoIntoDict(allNodes,meshDracos):
        treeDict = {}

        for node in allNodes:
            key = node.webTreeID
            value = {}
            value["meshDraco"] = meshDracos[node.webTreeID]  #### currently its polyline 
            
            if node.parent != None:
                value["parent"] = node.parent.webTreeID  #### currently its polyline 
            else:
                value["parent"] = "None"
            
        
            childrenID = []
            if node.child_A!= None:
                childrenID.append(node.child_A.webTreeID)
            if node.child_B!= None:
                childrenID.append(node.child_B.webTreeID)
            if node.child_C!= None:
                childrenID.append(node.child_C.webTreeID)
                
            value["children"] = childrenID
            
            value["depth"] = node.depth
            treeDict[key] = value
        
        return treeDict
    
    @staticmethod
    def ExportToSperateDict(treeDict):
        IDList = []
        childrenList = []
        parentList = []
        depthList = []
        dracoList = []

        for key in treeDict.keys():
            IDList.append(key)
            childrenList.append(treeDict[key]["children"])
            parentList.append(treeDict[key]["parent"])
            depthList.append(treeDict[key]["depth"])
            dracoList.append(treeDict[key]["meshDraco"])
        
        return IDList,childrenList,parentList,depthList,dracoList
    
    @staticmethod
    def GetEvaluationValueList(EV,polyLs):
        areaList = []
        orientationList = []
        elongationList = []
        compactnessList = []
        convexityList = []
        
        for polyL in polyLs:
            
            ###convert type
            if isinstance(polyL,rg.PolylineCurve)!=True:
                polyLCrv = polyL.ToPolylineCurve()
            else:
                polyLCrv = polyL
                
            area = rg.AreaMassProperties.Compute(polyLCrv).Area
            orientation =  rm.ToDegrees(EV.EvaluateOrientation(polyLCrv,0)) #angle against X-axis
            elongation = EV.EvaluateElongation(polyLCrv)
            compactness = EV.EvaluateCompactness(polyLCrv)
            convexity = EV.EvaluateConvexity(polyLCrv)
            
            areaList.append(area)
            orientationList.append(orientation)
            elongationList.append(elongation)
            compactnessList.append(compactness)
            convexityList.append(convexity)

        return areaList,orientationList,elongationList,compactnessList,convexityList
# ---------- end ghpython_script_12 ----------

coords = GetString(panel, AtLeast=1, AtMost=1, TreeAccess=False)
pointay = GetNumber("142820.2983357521", AtLeast=1, AtMost=1, Maximum=1.797693135e+308, Minimum=-1.797693135e+308, TreeAccess=False)
pointbx = GetNumber("11559951.782512307", AtLeast=1, AtMost=1, Maximum=1.797693135e+308, Minimum=-1.797693135e+308, TreeAccess=False)
pointax = GetNumber(panel_2, AtLeast=1, AtMost=1, Maximum=1.797693135e+308, Minimum=-1.797693135e+308, TreeAccess=False)
pointby = GetNumber("142642.7433042495", AtLeast=1, AtMost=1, Maximum=1.797693135e+308, Minimum=-1.797693135e+308, TreeAccess=False)
# GIS_INPUT
ghpython_script_13 = GhPythonScript(input_string=coords)  # -> out, inputPolyline
# ---------- ghpython_script_13: Python ----------
import Rhino.Geometry as rg
#import Rhino.RhinoDoc as rd
import Rhino.RhinoMath as rm

# Added by Anna vvv
x_val = []
y_val = []
inputGIS = []
items = input_string.split(',')

for i in range(len(items)):
    if i%2 == 0:
        x_val.append(float(items[i]))
    else:
        y_val.append(float(items[i]))

for i in range(len(x_val)):
    inputGIS.append([x_val[i], y_val[i]])
# Added by Anna ^^^

"""
inputGIS = [ [11572150.257125726,150540.92751019588],
          [11572293.031019911,150415.32117484743],
          [11572368.605708903,150244.4983472939],
          [11571811.542666271,149810.67580068656],
          [11571493.165541334,150216.41114526242],
          [11571905.981938206,150348.29488085952],
          [11572150.257125726,150540.92751019588]]
"""

inputVertices = []

for list in inputGIS:
    inputVertices.append(rg.Point3d(list[0],list[1],0))

inputPolyline = [rg.Polyline(inputVertices)]
# ---------- end ghpython_script_13 ----------

# ----
# Road category para
# first%
# second% will be 1-first%
road_percentage = Panel("0.6")
roads = GetNumber(road_percentage, AtLeast=1, AtMost=1, Maximum=1.797693135e+308, Minimum=-1.797693135e+308, TreeAccess=False)

minarea = GetInteger(min_area, AtLeast=1, AtMost=1, Maximum=2147483647, Minimum=-2147483648, TreeAccess=False)
orientation_2 = GetInteger(idealorientation, AtLeast=1, AtMost=1, Maximum=2147483647, Minimum=-2147483648, TreeAccess=False)
construct_point = ConstructPoint(XCoordinate=pointax, YCoordinate=pointay, ZCoordinate=0)
construct_point_2 = ConstructPoint(XCoordinate=pointbx, YCoordinate=pointby, ZCoordinate=0)
crv = Curve(ghpython_script_13.inputPolyline)
merge = Merge(
    Data1=vanchorstrength,
    Data2=voncrvstrength,
    Data3=panchorstrength,
    Data4=roadsmoothstrength,
    Data5=roadjunctionanglestrength,
    Data6=parcelsidesmoothstrength,
    Data7=parcelsideanglestrength,
    Data8=parcelsidelengthstrength,
    Data9=parceladjacencystrength)
lengthvsangle = GetNumber(wa, AtLeast=1, AtMost=1, Maximum=1.797693135e+308, Minimum=-1.797693135e+308, TreeAccess=False)
weights = GetString("0.2,3.5,2.1,4,0,1.7,0", AtLeast=1, AtMost=1, TreeAccess=False)

# ---- group: Area
# Total Site Area Display
area = Area(Geometry=crv)  # -> Area, Centroid
panel_3 = Panel(area.Area)

# ----
merge_2 = Merge(Data1=construct_point, Data2=construct_point_2)
# Doubleclick Me!
# NakedEdgeIndicies
num = Number(roads)
ghpython_script_14 = GhPythonScript(x=weights)  # -> out, flatten(a)
# ---------- ghpython_script_14: Python ----------
__author__ = "Anna Yenardi"
__version__ = "2023.08.03"

import rhinoscriptsyntax as rs
temp = x.split(",")
a = []
for e in temp:
    a.append(float(e))
# ---------- end ghpython_script_14 ----------

# ---- group: Web app scale func
# Input Parcel Boundary
python_3 = GhPythonScript(WebApp_Func=ghpython_script_12.WebApp_Func, inputPolyline=crv, userInputPair=merge_2, minArea=minarea)  # -> out, inputPolyline_New, userInputPair, scale, sourceCenter, minArea; inputs inputPolyline: Polyline, userInputPair: list of Point3d
# ---------- python_3: Python ----------
import Rhino.Geometry as rg
import Rhino.RhinoDoc as rd
import Rhino.RhinoMath as rm
import ghpythonlib.components as ghc
import math


userInput_A = userInputPair[0]
userInput_B = userInputPair[1]

### Prepare
closestPoint_A_t = inputPolyline.ClosestParameter(userInput_A)
closestPoint_B_t = inputPolyline.ClosestParameter (userInput_B)

Xs = []
Ys =[]
for i in range(len(inputPolyline)):
    Xs.append(inputPolyline[i].X)
    Ys.append(inputPolyline[i].Y)

maxPt = rg.Point3d(max(Xs),max(Ys),0)
minPt = rg.Point3d(min(Xs),min(Ys),0)


obbFlat = rg.Rectangle3d(rg.Plane.WorldXY,maxPt,minPt)

area = obbFlat.Area
scale = math.sqrt(area/10000)
print area

### move to origin
sourceCenter = rg.AreaMassProperties.Compute(inputPolyline.ToPolylineCurve()).Centroid
inputPolyline_New = WebApp_Func.RelocateGeoToOrigin(inputPolyline,sourceCenter)   

### scale to 100x100
sourceCenter_New = rg.AreaMassProperties.Compute(inputPolyline_New.ToPolylineCurve()).Centroid
transform = rg.Transform.Scale(sourceCenter_New,1/scale)
inputPolyline_New.Transform(transform)
#
userInput_A_New = inputPolyline_New.PointAt(closestPoint_A_t)
userInput_B_New = inputPolyline_New.PointAt(closestPoint_B_t)

userInputPair = [userInput_A_New,userInput_B_New]     # output
inputPolyline_New = [inputPolyline_New] # output



minArea = minArea/(scale**2)
# ---------- end python_3 ----------

# ----
# Access point detail setting
idealorientation_2 = Slider(1, range=0..10)
idealelongation = Slider(1.5, range=0..10)
idealcompactness = Slider(1, range=0..10)
idealconvexity = Slider(1, range=0..10)
populatenum = Slider(100, range=0..100)
movedist = Slider(50, range=0..200)

# ----
# EvenArea
# Elongation
# Compactness
# Convexity
# Orientation
gene_pool = GenePool(Decimals=2, Maximum=2, Minimum=0, Value=[0.7, 0.4, 0.1, 0.1, 0.1])

# ----
# global resolution control
# streamline spacing control
# maxium depth control
# Streamline split detail control
# Streamline split final result fliter
# Postprocess para
# Road Finding Para
min_elongation = Slider(10, range=0..50)
minconvexity = Slider(0.5, range=0..10)
mincompactness = Slider(0.5, range=0..10)
minorientation = Slider(0.5, range=0..10)
sidelengthpercentage = Slider(0.2, range=0..1)
areatol = Slider(0.8, range=0..1)
# Global computation setting
resolution = Slider(30, range=0..30)
percentagerf = Slider(1, range=0..1)
disablerate = Slider(0.8, range=0..1)
allowtop = Slider(20, range=0..20)
thresholdlvarrate = Slider(0.2, range=0..1)
issurance = Slider(10000, range=0..10000)
max_depth = Slider(100, range=0..100)
pi = Pi(Factor=Slider(0.5, range=0..1))
multiplication = Multiplication(A=minorientation, B=pi)

# ----
# Access Points
ghpython_script_15 = GhPythonScript(
    PC=python.PC,
    DM=python_2.DM,
    SLG=ghpython_script.SLG,
    EV=ghpython_script_2.EV,
    EV_AccessPoint=ghpython_script_11.EV_AccessPoint,
    resolution=resolution,
    inputPolyline=python_3.inputPolyline_New,
    userInputPair=python_3.userInputPair,
    moveDist=movedist,
    populateNum=populatenum,
    idealElongation=idealelongation,
    idealCompactness=idealcompactness,
    idealConvexity=idealconvexity,
    idealOrientation=idealorientation_2,
    weight=gene_pool)  # -> out, Initialize_nodes, nodes, segments, Try_Compute_streamline, streamlineA, validity_A, streamlineB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; inputs inputPolyline: Polyline, divNum: Int32, userInputPair: list of Point3d, weight: list
# ---------- ghpython_script_15: Python ----------
import Rhino.Geometry as rg
#import Rhino.RhinoDoc as rd
import Rhino.RhinoMath as rm

### Sort the input order
EV_AccessPoint.EnsureCounterClockwise(inputPolyline)

### Initialize nodes
#segments = inputPolyline.GetSegments()
#nodes = EV_AccessPoint.InitializeNodes(inputPolyline,segments,divNum)
#EV_AccessPoint.CheckNodesNormal(nodes,inputPolyline)

### Try Compute streamline
processMesh = PC.ProcessMesh()
processMesh.InitializeInput(inputPolyline,resolution)  

mappingGrid = DM.MappingGrid()
mappingGrid.CreateMappingGrid(inputPolyline,20,5)  #rows,columns 
mappingGrid.GetOverlappedTriangleIndex(processMesh,2)  #detectRadius 


seedpointList = SLG.SeedpointList()
seedpointList.CreateSeedpointList(processMesh,1,1)  #reduce points onEdge, on MA

streamlineNetwork=SLG.StreamlineNetwork()

closestPoint_A = inputPolyline.ClosestPoint (userInputPair[0])
closestPoint_B = inputPolyline.ClosestPoint (userInputPair[1])

streamlineA = streamlineNetwork.GetStreamlineOnSpecificPoint(closestPoint_A,mappingGrid,processMesh,2)
streamlineB = streamlineNetwork.GetStreamlineOnSpecificPoint(closestPoint_B,mappingGrid,processMesh,2)


### Detect Location 
validity_A = EV_AccessPoint.CheckStreamLineValidity (PC,inputPolyline,streamlineA,closestPoint_A,closestPoint_B)
validity_B = EV_AccessPoint.CheckStreamLineValidity (PC,inputPolyline,streamlineB,closestPoint_A,closestPoint_B)

### Connect point to get a straight line 
strightLine = rg.Line(closestPoint_A,closestPoint_B)

### Check if straight line valid
validity_Straight = EV_AccessPoint.CheckStrightLineValidity(strightLine,inputPolyline)

### Check if the user is satisfied with this straight line
 
### Create A detect Region and Populate random points to form BezierCrvs
detectRegion = EV_AccessPoint.GetDetectRegion(strightLine,moveDist)

bCurveList_Valid,randomPoints,bCurveList = EV_AccessPoint.GetBezierCrvOptions(detectRegion,inputPolyline,closestPoint_A,closestPoint_B,populateNum)

### Evaluate streamline Parcel Level Score
scoreResult = EV.Score_ParcelLevel(bCurveList_Valid,inputPolyline,idealElongation,idealCompactness,idealConvexity,idealOrientation)
score_EvenArea = scoreResult[0]
score_Elongation = scoreResult[1]
score_Compactness = scoreResult[2]
score_Convexity = scoreResult[3]
score_Orientation = scoreResult[4]

elongationPairCollection = scoreResult[5]
areaPairCollection = scoreResult[6]
convexityPairCollection  = scoreResult[7]
compactnessPairCollection = scoreResult[8]
orientationPairCollection = scoreResult[9]

### Remap the scores 
score_EvenArea = EV.RemapRange(score_EvenArea,1,0)
score_Elongation = EV.RemapRange(score_Elongation,1,0)
score_Compactness = EV.RemapRange(score_Compactness,1,0)
score_Convexity = EV.RemapRange(score_Convexity,1,0)
score_Orientation = EV.RemapRange(score_Orientation,1,0) 
score_Overall = EV.GetScore_ParcelLevel(score_EvenArea,score_Elongation,score_Compactness,score_Convexity,score_Orientation,weight)

### Store in instances
sls = EV_AccessPoint.InitializeSplitlines(bCurveList_Valid,score_EvenArea,score_Elongation,score_Compactness,score_Convexity,score_Orientation,score_Overall,elongationPairCollection,areaPairCollection,convexityPairCollection,compactnessPairCollection,orientationPairCollection)

### Select the best
bestSl = EV_AccessPoint.SelectBestSplitline(sls)
bestSl = EV_AccessPoint.ConvertNurbcurveToPolyline(bestSl,10)
### Do the desicion and pass to next step

finalDesicion = EV_AccessPoint.DecideFinalStreamline(streamlineA,validity_A,streamlineB,validity_B,strightLine,validity_Straight,closestPoint_A,closestPoint_B,"bcrv",bestSl)

### Preview
#anchors,edgeLabel,normals = EV_AccessPoint.PreviewNodeInfo(nodes)
closestPoint_A=closestPoint_A
closestPoint_B=closestPoint_B


newedges = PC.ProcessMesh.GetNewEdges(inputPolyline)
# ---------- end ghpython_script_15 ----------
panel_4 = Panel(ghpython_script_15.out)

# ----
# Pass the Desicion
geometry = Geometry(ghpython_script_15.finalDesicion)
# ----
# Main computation
python_4 = GhPythonScript(
    PC=python.PC,
    DM=python_2.DM,
    SLG=ghpython_script.SLG,
    SPF=ghpython_script_4.SPF,
    PL=ghpython_script_3.PL,
    EV=ghpython_script_2.EV,
    RF=ghpython_script_5.RF,
    PP=ghpython_script_7.PP,
    GRP=ghpython_script_6.GRP,
    crv=python_3.inputPolyline_New,
    finalDesicion=geometry,
    resolution=resolution,
    disableRate=disablerate,
    percentageRF=percentagerf,
    minArea=python_3.minArea,
    areaTol=areatol,
    allowTopNum=allowtop,
    minElongation=min_elongation,
    minConvexity=minconvexity,
    minCompactness=mincompactness,
    minOrientation=multiplication,
    maxDepth=max_depth,
    maxIssurance=issurance,
    idealOrientation=orientation_2,
    weight=ghpython_script_14.a,
    wA=lengthvsangle,
    sideLengthPercentage=sidelengthpercentage,
    thresholdLVarRate=thresholdlvarrate)  # -> out, parcels, Solution_Collection_Space, p0, collection_VP, collection_E, collection_E_All, collection_F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; inputs crv: Polyline, finalDesicion: list of Polyline, allowTopNum: Int32, maxDepth: Int32, maxIssurance: Int32, weight: list
# ---------- python_4: Python ----------
import Rhino.Geometry as rg
#import Rhino.RhinoDoc as rd
import Rhino.RhinoMath as rm
import Rhino.RhinoApp as ra

import scriptcontext
from collections import deque 

import Queue
import math
import time
import gc
gc.collect()
startTime = time.time()
prevTime = time.time()




##################
######Store for debug
##################
parcels=[]
streamlines = []
debugColletion1 = []
debugColletion2 = []


##################
######Animation
##################
parcelListBeforeMerge = []
streamlineList = []
streamlineList.append([])
thisDepthStreamlines = []
##################
######Create Tree
##################


tol = 0.001  ### tol = rd.ActiveDoc.ModelAbsoluteTolerance

# Initialize Collection Space (for Vertex&Point,Edge,Face)
collection_VP= [] 
collection_E= [] 
collection_E_All= [] 
collection_F= [] 
#collection_F_Dict =[]
# For redirection
redirectMap = {}

# Initialize Root
p0 = PL.ParcFace()
p0.FormParcFace_First(crv,0)
p0.name = 0
p0.depth=0

parcelListBeforeMerge.append([p0.GetGeometry()])


#p0.sides = [[0,1,2,3,4,5],[6,7],[8,9],[10,11,12,13]]         
#allEdgeIDLists = [[0,1,2,3,4,5],[6,7],[8,9],[10,11,12,13]]    
p0.sides = PC.ProcessMesh().GetCombindedEgdeIndices(crv) 

allEdgeIDLists = PC.ProcessMesh().GetCombindedEgdeIndices(crv)

sameSideList = []
for side in p0.sides:
    if len(side) >=2:
        sameSideList.append(side)
        

    

# Create Global Dict
VP_Dict_L0 = {}
VP_Istance_L0 =p0.GetVPInstance()
for instance in VP_Istance_L0:
    VP_Dict_L0[instance.ID] = instance
    
E_Dict_L0 = {}
E_Istance_L0 = p0.GetEInstance()
for instance in E_Istance_L0:
    E_Dict_L0[instance.ID] = instance
    
# store into collection
currQ = [p0]
currQ_Dict = {}
currQ_Dict[p0.ID] = p0


collection_VP.append(VP_Dict_L0)  ### they are dict
collection_E.append(E_Dict_L0)  ### they are dict
collection_E_All.append(E_Dict_L0) ### they are dict
collection_F.append(currQ_Dict) ### they are list
#collection_F_Dict.append(currQ_Dict) ### they are dict

# Initialize Collection Space (for Road)/Initialize Root

roadFindingThreshold = RF.GetRoadFindingThreshold(crv, minArea,percentageRF)
roadFindingThreshold = 99

#roadFindingThreshold = 6

# Initialize Collection Space (for Graph)
collection_ParcelGraph = []
collection_JunctionGraph = []
collection_ParcEdgeGraph = []
collection_StreetGraph = []

parcelGraph_L0 = GRP.ParcelGraph()
parcelGraph_L0.graph[p0] = {}
collection_ParcelGraph.append(parcelGraph_L0)
streetGraph_L0 = GRP.StreetGraph()   #### it will be different if I assign intially


allStreets = []

### InitializedStreets

allStreets = RF.InitializedStreets(p0,allEdgeIDLists,E_Dict_L0,streetGraph_L0)
for street in allStreets:
    streetGraph_L0.AddStreet(street,E_Dict_L0)


collection_StreetGraph.append(streetGraph_L0)

junctionGraph_L0  = GRP.JunctionGraph.CreateJunctionGraphForThisDepth(E_Dict_L0)
collection_JunctionGraph.append(junctionGraph_L0)

parcEdgeGraph_L0 = GRP.ParcEdgeGraph.CreateParcEdgeGraphForThisDepth(junctionGraph_L0)
collection_ParcEdgeGraph.append(parcEdgeGraph_L0)


##### Start Loop
### Prepare 

issurance = 0
lastDepth = 0
currDepth = 0
currVP_Dict = SPF.GetDeepCopyDict_VP(VP_Dict_L0)
currE_Dict_All = SPF.GetDeepCopyDict_E_All(currVP_Dict,E_Dict_L0)
currE_Dict = SPF.GetDeepCopyDict_E(E_Dict_L0,currE_Dict_All)

currQ = SPF.GetDeepCopyParcFace_Q(currQ,currVP_Dict,currE_Dict,currE_Dict_All,redirectMap)
currQ_Dict =SPF.GetDeepCopyParcFace_Dict(currQ)


currParcelGraph = collection_ParcelGraph[-1].DeepCopy(currQ_Dict,currE_Dict)
currJunctionGraph = collection_JunctionGraph[-1].DeepCopy(currVP_Dict,currE_Dict)
currStreetGraph = collection_StreetGraph[-1].DeepCopy(currVP_Dict,currE_Dict)
print ("【【【【【【【【【【【【【【--- Moving to next depth %d---】】】】】】】】】】】】】】】】" %currDepth)
ra.WriteLine("【【【【【【【【【【【【【【--- Moving to next depth %d---】】】】】】】】】】】】】】】】" %currDepth)


#maxDepth = 10
while currQ[0].depth <= maxDepth:
    # for NY
    # if currQ[0].ID == 110:
    #     currQ[0].alive = False
    #     thispF = currQ[0]
    #     currQ.popleft()
    #     currQ.append(thispF)
    #     continue
    
    #for SL access
    # if currQ[0].ID == 89 or currQ[0].ID == 94  :
    #     currQ[0].alive = False
    #     thispF = currQ[0]
    #     currQ.popleft()
    #     currQ.append(thispF)
    #     continue
    
    
    # print currStreetGraph.graph.keys()
    # print currStreetGraph.GetAllParcEdgeAndTwinID()
#iterationTime = 6
#for time in range(iterationTime):
    #region Stop Condition Checking 
    ######################################
    #####  Stop Condition Checking   #####
    ######################################
    if issurance > maxIssurance:
        print ("End: Hit max issurance")
        ra.WriteLine("End: Hit max issurance")
        break
    
    #if scriptcontext.escape_test(False):
        #print ("ESC pressed ")
        #break 
    
    allDeadTag = SPF.CheckIfAllNodesDead(currQ)
    if allDeadTag == True:
        # mergedEdgeIndices,mergedEdgeNewVs = PP.CheckMergeEdge(PL,currQ,currE_Dict,currVP_Dict,sideLengthPercentage,debugColletion1,debugColletion2)
        # PP.CheckStreetChangedByMerge(RF,currStreetGraph,mergedEdgeIndices,mergedEdgeNewVs)

        print ("End: All nodes are dead")
        break
    #endregion
    
    #region Important address checking
    ######################################
    ##### Important address checking #####
    ######################################
    
    # print ("Important address checking")
    # Echecktag = SPF.CheckIfEdgeCorrect(currQ,currE_Dict)
    # if Echecktag==False:
    #     print ("CurrQ Edge and Edict are same: No")
    #     break
    # else:
    #     print ("CurrQ Edge and Edict are same")
        
    # PcheckTag = SPF. CheckIfCurrQNeighborsInCurrQ(currQ)
    # if PcheckTag ==False:
    #     print ("CurrQ Neighbors are In CurrQ: No")
    #     break
    # else:
    #     print ("CurrQ Neighbors are In CurrQ")
        
    # PEEPCheckTag = SPF.CheckIfP_EAndE_PCorrect(currQ)
    
    # if PEEPCheckTag ==False:
    #     print ("CurrQ P_E And E_P are correct: No")
    #     print ("quit because of PEEPCheckTag")
    #     break
    # else:
    #     print ("CurrQ P_E And E_P are correct")
    #endregion    

    #region Status info checking    
    ######################################
    #####     Status info checking   #####
    ######################################
    #print ("Status info checking ")
    #print ("All nodes in tree"),
    #SPF.PrintAllNodesAddress(p0)
    
    #print ("curr nodes depth"), 
    #SPF.CheckCurrQDepth(currQ)
    
    #print ("curr nodes alive"),
    #SPF.CheckCurrQAlives(currQ)
    
    #print ("RedirectMap"),
    #SPF.PrintDictionaryAddress(redirectMap)
    #endregion 

    #region Check If need Collection and DeepCopy  
    #####################################################
    #####   Check If need Collection and DeepCopy   #####
    #####################################################
    currNode = currQ[0]
    #print ("CurrNode.depth"),currNode.depth ,("CurrNode address"),id(currNode)
    currDepth=max(currDepth,currNode.depth)
    
    if lastDepth != currDepth:
        
        streamlineList.append(thisDepthStreamlines)
        thisDepthStreamlines = []
        currTime = time.time()
        usedTime = currTime - prevTime
        print ("Time: This Depth %d " %currDepth),"used time is " ,usedTime
        prevTime = currTime
        print ("【【【【【【【【【【【【【【--- Moving to next depth %d---】】】】】】】】】】】】】】】】" %currDepth)
        ra.WriteLine("【【【【【【【【【【【【【【--- Moving to next depth %d---】】】】】】】】】】】】】】】】" %currDepth)
        #SPF.PrintCurrQAddress(currQ)
        
        
        ###################
        inaccessibleParcels = RF.CollectAllInaccesibleParcels(currQ)
        clusterParcelCollection,clusterEdgeCollection = RF.ClusterInAccessibleParcels(inaccessibleParcels)
        parcelNum = []
        for cluster in clusterParcelCollection:
            parcelNum.append(len(cluster)) 
        
       
        ###################
        SPF.RedirectParentChildren(currQ,redirectMap)
        currQ = SPF.FindTheBottomElements_LevelOrder_Q(p0)
        RF.UpdateSideInfo (currQ,currE_Dict_All,sameSideList)
        
        #sideLengthPercentage = 0.2
        
        newPBMList = []
        for pF in currQ:
            if pF.identity != "C":
                newPBMList.append(pF.GetGeometry())
        parcelListBeforeMerge.append(newPBMList)
        
        mergedEdgeIndices,mergedEdgeNewVs = PP.CheckMergeEdge(PL,currQ,currE_Dict,currVP_Dict,sideLengthPercentage,debugColletion1,debugColletion2)
        
        #allStreetNodeIDs = currStreetGraph.GetAllParcVertexID()
        #print "before CheckStreetChangedByMerge allStreetNodeIDs",allStreetNodeIDs
        # print ("street.GetAllParcVertex")
        # for street in currStreetGraph.graph.keys():
        #     street.PrintVIDHeadToEnd()
        #     street.PrintVIDEndToHead()
        #     print ("-----")
        
        PP.CheckStreetChangedByMerge(RF,currStreetGraph,mergedEdgeIndices,mergedEdgeNewVs)

        allStreetNodeIDs = currStreetGraph.GetAllParcVertexID()
        #print "after CheckStreetChangedByMerge allStreetNodeIDs",allStreetNodeIDs
        ### Check if 0 length:
        # for edge in collection_ParcEdgeGraph[-1].graph.keys():
        #     if edge.GetGeometry().Length <0.001:
        #         print ("0length edge.ID"),edge.ID
        #         print ("found 0 length edge")

        #         print ("currE_Dict")
        #         print ([edge.ID for edge in currE_Dict.keys()])
                
        #         break 
        
       
        
        collection_VP.append(currVP_Dict)
        collection_E.append(currE_Dict)
        collection_E_All.append(currE_Dict_All)
        #collection_F.append(currQ)
        collection_F.append(currQ_Dict)
        
        # if currDepth ==9:
        #     break
        
        collection_ParcelGraph.append(GRP.ParcelGraph.CreateParcelGraphForThisDepth(currQ_Dict))
        collection_JunctionGraph.append(GRP.JunctionGraph.CreateJunctionGraphForThisDepth(currE_Dict)) 
        collection_ParcEdgeGraph.append(GRP.ParcEdgeGraph.CreateParcEdgeGraphForThisDepth(collection_JunctionGraph[-1])) 
        
        
        ### Once it append, update the depth (Q doesnot need to update)
        for instance in collection_VP[-1].values():
            instance.depth = len(collection_VP)-1
        for instance in collection_E_All[-1].values():
            instance.depth = len(collection_E_All)-1
            
        collection_ParcelGraph[-1].depth = len(collection_ParcelGraph)-1
        collection_JunctionGraph[-1].depth = len(collection_JunctionGraph)-1
        collection_ParcEdgeGraph[-1].depth = len(collection_ParcEdgeGraph)-1
            
        #####################################################
        #####             Do Road Finding               #####
        #####################################################
    
        #if lastDepth==0 and len(currStreetGraph.graph.keys())==0:   ### the case that without anyroad at the begining
            #pass
        #else:
            #print "in Main,currStreetGraph"
            #allEIDs = currStreetGraph.GetAllParcEdgeID()
            #print allEIDs
            #print "in previous depth, there are this number of street ",len(currStreetGraph.graph.keys())
        

        #RF.PrintInaccessibleParcels(currQ,currE_Dict)
        
        # #########
        # #### Road Finding WIP
        # #########
        # inaccessibleParcels = RF.CollectAllInaccesibleParcels(currQ)
        # clusterParcelCollection,clusterEdgeCollection = RF.ClusterInAccessibleParcels(inaccessibleParcels)
        # relatedNumClusters = []
        # for cluster in clusterParcelCollection:
        #     relatedNumClusters.append([cluster,len(cluster)])
        
        # relatedNumClusters = sorted(relatedNumClusters,key=lambda x: (-x[1]))  ### cluster, num
        # relatedNumCluster_Sorted = [relatedNumCluster[0] for relatedNumCluster in relatedNumClusters]  
        # # print relatedNumCluster_Sorted
        # if relatedNumCluster_Sorted!=[]:
        #     if len(relatedNumCluster_Sorted[0])!=1:
        #         mutualPath  = RF.TryClusterRoadFinding(GRP,relatedNumCluster_Sorted,currE_Dict_All)
        #         if mutualPath!=None:
        #             print ("final choice mutualPath"),[edge.ID for edge in mutualPath]
               
        #             print (" final choice mutualPath Path Geo: "), 
        #             for pE in mutualPath:
        #                 for pt in pE.GetGeometry():
        #                     print (pt.X),pt.Y,0
        #                 print ("-----") 
                    
                  
            
            
            
        
        #wA = 0.8
        if currDepth <= roadFindingThreshold:
            print ("currDepth:") ,currDepth,("use First")
            #RF.FindRoadForThisDepth(PL,currQ,collection_ParcEdgeGraph[-1],currStreetGraph,currE_Dict,collection_JunctionGraph[-1], True)
            
            #RF.FindRoadForThisDepth_Angle(PL,currQ,collection_ParcEdgeGraph[-1],currStreetGraph,currE_Dict,collection_JunctionGraph[-1], True)
            #RF.FindRoadForThisDepth_Mix(PL,currQ,collection_ParcEdgeGraph[-1],currStreetGraph,currE_Dict,wA,collection_JunctionGraph[-1], True)
            RF.FindRoadForThisDepth_New(GRP,PL,currQ,collection_ParcEdgeGraph[-1],currStreetGraph,currE_Dict,wA,collection_JunctionGraph[-1], True)
        else:
            #RF.FindRoadForThisDepth(PL,currQ,collection_ParcEdgeGraph[-1],currStreetGraph,currE_Dict)
            #RF.FindRoadForThisDepth_Angle(PL,currQ,collection_ParcEdgeGraph[-1],currStreetGraph,currE_Dict)
            #RF.FindRoadForThisDepth_Mix(PL,currQ,collection_ParcEdgeGraph[-1],currStreetGraph,currE_Dict,wA)
            RF.FindRoadForThisDepth_New(GRP,PL,currQ,collection_ParcEdgeGraph[-1],currStreetGraph,currE_Dict,wA)
            print ("currDepth:") ,currDepth, ("use Second")

        # print ("InaccessibleParcels parcelNum"), parcelNum    
     
        
            
        collection_StreetGraph.append(currStreetGraph)
        #collection_ParcelGraph.append(currParcelGraph)
        #collection_JunctionGraph.append(currJunctionGraph) 
        
        ### New Instances for next depth
        currVP_Dict = SPF.GetDeepCopyDict_VP(currVP_Dict)
        currE_Dict_All = SPF.GetDeepCopyDict_E_All(currVP_Dict,currE_Dict_All)
        currE_Dict = SPF.GetDeepCopyDict_E(currE_Dict,currE_Dict_All)
        currQ = SPF.GetDeepCopyParcFace_Q(currQ,currVP_Dict,currE_Dict,currE_Dict_All,redirectMap)  # new Instance
        currQ_Dict =SPF.GetDeepCopyParcFace_Dict(currQ)
        

        #currParcelGraph = currParcelGraph.DeepCopy()
        #currJunctionGraph = currJunctionGraph.DeepCopy()
        currStreetGraph = currStreetGraph.DeepCopy(currVP_Dict,currE_Dict)
        
        
        ### remember update the currNode
        currNode = currQ[0]
        SPF.RedirectNeighbors(currQ,currE_Dict,redirectMap)

        ### Update the depth 
        lastDepth = currDepth
    #endregion 
    
    #region TryStreamline
    ##########################
    #####TryStreamline########
    ##########################
    if finalDesicion == []:     ### accessPt create a streamline
        if currNode.situation==0:
            if currNode.alive == True:
                
                coefficient = [1,1,1,1,1,1,1]
                currentWeight=SPF.GetCurrentWeight(weight,coefficient,currDepth)
                #newTriangleSize = SPF.StoreStreamlines(PC,DM,SLG,EV,currNode,weight,None,idealOrientation,resolution)
                newTriangleSize = SPF.StoreStreamlines_New(PC,DM,SLG,EV,currNode,currE_Dict_All, collection_StreetGraph[-1], sameSideList,weight,None,idealOrientation,resolution,disableRate)
                #print ("length of sortedSL:"),len(currNode.sortedSL)
                
                ### for preview , show the streamline network
                #for sl in currNode.sortedSL:
                    #streamlines.append(sl.GetGeometry())
                
                
                streamline = SPF.TryStreamlineOptions(currNode,minArea,minElongation,minConvexity,minCompactness,areaTol,allowTopNum,thresholdLVarRate)
            
            else:
                if currNode.alive == False:  ### just skip the caculation
                    streamline = None
                    
            if streamline ==None:
                #Fail and pop  
                #currNode.alive = False
                currQ.popleft()
                
                ### Important, Since this node fail to split
                ### In order to move it to root and dont conflict with the exsiting 
                ### Copy a new one
                newCurrNode = currNode.DeepCopy(currVP_Dict,currE_Dict,currE_Dict_All)
                newCurrNode.alive = False    ### to avoid depth+2
                newCurrNode.depth+=1
                #print ("the old working node, "),id(currNode), ("copy to a new node "),id(newCurrNode)
                #print ("!!!!!!!!!!") ,currNode.depth, id(currNode),currNode.alive
                
                ### After Copying a new one, we need to make the new node replace the old one in their neighbors position
                ### Mainly check "neighbors","mutualE_P","mutualP_E"
                for node in currQ:
                    if currNode in node.neighbors:
                        ### update neighbors info
                        node.neighbors.remove(currNode)
                        node.neighbors.append(newCurrNode)
                        
                        ### update neighbors info
                        popParcFace = currNode
                        popEdge = node.mutualP_E[currNode]   ### will still keep it

                        ### Remove
     
                        node.mutualE_P.pop(popEdge)             
                        node.mutualP_E.pop(popParcFace)
                        
                        ### Add it back, update to the new node
                        node.mutualE_P[popEdge] = newCurrNode
                        node.mutualP_E[newCurrNode] = popEdge

                currQ.append(newCurrNode)
                
                ### replace the new parc into currF_Dict
                currQ_Dict[newCurrNode.ID] = newCurrNode
                
                
                #print ("abondoned node address:"), id(currNode)
                #print ("abondoned node's neighbor address:")
                #SPF.PrintCurrNodeNeighbors(currNode)
                #print ("new node address:"), id(newCurrNode)
                #print ("new node's neighbor address:")
                #SPF.PrintCurrNodeNeighbors(newCurrNode)
                       
        elif currNode.situation==1:    
            #streamlines store inside, return the used triangleSize 
           
            newTriangleSize = SPF.StoreStreamlines_New(PC,DM,SLG,EV,currNode,currE_Dict_All,collection_StreetGraph[-1],None,currNode.startPt.geometry,idealOrientation,resolution,disableRate)
            #newTriangleSize = SPF.StoreStreamlines(PC,DM,SLG,EV,currNode,None,currNode.startPt.geometry,idealOrientation,resolution)
            streamline = SPF.TrySpecificStreamline(EV,currNode,minArea,minElongation,minConvexity,minCompactness,0.7)
            print "asd:".asd
            print "SPF.TrySpecificStreamline happened?"
            
            if streamline == None:
                #dont pop here , give another chance
                currNode.situation=0
            
            else:
                pass
            
    elif finalDesicion!= []:
        ### select streamline
        newTriangleSize = resolution
        streamline = SLG.Streamline()
        streamline.CreateStreamlineInstance(finalDesicion[0])
        finalDesicion.pop(0)

        
        
    
    #endregion
    
    #region Split it with streamline
    #####################################
    ##### Split it with streamline ######
    #####################################

    if streamline != None:    
        thisDepthStreamlines.append(streamline.GetGeometry() )
        # for pt in streamline.GetGeometry():
        #     print pt.X,pt.Y,0
        if currNode.situation == 0 :
            
            # store the final chosen streamline into this instance
            currNode.chosenSL = streamline
            
            startEdge,endEdge,startEdgeIndex,endEdgeIndex,startSplitPointPair,endSplitPointPair,flag =SPF.DetectLocation(currNode,streamline)
            
            
            ##### SplitParcFace : Normal Case and Speical Case
            shareResult = SPF.GetNewShare(PL,currNode,streamline,currVP_Dict,currE_Dict,currE_Dict_All,startEdge,endEdge)
            shareEdge = shareResult[0]
            shareEdge_twin = shareResult[1]
            
            ### for Normal case
            if startEdge != endEdge:
                
                ### split the parcFace and return the new split edges
                splitResult = SPF.ConstructNewParcel_Normal(PL,currNode,currQ_Dict,currVP_Dict,currE_Dict,currE_Dict_All,shareEdge,shareEdge_twin,startEdge,endEdge,startEdgeIndex,endEdgeIndex,startSplitPointPair,endSplitPointPair,currStreetGraph)
                splitEdges_Start = splitResult[2]
                splitEdges_End = splitResult[3]
                
                
                
                ### Insert into tree and redirect the parent-children based on redirectMap
                SPF.InsertValue(splitResult,newTriangleSize,currQ,currQ_Dict)
                #SPF.RedirectParentChildren(currQ,redirectMap)

                ### Check affected parcFace, the affected Edge(twin edge) will be split
                #if currNode.neighbors!=[]:
                    #print currNode.neighbors
                    
                    #neighbor  = currNode.neighbors[0]
                    #print "thisNeighbor: " ,neighbor, id(neighbor)
                    #print  "thisNode: ",currNode, id(currNode)
                    #print neighbor.mutualP_E
                    #print currNode.mutualP_E
                
                
                #SPF.PrintAllNodesAddress(p0)
                
                start_PF,end_PF = SPF.GetAffectedParcFace(currNode,startEdge,endEdge,p0,collection_F,currQ,redirectMap) 
                #print ("start_PF,end_PF"),start_PF,end_PF
                if start_PF!= None:
                    start_PF.startPt = shareEdge.startVertex
                    #SPF.StoreAffectedPoint(start_PF,streamline)
                    affectedEdge = startEdge
                    start_PF.UpdateAffectedInfo_Normal(shareEdge,affectedEdge,splitEdges_Start,currE_Dict,"start")
                    
                
                if end_PF!= None:
                    end_PF.startPt = shareEdge.endVertex
                    #SPF.StoreAffectedPoint(end_PF,streamline)
                    affectedEdge = endEdge
                    end_PF.UpdateAffectedInfo_Normal(shareEdge,affectedEdge,splitEdges_End,currE_Dict,"end")
                

                    
                ### Check Neighbors info by mutual edge, this must be conducted after inserting new edges for the affected parcFace

                #if currNode.neighbors!=[]:
                    #print ("currNode,"),(id(currNode)), "'s neighbor is: " ,id(currNode.neighbors[0])
                    
                #if currNode.parent!=None and currNode.parent.neighbors!=[]:
                    #print ("currNode's parent,"),(id(currNode.parent)), "'s neighbor is: " ,id(currNode.parent.neighbors[0]) 
                    
                #print ("!!!!!!!!!!!!!!!!!!!!!!!!!!!!!!!!!!!!!!!!!!!!!!!!!!!!!!!Before")    
                #SPF.TraversePrintNeighbor(p0)
                parentNeighbor = currNode.neighbors
                for pneighbor in parentNeighbor:
                    SPF.CheckNeighbor(splitResult[0],pneighbor)
                    SPF.CheckNeighbor(splitResult[1],pneighbor)

                ### Update current Junction graph
                ##currJunctionGraph.Update(startEdge,splitEdges_Start,endEdge,splitEdges_End,shareEdge)
            
                #print ("!!!!!!!!!!!!!!!!!!!!!!!!!!!!!!!!!!!!!!!!!!!!!!!!!!!!!!!After")    
                #SPF.TraversePrintNeighbor(p0)
                #print ("splitResult[0],"),(id(splitResult[0])), "'s neighbor is: " ,id(splitResult[0].neighbors[0])
                #print ("splitResult[1],"),(id(splitResult[1])), "'s neighbor is: " ,id(splitResult[1].neighbors[0])
                 
            ### for Special case
            if startEdge == endEdge:
                ### split the parcFace and return the new split edges
                splitResult = SPF.ConstructNewParcel_Special(PL,currNode,currQ_Dict,currVP_Dict,currE_Dict,currE_Dict_All,shareEdge,shareEdge_twin,startEdge,endEdge,startEdgeIndex,endEdgeIndex,startSplitPointPair,endSplitPointPair)
                splitEdges_Special= splitResult[2]
                
                ### Insert into tree and redirect the parent-children based on redirectMap
                SPF.InsertValue(splitResult,newTriangleSize,currQ,currQ_Dict)
                
                
                #SPF.RedirectParentChildren(currQ,redirectMap)
                
                
                
                ### Check affected parcFace, the affected Edge(twin edge) will be split
                start_PF,end_PF = SPF.GetAffectedParcFace(currNode,startEdge,endEdge,p0,collection_F,currQ,redirectMap) 
                
                # its same as end PF so we only do it once
                if start_PF!= None:
                    
                    start_PF.situation = 0   ### dont bother , just take it as normal case
                    affectedEdge = startEdge
                    start_PF.UpdateAffectedInfo_Special(shareEdge,affectedEdge,splitEdges_Special,startSplitPointPair,endSplitPointPair,currE_Dict)
                    
                    ### Check Neighbors info by mutual edge, this must be conducted after inserting new edges for the affected parcFace  
                    parentNeighbor = currNode.neighbors
                    for pneighbor in parentNeighbor:
                        SPF.CheckNeighbor(splitResult[0],pneighbor)
                        SPF.CheckNeighbor(splitResult[1],pneighbor)

                ### Update current Junction graph
                ###currJunctionGraph.Update(endEdge,splitEdges_Special,None,None,shareEdge)
            
        
        elif currNode.situation == 1 :

            shareResult = SPF.GetNewShare_Constrained(PL,currNode,streamline,currVP_Dict,currE_Dict,currE_Dict_All)
            shareEdge = shareResult[0]
            shareEdge_twin = shareResult[1]
            endEdge,endEdgeIndex,endSplitPointPair = SPF.DetectLocation_Constrained(currNode,streamline)
            
            startIndexPair = SPF.GetStartPtInfo(currNode)

            if endEdge.naked ==True:
                shareEdge.endVertex.onBoundary = True    ### pending to relocate
                splitResult = endEdge.SplitEdge_Naked_Normal(shareEdge,shareEdge.endVertex,"end",currE_Dict,currE_Dict_All,currVP_Dict)
                subEdge_End_0 = splitResult[0]
                subEdge_End_1 = splitResult[1]
                splitEdges_End = [subEdge_End_0,subEdge_End_1]
                chosenNewEdges = [subEdge_End_0,subEdge_End_1]
            
            elif endEdge.naked == False:
                splitResult = endEdge.SplitEdge_Shared_Normal(shareEdge,shareEdge.endVertex,"end",currE_Dict,currE_Dict_All,currVP_Dict,endSplitPointPair)
                subEdge_End_a = splitResult[0]
                subEdge_End_a_twin = splitResult[1]
                subEdge_End_b = splitResult[2]
                subEdge_End_b_twin = splitResult[3]
                splitEdges_End = [subEdge_End_a,subEdge_End_a_twin,subEdge_End_b, subEdge_End_b_twin]
                chosenNewEdges = [subEdge_End_a,subEdge_End_b]
                
            splitResult = SPF.Construct_Constrained(PL,currNode,currQ_Dict,startIndexPair,endEdgeIndex,shareEdge,shareEdge_twin,chosenNewEdges)
            ### Insert into tree and redirect the parent-children based on redirectMap
            SPF.InsertValue(splitResult,newTriangleSize,currQ,currQ_Dict)
            #SPF.RedirectParentChildren(currQ,redirectMap)
    
            ### Check affected parcFace, the affected Edge(twin edge) will be split, in this case , only endPF
            end_PF = SPF.GetAffectedParcFace_Constrained(currNode,endEdge,p0 ,collection_F,currQ,redirectMap)
            
            if end_PF!= None:
                end_PF.startPt = shareEdge.endVertex
                affectedEdge = endEdge
                #print ("splitEdges_End")
                #for edge in splitEdges_End:
                    #print (edge.isValid)
                end_PF.UpdateAffectedInfo_Normal(shareEdge,affectedEdge,splitEdges_End,currE_Dict,"end")

            ### Check Neighbors info by mutual edge, this must be conducted after inserting new edges for the affected parcFace
            parentNeighbor = currNode.neighbors
            for pneighbor in parentNeighbor:
                SPF.CheckNeighbor(splitResult[0],pneighbor)
                SPF.CheckNeighbor(splitResult[1],pneighbor)

            

            ########################
            ###  for streetGraph_Constraint
            ########################
       
            if endEdge.streetID!=None:
                if endEdge.naked ==True :
                    targetStreet,startNode,endNode,order =  currStreetGraph.CheckInsertLocation(endEdge)
                    # no twin edge,must be true
                    targetStreet.Insert(startNode,endNode,subEdge_End_0,subEdge_End_1,currE_Dict)
                    
                elif endEdge.naked == False :
                    targetStreet,startNode,endNode,order =  currStreetGraph.CheckInsertLocation(endEdge)
                    if order == True:
                        targetStreet.Insert(startNode,endNode,subEdge_End_a,subEdge_End_b,currE_Dict)
                    elif order != True:
                        targetStreet.Insert(startNode,endNode,subEdge_End_b_twin,subEdge_End_a_twin,currE_Dict)

                
                splitResult[0].accessible = True
                splitResult[1].accessible = True
            ### Update current Junction graph
            #currJunctionGraph.Update(endEdge,splitEdges_End,None,None,shareEdge)
            
        #print ("before RemoveInvalidNeighbor" )
        #print (" currQ:"), SPF.PrintCurrQAddress(currQ)
        SPF.RemoveInvalidNeighbor(currNode,currQ)
        
        ### Update current parcel graph
        #currParcelGraph.Update(currNode,[splitResult[0],splitResult[1]])
        
        
        ### Update current parcel graph
        minLength = 3
        newParcels = [splitResult[0],splitResult[1]]
        
        ###SPF.MergeShortEdgeAndUpdateGraph(PL,PP,currVP_Dict,currE_Dict,newParcels,minLength,currParcelGraph,currJunctionGraph)
        #SPF.MergeShortEdge(PL,PP,currVP_Dict,currE_Dict,newParcels,minLength,currStreetGraph)
        
    #endregion
        
       
  
    print ("Now, there are %d nodes in currQ  ") %len(currQ)
    ra.WriteLine("Now, there are %d nodes in currQ " %len(currQ))

    
    print ("********************************************************************************************************************************************")
 
    
    #Collect geometry
    parcels.append(splitResult[0].GetGeometry())  ###just for preview
    parcels.append(splitResult[1].GetGeometry())
    
    issurance+=1    

################################
###### Might be redundant ######
################################

# if currVP_Dict not in collection_VP:
#     collection_VP.append(currVP_Dict)

# if currE_Dict not in collection_E:
#     collection_E.append(currE_Dict)

# ### Do something here for the case that the alogithm doesnt finish the whole depth, so we need to mannually add the node in currQ into Root Tree
# allNodes = SPF.TraverseCollectAllNodes(p0)


# ############### because of the redirect parent ,need to change here, its doesnt work anymore

# for node in currQ:
#     #print ("node: "),id(node), ("node.parent: "),id(node.parent)
#     #print ("In the end , In RedirectParentChildren:" ,id(node))
#     #print ("before, this node's parent is :" ,id(node.parent))
#     #print ("identity: "),node.identity
#     if node.alive == False:
#         if node.identity == "A":
#             node.parent = node.parent.child_A
            
#         if node.identity == "B":
#             node.parent = node.parent.child_B
            
#         if node.identity == "C":
#             node.parent = node.parent.child_C
            
#         #print ("after, this node's parent is :" ,id(node.parent))
#         ### No Matter A or B , just attach to A    
#         node.parent.child_C = node     

#     elif node.alive == True:
#         node.parent  = redirectMap[node.parent]
#         #rediect children
        
#         if node.identity =="A":
#             node.parent.child_A = node
#         elif node.identity =="B":
#             node.parent.child_B = node

# #print ("print node in root")



# bottomElements = SPF.FindTheBottomElements_LevelOrder(p0) 
# bottomAddress = []
# for node in bottomElements:
#     bottomAddress.append(id(node))
    
# #print ("bottom address Aagin: "),bottomAddress

# finalQ = SPF.FindTheBottomElements_LevelOrder_Q(p0)
# if finalQ!=collection_F[-1]:
#     collection_F.append(finalQ)

# print ("last list of collection_F")
# SPF.PrintCurrQAddress(collection_F[-1])
# print ("finalQ")
# SPF.PrintCurrQAddress(finalQ)


# ##### PREVIEW #####
# pts_Curr = SPF.ShowCurrPts(currVP_Dict)[0]
# pts_indices_Curr = SPF.ShowCurrPts(currVP_Dict)[1]
# edges_Curr = SPF.ShowCurrEdge(currE_Dict)[0]
# edges_indices_Curr = SPF.ShowCurrEdge(currE_Dict)[1]
# print (currQ[0]), "its neighbors: ",currQ[0].neighbors
# print (currQ[1]), "its neighbors: ",currQ[1].neighbors
            

                
                
print ("End: Finish iterationTime")
ra.WriteLine("End: Finish iterationTime")
currTime = time.time()
usedTime = currTime - startTime
print ("Time: total used time is ") ,usedTime
# ---------- end python_4 ----------
panel_5 = Panel(python_4.out)

# ----
# Export whole tree data before optimization
# Tree Data
ghpython_script_16 = GhPythonScript(
    WebApp_Func=ghpython_script_12.WebApp_Func,
    SPF=ghpython_script_4.SPF,
    EV=ghpython_script_2.EV,
    p0=python_4.p0,
    targetPoint=python_3.sourceCenter,
    scale=python_3.scale)  # -> out, port, parcels_Mb_All, port_2, IDList, childrenList, simplify(graft(parentList)), simplify(graft(depthList))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; inputs targetPoint: Point3d
# ---------- ghpython_script_16: Python ----------
###########################
####    Import Libs    ####
###########################
import Rhino.Geometry as rg
#import Rhino.RhinoDoc as rd
import Rhino.RhinoMath as rm
import Rhino.RhinoApp as ra
import ghpythonlib.components as ghc
import ghpythonlib.treehelpers as th
import Rhino as rh
from collections import deque 
import Queue
import math

#########################################################
#################  Move and Scale  ######################
#########################################################
allNodes = SPF.TraverseCollectAllNodes(p0)
parcels_Origin = [node.GetGeometry() for node in allNodes]
parcels_Mb_All = WebApp_Func.MoveFromOriginAndScaleAllParcels(parcels_Origin,targetPoint,scale)

#########################################################
#################  Store Dict        ####################
#########################################################
meshDracos_Mb_All  = [WebApp_Func.DracoCompression_MoveZ(polyL) for polyL in parcels_Mb_All]
##### assign a WebTreeID
WebApp_Func.AssignWebTreeID(allNodes)
##### store info in to a dict
treeDict = WebApp_Func.StoreInfoIntoDict(allNodes,meshDracos_Mb_All)
    

####################################################################
#################  Store Info Sperately         ####################
####################################################################

IDList,childrenList,parentList,depthList,dracoList = WebApp_Func.ExportToSperateDict(treeDict)
childrenList = th.list_to_tree(childrenList)

####################################################################
#################         Evaluation            ####################
####################################################################

areaList_All,orientationList_All,elongationList_All,compactnessList_All,convexityList_All = WebApp_Func.GetEvaluationValueList(EV,parcels_Mb_All)
# ---------- end ghpython_script_16 ----------
curve = Curve(simplify(graft(ghpython_script_16.parcels_Mb_All)))
number = Number(simplify(graft(ghpython_script_16.convexityList_All)))
number_2 = Number(simplify(graft(ghpython_script_16.compactnessList_All)))
number_3 = Number(simplify(graft(ghpython_script_16.orientationList_All)))
number_4 = Number(simplify(graft(ghpython_script_16.elongationList_All)))
number_5 = Number(simplify(graft(ghpython_script_16.areaList_All)))
curve_to_polyline = CurveToPolyline(Curve=curve, ToleranceDistance=0, ToleranceAngle=0)  # -> Polyline, Segments
ghpython_script_17 = GhPythonScript(area=number_5, orientation=number_3, elongation=number_4, compactness=number_2, convexity=number)  # -> out, simplify(graft(eva)); inputs area: tree, orientation: tree, elongation: tree, compactness: tree, convexity: tree
# ---------- ghpython_script_17: Python ----------
__author__ = "Anna Yenardi"
__version__ = "2023.02.08"

import rhinoscriptsyntax as rs
import ghpythonlib.treehelpers as th

eva = []
for i in range(area.BranchCount):
    eva.append(str(area.Branch(i)[0])+','+str(orientation.Branch(i)[0])+','+str(elongation.Branch(i)[0])+','+str(compactness.Branch(i)[0])+','+str(convexity.Branch(i)[0]))

eva = th.list_to_tree(eva)
# ---------- end ghpython_script_17 ----------
ghpython_script_18 = GhPythonScript(x=ghpython_script_16.childrenList)  # -> out, a; inputs x: tree of Int32
# ---------- ghpython_script_18: Python ----------
__author__ = "Anna Yenardi"
__version__ = "2023.02.01"

import rhinoscriptsyntax as rs
import ghpythonlib.treehelpers as th
import ghpythonlib.components as gh

arr = th.tree_to_list(x)
resArr = []

for i in range(len(arr)):
    if arr[i] == []:
        resArr.append("empty")
    else:
        newStr = ""
        for k in range(len(arr[i])):
            newStr = newStr + str(arr[i][k]) + ","
        resArr.append(newStr[0:len(newStr) - 1])

a = th.list_to_tree(resArr)
# ---------- end ghpython_script_18 ----------
ghpython_script_19 = GhPythonScript(poly=flatten(curve_to_polyline.Polyline))  # -> out, simplify(res); inputs poly: tree of Polyline
# ---------- ghpython_script_19: Python ----------
__author__ = "Anna Yenardi"
__version__ = "2023.02.06"

import rhinoscriptsyntax as rs
import ghpythonlib.components as gh
import ghpythonlib.treehelpers as th

res =[]
arr = th.tree_to_list(poly)
for i in range(len(arr)):
    verts = gh.Explode(arr[i], True)[1]
    coords = ""
    for j in range(len(verts)):
        curr = (gh.Deconstruct(verts[j]))
        coords = coords + str(curr[0])+","+str(curr[1])+","+str(curr[2])+";"
    coords = coords[0:len(coords)-1]
    res.append(coords)

res = th.list_to_tree(res)
# ---------- end ghpython_script_19 ----------
path_mapper = PathMapper(ghpython_script_18.a, source="{i}", target="{0}")
path_mapper_2 = PathMapper(ghpython_script_16.parentList, source="{i}", target="{0;0}")
path_mapper_3 = PathMapper(ghpython_script_16.depthList, source="{i}", target="{0;0;0}")
path_mapper_4 = PathMapper(ghpython_script_17.eva, source="{i}", target="{0;0;0;0;0;0}")
path_mapper_5 = PathMapper(ghpython_script_19.res, source="{i}", target="{0;0;0;0;0}")
path_mapper_6 = PathMapper(ghpython_script_16.dracoList, source="{i}", target="{0;0;0;0}")
merge_3 = Merge(
    Data1=path_mapper,
    Data2=path_mapper_2,
    Data3=path_mapper_3,
    Data4=path_mapper_6,
    Data5=path_mapper_5,
    Data6=path_mapper_4)

# ----
# Optimization
python_5 = GhPythonScript(
    GRP=ghpython_script_6.GRP,
    SPF=ghpython_script_4.SPF,
    PL=ghpython_script_3.PL,
    PP=ghpython_script_7.PP,
    RD=ghpython_script_8.RD,
    OP=ghpython_script_9.OP,
    collection_F=python_4.collection_F,
    collection_ParcEdgeGraph=python_4.collection_ParcEdgeGraph,
    collection_StreetGraph=python_4.collection_StreetGraph,
    inputPolyline=python_3.inputPolyline_New,
    constraints=merge)  # -> out, port, Intial_Overall_Info, port_2, allV_Geo, allP_Geo, edges, edges_indices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; inputs collection_F: list, collection_ParcEdgeGraph: list, collection_StreetGraph: list, inputPolyline: Polyline, constraints: list
# ---------- python_5: Python ----------
import Rhino.Geometry as rg
#import Rhino.RhinoDoc as rd
import Rhino.RhinoMath as rm
import Rhino.RhinoApp as ra
import ghpythonlib.components as ghc
import math

from System.Collections.Generic import List
import clr

clr.AddReference("KangarooSolver.dll")
import KangarooSolver as ks

import ghpythonlib.treehelpers as th



collection = collection_F[-1].values()
### preview all Parcles
parcels = [parcF.GetGeometry for parcF in collection]

##############################
########## make a partial copy
##############################
selectedParcFace = [parcel for parcel in collection]
copiedParcFace,currVP_Dict,currE_Dict,redirectMap = OP.MakePartialCopy(selectedParcFace)
OP.RedirectNeighbors_Temp(copiedParcFace,selectedParcFace,currE_Dict,redirectMap)
#print ("---make a partial copy---")


allV_Geo,allP_Geo = OP.PreviewAllParcVertexAndParcPoint(copiedParcFace)  ### preview

edges,edges_indices = OP.GetAllEdgeGeoAndIDFromDict(currE_Dict)   ### preview
partParcels_Geo_Before = [parcF.GetGeometry() for parcF in copiedParcFace]  

# currE_Dict = collection_E_All[-1]


# PP.AssignRoadHierarchyAndOffsetDist(roadPercentage,roadWidth,copiedParcFace,currE_Dict,1)
# partParcels_Geo_Offset_Before = [PP.GetOffsetParcel_Simplified(thisNode) for thisNode in copiedParcFace]


##############################
########## make a partial copy
##############################

### turning Point
turningPtCollection = OP.GetTurningPtInfoCollection(copiedParcFace,20)
turningParcPts,turningParcFs = OP.ExtractTurningPtInfo(turningPtCollection)
OP.ModifyAllTurningPointsWithNewType(PL,turningPtCollection,copiedParcFace,currVP_Dict,currE_Dict)
turningPts = [parcPt.geometry for parcPt in turningParcPts]  ### preview


### preview
partParcels_Geo_Simplified = [parcF.GetGeometry_SimplifiedWithTurningPoints() for parcF in copiedParcFace] 


#####################################
################## Resample Points 
#####################################
# ##### Create Resample Point
OP.GetResamplePointsForAllEdges(PL,currVP_Dict,currE_Dict,turningPtCollection,5,2)
edge_Resample_Geo = [edge.GetGeometry_SimplifiedWithResamplePoints() for edge in currE_Dict.values()]
partParcels_Geo_Resample = [parcF.GetGeometry_SimplifiedWithResamplePoints() for parcF in copiedParcFace]

# partParcels_Offset_Simplified = [PP.GetOffsetParcel_SimplifiedWithTurningPoints(thisNode) for thisNode in copiedParcFace]


############################################
######  Network 
############################################
currStreetGraph = collection_StreetGraph[-1]
streets_Geo = [street.GetGeometry() for street in currStreetGraph.graph.keys()]

# edges,edges_indices = PP.GetAllEdgeGeoAndIDFromDict(currE_Dict)   ### preview

edgeConnectionRecord, currStreetE_Dict = RD.CreateConnectionRecord(currStreetGraph,currE_Dict)

edgeCollection_All = RD.GetRoadCollection(edgeConnectionRecord,currStreetE_Dict)

roads = RD.CreateRoadInstances(edgeCollection_All)


# print len(roads)
newRoads = []
for road in roads:
    roadEdgeIDCollection = [pE.ID for pE in road.edgeCollection]
    roadEdgeCollection = [currE_Dict[index] for index in roadEdgeIDCollection]
    newRoads.append(RD.Road(roadEdgeCollection))
      
roads =  newRoads     
# print len(roads)
originalRoads = RD.CreateRoadInstances_Original(currStreetGraph,currE_Dict)


newRoadInstances = newRoads
originalRoadInstances = originalRoads

vs_OnBoundary = []
pts = []
vs = []
for cP in copiedParcFace:
    for v in cP.vertices:
        vs.append(v.geometry)
        if v.onBoundary == True:
            vs_OnBoundary.append(v.geometry)
    
    for e in cP.edges:
        for rPt in e.resamplePoints:
            pts.append(rPt.geometry)

############################################
############################################
#############   Kangaroo   #################
############################################
############################################

#newParcels,oldParcels,newRoads,oldRoads,ptDict_New,ptDict_Old,pFSideDataColletion = OP.OptimizeWithConstraints_Simplified(GRP,copiedParcFace,roads,inputPolyline,currE_Dict,constraints)

#print constraints
newParcels,oldParcels,newRoads,oldRoads,ptDict_New,ptDict_Old = OP.OptimizeWithConstraints_Resample(GRP,copiedParcFace,roads,inputPolyline,currE_Dict,constraints)

#newParcels,oldParcels,newRoads,oldRoads = OP.OptimizeWithConstraints_Simplified(copiedParcFace,roads,inputPolyline)
#newParcels,oldParcels,newRoads,oldRoads = OP.OptimizeWithConstraints_TurningPoints(copiedParcFace,roads,inputPolyline)
# oldRoadsWithoutNaked = [road for road in oldRoads]
# newRoadsWithoutNaked = [road for road in newRoads]


oldRoads.extend(road.GetGeometry_SimplifiedWithResamplePoints() for road in originalRoads)

newRoadsWithoutNaked = [roadGeo for roadGeo in newRoads]

# originalPts_AfterOpt = []

# road.edgeCollection
allNakedRoadGeo = []
for road in originalRoads:
    thisRoadPts = []
    for edge in road.edgeCollection:
        thisRoadPts.append( ptDict_New[edge.startVertex.ID] )
        # for rPt in edge.resamplePoints:
        #     thisRoadPts.append( ptDict_New[rPt.ID] )
        
    thisRoadPts.append( ptDict_New[road.edgeCollection[-1].endVertex.ID] )
    thisRoadGeo = rg.Polyline(thisRoadPts).ToPolylineCurve()
    allNakedRoadGeo.append(thisRoadGeo)
    
originalRoadsGeo = rg.Curve.JoinCurves(allNakedRoadGeo)[0]
#     originalPts_AfterOpt.append (ptDict_New[road.edgeCollection[0].startVertex.ID])

# originalRoadsGeo = rg.Polyline(originalPts_AfterOpt)
newRoads.append(originalRoadsGeo)

ptDict_New = [ptDict_New]
currE_Dict = [currE_Dict]



############################################
#############   Debug   #################
############################################
# pairColllection_Check,jvs = OP.GetStreetAngleConstraintPair(roads)
# pairColllection_Check = th.list_to_tree(pairColllection_Check)
# ---------- end python_5 ----------

# ---- group: RH_OUT:Tree
text = Text(merge_3)

# ----
# Preview for edge index
explode = Explode(Curve=crv, Recursive=True)  # -> Segments, Vertices
midpt = CurveMiddle(Curve=explode.Segments)
points = PointList(Points=midpt, Size=Slider(48, range=0..100))

geometry_2 = Geometry(python_5.oldParcels)

# ----
# Preview access point and first road
cluster = Cluster_3(
    geometry_7=ghpython_script_15.streamlineA,
    validity_A=ghpython_script_15.validity_A,
    geometry_6=ghpython_script_15.streamlineB,
    validity_B=ghpython_script_15.validity_B,
    geometry_3=ghpython_script_15.strightLine,
    validity_Straight=ghpython_script_15.validity_Straight,
    geometry_5=ghpython_script_15.detectRegion,
    geometry_8=ghpython_script_15.bCurveList_Valid,
    geometry_4=ghpython_script_15.bestSl,
    geometry_2=ghpython_script_15.anchors,
    vector=ghpython_script_15.normals,
    geometry=ghpython_script_15.newedges)  # disabled

# ----
# firstWidth
# secondWidth
# (Default)
road_width = Panel("""26
18""")

# ----
# Offset and Format the output
s = GhPythonScript(
    WebApp_Func=ghpython_script_12.WebApp_Func,
    targetPoint=python_3.sourceCenter,
    scale=python_3.scale,
    PL=ghpython_script_3.PL,
    NewOffset=ghpython_script_10.NewOffset,
    newRoads=python_5.newRoads,
    collection_StreetGraph=python_4.collection_StreetGraph,
    copiedParcFace=python_5.copiedParcFace,
    ptDict_New=python_5.ptDict_New,
    roadPercentage=num,
    offsetDists=road_width,
    boundary=python_3.inputPolyline_New)  # -> out, port, resampleParcFaces, resamplePFGeos, resamplePFIndices, port_2, validStreetGeos, allStreetGeos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; inputs targetPoint: Point3d, newRoads: list of Curve, collection_StreetGraph: list, copiedParcFace: list, ptDict_New: list, offsetDists: list, boundary: Curve
# ---------- s: Python ----------
###########################
####    Import Libs    ####
###########################
import Rhino.Geometry as rg
#import Rhino.RhinoDoc as rd
import Rhino.RhinoMath as rm
import ghpythonlib.components as gh
import ghpythonlib.treehelpers as th
import json


offsetDists= [offsetDist/2/scale for offsetDist in offsetDists]


### Reconstruct the parcel with simple data structure
resampleParcFaces,resamplePFGeos,resamplePFIndices = NewOffset.ReconstructSimplifiedParcelAfterOptimization(PL,copiedParcFace,ptDict_New)

vs_OnBoundary = []
pts = []
vs = []
for cP in resampleParcFaces:
    for v in cP.vertices:
        vs.append(v.geometry)
        if v.onBoundary == True:
            vs_OnBoundary.append(v.geometry)
    
    for e in cP.edges:
        for rPt in e.resamplePoints:
            pts.append(rPt.geometry)


### Assign the road cat for surrounding edge to cat 1
NewOffset.AssignNakedEdgesHierarchy(collection_StreetGraph, resampleParcFaces)

### Simply classify the road from newRoads output to proceed
boundary,validStreetGeos,allStreetGeos = NewOffset.PreClassifyRoads(newRoads)

validStreetGeos_Cats = NewOffset.CreateListWithProportions(len(newRoads),roadPercentage)
print "validStreetGeos_Cats",validStreetGeos_Cats



if len(validStreetGeos)!=0:
    
    #### choice the offsetDist here
    # offsetDist = []
    allOffsets,allOffsets_Flatten,allOffsetRegions,offsetRegionUnion = NewOffset.GetThisHierachyOffsetUnionRegion(validStreetGeos,allStreetGeos,boundary,offsetDists,validStreetGeos_Cats)
    pFGeoCollection,pEGeoCollection,pECatCollection = NewOffset.GetOffsetParcelAndEdgeCat(resampleParcFaces,validStreetGeos,allOffsets,allOffsetRegions,validStreetGeos_Cats)

    ### moveBack
    pFGeoCollection_Copy = [pF.Duplicate() for pF in pFGeoCollection]
    pFGeoCollection_Mb = WebApp_Func.MoveFromOriginAndScaleAllParcels(pFGeoCollection_Copy,targetPoint,scale)
    pEGeoCollection_Mb = []
    
    for thisPFECollection in pEGeoCollection:
        thisPFECollection_Mb = []
        for edge in thisPFECollection:
            thisPFECollection_Mb.append(WebApp_Func.RelocateGeoFromOrigin(edge,targetPoint))
        pEGeoCollection_Mb.append(thisPFECollection_Mb)
            
    ### convert to tree
    
    pECatCollection_Explode = []
    for i in range(len(pEGeoCollection_Mb)):
        pEGeoList = pEGeoCollection_Mb[i]
        pECatList = pECatCollection[i]
        
        thisPECat_Explode = []
        for j in range(len(pEGeoList)):
            thisEdgeGeo = pEGeoList[j].TryGetPolyline()[1]
            thisEdgeCat = pECatList[j]
            
            segCount = thisEdgeGeo.SegmentCount 
            for k in range(segCount):
                if thisEdgeCat == None:
                    thisPECat_Explode.append(6)
                else:
                    thisPECat_Explode.append(thisEdgeCat)
        pECatCollection_Explode.append(thisPECat_Explode)
    
    #pFGeoCollection_PL = [pFGeo.TryGetPolyline()[1] for pFGeo in pFGeoCollection]
    


else:
    
    pFGeoCollection_Copy = [pF.GetGeometry_SimplifiedWithResamplePoints().ToPolylineCurve() for pF in resampleParcFaces]
    
    pFGeoCollection_Mb = WebApp_Func.MoveFromOriginAndScaleAllParcels(pFGeoCollection_Copy,targetPoint,scale)
    
    pEGeoCollection_Mb = []
    pECatCollection = []
    for pF in resampleParcFaces:
        thisPFECollection_Mb = []
        thispECatCollection = []
        for edge in pF.edges:
            thisPFECollection_Mb.append(WebApp_Func.RelocateGeoFromOrigin(edge.GetGeometry_SimplifiedWithResamplePoints(),targetPoint))
            thispECatCollection.append(edge.hierarchy)
        pEGeoCollection_Mb.append(thisPFECollection_Mb)
        pECatCollection.append(thispECatCollection)
        
    
    ### convert to tree
    for pF in resampleParcFaces:
        pECatCollection_Explode = []
        for i in range(len(pEGeoCollection_Mb)):
            pEGeoList = pEGeoCollection_Mb[i]
            pECatList = pECatCollection[i]
            
            thisPECat_Explode = []
            for j in range(len(pEGeoList)):
                thisEdgeGeo = pEGeoList[j]
                thisEdgeCat = pECatList[j]
                
                segCount = thisEdgeGeo.SegmentCount 
                for k in range(segCount):
                    if thisEdgeCat == None:
                        thisPECat_Explode.append(6)
                    else:
                        thisPECat_Explode.append(thisEdgeCat)
            pECatCollection_Explode.append(thisPECat_Explode)

ParcelBoundaryPolyline = pFGeoCollection_Mb
ParcelCategories = pECatCollection_Explode
pEGeoCollection = pEGeoCollection
# ---------- end s ----------

# ---- group: preview depth control
parceldepth = Slider(-1, range=-1..20)

# ----
panel_6 = Panel(s.out)

# ---- group: visualization preview for checking each depth before optimization
python_6 = GhPythonScript(
    depth=parceldepth,
    collection_F=python_4.collection_F,
    collection_F_Dict=python_4.collection_F_Dict,
    collection_E=python_4.collection_E,
    collection_VP=python_4.collection_VP,
    collection_ParcelGraph=python_4.collection_ParcelGraph,
    collection_JunctionGraph=python_4.collection_JunctionGraph,
    collection_ParcEdgeGraph=python_4.collection_ParcEdgeGraph,
    collection_StreetGraph=python_4.collection_StreetGraph)  # -> out, port, parcelIDs, parcelGeo, edgeIDs, edgeGeo, vIDs, vGeo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; inputs depth: Int32, collection_F: list, collection_F_Dict: list, collection_E: list, collection_VP: list, collection_ParcelGraph: list, collection_JunctionGraph: list, collection_ParcEdgeGraph: list, collection_StreetGraph: list
# ---------- python_6: Python ----------
__author__ = "asdbe"
__version__ = "2023.04.03"

import rhinoscriptsyntax as rs

### Check if collection and collection Dict are the same
#x = collection_F[-1]
#y = collection_F_Dict[-1]
#print x[0].depth
#print y[x[0].ID].depth
#for pf in x:
#    print id(pf),pf.ID
#print "-----------"
#
#for pf in y.values():
#    print id(pf),pf.ID

######################################
##### Check Parcel from Solution #####
######################################
parcelIDs = [pF.ID for pF in collection_F[depth].values()]
parcelGeo = [pF.GetGeometry() for pF in collection_F[depth].values()]

######################################
#####  Check Edge from Solution  #####
######################################
edgeIDs = [edge.ID for edge in collection_E[depth].values()]
edgeGeo = [edge.GetGeometry() for edge in collection_E[depth].values()]

######################################
####  Check Vertex from Solution  ####
######################################
vIDs = []
vGeo = []
for edge in collection_E[depth].values():
    if edge.startVertex.ID not in vIDs:
        vIDs.append(edge.startVertex.ID)
        vGeo.append(edge.startVertex.geometry)
    if edge.endVertex.ID not in vIDs:
        vIDs.append(edge.endVertex.ID)
        vGeo.append(edge.endVertex.geometry)
            

############################################################################
############################################################################
############################################################################

#currParcelGraph = collection_ParcelGraph[depth]
#currParcelGraph = currParcelGraph.GetIDNumWeightGraph()
#print currParcelGraph.graph
#
#currJunctionGraph = collection_JunctionGraph[depth]
#currJunctionGraph = currJunctionGraph.GetIDNumWeightGraph()
#print currJunctionGraph.graph
#
#currParcEdgeGraph = collection_ParcEdgeGraph[depth]
#currParcEdgeGraph = currParcEdgeGraph.GetIDNumWeightGraph()
#print currParcEdgeGraph.graph

currStreetGraph = collection_StreetGraph[depth]

streetGeo = []

streetDict = currStreetGraph.GetStreetDict()

for sID in streetDict.keys():

    streetGeo.append(streetDict[sID].GetGeometry())

for collection in collection_VP:
    for instance in collection.values():
        print "depth:", instance.depth,"id:",instance.ID
    
    print "----"
# ---------- end python_6 ----------

# ----
textsize = Slider(1, range=0..1000)

# ----
# Edge
geo = Geometry(python_6.edgeGeo)
midpt_2 = CurveMiddle(Curve=geo)
tag = TextTag3D(Location=midpt_2, Text=python_6.edgeIDs, Size=textsize, Justification=5)

# ----
# Vertices
geo_2 = Geometry(python_6.vGeo)
tag_2 = TextTag3D(Location=geo_2, Text=python_6.vIDs, Size=textsize, Justification=5)

# ----
# Parcel
geo_3 = Geometry(python_6.parcelGeo)
area_2 = Area(Geometry=python_6.parcelGeo, UseTasks=True)  # -> Area, Centroid
srf = Surface(python_6.parcelGeo)
tag_3 = TextTag3D(Location=area_2.Centroid, Text=python_6.parcelIDs, Size=textsize, Justification=5)
preview = CustomPreview(Geometry=srf, Material=ColourSwatch(SwatchColor=RGB(122, 122, 122)))
preview_2 = CustomPreview(Geometry=geo_3, Material=ColourSwatch(SwatchColor=RGB(0, 0, 0)))

# ----
# mergeEdges
geo_4 = Geometry(python_4.debugColletion1)
pipe = Pipe(Curve=geo_4, Radius=Slider(1, range=0..10), Caps=0)

# ----
# NakedEdgeIndices
python_7 = GhPythonScript(collection_F=python_4.collection_F)  # -> out, edgeGeo_First, edgeID_First; inputs collection_F: list
# ---------- python_7: Python ----------
import Rhino.Geometry as rg

firstParcel = collection_F[0][0]

edgeGeo_First = []
edgeID_First = []
for edge in firstParcel.edges:
    edgeGeo_First.append(edge.GetGeometry())
    edgeID_First.append(edge.ID)

print firstParcel.sides
# ---------- end python_7 ----------
midpt_3 = CurveMiddle(Curve=python_7.edgeGeo_First)
tag_4 = TextTag3D(Location=midpt_3, Text=python_7.edgeID_First, Size=Slider(49, range=0..100), Justification=7)

ghpython_script_20 = GhPythonScript(newRoads=python_5.newRoads, validStreetGeos_Cats=s.validStreetGeos_Cats)  # -> out, RoadLines, RoadCategories, RoadJSON; inputs newRoads: list, validStreetGeos_Cats: list
# ---------- ghpython_script_20: Python ----------
###########################
####    Import Libs    ####
###########################
import Rhino.Geometry as rg
#import Rhino.RhinoDoc as rd
import Rhino.RhinoMath as rm
import ghpythonlib.components as ghc
import math

import json

print("This script extracts road category from edge category, explode curves, removes duplicate roads.")
print("Cat 3 = Major Arterial, Cat 4 = Minor Arterial")




RoadCategories = []
RoadLines = []

for i in range(len(newRoads)):
    road = newRoads[i]
    if isinstance(road,rg.Polyline)!=True:
        road = newRoads[i].TryGetPolyline()[1]
        
    if i != len(newRoads)-1:
        RoadLines.extend(road.GetSegments())

        for j in range(road.SegmentCount):
            RoadCategories.append(validStreetGeos_Cats[i]+3)
    
    else:
        RoadLines.extend(road.GetSegments())
        RoadCategories.append(1)



RoadJSON = {}
RoadVertices = []
RoadEdgeConnectivity = []

for index in range(len(RoadLines)):
    line = RoadLines[index]
    
    RoadVertices.append(line.From)
    RoadEdgeConnectivity.append([index,index+1])
    
RoadVertices.append(RoadLines[-1].To)

RoadJSON['Vertices'] = [[pt[0],pt[1],pt[2]]for pt in RoadVertices]
RoadJSON['EdgeConnectivity'] = RoadEdgeConnectivity
RoadJSON['EdgeCategory'] = RoadCategories
RoadJSON = json.dumps(RoadJSON)
# ---------- end ghpython_script_20 ----------
dash_pattern = DashPattern(Curve=ghpython_script_20.RoadLines, Pattern=7)  # -> Dashes, Gaps
curve_middle = CurveMiddle(Curve=ghpython_script_20.RoadLines)
size = Slider(3, range=0..10)
# vAnchorStrength
# vOnCrvStrength
# pAnchorStrength
# roadSmoothStrength
# roadJunctionAngleStrength
# parcelSideSmoothStrength
# parcelSideAngleStrength
# parcelSideLengthStrength
# parcelSideSimLengthStrength
# parcelAdjacencyStrength
panel_7 = Panel(ghpython_script_20.out)
colour_swatch = ColourSwatch(SwatchColor=RGB(33, 184, 128))
text_tag_3d = TextTag3D(Location=curve_middle, Text=ghpython_script_20.RoadCategories, Size=size, Colour=colour_swatch, Justification=5)
custom_preview = CustomPreview(Geometry=dash_pattern.Dashes, Material=colour_swatch)

# ---- group: preview sorted road
cluster_2 = Cluster(geometry=python_5.oldRoads)

# ---- group: 0: before opt / 1: after opt
before_after = Slider(1, range=0..1)

# ---- group: parcel
filter = StreamFilter(Gate=before_after, Stream0=python_5.oldParcels, Stream1=python_5.newParcels)
preview_3 = CustomPreview(Geometry=filter, Material=ColourSwatch(SwatchColor=RGB(0, 0, 0)))

# ---- group: road
filter_2 = StreamFilter(Gate=before_after, Stream0=python_5.oldRoads, Stream1=python_5.newRoads)
previewlw = CustomPreviewLineweights(Geometry=filter_2, Shader=ColourSwatch(SwatchColor=RGB(0, 0, 0)), Thickness=Slider(5, range=0..10), Absolute=False)

# ---- group: RH_OUT:RoadGenerationJSON
text_2 = Text(ghpython_script_20.RoadJSON)

# ----
# Export the last depth data after optimization
# Final Offset Data
ghpython_script_21 = GhPythonScript(
    WebApp_Func=ghpython_script_12.WebApp_Func,
    SPF=ghpython_script_4.SPF,
    EV=ghpython_script_2.EV,
    parcels_Offset=s.ParcelBoundaryPolyline)  # -> out, parcels_Offset, simplify(graft(meshDraco_Offset)), areaList, orientationList, elongationList, compactnessList, convexityList; inputs parcels_Offset: list
# ---------- ghpython_script_21: Python ----------
###########################
####    Import Libs    ####
###########################
import Rhino.Geometry as rg
#import Rhino.RhinoDoc as rd
import Rhino.RhinoMath as rm
import Rhino.RhinoApp as ra
import ghpythonlib.components as ghc
import ghpythonlib.treehelpers as th
import Rhino as rh
from collections import deque 
import Queue
import math


meshDraco_Offset = [WebApp_Func.DracoCompression_MoveZ(polyL.TryGetPolyline()[1]) for polyL in parcels_Offset]
areaList,orientationList,elongationList,compactnessList,convexityList = WebApp_Func.GetEvaluationValueList(EV,parcels_Offset)
# ---------- end ghpython_script_21 ----------
number_6 = Number(simplify(graft(ghpython_script_21.convexityList)))
number_7 = Number(simplify(graft(ghpython_script_21.compactnessList)))
number_8 = Number(simplify(graft(ghpython_script_21.orientationList)))
number_9 = Number(simplify(graft(ghpython_script_21.elongationList)))
number_10 = Number(simplify(graft(ghpython_script_21.areaList)))
ghpython_script_22 = GhPythonScript(poly=flatten(ghpython_script_21.parcels_Offset))  # -> out, simplify(res); inputs poly: tree of Polyline; same code as ghpython_script_19
ghpython_script_23 = GhPythonScript(area=number_10, orientation=number_8, elongation=number_9, compactness=number_7, convexity=number_6)  # -> out, simplify(graft(eva)); inputs area: tree, orientation: tree, elongation: tree, compactness: tree, convexity: tree; same code as ghpython_script_17
panel_8 = Panel(ghpython_script_23.eva)
path_mapper_7 = PathMapper(ghpython_script_21.meshDraco_Offset, source="{i}", target="{0;0;0;0}")
path_mapper_8 = PathMapper(ghpython_script_23.eva, source="{i}", target="{0;0;0;0;0;0}")
path_mapper_9 = PathMapper(ghpython_script_22.res, source="{i}", target="{0;0;0;0;0}")
path_mapper_10 = PathMapper(ghpython_script_16.dracoList, source="{i}", target="{0;0;0;0;0;0;0}")

# ----
# average
average = Average(Input=ghpython_script_21.areaList)
average_2 = Average(Input=ghpython_script_21.orientationList)
average_3 = Average(Input=ghpython_script_21.elongationList)
average_4 = Average(Input=ghpython_script_21.convexityList)
average_5 = Average(Input=ghpython_script_21.compactnessList)

ghpython_script_24 = GhPythonScript(x=average, y=average_2, z=average_3, u=average_5, v=average_4)  # -> out, simplify(graft(a))
# ---------- ghpython_script_24: Python ----------
__author__ = "Anna Yenardi"
__version__ = "2023.02.16"

import rhinoscriptsyntax as rs
import ghpythonlib.treehelpers as th

arr = [x,y,z,u,v]
a = th.list_to_tree(arr)
# ---------- end ghpython_script_24 ----------
path_mapper_11 = PathMapper(ghpython_script_24.a, source="{i}", target="{0;0;0;0;0;0;0;0}")
merge_4 = Merge(Data1=path_mapper_7, Data2=path_mapper_9, Data3=path_mapper_8, Data4=path_mapper_10, Data5=path_mapper_11)

ghpython_script_25 = GhPythonScript(
    ParcelBoundaryPolyline=s.ParcelBoundaryPolyline,
    ParcelCategories=s.ParcelCategories,
    dracomeshes=flatten(ghpython_script_21.meshDraco_Offset),
    area=ghpython_script_21.areaList,
    orientation=ghpython_script_21.orientationList,
    elongation=ghpython_script_21.elongationList,
    compactness=ghpython_script_21.compactnessList,
    convexity=ghpython_script_21.convexityList)  # -> out, graft(ParcelBoundaryPolyline), ParcelCategories, ParcelJSON; inputs ParcelBoundaryPolyline: list, ParcelCategories: list, dracomeshes: list, area: list, orientation: list, elongation: list, compactness: list, convexity: list
# ---------- ghpython_script_25: Python ----------
__author__ = "jingz"
__version__ = "2023.03.24"

import rhinoscriptsyntax as rs
import ghpythonlib.components as gh
import ghpythonlib.treehelpers as th
import json

print("This script extracts parcel polylines and assign road category from edge category.")
print("Cat 3 = Major Arterial, Cat 4 = Minor Arterial, Cat 6 = Adjacent to Parcel")


ParcelJSON = {}


for i,(polyline, categories) in enumerate(zip(ParcelBoundaryPolyline,ParcelCategories)):
    parcelKey = str(i)
    
    ParcelJSON[parcelKey] = {}
    ParcelJSON[parcelKey]["EdgeCategory"] = categories
    ParcelJSON[parcelKey]["ParcelCoordinates"] = [[pt[0],pt[1],pt[2]] for pt in gh.ControlPoints(polyline)[0]]
    ParcelJSON[parcelKey]["Draco"] = dracomeshes[i]
    ParcelJSON[parcelKey]["Area"] = area[i]
    ParcelJSON[parcelKey]["Scores"] = [orientation[i], elongation[i], compactness[i], convexity[i]]

ParcelBoundaryPolyline = th.list_to_tree(ParcelBoundaryPolyline)
ParcelCategories = th.list_to_tree(ParcelCategories)
ParcelJSON = json.dumps(ParcelJSON)
# ---------- end ghpython_script_25 ----------
panel_9 = Panel(ghpython_script_25.out)
explode_2 = Explode(Curve=ghpython_script_25.ParcelBoundaryPolyline, Recursive=True)  # -> Segments, Vertices
geometry_3 = Geometry(ghpython_script_25.ParcelBoundaryPolyline)
trim_tree = TrimTree(Tree=explode_2.Segments, Depth=1)
curve_middle_2 = CurveMiddle(Curve=trim_tree)
size_2 = Slider(10, range=0..10)
colour_swatch_2 = ColourSwatch(SwatchColor=RGB(184, 33, 153))
custom_preview_2 = CustomPreview(Geometry=trim_tree, Material=colour_swatch_2)
text_tag_3d_2 = TextTag3D(Location=curve_middle_2, Text=ghpython_script_25.ParcelCategories, Size=size_2, Colour=colour_swatch_2, Justification=5)
path_mapper_12 = PathMapper(ghpython_script_25.ParcelJSON, source="{0;0;0;0;0;0;0}", target="{0}")
path_mapper_13 = PathMapper(ghpython_script_24.a, source="{i}", target="{2}")
path_mapper_14 = PathMapper(ghpython_script_16.dracoList, source="{i}", target="{1}")
merge_5 = Merge(Data1=path_mapper_12, Data2=path_mapper_14, Data3=path_mapper_13)

# ---- group: RH_OUT:Offset
text_3 = Text(merge_4)

# ---- group: RH_OUT:ParcelGenerationJSON
text_4 = Text(merge_5)

# ==== cluster Cluster
geometry = ClusterInput()

# ----
# sort road
geometry_2 = Geometry(geometry)
length = Length(Curve=geometry_2)
list_length = ListLength(List=length)
random = Random(Range=Domain(0, 1), Number=list_length, Seed=2)
bounds = Bounds(Numbers=random)
remap_numbers = RemapNumbers(Value=random, Source=bounds, Target=Domain(0, 1))  # -> Mapped, Clipped
bounds_2 = Bounds(Numbers=remap_numbers.Mapped)
deconstruct_domain = DeconstructDomain(Domain=bounds_2)  # -> Start, End
gradient = Gradient(
    LowerLimit=deconstruct_domain.Start,
    UpperLimit=deconstruct_domain.End,
    Parameter=random,
    stops=[0: RGB(243, 57, 0), 0.1: RGB(236, 27, 60), 0.2: RGB(210, 0, 118), 0.3: RGB(103, 0, 120), 0.4: RGB(39, 72, 161), 0.5: RGB(1, 192, 229), 0.6: RGB(18, 178, 90), 0.7: RGB(79, 186, 8), 0.8: RGB(220, 237, 32), 0.9: RGB(247, 159, 20), 1: RGB(243, 57, 0)])
custom_preview_lineweights = CustomPreviewLineweights(Geometry=geometry_2, Shader=gradient, Thickness=Slider(6, range=0..10), Absolute=False)

# ==== cluster Cluster_3
geometry = ClusterInput()
geometry_2 = ClusterInput()
geometry_3 = ClusterInput()
geometry_4 = ClusterInput()
vector = ClusterInput()
geometry_5 = ClusterInput()
geometry_6 = ClusterInput()
geometry_7 = ClusterInput()
geometry_8 = ClusterInput()

# ----
# node indices
geometry_9 = Geometry(geometry_2)
point_list = PointList(Points=geometry_9, Size=Slider(2, range=0..10))

# ----
# edge classification preview
cluster = Cluster_2(geometry=geometry)

# ----
# streamline
panel = Panel(ClusterInput())
panel_2 = Panel(ClusterInput())
geometry_10 = Geometry(geometry_6)
geometry_11 = Geometry(geometry_7)

# ----
# StraightLine
panel_3 = Panel(ClusterInput())
geometry_12 = Geometry(geometry_3)

# ----
# Best Crv
geometry_13 = Geometry(geometry_4)

# ----
# DetectRegion
geometry_14 = Geometry(geometry_5)

# ----
# node normals
vector_display_ex = VectorDisplayEx(Point=geometry_2, Vector=vector, Colour=RGB(0, 0, 0), Width=2)

# ----
# Crv Options
geometry_15 = Geometry(geometry_8)

# ==== cluster Cluster_2
geometry = ClusterInput()
geometry_2 = Geometry(geometry)
colour_swatch = ColourSwatch(SwatchColor=RGB(255, 255, 255))
list_length = ListLength(List=geometry_2)
curve_middle = CurveMiddle(Curve=geometry_2)
range = Range(Domain=list_length, Steps=expr("x-1", list_length))
point_list = PointList(Points=curve_middle, Size=Slider(3, range=0..10))
gradient = Gradient(
    LowerLimit=0,
    UpperLimit=list_length,
    Parameter=range,
    stops=[0: RGB(0, 128, 0), 0.5: RGB(255, 255, 0), 1: RGB(255, 0, 0)])
custom_preview_lineweights = CustomPreviewLineweights(Geometry=geometry_2, Shader=gradient, Thickness=Slider(3, range=0..10), Absolute=False)
